# Dynamo graph AdvanceSteel.ConnectionAutomation.Nodes.Connection.RevitHandle.dyn (Dynamo 3.5.2.8914)

selectStructureData = SelectStructureData()  # 1 picked in the model
fromStructure = AdvanceSteel.ConnectionAutomation.Nodes.ConnectionNode.FromStructure(objects=selectStructureData)
existingConnections = AdvanceSteel.ConnectionAutomation.Nodes.ConnectionNode.ExistingConnections(node=fromStructure)
revitHandle = AdvanceSteel.ConnectionAutomation.Nodes.Connection.RevitHandle(connection=existingConnections)
connectionType = AdvanceSteel.ConnectionAutomation.Nodes.Connection.ConnectionType(connection=existingConnections)
connectionName = AdvanceSteel.ConnectionAutomation.Nodes.ConnectionType.ConnectionName(connectionType=connectionType)
