# Dynamo graph AdvanceSteel.ConnectionAutomation.Nodes.ConnectionNode.RemoveDuplicates.dyn (Dynamo 3.4.1.7055)

selectStructureData = SelectStructureData()  # 3 picked in the model
fromStructure = AdvanceSteel.ConnectionAutomation.Nodes.ConnectionNode.FromStructure(objects=selectStructureData)
removeDuplicates = AdvanceSteel.ConnectionAutomation.Nodes.ConnectionNode.RemoveDuplicates(nodes=fromStructure)
