# Dynamo graph AdvanceSteel.ConnectionAutomation.Nodes.ConnectionNode.SubNodesOfSize.dyn (Dynamo 3.5.2.8914)

selectStructureData = SelectStructureData()  # 7 picked in the model
fromStructure = AdvanceSteel.ConnectionAutomation.Nodes.ConnectionNode.FromStructure(objects=selectStructureData)
number_slider = DoubleSlider(3, range=1..10 step 1)
subNodesOfSize = AdvanceSteel.ConnectionAutomation.Nodes.ConnectionNode.SubNodesOfSize(node=fromStructure, noOfZones=number_slider)
