# Dynamo graph AdvanceSteel.ConnectionAutomation.Nodes.ConnectionNode.Zones.dyn (Dynamo 3.5.2.8914)

selectStructureData = SelectStructureData()  # 1 picked in the model
fromStructure = AdvanceSteel.ConnectionAutomation.Nodes.ConnectionNode.FromStructure(objects=selectStructureData)
zones = AdvanceSteel.ConnectionAutomation.Nodes.ConnectionNode.Zones(connectionNode=fromStructure)
