# Dynamo graph AdvanceSteel.ConnectionAutomation.Nodes.ConnectionType.ByNameAndType.dyn (Dynamo 3.5.2.8914)

string = StringInput("Base Plate")
file_path = Filename("..\..\Downloads\AISC 10.2WB_Adv_Stl_Projects\ACO_Supermarket building_2022_AISC.0001_SADE.rvt")
byNameAndType = AdvanceSteel.ConnectionAutomation.Nodes.ConnectionType.ByNameAndType(connectionName=string, typeName=string, filePath=file_path)
connectionName = AdvanceSteel.ConnectionAutomation.Nodes.ConnectionType.ConnectionName(connectionType=byNameAndType)
