# Dynamo graph AdvanceSteel.ConnectionAutomation.Nodes.ConnectionType.LoadFromFile.dyn (Dynamo 3.5.2.8914)

file_path = Filename("..\..\Downloads\AISC 10.2WB_Adv_Stl_Projects\AISC 10.2WB.rvt")
string = StringInput("Clip angle")
loadFromFile = AdvanceSteel.ConnectionAutomation.Nodes.ConnectionType.LoadFromFile(filePath=file_path, connectionName=string, typeName=string)
connectionName = AdvanceSteel.ConnectionAutomation.Nodes.ConnectionType.ConnectionName(connectionType=loadFromFile)
