# Dynamo graph AdvanceSteel.ConnectionAutomation.Nodes.ConnectionType.SourceFile.dyn (Dynamo 3.5.2.8914)

selectStructureData = SelectStructureData()  # 1 picked in the model
fromStructure = AdvanceSteel.ConnectionAutomation.Nodes.ConnectionNode.FromStructure(objects=selectStructureData)
existingConnections = AdvanceSteel.ConnectionAutomation.Nodes.ConnectionNode.ExistingConnections(node=fromStructure)
connectionType = AdvanceSteel.ConnectionAutomation.Nodes.Connection.ConnectionType(connection=existingConnections)
sourceFile = AdvanceSteel.ConnectionAutomation.Nodes.ConnectionType.SourceFile(connectionType=connectionType)
