# Dynamo graph AdvanceSteel.ConnectionAutomation.Nodes.Filter.ByAnalysisResults.dyn (Dynamo 3.5.2.8914)

selectStructureData = SelectStructureData()  # 4 picked in the model
sectionShape = AdvanceSteel.ConnectionAutomation.Nodes.StructureData.SectionShape(structureData=selectStructureData)
fromStructure = AdvanceSteel.ConnectionAutomation.Nodes.ConnectionNode.FromStructure(objects=selectStructureData)
number = DoubleInput(0)
resultTypes = ResultTypes("Fz")
analysisResults = AnalysisResults("Model1|Analysis results|DL1")
integer_slider = IntegerSlider(-10, range=-10..10 step 1)
integer_slider_2 = IntegerSlider(10, range=-10..10 step 1)
byAnalysisResults = AdvanceSteel.ConnectionAutomation.Nodes.Filter.ByAnalysisResults(node=fromStructure, index=number, resultType=resultTypes, analysisResult=analysisResults, rangeStart=integer_slider, rangeEnd=integer_slider_2)
