# Dynamo graph AdvanceSteel.ConnectionAutomation.Nodes.Filter.ByAngleBetweenAxes.dyn (Dynamo 3.4.1.7055)

selectStructureData = SelectStructureData()  # 2 picked in the model
number_slider = DoubleSlider(0, range=0..1 step 1)
getItemAtIndex = List.GetItemAtIndex(list=selectStructureData, index=number_slider)
sectionShape = AdvanceSteel.ConnectionAutomation.Nodes.StructureData.SectionShape(structureData=getItemAtIndex)
number_slider_2 = DoubleSlider(1, range=0..2 step 1)
getItemAtIndex_2 = List.GetItemAtIndex(list=selectStructureData, index=number_slider_2)
sectionShape_2 = AdvanceSteel.ConnectionAutomation.Nodes.StructureData.SectionShape(structureData=getItemAtIndex_2)
sectionShape_3 = AdvanceSteel.ConnectionAutomation.Nodes.StructureData.SectionShape(structureData=selectStructureData)
fromStructure = AdvanceSteel.ConnectionAutomation.Nodes.ConnectionNode.FromStructure(objects=selectStructureData)
string = StringInput("x")
number = DoubleInput(0)
number_2 = DoubleInput(60)
byAngleBetweenAxes = AdvanceSteel.ConnectionAutomation.Nodes.Filter.ByAngleBetweenAxes(node=fromStructure, indexFirst=number_slider@L2, indexSecond=number_slider_2@@L2, axisFirst=string, axisSecond=string, rangeStart=number, rangeEnd=number_2)
removeDuplicates = AdvanceSteel.ConnectionAutomation.Nodes.ConnectionNode.RemoveDuplicates(nodes=byAngleBetweenAxes.accepted)
zones = AdvanceSteel.ConnectionAutomation.Nodes.ConnectionNode.Zones(connectionNode=removeDuplicates)
parent = AdvanceSteel.ConnectionAutomation.Nodes.Zone.Parent(zone=zones)
sectionType = AdvanceSteel.ConnectionAutomation.Nodes.StructureData.SectionType(structureData=parent)
