# Dynamo graph AdvanceSteel.ConnectionAutomation.Nodes.Filter.BySectionProfile.dyn (Dynamo 3.4.1.7055)

selectStructureData = SelectStructureData()  # 5 picked in the model
fromStructure = AdvanceSteel.ConnectionAutomation.Nodes.ConnectionNode.FromStructure(objects=selectStructureData)
number = DoubleInput(0)
number_slider = DoubleSlider(0, range=0..10 step 0.1)
getItemAtIndex = List.GetItemAtIndex(list=selectStructureData, index=number_slider)
sectionProfile = AdvanceSteel.ConnectionAutomation.Nodes.StructureData.SectionProfile(structureData=getItemAtIndex)
bySectionProfile = AdvanceSteel.ConnectionAutomation.Nodes.Filter.BySectionProfile(node=fromStructure, index=number, profileToFind=sectionProfile)
removeDuplicates = AdvanceSteel.ConnectionAutomation.Nodes.ConnectionNode.RemoveDuplicates(nodes=bySectionProfile.accepted)
zones = AdvanceSteel.ConnectionAutomation.Nodes.ConnectionNode.Zones(connectionNode=removeDuplicates)
parent = AdvanceSteel.ConnectionAutomation.Nodes.Zone.Parent(zone=zones)
sectionProfile_2 = AdvanceSteel.ConnectionAutomation.Nodes.StructureData.SectionProfile(structureData=parent)
