# Dynamo graph AdvanceSteel.ConnectionAutomation.Nodes.Filter.BySectionShape.dyn (Dynamo 3.4.1.7055)

selectStructureData = SelectStructureData()  # 4 picked in the model
sectionShape = AdvanceSteel.ConnectionAutomation.Nodes.StructureData.SectionShape(structureData=selectStructureData)
fromStructure = AdvanceSteel.ConnectionAutomation.Nodes.ConnectionNode.FromStructure(objects=selectStructureData)
number = DoubleInput(0)
number_slider = DoubleSlider(3, range=0..4 step 1)
getItemAtIndex = List.GetItemAtIndex(list=selectStructureData, index=number_slider)
sectionShape_2 = AdvanceSteel.ConnectionAutomation.Nodes.StructureData.SectionShape(structureData=getItemAtIndex)
bySectionShape = AdvanceSteel.ConnectionAutomation.Nodes.Filter.BySectionShape(node=fromStructure, index=number, shapeToFind=sectionShape_2)
removeDuplicates = AdvanceSteel.ConnectionAutomation.Nodes.ConnectionNode.RemoveDuplicates(nodes=bySectionShape.accepted)
zones = AdvanceSteel.ConnectionAutomation.Nodes.ConnectionNode.Zones(connectionNode=removeDuplicates)
parent = AdvanceSteel.ConnectionAutomation.Nodes.Zone.Parent(zone=zones)
sectionType = AdvanceSteel.ConnectionAutomation.Nodes.StructureData.SectionType(structureData=parent)
