# Dynamo graph AdvanceSteel.ConnectionAutomation.Nodes.Filter.BySectionType.dyn (Dynamo 3.4.1.7055)

selectStructureData = SelectStructureData()  # 7 picked in the model
sectionType = AdvanceSteel.ConnectionAutomation.Nodes.StructureData.SectionType(structureData=selectStructureData)
fromStructure = AdvanceSteel.ConnectionAutomation.Nodes.ConnectionNode.FromStructure(objects=selectStructureData)
number = DoubleInput(0)
number_slider = DoubleSlider(0, range=0..10 step 0.1)
getItemAtIndex = List.GetItemAtIndex(list=selectStructureData, index=number_slider)
sectionType_2 = AdvanceSteel.ConnectionAutomation.Nodes.StructureData.SectionType(structureData=getItemAtIndex)
bySectionType = AdvanceSteel.ConnectionAutomation.Nodes.Filter.BySectionType(node=fromStructure, index=number, nameToFind=sectionType_2)
removeDuplicates = AdvanceSteel.ConnectionAutomation.Nodes.ConnectionNode.RemoveDuplicates(nodes=bySectionType.accepted)
zones = AdvanceSteel.ConnectionAutomation.Nodes.ConnectionNode.Zones(connectionNode=removeDuplicates)
parent = AdvanceSteel.ConnectionAutomation.Nodes.Zone.Parent(zone=zones)
sectionType_3 = AdvanceSteel.ConnectionAutomation.Nodes.StructureData.SectionType(structureData=parent)
