# Dynamo graph AdvanceSteel.ConnectionAutomation.Nodes.Filter.BySlopeAngle.dyn (Dynamo 3.4.1.7055)

selectStructureData = SelectStructureData()  # 2 picked in the model
fromStructure = AdvanceSteel.ConnectionAutomation.Nodes.ConnectionNode.FromStructure(objects=selectStructureData)
number = DoubleInput(30)
number_2 = DoubleInput(60)
bySlopeAngle = AdvanceSteel.ConnectionAutomation.Nodes.Filter.BySlopeAngle(node=fromStructure, rangeStart=number, rangeEnd=number_2)
removeDuplicates = AdvanceSteel.ConnectionAutomation.Nodes.ConnectionNode.RemoveDuplicates(nodes=bySlopeAngle.accepted)
zones = AdvanceSteel.ConnectionAutomation.Nodes.ConnectionNode.Zones(connectionNode=removeDuplicates)
parent = AdvanceSteel.ConnectionAutomation.Nodes.Zone.Parent(zone=zones)
sectionType = AdvanceSteel.ConnectionAutomation.Nodes.StructureData.SectionType(structureData=parent)
sectionShape = AdvanceSteel.ConnectionAutomation.Nodes.StructureData.SectionShape(structureData=selectStructureData)
