# Dynamo graph AdvanceSteel.ConnectionAutomation.Nodes.Filter.ByVerticalPosition.dyn (Dynamo 3.5.2.8914)

selectStructureData = SelectStructureData()  # 13 picked in the model
sectionShape = AdvanceSteel.ConnectionAutomation.Nodes.StructureData.SectionShape(structureData=selectStructureData)
fromStructure = AdvanceSteel.ConnectionAutomation.Nodes.ConnectionNode.FromStructure(objects=selectStructureData)
custom_selection = CustomSelection("top", items={top: "Top", bottom: "Bottom"}, IsVisibleDropDownTextBlock=true)
byVerticalPosition = AdvanceSteel.ConnectionAutomation.Nodes.Filter.ByVerticalPosition(node=fromStructure, position=custom_selection)
