# Dynamo graph AdvanceSteel.ConnectionAutomation.Nodes.Filter.ByZoneType.dyn (Dynamo 3.5.2.8914)

selectStructureData = SelectStructureData()  # 13 picked in the model
sectionShape = AdvanceSteel.ConnectionAutomation.Nodes.StructureData.SectionShape(structureData=selectStructureData)
fromStructure = AdvanceSteel.ConnectionAutomation.Nodes.ConnectionNode.FromStructure(objects=selectStructureData)
zones = AdvanceSteel.ConnectionAutomation.Nodes.ConnectionNode.Zones(connectionNode=fromStructure)
zoneType = AdvanceSteel.ConnectionAutomation.Nodes.Zone.ZoneType(zone=zones)
custom_selection = CustomSelection("End", items={End: "End", Body: "Body"}, IsVisibleDropDownTextBlock=true)
byZoneType = AdvanceSteel.ConnectionAutomation.Nodes.Filter.ByZoneType(node=fromStructure, zoneType=custom_selection)
removeDuplicates = AdvanceSteel.ConnectionAutomation.Nodes.ConnectionNode.RemoveDuplicates(nodes=byZoneType.accepted)
zones_2 = AdvanceSteel.ConnectionAutomation.Nodes.ConnectionNode.Zones(connectionNode=removeDuplicates)
zoneType_2 = AdvanceSteel.ConnectionAutomation.Nodes.Zone.ZoneType(zone=zones_2)
