# Dynamo graph AdvanceSteel.ConnectionAutomation.Nodes.Filter.IsItAWebFlangeSection.dyn (Dynamo 3.4.1.7055)

selectStructureData = SelectStructureData()  # 2 picked in the model
sectionShape = AdvanceSteel.ConnectionAutomation.Nodes.StructureData.SectionShape(structureData=selectStructureData)
fromStructure = AdvanceSteel.ConnectionAutomation.Nodes.ConnectionNode.FromStructure(objects=selectStructureData)
isItAWebFlangeSection = AdvanceSteel.ConnectionAutomation.Nodes.Filter.IsItAWebFlangeSection(node=fromStructure)
removeDuplicates = AdvanceSteel.ConnectionAutomation.Nodes.ConnectionNode.RemoveDuplicates(nodes=isItAWebFlangeSection.accepted)
zones = AdvanceSteel.ConnectionAutomation.Nodes.ConnectionNode.Zones(connectionNode=removeDuplicates)
parent = AdvanceSteel.ConnectionAutomation.Nodes.Zone.Parent(zone=zones)
sectionType = AdvanceSteel.ConnectionAutomation.Nodes.StructureData.SectionType(structureData=parent)
