# Dynamo graph AdvanceSteel.ConnectionAutomation.Nodes.Zone.GetAnalysisResults.dyn (Dynamo 3.5.2.8914)

selectStructureData = SelectStructureData()  # 1 picked in the model
fromStructure = AdvanceSteel.ConnectionAutomation.Nodes.ConnectionNode.FromStructure(objects=selectStructureData)
zones = AdvanceSteel.ConnectionAutomation.Nodes.ConnectionNode.Zones(connectionNode=fromStructure)
resultTypes = ResultTypes("Fz")
analysisResults = AnalysisResults("Model1|Analysis results|DL1")
getAnalysisResults = AdvanceSteel.ConnectionAutomation.Nodes.Zone.GetAnalysisResults(zone=zones, resultType=resultTypes, analysisResult=analysisResults)
