# Dynamo graph AdvanceSteel.ConnectionAutomation.Nodes.Zone.Parent.dyn (Dynamo 3.4.1.7055)

selectStructureData = SelectStructureData()  # 12 picked in the model
fromStructure = AdvanceSteel.ConnectionAutomation.Nodes.ConnectionNode.FromStructure(objects=selectStructureData)
zones = AdvanceSteel.ConnectionAutomation.Nodes.ConnectionNode.Zones(connectionNode=fromStructure)
parent = AdvanceSteel.ConnectionAutomation.Nodes.Zone.Parent(zone=zones)
sectionType = AdvanceSteel.ConnectionAutomation.Nodes.StructureData.SectionType(structureData=parent)
getCoordinateSystem = AdvanceSteel.ConnectionAutomation.Nodes.StructureData.GetCoordinateSystem(structureData=parent)
zoneType = AdvanceSteel.ConnectionAutomation.Nodes.Zone.ZoneType(zone=zones)
