# Dynamo graph AdvanceSteel.ConnectionAutomation.Nodes.Zone.ZoneType.dyn (Dynamo 3.4.1.7055)

selectStructureData = SelectStructureData()  # 12 picked in the model
fromStructure = AdvanceSteel.ConnectionAutomation.Nodes.ConnectionNode.FromStructure(objects=selectStructureData)
zones = AdvanceSteel.ConnectionAutomation.Nodes.ConnectionNode.Zones(connectionNode=fromStructure)
zoneType = AdvanceSteel.ConnectionAutomation.Nodes.Zone.ZoneType(zone=zones)
