# Dynamo graph AnalyticalAutomation.AnalyticalElements.AnalyticalElement.AssociateElement.dyn (Dynamo 3.6.0.9395)

# group: Create Linear Path from A-4 to A-5 at level L2 TOS
select_model_elements_by = DSModelElementsByCategorySelection()  # "Select Model Elements By Category"; nothing selected; 2 picked in the model
curve = Grid.Curve(grid=select_model_elements_by)
select_model_element = DSModelElementSelection()  # 1 picked in the model
curve_2 = Grid.Curve(grid=select_model_element)
intersect = Geometry.Intersect(geometry=curve, other=curve_2, lacing=CrossProduct)
flatten = List.Flatten(list=intersect)
X = Point.X(point=flatten)
Y = Point.Y(point=flatten)
levels = Levels("L2 TOS")
elevation = Level.Elevation(level=levels)
byCoordinates = Point.ByCoordinates(x=X, y=Y, z=elevation)
firstItem = List.FirstItem(list=byCoordinates)
lastItem = List.LastItem(list=byCoordinates)
byStartPointEndPoint = Line.ByStartPointEndPoint(startPoint=firstItem, endPoint=lastItem)

byCurve = AnalyticalAutomation.AnalyticalElements.AnalyticalMember.ByCurve(curve=byStartPointEndPoint)
select_model_element_2 = DSModelElementSelection()  # 1 picked in the model
associateElement = AnalyticalAutomation.AnalyticalElements.AnalyticalElement.AssociateElement(analyticalElement=byCurve, element=select_model_element_2)
