# Dynamo graph AnalyticalAutomation.AnalyticalElements.AnalyticalElement.ConvertFromElement.dyn (Dynamo 3.6.0.9395)

select_model_element = DSModelElementSelection()  # 1 picked in the model
byElement = AnalyticalAutomation.AnalyticalElements.AnalyticalMember.ByElement(element=select_model_element)
convertFromElement = AnalyticalAutomation.AnalyticalElements.AnalyticalElement.ConvertFromElement(element=byElement)
