# Dynamo graph AnalyticalAutomation.AnalyticalElements.AnalyticalMember.SetStructuralRole.dyn (Dynamo 3.6.0.9395)

select_model_element = DSModelElementSelection()  # 1 picked in the model
byElement = AnalyticalAutomation.AnalyticalElements.AnalyticalMember.ByElement(element=select_model_element)
structural_roles = StructuralRoleComboBox("Beam")
setStructuralRole = AnalyticalAutomation.AnalyticalElements.AnalyticalMember.SetStructuralRole(analyticalMember=byElement, structuralRole=structural_roles)
