# Dynamo graph AnalyticalAutomation.AnalyticalElements.AnalyticalMember.StructuralRole.dyn (Dynamo 3.6.0.9395)

select_model_element = DSModelElementSelection()  # 1 picked in the model
byElement = AnalyticalAutomation.AnalyticalElements.AnalyticalMember.ByElement(element=select_model_element)
structuralRole = AnalyticalAutomation.AnalyticalElements.AnalyticalMember.StructuralRole(analyticalMember=byElement)
