# Dynamo graph AnalyticalAutomation.AnalyticalElements.AnalyticalOpening.Surface.dyn (Dynamo 3.6.0.9395)

select_model_element = DSModelElementSelection()  # 1 picked in the model
byElement = AnalyticalAutomation.AnalyticalElements.AnalyticalPanel.ByElement(element=select_model_element)
openings = AnalyticalAutomation.AnalyticalElements.AnalyticalPanel.Openings(analyticalPanel=byElement)
surface = AnalyticalAutomation.AnalyticalElements.AnalyticalOpening.Surface(analyticalOpening=openings)
