# Dynamo graph AnalyticalAutomation.AnalyticalElements.AnalyticalPanel.AddOpeningsBySurfaces.dyn (Dynamo 3.6.0.9395)

# group: Create an analytical panel by L2 TOS
select_model_element = DSModelElementSelection()  # 1 picked in the model
byElement = AnalyticalAutomation.AnalyticalElements.AnalyticalPanel.ByElement(element=select_model_element)

# group: Create a surface on L2 TOS defined by A4-A5 and B4-B5
select_model_elements_by = DSModelElementsByCategorySelection("OST_Grids")  # "Select Model Elements By Category"; 2 picked in the model
curve = Grid.Curve(grid=select_model_elements_by)
select_model_elements_by_2 = DSModelElementsByCategorySelection("OST_Grids")  # "Select Model Elements By Category"; 2 picked in the model
curve_2 = Grid.Curve(grid=select_model_elements_by_2)
intersect = Geometry.Intersect(geometry=curve, other=curve_2, lacing=CrossProduct)
flatten = List.Flatten(list=intersect)
X = Point.X(point=flatten)
Y = Point.Y(point=flatten)
levels = Levels("L2 TOS")
elevation = Level.Elevation(level=levels)
byCoordinates = Point.ByCoordinates(x=X, y=Y, z=elevation@L1)
number = DoubleInput(0)
getItemAtIndex = List.GetItemAtIndex(list=byCoordinates@L2, index=number)
number_2 = DoubleInput(2)
getItemAtIndex_2 = List.GetItemAtIndex(list=byCoordinates@L2, index=number_2)
number_3 = DoubleInput(3)
getItemAtIndex_3 = List.GetItemAtIndex(list=byCoordinates@L2, index=number_3)
number_4 = DoubleInput(1)
getItemAtIndex_4 = List.GetItemAtIndex(list=byCoordinates@L2, index=number_4)

# group: Offset the defined area to create an opening within
list_create = List.Create(item0=getItemAtIndex, item1=getItemAtIndex_2, item2=getItemAtIndex_3, item3=getItemAtIndex_4, item4=getItemAtIndex)
flatten_2 = List.Flatten(list=list_create)
byPoints = PolyCurve.ByPoints(points=flatten_2)
number_5 = DoubleInput(-4)
boolean = BoolSelector(false)
offsetMany = PolyCurve.OffsetMany(polyCurve=byPoints, signedDistance=number_5, extendCircular=boolean)
byPatch = Surface.ByPatch(closedCurve=offsetMany)

addOpeningsBySurfaces = AnalyticalAutomation.AnalyticalElements.AnalyticalPanel.AddOpeningsBySurfaces(analyticalPanel=byElement, surfaces=byPatch)
