# Dynamo graph AnalyticalAutomation.AnalyticalElements.AnalyticalPanel.RemoveOpenings.dyn (Dynamo 3.6.0.9395)

select_model_element = DSModelElementSelection()  # 1 picked in the model
byElement = AnalyticalAutomation.AnalyticalElements.AnalyticalPanel.ByElement(element=select_model_element)
openings = AnalyticalAutomation.AnalyticalElements.AnalyticalPanel.Openings(analyticalPanel=byElement)
firstItem = List.FirstItem(list=openings)
removeOpenings = AnalyticalAutomation.AnalyticalElements.AnalyticalPanel.RemoveOpenings(analyticalPanel=byElement, analyticalOpenings=firstItem)
