# Dynamo graph AnalyticalAutomation.AnalyticalElements.AnalyticalPanel.SetStructuralRole.dyn (Dynamo 3.6.0.9395)

select_model_element = DSModelElementSelection()  # 1 picked in the model
byElement = AnalyticalAutomation.AnalyticalElements.AnalyticalPanel.ByElement(element=select_model_element)
structural_roles = StructuralRoleComboBox("Floor")
setStructuralRole = AnalyticalAutomation.AnalyticalElements.AnalyticalPanel.SetStructuralRole(analyticalPanel=byElement, structuralRole=structural_roles)
