# Dynamo graph AnalyticalAutomation.AnalyticalElements.AnalyticalPanel.StructuralRole.dyn (Dynamo 3.6.0.9395)

select_model_element = DSModelElementSelection()  # 1 picked in the model
byElement = AnalyticalAutomation.AnalyticalElements.AnalyticalPanel.ByElement(element=select_model_element)
structuralRole = AnalyticalAutomation.AnalyticalElements.AnalyticalPanel.StructuralRole(analyticalPanel=byElement)
