# Dynamo graph AnalyticalAutomation.AnalyticalElements.AnalyticalPanel.Surface.dyn (Dynamo 3.6.0.9395)

select_model_element = DSModelElementSelection()  # 1 picked in the model
byElement = AnalyticalAutomation.AnalyticalElements.AnalyticalPanel.ByElement(element=select_model_element)
surface = AnalyticalAutomation.AnalyticalElements.AnalyticalPanel.Surface(analyticalPanel=byElement)
