# Dynamo graph AnalyticalAutomation.Geometry.Surface.IsValidForAnalyticalPanel.dyn (Dynamo 3.4.1.7055)

number = DoubleInput(687839)
element_by_id = ElementById(Id=number)
faces = Element.Faces(element=element_by_id)
firstItem = List.FirstItem(list=faces)
number_2 = DoubleInput(1)
isValidForAnalyticalPanel = AnalyticalAutomation.Geometry.Surface.IsValidForAnalyticalPanel(surface=firstItem, checkOpenings=number_2)
