# Dynamo graph AnalyticalAutomation.RevitElements.Element.ByAnalyticalMember.dyn (Dynamo 3.6.0.9395)

select_model_element = DSModelElementSelection()  # 1 picked in the model
boolean = BoolSelector(true)
byAnalyticalMember = AnalyticalAutomation.RevitElements.Element.ByAnalyticalMember(analyticalMember=select_model_element, updateGeometry=boolean, updateParameters=boolean, preserveExistingJoin=boolean, generateDefaultJoin=boolean)
