# Dynamo graph AnalyticalAutomation.RevitElements.Element.ByAnalyticalPanel.dyn (Dynamo 3.4.1.7055)

select_model_element = DSModelElementSelection()  # 1 picked in the model
boolean = BoolSelector(true)
byAnalyticalPanel = AnalyticalAutomation.RevitElements.Element.ByAnalyticalPanel(analyticalPanel=select_model_element, updateGeometry=boolean, updateParameters=boolean, includeOpenings=boolean, preserveExistingJoin=boolean, generateDefaultJoin=boolean)
