# Dynamo graph AnalyticalAutomation.RevitElements.Element.IsValidForAnalyticalMember.dyn (Dynamo 3.6.0.9395)

integer_slider = IntegerSlider(769857, range=687839..769857 step 1)
element_by_id = ElementById(Id=integer_slider)
isValidForAnalyticalMember = AnalyticalAutomation.RevitElements.Element.IsValidForAnalyticalMember(element=element_by_id)
