# Dynamo graph AnalyticalAutomation.RevitElements.Element.IsValidForAnalyticalPanel.dyn (Dynamo 3.6.0.9395)

integer_slider = IntegerSlider(687839, range=687839..769857 step 1)
element_by_id = ElementById(Id=integer_slider)
number = DoubleInput(1)
isValidForAnalyticalPanel = AnalyticalAutomation.RevitElements.Element.IsValidForAnalyticalPanel(element=element_by_id, checkOpenings=number)
