# Dynamo graph AnalyticalAutomation.Utilities.UnitsUtilities.ConvertToCurrentProjectLengthUnit.dyn (Dynamo 3.6.0.9395)

number_slider = DoubleSlider(75.7, range=0..100 step 0.1)
units = Units("Meters")
typeId = DynamoUnits.Unit.TypeId(unit=units)
convertToCurrentProjectLengthUnit = AnalyticalAutomation.Utilities.UnitsUtilities.ConvertToCurrentProjectLengthUnit(value=number_slider, unitTypeId=typeId)
