# Dynamo graph Autodesk.DesignScript.Geometry.BoundingBox.ContextCoordinateSystem.dyn (Dynamo 3.4.1.7055)

select_model_element = DSModelElementSelection()  # 1 picked in the model
geometry = Element.Geometry(element=select_model_element)
byGeometry = BoundingBox.ByGeometry(geom=geometry)
contextCoordinateSystem = BoundingBox.ContextCoordinateSystem(boundingBox=byGeometry)
origin = CoordinateSystem.Origin(coordinateSystem=contextCoordinateSystem)
