# Dynamo graph Autodesk.DesignScript.Geometry.Mesh.BoundingBox.dyn (Dynamo 3.4.1.7055)

number_slider = DoubleSlider(10, range=0..100 step 0.1)
byCoordinates = Point.ByCoordinates(x=number_slider, y=number_slider, z=number_slider)
number_slider_2 = DoubleSlider(1, range=0..100 step 0.1)
byCoordinates_2 = Point.ByCoordinates(x=number_slider_2, y=number_slider_2, z=number_slider_2)
list_create = List.Create(item0=byCoordinates, item1=byCoordinates_2)
byPoints = NurbsCurve.ByPoints(points=list_create)
byRevolve = Surface.ByRevolve(profile=byPoints)
byGeometry = Mesh.ByGeometry(inputGeometry=byRevolve)
boundingBox = Mesh.BoundingBox(mesh=byGeometry)
minPoint = BoundingBox.MinPoint(boundingBox=boundingBox)
