# Dynamo graph Autodesk.DesignScript.Geometry.PolyCurve.OffsetMany.dyn (Dynamo 3.4.1.7055)

byCoordinates = Point.ByCoordinates()
code_block = CodeBlock { 10; }
byCoordinates_2 = Point.ByCoordinates(x=code_block)
byCoordinates_3 = Point.ByCoordinates(x=code_block, y=code_block)
byCoordinates_4 = Point.ByCoordinates(y=code_block)
list_create = List.Create(item0=byCoordinates, item1=byCoordinates_2, item2=byCoordinates_3, item3=byCoordinates_4)
boolean = BoolSelector(true)
byPoints = PolyCurve.ByPoints(points=list_create, connectLastToFirst=boolean)
number_slider = DoubleSlider(-1, range=-1..100 step 0.1)
boolean_2 = BoolSelector(false)
code_block_2 = CodeBlock { 1; }
byCoordinates_5 = Vector.ByCoordinates(z=code_block_2)
offsetMany = PolyCurve.OffsetMany(polyCurve=byPoints, signedDistance=number_slider, extendCircular=boolean_2, planeNormal=byCoordinates_5)
