# Dynamo graph CoreNodeModels.Logic.Gate.dyn (Dynamo 3.4.1.7055)

categories = Categories("OST_CurtainWallPanels")
all_elements_of_category = ElementsOfCategory(Category=categories)
firstItem = List.FirstItem(list=all_elements_of_category)
geometry = Element.Geometry(element=firstItem)
gate = Gate(true, geometry)
explode = Geometry.Explode(geometry=gate)
