# Dynamo graph CoreNodeModels.Remember.dyn (Dynamo 3.4.1.7055)

categories = Categories("OST_Floors")
all_elements_of_category = ElementsOfCategory(Category=categories)
firstItem = List.FirstItem(list=all_elements_of_category)
geometry = Element.Geometry(element=firstItem)
remember = Remember(geometry)
