# Dynamo graph DSRevitNodesUI.ElementById.dyn (Dynamo 2.18.1.5096)

number = DoubleInput(1263678)
element_by_id = ElementById(Id=number)
string = StringInput("7e4e1325-068d-4889-a124-dd475f3ddae2-0013483e")
element_by_id_2 = ElementById(Id=string)
