# Dynamo graph DSRevitNodesUI.ElementsOfCategoryInView.dyn (Dynamo 2.18.1.5096)

categories = Categories("OST_Walls")
views = Views("L1")
all_elements_of_category_in_view = ElementsOfCategoryInView(Category=categories, View=views)
