# Dynamo graph DSRevitNodesUI.FamilyInstanceParameters.dyn (Dynamo 2.18.1.5096)

family_types = FamilyTypes("Door-Passage-Single-Flush:30\" x 84\"")
get_family_parameter = FamilyInstanceParameters("Type Mark(Type)(string)", f=family_types)
getParameterValueByName = Element.GetParameterValueByName(element=family_types, parameterName=get_family_parameter)
