# Dynamo graph DSRevitNodesUI.FloorTypes.dyn (Dynamo 2.18.1.5096)

select_model_element_by_category = DSModelElementByCategorySelection("OST_Rooms")  # 1 picked in the model
finishBoundary = Room.FinishBoundary(room=select_model_element_by_category)
floor_types = FloorTypes("Finish Floor - Terrazo")
levels = Levels("L4")
byOutlineTypeAndLevel = Floor.ByOutlineTypeAndLevel(outlineCurves=finishBoundary, floorType=floor_types, level=levels)
