# Dynamo graph DSRevitNodesUI.PerformanceAdviserRules.dyn (Dynamo 3.4.1.7055)

performance_adviser_rules = PerformanceAdviserRules("View clipping is disabled")  # graph input
name = PerformanceAdviserRule.Name(performanceAdviserRule=performance_adviser_rules)
description = PerformanceAdviserRule.Description(performanceAdviserRule=performance_adviser_rules)
execute = PerformanceAdviserRule.Execute(rules=performance_adviser_rules)
severity = FailureMessage.Severity(failureMessage=execute)
failingElements = FailureMessage.FailingElements(failureMessage=execute)
description_2 = FailureMessage.Description(failureMessage=execute)
