# Dynamo graph DSRevitNodesUI.RevisionNumberType.dyn (Dynamo 3.4.1.7055)

string = StringInput("Dynamo Revision")
string_2 = StringInput("10-31-2025")
string_3 = StringInput("Dynamo Desciption")
boolean = BoolSelector(false)
string_4 = StringInput("Dynamo Issued By")
string_5 = StringInput("Dynamo Issued To")
select_revision_visibility = RevisionVisibility("TagVisible")
select_revision_number_type = RevisionNumberType("Alphanumeric")
byName = Revision.ByName(name=string, revDate=string_2, description=string_3, issued=boolean, issuedBy=string_4, issuedTo=string_5, visibility=select_revision_visibility, numberType=select_revision_number_type)
