# Dynamo graph DSRevitNodesUI.RevisionVisibility.dyn (Dynamo 3.4.1.7055)

string = StringInput("Dynamo Demo")
string_2 = StringInput("Rev Date")
string_3 = StringInput("Revision Description")
boolean = BoolSelector(false)
string_4 = StringInput("By Dynamo")
string_5 = StringInput("To Dynamo")
select_revision_visibility = RevisionVisibility("CloudAndTagVisible")
select_revision_number_type = RevisionNumberType("Alphanumeric")
byName = Revision.ByName(name=string, revDate=string_2, description=string_3, issued=boolean, issuedBy=string_4, issuedTo=string_5, visibility=select_revision_visibility, numberType=select_revision_number_type)
