# Dynamo graph DSRevitNodesUI.RevitPhases.dyn (Dynamo 3.4.1.7055)

categories = Categories("OST_Walls")
all_elements_of_category = ElementsOfCategory(Category=categories)
firstItem = List.FirstItem(list=all_elements_of_category)
string = StringInput("Phase Created")
select_phase = RevitPhases("Existing")
setParameterByName = Element.SetParameterByName(element=firstItem, parameterName=string, value=select_phase)
getParameterValueByName = Element.GetParameterValueByName(element=setParameterByName, parameterName=string)
name = Element.Name(element=getParameterValueByName)
