# Dynamo graph DSRevitNodesUI.RevitRevisions.dyn (Dynamo 3.4.1.7055)

select_revision = RevitRevisions("Seq. 1 - Schematic Design")
revisionDate = Revision.RevisionDate(revision=select_revision)
issued = Revision.Issued(revision=select_revision)
