# Dynamo graph DSRevitNodesUI.RuleTypes.dyn (Dynamo 3.4.1.7055)

# group:
# Inserted Dynamo graph
# note: Lookup Parameter
# note: Create Filter Rule

views = Views("L1 Wall Base")
string = StringInput("2 HR Walls Dynamo")
categories = Categories("OST_Walls")
select_rule_type = RuleTypes("Equals")
string_2 = StringInput("2 HR")
element_classes = ElementTypes("WallType")
all_elements_of_class = ElementsOfType(element_class=element_classes)
firstItem = List.FirstItem(list=all_elements_of_class)
string_3 = StringInput("Fire Rating")
parameterByName = Parameter.ParameterByName(element=firstItem, name=string_3)
byRuleType = Revit.Filter.FilterRule.ByRuleType(type=select_rule_type, value=string_2, parameter=parameterByName)
byRules = Revit.Filter.ParameterFilterElement.ByRules(name=string, categories=categories, rules=byRuleType)
addFilter = View.AddFilter(view=views, parameterFilter=byRules)
filters = View.Filters(view=views)
filterOverrides = View.FilterOverrides(view=addFilter, parameterFilter=filters)
name = Element.Name(element=filters)
