# Dynamo graph DSRevitNodesUI.ScheduleTypes.dyn (Dynamo 3.2.1.5366)

categories = Categories("OST_Doors")
string = StringInput("Working Door Schedule")
schedule_type = ScheduleTypes("RegularSchedule")
createSchedule = ScheduleView.CreateSchedule(category=categories, name=string, scheduleType=schedule_type)
