# Dynamo graph DSRevitNodesUI.SpacingRuleLayouts.dyn (Dynamo 3.6.2.11575)

select_model_element = DSModelElementSelection()  # 1 picked in the model
string = StringInput("Layout")
spacing_rule_layout = SpacingRuleLayouts("FixedNumber")
setParameterByName = Element.SetParameterByName(element=select_model_element, parameterName=string, value=spacing_rule_layout)
