# Dynamo graph DSRevitNodesUI.StructuralColumnTypes.dyn (Dynamo 2.18.1.5096)

origin = Point.Origin()
number_slider = DoubleSlider(20, range=0..100 step 0.1)
byCoordinates = Point.ByCoordinates(z=number_slider)
byStartPointEndPoint = Line.ByStartPointEndPoint(startPoint=origin, endPoint=byCoordinates)
levels = Levels("L2")
structural_column_types = StructuralColumnTypes("W10X33")
columnByCurve = StructuralFraming.ColumnByCurve(curve=byStartPointEndPoint, level=levels, structuralColumnType=structural_column_types)
