# Dynamo graph DSRevitNodesUI.StructuralFramingTypes.dyn (Dynamo 2.18.1.5096)

origin = Point.Origin()
number_slider = DoubleSlider(20, range=0..100 step 0.1)
byCoordinates = Point.ByCoordinates(y=number_slider)
byStartPointEndPoint = Line.ByStartPointEndPoint(startPoint=origin, endPoint=byCoordinates)
levels = Levels("L2")
structural_framing_types = StructuralFramingTypes("W12X26")
beamByCurve = StructuralFraming.BeamByCurve(curve=byStartPointEndPoint, level=levels, structuralFramingType=structural_framing_types)
