# Dynamo graph DSRevitNodesUI.SunSettings.dyn (Dynamo 2.18.1.5096)

current = SunSettings()  # "SunSettings.Current"
watch = Watch(current)
currentDateTime = SunSettings.CurrentDateTime(sunSettings=current)
