# Dynamo graph DSRevitNodesUI.ViewFamilyTypes.dyn (Dynamo 2.18.1.5096)

views = Views("L2")
duplicateView = View.DuplicateView(view=views)
string = StringInput("Family and Type")
view_family_types = ViewFamilyTypes("Enlarged Plan")
setParameterByName = Element.SetParameterByName(element=duplicateView, parameterName=string, value=view_family_types)
