# Dynamo graph DSRevitNodesUI.WallTypes.dyn (Dynamo 2.18.1.5096)

origin = Point.Origin()
number_slider = DoubleSlider(20, range=0..100 step 0.1)
byCoordinates = Point.ByCoordinates(x=number_slider)
byStartPointEndPoint = Line.ByStartPointEndPoint(startPoint=origin, endPoint=byCoordinates)
number = DoubleInput(10)
levels = Levels("L2")
wall_types = WallTypes("Interior - 7 1/4\" Partition (1 hr)")
byCurveAndHeight = Wall.ByCurveAndHeight(curve=byStartPointEndPoint, height=number, level=levels, wallType=wall_types)
