# Dynamo graph Dynamo.Graph.Nodes.CodeBlockNodeModel.dyn (Dynamo 3.4.1.7055)

code_block = CodeBlock { 1..10; }
code_block_2 = CodeBlock { 1; }
code_block_3 = CodeBlock(a=code_block_2, b=code_block_2) { a+b; }
code_block_4 = CodeBlock { 1..10..2; }
