# Dynamo graph Dynamo.Translation.Models.ObjectSelector.dyn (Dynamo 3.4.1.7055)
# packages: DynamoATF 26.0.2.0

file_path = Filename("..\..\..\Downloads\North Arrows.dwg")
import_geometry_file = ObjectImporter(path=file_path)
select_geometry_file_objects = ObjectSelector(objects=import_geometry_file, SelectedObjectIds=["16", "27", "33"])
