# Dynamo graph Revit.AnalysisDisplay.VectorAnalysisDisplay.ByViewPointsAndVectorValues.dyn (Dynamo 3.6.2.11575)
# VectorAnalysisDisplay Demo - Shows how to create vector arrow visualizations in Revit using the VectorAnalysisDisplay.ByViewPointsAndVectorValues node for displaying directional data like wind flow or force vectors.

views = Views("{3D}")
number = DoubleInput(0)
number_2 = DoubleInput(0)
number_3 = DoubleInput(0)
byCoordinates = Point.ByCoordinates(x=number, y=number_2, z=number_3)
number_4 = DoubleInput(5)
number_5 = DoubleInput(5)
number_6 = DoubleInput(10)
byCoordinates_2 = Point.ByCoordinates(x=number_4, y=number_5, z=number_6)
list_create = List.Create(item0=byCoordinates, item1=byCoordinates_2)
number_7 = DoubleInput(1)
number_8 = DoubleInput(0)
number_9 = DoubleInput(1)
byCoordinates_3 = Vector.ByCoordinates(x=number_7, y=number_8, z=number_9)
number_10 = DoubleInput(0)
number_11 = DoubleInput(1)
number_12 = DoubleInput(0.5)
byCoordinates_4 = Vector.ByCoordinates(x=number_10, y=number_11, z=number_12)
list_create_2 = List.Create(item0=byCoordinates_3, item1=byCoordinates_4)
analysis_name = StringInput("Wind Flow Analysis")
description = StringInput("Wind Vectors")
byViewPointsAndVectorValues = Revit.AnalysisDisplay.VectorAnalysisDisplay.ByViewPointsAndVectorValues(view=views, sampleLocations=list_create, samples=list_create_2, name=analysis_name, description=description)  # unwired: unitType
