# Dynamo graph Revit.Application.Document.IsCloudPath.dyn (Dynamo 3.3.0.6316)

current = Document.Current()
getLinkInstances = Document.GetLinkInstances(document=current)
document = LinkInstance.Document(linkInstance=getLinkInstances)
isCloudPath = Document.IsCloudPath(document=document)
