# Dynamo graph Revit.Application.Document.IsFamilyDocument.dyn (Dynamo 2.18.1.5096)

current = Document.Current()
byDocument = FamilyDocument.ByDocument(document=current)
isFamilyDocument = Document.IsFamilyDocument(document=current)
