# Dynamo graph Revit.Application.Document.SaveFamilyToFolder.dyn (Dynamo 3.2.1.5366)

current = Document.Current()
element_classes = ElementTypes("Family")
all_elements_of_class = ElementsOfType(element_class=element_classes)
directory_path = Directory("C:\Users\johnpierson\Documents\Exported Families")
saveFamilyToFolder = Document.SaveFamilyToFolder(document=current, family=all_elements_of_class, directoryPath=directory_path)
