# Dynamo graph Revit.Application.Document.UnitTypeBySpecType.dyn (Dynamo 3.4.1.7055)

current = Document.Current()
spec_types = SpecTypes("autodesk.spec.aec:area")
spec_types_2 = SpecTypes("autodesk.spec.aec:costPerArea")
list_create = List.Create(item0=spec_types, item1=spec_types_2)
unitTypeBySpecType = Document.UnitTypeBySpecType(document=current, specType=list_create)
