# Dynamo graph Revit.Application.FamilyDocument.AddParameter.dyn (Dynamo 2.18.1.5096)

current = Document.Current()
byDocument = FamilyDocument.ByDocument(document=current)
string = StringInput("Warehouse Id")
string_2 = StringInput("autodesk.parameter.group:identityData-1.0.0")
byTypeId = GroupType.ByTypeId(typeId=string_2)
string_3 = StringInput("autodesk.spec:spec.string-2.0.0")
byTypeId_2 = SpecType.ByTypeId(typeId=string_3)
boolean = BoolSelector(false)
addParameter = FamilyDocument.AddParameter(familyDocument=byDocument, parameterName=string, groupType=byTypeId, specType=byTypeId_2, isInstance=boolean)
