# Dynamo graph Revit.Application.FamilyDocument.Category.dyn (Dynamo 2.18.1.5096)

current = Document.Current()
byDocument = FamilyDocument.ByDocument(document=current)
category = FamilyDocument.Category(familyDocument=byDocument)
