# Dynamo graph Revit.Application.FamilyDocument.DeleteParameter.dyn (Dynamo 2.18.1.5096)

current = Document.Current()
byDocument = FamilyDocument.ByDocument(document=current)
string = StringInput("Warehouse Id")
deleteParameter = FamilyDocument.DeleteParameter(familyDocument=byDocument, parameterName=string)
parameters = FamilyDocument.Parameters(familyDocument=byDocument)
name = FamilyParameter.Name(familyParameter=parameters)
