# Dynamo graph Revit.Application.FamilyDocument.GetFormula.dyn (Dynamo 2.18.1.5096)

current = Document.Current()
byDocument = FamilyDocument.ByDocument(document=current)
string = StringInput("Radius")
getFormula = FamilyDocument.GetFormula(familyDocument=byDocument, parameterName=string)
