# Dynamo graph Revit.Application.FamilyDocument.GetParameterValueByName.dyn (Dynamo 2.18.1.5096)

current = Document.Current()
byDocument = FamilyDocument.ByDocument(document=current)
types = FamilyDocument.Types(familyDocument=byDocument)
integer_slider = IntegerSlider(1, range=0..100 step 1)
getItemAtIndex = List.GetItemAtIndex(list=types, index=integer_slider)
string = StringInput("Radius")
getParameterValueByName = FamilyDocument.GetParameterValueByName(familyDocument=byDocument, familyTypeName=getItemAtIndex, parameterName=string)
