# Dynamo graph Revit.Application.FamilyDocument.SetCategory.dyn (Dynamo 2.18.1.5096)

current = Document.Current()
byDocument = FamilyDocument.ByDocument(document=current)
categories = Categories("OST_GenericModel")
setCategory = FamilyDocument.SetCategory(familyDocument=byDocument, category=categories)
category = FamilyDocument.Category(familyDocument=setCategory)
