# Dynamo graph Revit.Application.FamilyDocument.SetFormula.dyn (Dynamo 2.18.1.5096)

current = Document.Current()
byDocument = FamilyDocument.ByDocument(document=current)
string = StringInput("Chairs")
string_2 = StringInput("Diameter / 1'")
setFormula = FamilyDocument.SetFormula(familyDocument=byDocument, parameterName=string, formula=string_2)
