# Dynamo graph Revit.Application.FamilyDocument.SetParameterValueByName.dyn (Dynamo 2.18.1.5096)

current = Document.Current()
byDocument = FamilyDocument.ByDocument(document=current)
types = FamilyDocument.Types(familyDocument=byDocument)
integer_slider = IntegerSlider(1, range=0..100 step 1)
getItemAtIndex = List.GetItemAtIndex(list=types, index=integer_slider)
string = StringInput("Radius")
number_slider = DoubleSlider(3, range=3..20 step 0.1)
setParameterValueByName = FamilyDocument.SetParameterValueByName(familyDocument=byDocument, familyTypeName=getItemAtIndex, parameter=string, value=number_slider)
