# Dynamo graph Revit.Application.FamilyDocument.Types.dyn (Dynamo 2.18.1.5096)

current = Document.Current()
byDocument = FamilyDocument.ByDocument(document=current)
types = FamilyDocument.Types(familyDocument=byDocument)
