# Dynamo graph Revit.Application.Warning.GetWarnings.dyn (Dynamo 2.18.1.5096)

current = Document.Current()
getWarnings = Warning.GetWarnings(document=current)
description = Warning.Description(warning=getWarnings)
groupByKey = List.GroupByKey(list=getWarnings, keys=description)
watch = Watch(groupByKey.groups)
watch_2 = Watch(groupByKey.uniqueKeys)
