# Dynamo graph Revit.Application.Warning.Severity.dyn (Dynamo 2.18.1.5096)

all_warnings_of_type = AllWarningsOfType("Highlighted floors overlap. ")
description = Warning.Description(warning=all_warnings_of_type)
severity = Warning.Severity(warning=all_warnings_of_type)
