# Dynamo graph Revit.Elements.AdaptiveComponent.ByParametersOnCurveReference.dyn (Dynamo 3.4.1.7055)

number = DoubleInput(0)
number_slider = DoubleSlider(5, range=1..10 step 1)
number_slider_2 = DoubleSlider(0.1, range=0.01..0.3 step 0.01)
sequence = Sequence(start=number, amount=number_slider, step=number_slider_2)
byCoordinates = Point.ByCoordinates()
number_slider_3 = DoubleSlider(10, range=0..100 step 0.1)
byCoordinates_2 = Point.ByCoordinates(x=number_slider_3, y=number_slider_3)
byStartPointEndPoint = Line.ByStartPointEndPoint(startPoint=byCoordinates, endPoint=byCoordinates_2)
byCurve = ModelCurve.ByCurve(curve=byStartPointEndPoint)
family_types = FamilyTypes("Diagnostic Tripod-1 point:Diagnostic Tripod-1 point")
byParametersOnCurveReference = AdaptiveComponent.ByParametersOnCurveReference(parameters=sequence@L1, curve=byCurve, familyType=family_types)
