# Dynamo graph Revit.Elements.AdaptiveComponent.ByParametersOnFace.dyn (Dynamo 3.4.1.7055)

number = DoubleInput(1)
number_slider = DoubleSlider(10, range=0..20 step 1)
number_slider_2 = DoubleSlider(2.5, range=0.5..10 step 0.5)
range = Range(start=number, end=number_slider, step=number_slider_2)
byCoordinates = UV.ByCoordinates(u=range, v=range)
integer_slider = IntegerSlider(1, range=1..1 step 1)
chop = List.Chop(list=byCoordinates@L2, lengths=integer_slider)
select_face = DSFaceSelection()  # 1 picked in the model
firstItem = List.FirstItem(list=select_face)
family_types = FamilyTypes("Adaptive Component:Adaptive Type")
byParametersOnFace = AdaptiveComponent.ByParametersOnFace(uvs=chop, surface=firstItem, familyType=family_types)
