# Dynamo graph Revit.Elements.AdaptiveComponent.ByPoints.dyn (Dynamo 3.4.1.7055)

number = DoubleInput(20)
byCoordinates = Point.ByCoordinates(x=number, y=number, z=number)
family_types = FamilyTypes("Adaptive Component:Adaptive Type")
byPoints = AdaptiveComponent.ByPoints(points=byCoordinates, familyType=family_types)
