# Dynamo graph Revit.Elements.AdaptiveComponent.Locations.dyn (Dynamo 3.4.1.7055)

family_types = FamilyTypes("Diagnostic Tripod-1 point:Diagnostic Tripod-1 point")
all_elements_of_family_type = ElementsOfFamilyType(Family_Type=family_types)
locations = AdaptiveComponent.Locations(adaptiveComponent=all_elements_of_family_type)
number_slider = DoubleSlider(10, range=0..100 step 0.1)
byCoordinates = Point.ByCoordinates(x=number_slider)
byPoint = FamilyInstance.ByPoint(familyType=family_types, point=byCoordinates)
