# Dynamo graph Revit.Elements.AdaptiveComponent.Type.dyn (Dynamo 3.6.0.9395)

family_types = FamilyTypes("Diagnostic Tripod-1 point:Diagnostic Tripod-1 point")
all_elements_of_family_type = ElementsOfFamilyType(Family_Type=family_types)
type = AdaptiveComponent.Type(adaptiveComponent=all_elements_of_family_type)
