# Dynamo graph Revit.Elements.AppearanceAssetElement.GetRenderingAssetTextureImages.dyn (Dynamo 3.4.1.7055)

element_classes = ElementTypes("AppearanceAssetElement")
all_elements_of_class = ElementsOfType(element_class=element_classes)
getRenderingAssetTextureImages = AppearanceAssetElement.GetRenderingAssetTextureImages(appearanceAssetElement=all_elements_of_class)
name = Element.Name(element=all_elements_of_class)
