# Dynamo graph Revit.Elements.Area.Boundaries.dyn (Dynamo 3.4.1.7055)

categories = Categories("OST_Areas")
all_elements_of_category = ElementsOfCategory(Category=categories)
boundaries = Area.Boundaries(area=all_elements_of_category)
name = Element.Name(element=all_elements_of_category)
