# Dynamo graph Revit.Elements.Ceiling.ByOutlineTypeAndLevel(outlineCurves, ceilingType, level).dyn "Dynamo.Graph.Nodes.ZeroTouch.DSFunction" (Dynamo 2.18.1.5096)

select_model_element_by_category = DSModelElementByCategorySelection("OST_Rooms")  # 1 picked in the model
finishBoundary = Room.FinishBoundary(room=select_model_element_by_category)
ceiling_types = CeilingTypes("2' x 4' ACT System")
levels = Levels("L4")
byOutlineTypeAndLevel = Ceiling.ByOutlineTypeAndLevel(outlineCurves=finishBoundary, ceilingType=ceiling_types, level=levels)
