# Dynamo graph Revit.Elements.Ceiling.ByOutlineTypeAndLevel.dyn (Dynamo 3.4.1.7055)

number_slider = DoubleSlider(10, range=0..100 step 0.1)
byWidthLength = Rectangle.ByWidthLength(width=number_slider, length=number_slider)
ceiling_types = CeilingTypes("2' x 4' ACT System")
levels = Levels("L1 - Block 35")
byOutlineTypeAndLevel = Ceiling.ByOutlineTypeAndLevel(outline=byWidthLength, ceilingType=ceiling_types, level=levels)
