# Dynamo graph Revit.Elements.CeilingType.GetThermalProperties.dyn (Dynamo 3.3.0.6316)

string = StringInput("Generic")
byName = CeilingType.ByName(name=string)
getThermalProperties = CeilingType.GetThermalProperties(ceilingType=byName)
