# Dynamo graph Revit.Elements.CeilingType.Name.dyn (Dynamo 3.3.0.6316)

element_classes = ElementTypes("CeilingType")
all_elements_of_class = ElementsOfType(element_class=element_classes)
name = CeilingType.Name(ceilingType=all_elements_of_class)
