# Dynamo graph Revit.Elements.CurtainPanel.IsRectangular.dyn (Dynamo 3.2.1.5366)

select_curtain_wall = DSModelElementByCategorySelection("OST_Walls")  # 1 picked in the model
byElement = CurtainPanel.ByElement(hostingElement=select_curtain_wall)
isRectangular = CurtainPanel.IsRectangular(curtainPanel=byElement)
