# Dynamo graph Revit.Elements.CurtainPanel.Length.dyn (Dynamo 2.18.1.5096)

number = DoubleInput(1055165)
element_by_id = ElementById(Id=number)
byElement = CurtainPanel.ByElement(hostingElement=element_by_id)
length = CurtainPanel.Length(curtainPanel=byElement)
