# Dynamo graph Revit.Elements.CurtainPanel.Width.dyn (Dynamo 2.18.1.5096)

number = DoubleInput(1055165)
element_by_id = ElementById(Id=number)
byElement = CurtainPanel.ByElement(hostingElement=element_by_id)
width = CurtainPanel.Width(curtainPanel=byElement)
