# Dynamo graph Revit.Elements.DetailCurve.ByCurve.dyn (Dynamo 3.4.1.7055)

views = Views("Partition Type - CMU")
number_slider = DoubleSlider(5, range=0..100 step 0.1)
byCoordinates = Point.ByCoordinates(x=number_slider, y=number_slider)
byCoordinates_2 = Point.ByCoordinates()
byStartPointEndPoint = Line.ByStartPointEndPoint(startPoint=byCoordinates, endPoint=byCoordinates_2)
byCurve = DetailCurve.ByCurve(view=views, curve=byStartPointEndPoint)
curve = DetailCurve.Curve(detailCurve=byCurve)
parameters = Element.Parameters(element=byCurve)
