# Dynamo graph Revit.Elements.DetailCurve.Curve.dyn (Dynamo 3.4.1.7055)

views = Views("L1")
number_slider = DoubleSlider(20, range=0..100 step 0.1)
byCoordinates = Point.ByCoordinates(x=number_slider, y=number_slider)
byCoordinates_2 = Point.ByCoordinates()
byStartPointEndPoint = Line.ByStartPointEndPoint(startPoint=byCoordinates, endPoint=byCoordinates_2)
byCurve = DetailCurve.ByCurve(view=views, curve=byStartPointEndPoint)
curve = DetailCurve.Curve(detailCurve=byCurve)
levels = Levels("L1 - Block 37")
levels_2 = Levels("L2")
wall_types = WallTypes("Generic - 12\"")
byCurveAndLevels = Wall.ByCurveAndLevels(curve=curve, startLevel=levels, endLevel=levels_2, wallType=wall_types)
parameters = Element.Parameters(element=byCurveAndLevels)
