# Dynamo graph Revit.Elements.DetailCurve.SetCurve.dyn (Dynamo 3.4.1.7055)

views = Views("Partition Type - CMU")
number_slider = DoubleSlider(1.5, range=0..100 step 0.1)
byCoordinates = Point.ByCoordinates(x=number_slider, y=number_slider)
byCoordinates_2 = Point.ByCoordinates()
byStartPointEndPoint = Line.ByStartPointEndPoint(startPoint=byCoordinates, endPoint=byCoordinates_2)
byCurve = DetailCurve.ByCurve(view=views, curve=byStartPointEndPoint)
number_slider_2 = DoubleSlider(2.75, range=0..100 step 0.1)
byCoordinates_3 = Point.ByCoordinates(x=number_slider_2, y=number_slider_2)
byCoordinates_4 = Point.ByCoordinates()
byStartPointEndPoint_2 = Line.ByStartPointEndPoint(startPoint=byCoordinates_3, endPoint=byCoordinates_4)
setCurve = DetailCurve.SetCurve(detailCurve=byCurve, curve=byStartPointEndPoint_2)
