# Dynamo graph Revit.Elements.Dimension.ByEdges.dyn (Dynamo 3.4.1.7055)

# group: Select View L1 on Sheet A101
element_classes = ElementTypes("View")
all_elements_of_class = ElementsOfType(element_class=element_classes)
string = StringInput("Sheet Number")
getParameterValueByName = Element.GetParameterValueByName(element=all_elements_of_class, parameterName=string)
string_2 = StringInput("A101")
allIndicesOf = List.AllIndicesOf(list=getParameterValueByName, item=string_2)
getItemAtIndex = List.GetItemAtIndex(list=all_elements_of_class, index=allIndicesOf)
string_3 = StringInput("Title on Sheet")
getParameterValueByName_2 = Element.GetParameterValueByName(element=getItemAtIndex, parameterName=string_3)
string_4 = StringInput("L1 Floor Plan")
allIndicesOf_2 = List.AllIndicesOf(list=getParameterValueByName_2, item=string_4)
getItemAtIndex_2 = List.GetItemAtIndex(list=getItemAtIndex, index=allIndicesOf_2)

select_edges = SelectEdges()  # 4 picked in the model
select_edge = DSEdgeSelection()  # 1 picked in the model
number = DoubleInput(-1)
byCoordinates = Vector.ByCoordinates(y=number)
number_2 = DoubleInput(3)
translate = Geometry.Translate(geometry=select_edge, direction=byCoordinates, distance=number_2)
string_5 = StringInput("Dynamo")
byEdges = Dimension.ByEdges(view=getItemAtIndex_2, referenceCurves=select_edges, line=translate, suffix=string_5, prefix=string_5)
prefix = Dimension.Prefix(dimension=byEdges)
value = Dimension.Value(dimension=byEdges)
