# Dynamo graph Revit.Elements.Dimension.ByElementDirection.dyn (Dynamo 3.4.1.7055)

# group: Selects View L1 on Sheet A101
element_classes = ElementTypes("View")
all_elements_of_class = ElementsOfType(element_class=element_classes)
string = StringInput("Sheet Number")
getParameterValueByName = Element.GetParameterValueByName(element=all_elements_of_class, parameterName=string)
string_2 = StringInput("A101")
allIndicesOf = List.AllIndicesOf(list=getParameterValueByName, item=string_2)
getItemAtIndex = List.GetItemAtIndex(list=all_elements_of_class, index=allIndicesOf)
string_3 = StringInput("Title on Sheet")
getParameterValueByName_2 = Element.GetParameterValueByName(element=getItemAtIndex, parameterName=string_3)
string_4 = StringInput("L1 Floor Plan")
allIndicesOf_2 = List.AllIndicesOf(list=getParameterValueByName_2, item=string_4)
getItemAtIndex_2 = List.GetItemAtIndex(list=getItemAtIndex, index=allIndicesOf_2)

select_model_element = DSModelElementSelection()  # 1 picked in the model
getLocation = Element.GetLocation(element=select_model_element)
direction = Line.Direction(line=getLocation)
string_5 = StringInput("Dynamo")
byElementDirection = Dimension.ByElementDirection(view=getItemAtIndex_2, element=select_model_element, direction=direction, suffix=string_5, prefix=string_5)
prefix = Dimension.Prefix(dimension=byElementDirection)
value = Dimension.Value(dimension=byElementDirection)
