# Dynamo graph Revit.Elements.Dimension.ByElements.dyn (Dynamo 2.18.1.5096)

categories = Categories("OST_Grids")
current = Document.Current()
activeView = Document.ActiveView(document=current)
all_elements_of_category_in_view = ElementsOfCategoryInView(Category=categories, View=activeView)
curve = Grid.Curve(grid=all_elements_of_category_in_view)
direction = Line.Direction(line=curve)
groupByKey = List.GroupByKey(list=all_elements_of_category_in_view, keys=direction)
number = DoubleInput(0)
getItemAtIndex = List.GetItemAtIndex(list=groupByKey.groups, index=number)
curve_2 = Grid.Curve(grid=getItemAtIndex)
byElements = Dimension.ByElements(view=activeView, referenceElements=getItemAtIndex)
