# Dynamo graph Revit.Elements.Dimension.ByReferences.dyn (Dynamo 3.6.2.11575)
# Demonstration of Dimension.ByReferences node - Creates dimension annotations in Revit by measuring between geometric references. Shows the complete workflow from creating geometry to generating Revit dimensions.

number = DoubleInput(10)
number_2 = DoubleInput(0)
number_3 = DoubleInput(0)
byCoordinates = Point.ByCoordinates(x=number, y=number_2, z=number_3)
number_4 = DoubleInput(10)
number_5 = DoubleInput(10)
number_6 = DoubleInput(0)
byCoordinates_2 = Point.ByCoordinates(x=number_4, y=number_5, z=number_6)
byStartPointEndPoint = Line.ByStartPointEndPoint(startPoint=byCoordinates, endPoint=byCoordinates_2)
number_7 = DoubleInput(0)
number_8 = DoubleInput(10)
number_9 = DoubleInput(0)
byCoordinates_3 = Point.ByCoordinates(x=number_7, y=number_8, z=number_9)
number_10 = DoubleInput(0)
number_11 = DoubleInput(0)
number_12 = DoubleInput(0)
byCoordinates_4 = Point.ByCoordinates(x=number_10, y=number_11, z=number_12)
byStartPointEndPoint_2 = Line.ByStartPointEndPoint(startPoint=byCoordinates_3, endPoint=byCoordinates_4)
views = Views("L1")
byStartPointEndPoint_3 = Line.ByStartPointEndPoint(startPoint=byCoordinates_4, endPoint=byCoordinates)
byCurve = ModelCurve.ByCurve(curve=byStartPointEndPoint_3)
curve = CurveElement.Curve(curveElement=byCurve)
byCurve_2 = Revit.GeometryReferences.ElementCurveReference.ByCurve(curve=curve)
byStartPointEndPoint_4 = Line.ByStartPointEndPoint(startPoint=byCoordinates_2, endPoint=byCoordinates_3)
byCurve_3 = ModelCurve.ByCurve(curve=byStartPointEndPoint_4)
curve_2 = CurveElement.Curve(curveElement=byCurve_3)
byCurve_4 = Revit.GeometryReferences.ElementCurveReference.ByCurve(curve=curve_2)
list_create = List.Create(item0=byCurve_2, item1=byCurve_4)
byStartPointEndPoint_5 = Line.ByStartPointEndPoint(startPoint=byCoordinates_4, endPoint=byCoordinates_2)
string = StringInput("Horizontal")
string_2 = StringInput("ft")
byReferences = Dimension.ByReferences(view=views, referenceGeometries=list_create, line=byStartPointEndPoint_5, suffix=string, prefix=string_2)
