# Dynamo graph Revit.Elements.Dimension.SetAboveValue.dyn (Dynamo 2.18.1.5096)

categories = Categories("OST_Dimensions")
current = Document.Current()
activeView = Document.ActiveView(document=current)
all_elements_of_category_in_view = ElementsOfCategoryInView(Category=categories, View=activeView)

# group: Generate Letter Sequence Based on Dimension Count
string = StringInput("A")
aboveValue = Dimension.AboveValue(dimension=all_elements_of_category_in_view)
count = List.Count(list=aboveValue)
number = DoubleInput(1)
sequence = Sequence(start=string, amount=count, step=number)

setAboveValue = Dimension.SetAboveValue(dimension=all_elements_of_category_in_view, value=sequence)
