# Dynamo graph Revit.Elements.Dimension.SetValueOverride.dyn (Dynamo 2.18.1.5096)

categories = Categories("OST_Dimensions")
current = Document.Current()
activeView = Document.ActiveView(document=current)
all_elements_of_category_in_view = ElementsOfCategoryInView(Category=categories, View=activeView)
firstItem = List.FirstItem(list=all_elements_of_category_in_view)
string = StringInput("CHECK")
setValueOverride = Dimension.SetValueOverride(dimension=firstItem, values=string)
