# Dynamo graph Revit.Elements.Dimension.Suffix.dyn (Dynamo 2.18.1.5096)

categories = Categories("OST_Dimensions")
current = Document.Current()
activeView = Document.ActiveView(document=current)
all_elements_of_category_in_view = ElementsOfCategoryInView(Category=categories, View=activeView)
suffix = Dimension.Suffix(dimension=all_elements_of_category_in_view)
