# Dynamo graph Revit.Elements.Dimension.ValueOverride.dyn (Dynamo 2.18.1.5096)

categories = Categories("OST_Dimensions")
current = Document.Current()
activeView = Document.ActiveView(document=current)
all_elements_of_category_in_view = ElementsOfCategoryInView(Category=categories, View=activeView)
firstItem = List.FirstItem(list=all_elements_of_category_in_view)
valueOverride = Dimension.ValueOverride(dimension=firstItem)
string = StringInput("")
ne = valueOverride != string
filterByBoolMask = List.FilterByBoolMask(list=firstItem, mask=ne)
string_2 = StringInput("")
setValueOverride = Dimension.SetValueOverride(dimension=filterByBoolMask.in, values=string_2)
