# Dynamo graph Revit.Elements.DimensionType.StyleType.dyn (Dynamo 2.18.1.5096)

element_classes = ElementTypes("DimensionType")
all_elements_of_class = ElementsOfType(element_class=element_classes)
firstItem = List.FirstItem(list=all_elements_of_class)
styleType = DimensionType.StyleType(dimensionType=firstItem)
name = Element.Name(element=firstItem)
