# Dynamo graph Revit.Elements.DirectShape.ByGeometry.dyn (Dynamo 3.3.0.6316)

# note: Select "Simple Dome" from Design Option
select_face = DSFaceSelection()  # 1 picked in the model
integer_slider = IntegerSlider(8, range=4..20 step 1)
integer_slider_2 = IntegerSlider(4, range=4..20 step 1)
byCrossSplitSquares = PanelSurface.ByCrossSplitSquares(surface=select_face, numU=integer_slider, numV=integer_slider_2)
getPanelPolygon = PanelSurface.GetPanelPolygon(panelSurface=byCrossSplitSquares)
byPatch = Surface.ByPatch(closedCurve=getPanelPolygon)
byJoinedSurfaces = PolySurface.ByJoinedSurfaces(surfaces=byPatch)
categories = Categories("OST_Roofs")
string = StringInput("Aluminum")
byName = Material.ByName(name=string)
byGeometry = DirectShape.ByGeometry(geometry=byJoinedSurfaces, category=categories, material=byName)
