# Dynamo graph Revit.Elements.DirectShape.ByMesh.dyn (Dynamo 3.4.1.7055)

select_model_element = DSModelElementSelection()  # 1 picked in the model
geometry = Element.Geometry(element=select_model_element)
categories = Categories("OST_FurnitureSystems")
string = StringInput("Default")
byName = Material.ByName(name=string)
string_2 = StringInput("DynamoDirectSHape ")
name = Element.Name(element=select_model_element)
add = string_2 + name
byMesh = DirectShape.ByMesh(mesh=geometry, category=categories, material=byName, name=add)
type = Object.Type(object=geometry)
