# Dynamo graph Revit.Elements.DividedPath.ByCurveAndDivisions.dyn (Dynamo 3.4.1.7055)

byCoordinates = Point.ByCoordinates()
number_slider = DoubleSlider(10, range=0..100 step 0.1)
byCoordinates_2 = Point.ByCoordinates(x=number_slider)
byStartPointEndPoint = Line.ByStartPointEndPoint(startPoint=byCoordinates, endPoint=byCoordinates_2)
byCurve = ModelCurve.ByCurve(curve=byStartPointEndPoint)
integer_slider = IntegerSlider(4, range=0..100 step 1)
byCurveAndDivisions = DividedPath.ByCurveAndDivisions(curve=byCurve, divisions=integer_slider)
points = DividedPath.Points(dividedPath=byCurveAndDivisions)
