# Dynamo graph Revit.Elements.DividedPath.ByCurvesAndDivisions.dyn (Dynamo 3.4.1.7055)

byCoordinates = Point.ByCoordinates()
number_slider = DoubleSlider(10, range=0..100 step 0.1)
byCoordinates_2 = Point.ByCoordinates(x=number_slider)
byStartPointEndPoint = Line.ByStartPointEndPoint(startPoint=byCoordinates, endPoint=byCoordinates_2)
byCurve = ModelCurve.ByCurve(curve=byStartPointEndPoint)
byCoordinates_3 = Point.ByCoordinates()
number_slider_2 = DoubleSlider(10, range=0..100 step 0.1)
byCoordinates_4 = Point.ByCoordinates(y=number_slider_2)
byStartPointEndPoint_2 = Line.ByStartPointEndPoint(startPoint=byCoordinates_3, endPoint=byCoordinates_4)
byCurve_2 = ModelCurve.ByCurve(curve=byStartPointEndPoint_2)
list_create = List.Create(item0=byCurve, item1=byCurve_2)
integer_slider = IntegerSlider(10, range=0..100 step 1)
byCurvesAndDivisions = DividedPath.ByCurvesAndDivisions(curve=list_create, divisions=integer_slider)
points = DividedPath.Points(dividedPath=byCurvesAndDivisions)
