# Dynamo graph Revit.Elements.DividedSurface.ByFaceAndUVDivisions.dyn (Dynamo 3.4.1.7055)

select_face = DSFaceSelection()  # 1 picked in the model
integer_slider = IntegerSlider(10, range=0..100 step 1)
integer_slider_2 = IntegerSlider(20, range=0..100 step 1)
byFaceAndUVDivisions = DividedSurface.ByFaceAndUVDivisions(elementFace=select_face, uDivs=integer_slider, vDivs=integer_slider_2)
geometry = Element.Geometry(element=byFaceAndUVDivisions)
rotation = DividedSurface.Rotation(dividedSurface=byFaceAndUVDivisions)
VDivisions = DividedSurface.VDivisions(dividedSurface=byFaceAndUVDivisions)
UDivisions = DividedSurface.UDivisions(dividedSurface=byFaceAndUVDivisions)
number_slider = DoubleSlider(1, range=0..90 step 1)
