# Dynamo graph Revit.Elements.DividedSurface.VDivisions.dyn (Dynamo 3.4.1.7055)

select_face = DSFaceSelection()  # 1 picked in the model
integer_slider = IntegerSlider(10, range=0..100 step 1)
integer_slider_2 = IntegerSlider(20, range=0..100 step 1)
number_slider = DoubleSlider(1, range=0..90 step 1)
byFaceUVDivisionsAndRotation = DividedSurface.ByFaceUVDivisionsAndRotation(surface=select_face, uDivs=integer_slider, vDivs=integer_slider_2, gridRotation=number_slider)
geometry = Element.Geometry(element=byFaceUVDivisionsAndRotation)
rotation = DividedSurface.Rotation(dividedSurface=byFaceUVDivisionsAndRotation)
VDivisions = DividedSurface.VDivisions(dividedSurface=byFaceUVDivisionsAndRotation)
UDivisions = DividedSurface.UDivisions(dividedSurface=byFaceUVDivisionsAndRotation)
