# Dynamo graph Revit.Elements.Element.AreJoined.dyn (Dynamo 2.18.1.5096)

select_model_element = DSModelElementSelection()  # 1 picked in the model
select_model_element_2 = DSModelElementSelection()  # 1 picked in the model
areJoined = Element.AreJoined(element=select_model_element, otherElement=select_model_element_2)
list_create = List.Create(item0=select_model_element, item1=select_model_element_2)
geometry = Element.Geometry(element=list_create)
watch_3d = Watch3D(geometry)
