# Dynamo graph Revit.Elements.Element.BoundingBox.dyn (Dynamo 2.18.1.5096)

# group: Collect
# Collect all elements at L1 - Block 35 and Filter for Family Instances
levels = Levels("L1 - Block 35")
all_elements_at_level = ElementsAtLevel(Level=levels)
string = StringInput("Revit.Elements.FamilyInstance")
removeIfNot = List.RemoveIfNot(list=all_elements_at_level, type=string)

# group: Collect
# Collect all family instances of the given family type.
family_types = FamilyTypes("Chair-Breuer:Chair-Breuer")
all_elements_of_family_type = ElementsOfFamilyType(Family_Type=family_types)

# group: Select
# Only select family instances of the given family type on L1 - Block 35
setIntersection = List.SetIntersection(list1=removeIfNot, list2=all_elements_of_family_type)

# group: Extract Axis-Aligned Bounding Box
boundingBox = Element.BoundingBox(element=setIntersection)
toCuboid = BoundingBox.ToCuboid(boundingBox=boundingBox)

watch_3d = Watch3D(toCuboid)

# group: Extract Non-Axis-Aligned Bounding Box
solids = Element.Solids(element=setIntersection)
byMinimumVolume = BoundingBox.ByMinimumVolume(geom=solids)
toCuboid_2 = BoundingBox.ToCuboid(boundingBox=byMinimumVolume)

watch_3d_2 = Watch3D(toCuboid_2)
