# Dynamo graph Revit.Elements.Element.Curves.dyn (Dynamo 3.2.1.5366)

all_warnings_of_type = AllWarningsOfType("""A wall and a space separation line overlap. One of them may be ignored 
when Revit finds space boundaries. Shorten or delete the space 
separation line to remove the overlap. """)
getFailingElements = Warning.GetFailingElements(warning=all_warnings_of_type)
lastItem = List.LastItem(list=getFailingElements@L2)
curves = Element.Curves(element=lastItem)
firstItem = List.FirstItem(list=getFailingElements@L2)
solids = Element.Solids(element=firstItem)
watch_3d = Watch3D(curves, solids)
