# Dynamo graph Revit.Elements.Element.Delete.dyn (Dynamo 2.18.1.5096)

family_types = FamilyTypes("Help Button:Select for Help Link")
all_elements_of_family_type = ElementsOfFamilyType(Family_Type=family_types)
delete = Element.Delete(element=all_elements_of_family_type)
