# Dynamo graph Revit.Elements.Element.ElementFaceReferences.dyn (Dynamo 3.2.1.5366)

categories = Categories("OST_Walls")
views = Views("L1")
all_elements_of_category_in_view = ElementsOfCategoryInView(Category=categories, View=views)
elementFaceReferences = Element.ElementFaceReferences(element=all_elements_of_category_in_view)
