# Dynamo graph Revit.Elements.Element.Faces.dyn (Dynamo 3.2.1.5366)

categories = Categories("OST_Walls")
views = Views("Residential Lobby - South")
all_elements_of_category_in_view = ElementsOfCategoryInView(Category=categories, View=views)
string = StringInput("Revit.Elements.Wall")
# note: Removes in place families
removeIfNot = List.RemoveIfNot(list=all_elements_of_category_in_view, type=string)
faces = Element.Faces(element=removeIfNot)
watch_3d = Watch3D(faces)
