# Dynamo graph Revit.Elements.Element.Geometry.dyn (Dynamo 2.18.1.5096)

categories = Categories("OST_Walls")
all_elements_of_category = ElementsOfCategory(Category=categories)
geometry = Element.Geometry(element=all_elements_of_category)
