# Dynamo graph Revit.Elements.Element.GetCategory.dyn (Dynamo 3.2.1.5366)

# group: Update this input
# Update this input with a unique selection from the current Revit document
pick_model_elements = DSModelElementMultipleSelection()  # 2338 picked in the model

getCategory = Element.GetCategory(element=pick_model_elements)
name = Category.Name(category=getCategory)
categories = Categories("OST_Doors")
name_2 = Category.Name(category=categories)
eq = name == name_2
filterByBoolMask = List.FilterByBoolMask(list=pick_model_elements, mask=eq)
watch = Watch(filterByBoolMask.in)
