# Dynamo graph Revit.Elements.Element.GetChildElements.dyn (Dynamo 3.4.1.7055)

categories = Categories("OST_StairsRailing")
all_elements_of_category = ElementsOfCategory(Category=categories)
getChildElements = Element.GetChildElements(element=all_elements_of_category)
