# Dynamo graph Revit.Elements.Element.GetHostedElements.dyn (Dynamo 2.18.1.5096)

# group: Collect Walls of Type
# Collect all walls and filter based on a selected type
categories = Categories("OST_Walls")
all_elements_of_category = ElementsOfCategory(Category=categories)
elementType = Element.ElementType(element=all_elements_of_category)
id = Element.Id(element=elementType)
wall_types = WallTypes("Interior - 4 7/8\" Partition (NR)")
id_2 = Element.Id(element=wall_types)
eq = id == id_2
filterByBoolMask = List.FilterByBoolMask(list=all_elements_of_category, mask=eq)

boolean = BoolSelector(true)
getHostedElements = Element.GetHostedElements(element=filterByBoolMask.in, includeOpenings=boolean, includeEmbeddedWalls=boolean)
