# Dynamo graph Revit.Elements.Element.GetIntersectingElementsOfCategory.dyn (Dynamo 2.18.1.5096)

categories = Categories("OST_Floors")
current = Document.Current()
activeView = Document.ActiveView(document=current)
all_elements_of_category_in_view = ElementsOfCategoryInView(Category=categories, View=activeView)
categories_2 = Categories("OST_Columns")
getIntersectingElementsOfCategory = Element.GetIntersectingElementsOfCategory(element=all_elements_of_category_in_view, category=categories_2)
