# Dynamo graph Revit.Elements.Element.GetLocation.dyn (Dynamo 2.18.1.5096)

categories = Categories("OST_Furniture")
all_elements_of_category = ElementsOfCategory(Category=categories)
getLocation = Element.GetLocation(element=all_elements_of_category)
