# Dynamo graph Revit.Elements.Element.GetParameterValueByName.dyn (Dynamo 2.18.1.5096)

categories = Categories("OST_Doors")
all_elements_of_category = ElementsOfCategory(Category=categories)
string = StringInput("Mark")
getParameterValueByName = Element.GetParameterValueByName(element=all_elements_of_category, parameterName=string)
