# Dynamo graph Revit.Elements.Element.GetParentElement.dyn (Dynamo 2.18.1.5096)

family_types = FamilyTypes("Chair-Breuer:Chair-Breuer")
all_elements_of_family_type = ElementsOfFamilyType(Family_Type=family_types)
getParentElement = Element.GetParentElement(element=all_elements_of_family_type)
# note: Grouped by Parent Element
groupByKey = List.GroupByKey(list=all_elements_of_family_type, keys=getParentElement)
