# Dynamo graph Revit.Elements.Element.IsHiddeninView.dyn (Dynamo 2.18.1.5096)

categories = Categories("OST_Windows")
all_elements_of_category = ElementsOfCategory(Category=categories)
views = Views("North Wall Window Detail")
isHiddeninView = Element.IsHiddeninView(element=all_elements_of_category, view=views)
# note: If this shows true, part of the model has been hidden in this detail view.
anyTrue = List.AnyTrue(list=isHiddeninView)
