# Dynamo graph Revit.Elements.Element.IsPinned.dyn (Dynamo 3.2.1.5366)

element_classes = ElementTypes("RevitLinkInstance")
all_elements_of_class = ElementsOfType(element_class=element_classes)
isPinned = Element.IsPinned(element=all_elements_of_class)
