# Dynamo graph Revit.Elements.Element.JoinGeometry.dyn (Dynamo 2.18.1.5096)

select_model_element = DSModelElementSelection()  # 1 picked in the model
select_model_element_2 = DSModelElementSelection()  # 1 picked in the model
joinGeometry = Element.JoinGeometry(element=select_model_element, otherElement=select_model_element_2)
areJoined = Element.AreJoined(element=select_model_element, otherElement=select_model_element_2)
