# Dynamo graph Revit.Elements.Element.MoveByVector.dyn (Dynamo 2.18.1.5096)

select_model_element = DSModelElementSelection()  # 1 picked in the model
start = Revit.Transaction.Transaction.Start(input=select_model_element)
getLocation = Element.GetLocation(element=select_model_element)
number = DoubleInput(-2)
translate = Geometry.Translate(geometry=getLocation, yTranslation=number)
byTwoPoints = Vector.ByTwoPoints(start=getLocation, end=translate)
moveByVector = Element.MoveByVector(element=start, vector=byTwoPoints)
geometry = Element.Geometry(element=select_model_element)
