# Dynamo graph Revit.Elements.Element.Name.dyn (Dynamo 2.18.1.5096)

categories = Categories("OST_Walls")
all_elements_of_category = ElementsOfCategory(Category=categories)
name = Element.Name(element=all_elements_of_category)
groupByKey = List.GroupByKey(list=all_elements_of_category, keys=name)
watch = Watch(groupByKey.groups)
watch_2 = Watch(groupByKey.uniqueKeys)
