# Dynamo graph Revit.Elements.Element.OverrideColorInView.dyn (Dynamo 2.18.1.5096)

all_warnings_of_type = AllWarningsOfType("""Highlighted walls overlap. One of them may be ignored when Revit 
finds room boundaries. Use Cut Geometry to embed one wall within 
the other. """)
getFailingElements = Warning.GetFailingElements(warning=all_warnings_of_type)
color_palette = ColorPalette({R: 255, G: 0, B: 0, A: 255})
overrideColorInView = Element.OverrideColorInView(element=getFailingElements, color=color_palette)
