# Dynamo graph Revit.Elements.Element.OverrideInView.dyn (Dynamo 3.2.1.5366)

categories = Categories("OST_Doors")
views = Views("L1")
all_elements_of_category_in_view = ElementsOfCategoryInView(Category=categories, View=views)
string = StringInput("Fire Rating")

# group: Get Wall Fire Rating
# Get the host wall, the wall type and the fire rating parameter value
getHost = FamilyInstance.GetHost(familyInstance=all_elements_of_category_in_view)
elementType = Element.ElementType(element=getHost)
getParameterValueByName = Element.GetParameterValueByName(element=elementType, parameterName=string)

# group: Get Door Fire Rating
# Get the door type and the fire rating
elementType_2 = Element.ElementType(element=all_elements_of_category_in_view)
getParameterValueByName_2 = Element.GetParameterValueByName(element=elementType_2, parameterName=string)

# group: Check if the Values Match
# If the Fire Rating does not match, filter to isolate the doors
eq = getParameterValueByName == getParameterValueByName_2
filterByBoolMask = List.FilterByBoolMask(list=all_elements_of_category_in_view, mask=eq)

doors_to_review = Watch(filterByBoolMask.in)
color_palette = ColorPalette({R: 255, G: 0, B: 0, A: 255})
byProperties = Revit.Filter.OverrideGraphicSettings.ByProperties(cutFillColor=color_palette, projectionFillColor=color_palette, cutLineColor=color_palette, projectionLineColor=color_palette)
overrideInView = Element.OverrideInView(element=doors_to_review, overrides=byProperties)
