# Dynamo graph Revit.Elements.Element.Parameters.dyn (Dynamo 3.2.1.5366)

categories = Categories("OST_Doors")
all_elements_of_category = ElementsOfCategory(Category=categories)
firstItem = List.FirstItem(list=all_elements_of_category)
# note: Instance Parameters
parameters = Element.Parameters(element=firstItem)
elementType = Element.ElementType(element=firstItem)
# note: Type Parameters
parameters_2 = Element.Parameters(element=elementType)
