# Dynamo graph Revit.Elements.Element.SetGeometryJoinOrder.dyn (Dynamo 3.4.1.7055)

select_model_element = DSModelElementSelection()  # 1 picked in the model
name = Element.Name(element=select_model_element)
select_model_element_2 = DSModelElementSelection()  # 1 picked in the model
name_2 = Element.Name(element=select_model_element_2)
setGeometryJoinOrder = Element.SetGeometryJoinOrder(cuttingElement=select_model_element, otherElement=select_model_element_2)
name_3 = Element.Name(element=setGeometryJoinOrder)
