# Dynamo graph Revit.Elements.Element.SetLocation.dyn (Dynamo 3.4.1.7055)

select_model_element = DSModelElementSelection()  # 1 picked in the model
getLocation = Element.GetLocation(element=select_model_element)
number_slider = DoubleSlider(100, range=0..100 step 0.1)
translate = Geometry.Translate(geometry=getLocation, xTranslation=number_slider, yTranslation=number_slider)
setLocation = Element.SetLocation(element=select_model_element, geometry=translate)
