# Dynamo graph Revit.Elements.Element.SetParameterByName.dyn (Dynamo 2.18.1.5096)

# group: Collect
# Collect all furniture from the model
categories = Categories("OST_Furniture")
all_elements_of_category = ElementsOfCategory(Category=categories)

# note: Obtain the family instance's room. If it is not in a room, return null.
room = FamilyInstance.Room(familyInstance=all_elements_of_category)

# group: Weave Family Instance & Room
# Combine the family instance and related room (or null) into one list for filtering.
list_create = List.Create(item0=all_elements_of_category, item1=room)
transpose = List.Transpose(lists=list_create)

isNull = Object.IsNull(object=room)
# note: in = family instances without rooms
# out = family instances with rooms
filterByBoolMask = List.FilterByBoolMask(list=transpose, mask=isNull)

# group: Split List into Family Instances and Rooms
transpose_2 = List.Transpose(lists=filterByBoolMask.out)
code_block = CodeBlock(value=transpose_2) { familyInstances = value[0]; rooms = value[1]; }

string = StringInput("Comments")
name = Room.Name(room=code_block.rooms)
setParameterByName = Element.SetParameterByName(element=code_block.familyInstances, parameterName=string, value=name)
