# Dynamo graph Revit.Elements.Element.SetPinnedStatus.dyn (Dynamo 2.18.1.5096)

categories = Categories("OST_Furniture")
all_elements_of_category = ElementsOfCategory(Category=categories)
boolean = BoolSelector(true)
setPinnedStatus = Element.SetPinnedStatus(element=all_elements_of_category, pinned=boolean)
