# Dynamo graph Revit.Elements.Element.Solids.dyn (Dynamo 3.2.1.5366)

categories = Categories("OST_Walls")
views = Views("Residential Lobby - South")
all_elements_of_category_in_view = ElementsOfCategoryInView(Category=categories, View=views)
string = StringInput("Revit.Elements.Wall")
# note: Removes in place families
removeIfNot = List.RemoveIfNot(list=all_elements_of_category_in_view, type=string)
solids = Element.Solids(element=removeIfNot)

# group: Optional Union of Solids
# Optional method to return a single solid for the given elements
boolean = BoolSelector(false)
clean = List.Clean(list=solids, preserveIndices=boolean)
byUnion = Solid.ByUnion(solids=clean)

watch_3d = Watch3D(solids)
