# Dynamo graph Revit.Elements.Element.UniqueId.dyn (Dynamo 2.18.1.5096)

categories = Categories("OST_Walls")
all_elements_of_category = ElementsOfCategory(Category=categories)
uniqueId = Element.UniqueId(element=all_elements_of_category)

# group: Weave Lists
# Combine the Wall element with it's unique id
list_create = List.Create(item0=uniqueId, item1=all_elements_of_category)
transpose = List.Transpose(lists=list_create)
