# Dynamo graph Revit.Elements.Element.UnjoinGeometry.dyn (Dynamo 3.2.1.5366)

select_model_element_by_category = DSModelElementByCategorySelection("OST_Floors")  # 1 picked in the model; graph input
getJoinedElements = Element.GetJoinedElements(element=select_model_element_by_category)
unjoinGeometry = Element.UnjoinGeometry(element=select_model_element_by_category, otherElement=getJoinedElements)
