# Dynamo graph Revit.Elements.ElementType.CanBeDeleted.dyn (Dynamo 2.18.1.5096)

element_classes = ElementTypes("ViewPlan")
all_elements_of_class = ElementsOfType(element_class=element_classes)
isViewTemplate = View.IsViewTemplate(view=all_elements_of_class)
filterByBoolMask = List.FilterByBoolMask(list=all_elements_of_class, mask=isViewTemplate)
floor_plans = Watch(filterByBoolMask.out)
elementType = Element.ElementType(element=floor_plans)
canBeDeleted = ElementType.CanBeDeleted(elementType=elementType)
filterByBoolMask_2 = List.FilterByBoolMask(list=elementType, mask=canBeDeleted)
can_be_deleted = Watch(filterByBoolMask_2.in)
cannot_be_deleted = Watch(filterByBoolMask_2.out)
