# Dynamo graph Revit.Elements.ElementType.CanBeRenamed.dyn (Dynamo 2.18.1.5096)

categories = Categories("OST_Floors")
all_elements_of_category = ElementsOfCategory(Category=categories)
elementType = Element.ElementType(element=all_elements_of_category)
canBeRenamed = ElementType.CanBeRenamed(elementType=elementType)
