# Dynamo graph Revit.Elements.ElementType.FamilyName.dyn (Dynamo 3.2.1.5366)

categories = Categories("OST_Walls")
all_elements_of_category = ElementsOfCategory(Category=categories)
elementType = Element.ElementType(element=all_elements_of_category)
familyName = ElementType.FamilyName(elementType=elementType)
