# Dynamo graph Revit.Elements.ElementType.GetPreviewImage.dyn (Dynamo 2.18.1.5096)

categories = Categories("OST_Furniture")
all_elements_of_category = ElementsOfCategory(Category=categories)
elementType = Element.ElementType(element=all_elements_of_category)
uniqueItems = List.UniqueItems(list=elementType)
getPreviewImage = ElementType.GetPreviewImage(elementType=uniqueItems)
integer_slider = IntegerSlider(1, range=0..100 step 1)
getItemAtIndex = List.GetItemAtIndex(list=getPreviewImage, index=integer_slider)
watch_image = WatchImageCore(image=getItemAtIndex)
