# Dynamo graph Revit.Elements.ElevationMarker.CreateElevationByMarkerIndex.dyn (Dynamo 3.4.1.7055)

view_family_types = ViewFamilyTypes("Interior Elevation")
number_slider = DoubleSlider(-70, range=-80..100 step 0.1)
number_slider_2 = DoubleSlider(5, range=0..100 step 0.1)
byCoordinates = Point.ByCoordinates(x=number_slider, y=number_slider_2)
number = DoubleInput(4)
byViewTypeLocation = ElevationMarker.ByViewTypeLocation(viewFamilyType=view_family_types, location=byCoordinates, initialViewScale=number)
views = Views("L1")
number_2 = DoubleInput(1)
number_3 = DoubleInput(2)
join = List.Join(list0=number_2, list1=number_3)
createElevationByMarkerIndex = ElevationMarker.CreateElevationByMarkerIndex(elevationMarker=byViewTypeLocation, planView=views, index=join)
