# Dynamo graph Revit.Elements.ElevationMarker.CurrentViewCount.dyn (Dynamo 3.4.1.7055)

element_classes = ElementTypes("ElevationMarker")
all_elements_of_class = ElementsOfType(element_class=element_classes)
currentViewCount = ElevationMarker.CurrentViewCount(elevationMarker=all_elements_of_class)
