# Dynamo graph Revit.Elements.ElevationMarker.GetView.dyn (Dynamo 3.4.1.7055)

element_classes = ElementTypes("ElevationMarker")
all_elements_of_class = ElementsOfType(element_class=element_classes)
currentViewCount = ElevationMarker.CurrentViewCount(elevationMarker=all_elements_of_class)
number = DoubleInput(0)
number_2 = DoubleInput(1)
number_3 = DoubleInput(2)
number_4 = DoubleInput(3)
join = List.Join(list0=number, list1=number_2, list2=number_3, list3=number_4)
getView = ElevationMarker.GetView(elevationMarker=all_elements_of_class, index=join, lacing=CrossProduct)
