# Dynamo graph Revit.Elements.FailureMessage.Severity.dyn (Dynamo 3.4.1.7055)

performance_adviser_rules = PerformanceAdviserRules("View clipping is disabled")  # graph input
execute = PerformanceAdviserRule.Execute(rules=performance_adviser_rules)
severity = FailureMessage.Severity(failureMessage=execute)
