# Dynamo graph Revit.Elements.Family.FamilyDocument.dyn (Dynamo 3.2.1.5366)

string = StringInput("Door-Passage-Single-Flush")
byName = Family.ByName(name=string)
familyDocument = Family.FamilyDocument(family=byName)
types = FamilyDocument.Types(familyDocument=familyDocument)
