# Dynamo graph Revit.Elements.Family.Name.dyn (Dynamo 3.2.1.5366)

element_classes = ElementTypes("Family")
all_elements_of_class = ElementsOfType(element_class=element_classes)
name = Family.Name(family=all_elements_of_class)
