# Dynamo graph Revit.Elements.FamilyInstance.ByCoordinateSystem.dyn (Dynamo 3.4.1.7055)

string = StringInput("TableWithUmbrella")
byName = FamilyType.ByName(name=string)
number = DoubleInput(100)
byOrigin = CoordinateSystem.ByOrigin(x=number, y=number)
byCoordinateSystem = FamilyInstance.ByCoordinateSystem(familyType=byName, coordinateSystem=byOrigin)
