# Dynamo graph Revit.Elements.FamilyInstance.ByCoordinates.dyn (Dynamo 3.3.0.6316)

family_types = FamilyTypes("RPC Male:Alex")
number_slider = DoubleSlider(3, range=0..100 step 0.1)
number_slider_2 = DoubleSlider(8, range=0..100 step 0.1)
number_slider_3 = DoubleSlider(12, range=0..100 step 0.1)
byCoordinates = FamilyInstance.ByCoordinates(familyType=family_types, x=number_slider, y=number_slider_2, z=number_slider_3)
