# Dynamo graph Revit.Elements.FamilyInstance.ByFace.dyn (Dynamo 3.4.1.7055)

code_block = CodeBlock { "150W - 120V"; }
byName = FamilyType.ByName(name=code_block)
select_face = DSFaceSelection()  # 1 picked in the model
select_model_element = DSModelElementSelection()  # 1 picked in the model
getLocation = Element.GetLocation(element=select_model_element)
YAxis = Vector.YAxis()
byFace = FamilyInstance.ByFace(familyType=byName, face=select_face, location=getLocation, referenceDirection=YAxis)
