# Dynamo graph Revit.Elements.FamilyInstance.ByHostAndPoint.dyn (Dynamo 3.4.1.7055)

string = StringInput("36\" x 84\" (Roof)")
byName = FamilyType.ByName(name=string)
# note: Selected Wall
select_model_element = DSModelElementSelection()  # 1 picked in the model
getLocation = Element.GetLocation(element=select_model_element)
number = DoubleInput(0)
pointAtParameter = Curve.PointAtParameter(curve=getLocation, param=number)
byHostAndPoint = FamilyInstance.ByHostAndPoint(familyType=byName, host=select_model_element, point=pointAtParameter)
