# Dynamo graph Revit.Elements.FamilyInstance.ByPointAndLevel.dyn (Dynamo 3.4.1.7055)

string = StringInput("TableWithUmbrella")
byName = FamilyType.ByName(name=string)
number = DoubleInput(100)
byCoordinates = Point.ByCoordinates(x=number, y=number)
levels = Levels("L1 - Block 35")
byPointAndLevel = FamilyInstance.ByPointAndLevel(familyType=byName, point=byCoordinates, level=levels)
