# Dynamo graph Revit.Elements.FamilyInstance.FacingOrientation.dyn (Dynamo 3.2.1.5366)

categories = Categories("OST_Doors")
current = Document.Current()
activeView = Document.ActiveView(document=current)
all_elements_of_category_in_view = ElementsOfCategoryInView(Category=categories, View=activeView)
facingOrientation = FamilyInstance.FacingOrientation(familyInstance=all_elements_of_category_in_view)
