# Dynamo graph Revit.Elements.FamilyInstance.Location.dyn (Dynamo 3.2.1.5366)

categories = Categories("OST_Doors")
current = Document.Current()
activeView = Document.ActiveView(document=current)
all_elements_of_category_in_view = ElementsOfCategoryInView(Category=categories, View=activeView)
location = FamilyInstance.Location(familyInstance=all_elements_of_category_in_view)
