# Dynamo graph Revit.Elements.FamilyInstance.SetRotation.dyn (Dynamo 3.2.1.5366)

categories = Categories("OST_Entourage")
all_elements_of_category = ElementsOfCategory(Category=categories)
count = List.Count(list=all_elements_of_category)
number = DoubleInput(0)
number_2 = DoubleInput(360)
integer_slider = IntegerSlider(1, range=0..100 step 1)
randomList = Math.RandomList(amount=count, value1=number, value2=number_2, seed=integer_slider)
setRotation = FamilyInstance.SetRotation(familyInstance=all_elements_of_category, degree=randomList)
