# Dynamo graph Revit.Elements.FamilyParameter.CanAssignFormula.dyn (Dynamo 3.2.1.5366)

current = Document.Current()
byDocument = FamilyDocument.ByDocument(document=current)
parameters = FamilyDocument.Parameters(familyDocument=byDocument)
canAssignFormula = FamilyParameter.CanAssignFormula(familyParameter=parameters)
