# Dynamo graph Revit.Elements.FamilyParameter.GroupType.dyn (Dynamo 2.18.1.5096)

current = Document.Current()
byDocument = FamilyDocument.ByDocument(document=current)
parameters = FamilyDocument.Parameters(familyDocument=byDocument)
groupType = FamilyParameter.GroupType(familyParameter=parameters)
