# Dynamo graph Revit.Elements.FamilyParameter.Id.dyn (Dynamo 3.2.1.5366)

current = Document.Current()
byDocument = FamilyDocument.ByDocument(document=current)
parameters = FamilyDocument.Parameters(familyDocument=byDocument)
id = FamilyParameter.Id(familyParameter=parameters)
