# Dynamo graph Revit.Elements.FamilyParameter.IsShared.dyn (Dynamo 3.2.1.5366)

current = Document.Current()
byDocument = FamilyDocument.ByDocument(document=current)
parameters = FamilyDocument.Parameters(familyDocument=byDocument)
name = FamilyParameter.Name(familyParameter=parameters)
isShared = FamilyParameter.IsShared(familyParameter=parameters)

# group: Combine into Sublists
# Combine the parameter name and the read only state to sublists
list_create = List.Create(item0=name, item1=isShared)
transpose = List.Transpose(lists=list_create)
