# Dynamo graph Revit.Elements.FamilyParameter.SpecType.dyn (Dynamo 3.4.1.7055)

# group: Gets all Element Classes
element_classes = ElementTypes("FamilyInstance")
all_elements_of_class = ElementsOfType(element_class=element_classes)

# group: Filters elements so that only 1 unique item is selected
name = Element.Name(element=all_elements_of_class)
uniqueItems = List.UniqueItems(list=name)
allIndicesOf = List.AllIndicesOf(list=name, item=uniqueItems)
firstItem = List.FirstItem(list=allIndicesOf@L2)
getItemAtIndex = List.GetItemAtIndex(list=all_elements_of_class, index=firstItem)

# group: Use slider to select a different element
integer_slider = IntegerSlider(65, range=0..279 step 1)
getItemAtIndex_2 = List.GetItemAtIndex(list=getItemAtIndex, index=integer_slider)

# group: Get FamilyParameter.SpecType
getFamily = FamilyInstance.GetFamily(familyInstance=getItemAtIndex_2)
familyDocument = Family.FamilyDocument(family=getFamily)
parameters = FamilyDocument.Parameters(familyDocument=familyDocument)
specType = FamilyParameter.SpecType(familyParameter=parameters)
watch = Watch(specType)
name_2 = Element.Name(element=getItemAtIndex_2)
watch_2 = Watch(name_2)
