# Dynamo graph Revit.Elements.FamilyParameter.StorageType.dyn (Dynamo 2.18.1.5096)

current = Document.Current()
byDocument = FamilyDocument.ByDocument(document=current)
parameters = FamilyDocument.Parameters(familyDocument=byDocument)
storageType = FamilyParameter.StorageType(familyParameter=parameters)
