# Dynamo graph Revit.Elements.FamilyType.ByFamilyAndName.dyn (Dynamo 3.2.1.5366)

string = StringInput("Door-Passage-Single-Flush")  # graph input
byName = Family.ByName(name=string)
string_2 = StringInput("36\" x 84\"")  # graph input
byFamilyAndName = FamilyType.ByFamilyAndName(family=byName, name=string_2)
