# Dynamo graph Revit.Elements.FamilyType.ByFamilyNameAndTypeName.dyn (Dynamo 3.2.1.5366)

string = StringInput("Door-Passage-Single-Flush")  # graph input
string_2 = StringInput("36\" x 84\"")  # graph input
byFamilyNameAndTypeName = FamilyType.ByFamilyNameAndTypeName(familyName=string, typeName=string_2)
