# Dynamo graph Revit.Elements.FamilyType.ByGeometry.dyn (Dynamo 3.4.1.7055)

number_slider = DoubleSlider(42.5, range=0..100 step 0.1)
number_slider_2 = DoubleSlider(49.9, range=0..100 step 0.1)
number_slider_3 = DoubleSlider(60.5, range=0..100 step 0.1)
byCoordinates = Point.ByCoordinates(x=number_slider, y=number_slider_2, z=number_slider_3)
number_slider_4 = DoubleSlider(42.3, range=0..100 step 0.1)
number_slider_5 = DoubleSlider(25, range=0..100 step 0.1)
number_slider_6 = DoubleSlider(0.25, range=0..100 step 0.1)
byLengths = Cuboid.ByLengths(origin=byCoordinates, width=number_slider_4, length=number_slider_5, height=number_slider_6)
string = StringInput("DynamoFamilyTypeByGeometry")
categories = Categories("OST_GenericModel")
file_path = Filename("C:\ProgramData\Autodesk\RVT 2026\Family Templates\English-Imperial\Generic Model.rft")
string_2 = StringInput("Grass")
byName = Material.ByName(name=string_2)
string_3 = StringInput("DynamoFloor")
byGeometry = FamilyType.ByGeometry(solidGeometry=byLengths, name=string, category=categories, templatePath=file_path, material=byName, subcategory=string_3)
number_slider_7 = DoubleSlider(21.7, range=0..100 step 0.1)
number_slider_8 = DoubleSlider(42.5, range=0..100 step 0.1)
number_slider_9 = DoubleSlider(60.5, range=0..100 step 0.1)
byCoordinates_2 = Point.ByCoordinates(x=number_slider_7, y=number_slider_8, z=number_slider_9)
byPoint = FamilyInstance.ByPoint(familyType=byGeometry, point=byCoordinates_2)
watch_3d = Watch3D(byLengths)
