# Dynamo graph Revit.Elements.FamilyType.Name.dyn (Dynamo 3.2.1.5366)

categories = Categories("OST_Doors")
current = Document.Current()
activeView = Document.ActiveView(document=current)
all_elements_of_category_in_view = ElementsOfCategoryInView(Category=categories, View=activeView)
elementType = Element.ElementType(element=all_elements_of_category_in_view)
name = FamilyType.Name(familyType=elementType)
groupByKey = List.GroupByKey(list=all_elements_of_category_in_view, keys=name)
watch = Watch(groupByKey.groups)
