# Dynamo graph Revit.Elements.FamilyType.VoidByGeometry.dyn (Dynamo 3.4.1.7055)

number_slider = DoubleSlider(42.5, range=0..100 step 0.1)
number_slider_2 = DoubleSlider(49.9, range=0..100 step 0.1)
number_slider_3 = DoubleSlider(60.5, range=0..100 step 0.1)
byCoordinates = Point.ByCoordinates(x=number_slider, y=number_slider_2, z=number_slider_3)
number_slider_4 = DoubleSlider(42.3, range=0..100 step 0.1)
number_slider_5 = DoubleSlider(25, range=0..100 step 0.1)
number_slider_6 = DoubleSlider(43.1, range=0..100 step 0.1)
byLengths = Cuboid.ByLengths(origin=byCoordinates, width=number_slider_4, length=number_slider_5, height=number_slider_6)
string = StringInput("DynamoFamilyTypeByVoidGeometry")
categories = Categories("OST_GenericModel")
file_path = Filename("C:\ProgramData\Autodesk\RVT 2026\Family Templates\English-Imperial\Generic Model.rft")
voidByGeometry = FamilyType.VoidByGeometry(solidGeometry=byLengths, name=string, category=categories, templatePath=file_path)
number_slider_7 = DoubleSlider(21.7, range=0..100 step 0.1)
number_slider_8 = DoubleSlider(39, range=0..100 step 0.1)
number_slider_9 = DoubleSlider(38.6, range=0..100 step 0.1)
byCoordinates_2 = Point.ByCoordinates(x=number_slider_7, y=number_slider_8, z=number_slider_9)
byPoint = FamilyInstance.ByPoint(familyType=voidByGeometry, point=byCoordinates_2)
watch_3d = Watch3D(byLengths)
