# Dynamo graph Revit.Elements.FillPatternElement.GetByName.dyn (Dynamo 3.3.0.6316)

string = StringInput("<Solid Fill>")
fill_pattern_targets = FillPatternTargets("Drafting")
getByName = FillPatternElement.GetByName(name=string, fillPatternTarget=fill_pattern_targets)
