# Dynamo graph Revit.Elements.FilledRegion.ByCurves.dyn (Dynamo 3.2.1.5366)

string = StringInput("Sample Drafting View")
byName = DraftingView.ByName(name=string)
byWidthLength = Rectangle.ByWidthLength()
explode = Geometry.Explode(geometry=byWidthLength)
select_filled_region_type = FilledRegionTypes("Diagonal Down")
byCurves = FilledRegion.ByCurves(view=byName, boundary=explode, regionType=select_filled_region_type)
