# Dynamo graph Revit.Elements.FilledRegionType.Color.dyn (Dynamo 3.2.1.5366)

string = StringInput("Diagonal Down")
byName = FilledRegionType.ByName(name=string)
color = FilledRegionType.Color(filledRegionType=byName)
