# Dynamo graph Revit.Elements.Floor.ByOutlineTypeAndLevel.dyn (Dynamo 3.4.1.7055)

number_slider = DoubleSlider(10, range=0..100 step 0.1)
byWidthLength = Rectangle.ByWidthLength(width=number_slider, length=number_slider)
floor_types = FloorTypes("Generic - 12\"")
levels = Levels("Level 1")
byOutlineTypeAndLevel = Floor.ByOutlineTypeAndLevel(outlineCurves=byWidthLength, floorType=floor_types, level=levels)
