# Dynamo graph Revit.Elements.FloorType.GetStructuralMaterial.dyn (Dynamo 3.2.1.5366)

categories = Categories("OST_Floors")
all_elements_of_category = ElementsOfCategory(Category=categories)
name = Element.Name(element=all_elements_of_category)
byName = FloorType.ByName(name=name)
# note: Group Floors by Type
groupByKey = List.GroupByKey(list=all_elements_of_category, keys=byName)
floor_types_used = Watch(groupByKey.uniqueKeys)
getStructuralMaterial = FloorType.GetStructuralMaterial(floorType=floor_types_used)
