# Dynamo graph Revit.Elements.FloorType.Name.dyn (Dynamo 3.2.1.5366)

element_classes = ElementTypes("FloorType")
all_elements_of_class = ElementsOfType(element_class=element_classes)
name = FloorType.Name(floorType=all_elements_of_class)
