# Dynamo graph Revit.Elements.Form.ByLoftCrossSections.dyn (Dynamo 3.4.1.7055)

number = DoubleInput(10)
number_2 = DoubleInput(0)
number_3 = DoubleInput(10)
number_4 = DoubleInput(0)
list_create = List.Create(item0=number, item1=number_2, item2=number_3, item3=number_4)
byCoordinates = Point.ByCoordinates(z=list_create)
number_5 = DoubleInput(20)
number_6 = DoubleInput(0)
number_7 = DoubleInput(20)
number_8 = DoubleInput(0)
list_create_2 = List.Create(item0=number_5, item1=number_6, item2=number_7, item3=number_8)
translate = Geometry.Translate(geometry=byCoordinates@L1, xTranslation=list_create_2)
number_9 = DoubleInput(4)
number_10 = DoubleInput(8)
number_11 = DoubleInput(4)
number_12 = DoubleInput(8)
list_create_3 = List.Create(item0=number_9, item1=number_10, item2=number_11, item3=number_12)
byCenterPointRadius = Circle.ByCenterPointRadius(centerPoint=translate, radius=list_create_3)
transpose = List.Transpose(lists=byCenterPointRadius)
byCurve = ModelCurve.ByCurve(curve=transpose)
elementCurveReferences = Element.ElementCurveReferences(element=byCurve@L2)
boolean = BoolSelector(true)
byLoftCrossSections = Form.ByLoftCrossSections(curves=elementCurveReferences, isSolid=boolean)
