# Dynamo graph Revit.Elements.GlobalParameter.FindByName.dyn (Dynamo 3.2.1.5366)

string = StringInput("Windows_North Elevation Inset")
findByName = GlobalParameter.FindByName(name=string)
value = GlobalParameter.Value(globalParameter=findByName)
