# Dynamo graph Revit.Elements.Grid.ByArc.dyn (Dynamo 3.4.1.7055)

number_slider = DoubleSlider(0, range=0..100 step 0.1)
number_slider_2 = DoubleSlider(0, range=0..100 step 0.1)
number_slider_3 = DoubleSlider(0, range=0..100 step 0.1)
byCoordinates = Point.ByCoordinates(x=number_slider, y=number_slider_2, z=number_slider_3)
number_slider_4 = DoubleSlider(30, range=0..50 step 0.1)
number_slider_5 = DoubleSlider(100, range=0..100 step 0.1)
number_slider_6 = DoubleSlider(300, range=0..300 step 0.1)
ZAxis = Vector.ZAxis()
byCenterPointRadiusAngle = Arc.ByCenterPointRadiusAngle(center=byCoordinates, radius=number_slider_4, startAngle=number_slider_5, endAngle=number_slider_6, normal=ZAxis)
byArc = Grid.ByArc(arc=byCenterPointRadiusAngle)
