# Dynamo graph Revit.Elements.Grid.ByLine.dyn (Dynamo 3.4.1.7055)

integer_slider = IntegerSlider(-150, range=-150..100 step 1)
integer_slider_2 = IntegerSlider(0, range=0..100 step 1)
integer_slider_3 = IntegerSlider(0, range=0..100 step 1)
byCoordinates = Point.ByCoordinates(x=integer_slider, y=integer_slider_2, z=integer_slider_3)
XAxis = Vector.XAxis()
integer_slider_4 = IntegerSlider(150, range=0..150 step 1)
byStartPointDirectionLength = Line.ByStartPointDirectionLength(startPoint=byCoordinates, direction=XAxis, length=integer_slider_4)
byLine = Grid.ByLine(line=byStartPointDirectionLength)
