# Dynamo graph Revit.Elements.Grid.ByStartPointEndPoint.dyn (Dynamo 3.4.1.7055)

number = DoubleInput(-150)
byCoordinates = Point.ByCoordinates(x=number)
number_2 = DoubleInput(100)
byCoordinates_2 = Point.ByCoordinates(x=number_2)
byStartPointEndPoint = Grid.ByStartPointEndPoint(start=byCoordinates, end=byCoordinates_2)
string = StringInput("Name")
string_2 = StringInput("Dynamo")
setParameterByName = Element.SetParameterByName(element=byStartPointEndPoint, parameterName=string, value=string_2)
name = Element.Name(element=setParameterByName)
