# Dynamo graph Revit.Elements.Grid.Curve.dyn (Dynamo 2.18.1.5096)

categories = Categories("OST_Grids")
current = Document.Current()
activeView = Document.ActiveView(document=current)
all_elements_of_category_in_view = ElementsOfCategoryInView(Category=categories, View=activeView)
curve = Grid.Curve(grid=all_elements_of_category_in_view)
