# Dynamo graph Revit.Elements.Grid.ElementCurveReference.dyn (Dynamo 3.4.1.7055)

element_classes = ElementTypes("Grid")
all_elements_of_class = ElementsOfType(element_class=element_classes)
elementCurveReference = Grid.ElementCurveReference(grid=all_elements_of_class)
