# Dynamo graph Revit.Elements.Group.ByElements.dyn (Dynamo 3.4.1.7055)

select_model_element = DSModelElementSelection()  # 1 picked in the model
select_model_element_2 = DSModelElementSelection()  # 1 picked in the model
join = List.Join(list0=select_model_element, list1=select_model_element_2)
byElements = Group.ByElements(elements=join)
