# Dynamo graph Revit.Elements.Group.GetMembers.dyn (Dynamo 3.2.1.5366)

categories = Categories("OST_IOSModelGroups")
all_elements_of_category = ElementsOfCategory(Category=categories)
getMembers = Group.GetMembers(group=all_elements_of_category)
