# Dynamo graph Revit.Elements.Group.IsAttached.dyn (Dynamo 3.4.1.7055)

categories = Categories("OST_IOSModelGroups")
all_elements_of_category = ElementsOfCategory(Category=categories)
isAttached = Group.IsAttached(group=all_elements_of_category)
