# Dynamo graph Revit.Elements.Group.PlaceInstance.dyn (Dynamo 3.4.1.7055)

number = DoubleInput(100)
byCoordinates = Point.ByCoordinates(x=number, y=number)
categories = Categories("OST_IOSModelGroups")
all_elements_of_category = ElementsOfCategory(Category=categories)
groupType = Group.GroupType(group=all_elements_of_category)
firstItem = List.FirstItem(list=groupType)
placeInstance = Group.PlaceInstance(location=byCoordinates, groupType=firstItem)
