# Dynamo graph Revit.Elements.GroupType.ByTypeId.dyn (Dynamo 3.6.2.11575)

string = StringInput("autodesk.parameter.group:adskModelProperties-1.0.0")
string_2 = StringInput("autodesk.parameter.group:text-1.0.0")
string_3 = StringInput("autodesk.parameter.group:constraints-1.0.0")
string_4 = StringInput("autodesk.parameter.group:data-1.0.0")
list_create = List.Create(item0=string, item1=string_2, item2=string_3, item3=string_4)
byTypeId = GroupType.ByTypeId(typeId=list_create)

# group: GroupType.ByTypeId (this is grouping of parameters). use this only
# I have no idea what to use this output for.  also seems like forgeType. is the only input allowed.  Not Element ID.  see ChatGPT notes, it seems like its confused about what can be input.  the agent agrees that its Forge only
group_types = GroupTypes("autodesk.parameter.group:adskModelProperties")
typeId = ForgeType.TypeId(forgeType=group_types)

toString = Element.ToString()  # unwired: element, format, formatProvider
categories = Categories("OST_IOSModelGroups")
all_elements_of_category = ElementsOfCategory(Category=categories)
id = Element.Id(element=all_elements_of_category)
string_from_object = FromObject(object=id)
group_types_2 = GroupTypes("autodesk.revit.group:energyAnalysisBuildingData")
