# Dynamo graph Revit.Elements.Level.ByLevelOffsetAndName.dyn (Dynamo 3.2.1.5366)

categories = Categories("OST_Levels")
all_elements_of_category = ElementsOfCategory(Category=categories)
elevation = Level.Elevation(level=all_elements_of_category)
sortByKey = List.SortByKey(list=all_elements_of_category, keys=elevation)
# note: Get the highest level
lastItem = List.LastItem(list=sortByKey.sortedList)
number = DoubleInput(10)  # graph input
string = StringInput("T.O. Parapet")
byLevelOffsetAndName = Level.ByLevelOffsetAndName(level=lastItem, offset=number, name=string)
