# Dynamo graph Revit.Elements.Level.Elevation.dyn (Dynamo 3.2.1.5366)

categories = Categories("OST_Levels")
all_elements_of_category = ElementsOfCategory(Category=categories)
elevation = Level.Elevation(level=all_elements_of_category)
sortByKey = List.SortByKey(list=all_elements_of_category, keys=elevation)
