# Dynamo graph Revit.Elements.Level.Name.dyn (Dynamo 3.2.1.5366)

categories = Categories("OST_Levels")
all_elements_of_category = ElementsOfCategory(Category=categories)
name = Level.Name(level=all_elements_of_category)
