# Dynamo graph Revit.Elements.LinkElement.ByRayBounce.dyn (Dynamo 3.4.1.7055)

select_model_element = DSModelElementSelection()  # 1 picked in the model
getLocation = Element.GetLocation(element=select_model_element)
startPoint = Curve.StartPoint(curve=getLocation)
XAxis = Vector.XAxis()
integer_slider = IntegerSlider(9, range=0..100 step 1)
views = Views("{3D}")
byRayBounce = LinkElement.ByRayBounce(origin=startPoint, direction=XAxis, maxBounces=integer_slider, view=views)
