# Dynamo graph Revit.Elements.LinkElement.GetGeometry.dyn (Dynamo 3.2.1.5366)

string = StringInput("Snowdon Towers Sample Site")
byTitle = LinkInstance.ByTitle(title=string)
categories = Categories("OST_Walls")
allElementsOfCategory = LinkInstance.AllElementsOfCategory(linkInstance=byTitle, category=categories)
getGeometry = LinkElement.GetGeometry(linkedElement=allElementsOfCategory)
watch_3d = Watch3D(getGeometry)
