# Dynamo graph Revit.Elements.LinkElement.GetLocation.dyn (Dynamo 3.2.1.5366)

string = StringInput("Snowdon Towers Sample Site")
byTitle = LinkInstance.ByTitle(title=string)
categories = Categories("OST_Walls")
allElementsOfCategory = LinkInstance.AllElementsOfCategory(linkInstance=byTitle, category=categories)
getLocation = LinkElement.GetLocation(linkedElement=allElementsOfCategory)
watch_3d = Watch3D(getLocation)
