# Dynamo graph Revit.Elements.LinkElement.LinkTransform.dyn (Dynamo 3.4.1.7055)

categories = Categories("OST_RvtLinks")
all_elements_of_category = ElementsOfCategory(Category=categories)
levels = Levels("L3")
allElementsAtLevel = LinkInstance.AllElementsAtLevel(linkInstance=all_elements_of_category, level=levels)
linkTransform = LinkElement.LinkTransform(linkedElement=allElementsAtLevel)
