# Dynamo graph Revit.Elements.Material.AppearanceParameters.dyn (Dynamo 3.3.0.6316)

string = StringInput("Aluminum")
byName = Material.ByName(name=string)
appearanceParameters = Material.AppearanceParameters(material=byName)
