# Dynamo graph Revit.Elements.Material.CutPatternColor.dyn (Dynamo 3.2.1.5366)

categories = Categories("OST_Materials")
all_elements_of_category = ElementsOfCategory(Category=categories)
cutPatternColor = Material.CutPatternColor(material=all_elements_of_category)
