# Dynamo graph Revit.Elements.Material.CutPatternId.dyn (Dynamo 3.2.1.5366)

categories = Categories("OST_Materials")
all_elements_of_category = ElementsOfCategory(Category=categories)
cutPatternId = Material.CutPatternId(material=all_elements_of_category)
