# Dynamo graph Revit.Elements.Material.MaterialCategory.dyn (Dynamo 3.3.0.6316)

string = StringInput("Aluminum")
byName = Material.ByName(name=string)
materialCategory = Material.MaterialCategory(material=byName)
