# Dynamo graph Revit.Elements.Material.MaterialClass.dyn (Dynamo 3.2.1.5366)

categories = Categories("OST_Materials")
all_elements_of_category = ElementsOfCategory(Category=categories)
materialClass = Material.MaterialClass(material=all_elements_of_category)
