# Dynamo graph Revit.Elements.Material.Name.dyn (Dynamo 3.2.1.5366)

categories = Categories("OST_Materials")
all_elements_of_category = ElementsOfCategory(Category=categories)
name = Material.Name(material=all_elements_of_category)
