# Dynamo graph Revit.Elements.Material.StructuralParameters.dyn (Dynamo 3.3.0.6316)

string = StringInput("Aluminum")
byName = Material.ByName(name=string)
structuralParameters = Material.StructuralParameters(material=byName)
