# Dynamo graph Revit.Elements.Material.ThermalParameters.dyn (Dynamo 3.3.0.6316)

string = StringInput("Aluminum")
byName = Material.ByName(name=string)
thermalParameters = Material.ThermalParameters(material=byName)
