# Dynamo graph Revit.Elements.ModelCurve.ByCurve.dyn (Dynamo 3.4.1.7055)

number_slider = DoubleSlider(20, range=0..100 step 0.1)
byCoordinates = Point.ByCoordinates(y=number_slider)
byCoordinates_2 = Point.ByCoordinates()
byStartPointEndPoint = Line.ByStartPointEndPoint(startPoint=byCoordinates, endPoint=byCoordinates_2)
byCurve = ModelCurve.ByCurve(curve=byStartPointEndPoint)
curves = Element.Curves(element=byCurve)
parameters = Element.Parameters(element=byCurve)
