# Dynamo graph Revit.Elements.ModelCurve.ReferenceCurveByCurve.dyn (Dynamo 3.4.1.7055)

byCoordinates = Point.ByCoordinates()
number_slider = DoubleSlider(20, range=0..100 step 0.1)
byCoordinates_2 = Point.ByCoordinates(x=number_slider, y=number_slider)
byStartPointEndPoint = Line.ByStartPointEndPoint(startPoint=byCoordinates, endPoint=byCoordinates_2)
referenceCurveByCurve = ModelCurve.ReferenceCurveByCurve(curve=byStartPointEndPoint)
parameters = Element.Parameters(element=referenceCurveByCurve)
