# Dynamo graph Revit.Elements.Mullion.LocationCurve.dyn (Dynamo 2.18.1.5096)

number = DoubleInput(1055165)
element_by_id = ElementById(Id=number)
byElement = CurtainPanel.ByElement(hostingElement=element_by_id)
supportingMullions = CurtainPanel.SupportingMullions(curtainPanel=byElement)
locationCurve = Mullion.LocationCurve(mullion=supportingMullions)
