# Dynamo graph Revit.Elements.Mullion.SupportedPanels.dyn (Dynamo 2.18.1.5096)

number = DoubleInput(1055165)
element_by_id = ElementById(Id=number)
byElement = Mullion.ByElement(hostingElement=element_by_id)
supportedPanels = Mullion.SupportedPanels(mullion=byElement)
