# Dynamo graph Revit.Elements.Parameter.CreateSharedParameter.dyn (Dynamo 3.2.1.5366)

string = StringInput("Include in FFE")
string_2 = StringInput("Data")
spec_types = SpecTypes("autodesk.spec:spec.bool")
group_types = GroupTypes("autodesk.revit.group:energyAnalysisBuildingData")
boolean = BoolSelector(true)
categories = Categories("OST_Furniture")
categories_2 = Categories("OST_GenericModel")
list_create = List.Create(item0=categories, item1=categories_2)
createSharedParameter = Parameter.CreateSharedParameter(parameterName=string, groupName=string_2, specType=spec_types, groupType=group_types, instance=boolean, categoryList=list_create)
