# Dynamo graph Revit.Elements.Parameter.CreateSharedParameterForAllCategories.dyn (Dynamo 3.2.1.5366)

string = StringInput("Include in FFE")
string_2 = StringInput("Data")
spec_types = SpecTypes("autodesk.spec:spec.bool")
group_types = GroupTypes("autodesk.revit.group:energyAnalysisBuildingData")
boolean = BoolSelector(true)
createSharedParameterForAllCategories = Parameter.CreateSharedParameterForAllCategories(parameterName=string, groupName=string_2, specType=spec_types, groupType=group_types, instance=boolean)
