# Dynamo graph Revit.Elements.Parameter.ParameterByName.dyn (Dynamo 3.2.1.5366)

categories = Categories("OST_ProjectInformation")
all_elements_of_category = ElementsOfCategory(Category=categories)
string = StringInput("Project Name")
parameterByName = Parameter.ParameterByName(element=all_elements_of_category, name=string)
