# Dynamo graph Revit.Elements.Parameter.SharedParameterFile.dyn (Dynamo 3.2.1.5366)

sharedParameterFile = Parameter.SharedParameterFile()
file_from_path = FileObject(path=sharedParameterFile)
readText = FileSystem.ReadText(file=file_from_path)
watch = Watch(readText)
