# Dynamo graph Revit.Elements.Parameter.SpecType.dyn (Dynamo 3.2.1.5366)

categories = Categories("OST_ProjectInformation")
all_elements_of_category = ElementsOfCategory(Category=categories)
parameters = Element.Parameters(element=all_elements_of_category)
specType = Parameter.SpecType(parameter=parameters)
