# Dynamo graph Revit.Elements.Parameter.StorageType.dyn (Dynamo 3.2.1.5366)

categories = Categories("OST_ProjectInformation")
all_elements_of_category = ElementsOfCategory(Category=categories)
parameters = Element.Parameters(element=all_elements_of_category)
storageType = Parameter.StorageType(parameter=parameters)
