# Dynamo graph Revit.Elements.Parameter.Unit.dyn (Dynamo 3.4.1.7055)

categories = Categories("OST_Columns")
all_elements_of_category = ElementsOfCategory(Category=categories)
parameters = Element.Parameters(element=all_elements_of_category)
unit = Parameter.Unit(parameter=parameters)
