# Dynamo graph Revit.Elements.PathOfTravel.ByFloorPlanPoints.dyn (Dynamo 3.3.0.6316)

views = Views("L1")
categories = Categories("OST_Rooms")
all_elements_of_category_in_view = ElementsOfCategoryInView(Category=categories, View=views)
getLocation = Element.GetLocation(element=all_elements_of_category_in_view)
# note: Select Exit Door
select_model_element_by_category = DSModelElementByCategorySelection("OST_Doors")  # 1 picked in the model
getLocation_2 = Element.GetLocation(element=select_model_element_by_category)
boolean = BoolSelector(false)
byFloorPlanPoints = PathOfTravel.ByFloorPlanPoints(floorPlan=views, startPtsList=getLocation, endPtsList=getLocation_2, manyToMany=boolean, lacing=Longest)
