# Dynamo graph Revit.Elements.PathOfTravel.LongestOfShortestExitPaths.dyn (Dynamo 3.6.2.11575)
# Demonstration of PathOfTravel.LongestOfShortestExitPaths node for analyzing building egress paths and fire safety compliance

number = DoubleInput(0)
byElevation = Level.ByElevation(elevation=number)
byLevel = FloorPlanView.ByLevel(level=byElevation)
number_2 = DoubleInput(0)
number_3 = DoubleInput(0)
number_4 = DoubleInput(0)
byCoordinates = Point.ByCoordinates(x=number_2, y=number_3, z=number_4)
number_5 = DoubleInput(10)
number_6 = DoubleInput(0)
number_7 = DoubleInput(0)
byCoordinates_2 = Point.ByCoordinates(x=number_5, y=number_6, z=number_7)
number_8 = DoubleInput(20)
number_9 = DoubleInput(10)
number_10 = DoubleInput(0)
byCoordinates_3 = Point.ByCoordinates(x=number_8, y=number_9, z=number_10)
list_create = List.Create(item0=byCoordinates, item1=byCoordinates_2, item2=byCoordinates_3)
longestOfShortestExitPaths = PathOfTravel.LongestOfShortestExitPaths(floorPlan=byLevel, endPtsList=list_create)
