# Dynamo graph Revit.Elements.PerformanceAdviserRule.ById.dyn (Dynamo 3.4.1.7055)

performance_adviser_rules = PerformanceAdviserRules("Project contains unused families and types")  # graph input
ruleId = PerformanceAdviserRule.RuleId(performanceAdviserRule=performance_adviser_rules)
string_from_object = FromObject(object=ruleId)
byId = PerformanceAdviserRule.ById(guid=string_from_object)
