# Dynamo graph Revit.Elements.PerformanceAdviserRule.Description.dyn (Dynamo 3.4.1.7055)

performance_adviser_rules = PerformanceAdviserRules("View clipping is disabled")  # graph input
description = PerformanceAdviserRule.Description(performanceAdviserRule=performance_adviser_rules)
watch = Watch(description)
