# Dynamo graph Revit.Elements.PerformanceAdviserRule.Enabled.dyn (Dynamo 3.4.1.7055)

performance_adviser_rules = PerformanceAdviserRules("View clipping is disabled")  # graph input
enabled = PerformanceAdviserRule.Enabled(performanceAdviserRule=performance_adviser_rules)
watch = Watch(enabled)
