# Dynamo graph Revit.Elements.PerformanceAdviserRule.Name.dyn (Dynamo 3.4.1.7055)

performance_adviser_rules = PerformanceAdviserRules("Project contains unused families and types")  # graph input
name = PerformanceAdviserRule.Name(performanceAdviserRule=performance_adviser_rules)
watch = Watch(name)
