# Dynamo graph Revit.Elements.ReferencePlane.ByLine.dyn (Dynamo 3.4.1.7055)

number_slider = DoubleSlider(40, range=0..100 step 0.1)
number_slider_2 = DoubleSlider(-100, range=-100..100 step 0.1)
number_slider_3 = DoubleSlider(0, range=0..100 step 0.1)
byCoordinates = Point.ByCoordinates(x=number_slider, y=number_slider_2, z=number_slider_3)
number_slider_4 = DoubleSlider(-20, range=-20..100 step 0.1)
number_slider_5 = DoubleSlider(100, range=0..100 step 0.1)
number_slider_6 = DoubleSlider(0, range=0..100 step 0.1)
byCoordinates_2 = Point.ByCoordinates(x=number_slider_4, y=number_slider_5, z=number_slider_6)
byStartPointEndPoint = Line.ByStartPointEndPoint(startPoint=byCoordinates, endPoint=byCoordinates_2)
byLine = ReferencePlane.ByLine(line=byStartPointEndPoint)
