# Dynamo graph Revit.Elements.ReferencePlane.ElementPlaneReference.dyn (Dynamo 3.4.1.7055)

number = DoubleInput(40)
number_2 = DoubleInput(-100)
number_3 = DoubleInput(0)
byCoordinates = Point.ByCoordinates(x=number, y=number_2, z=number_3)
number_4 = DoubleInput(-20)
number_5 = DoubleInput(100)
number_6 = DoubleInput(0)
byCoordinates_2 = Point.ByCoordinates(x=number_4, y=number_5, z=number_6)
byStartPointEndPoint = ReferencePlane.ByStartPointEndPoint(start=byCoordinates, end=byCoordinates_2)
elementPlaneReference = ReferencePlane.ElementPlaneReference(referencePlane=byStartPointEndPoint)
