# Dynamo graph Revit.Elements.ReferencePoint.ByPoint.dyn (Dynamo 3.3.0.6316)

number_slider = DoubleSlider(0, range=0..100 step 0.1)
number_slider_2 = DoubleSlider(0, range=0..100 step 0.1)
number_slider_3 = DoubleSlider(1, range=0..100 step 0.1)
byCoordinates = Point.ByCoordinates(x=number_slider, y=number_slider_2, z=number_slider_3)
byPoint = ReferencePoint.ByPoint(pt=byCoordinates)
