# Dynamo graph Revit.Elements.ReferencePoint.XYPlane.dyn (Dynamo 3.3.0.6316)

select_face = DSFaceSelection()  # 1 picked in the model
number_slider = DoubleSlider(0.5, range=0..1 step 0.1)
number_slider_2 = DoubleSlider(0.5, range=0..1 step 0.1)
byParametersOnFaceReference = ReferencePoint.ByParametersOnFaceReference(elementFaceReference=select_face, u=number_slider, v=number_slider_2)
XYPlane = ReferencePoint.XYPlane(referencePoint=byParametersOnFaceReference)
watch_3d = Watch3D(XYPlane)
