# Dynamo graph Revit.Elements.Revision.Issued.dyn (Dynamo 3.4.1.7055)

select_revision = RevitRevisions("Seq. 2 (Issued) - UPDATED CONSULTANT BACKGROUND")
issued = Revision.Issued(revision=select_revision)
watch = Watch(issued)
