# Dynamo graph Revit.Elements.Revision.IssuedBy.dyn (Dynamo 3.4.1.7055)

select_revision = RevitRevisions("Seq. 1 - Revision 1")
issuedBy = Revision.IssuedBy(revision=select_revision)
watch = Watch(issuedBy)
