# Dynamo graph Revit.Elements.Revision.IssuedTo.dyn (Dynamo 3.4.1.7055)

select_revision = RevitRevisions("Seq. 1 - Revision 1")
issuedTo = Revision.IssuedTo(revision=select_revision)
watch = Watch(issuedTo)
