# Dynamo graph Revit.Elements.Revision.RevisionDate.dyn (Dynamo 3.4.1.7055)

select_revision = RevitRevisions("Seq. 2 (Issued) - UPDATED CONSULTANT BACKGROUND")
revisionDate = Revision.RevisionDate(revision=select_revision)
watch = Watch(revisionDate)
