# Dynamo graph Revit.Elements.Revision.SetIssued.dyn (Dynamo 3.4.1.7055)

select_revision = RevitRevisions("Seq. 1 - Revision 1")
boolean = BoolSelector(true)
setIssued = Revision.SetIssued(revision=select_revision, value=boolean)
