# Dynamo graph Revit.Elements.Revision.SetIssuedBy.dyn (Dynamo 3.4.1.7055)

select_revision = RevitRevisions("Seq. 1 - Revision 1")
string = StringInput("ABC")
setIssuedBy = Revision.SetIssuedBy(revision=select_revision, value=string)
