# Dynamo graph Revit.Elements.Revision.SetIssuedTo.dyn (Dynamo 3.4.1.7055)

select_revision = RevitRevisions("Seq. 1 - Revision 1")
string = StringInput("XYZ")
setIssuedTo = Revision.SetIssuedTo(revision=select_revision, value=string)
