# Dynamo graph Revit.Elements.Revision.SetRevisionDate.dyn (Dynamo 3.4.1.7055)

select_revision = RevitRevisions("Seq. 1 - Revision 1")
string = StringInput("8/31/2025")
setRevisionDate = Revision.SetRevisionDate(revision=select_revision, value=string)
