# Dynamo graph Revit.Elements.RevisionCloud.Curves.dyn (Dynamo 3.4.1.7055)

views = Views("First Floor Plan")
number_slider = DoubleSlider(20, range=0..100 step 0.1)
number_slider_2 = DoubleSlider(40, range=0..100 step 0.1)
byWidthLength = Rectangle.ByWidthLength(width=number_slider, length=number_slider_2)
explode = Geometry.Explode(geometry=byWidthLength)
reverse = Curve.Reverse(curve=explode)
select_revision = RevitRevisions("Seq. 2 - Not For Construction")
byCurve = RevisionCloud.ByCurve(view=views, curves=reverse, revision=select_revision)
curves = RevisionCloud.Curves(revisionCloud=byCurve)
