# Dynamo graph Revit.Elements.Roof.ByOutlineTypeAndLevel.dyn (Dynamo 3.4.1.7055)

number_slider = DoubleSlider(10, range=0..100 step 0.1)
byWidthLength = Rectangle.ByWidthLength(width=number_slider, length=number_slider)
roof_types = RoofTypes("Generic - 12\"")
levels = Levels("Green Roof Hardscape")
byOutlineTypeAndLevel = Roof.ByOutlineTypeAndLevel(outline=byWidthLength, roofType=roof_types, level=levels)
string = StringInput("Base Offset From Level")
number_slider_2 = DoubleSlider(10, range=0..100 step 0.1)
setParameterByName = Element.SetParameterByName(element=byOutlineTypeAndLevel, parameterName=string, value=number_slider_2)
