# Dynamo graph Revit.Elements.Roof.Points.dyn (Dynamo 3.4.1.7055)

categories = Categories("OST_Roofs")
all_elements_of_category = ElementsOfCategory(Category=categories)
points = Roof.Points(roof=all_elements_of_category)
