# Dynamo graph Revit.Elements.RoofType.GetThermalProperties.dyn (Dynamo 3.3.0.6316)

string = StringInput("Generic - 9\"")
byName = RoofType.ByName(name=string)
getThermalProperties = RoofType.GetThermalProperties(roofType=byName)
