# Dynamo graph Revit.Elements.Room.Area.dyn (Dynamo 3.2.1.5366)

categories = Categories("OST_Rooms")
all_elements_of_category = ElementsOfCategory(Category=categories)
area = Room.Area(room=all_elements_of_category)
