# Dynamo graph Revit.Elements.Room.ByLocation.dyn (Dynamo 3.4.1.7055)

# group: Locate elements on specific level and point (use these points for Room.ByLocation)
levels = Levels("L1 - Block 35")
family_types = FamilyTypes("Wheel Chair Circle:Wheel Chair Circle")
all_elements_of_family_type = ElementsOfFamilyType(Family_Type=family_types)
string = StringInput("Level")
getParameterValueByName = Element.GetParameterValueByName(element=all_elements_of_family_type, parameterName=string)
name = Element.Name(element=getParameterValueByName)
name_2 = Element.Name(element=levels)
allIndicesOf = List.AllIndicesOf(list=name, item=name_2)
getItemAtIndex = List.GetItemAtIndex(list=all_elements_of_family_type, index=allIndicesOf)
location = FamilyInstance.Location(familyInstance=getItemAtIndex)

# group: Create room and see output of Room name and number
string_2 = StringInput("DynRm")
string_3 = StringInput("10x")
byLocation = Room.ByLocation(level=levels, location=location, name=string_2, number=string_3)
string_4 = StringInput("Number")
getParameterValueByName_2 = Element.GetParameterValueByName(element=byLocation, parameterName=string_4)
watch = Watch(getParameterValueByName_2)
string_5 = StringInput("Name")
getParameterValueByName_3 = Element.GetParameterValueByName(element=byLocation, parameterName=string_5)
watch_2 = Watch(getParameterValueByName_3)
