# Dynamo graph Revit.Elements.Room.CenterBoundary.dyn (Dynamo 2.18.1.5096)

categories = Categories("OST_Rooms")
all_elements_of_category = ElementsOfCategory(Category=categories)
integer_slider = IntegerSlider(11, range=0..100 step 1)
getItemAtIndex = List.GetItemAtIndex(list=all_elements_of_category, index=integer_slider)

# group: Background
centerBoundary = Room.CenterBoundary(room=getItemAtIndex)
color_palette = ColorPalette({R: 0, G: 128, B: 254, A: 255})
byGeometryColor = Modifiers.GeometryColor.ByGeometryColor(geometry=centerBoundary, color=color_palette)

# group: Background
coreBoundary = Room.CoreBoundary(room=getItemAtIndex)
color_palette_2 = ColorPalette({R: 46, G: 204, B: 3, A: 255})
byGeometryColor_2 = Modifiers.GeometryColor.ByGeometryColor(geometry=coreBoundary, color=color_palette_2)

# group: Background
finishBoundary = Room.FinishBoundary(room=getItemAtIndex)
color_palette_3 = ColorPalette({R: 255, G: 127, B: 1, A: 255})
byGeometryColor_3 = Modifiers.GeometryColor.ByGeometryColor(geometry=finishBoundary, color=color_palette_3)
