# Dynamo graph Revit.Elements.Room.Height.dyn (Dynamo 3.2.1.5366)

categories = Categories("OST_Rooms")
all_elements_of_category = ElementsOfCategory(Category=categories)
height = Room.Height(room=all_elements_of_category)
