# Dynamo graph Revit.Elements.Room.IsInsideRoom.dyn (Dynamo 3.3.0.6316)

categories = Categories("OST_Furniture")
all_elements_of_category = ElementsOfCategory(Category=categories)
categories_2 = Categories("OST_Rooms")
all_elements_of_category_2 = ElementsOfCategory(Category=categories_2)

# group: Check Points in Rooms
# Using List@Level, check if the furniture locations occur in any of the given rooms
getLocation = Element.GetLocation(element=all_elements_of_category)
isInsideRoom = Room.IsInsideRoom(room=all_elements_of_category_2, point=getLocation@L1)
boolean = BoolSelector(true)
indexOf = List.IndexOf(list=isInsideRoom@L2, element=boolean)

isNull = Object.IsNull(object=indexOf)

# group: Filter
# Filter furniture that a room cannot be found for
# note: in = no rooms found
filterByBoolMask = List.FilterByBoolMask(list=all_elements_of_category, mask=isNull)
filterByBoolMask_2 = List.FilterByBoolMask(list=indexOf, mask=isNull)

# group: Return Rooms for Furniture
# Get the room for the furniture location and combine into sublists
getItemAtIndex = List.GetItemAtIndex(list=all_elements_of_category_2, index=filterByBoolMask_2.out)
list_create = List.Create(item0=filterByBoolMask.out, item1=getItemAtIndex)
# note: Furniture grouped with found room
transpose = List.Transpose(lists=list_create)
