# Dynamo graph Revit.Elements.Room.SetNumber.dyn (Dynamo 3.2.1.5366)

categories = Categories("OST_Rooms")
views = Views("L1")
all_elements_of_category_in_view = ElementsOfCategoryInView(Category=categories, View=views)
number = Room.Number(room=all_elements_of_category_in_view)
string = StringInput("e")
add = number + string
setNumber = Room.SetNumber(room=all_elements_of_category_in_view, value=add)
