# Dynamo graph Revit.Elements.ScheduleOnSheet.BySheetScheduleLocation.dyn (Dynamo 3.4.1.7055)

sheets = Sheets("Cover")
views = Views("Analytical Surfaces")
number_slider = DoubleSlider(0.25, range=0..100 step 0.25)
number_slider_2 = DoubleSlider(1.25, range=0..100 step 0.25)
byCoordinates = Point.ByCoordinates(x=number_slider, y=number_slider_2)
bySheetScheduleLocation = ScheduleOnSheet.BySheetScheduleLocation(sheet=sheets, scheduleView=views, location=byCoordinates)
location = ScheduleOnSheet.Location(scheduleOnSheet=bySheetScheduleLocation)
sheet = ScheduleOnSheet.Sheet(scheduleOnSheet=bySheetScheduleLocation)
sheetName = Sheet.SheetName(sheet=sheet)
