# Dynamo graph Revit.Elements.ScheduleOnSheet.SetLocation.dyn (Dynamo 3.4.1.7055)

sheets = Sheets("Cover")
views = Views("Analytical Surfaces")
number_slider = DoubleSlider(0.25, range=0..100 step 0.25)
number_slider_2 = DoubleSlider(1.25, range=0..100 step 0.25)
byCoordinates = Point.ByCoordinates(x=number_slider, y=number_slider_2)
bySheetScheduleLocation = ScheduleOnSheet.BySheetScheduleLocation(sheet=sheets, scheduleView=views, location=byCoordinates)
number_slider_3 = DoubleSlider(0.2, range=0..100 step 0.1)
byCoordinates_2 = Point.ByCoordinates(x=number_slider_3, y=number_slider_2)
setLocation = ScheduleOnSheet.SetLocation(scheduleOnSheet=bySheetScheduleLocation, point=byCoordinates_2)
location = ScheduleOnSheet.Location(scheduleOnSheet=setLocation)
