# Dynamo graph Revit.Elements.SketchPlane.ElementPlaneReference.dyn (Dynamo 3.4.1.7055)

number_slider = DoubleSlider(1, range=0..100 step 0.1)
number_slider_2 = DoubleSlider(1, range=0..100 step 0.1)
number_slider_3 = DoubleSlider(1, range=0..100 step 0.1)
byCoordinates = Vector.ByCoordinates(x=number_slider, y=number_slider_2, z=number_slider_3)
byOriginNormal = Plane.ByOriginNormal(normal=byCoordinates)
byPlane = SketchPlane.ByPlane(plane=byOriginNormal)
elementPlaneReference = SketchPlane.ElementPlaneReference(sketchPlane=byPlane)
