# Dynamo graph Revit.Elements.SketchPlane.Plane.dyn (Dynamo 2.18.1.5096)

current = Document.Current()
activeView = Document.ActiveView(document=current)
sketchPlane = View.SketchPlane(view=activeView)
plane = SketchPlane.Plane(sketchPlane=sketchPlane)
