# Dynamo graph Revit.Elements.Space.ByLevelLocation.dyn (Dynamo 3.4.1.7055)

levels = Levels("L1 - Block 35")
select_model_element = DSModelElementSelection()  # 1 picked in the model
location = FamilyInstance.Location(familyInstance=select_model_element)
string = StringInput("Dynamo Space")
string_2 = StringInput("DYN01")
byLevelLocation = Space.ByLevelLocation(level=levels, location=location, name=string, number=string_2)
