# Dynamo graph Revit.Elements.Space.CoreBoundary.dyn (Dynamo 3.2.1.5366)

categories = Categories("OST_MEPSpaces")
views = Views("L1 - Block 35")
all_elements_of_category_in_view = ElementsOfCategoryInView(Category=categories, View=views)
coreBoundary = Space.CoreBoundary(space=all_elements_of_category_in_view)
watch_3d = Watch3D(coreBoundary)
