# Dynamo graph Revit.Elements.Space.Location.dyn (Dynamo 3.2.1.5366)

categories = Categories("OST_MEPSpaces")
views = Views("L1 - Block 35")
all_elements_of_category_in_view = ElementsOfCategoryInView(Category=categories, View=views)
location = Space.Location(space=all_elements_of_category_in_view)

# group: Review
# Preview room names in Dynamo viewport
name = Room.Name(room=all_elements_of_category_in_view)
byPointAndString = Analysis.Label.ByPointAndString(point=location, label=name)
centerBoundary = Space.CenterBoundary(space=all_elements_of_category_in_view)
