# Dynamo graph Revit.Elements.Space.Number.dyn (Dynamo 3.2.1.5366)

categories = Categories("OST_MEPSpaces")
views = Views("L1 - Block 35")
all_elements_of_category_in_view = ElementsOfCategoryInView(Category=categories, View=views)
number = Space.Number(space=all_elements_of_category_in_view)
