# Dynamo graph Revit.Elements.SpecType.ByTypeId.dyn (Dynamo 3.6.2.11575)

string = StringInput("autodesk.spec.aec:length-2.0.0")
string_2 = StringInput("autodesk.spec.aec:area-2.0.0")
string_3 = StringInput("autodesk.spec.aec:volume-2.0.0")
string_4 = StringInput("autodesk.spec:spec.string-2.0.0")
string_5 = StringInput("autodesk.spec:spec.bool-2.0.0")
list_create = List.Create(item0=string, item1=string_2, item2=string_3, item3=string_4, item4=string_5)
byTypeId = SpecType.ByTypeId(typeId=list_create)
