# Dynamo graph Revit.Elements.StructuralFraming.BeamByCurve.dyn (Dynamo 3.6.0.9395)

# group: Create Linear Path from A-5 to A-6 at level L2 TOS
select_model_elements_by = DSModelElementsByCategorySelection("OST_Grids")  # "Select Model Elements By Category"; 2 picked in the model
curve = Grid.Curve(grid=select_model_elements_by)
select_model_element = DSModelElementSelection()  # 1 picked in the model
curve_2 = Grid.Curve(grid=select_model_element)
intersect = Geometry.Intersect(geometry=curve, other=curve_2, lacing=CrossProduct)
flatten = List.Flatten(list=intersect)
X = Point.X(point=flatten)
Y = Point.Y(point=flatten)
levels = Levels("L2 TOS")
elevation = Level.Elevation(level=levels)
byCoordinates = Point.ByCoordinates(x=X, y=Y, z=elevation)
firstItem = List.FirstItem(list=byCoordinates)
lastItem = List.LastItem(list=byCoordinates)
byStartPointEndPoint = Line.ByStartPointEndPoint(startPoint=firstItem, endPoint=lastItem)

structural_framing_types = StructuralFramingTypes("W18x55")
beamByCurve = StructuralFraming.BeamByCurve(curve=byStartPointEndPoint, level=levels, structuralFramingType=structural_framing_types)
