# Dynamo graph Revit.Elements.StructuralFraming.BraceByCurve.dyn (Dynamo 3.6.0.9395)

# group: Create vertical curve at A4 from levels L2 to L3
select_model_elements_by = DSModelElementsByCategorySelection("OST_Grids")  # "Select Model Elements By Category"; 2 picked in the model
curve = Grid.Curve(grid=select_model_elements_by)
select_model_element = DSModelElementSelection()  # 1 picked in the model
curve_2 = Grid.Curve(grid=select_model_element)
intersect = Geometry.Intersect(geometry=curve, other=curve_2, lacing=CrossProduct)
X = Point.X(point=intersect)
Y = Point.Y(point=intersect)
select_model_elements_by_2 = DSModelElementsByCategorySelection("OST_Levels")  # "Select Model Elements By Category"; 2 picked in the model
elevation = Level.Elevation(level=select_model_elements_by_2)
byCoordinates = Point.ByCoordinates(x=X, y=Y, z=elevation@L1)
flatten = List.Flatten(list=byCoordinates)
firstItem = List.FirstItem(list=flatten@L2)
lastItem = List.LastItem(list=flatten)
byStartPointEndPoint = Line.ByStartPointEndPoint(startPoint=firstItem, endPoint=lastItem)

levels = Levels("L2")
structural_framing_types = StructuralFramingTypes("L8X6X1/2")
braceByCurve = StructuralFraming.BraceByCurve(curve=byStartPointEndPoint, level=levels, structuralFramingType=structural_framing_types)
