# Dynamo graph Revit.Elements.StructuralFraming.ColumnByCurve.dyn (Dynamo 3.6.0.9395)

# group: Create vertical curve at A4 from levels L2 to L3
select_model_element = DSModelElementSelection()  # 1 picked in the model
curve = Grid.Curve(grid=select_model_element)
select_model_element_2 = DSModelElementSelection()  # 1 picked in the model
curve_2 = Grid.Curve(grid=select_model_element_2)
intersect = Geometry.Intersect(geometry=curve, other=curve_2, lacing=CrossProduct)
X = Point.X(point=intersect)
Y = Point.Y(point=intersect)
select_model_elements_by = DSModelElementsByCategorySelection("OST_Levels")  # "Select Model Elements By Category"; 2 picked in the model
reverse = List.Reverse(list=select_model_elements_by)
elevation = Level.Elevation(level=reverse)
byCoordinates = Point.ByCoordinates(x=X, y=Y, z=elevation@L1)
firstItem = List.FirstItem(list=byCoordinates)
lastItem = List.LastItem(list=byCoordinates)
byStartPointEndPoint = Line.ByStartPointEndPoint(startPoint=firstItem, endPoint=lastItem)

levels = Levels("L1_35_Low")
structural_column_types = StructuralColumnTypes("W18x119")
columnByCurve = StructuralFraming.ColumnByCurve(curve=byStartPointEndPoint, level=levels, structuralColumnType=structural_column_types)
