# Dynamo graph Revit.Elements.Subelement.Element.dyn (Dynamo 3.6.2.11575)

all_elements_in_active_view = ElementsInView()
subelements = Element.Subelements(element=all_elements_in_active_view)
boolean = BoolSelector(false)
clean = List.Clean(list=subelements, preserveIndices=boolean)
element = Subelement.Element(subelement=clean)
name = Element.Name(element=element)
