# Dynamo graph Revit.Elements.Subelement.GetParameterValue.dyn (Dynamo 3.6.2.11575)

all_elements_in_active_view = ElementsInView()
subelements = Element.Subelements(element=all_elements_in_active_view)
boolean = BoolSelector(false)
clean = List.Clean(list=subelements, preserveIndices=boolean)
firstItem = List.FirstItem(list=clean)
getAllParameters = Subelement.GetAllParameters(subelement=firstItem)
getParameterValue = Subelement.GetParameterValue(subelement=firstItem, paramId=getAllParameters)
