# Dynamo graph Revit.Elements.SunSettings.Altitude.dyn (Dynamo 2.18.1.5096)

current = SunSettings()  # "SunSettings.Current"
watch = Watch(current)
altitude = SunSettings.Altitude(sunSettings=current)
azimuth = SunSettings.Azimuth(sunSettings=current)
