# Dynamo graph Revit.Elements.SunSettings.StartDateTime.dyn (Dynamo 2.18.1.5096)

current = SunSettings()  # "SunSettings.Current"
watch = Watch(current)
startDateTime = SunSettings.StartDateTime(sunSettings=current)
endDateTime = SunSettings.EndDateTime(sunSettings=current)
