# Dynamo graph Revit.Elements.SunSettings.SunDirection.dyn (Dynamo 2.18.1.5096)

current = SunSettings()  # "SunSettings.Current"
watch = Watch(current)
origin = Point.Origin()
sunDirection = SunSettings.SunDirection(sunSettings=current)
number = DoubleInput(10)
byStartPointDirectionLength = Line.ByStartPointDirectionLength(startPoint=origin, direction=sunDirection, length=number)
