# Dynamo graph Revit.Elements.Tag.ByElementAndLocation.dyn (Dynamo 3.4.1.7055)

views = Views("Studio Live_Work Core B")
select_model_element = DSModelElementSelection()  # 1 picked in the model
location = FamilyInstance.Location(familyInstance=select_model_element)
boolean = BoolSelector(true)
boolean_2 = BoolSelector(true)
byElementAndLocation = Tag.ByElementAndLocation(view=views, element=select_model_element, location=location, horizontal=boolean, addLeader=boolean_2)
X = Point.X(point=location)
number_slider = DoubleSlider(1, range=-5..5 step 0.1)
add = X + number_slider
Y = Point.Y(point=location)
sub = Y - number_slider
Z = Point.Z(point=location)
byCoordinates = Point.ByCoordinates(x=add, y=sub, z=Z)
setHeadLocation = Tag.SetHeadLocation(tag=byElementAndLocation, location=byCoordinates)
