# Dynamo graph Revit.Elements.Tag.ByElementAndOffset.dyn (Dynamo 3.4.1.7055)

views = Views("Studio Live_Work Core B")
select_model_element = DSModelElementSelection()  # 1 picked in the model
location = FamilyInstance.Location(familyInstance=select_model_element)
X = Point.X(point=location)
number_slider = DoubleSlider(1, range=-5..5 step 0.1)
add = X + number_slider
Y = Point.Y(point=location)
sub = Y - number_slider
Z = Point.Z(point=location)
byCoordinates = Point.ByCoordinates(x=add, y=sub, z=Z)
byTwoPoints = Vector.ByTwoPoints(start=location, end=byCoordinates)
select_horizontal_text_alignment = HorizontalAlignment("Left")
select_vertical_text_alignment = VerticalAlignment("Bottom")
boolean = BoolSelector(true)
boolean_2 = BoolSelector(true)
byElementAndOffset = Tag.ByElementAndOffset(view=views, element=select_model_element, offset=byTwoPoints, horizontalAlignment=select_horizontal_text_alignment, verticalAlignment=select_vertical_text_alignment, horizontal=boolean, addLeader=boolean_2)
