# Dynamo graph Revit.Elements.Tag.GetLeaderEndCondition.dyn (Dynamo 3.2.1.5366)

categories = Categories("OST_KeynoteTags")
views = Views("North Wall Window Detail")
all_elements_of_category_in_view = ElementsOfCategoryInView(Category=categories, View=views)
getLeaderEndCondition = Tag.GetLeaderEndCondition(tag=all_elements_of_category_in_view)
