# Dynamo graph Revit.Elements.Tag.LeaderEnd.dyn (Dynamo 3.2.1.5366)

categories = Categories("OST_KeynoteTags")
views = Views("North Wall Window Detail")
all_elements_of_category_in_view = ElementsOfCategoryInView(Category=categories, View=views)
leaderEnd = Tag.LeaderEnd(tag=all_elements_of_category_in_view)
watch_3d = Watch3D(leaderEnd)
