# Dynamo graph Revit.Elements.Tag.SetLeaderElbow.dyn (Dynamo 3.4.1.7055)

select_model_element = DSModelElementSelection()  # 1 picked in the model
leaderElbow = Tag.LeaderElbow(tag=select_model_element)
X = Point.X(point=leaderElbow)
number_slider = DoubleSlider(3, range=0..100 step 0.1)
add = X + number_slider
Y = Point.Y(point=leaderElbow)
Z = Point.Z(point=leaderElbow)
byCoordinates = Point.ByCoordinates(x=add, y=Y, z=Z)
setLeaderElbow = Tag.SetLeaderElbow(tag=select_model_element, location=byCoordinates)
