# Dynamo graph Revit.Elements.Tag.SetLeaderEnd.dyn (Dynamo 3.4.1.7055)

select_model_element = DSModelElementSelection()  # 1 picked in the model
leaderEnd = Tag.LeaderEnd(tag=select_model_element)
X = Point.X(point=leaderEnd)
Y = Point.Y(point=leaderEnd)
number_slider = DoubleSlider(1, range=0..100 step 0.1)
sub = Y - number_slider
Z = Point.Z(point=leaderEnd)
byCoordinates = Point.ByCoordinates(x=X, y=sub, z=Z)
setLeaderEnd = Tag.SetLeaderEnd(tag=select_model_element, location=byCoordinates)
