# Dynamo graph Revit.Elements.Tag.SetLeaderEndCondition.dyn (Dynamo 3.3.0.6316)

views = Views("L1")
categories = Categories("OST_Walls")
all_elements_of_category_in_view = ElementsOfCategoryInView(Category=categories, View=views)
boolean = BoolSelector(false)
boolean_2 = BoolSelector(true)
select_horizontal_text_alignment = HorizontalAlignment("Center")
select_vertical_text_alignment = VerticalAlignment("Middle")
byElement = Tag.ByElement(view=views, element=all_elements_of_category_in_view, horizontal=boolean, addLeader=boolean_2, horizontalAlignment=select_horizontal_text_alignment, verticalAlignment=select_vertical_text_alignment)
leaderend_condition = LeaderEndCondition("Attached")
setLeaderEndCondition = Tag.SetLeaderEndCondition(tag=byElement, leaderEndCondition=leaderend_condition)
