# Dynamo graph Revit.Elements.Tag.TagText.dyn (Dynamo 3.2.1.5366)

categories = Categories("OST_DoorTags")
all_elements_of_category = ElementsOfCategory(Category=categories)
tagText = Tag.TagText(tag=all_elements_of_category)
