# Dynamo graph Revit.Elements.TextNote.HorizontalAlignment.dyn (Dynamo 3.2.1.5366)

categories = Categories("OST_TextNotes")
all_elements_of_category = ElementsOfCategory(Category=categories)
typename = TextNote.Typename(textNote=all_elements_of_category)
string = StringInput("Working Notes")
eq = typename == string
# note: in = working notes
filterByBoolMask = List.FilterByBoolMask(list=all_elements_of_category, mask=eq)
horizontalAlignment = TextNote.HorizontalAlignment(textNote=filterByBoolMask.in)
