# Dynamo graph Revit.Elements.TextNote.SetHorizontalAlignment.dyn (Dynamo 3.3.0.6316)

categories = Categories("OST_TextNotes")
sheets = Sheets("Details")  # graph input
views = Sheet.Views(sheet=sheets)
all_elements_of_category_in_view = ElementsOfCategoryInView(Category=categories, View=views)
select_horizontal_text_alignment = HorizontalAlignment("Center")
setHorizontalAlignment = TextNote.SetHorizontalAlignment(textNote=all_elements_of_category_in_view, value=select_horizontal_text_alignment)
