# Dynamo graph Revit.Elements.TextNote.SetKeepRotatedTextReadable.dyn (Dynamo 3.3.0.6316)

categories = Categories("OST_TextNotes")
sheets = Sheets("Details")  # graph input
views = Sheet.Views(sheet=sheets)
all_elements_of_category_in_view = ElementsOfCategoryInView(Category=categories, View=views)
boolean = BoolSelector(true)
setKeepRotatedTextReadable = TextNote.SetKeepRotatedTextReadable(textNote=all_elements_of_category_in_view, value=boolean)
