# Dynamo graph Revit.Elements.TextNote.Text.dyn (Dynamo 3.2.1.5366)

categories = Categories("OST_TextNotes")
all_elements_of_category = ElementsOfCategory(Category=categories)
text = TextNote.Text(textNote=all_elements_of_category)
