# Dynamo graph Revit.Elements.TextNoteType.Default.dyn (Dynamo 3.2.1.5366)

string = StringInput("Sample Detail View")
byName = DraftingView.ByName(name=string)
origin = Point.Origin()
string_2 = StringInput("A new text note in the new view")
select_horizontal_text_alignment = HorizontalAlignment("Center")
default = TextNoteType.Default()
byLocation = TextNote.ByLocation(view=byName, location=origin, text=string_2, alignment=select_horizontal_text_alignment, type=default)
