# Dynamo graph Revit.Elements.Toposolid.ByOutlineTypeAndLevel.dyn (Dynamo 3.4.1.7055)

XY = Plane.XY()
number = DoubleInput(100)
number_2 = DoubleInput(100)
byWidthLength = Rectangle.ByWidthLength(plane=XY, width=number, length=number_2)
string = StringInput("Toposolid 1")
byName = ToposolidType.ByName(name=string)
levels = Levels("L1 - Block 37")
byOutlineTypeAndLevel = Toposolid.ByOutlineTypeAndLevel(outlineCurves=byWidthLength, toposolidType=byName, level=levels)
