# Dynamo graph Revit.Elements.Toposolid.ByPointsTypeAndLevel.dyn (Dynamo 3.4.1.7055)

XY = Plane.XY()
number = DoubleInput(500)
number_2 = DoubleInput(100)
byWidthLength = Rectangle.ByWidthLength(plane=XY, width=number, length=number_2)
pointsAtEqualChordLength = Curve.PointsAtEqualChordLength(curve=byWidthLength)
string = StringInput("Toposolid 1")
byName = ToposolidType.ByName(name=string)
levels = Levels("L1 - Block 37")
byPointsTypeAndLevel = Toposolid.ByPointsTypeAndLevel(points=pointsAtEqualChordLength, toposolidType=byName, level=levels)
