# Dynamo graph Revit.Elements.Viewport.BoxCenter.dyn (Dynamo 3.2.1.5366)

sheets = Sheets("Wall Sections")
viewports = Sheet.Viewports(sheet=sheets)
boxCenter = Viewport.BoxCenter(viewport=viewports)
watch_3d = Watch3D(boxCenter)
