# Dynamo graph Revit.Elements.Viewport.BySheetViewLocation.dyn (Dynamo 3.4.1.7055)

string = StringInput("Dynamo Sheet")
string_2 = StringInput("_D001")
family_types = FamilyTypes("E1 30 x 42 Horizontal_Snowdon:E1 30 x 42 Horizontal_Snowdon")
byNameNumberTitleBlock = Sheet.ByNameNumberTitleBlock(sheetName=string, sheetNumber=string_2, titleBlockFamilyType=family_types)
views = Views("L1 Wall Base")
number_slider = DoubleSlider(0, range=0..100 step 0.1)
byCoordinates = Point.ByCoordinates(x=number_slider, y=number_slider)
bySheetViewLocation = Viewport.BySheetViewLocation(sheet=byNameNumberTitleBlock, view=views, location=byCoordinates)
