# Dynamo graph Revit.Elements.Viewport.LabelLineLength.dyn (Dynamo 3.2.1.5366)

sheets = Sheets("Wall Sections")
viewports = Sheet.Viewports(sheet=sheets)
labelLineLength = Viewport.LabelLineLength(viewport=viewports)
