# Dynamo graph Revit.Elements.Viewport.LabelOffset.dyn (Dynamo 3.2.1.5366)

sheets = Sheets("Wall Sections")
viewports = Sheet.Viewports(sheet=sheets)
labelOffset = Viewport.LabelOffset(viewport=viewports)
watch_3d = Watch3D(labelOffset)
