# Dynamo graph Revit.Elements.Viewport.LabelOutline.dyn (Dynamo 3.2.1.5366)

sheets = Sheets("Wall Sections")
viewports = Sheet.Viewports(sheet=sheets)
labelOutline = Viewport.LabelOutline(viewport=viewports)
watch_3d = Watch3D(labelOutline)
