# Dynamo graph Revit.Elements.Viewport.SetLabelLineLength.dyn (Dynamo 3.2.1.5366)

sheets = Sheets("Wall Sections")
viewports = Sheet.Viewports(sheet=sheets)

# group: Calculate Length
# Calculate ideal viewport line length based on extents
boxOutline = Viewport.BoxOutline(viewport=viewports)
maxPoint = BoundingBox.MaxPoint(boundingBox=boxOutline)
X = Point.X(point=maxPoint)
minPoint = BoundingBox.MinPoint(boundingBox=boxOutline)
X_2 = Point.X(point=minPoint)
sub = X - X_2

setLabelLineLength = Viewport.SetLabelLineLength(viewport=viewports, length=sub)
