# Dynamo graph Revit.Elements.Viewport.SetLabelOffset.dyn (Dynamo 3.4.1.7055)

string = StringInput("Dynamo Sheet")
string_2 = StringInput("_D001")
family_types = FamilyTypes("E1 30 x 42 Horizontal_Snowdon:E1 30 x 42 Horizontal_Snowdon")
byNameNumberTitleBlock = Sheet.ByNameNumberTitleBlock(sheetName=string, sheetNumber=string_2, titleBlockFamilyType=family_types)
views = Views("L1 Wall Base")
number_slider = DoubleSlider(0, range=0..100 step 0.1)
byCoordinates = Point.ByCoordinates(x=number_slider, y=number_slider)
bySheetViewLocation = Viewport.BySheetViewLocation(sheet=byNameNumberTitleBlock, view=views, location=byCoordinates)
number_slider_2 = DoubleSlider(1.6, range=0..100 step 0.1)
number_slider_3 = DoubleSlider(1.25, range=0..100 step 0.1)
byCoordinates_2 = Point.ByCoordinates(x=number_slider_2, y=number_slider_3)
setBoxCenter = Viewport.SetBoxCenter(viewport=bySheetViewLocation, point=byCoordinates_2)
number_slider_4 = DoubleSlider(1.5, range=0..100 step 0.1)
number_slider_5 = DoubleSlider(0.03, range=0..100 step 0.1)
byCoordinates_3 = Point.ByCoordinates(x=number_slider_4, y=number_slider_5)
setLabelOffset = Viewport.SetLabelOffset(viewport=setBoxCenter, point=byCoordinates_3)
