# Dynamo graph Revit.Elements.Viewport.Sheet.dyn (Dynamo 3.2.1.5366)

categories = Categories("OST_Viewports")
all_elements_of_category = ElementsOfCategory(Category=categories)
sheet = Viewport.Sheet(viewport=all_elements_of_category)
groupByKey = List.GroupByKey(list=all_elements_of_category, keys=sheet)
watch = Watch(groupByKey.groups)
