# Dynamo graph Revit.Elements.Views.AreaPlanView.ByLevelAndAreaScheme.dyn (Dynamo 3.5.0.8297)

levels = Levels("L3")
element_classes = ElementTypes("AreaScheme")
all_elements_of_class = ElementsOfType(element_class=element_classes)
firstItem = List.FirstItem(list=all_elements_of_class)
byLevelAndAreaScheme = AreaPlanView.ByLevelAndAreaScheme(level=levels, areaScheme=firstItem)
name = Element.Name(element=all_elements_of_class)
