# Dynamo graph Revit.Elements.Views.AxonometricView.ByEyePointAndTarget.dyn (Dynamo 3.5.0.8297)

number = DoubleInput(0)
number_2 = DoubleInput(100)
byCoordinates = Point.ByCoordinates(x=number, y=number, z=number_2)
byCoordinates_2 = Point.ByCoordinates(x=number_2, y=number_2, z=number)
string = StringInput("DynamoAxonView")
byEyePointAndTarget = AxonometricView.ByEyePointAndTarget(eyePoint=byCoordinates, target=byCoordinates_2, name=string)
