# Dynamo graph Revit.Elements.Views.AxonometricView.ByEyePointTargetAndElement.dyn (Dynamo 3.4.1.7055)

number = DoubleInput(0)
number_2 = DoubleInput(100)
byCoordinates = Point.ByCoordinates(x=number, y=number, z=number_2)
byCoordinates_2 = Point.ByCoordinates(x=number_2, y=number_2, z=number)
select_model_element = DSModelElementSelection()  # 1 picked in the model
name = Element.Name(element=select_model_element)
boolean = BoolSelector(true)
byEyePointTargetAndElement = AxonometricView.ByEyePointTargetAndElement(eyePoint=byCoordinates, target=byCoordinates_2, name=name, element=select_model_element, isolateElement=boolean)
