# Dynamo graph Revit.Elements.Views.PerspectiveView.ByEyePointTargetAndBoundingBox.dyn (Dynamo 3.6.2.11575)

number = DoubleInput(50)
number_2 = DoubleInput(50)
byCoordinates = Point.ByCoordinates(x=number, y=number_2)
number_3 = DoubleInput(0)
number_4 = DoubleInput(0)
byCoordinates_2 = Point.ByCoordinates(x=number_3, y=number_4)
number_5 = DoubleInput(-10)
number_6 = DoubleInput(-10)
byCoordinates_3 = Point.ByCoordinates(x=number_5, y=number_6)
number_7 = DoubleInput(10)
number_8 = DoubleInput(10)
byCoordinates_4 = Point.ByCoordinates(x=number_7, y=number_8)
byCorners = BoundingBox.ByCorners(min=byCoordinates_3, max=byCoordinates_4)
string = StringInput("Dynamo Perspective View")
boolean = BoolSelector(false)
byEyePointTargetAndBoundingBox = PerspectiveView.ByEyePointTargetAndBoundingBox(eyePoint=byCoordinates, target=byCoordinates_2, boundingBox=byCorners, name=string, isolateElement=boolean)
