# Dynamo graph Revit.Elements.Views.PerspectiveView.ByEyePointTargetAndElement.dyn (Dynamo 3.6.2.11575)

number = DoubleInput(10)
number_2 = DoubleInput(15)
number_3 = DoubleInput(0)
byCoordinates = Point.ByCoordinates(x=number, y=number_2, z=number_3)
number_4 = DoubleInput(5)
number_5 = DoubleInput(5)
number_6 = DoubleInput(0)
byCoordinates_2 = Point.ByCoordinates(x=number_4, y=number_5, z=number_6)
select_model_element = DSModelElementSelection()  # 1 picked in the model
string = StringInput("My Perspective View")
boolean = BoolSelector(false)
byEyePointTargetAndElement = PerspectiveView.ByEyePointTargetAndElement(eyePoint=byCoordinates, target=byCoordinates_2, element=select_model_element, name=string, isolateElement=boolean)
