# Dynamo graph Revit.Elements.Views.ScheduleView.AddFields.dyn (Dynamo 3.2.1.5366)

categories = Categories("OST_Doors")
string = StringInput("Working Door Schedule")
schedule_type = ScheduleTypes("RegularSchedule")
createSchedule = ScheduleView.CreateSchedule(category=categories, name=string, scheduleType=schedule_type)

# group: Create Lookup Dictionary for Schedulable Fields
# A lookup dictionary is needed as getting the scheudable fields is not straightforward. Duplicates also need removed.
schedulableFields = ScheduleView.SchedulableFields(scheduleView=createSchedule)
name = Revit.Schedules.SchedulableField.Name(schedulableField=schedulableFields)
# note: Group  and get first item to avoid duplicates
groupByKey = List.GroupByKey(list=schedulableFields, keys=name)
firstItem = List.FirstItem(list=groupByKey.groups@L2)
byKeysValues = DesignScript.Builtin.Dictionary.ByKeysValues(keys=groupByKey.uniqueKeys, values=firstItem)

# group: Schedulable Field Names
# Enter Names of Schedulable Fields to add to the created schedule
string_2 = StringInput("Family and Type")
string_3 = StringInput("Description")
string_4 = StringInput("Level")
string_5 = StringInput("Type Mark")  # graph input

list_create = List.Create(item0=string_2, item1=string_3, item2=string_4, item3=string_5)
# note: Get the associated schedulable field by name
valueAtKey = DesignScript.Builtin.Dictionary.ValueAtKey(dictionary=byKeysValues, key=list_create)
addFields = ScheduleView.AddFields(scheduleView=createSchedule, fields=valueAtKey)
