# Dynamo graph Revit.Elements.Views.ScheduleView.ClearAllFilters.dyn (Dynamo 3.4.1.7055)

views = Views("Bleachers Schedule - Option Middle Stair")
number = DoubleInput(10)
pause = Thread.Pause(object=views, msTimeout=number)
clearAllFilters = ScheduleView.ClearAllFilters(scheduleView=pause)
scheduleFilters = ScheduleView.ScheduleFilters(scheduleView=clearAllFilters)
scheduleFilters_2 = ScheduleView.ScheduleFilters(scheduleView=views)
