# Dynamo graph Revit.Elements.Views.ScheduleView.CreateAreaSchedule.dyn (Dynamo 3.5.0.8297)

element_classes = ElementTypes("AreaScheme")
all_elements_of_class = ElementsOfType(element_class=element_classes)
firstItem = List.FirstItem(list=all_elements_of_class)
name = Element.Name(element=firstItem)
string = StringInput(" Dynamo Schedule")
add = name + string
createAreaSchedule = ScheduleView.CreateAreaSchedule(areaScheme=firstItem, name=add)
name_2 = Element.Name(element=all_elements_of_class)
