# Dynamo graph Revit.Elements.Views.ScheduleView.Export.dyn (Dynamo 3.2.1.5366)

element_classes = ElementTypes("ViewSchedule")
all_elements_of_class = ElementsOfType(element_class=element_classes)
firstItem = List.FirstItem(list=all_elements_of_class)
name = Element.Name(element=firstItem)
python_script = Python(IN[0]=name)  # CPython3
# ---------- python_script.python (15 lines) ----------
# Load the Python Standard and DesignScript Libraries
import sys
import clr
import os
clr.AddReference('ProtoGeometry')
from Autodesk.DesignScript.Geometry import *

# user inputs
viewName = IN[0]

# Place your code below this line
exportedSchedulePath = os.path.expanduser('~\\Documents\\')

# Assign your output to the OUT variable.
OUT = exportedSchedulePath + viewName + ".csv"
# ----------------------------------------
byProperties = Revit.Schedules.ScheduleExportOptions.ByProperties()
export = ScheduleView.Export(scheduleView=firstItem, path=python_script, exportOptions=byProperties)
