# Dynamo graph Revit.Elements.Views.ScheduleView.RemoveFields.dyn (Dynamo 3.5.0.8297)

element_classes = ElementTypes("ViewSchedule")
all_elements_of_class = ElementsOfType(element_class=element_classes)
firstItem = List.FirstItem(list=all_elements_of_class)
fields = ScheduleView.Fields(scheduleView=firstItem)
firstItem_2 = List.FirstItem(list=fields)
removeFields = ScheduleView.RemoveFields(scheduleView=firstItem, fields=firstItem_2)
