# Dynamo graph Revit.Elements.Views.ScheduleView.ScheduleFilters.dyn (Dynamo 2.18.1.5096)

element_classes = ElementTypes("ViewSchedule")
all_elements_of_class = ElementsOfType(element_class=element_classes)
firstItem = List.FirstItem(list=all_elements_of_class)
scheduleFilters = ScheduleView.ScheduleFilters(scheduleView=firstItem)
