# Dynamo graph Revit.Elements.Views.SectionView.ByBoundingBox.dyn (Dynamo 3.4.1.7055)

select_model_element = DSModelElementSelection()  # 1 picked in the model
select_model_element_2 = DSModelElementSelection()  # 1 picked in the model
list_create = List.Create(item0=select_model_element, item1=select_model_element_2)
boundingBox = Element.BoundingBox(element=list_create)
byBoundingBox = SectionView.ByBoundingBox(box=boundingBox)
