# Dynamo graph Revit.Elements.Views.SectionView.ByCoordinateSystemMinPointMaxPoint.dyn (Dynamo 3.4.1.7055)

origin = Point.Origin()
byOrigin = CoordinateSystem.ByOrigin(origin=origin)
number = DoubleInput(10)
number_2 = DoubleInput(0)
byCoordinates = Point.ByCoordinates(x=number, y=number, z=number_2)
number_3 = DoubleInput(80)
byCoordinates_2 = Point.ByCoordinates(x=number_3, y=number_3, z=number_3)
byCoordinateSystemMinPointMaxPoint = SectionView.ByCoordinateSystemMinPointMaxPoint(cs=byOrigin, minPoint=byCoordinates, maxPoint=byCoordinates_2)
