# Dynamo graph Revit.Elements.Views.Sheet.ByNameNumberTitleBlock.dyn (Dynamo 3.4.1.7055)

string = StringInput("DynamoDemo3")
string_2 = StringInput("DynamoDemo4")
list_create = List.Create(item0=string, item1=string_2)
string_3 = StringInput("_D-003")
string_4 = StringInput("_D-004")
list_create_2 = List.Create(item0=string_3, item1=string_4)
family_types = FamilyTypes("E1 30 x 42 Horizontal_Snowdon:E1 30 x 42 Horizontal_Snowdon")
byNameNumberTitleBlock = Sheet.ByNameNumberTitleBlock(sheetName=list_create, sheetNumber=list_create_2, titleBlockFamilyType=family_types)
