# Dynamo graph Revit.Elements.Views.Sheet.ByNameNumberTitleBlockAndView.dyn (Dynamo 3.4.1.7055)

string = StringInput("DynamoDemo1")
string_2 = StringInput("DynamoDemo2")
list_create = List.Create(item0=string, item1=string_2)
string_3 = StringInput("_D-002")
string_4 = StringInput("_D-001")
list_create_2 = List.Create(item0=string_3, item1=string_4)
family_types = FamilyTypes("E1 30 x 42 Horizontal_Snowdon:E1 30 x 42 Horizontal_Snowdon")
views = Views("Parking")
views_2 = Views("R2_SD")
list_create_3 = List.Create(item0=views, item1=views_2)
byNameNumberTitleBlockAndView = Sheet.ByNameNumberTitleBlockAndView(sheetName=list_create, sheetNumber=list_create_2, titleBlockFamilyType=family_types, view=list_create_3)
