# Dynamo graph Revit.Elements.Views.Sheet.ByNameNumberTitleBlockAndViews.dyn (Dynamo 3.4.1.7055)

string = StringInput("DynamoDemo20")
string_2 = StringInput("_D-020")
family_types = FamilyTypes("E1 30 x 42 Horizontal_Snowdon:E1 30 x 42 Horizontal_Snowdon")
views = Views("WV_Under Lobby Stair Landing")
views_2 = Views("Café Kitchen - Section")
list_create = List.Create(item0=views, item1=views_2)
byNameNumberTitleBlockAndViews = Sheet.ByNameNumberTitleBlockAndViews(sheetName=string, sheetNumber=string_2, titleBlockFamilyType=family_types, views=list_create)
