# Dynamo graph Revit.Elements.Views.Sheet.ByNameNumberTitleBlockViewAndLocation.dyn (Dynamo 3.4.1.7055)

string = StringInput("DynamoDemo11")
string_2 = StringInput("_D-011")
family_types = FamilyTypes("E1 30 x 42 Horizontal_Snowdon:E1 30 x 42 Horizontal_Snowdon")
views = Views("WV_Looking at Lobby Stair")
list_create = List.Create(item0=views)
number = DoubleInput(1)
number_2 = DoubleInput(1)
byCoordinates = Point.ByCoordinates(x=number, y=number_2)
list_create_2 = List.Create(item0=byCoordinates)
byNameNumberTitleBlockViewAndLocation = Sheet.ByNameNumberTitleBlockViewAndLocation(sheetName=string, sheetNumber=string_2, titleBlockFamilyType=family_types, view=list_create, location=list_create_2)
