# Dynamo graph Revit.Elements.Views.Sheet.ByNameNumberTitleBlockViewsAndLocations.dyn (Dynamo 3.4.1.7055)

string = StringInput("DynamoDemo10")
string_2 = StringInput("_D-010")
family_types = FamilyTypes("E1 30 x 42 Horizontal_Snowdon:E1 30 x 42 Horizontal_Snowdon")
views = Views("Café Kitchen - Section")
views_2 = Views("WV_Under Lobby Stair Landing")
list_create = List.Create(item0=views, item1=views_2)
number = DoubleInput(0.75)
number_2 = DoubleInput(0.5)
byCoordinates = Point.ByCoordinates(x=number, y=number_2)
number_3 = DoubleInput(1.75)
byCoordinates_2 = Point.ByCoordinates(x=number_3, y=number_2)
list_create_2 = List.Create(item0=byCoordinates, item1=byCoordinates_2)
byNameNumberTitleBlockViewsAndLocations = Sheet.ByNameNumberTitleBlockViewsAndLocations(sheetName=string, sheetNumber=string_2, titleBlockFamilyType=family_types, views=list_create, locations=list_create_2)
