# Dynamo graph Revit.Elements.Views.Sheet.DuplicateSheet.dyn (Dynamo 3.4.1.7055)

sheets = Sheets("Parking Deck Floor Plan")
boolean = BoolSelector(true)
string = StringInput("WithDetailing")
string_2 = StringInput("_D")
string_3 = StringInput("D_")
duplicateSheet = Sheet.DuplicateSheet(sheet=sheets, duplicateWithContents=boolean, duplicateWithView=boolean, viewDuplicateOption=string, prefix=string_2, suffix=string_3)
