# Dynamo graph Revit.Elements.Views.Sheet.SetSheetName.dyn (Dynamo 2.18.1.5096)

categories = Categories("OST_Sheets")
all_elements_of_category = ElementsOfCategory(Category=categories)
sheetName = Sheet.SheetName(sheet=all_elements_of_category)
number = DoubleInput(0)
string = StringInput("(E)")
insert = String.Insert(string=sheetName, index=number, toInsert=string)
setSheetName = Sheet.SetSheetName(sheet=all_elements_of_category, sheetName=insert)
