# Dynamo graph Revit.Elements.Views.Sheet.SetSheetNumber.dyn (Dynamo 2.18.1.5096)

categories = Categories("OST_Sheets")
all_elements_of_category = ElementsOfCategory(Category=categories)
sheetNumber = Sheet.SheetNumber(sheet=all_elements_of_category)
number = DoubleInput(0)
string = StringInput("*")
insert = String.Insert(string=sheetNumber, index=number, toInsert=string)
setSheetNumber = Sheet.SetSheetNumber(sheet=all_elements_of_category, sheetNumber=insert)
