# Dynamo graph Revit.Elements.Views.Sheet.SheetName.dyn (Dynamo 2.18.1.5096)

categories = Categories("OST_Sheets")
all_elements_of_category = ElementsOfCategory(Category=categories)
sheetName = Sheet.SheetName(sheet=all_elements_of_category)
groupByKey = List.GroupByKey(list=all_elements_of_category, keys=sheetName)
watch = Watch(groupByKey.groups)
watch_2 = Watch(groupByKey.uniqueKeys)
