# Dynamo graph Revit.Elements.Views.Sheet.SheetNumber.dyn (Dynamo 2.18.1.5096)

categories = Categories("OST_Sheets")
all_elements_of_category = ElementsOfCategory(Category=categories)
sheetNumber = Sheet.SheetNumber(sheet=all_elements_of_category)
sortByKey = List.SortByKey(list=all_elements_of_category, keys=sheetNumber)
watch = Watch(sortByKey.sortedList)
watch_2 = Watch(sortByKey.sortedKeys)
