# Dynamo graph Revit.Elements.Views.View.CropBox.dyn (Dynamo 2.18.1.5096)

current = Document.Current()
activeView = Document.ActiveView(document=current)
cropBox = View.CropBox(view=activeView)
toCuboid = BoundingBox.ToCuboid(boundingBox=cropBox)
