# Dynamo graph Revit.Elements.Views.View.CropBoxActive.dyn (Dynamo 2.18.1.5096)

current = Document.Current()
activeView = Document.ActiveView(document=current)
cropBoxActive = View.CropBoxActive(view=activeView)
