# Dynamo graph Revit.Elements.Views.View.CropBoxVisible.dyn (Dynamo 2.18.1.5096)

current = Document.Current()
activeView = Document.ActiveView(document=current)
cropBoxVisible = View.CropBoxVisible(view=activeView)
string = StringInput("View Template")
getParameterValueByName = Element.GetParameterValueByName(element=activeView, parameterName=string)
