# Dynamo graph Revit.Elements.Views.View.Discipline.dyn (Dynamo 2.18.1.5096)

current = Document.Current()
activeView = Document.ActiveView(document=current)
discipline = View.Discipline(view=activeView)
