# Dynamo graph Revit.Elements.Views.View.Displaystyle.dyn (Dynamo 2.18.1.5096)

current = Document.Current()
activeView = Document.ActiveView(document=current)
displaystyle = View.Displaystyle(view=activeView)
