# Dynamo graph Revit.Elements.Views.View.FilterOverrides.dyn (Dynamo 3.2.1.5366)

views = Views("L1")
filters = View.Filters(view=views)
filterOverrides = View.FilterOverrides(view=views, parameterFilter=filters)
