# Dynamo graph Revit.Elements.Views.View.HideCategoriesTemporary.dyn (Dynamo 3.2.1.5366)

views = Views("L1")
categories = Categories("OST_Doors")
categories_2 = Categories("OST_Furniture")
list_create = List.Create(item0=categories, item1=categories_2)
hideCategoriesTemporary = View.HideCategoriesTemporary(view=views, categories=list_create)
