# Dynamo graph Revit.Elements.Views.View.IsViewTemplate.dyn (Dynamo 2.18.1.5096)

element_classes = ElementTypes("ViewPlan")
all_elements_of_class = ElementsOfType(element_class=element_classes)
isViewTemplate = View.IsViewTemplate(view=all_elements_of_class)
filterByBoolMask = List.FilterByBoolMask(list=all_elements_of_class, mask=isViewTemplate)
view_templates = Watch(filterByBoolMask.in)
floor_plans = Watch(filterByBoolMask.out)
