# Dynamo graph Revit.Elements.Views.View.Origin.dyn (Dynamo 2.18.1.5096)

current = Document.Current()
activeView = Document.ActiveView(document=current)
views = Views("{3D}")
list_create = List.Create(item0=activeView, item1=views)
origin = View.Origin(view=list_create)
