# Dynamo graph Revit.Elements.Views.View.Outline.dyn (Dynamo 2.18.1.5096)

current = Document.Current()
activeView = Document.ActiveView(document=current)
outline = View.Outline(view=activeView)
minPoint = BoundingBox.MinPoint(boundingBox=outline)
maxPoint = BoundingBox.MaxPoint(boundingBox=outline)

# group: Construct Plane
# Construct a plane to mirror geometry for a rectangle reprsentation
byStartPointEndPoint = Line.ByStartPointEndPoint(startPoint=minPoint, endPoint=maxPoint)
number = DoubleInput(0.5)
pointAtParameter = Curve.PointAtParameter(curve=byStartPointEndPoint, param=number)
XAxis = Vector.XAxis()
byOriginNormal = Plane.ByOriginNormal(origin=pointAtParameter, normal=XAxis)

# group: Mirror and Combine
# Mirror and Combine geometry into a sorted list for rectangle creation
list_create = List.Create(item0=minPoint, item1=maxPoint)
mirror = Geometry.Mirror(geometry=list_create, mirrorPlane=byOriginNormal)
list_create_2 = List.Create(item0=list_create, item1=mirror)
transpose = List.Transpose(lists=list_create_2)
flatten = List.Flatten(list=transpose)

byCornerPoints = Rectangle.ByCornerPoints(points=flatten)
watch_3d = Watch3D(byCornerPoints)
