# Dynamo graph Revit.Elements.Views.View.Partsvisibility.dyn (Dynamo 2.18.1.5096)

current = Document.Current()
activeView = Document.ActiveView(document=current)
partsvisibility = View.Partsvisibility(view=activeView)
