# Dynamo graph Revit.Elements.Views.View.SetCropBox.dyn (Dynamo 3.4.1.7055)

# note: A viewport is selected
select_model_element = DSModelElementSelection()  # 1 picked in the model
view = Viewport.View(viewport=select_model_element)
select_model_element_2 = DSModelElementSelection()  # 1 picked in the model
boundingBox = Element.BoundingBox(element=select_model_element_2)
setCropBox = View.SetCropBox(view=view, boundingBox=boundingBox)
