# Dynamo graph Revit.Elements.Views.View.SetCropBoxActive.dyn (Dynamo 3.3.0.6316)

sheets = Sheets("First Floor Plan")
views = Sheet.Views(sheet=sheets)
boolean = BoolSelector(true)
setCropBoxActive = View.SetCropBoxActive(view=views, isActive=boolean)
