# Dynamo graph Revit.Elements.Views.View.SetDiscipline.dyn (Dynamo 3.2.1.5366)

views = Views("{3D}")
view_disciplines = ViewDisciplines("Coordination")
setDiscipline = View.SetDiscipline(view=views, discipline=view_disciplines)
