# Dynamo graph Revit.Elements.Views.View.SetDisplayStyle.dyn (Dynamo 3.2.1.5366)

views = Views("{3D}")
view_displaystyles = ViewDisplayStyles("Realistic")
setDisplayStyle = View.SetDisplayStyle(view=views, displayStyle=view_displaystyles)
