# Dynamo graph Revit.Elements.Views.View.SetPartsVisibility.dyn (Dynamo 3.4.1.7055)

views = Views("3D Views")
view_parts_visibilities = ViewPartsVisibilitys("ShowPartsAndOriginal")
setPartsVisibility = View.SetPartsVisibility(view=views, partsVisibility=view_parts_visibilities)
partsvisibility = View.Partsvisibility(view=setPartsVisibility)
partsvisibility_2 = View.Partsvisibility(view=views)
