# Dynamo graph Revit.Elements.Views.View.SetSketchPlane.dyn (Dynamo 3.4.1.7055)

views = Views("WV_3D Walls Only")
sketchPlane = View.SketchPlane(view=views)
element_classes = ElementTypes("SketchPlane")
all_elements_of_class = ElementsOfType(element_class=element_classes)
name = Element.Name(element=all_elements_of_class)
string = StringInput("Parking")
allIndicesOf = List.AllIndicesOf(list=name, item=string)
firstItem = List.FirstItem(list=allIndicesOf)
getItemAtIndex = List.GetItemAtIndex(list=all_elements_of_class, index=firstItem)
setSketchPlane = View.SetSketchPlane(view=views, sketchPlane=getItemAtIndex)
sketchPlane_2 = View.SketchPlane(view=setSketchPlane)
