# Dynamo graph Revit.Elements.Views.View.ViewDirection.dyn (Dynamo 2.18.1.5096)

current = Document.Current()
activeView = Document.ActiveView(document=current)
viewDirection = View.ViewDirection(view=activeView)
