# Dynamo graph Revit.Elements.Views.View3D.CreateUniqueViewName.dyn (Dynamo 2.18.1.5096)

views = Views("{3D}")
name = Element.Name(element=views)
createUniqueViewName = View3D.CreateUniqueViewName(name=name)
string = StringInput("L1")
createUniqueViewName_2 = View3D.CreateUniqueViewName(name=string)
string_2 = StringInput("Neat Revit View")
createUniqueViewName_3 = View3D.CreateUniqueViewName(name=string_2)
