# Dynamo graph Revit.Elements.Wall.ByCurveAndHeight.dyn (Dynamo 3.2.1.5366)

# group: Create a line
# Create line to draw the wall with
byCoordinates = Point.ByCoordinates()
number = DoubleInput(10)
byCoordinates_2 = Point.ByCoordinates(x=number)
byStartPointEndPoint = Line.ByStartPointEndPoint(startPoint=byCoordinates, endPoint=byCoordinates_2)

number_2 = DoubleInput(10)
levels = Levels("R3")
string = StringInput("Exterior - CMU on Mtl. Stud")
byName = WallType.ByName(name=string)
byCurveAndHeight = Wall.ByCurveAndHeight(curve=byStartPointEndPoint, height=number_2, level=levels, wallType=byName)
watch_3d = Watch3D(byStartPointEndPoint)
