# Dynamo graph Revit.Elements.Wall.ByCurveAndLevels.dyn (Dynamo 3.4.1.7055)

# group: Create a line
# Create line to draw the wall with
number = DoubleInput(90)
byCoordinates = Point.ByCoordinates(x=number)
number_2 = DoubleInput(100)
byCoordinates_2 = Point.ByCoordinates(x=number_2)
byStartPointEndPoint = Line.ByStartPointEndPoint(startPoint=byCoordinates, endPoint=byCoordinates_2)

# group: 
# Inserted Dynamo graph
levels = Levels("R1")
levels_2 = Levels("R3")
string = StringInput("Exterior - CMU on Mtl. Stud")
byName = WallType.ByName(name=string)
byCurveAndLevels = Wall.ByCurveAndLevels(curve=byStartPointEndPoint, startLevel=levels, endLevel=levels_2, wallType=byName)
watch_3d = Watch3D(byStartPointEndPoint)
