# Dynamo graph Revit.Elements.Wall.ByFace.dyn (Dynamo 3.3.0.6316)

wall_location = WallLocation("FinishFaceInterior")
wall_types = WallTypes("Generic - 10\"")
select_face = DSFaceSelection()  # 1 picked in the model
byFace = Wall.ByFace(locationLine=wall_location, wallType=wall_types, surface=select_face)
