# Dynamo graph Revit.Elements.WallType.Function.dyn (Dynamo 3.2.1.5366)

element_classes = ElementTypes("WallType")
all_elements_of_class = ElementsOfType(element_class=element_classes)
function = WallType.Function(wallType=all_elements_of_class)
