# Dynamo graph Revit.Elements.WallType.Kind.dyn (Dynamo 2.18.1.5096)

categories = Categories("OST_Walls")
all_elements_of_category = ElementsOfCategory(Category=categories)
elementType = Element.ElementType(element=all_elements_of_category)
# note: an error here is okay, this occurs for in-place families
kind = WallType.Kind(wallType=elementType)
isNull = Object.IsNull(object=kind)
# note: in = in-place families categorized as walls
filterByBoolMask = List.FilterByBoolMask(list=all_elements_of_category, mask=isNull)
