# Dynamo graph Revit.Filter.FilterRule.ByRuleType.dyn (Dynamo 3.6.2.11575)

views = Views("L1")  # graph input
string = StringInput("2 HR Walls")
categories = Categories("OST_Walls")
select_rule_type = RuleTypes("Equals")
string_2 = StringInput("2 HR")
element_classes = ElementTypes("WallType")
all_elements_of_class = ElementsOfType(element_class=element_classes)
firstItem = List.FirstItem(list=all_elements_of_class)
string_3 = StringInput("Fire Rating")
parameterByName = Parameter.ParameterByName(element=firstItem, name=string_3)
byRuleType = Revit.Filter.FilterRule.ByRuleType(type=select_rule_type, value=string_2, parameter=parameterByName)
byRules = Revit.Filter.ParameterFilterElement.ByRules(name=string, categories=categories, rules=byRuleType)
addFilter = View.AddFilter(view=views, parameterFilter=byRules)
