# Dynamo graph Revit.Filter.OverrideGraphicSettings.ByProperties.dyn (Dynamo 3.3.0.6316)

element_classes = ElementTypes("ViewPlan")
all_elements_of_class = ElementsOfType(element_class=element_classes)
isViewTemplate = View.IsViewTemplate()  # unwired: view
# note: in = view templates
filter = List.Filter(list=all_elements_of_class, condition=isViewTemplate)
watch = Watch(filter.in)
categories = Categories("OST_DuctCurvesCenterLine")
byProperties = Revit.Filter.OverrideGraphicSettings.ByProperties()
boolean = BoolSelector(true)
setCategoryOverrides = View.SetCategoryOverrides(view=watch, category=categories, overrides=byProperties, hide=boolean)
