# Dynamo graph Revit.GeometryReferences.ElementCurveReference.ByCurve.dyn (Dynamo 3.6.2.11575)
# Demonstration of RevitNodes.Revit.GeometryReferences.ElementCurveReference.ByCurve - shows how to create Revit curve references from existing element curves for parametric operations

categories = Categories("OST_Lines")
all_elements_of_category = ElementsOfCategory(Category=categories)
firstItem = List.FirstItem(list=all_elements_of_category)
curves = Element.Curves(element=firstItem)
byCurve = Revit.GeometryReferences.ElementCurveReference.ByCurve(curve=curves)
