# Dynamo graph Revit.GeometryReferences.ElementFaceReference.BySurface.dyn (Dynamo 3.6.2.11575)
# ElementFaceReference.BySurface Demonstration - Shows how to create element face references from Revit wall surfaces for use in dimensioning, constraints, and face-based operations.

number = DoubleInput(0)
number_2 = DoubleInput(0)
number_3 = DoubleInput(3)
byCoordinates = Point.ByCoordinates(x=number, y=number_2, z=number_3)
number_4 = DoubleInput(0)
number_5 = DoubleInput(0)
number_6 = DoubleInput(0)
byCoordinates_2 = Point.ByCoordinates(x=number_4, y=number_5, z=number_6)
number_7 = DoubleInput(10)
number_8 = DoubleInput(0)
number_9 = DoubleInput(0)
byCoordinates_3 = Point.ByCoordinates(x=number_7, y=number_8, z=number_9)
byStartPointEndPoint = Line.ByStartPointEndPoint(startPoint=byCoordinates_2, endPoint=byCoordinates_3)
number_10 = DoubleInput(3)
levels = Levels("L2")
wall_types = WallTypes("Interior - 5 1/2\" Partition (1-hr Smoke)")
byCurveAndHeight = Wall.ByCurveAndHeight(curve=byStartPointEndPoint, height=number_10, level=levels, wallType=wall_types)
faces = Element.Faces(element=byCurveAndHeight)
integer_slider = IntegerSlider(0, range=0..100 step 1)
getItemAtIndex = List.GetItemAtIndex(list=faces, index=integer_slider)
bySurface = Revit.GeometryReferences.ElementFaceReference.BySurface(surface=getItemAtIndex)
