# Dynamo graph Revit.References.RayBounce.ByOriginDirection.dyn (Dynamo 3.4.1.7055)

select_model_element = DSModelElementSelection()  # 1 picked in the model
getLocation = Element.GetLocation(element=select_model_element)
ZAxis = Vector.ZAxis()
integer_slider = IntegerSlider(3, range=0..100 step 1)
views = Views("{3D}")
byOriginDirection = Revit.References.RayBounce.ByOriginDirection(origin=getLocation, direction=ZAxis, maxBounces=integer_slider, view=views)
