# Dynamo graph Revit.Schedules.SchedulableField.Name.dyn (Dynamo 2.18.1.5096)

element_classes = ElementTypes("ViewSchedule")
all_elements_of_class = ElementsOfType(element_class=element_classes)
firstItem = List.FirstItem(list=all_elements_of_class)
schedulableFields = ScheduleView.SchedulableFields(scheduleView=firstItem)
type = Object.Type(object=schedulableFields)
name = Revit.Schedules.SchedulableField.Name(schedulableField=schedulableFields)
