# Dynamo graph Revit.Schedules.ScheduleExportOptions.ByProperties.dyn (Dynamo 3.4.1.7055)

export_column_headers = ExportColumnHeaders("OneRow")
string = StringInput("")
boolean = BoolSelector(false)
export_text_qualifier = ExportTextQualifier("Quote")
boolean_2 = BoolSelector(false)
byProperties = Revit.Schedules.ScheduleExportOptions.ByProperties(columnHeaders=export_column_headers, fieldDelimiter=string, headersFootersBlanks=boolean, textQualifier=export_text_qualifier, title=boolean_2)
