# Dynamo graph Revit.Schedules.ScheduleField.Name.dyn (Dynamo 2.18.1.5096)

element_classes = ElementTypes("ViewSchedule")
all_elements_of_class = ElementsOfType(element_class=element_classes)
firstItem = List.FirstItem(list=all_elements_of_class)
fields = ScheduleView.Fields(scheduleView=firstItem)
name = Revit.Schedules.ScheduleField.Name(scheduleField=fields)
type = Object.Type(object=fields)
