# Dynamo graph Revit.Schedules.ScheduleFilter.FiledId.dyn (Dynamo 3.4.1.7055)

views = Views("WV_Wall Schedule")
fields = ScheduleView.Fields(scheduleView=views)
number = DoubleInput(1)
getItemAtIndex = List.GetItemAtIndex(list=fields, index=number)
schedule_filter_type = ScheduleFilterType("BeginsWith")
string = StringInput("Exterior")
byFieldTypeAndValue = Revit.Schedules.ScheduleFilter.ByFieldTypeAndValue(field=getItemAtIndex, filterType=schedule_filter_type, value=string)
filedId = Revit.Schedules.ScheduleFilter.FiledId(scheduleFilter=byFieldTypeAndValue)
