# Dynamo graph Revit.Transaction.Transaction.End.dyn (Dynamo 3.3.0.6316)

family_types = FamilyTypes("RPC Male:Alex")
number_slider = DoubleSlider(3, range=0..100 step 0.1)
number_slider_2 = DoubleSlider(8, range=0..100 step 0.1)
number_slider_3 = DoubleSlider(12, range=0..100 step 0.1)
byCoordinates = Point.ByCoordinates(x=number_slider, y=number_slider_2, z=number_slider_3)
byPoint = FamilyInstance.ByPoint(familyType=family_types, point=byCoordinates)
end = Revit.Transaction.Transaction.End(input=byPoint)
number_slider_4 = DoubleSlider(45, range=0..360 step 1)
setRotation = FamilyInstance.SetRotation(familyInstance=end, degree=number_slider_4)
