# Dynamo graph Revit.Transaction.Transaction.Start.dyn (Dynamo 3.6.2.11575)

number = DoubleInput(10)
string = StringInput("New Level")
byElevationAndName = Level.ByElevationAndName(elevation=number, name=string)
start = Revit.Transaction.Transaction.Start(input=byElevationAndName)
end = Revit.Transaction.Transaction.End(input=start)
watch = Watch(end)
