# Dynamo graph Toposolid.ByOutlinePointsTypeAndLevel(outline, points, toposolidType, level).dyn "Revit.Elements.Toposolid.ByOutlinePointsTypeAndLevel" (Dynamo 3.3.0.6316)

# note: Select Existing Floor to Convert to Toposolid
select_model_element = DSModelElementSelection()  # 1 picked in the model

# group: Extract Bottom Surface
# Extract Bottom Surface of the Given Floor to Get the Boundary
solids = Element.Solids(element=select_model_element)
explode = Geometry.Explode(geometry=solids)
flatten = List.Flatten(list=explode)
normalAtParameter = Surface.NormalAtParameter(surface=flatten)
number = DoubleInput(-1)
byCoordinates = Vector.ByCoordinates(z=number)
isAlmostEqualTo = Vector.IsAlmostEqualTo(vector=normalAtParameter, otherVector=byCoordinates)
filterByBoolMask = List.FilterByBoolMask(list=flatten, mask=isAlmostEqualTo)
code_block = CodeBlock(bottomSurface=filterByBoolMask.in) { bottomSurface; }

perimeterCurves = Surface.PerimeterCurves(surface=code_block)
byJoinedCurves = PolyCurve.ByJoinedCurves(curves=perimeterCurves)
points = Floor.Points(floor=select_model_element)

# group: Select Toposolid Type
# Given the toposolid name, collect the type from the current file
string = StringInput("Toposolid 1")  # graph input
byName = ToposolidType.ByName(name=string)

# group: Get Level
# Get the level value from the existing floor to use for toposolid creation
string_2 = StringInput("Level")
getParameterValueByName = Element.GetParameterValueByName(element=select_model_element, parameterName=string_2)

# group: Create Toposolid + Delete Existing Floor
# Create the new toposolid element and delete the floor that was converted
byOutlinePointsTypeAndLevel = Toposolid.ByOutlinePointsTypeAndLevel(outline=byJoinedCurves, points=points, toposolidType=byName, level=getParameterValueByName)
code_block_2 = CodeBlock(toposolid=byOutlinePointsTypeAndLevel, existingFloor=select_model_element)
# ---------- code_block_2.designscript (3 lines) ----------
/*this allows the graph to wait for the new toposolid
before deleting the existing floor*/
[toposolid,existingFloor][1];
# ----------------------------------------
delete = Element.Delete(element=code_block_2)
