# Dynamo graph UnitsUI.Quantities.dyn (Dynamo 3.6.2.11575)

quantities = Quantities("Area")
typeId = DynamoUnits.Quantity.TypeId(quantity=quantities)
byTypeID = DynamoUnits.Quantity.ByTypeID(typeId=typeId)
name = DynamoUnits.Quantity.Name(quantity=quantities)
units = DynamoUnits.Quantity.Units(quantity=quantities)
symbolsByUnit = DynamoUnits.Symbol.SymbolsByUnit(unit=units)
