# Dynamo graph UnitsUI.Symbols.dyn (Dynamo 3.6.2.11575)

number = DoubleInput(1.5)
number_2 = DoubleInput(1)
symbols = Symbols("Feet: '")
stringifyFraction = DynamoUnits.Symbol.StringifyFraction(value=number, precision=number_2, symbol=symbols)
watch = Watch(stringifyFraction)
