# Dynamo graph UnitsUI.UnitInput.dyn (Dynamo 3.4.1.7055)

parse_unit_input = UnitInput("10", UnitType="autodesk.unit.unit:feet-1.0.1")
watch = Watch(parse_unit_input.Unit)
type = Object.Type(object=parse_unit_input.Value)
watch_2 = Watch(parse_unit_input.Value)
