# Dynamo graph DSRevitNodesUI.HorizontalAlignment.dyn (Dynamo 3.3.0.6316)

string = StringInput("Sample Detail View")
byName = DraftingView.ByName(name=string)
origin = Point.Origin()
string_2 = StringInput("A new text note in the new view")
select_horizontal_text_alignment = HorizontalAlignment("Center")
default = TextNoteType.Default()
byLocation = TextNote.ByLocation(view=byName, location=origin, text=string_2, alignment=select_horizontal_text_alignment, type=default)
