# Dynamo graph Revit.Application.Document.GetLinkInstances.dyn (Dynamo 3.2.1.5366)

current = Document.Current()
getLinkInstances = Document.GetLinkInstances(document=current)
name = Element.Name(element=getLinkInstances)
