# Dynamo graph Revit.Application.Document.WorksharingPath.dyn (Dynamo 3.3.0.6316)

current = Document.Current()
getLinkInstances = Document.GetLinkInstances(document=current)
document = LinkInstance.Document(linkInstance=getLinkInstances)
worksharingPath = Document.WorksharingPath(document=document)
