# Dynamo graph Revit.Elements.Element.OverridesInView.dyn (Dynamo 3.2.1.5366)

overrideInView = Element.OverrideInView()  # unwired: element, overrides
categories = Categories("OST_Doors")
views = Views("L1")
all_elements_of_category_in_view = ElementsOfCategoryInView(Category=categories, View=views)
overridesInView = Element.OverridesInView(element=all_elements_of_category_in_view)
