# Dynamo graph Revit.Elements.ElementType.CanBeDeleted.dyn (Dynamo 3.2.1.5366)

element_classes = ElementTypes("WallType")
all_elements_of_class = ElementsOfType(element_class=element_classes)
name = ElementType.Name(elementType=all_elements_of_class)
canBeDeleted = ElementType.CanBeDeleted(elementType=all_elements_of_class)
