# Dynamo graph Revit.Elements.ElementType.Duplicate.dyn (Dynamo 3.2.1.5366)

string = StringInput("Generic - 4\"")  # graph input
byName = ElementType.ByName(name=string)
string_2 = StringInput("Typical - 4\"")  # graph input
duplicate = ElementType.Duplicate(elementType=byName, name=string_2)
