# Dynamo graph Revit.Elements.Family.Types.dyn (Dynamo 3.2.1.5366)

string = StringInput("RPC Male")
string_2 = StringInput("RPC Female")
list_create = List.Create(item0=string, item1=string_2)
byName = Family.ByName(name=list_create)
types = Family.Types(family=byName)
