# Dynamo graph Revit.Elements.FamilyInstance.ByPoint.dyn (Dynamo 3.2.1.5366)

# group: Construct Placement Points
# Construct Placement Points from a Parameterized Surface Using Panel Nodes
select_face = DSFaceSelection()  # 1 picked in the model
integer_slider = IntegerSlider(3, range=2..20 step 1)
integer_slider_2 = IntegerSlider(3, range=2..20 step 1)
select_boundary_condition = PanelSurfaceBoundaryConditionDropDown("Remove")
byHexagons = PanelSurface.ByHexagons(surface=select_face, numU=integer_slider, numV=integer_slider_2, boundaryCondition=select_boundary_condition)
getPanelPolygon = PanelSurface.GetPanelPolygon(panelSurface=byHexagons)
center = Polygon.Center(polygon=getPanelPolygon)
flatten = List.Flatten(list=center)

# group: Create List of Family Types
# Create a big list of randomized family types to select from for RPC placement
string = StringInput("RPC Male")
string_2 = StringInput("RPC Female")
list_create = List.Create(item0=string, item1=string_2)
byName = Family.ByName(name=list_create)
types = Family.Types(family=byName)
flatten_2 = List.Flatten(list=types)
count = List.Count(list=flatten)
cycle = List.Cycle(list=flatten_2, amount=count)
integer_slider_3 = IntegerSlider(0, range=0..100 step 1)
shuffle = List.Shuffle(list=cycle, seed=integer_slider_3)

byPoint = FamilyInstance.ByPoint(familyType=shuffle, point=flatten)
watch_3d = Watch3D(select_face, getPanelPolygon, flatten)
