# Dynamo graph Revit.Elements.FamilyInstance.GetHost.dyn (Dynamo 3.2.1.5366)

categories = Categories("OST_Doors")
current = Document.Current()
activeView = Document.ActiveView(document=current)
all_elements_of_category_in_view = ElementsOfCategoryInView(Category=categories, View=activeView)
getHost = FamilyInstance.GetHost(familyInstance=all_elements_of_category_in_view)
