# Dynamo graph Revit.Elements.FamilyInstance.Space.dyn (Dynamo 3.2.1.5366)

categories = Categories("OST_DuctTerminal")
all_elements_of_category = ElementsOfCategory(Category=categories)
space = FamilyInstance.Space(familyInstance=all_elements_of_category)
