# Dynamo graph Revit.Elements.FamilyType.Family.dyn (Dynamo 3.2.1.5366)

categories = Categories("OST_Doors")
current = Document.Current()
activeView = Document.ActiveView(document=current)
all_elements_of_category_in_view = ElementsOfCategoryInView(Category=categories, View=activeView)
elementType = Element.ElementType(element=all_elements_of_category_in_view)
family = FamilyType.Family(familyType=elementType)
groupByKey = List.GroupByKey(list=all_elements_of_category_in_view, keys=family)
watch = Watch(groupByKey.groups)
