# Dynamo graph Revit.Elements.FilledRegionType.FillPatternId.dyn (Dynamo 3.2.1.5366)

string = StringInput("Diagonal Down")
byName = FilledRegionType.ByName(name=string)
fillPatternId = FilledRegionType.FillPatternId(filledRegionType=byName)
