# Dynamo graph Revit.Elements.FilledRegionType.Name.dyn (Dynamo 3.3.0.6316)

element_classes = ElementTypes("FilledRegionType")
all_elements_of_class = ElementsOfType(element_class=element_classes)
name = FilledRegionType.Name(filledRegionType=all_elements_of_class)
