# Dynamo graph Revit.Elements.FloorType.ByName.dyn (Dynamo 3.2.1.5366)

categories = Categories("OST_Floors")
all_elements_of_category = ElementsOfCategory(Category=categories)
name = Element.Name(element=all_elements_of_category)
byName = FloorType.ByName(name=name)
