# Dynamo graph Revit.Elements.GlobalParameter.GroupType.dyn (Dynamo 3.2.1.5366)

element_classes = ElementTypes("GlobalParameter")
all_elements_of_class = ElementsOfType(element_class=element_classes)
groupType = GlobalParameter.GroupType(globalParameter=all_elements_of_class)
