# Dynamo graph Revit.Elements.GlobalParameter.SetValue.dyn (Dynamo 3.2.1.5366)

string = StringInput("Building Number")  # graph input
spec_types = SpecTypes("autodesk.spec:spec.string")
byName = GlobalParameter.ByName(name=string, specType=spec_types)
string_2 = StringInput("Building 01")
setValue = GlobalParameter.SetValue(parameter=byName, value=string_2)
