# Dynamo graph Revit.Elements.GlobalParameter.SpecType.dyn (Dynamo 3.2.1.5366)

element_classes = ElementTypes("GlobalParameter")
all_elements_of_class = ElementsOfType(element_class=element_classes)
specType = GlobalParameter.SpecType(globalParameter=all_elements_of_class)
