# Dynamo graph Revit.Elements.Group.GroupType.dyn (Dynamo 3.2.1.5366)

categories = Categories("OST_IOSModelGroups")
all_elements_of_category = ElementsOfCategory(Category=categories)
groupType = Group.GroupType(group=all_elements_of_category)
