# Dynamo graph Revit.Elements.Group.Location.dyn (Dynamo 3.2.1.5366)

categories = Categories("OST_IOSModelGroups")
all_elements_of_category = ElementsOfCategory(Category=categories)
location = Group.Location(group=all_elements_of_category)
watch_3d = Watch3D(location)
