# Dynamo graph Revit.Elements.Group.UngroupElements.dyn (Dynamo 3.2.1.5366)

categories = Categories("OST_IOSModelGroups")
all_elements_of_category = ElementsOfCategory(Category=categories)
groupType = Group.GroupType(group=all_elements_of_category)
name = Element.Name(element=groupType)
string = StringInput("Bleachers Continuous")
eq = name == string
filterByBoolMask = List.FilterByBoolMask(list=all_elements_of_category, mask=eq)
ungroupElements = Group.UngroupElements(group=filterByBoolMask.in)
