# Dynamo graph Revit.Elements.LinePatternElement.GetByName.dyn (Dynamo 3.3.0.6316)

string = StringInput("Center")
getByName = LinePatternElement.GetByName(name=string)
name = Element.Name(element=getByName)
