# Dynamo graph Revit.Elements.LinkElement.BoundingBox.dyn (Dynamo 3.3.0.6316)

# group: How a LinkInstance's Name Works
# Link instances are the individual placements of a specific link type. The name is unique and is found between the ":"
select_model_element = DSModelElementSelection()  # 1 picked in the model
name = Element.Name(element=select_model_element)
watch = Watch(name)

string = StringInput("1264746")
string_2 = StringInput("22")
byName = LinkInstance.ByName(name=string_2)
elementById = LinkInstance.ElementById(id=string, linkInstance=byName)
boundingBox = LinkElement.BoundingBox(linkedElement=elementById)
