# Dynamo graph Revit.Elements.LinkInstance.AllElementsOfCategoryInView.dyn (Dynamo 3.2.1.5366)

string = StringInput("Snowdon Towers Sample Site")
byTitle = LinkInstance.ByTitle(title=string)
categories = Categories("OST_Toposolid")
views = Views("L1")
allElementsOfCategoryInView = LinkInstance.AllElementsOfCategoryInView(linkInstance=byTitle, category=categories, view=views)
