# Dynamo graph Revit.Elements.LinkInstance.Document.dyn (Dynamo 3.2.1.5366)

string = StringInput("Snowdon Towers Sample Site")
byTitle = LinkInstance.ByTitle(title=string)
document = LinkInstance.Document(linkInstance=byTitle)
