# Dynamo graph Revit.Elements.Material.AppearanceAssetElement.dyn (Dynamo 3.2.1.5366)

categories = Categories("OST_Materials")
all_elements_of_category = ElementsOfCategory(Category=categories)
appearanceAssetElement = Material.AppearanceAssetElement(material=all_elements_of_category)
