# Dynamo graph Revit.Elements.ModelText.Depth.dyn (Dynamo 3.2.1.5366)

element_classes = ElementTypes("ModelText")
all_elements_of_class = ElementsOfType(element_class=element_classes)
depth = ModelText.Depth(modelText=all_elements_of_class)
