# Dynamo graph Revit.Elements.ModelText.Text.dyn (Dynamo 3.2.1.5366)

element_classes = ElementTypes("ModelText")
all_elements_of_class = ElementsOfType(element_class=element_classes)
text = ModelText.Text(modelText=all_elements_of_class)
