# Dynamo graph Revit.Elements.Parameter.HasValue.dyn (Dynamo 3.2.1.5366)

categories = Categories("OST_Walls")
all_elements_of_category = ElementsOfCategory(Category=categories)
firstItem = List.FirstItem(list=all_elements_of_category)
parameters = Element.Parameters(element=firstItem)
hasValue = Parameter.HasValue(parameter=parameters)
filterByBoolMask = List.FilterByBoolMask(list=parameters, mask=hasValue)
parameters_with_values = Watch(filterByBoolMask.in)
parameters_without_values = Watch(filterByBoolMask.out)
