# Dynamo graph Revit.Elements.Parameter.IsReadOnly.dyn (Dynamo 3.2.1.5366)

categories = Categories("OST_Walls")
all_elements_of_category = ElementsOfCategory(Category=categories)
firstItem = List.FirstItem(list=all_elements_of_category)
parameters = Element.Parameters(element=firstItem)
isReadOnly = Parameter.IsReadOnly(parameter=parameters)
filterByBoolMask = List.FilterByBoolMask(list=parameters, mask=isReadOnly)
read_only_parameters = Watch(filterByBoolMask.in)
editable_parameters = Watch(filterByBoolMask.out)
