# Dynamo graph Revit.Elements.Parameter.SetValue.dyn (Dynamo 3.2.1.5366)

categories = Categories("OST_ProjectInformation")
all_elements_of_category = ElementsOfCategory(Category=categories)
firstItem = List.FirstItem(list=all_elements_of_category)
string = StringInput("Project Name")  # graph input
parameterByName = Parameter.ParameterByName(element=firstItem, name=string)
value = Parameter.Value(parameter=parameterByName)
toLower = String.ToLower(string=value)
setValue = Parameter.SetValue(parameter=parameterByName, value=toLower)
