# Dynamo graph Revit.Elements.Parameter.SpecType.dyn (Dynamo 3.2.1.5366)

categories = Categories("OST_ProjectInformation")
all_elements_of_category = ElementsOfCategory(Category=categories)
firstItem = List.FirstItem(list=all_elements_of_category)
parameters = Element.Parameters(element=firstItem)
specType = Parameter.SpecType(parameter=parameters)
