# Dynamo graph Revit.Elements.RoofType.Name.dyn (Dynamo 3.3.0.6316)

element_classes = ElementTypes("RoofType")
all_elements_of_class = ElementsOfType(element_class=element_classes)
name = RoofType.Name(roofType=all_elements_of_class)
