# Dynamo graph Revit.Elements.Room.CoreBoundary.dyn (Dynamo 3.2.1.5366)

categories = Categories("OST_Rooms")
views = Views("L1")
all_elements_of_category_in_view = ElementsOfCategoryInView(Category=categories, View=views)
coreBoundary = Room.CoreBoundary(room=all_elements_of_category_in_view)
