# Dynamo graph Revit.Elements.Room.Location.dyn (Dynamo 3.2.1.5366)

categories = Categories("OST_Rooms")
views = Views("L1")
all_elements_of_category_in_view = ElementsOfCategoryInView(Category=categories, View=views)
location = Room.Location(room=all_elements_of_category_in_view)

# group: Review
# Preview room names in Dynamo viewport
name = Room.Name(room=all_elements_of_category_in_view)
byPointAndString = Analysis.Label.ByPointAndString(point=location, label=name)
centerBoundary = Room.CenterBoundary(room=all_elements_of_category_in_view)
