# Dynamo graph Revit.Elements.Room.Name.dyn (Dynamo 3.2.1.5366)

categories = Categories("OST_Rooms")
views = Views("L1")
all_elements_of_category_in_view = ElementsOfCategoryInView(Category=categories, View=views)
name = Room.Name(room=all_elements_of_category_in_view)
