# Dynamo graph Revit.Elements.ScheduleOnSheet.ScheduleView.dyn (Dynamo 3.2.1.5366)

# group: Select Sheet
# Select sheet to use
sheets = Sheets("First Floor Plan")  # graph input
schedules = Sheet.Schedules(sheet=sheets)

scheduleView = ScheduleOnSheet.ScheduleView(scheduleOnSheet=schedules)
