# Dynamo graph Revit.Elements.Space.IsPointInsideSpace.dyn (Dynamo 3.2.1.5366)

categories = Categories("OST_DuctTerminal")
views = Views("L1 - Block 35")
all_elements_of_category_in_view = ElementsOfCategoryInView(Category=categories, View=views)
categories_2 = Categories("OST_MEPSpaces")
all_elements_of_category_in_view_2 = ElementsOfCategoryInView(Category=categories_2, View=views)
getLocation = Element.GetLocation(element=all_elements_of_category_in_view)
isPointInsideSpace = Space.IsPointInsideSpace(space=all_elements_of_category_in_view_2@L1, point=getLocation)
allFalse = List.AllFalse(list=isPointInsideSpace@L2)

# group: Air Terminals within Spaces
# Filter for air terminals that are within spaces in the given view.
filterByBoolMask = List.FilterByBoolMask(list=all_elements_of_category_in_view, mask=allFalse)
