# Dynamo graph Revit.Elements.Space.SetName.dyn (Dynamo 3.2.1.5366)

categories = Categories("OST_MEPSpaces")
views = Views("L1 - Block 35")
all_elements_of_category_in_view = ElementsOfCategoryInView(Category=categories, View=views)
string = StringInput("(E)")
name = Room.Name(room=all_elements_of_category_in_view)
add = string + name
setName = Space.SetName(space=all_elements_of_category_in_view, value=add)
