# Dynamo graph Revit.Elements.Space.SetNumber.dyn (Dynamo 3.2.1.5366)

categories = Categories("OST_MEPSpaces")
views = Views("L1 - Block 35")
all_elements_of_category_in_view = ElementsOfCategoryInView(Category=categories, View=views)
number = Space.Number(space=all_elements_of_category_in_view)
string = StringInput("e")
add = number + string
setNumber = Space.SetNumber(space=all_elements_of_category_in_view, value=add)
