# Dynamo graph Revit.Elements.Space.Volume.dyn (Dynamo 3.2.1.5366)

categories = Categories("OST_MEPSpaces")
all_elements_of_category = ElementsOfCategory(Category=categories)
volume = Space.Volume(space=all_elements_of_category)
