# Dynamo graph Revit.Elements.Tag.HeadLocation.dyn (Dynamo 3.2.1.5366)

categories = Categories("OST_DoorTags")
views = Views("L1")
all_elements_of_category_in_view = ElementsOfCategoryInView(Category=categories, View=views)
headLocation = Tag.HeadLocation(tag=all_elements_of_category_in_view)
watch_3d = Watch3D(headLocation)
