# Dynamo graph Revit.Elements.TextNote.SetText.dyn (Dynamo 3.2.1.5366)

categories = Categories("OST_TextNotes")
all_elements_of_category = ElementsOfCategory(Category=categories)
text = TextNote.Text(textNote=all_elements_of_category)
toUpper = String.ToUpper(string=text)
setText = TextNote.SetText(textNote=all_elements_of_category, value=toUpper)
