# Dynamo graph Revit.Elements.Toposolid.Points.dyn (Dynamo 3.3.0.6316)

# note: Select Link in View
select_model_element = DSModelElementSelection()  # 1 picked in the model
categories = Categories("OST_Toposolid")
allElementsOfCategory = LinkInstance.AllElementsOfCategory(linkInstance=select_model_element, category=categories)
firstItem = List.FirstItem(list=allElementsOfCategory)
points = Toposolid.Points(toposolid=firstItem)
