# Dynamo graph Revit.Elements.Viewport.BoxOutline.dyn (Dynamo 3.2.1.5366)

sheets = Sheets("Wall Sections")
viewports = Sheet.Viewports(sheet=sheets)
boxOutline = Viewport.BoxOutline(viewport=viewports)
watch_3d = Watch3D(boxOutline)
