# Dynamo graph Revit.Elements.Views.View.AddFilter.dyn (Dynamo 3.2.1.5366)

# group: Input
views = Views("L1")  # graph input

# group: Lookup Parameter
# Get the fire rating parameter from wall types in the current Revit document
element_classes = ElementTypes("WallType")
all_elements_of_class = ElementsOfType(element_class=element_classes)
firstItem = List.FirstItem(list=all_elements_of_class)
string = StringInput("Fire Rating")
parameterByName = Parameter.ParameterByName(element=firstItem, name=string)

# group: Create Filter Rule
# Create a filter rule for 2 HR rated walls
string_2 = StringInput("2 HR Walls")
categories = Categories("OST_Walls")
select_rule_type = RuleTypes("Equals")
string_3 = StringInput("2 HR")
byRuleType = Revit.Filter.FilterRule.ByRuleType(type=select_rule_type, value=string_3, parameter=parameterByName)
byRules = Revit.Filter.ParameterFilterElement.ByRules(name=string_2, categories=categories, rules=byRuleType)

# group: Add Filter
# Add filter to view
addFilter = View.AddFilter(view=views, parameterFilter=byRules)
