# Dynamo graph Revit.Elements.Views.View.CanViewBeDuplicated.dyn (Dynamo 3.2.1.5366)

categories = Categories("OST_Views")
all_elements_of_category = ElementsOfCategory(Category=categories)

# group: Filter for Drafting Views
# Remove all views that are not drafting views
string = StringInput("Revit.Elements.Views.DraftingView")  # graph input
removeIfNot = List.RemoveIfNot(list=all_elements_of_category, type=string)

view_duplicate_options = ViewDuplicateOptions("WithDetailing")
canViewBeDuplicated = View.CanViewBeDuplicated(view=removeIfNot, viewDuplicateOption=view_duplicate_options)
