# Dynamo graph Revit.Elements.Views.View.DuplicateView.dyn (Dynamo 3.2.1.5366)

views = Views("North Wall Window Detail")  # graph input
view_duplicate_options = ViewDuplicateOptions("WithDetailing")
string = StringInput("-Revision 1")
duplicateView = View.DuplicateView(view=views, viewDuplicateOption=view_duplicate_options, suffix=string)
