# Dynamo graph Revit.Elements.Views.View.ExportAsImage.dyn (Dynamo 3.2.1.5366)

views = Views("{3D}")
name = Element.Name(element=views)
python_script = Python(IN[0]=name)  # CPython3
# ---------- python_script.python (15 lines) ----------
# Load the Python Standard and DesignScript Libraries
import sys
import clr
import os
clr.AddReference('ProtoGeometry')
from Autodesk.DesignScript.Geometry import *

# user inputs
viewName = IN[0]

# Place your code below this line
exportedImagePath = os.path.expanduser('~\pictures\\')

# Assign your output to the OUT variable.
OUT = exportedImagePath + viewName + ".png"
# ----------------------------------------
exportAsImage = View.ExportAsImage(view=views, path=python_script)
