# Dynamo graph Revit.Elements.Views.View.FilterOverrides.dyn (Dynamo 3.2.1.5366)

current = Document.Current()
activeView = Document.ActiveView(document=current)
filters = View.Filters(view=activeView)
filterOverrides = View.FilterOverrides(view=activeView, parameterFilter=filters)
