# Dynamo graph Revit.Elements.Views.View.IsCategoryHidden.dyn (Dynamo 3.2.1.5366)

current = Document.Current()
activeView = Document.ActiveView(document=current)
string = StringInput("View Template")
getParameterValueByName = Element.GetParameterValueByName(element=activeView, parameterName=string)
categories = Categories("OST_Walls")
isCategoryHidden = View.IsCategoryHidden(view=getParameterValueByName, category=categories)
