# Dynamo graph Revit.Elements.Views.View.IsolateCategoriesTemporary.dyn (Dynamo 3.2.1.5366)

views = Views("L1")
categories = Categories("OST_Doors")
categories_2 = Categories("OST_Furniture")
list_create = List.Create(item0=categories, item1=categories_2)
isolateCategoriesTemporary = View.IsolateCategoriesTemporary(view=views, categories=list_create)
