# Dynamo graph Revit.Elements.Views.View.IsolateElementsTemporary.dyn (Dynamo 3.2.1.5366)

views = Views("L1")
categories = Categories("OST_Walls")
all_elements_of_category_in_view = ElementsOfCategoryInView(Category=categories, View=views)

# group: Find Walls that are Fire Rated
# Create a boolean mask that represents if the wall has a fire rating
elementType = Element.ElementType(element=all_elements_of_category_in_view)
string = StringInput("Fire Rating")
getParameterValueByName = Element.GetParameterValueByName(element=elementType, parameterName=string)
string_2 = StringInput("")
ne = getParameterValueByName != string_2

# note: in = not fire rated
filterByBoolMask = List.FilterByBoolMask(list=all_elements_of_category_in_view, mask=ne)
isolateElementsTemporary = View.IsolateElementsTemporary(view=views, elements=filterByBoolMask.in)
