# Dynamo graph Revit.Elements.Views.View.SetCropBoxVisible.dyn (Dynamo 3.2.1.5366)

categories = Categories("OST_Sheets")
all_elements_of_category = ElementsOfCategory(Category=categories)
views = Sheet.Views(sheet=all_elements_of_category)
boolean = BoolSelector(false)
setCropBoxVisible = View.SetCropBoxVisible(view=views, isVisible=boolean)
