# Dynamo graph Revit.Elements.WallType.GetThermalProperties.dyn (Dynamo 3.2.1.5366)

string = StringInput("Exterior - CMU on Mtl. Stud")
byName = WallType.ByName(name=string)
getThermalProperties = WallType.GetThermalProperties(wallType=byName)
