# Dynamo graph Revit.Elements.WallType.Name.dyn (Dynamo 3.2.1.5366)

element_classes = ElementTypes("WallType")
all_elements_of_class = ElementsOfType(element_class=element_classes)
name = WallType.Name(wallType=all_elements_of_class)
