# Dynamo graph Revit Adaptive Component Placement.dyn "Umístění adaptivních komponent aplikace Revit" (Dynamo 4.0.0.3076)
# author: Dynamo Team
# Tento graf umisťuje adaptivní komponenty podle bodů v modelu.

# group: Info
# note: V aplikaci Revit byly předem vybrány čáry osnovy obvodového pláště, ID prvků byly uloženy se souborem aplikace Dynamo.
# note: Spusťte tento graf v souboru Snowdon Tower Sample Architectural.rvt ve složce Samples v rámci instalace aplikace Revit:
# C:\Program Files\Autodesk\Revit 2027\Samples
# Spusťte tento graf po načtení adaptivní rodiny AdaptivePanel.rfa z umístění datových sad aplikace Dynamo.
# note: Umístěte adaptivní komponenty relativně k některým prvkům vybraným v souboru aplikace Revit.
# Adaptivní komponenty vyžadují sadu bodů, která se rovná počtu bodů umístění rodiny, která je umísťována.

# group: Vstupy
# note: Vybrat čáry osnovy obvodového pláště
vybrat_hrany = SelectEdges()  # 7 picked in the model; graph input
# note: Nastavit minimální a maximální posunutí pro bod poloviny žebra
min_posunutí = DoubleSlider(1.4, range=0.2..3 step 0.1)
max_posunutí = DoubleSlider(4.3, range=3..8 step 0.1)
# note: Vybrat rodinu adaptivních komponent
family_types = FamilyTypes("AdaptivePanel:AdaptivePanel")  # graph input

# note: Vytvořte seznam pozic bodů podél křivky, přičemž 0 je počátek, 0,5 - střed a 1 je konec
seznam_parametrů = CodeBlock { [0,0.5,1]; }
# note: Najít počáteční, středový a koncový bod u každé křivky
pointAtParameter = Curve.PointAtParameter(curve=vybrat_hrany, param=seznam_parametrů, lacing=CrossProduct)

# group: Uchopit počáteční a koncový bod z každé křivky
indexy_počátečního_a_koncového = CodeBlock { 0; 2; }  # "indexy počátečního a koncového bodu"
getItemAtIndex = List.GetItemAtIndex(list=pointAtParameter@L2, index=indexy_počátečního_a_koncového.out0)
# note: Podobně jako při výběru poloviny vyberte pomocí úrovní počáteční a koncový bod z každé křivky.
getItemAtIndex_2 = List.GetItemAtIndex(list=pointAtParameter@L2, index=indexy_počátečního_a_koncového.out1)

# group: Uchopit polovinu z každé křivky
index_bodu_poloviny = CodeBlock { 1; }
# note: Použijte úrovně seznamu u vstupu `list`. Ve výchozím nastavení bude výsledkem uzlu seznam s indexem jedna (druhá křivka). Klikněte pravým tlačítkem na vstup `list` a vyberte položku `Použít úrovně` na @L2. Tím vyberete položku s indexem 1 z každého vnořeného seznamu (středové body z každé křivky).
getItemAtIndex_3 = List.GetItemAtIndex(list=pointAtParameter@L2, index=index_bodu_poloviny)

# group: Vytvořit sinusovou vlnu
# note: Spočítat počet vybraných zdrojových křivek
count = List.Count(list=vybrat_hrany)
# note: Vytvořit posloupnost hodnot N od 0 do 1
sequence = CodeBlock(steps=count) { 0..1..#steps; }
# note: Vytvořit sinusové vlny
sin = Math.Sin(angle=sequence)
# note: Přemapovat hodnoty sinusové vlny na nové hodnoty Max a MIn
remapRange = Math.RemapRange(numbers=sin, newMin=min_posunutí, newMax=max_posunutí)

# group: Posunout body poloviny
# note: Negovat hodnotu posunutí ve směru Y směrem k vnější straně obvodového pláště
negovat_hodnotu = CodeBlock(y=remapRange) { -y; }
# note: Posunout body poloviny žebra
translate = Geometry.Translate(geometry=getItemAtIndex_3, yTranslation=negovat_hodnotu, zTranslation=remapRange)

# note: Negovat hodnotu posunutí ve směru Y směrem k vnější straně obvodového pláště
negovat_hodnotu_2 = CodeBlock(y=remapRange) { y; }
# note: Posunout body poloviny žebra
translate_2 = Geometry.Translate(geometry=getItemAtIndex_3, yTranslation=negovat_hodnotu_2, zTranslation=remapRange)

# group: Znovu spojit body v seznamech
list_create = List.Create(item0=getItemAtIndex, item1=translate, item2=getItemAtIndex_2, item3=translate_2)
# note: Převrátit matici a uspořádat seznamy v sadách po 3
transpose = List.Transpose(lists=list_create)

# group: Do aplikace Revit: Umístit komponentu
# note: Adaptivní komponenty je možné umístit pomocí množin bodů, které se rovnají počtu bodů umístění rodiny.
byPoints = AdaptiveComponent.ByPoints(points=transpose, familyType=family_types)
