# Dynamo graph Revit Color.dyn "Barva aplikace Revit" (Dynamo 4.0.0.3076)
# author: Dynamo Team
# Tento graf vyhodnotí plochu povrchu vybraných prvků a pomocí přepsání zobrazení vybarví prvky podle této hodnoty.

# group: Info
# note: Spusťte tento graf v souboru Snowdon Tower Sample Architectural.rvt ve složce Samples v rámci instalace aplikace Revit
# C:\Program Files\Autodesk\Revit 2027\Samples
# note: Tento graf vybarvuje prvky aplikace Revit podle měřitelných kritérií (plocha povrchu).
# Prvky jsou vybarveny pomocí funkce Přepsat zobrazení v nabídce Zobrazení > Podle prvku.

# group: Vybrat prvky modelu
# Vyberte stěny fasády
# note: Kliknutím na tlačítko 'Změnit' vyberte prvky z modelu aplikace Revit.
vybere_prvky_modelu = DSModelElementsSelection()  # 33 picked in the model; graph input

# group: Vyhodnotit plochu povrchu prvku
# note: Načíst geometrii prvku
getGeometry = Element.GetGeometry(element=vybere_prvky_modelu)
flatten = List.Flatten(list=getGeometry)
# note: Extrahovat oblast povrchu geometrie
area = Solid.Area(solid=flatten)
# note: Načíst nejvyšší hodnotu
maximumItem = List.MaximumItem(list=area)
# note: Normalizovat na nejvyšší hodnotu
div = area / maximumItem  # graph output

# group: Vytvořit barvy
# Příprava barevného schématu pro barevné rozlišení prvků
number = DoubleInput(0)
number_2 = DoubleInput(255)
# note: zelená barva
byARGB = Color.ByARGB(alpha=number, red=number, green=number_2, blue=number, lacing=Longest)
number_3 = DoubleInput(0)
number_4 = DoubleInput(255)
# note: červená barva
byARGB_2 = Color.ByARGB(alpha=number_3, red=number_4, green=number_3, blue=number_3, lacing=Longest)
create = List.Create(item0=byARGB, item1=byARGB_2)
code_block = CodeBlock { [0,1]; }
# note: nastavit rozsah barev
color_range = ColorRange(colors=create, indices=code_block, value=div)

# group: Do aplikace Revit: Přepsat barvu prvku v pohledu
# note: Tato možnost přepíše barvu prvku v aktivním pohledu.
overrideColorInView = Element.OverrideColorInView(element=vybere_prvky_modelu, color=color_range, lacing=Longest)

# group: Práh
number_5 = DoubleInput(100)

# group: Alternativa – vyhodnotí, zda kritéria splňují daný práh
# note: Porovnat s prahovou hodnotou
gt = area > number_5
# note: Čísla budou označovat polohu na barevném spektru – od 0 do 1
number_6 = DoubleInput(1)
number_7 = DoubleInput(0)
# note: identifikovat oblasti v rámci tolerance
if_ = RefactoredIf(test=gt, true=number_6, false=number_7)
# note: tento výsledek je možné použít jako vstup 'indices' uzlu Color Range
watch = Watch(if_)
