# Dynamo graph Revit Floors and Framing.dyn "Podlahy a rámové konstrukce aplikace Revit" (Dynamo 4.0.0.3076)
# author: Dynamo Team
# Tento graf vytvoří architektonickou stavbu pomocí řady čar a jejich posunutí a umístí prvky konstrukčních rámových konstrukcí a podlaží v aplikaci Revit.
# packages: Modul PythonNet3 1.4.5

# group: Info
# note: Spusťte tento graf v souboru Snowdon Tower Sample Architectural.rvt ve složce Samples v rámci instalace aplikace Revit
# C:\Program Files\Autodesk\Revit 2027\Samples
# note: Tento graf vytvoří architektonickou stavbu pomocí řady čar a použije je k řízení umístění konstrukčních rámových konstrukcí a podlaží.

# group: Poloha středu podlaží
poloha_x = DoubleSlider(30, range=25..40 step 1)  # graph input
poloha_y = DoubleSlider(30, range=25..40 step 1)  # graph input
poloha_z = DoubleSlider(62, range=60..80 step 1)  # graph input

# group: Konfigurace stavby
# Popis <Dvojitým kliknutím sem upravte popis skupiny>
poloměr_dolního_podlaží = DoubleSlider(10, range=8..20 step 1)  # graph input
počet_podlaží = DoubleSlider(7, range=3..10 step 1)  # graph input
zmenšení_poloměru = DoubleSlider(-1.25, range=-2..-0.5 step 0.25)  # graph input
počet_stran_polygonu = IntegerSlider(5, range=3..10 step 1)  # graph input
výška_horního_podlaží = DoubleSlider(38.4, range=15..50 step 0.1)  # graph input
maximální_otočení_stupně = DoubleSlider(130, range=10..180 step 5)  # graph input

# group: Vytvořit polygony
# Vytvoří řadu polygonů se zmenšujícími se poloměry, které jsou vertikálně odsazovány a postupně otáčeny.
# note: Střed stavby
byCoordinates = Point.ByCoordinates(x=poloha_x, y=poloha_y, z=poloha_z)
# note: Posloupnost poloměrů kružnic
sequence = Sequence(start=poloměr_dolního_podlaží, amount=počet_podlaží, step=zmenšení_poloměru, lacing=Longest)
# note: Vytvořit řadu kružnic
byCenterPointRadius = Circle.ByCenterPointRadius(centerPoint=byCoordinates, radius=sequence)
# note: Vytvořit řadu polygonů
regularPolygon = Polygon.RegularPolygon(circle=byCenterPointRadius, numberSides=počet_stran_polygonu)
# note: Posloupnost výšek podlaží
posloupnost_výšek_podlaží = CodeBlock(top_floor=výška_horního_podlaží, count=počet_podlaží) { 0..top_floor..#count; }
byCoordinates_2 = Vector.ByCoordinates(z=posloupnost_výšek_podlaží)
# note: Přesunout polygony nahoru o zadané výšky
translate = Geometry.Translate(geometry=regularPolygon, direction=byCoordinates_2)
ZAxis = Vector.ZAxis()
# note: Posloupnost otočení pro každé podlaží
posloupnost_úhlů_otočení = CodeBlock(max_degrees=maximální_otočení_stupně, count=počet_podlaží) { 0..max_degrees..#count; }
# note: Otočení polygonů pomocí řady úhlů
rotate = Geometry.Rotate(geometry=translate, origin=byCoordinates, axis=ZAxis, degrees=posloupnost_úhlů_otočení)
# note: Extrahovat jednotlivé křivky z mnohoúhelníků
curves = PolyCurve.Curves(polyCurve=rotate)

# group: Typ a úroveň podlaží
# note: Vyberte typ podlaží pro vytvořená podlaží z typů existujících v projektu pomocí rozevíracího seznamu.
floor_types = FloorTypes("Concrete Slab 6\"")  # graph input
levels = Levels("Green Roof Hardscape")  # graph input

# group: Do aplikace Revit: Vytvořit podlaží
# Použijte řadu uzavřených smyček křivek jako vstup pro tvorbu podlaží
# note: Předat skupiny křivek za účelem vytvoření podlaží
byOutlineTypeAndLevel = Floor.ByOutlineTypeAndLevel(outline=curves, floorType=floor_types, level=levels)

# group: Vertikální propojení
# Spojit rohy polygonu mezi úrovněmi stavby
# note: Získat koncové body každé křivky polygonu
endPoint = Curve.EndPoint(curve=curves)
# note: Převrátit matici a získat seznamy koncových bodů zarovnaných vertikálně
transpose = List.Transpose(lists=endPoint)
# note: Spojte odpovídající rohy polygonů od nejnižší po nejvyšší podlaží stavby a propojte je jako objekty PolyCurve.
byPoints = PolyCurve.ByPoints(points=transpose)
# note: Dekonstruovat objekty PolyCurve a získat seznamy křivek, které budou sloužit jako vstup pro prvky konstrukčních rámových konstrukcí.
curves_2 = PolyCurve.Curves(polyCurve=byPoints)

# group: Typ a úroveň konstrukční rámové konstrukce
levels_2 = Levels("Green Roof Hardscape")  # graph input
# note: Vyberte typ konstrukční rámové konstrukce z typů načtených do projektu pomocí rozevíracího seznamu.
structural_framing_types = StructuralFramingTypes("W12X26")  # graph input

# group: Do aplikace Revit: Vytvořit konstrukční rámovou konstrukci
# Pomocí křivek vytvořte prvky konstrukčních rámových konstrukcí a pomocí uzlu jazyka Python zakažte spoj mezi jednotlivými nosníky.
# note: Předat jednotlivé křivky pro každý konstrukční prvek
beamByCurve = StructuralFraming.BeamByCurve(curve=curves_2, level=levels_2, structuralFramingType=structural_framing_types)
# note: Příprava seznamu
flatten = List.Flatten(list=beamByCurve)
# note: Jedná se o přejmenovaný uzel jazyka Python, který odkazuje na rozhraní API aplikace Revit a umožňuje rozšířit možnosti uzlů aplikace Dynamo oproti předem připraveným uzlům. Chcete-li si přečíst kód jazyka Python, klikněte pravým tlačítkem na uzel a vyberte možnost Upravit...
zakázat_spoje_na_konstrukční = Python(structuralFraming=flatten)  # "Zakázat spoje na konstrukční rámové konstrukci"; PythonNet3
# ---------- zakázat_spoje_na_konstrukční.python (35 lines) ----------
# Load the Python Standard and DesignScript Libraries
import sys
import clr
clr.AddReference('ProtoGeometry')
from Autodesk.DesignScript.Geometry import *
from Autodesk.Revit.DB import *
from RevitServices.Transactions import TransactionManager
from RevitServices.Persistence import DocumentManager 

doc = DocumentManager.Instance.CurrentDBDocument

# The inputs to this node will be stored as a list in the IN variables.
dataEnteringNode = IN

# Place your code below this line
structural_framing = UnwrapElement(IN[0])

unjoined_elements = []
# start a Transaction
TransactionManager.Instance.EnsureInTransaction(doc)
# iterate through each structural framing element
for sf in structural_framing:
    # check if the element passed in of Structural Framing Category
    sf_category = sf.Category # get the element's Category
    # use the Structural Framing's Category Id to check
    if sf_category.Id.Value == -2001320:
        # disallow joins at start and end of the structural framing element
        Structure.StructuralFramingUtils.DisallowJoinAtEnd(sf, 0)
        Structure.StructuralFramingUtils.DisallowJoinAtEnd(sf, 1)
        unjoined_elements.append(sf)
TransactionManager.Instance.TransactionTaskDone()

    
# Output the list of elements with Disallowed Join
OUT = unjoined_elements
# ----------------------------------------
