# Dynamo graph Revit Geometry Creation Points.dyn "Body tvorby geometrie aplikace Revit" (Dynamo 4.0.0.3076)
# author: Dynamo Team
# Tento graf vytvoří modelovou čáru a referenční bod v prostředí rodiny koncepčních objemů.

# group: Info
# note: Mezi 3D navigací na pozadí a navigací v zobrazení grafu můžete přepínat pomocí tlačítek v pravém horním rohu obrazovky (klávesová zkratka Ctrl+B). Náhled pozadí je také možné zapnout nebo vypnout v nabídce Zobrazit v aplikacích Dynamo a Revit.
# note: Spusťte tento graf v prostředí koncepčního objemu nebo rodiny obecných adaptivních modelů.
# Chcete-li vytvořit novou rodinu, přejděte do nabídky Soubor > Nová rodina > a vyberte šablonu ve složce:
# C:\ProgramData\Autodesk\RVT 2027\Family Templates\English-Imperial\Generic Model Adaptive.rft
# note: Tento graf vytvoří modelovou čáru a referenční bod v prostředí rodiny.

# group: Souřadnice bodů
hodnota_x_bodu = DoubleSlider(50, range=5..50 step 5)  # graph input
hodnota_y_bodu = DoubleSlider(25, range=5..50 step 5)  # graph input
hodnota_z_bodu = DoubleSlider(25, range=5..50 step 5)  # graph input

# note: Manipulace s polohou bodu v prostředí aplikace Dynamo: Vyberte uzel Point.ByCoordinates a přepněte do náhledu pozadí, abyste mohli táhnout bod podél jeho tří os.
byCoordinates = Point.ByCoordinates(x=hodnota_x_bodu, y=hodnota_y_bodu, z=hodnota_z_bodu)
# note: Geometrická data lze zobrazit buď jako textové informace, nebo v 3D prostoru.
watch = Watch(byCoordinates)
byCoordinates_2 = Point.ByCoordinates()
byStartPointEndPoint = Line.ByStartPointEndPoint(startPoint=byCoordinates_2, endPoint=byCoordinates)
# note: Náhled geometrie
watch_3d = Watch3D(byStartPointEndPoint)
# note: Vytvořit křivku modelu spojením dvou bodů
byCurve = ModelCurve.ByCurve(curve=byStartPointEndPoint)
# note: Aplikace Dynamo může tvořit a upravovat pouze prvky, které jsou vhodné pro soubor, s nímž je aplikace Dynamo asociována. Například referenční body je možné vytvořit pouze v určitých prostředích rodin (například Obecný model adaptivní), zatímco modelové čáry je možné tvořit téměř kdekoli.
byPoint = ReferencePoint.ByPoint(pt=byCoordinates)
