# Dynamo graph Revit Geometry Creation Solids.dyn "Tělesa tvorby geometrie aplikace Revit" (Dynamo 4.0.0.3076)
# author: Dynamo Team
# Tento graf představuje několik metod tvorby geometrie těles v aplikaci Dynamo a jejich začlenění do aplikace Revit – některé metody je možné použít v prostředí projektu, jiné – pouze v určitých prostředích rodin (koncepční objem).

# group: Info
# note: Pro většinu těles existuje více způsobů tvorby. Tyto příklady ukazují uzavřené profily jako základní, ale objekty PolySurface je možné sešít, k dispozici je mnoho primitivních objektů (povrchy, kvádry, kužely atd.).
# Aby bylo možné integrovat geometrii do prostředí aplikace Revit, je nutné nejprve převést geometrii na Prvek aplikace Revit.
# Tělesa je možné transformovat na instanci importu, která bude viditelná jak v prostředí projektu, tak v prostředí rodiny modelu.
# Geometrii tělesa je možné také převést na prvek tvaru, který je k dispozici pouze v prostředích rodin Koncepční objem a Adaptivní komponenta.
# note: Tento graf používá několik metod tvorby geometrie tělesa v aplikaci Revit – některé metody je možné použít v prostředí projektu, jiné – pouze v určitých prostředích rodiny.
# Pomocí šablony rodiny koncepčních objemů zobrazte všechny metody.
# Otevřete rodinu koncepčních objemů v nabídce Soubor > Nový > Rodina > a vyberte šablonu Mass.rft \Conceptual Mass\Mass.rft

# group: Připravit body
# Generovat sadu bodů k vytvoření geometrie
byCoordinates = Point.ByCoordinates()
number = DoubleInput(10)
byCoordinates_2 = Point.ByCoordinates(x=number)
number_2 = DoubleInput(5)
byCoordinates_3 = Point.ByCoordinates(z=number_2)
number_3 = DoubleInput(10)
byCoordinates_4 = Point.ByCoordinates(y=number_3)
number_4 = DoubleInput(15)
byCoordinates_5 = Point.ByCoordinates(x=number_4, y=number_4)
number_5 = DoubleInput(5)
number_6 = DoubleInput(10)
byCoordinates_6 = Point.ByCoordinates(x=number_5, y=number_6, z=number_6)
number_7 = DoubleInput(-2)
number_8 = DoubleInput(5)
byCoordinates_7 = Point.ByCoordinates(x=number_7, y=number_8)

# group: První profil
# Vytvořit první profil jako uzavřenou křivku z oblouku a čáry
byStartPointEndPoint = Line.ByStartPointEndPoint(startPoint=byCoordinates, endPoint=byCoordinates_2)
byThreePoints = Arc.ByThreePoints(firstPoint=byCoordinates, secondPoint=byCoordinates_3, thirdPoint=byCoordinates_2)
create = List.Create(item0=byStartPointEndPoint, item1=byThreePoints)
# note: První profil pro šablonování
byJoinedCurves = PolyCurve.ByJoinedCurves(curves=create)

# group: Druhý profil
# Vytvořit druhý profil jako uzavřenou křivku z oblouku a čáry
byStartPointEndPoint_2 = Line.ByStartPointEndPoint(startPoint=byCoordinates_4, endPoint=byCoordinates_5)
byThreePoints_2 = Arc.ByThreePoints(firstPoint=byCoordinates_4, secondPoint=byCoordinates_6, thirdPoint=byCoordinates_5)
create_2 = List.Create(item0=byStartPointEndPoint_2, item1=byThreePoints_2)
# note: Druhý profil pro šablonování
byJoinedCurves_2 = PolyCurve.ByJoinedCurves(curves=create_2)

# note: Spojení dvou profilů v seznamu
create_3 = List.Create(item0=byJoinedCurves, item1=byJoinedCurves_2)

# group: Šablonování těles pomocí průřezů
# Popis <Dvojitým kliknutím sem upravte popis skupiny>
byLoft = Solid.ByLoft(crossSections=create_3)

# note: Prozkoumat objem tělesa
volume = Solid.Volume(solid=byLoft)

# group: Vytvořit skořepinu
code_block = CodeBlock { 0; }
# note: Tip: Vypněte „Náhled“ v nabídce pravého tlačítka uzlu, pokud chcete vyloučit prvky ze zobrazení.
thinShell = Solid.ThinShell(solid=byLoft, internalFaceThickness=code_block)

# group: Přesunout geometrii
code_block_2 = CodeBlock { Vector.ByCoordinates(20,0,0); }
# note: Přesunutím geometrie na stranu zobrazíte náhled původního i konečného výsledku.
translate = Geometry.Translate(geometry=thinShell, direction=code_block_2)

# group: Oříznout těleso
# Pomocí operace Oříznout ořízněte těleso skořepiny rovinou.
code_block_3 = CodeBlock { Point.ByCoordinates(0,0,5); }
ZAxis = Vector.ZAxis()
byOriginNormal = Plane.ByOriginNormal(origin=code_block_3, normal=ZAxis)
number_9 = DoubleInput(10)
# note: Vyberte, kterou stranu oříznutí chcete zachovat (strana nejblíže k bodu bude odstraněna).
byCoordinates_8 = Point.ByCoordinates(x=number_9, y=number_9, z=number_9)
# note: Geometrické logické operace (sjednocení, rozdíl, průnik atd.) jsou k dispozici v kategorii geometrie.
trim = Geometry.Trim(geometry=translate, other=byOriginNormal, pick=byCoordinates_8)

# group: Vodicí křivka
# Vytvořit křivku NURBS, která se použije jako vodicí křivka pro tvar šablonování tělesa
create_4 = List.Create(item0=byCoordinates, item1=byCoordinates_7, item2=byCoordinates_4)
# note: Vodicí křivka vytvořená jako křivka NURBS
byPoints = NurbsCurve.ByPoints(points=create_4)

# group: Šablonování těles pomocí průřezů a vodicích křivek
# note: Tip: Vypněte „Náhled“ v nabídce pravého tlačítka uzlu, pokud chcete vyloučit prvky ze zobrazení.
byLoft_2 = Solid.ByLoft(crossSections=create_3, guideCurves=byPoints)

# group: Vytvořit instanci importu
code_block_4 = CodeBlock { Vector.ByCoordinates(-20,0,0); }
translate_2 = Geometry.Translate(geometry=byLoft_2, direction=code_block_4)
# note: Geometrie není stejná jako prvek aplikace Revit:
# Použijte objekt ImportInstance k vytvoření importů aplikace Revit z povrchů a těles v jakémkoli prostředí aplikace Revit, použijte body a křivky k umístění instancí rodin, nebo vytvořte rodiny Tvar v objemu a Obecný model podle bodu (adaptivní komponenta).
byGeometries = ImportInstance.ByGeometries(geometries=translate_2)
byCoordinates_9 = Vector.ByCoordinates()

# group: Vytvořit tvar
# Pomocí dvou smyček křivek profilu vytvořte prvek tvaru (v prostředí rodiny koncepčních objemů).
curves = PolyCurve.Curves(polyCurve=create_3)
# note: Vytvořit křivky modelu z křivek
referenceCurveByCurve = ModelCurve.ReferenceCurveByCurve(curve=curves)
# note: Tvary je možné vytvořit pouze jako součást rodiny koncepčních objemů.
byLoftCrossSections = Form.ByLoftCrossSections(curves=referenceCurveByCurve)
