# Dynamo graph Revit Geometry Creation Surfaces.dyn "Povrchy tvorby geometrie aplikace Revit" (Dynamo 4.0.0.3076)
# author: Dynamo Team
# Tento graf představuje několik metod tvorby povrchů v aplikaci Dynamo a dvě metody převodu geometrie na geometrii aplikace Revit.

# group: Info
# note: Tento graf používá několik metod tvorby geometrie povrchu v aplikaci Revit – některé metody je možné použít v prostředí projektu, jiné – pouze v určitých prostředích rodiny.
# Pomocí šablony rodiny koncepčních objemů zobrazte všechny metody.
# Vytvořte rodinu koncepčních objemů v nabídce Soubor > Nový > Rodina a vyberte šablonu Mass.rft ve složce Conceptual Mass.
# note: Pro většinu povrchů existuje několik způsobů tvorby. Povrchy, objekty PolySurface (kolekce povrchů) a povrchy NURBS je možné vytvořit pomocí bodů a křivek a je možné je také odvodit z jiných povrchů a těles pomocí různých operací.
# note: Aby bylo možné začlenit geometrii do prostředí aplikace Revit, je nejprve nutné ji převést na prvek aplikace Revit.
# Povrchy a tělesa je možné transformovat na instanci importu, která bude viditelná jak v prostředí rodiny projektu, tak v prostředí rodiny modelu.
# Geometrii povrchu je také možné převést na prvek tvaru, který je k dispozici pouze v prostředí rodin Koncepční objem a Adaptivní komponenta.

# group: Připravit body
# Generovat sadu bodů k vytvoření geometrie
number = DoubleInput(10)
byCoordinates = Point.ByCoordinates(y=number)
number_2 = DoubleInput(5)
number_3 = DoubleInput(10)
byCoordinates_2 = Point.ByCoordinates(x=number_2, y=number_3, z=number_3)
number_4 = DoubleInput(15)
byCoordinates_3 = Point.ByCoordinates(x=number_4, y=number_4)
byCoordinates_4 = Point.ByCoordinates()
number_5 = DoubleInput(5)
byCoordinates_5 = Point.ByCoordinates(z=number_5)
byCoordinates_6 = Point.ByCoordinates(x=number)
number_6 = DoubleInput(-5)
number_7 = DoubleInput(5)
byCoordinates_7 = Point.ByCoordinates(x=number_6, y=number_7)
number_8 = DoubleInput(10)
number_9 = DoubleInput(-10)
byCoordinates_8 = Point.ByCoordinates(x=number_8, y=number_9)
byCoordinates_9 = Point.ByCoordinates(y=number_9)

# group: Vytvořit profily
byThreePoints = Arc.ByThreePoints(firstPoint=byCoordinates, secondPoint=byCoordinates_2, thirdPoint=byCoordinates_3)
byThreePoints_2 = Arc.ByThreePoints(firstPoint=byCoordinates_4, secondPoint=byCoordinates_5, thirdPoint=byCoordinates_6)
byThreePoints_3 = Arc.ByThreePoints(firstPoint=byCoordinates_4, secondPoint=byCoordinates_7, thirdPoint=byCoordinates)
byStartPointEndPoint = Line.ByStartPointEndPoint(startPoint=byCoordinates_8, endPoint=byCoordinates_9)

# group: Povrch podle tažení
# Vytvořit povrch tažení pomocí profilu, křivky trajektorie a vodicí trajektorie
bySweep2Rails = Surface.BySweep2Rails(path=byThreePoints, guideRail=byThreePoints_2, profile=byThreePoints_3)

# group: Vytvořit import
# note: Pomocí objektu instance importu vytvořte importované položky aplikace Revit z povrchů a těles – ty budou viditelné v jakémkoli prostředí aplikace Revit.
byGeometries = ImportInstance.ByGeometries(geometries=bySweep2Rails)

create = List.Create(item0=byStartPointEndPoint, item1=byThreePoints_2)

# group: Vytvořit povrch podle šablonování
# Vytvořit šablonovací plochu spojením průřezů
byLoft = Surface.ByLoft(crossSections=create)

# group: Vyhodnotit plochu povrchu
area = Surface.Area(surface=byLoft)
watch = Watch(area)
create_2 = List.Create(item0=byLoft, item1=bySweep2Rails)
# note: Povrchy spojené jako objekty PolySurface lze vyhodnotit jako jednu entitu.
byJoinedSurfaces = PolySurface.ByJoinedSurfaces(surfaces=create_2)
area_2 = Surface.Area(surface=byJoinedSurfaces)
watch_2 = Watch(area_2)
area_3 = Surface.Area(surface=bySweep2Rails)
watch_3 = Watch(area_3)

# group: Povrch NURBS z řídicích bodů
# Převedení tažení na povrch NURBS z řídicích bodů
code_block = CodeBlock { 0..1..0.1; }
# note: Hrany, body a další prvky je možné odvodit z povrchů pomocí „akcí“, které jsou vhodné pro tyto geometrie.
pointAtParameter = Surface.PointAtParameter(surface=bySweep2Rails, u=code_block, v=code_block, lacing=CrossProduct)
# note: Rekonstruovat povrch jako povrch NURBS z řídicích bodů
byControlPoints = NurbsSurface.ByControlPoints(controlVertices=pointAtParameter)
# note: Pomocí uzlu Watch 3D je možné zobrazit náhled geometrie izolovaně.
watch_3d = Watch3D(byControlPoints)

# group: Povrch podle křivky vysunutí
# Vytvořit vysunutí s danou vzdáleností pomocí křivky
code_block_2 = CodeBlock { 10; }
extrude = Curve.Extrude(curve=byThreePoints, distance=code_block_2)

# group: Vytvořit tvar
# Vytvořit tvar šablonování ze dvou křivek
referenceCurveByCurve = ModelCurve.ReferenceCurveByCurve(curve=create)
byLoftCrossSections = Form.ByLoftCrossSections(curves=referenceCurveByCurve)
