# Dynamo graph Revit Import Solid.dyn "Revit_ImportSolid" (Dynamo 3.4.0.6752)
# author: Dynamo Team
# Tento graf ukazuje způsob vytvoření geometrie tělesa aplikace Dynamo a jeho použití k tvorbě prvku instance importu aplikace Revit. Vytvořte nový tvar střechy tak, že vytvoříte řadu obloukových profilů a poté pomocí těchto profilů vytvoříte šablonovanou plochu.

# group: Info
# note: Zdrojový prvek (střecha) byl předem vybrán z aplikace Revit, s ID prvků uloženými v souboru aplikace Dynamo.
# note: Spusťte tento graf v souboru Snowdon Tower Sample Architectural.rvt ve složce Samples, která se nachází ve složce instalace aplikace Revit
# C:\Program Files\Autodesk\Revit 2026\Samples
# note: Vytvoří nový tvar střechy z vybraného prvku střechy tak, že vytvoří řadu obloukových profilů a pomocí nich poté vytvoří šablonovanou plochu. Geometrie bude převedena na instanci importu, aby byla začleněna do prostředí aplikace Revit.

# group: Konfigurace nové střechy
# note: Počet profilů, ze kterých bude vytvořena šablonovaná plocha
počet_profilů = IntegerSlider(6, range=3..10 step 1)
# note: Výška na krátkých koncích nové střechy
min_řez_střechy = DoubleSlider(2.1, range=1..5 step 0.1)
# note: Výška uprostřed střechy
max_řez_střechy = DoubleSlider(7, range=5..10 step 0.1)
# note: Prodloužit obloukové profily do strany o tuto hodnotu
prodloužení_stran_střechy = DoubleSlider(0.5, range=0.1..3 step 0.1)
# note: Tloušťka nového tvaru střechy
tloušťka_střechy = DoubleSlider(0.5, range=0.1..2 step 0.1)

počet_profilů_2 = CodeBlock(steps=počet_profilů) { steps; }

# group: Vybrat střechu
# Vybrat zdrojový prvek střechy
# note: Všechny vstupy označené hodnotou 'IsInput' je možné nastavit z aplikace Přehrávač skriptů Dynamo.
vybrat_plochou_střechu = DSModelElementSelection()  # 1 picked in the model

# group: Získat plochu střechy
# Rozložte geometrii zdrojového prvku a vyberte jednu plochu s největší plochou.
# note: Chcete-li získat plochu vybraného prvku, získejte nejprve jeho geometrii.
# note: Chcete-li získat přehlednější pohled na konečný výsledek, klikněte pravým tlačítkem a zrušte zaškrtnutí možnosti 'Náhled geometrie'.
getGeometry = Element.GetGeometry(element=vybrat_plochou_střechu)
# note: Rozložením geometrie získáte jednotlivé plochy.
explode = Geometry.Explode(geometry=getGeometry)
# note: Odstraňte strukturu seznamu. Vezměte na vědomí, že tento krok nebude vyžadován, pokud se použije více zdrojových objektů.
flatten = List.Flatten(list=explode)
area = Surface.Area(surface=flatten)
# note: Seřadí seznam povrchů podle jejich plochy. Povrch s největšími plochami bude poslední položkou v seznamu na výstupu sortedList.
sortByKey = List.SortByKey(list=flatten, keys=area)
lastItem = List.LastItem(list=sortByKey.sortedList)
number = DoubleInput(1.5)
# note: Posunout povrch nahoru
translate = Geometry.Translate(geometry=lastItem, zTranslation=number)

# group: Odsadit ven (měřítko)
# Změnit měřítko povrchu tak, aby se jeho hrany prodloužily směrem ven
poloha_uv = CodeBlock { 0.5; }
pointAtParameter = Surface.PointAtParameter(surface=translate, u=poloha_uv, v=poloha_uv)
měřítko_bodu_od_a_bodu_do = CodeBlock { point1 = Point.ByCoordinates(1, 1); point2 = Point.ByCoordinates(-40, -40); }
scale = Geometry.Scale(geometry=translate, basePoint=pointAtParameter, from=měřítko_bodu_od_a_bodu_do.point1, to=měřítko_bodu_od_a_bodu_do.point2)

# group: Body na povrchu
# Vygenerujte tři seznamy rovnoměrně rozmístěných bodů – dva řádky podél delších hran a jedna řada uprostřed.
# note: 0 a 1 jsou polohy podél delších hran povrchu.
polohy_u_pro_řady_hran = CodeBlock { [0,1]; }
# note: Polohy V podél delších hran v posloupnosti od 0 do 1 a s krokem N
polohy_v_pro_řady_hran = CodeBlock(steps=počet_profilů_2) { [0..1..#steps]; }
# note: Použijte nastavení Nejdelší vázání kliknutím pravým tlačítkem na uzel > Vázání.
# Nejdelší vázání bude odpovídat vstupům s různými strukturami seznamu. V tomto případě budou výsledkem dva seznamy bodů, kde počet bodů v každém seznamu odpovídá nejdelšímu vstupnímu seznamu.
pointAtParameter_2 = Surface.PointAtParameter(surface=scale, u=polohy_u_pro_řady_hran, v=polohy_v_pro_řady_hran, lacing=Longest)
# note: Hodnota U 0,5 umístí body podél středu povrchu.
poloha_u_pro_střední_řadu = CodeBlock { [0.5]; }
# note: Polohy V podél střední řady bodů v posloupnosti od 0 do 1 a s krokem N
poloha_v_pro_střední_řadu = CodeBlock(steps=počet_profilů_2) { [0..1..#steps]; }
# note: U tohoto uzlu se použije možnost Nejdelší vázání. Výsledkem je jeden seznam bodů, kde počet bodů v seznamu odpovídá nejdelšímu vstupnímu seznamu.
pointAtParameter_3 = Surface.PointAtParameter(surface=scale, u=poloha_u_pro_střední_řadu, v=poloha_v_pro_střední_řadu, lacing=Longest)

# group: Odsadit body nahoru
# Odsadit body střední řady ve tvaru kosinové vlny
# note: posloupnost hodnot ke generování řady odsazení
posloupnost_úhlů = CodeBlock(steps=počet_profilů_2) { -1..1..#steps; }
# note: Alternativa: Použijte sinus k dosažení jiného tvaru střechy
sin = Math.Sin(angle=posloupnost_úhlů)
# note: hodnoty v kosinové vlně
cos = Math.Cos(angle=posloupnost_úhlů)
# note: přemapovat hodnoty na novou doménu
remapRange = Math.RemapRange(numbers=cos, newMin=min_řez_střechy, newMax=max_řez_střechy)
# note: posunout body střední řady
translate_2 = Geometry.Translate(geometry=pointAtParameter_3@L2, zTranslation=remapRange)

# group: Vytvořit profil z oblouku
# Vytvořte oblouky pomocí bodů
# note: Spojit hranu a střední řadu do jednoho seznamu
join = List.Join(list0=pointAtParameter_2, list1=translate_2)
index_položky = CodeBlock { 0; 1; 2; }
getItemAtIndex = List.GetItemAtIndex(list=join, index=index_položky.out0)
getItemAtIndex_2 = List.GetItemAtIndex(list=join, index=index_položky.out2)
getItemAtIndex_3 = List.GetItemAtIndex(list=join, index=index_položky.out1)
byThreePoints = Arc.ByThreePoints(firstPoint=getItemAtIndex, secondPoint=getItemAtIndex_2, thirdPoint=getItemAtIndex_3)

# group: Prodloužit profily
# Prodloužit křivky každého profilu o zadanou vzdálenost
# note: Hodnota prodloužení je nastavena jako vstup na levé straně grafu.
prodloužit_hrany = CodeBlock(roof_extension=prodloužení_stran_střechy) { roof_extension; }
extendStart = Curve.ExtendStart(curve=byThreePoints, distance=prodloužit_hrany)
extendEnd = Curve.ExtendEnd(curve=extendStart, distance=prodloužit_hrany)

# group: Šablonování a zesílení
# Vytvořit šablonovanou plochu a zadat její tloušťku
byLoft = Surface.ByLoft(crossSections=extendEnd)
thicken = Surface.Thicken(surface=byLoft, thickness=tloušťka_střechy)

# group: Do aplikace Revit:
# Převeďte geometrii aplikace Dynamo na prvek aplikace Revit pomocí objektu ImportInstance a nastavte parametr úrovně
# note: Aby bylo možné integrovat geometrii do prostředí aplikace Revit, je nejprve nutné ji převést na prvek aplikace Revit.
# Tělesa je možné převést na instance importu, které budou viditelné jak v prostředí projektu, tak v prostředí rodiny modelu.
byGeometry = ImportInstance.ByGeometry(geometry=thicken)
code_block = CodeBlock { "Pracovní rovina"; }
levels = Levels("L1 - Block 43")
# note: Opravte výšku umístěné instance importu nastavením parametru Pracovní rovina na podlaží, jehož výška odpovídá poloze vnitřního počátku.
setParameterByName = Element.SetParameterByName(element=byGeometry, parameterName=code_block, value=levels)
