# Dynamo graph Revit Place Families By Level Set Parameters.dyn "Umístění rodin podle parametrů sady podlaží v aplikaci Revit" (Dynamo 4.0.0.3076)
# author: Dynamo Team
# Tento graf ukazuje, jak umístit prvky aplikace Revit podle bodu. Umístěte řady židlí do vybrané místnosti a zapište jedinečná čísla do jejich parametru Označení.

# group: Info
# note: Spusťte tento graf v souboru Snowdon Tower Sample Architectural.rvt ve složce Samples v rámci instalace aplikace Revit
# C:\Program Files\Autodesk\Revit 2027\Samples
# note: Umístit řady židlí do vybrané místnosti a zapsat jedinečná čísla do jejich parametru Označení

# group: Vybrat prvky aplikace Revit
# note: Vyberte typ rodiny pro instance, které jsou umisťovány z typů rodin v projektu.
family_types = FamilyTypes("Chair-Breuer:Chair-Breuer")  # graph input
# note: Vyberte místnost, do které chcete umístit prvky. Bude nutné přejít do pohledu, ve kterém jsou místnosti viditelné (půdorys podlaží).
vybrat_místnost = DSModelElementSelection()  # 1 picked in the model; graph input
poloměr_kruhu = DoubleSlider(6.4, range=5..8 step 0.1)  # graph input
# note: Vyberte podlaží, na které chcete umístit prvky.
levels = Levels("L3")  # graph input

# group: Nastavit odsazení řad
# Hodnoty odsazení řad nejsou vzdálenosti, ale hodnoty U a V.
začátek_řady = DoubleSlider(0.3, range=0..3 step 0.1)  # graph input
konec_řady = DoubleSlider(2.2, range=0..3 step 0.1)  # graph input
počet_židlí_v_řadě = IntegerSlider(8, range=2..12 step 1)  # graph input
poloha_první_řady = DoubleSlider(0.2, range=0..3 step 0.1)  # graph input
poloha_poslední_řady = DoubleSlider(1.4, range=0..3 step 0.1)  # graph input
rozestupy_řad = DoubleSlider(0.35, range=0.15..1 step 0.05)  # graph input

# group: Generovat odsazení řad
# Řada čísel odpovídající polohám U a V na povrchu. Hodnoty mohou překročit doménu 0 až 1.
# note: Alternativa k tvorbě posloupnosti definováním počátku posloupnosti, konce posloupnosti a počtu kroků
posloupnost_odsazení_řad = CodeBlock(start=začátek_řady, finish=konec_řady, steps=počet_židlí_v_řadě) { start..finish..#steps; }
# note: Generovat řadu čísel v rozsahu s daným krokem
range = Range(start=poloha_první_řady, end=poloha_poslední_řady, step=rozestupy_řad)

# group: Připravit body umístění
# Popis <Dvojitým kliknutím sem upravte popis skupiny>
# note: Bod umístění vybrané místnosti
location = Room.Location(room=vybrat_místnost)
# note: Kružnice definující počáteční oblast umístění. Tvar kružnice v tomto případě není důležitý, ale je to nejrychlejší způsob definování uzavřeného povrchu.
byCenterPointRadius = Circle.ByCenterPointRadius(centerPoint=location, radius=poloměr_kruhu)
# note: Převést kružnici na povrch, aby ji bylo možné použít k umístění bodů
patch = Curve.Patch(curve=byCenterPointRadius)
# note: Pomocí posloupností hodnot U a V vytvořte matici bodů. Vázání uzlu nastavte na možnost Vektorový součin kliknutím pravým tlačítkem a výběrem možnosti Vázání.
pointAtParameter = Surface.PointAtParameter(surface=patch, u=posloupnost_odsazení_řad, v=range, lacing=CrossProduct)

# group: Do aplikace Revit: Umístit instance rodin
# note: Umístit instance rodiny
# Většinu rodin lze také umístit podle bodu umístění. Adaptivní komponenty mohou být umístěny pomocí více bodů, konstrukční rámová konstrukce je umístěna pomocí křivek.
byPointAndLevel = FamilyInstance.ByPointAndLevel(familyType=family_types, point=pointAtParameter, level=levels)

# note: Odstranění struktury seznamu – vytvoření seznamu obsahujícího všechny položky
flatten = List.Flatten(list=byPointAndLevel)

# group: Předpona označení
# Použít vlastní předponu pro umístěné prvky Číslo označení
předpona_označení = StringInput("C-")  # graph input

# group: Generovat čísla označení
number = DoubleInput(1)
# note: Spočítat počet položek v seznamu
count = List.Count(list=flatten)
# note: Generovat čísla od 1 do n
sequence = Sequence(start=number, amount=count, step=number, lacing=Longest)
# note: Aby bylo možné použít číslo v řetězcových operacích, musí být nejprve převedeno na řetězec.
string_from_object = FromObject(obj=sequence)
index = CodeBlock { 0; }
# note: Vložit vlastní předponu k číslu položky
insert = String.Insert(string=string_from_object, index=index, toInsert=předpona_označení)

# group: Do aplikace Revit: Nastavit hodnoty parametrů
string = StringInput("Označení")
# note: Nastaví parametr Označení se seznamem hodnot. Je nutné, aby se shodovala struktura seznamu prvků a vstupů hodnot, jinak je možné použít pouze jednu hodnotu. Parametry je možné načíst také pomocí uzlu Element.GetParameterByName.
setParameterByName = Element.SetParameterByName(element=flatten, parameterName=string, value=insert)

# group: Zkontrolovat výsledky
# note: Pomocí uzlu Watch je možné zkontrolovat, zda výsledky odpovídají očekávání.
watch = Watch(insert)  # graph output
