# Dynamo graph Revit Structural Framing.dyn "Revit_StructuralFraming" (Dynamo 3.4.0.6752)
# author: Dynamo Team
# Tento graf vytvoří konstrukci z rámové konstrukce a sloupů relativně k vybranému podlaží v aplikaci Revit.

# group: Info
# note: Umístěte nosníky a sloupy konstrukčních rámových konstrukcí relativně k prvku vybranému v modelu aplikace Revit.
# note: Spusťte tento graf v souboru Snowdon Tower Sample Architectural.rvt ve složce Samples, která se nachází ve složce instalace aplikace Revit
# C:\Program Files\Autodesk\Revit 2026\Samples

# group: Vstupy
# note: Vyberte prvek podlaží aplikace Revit, relativně vůči kterému bude vytvořena nová konstrukce pergoly.
vybrat_zdrojové_podlaží = DSModelElementSelection()  # 1 picked in the model; graph input
# note: Výška konstrukce
výška = DoubleSlider(8.4, range=0..10 step 0.1)  # graph input
počet_nosníků = IntegerSlider(9, range=2..10 step 1)  # graph input
# note: Vyberte podlaží, na které chcete umístit konstrukci.
úroveň_stavebního_objektu = Levels("L1 - Block 43")  # graph input
# note: Vyberte typ rámové konstrukce pro obvodové nosníky. Tento typ se také použije k vytvoření nového typu konstrukční rámové konstrukce.
structural_framing_types = StructuralFramingTypes("W12X26")  # graph input
# note: Vybrat typ rodiny vytvořených sloupů
typy_konstrukčních_sloupů = StructuralColumnTypes(index=0)  # graph input

# group: Připravit geometrii
# Příprava výrazu čistého tělesa geometrie vybraného prvku
# note: Získat geometrii prvku aplikace Revit
getGeometry = Element.GetGeometry(element=vybrat_zdrojové_podlaží)
# note: V rámci rychlého způsobu odstranění otvorů v prvcích je možné získat ohraničující kvádr prvku – virtuální kvádr, ve kterém je prvek obsažen.
byMinimumVolume = BoundingBox.ByMinimumVolume(geom=getGeometry)
# note: U těles je k dispozici více akcí než u ohraničujících kvádrů. Chcete-li umožnit další transformace, nejprve převeďte ohraničující kvádr na běžný kvádr (což je typ tělesa).
toCuboid = BoundingBox.ToCuboid(boundingBox=byMinimumVolume)
# note: Přesunout kvádr tělesa o výšku (zTranslation) nastavenou posuvníkem v části vstupů grafu
translate = Geometry.Translate(geometry=toCuboid, zTranslation=výška)

# group: Získat horní povrch tělesa
# Vyhodnotí všechny povrchy tělesa podle výšky ve středu a získá nejvyšší.
# note: Rozložit těleso na povrchy
explode = Geometry.Explode(geometry=translate)
code_block = CodeBlock { 0.5; }
# note: Najít bod ve středu povrchu
pointAtParameter = Surface.PointAtParameter(surface=explode, u=code_block, v=code_block)
# note: Získá číselnou hodnotu výšky každého středu.
Z = Point.Z(point=pointAtParameter)
# note: Seřadit jeden seznam podle druhého: pomocí výškových hodnot seřadit povrchy.
sortByKey = List.SortByKey(list=explode, keys=Z)
# note: Poslední povrch v seznamu je nejvyšší povrch.
lastItem = List.LastItem(list=sortByKey.sortedList)

# group: Odsadit řadu bodů na povrchu
# note: Pomocí jednoduchého vzorce vytvořte posloupnost hodnot od minima (0,1) po maximum (0,9) s počtem kroků 'n'.
posloupnost_hodnot_u = CodeBlock(n=počet_nosníků) { 0.1..0.9..#n; }
odsazení_hran = CodeBlock { [0.1,0.9]; }
# note: Pomocí parametrů U a V umístěte pole bodů na povrch. K vygenerování pole použijte vázání Kartézský součin (klikněte pravým tlačítkem na uzel a vyberte možnost Vázání).
pointAtParameter_2 = Surface.PointAtParameter(surface=lastItem, u=posloupnost_hodnot_u, v=odsazení_hran, lacing=CrossProduct)

# group: Vytvořit čáry pro vnitřní nosníky
# Připojit body a vytvořit čáry
indexy = CodeBlock { 0; 1; }
# note: Kliknutím na symbol > vedle vstupu 'list' použijte úrovně. To znamená, že výsledkem bude položka s indexem 0 z každého nejnižšího vnořeného seznamu (@L2).
getItemAtIndex = List.GetItemAtIndex(list=pointAtParameter_2@L2, index=indexy.out0)
getItemAtIndex_2 = List.GetItemAtIndex(list=pointAtParameter_2@L2, index=indexy.out1)
byStartPointEndPoint = Line.ByStartPointEndPoint(startPoint=getItemAtIndex, endPoint=getItemAtIndex_2)

# group: Křivky pro obvodové nosníky
# Popis <Dvojitým kliknutím sem upravte popis skupiny>
firstItem = List.FirstItem(list=pointAtParameter_2)
lastItem_2 = List.LastItem(list=pointAtParameter_2)
byStartPointEndPoint_2 = Line.ByStartPointEndPoint(startPoint=firstItem, endPoint=lastItem_2)

# group: Křivky sloupů
# Pomocí kždé druhé řady bodů vytvořit čáry pro umístění sloupů
code_block_2 = CodeBlock { 2; }
# note: Rozdělí seznam na seznamy po 2
chop = List.Chop(list=pointAtParameter_2, lengths=code_block_2)
# note: Použít logiku úrovní seznamu a použít pouze první seznam na úrovni @L3
firstItem_2 = List.FirstItem(list=chop@L3)
obrátit_výšku = CodeBlock(H=výška) { -H; }
# note: Přeunout body zpět dolů
translate_2 = Geometry.Translate(geometry=firstItem_2, zTranslation=obrátit_výšku)
# note: Vytvořit čáry spojením bodů
byStartPointEndPoint_3 = Line.ByStartPointEndPoint(startPoint=translate_2, endPoint=firstItem_2)

# group: Do aplikace Revit: Umístit nosníky podle křivky
# note: Umístit vnitřní nosníky
beamByCurve = StructuralFraming.BeamByCurve(curve=byStartPointEndPoint, level=úroveň_stavebního_objektu, structuralFramingType=structural_framing_types)
# note: Umístit obvodové nosníky
beamByCurve_2 = StructuralFraming.BeamByCurve(curve=byStartPointEndPoint_2, level=úroveň_stavebního_objektu, structuralFramingType=structural_framing_types)
# note: Umístit konstrukční sloupy
columnByCurve = StructuralFraming.ColumnByCurve(curve=byStartPointEndPoint_3, level=úroveň_stavebního_objektu, structuralColumnType=typy_konstrukčních_sloupů)
