# Dynamo graph Revit Adaptive Component Placement.dyn (Dynamo 4.0.0.3076)
# author: Dynamo Team
# Dieses Diagramm positioniert adaptive Bauteile nach Punkten in einem Modell.

# group: Info
# note: Fassadenrasterlinien wurden in Revit vorausgewählt, Element-IDs wurden in der Dynamo-Datei gespeichert
# note: Dieses Diagramm ausführen: Datei Snowdon Towers Sample Architectural.rvt im Ordner Samples in Ihrer Revit-Installation:
# C:\Programme\Autodesk\Revit 2027\Samples
# Führen Sie dieses Diagramm aus, nachdem Sie die adaptive Familie AdaptivePanel.rfa vom Speicherort der Dynamo-Datensätze geladen haben.
# note: Platzieren Sie adaptive Bauteile relativ zu einigen in einer Revit-Datei ausgewählten Elementen.
# Adaptive Bauteile erfordern eine Punktmenge, die der Anzahl der Platzierungspunkte der platzierten Familie entspricht

# group: Eingaben
# note: Fassadenrasterlinien auswählen
kanten_auswählen = SelectEdges()  # 7 picked in the model; graph input
# note: Minimale und maximale Verschiebung für den Mittelpunkt der Rippe festlegen
min_verschiebung = DoubleSlider(1.4, range=0.2..3 step 0.1)
max_verschiebung = DoubleSlider(4.3, range=3..8 step 0.1)
# note: Adaptive Bauteilfamilie auswählen
family_types = FamilyTypes("AdaptivePanel:AdaptivePanel")  # graph input

# note: Liste mit Punktpositionen entlang einer Kurve erstellen; 0 steht für den Start, 0.5 für die Mitte und 1 für das Ende
parameterliste = CodeBlock { [0,0.5,1]; }
# note: Start-, Mittel- und Endpunkte auf jeder Kurve positionieren
pointAtParameter = Curve.PointAtParameter(curve=kanten_auswählen, param=parameterliste, lacing=CrossProduct)

# group: Start- und Endpunkte von jeder Kurve erfassen
start_und_endpunkt_indizes = CodeBlock { 0; 2; }
getItemAtIndex = List.GetItemAtIndex(list=pointAtParameter@L2, index=start_und_endpunkt_indizes.out0)
# note: Ebenen ähnlich wie bei der Auswahl des Mittelpunkts verwenden, um die Start- und Endpunkte von jeder Kurve auszuwählen
getItemAtIndex_2 = List.GetItemAtIndex(list=pointAtParameter@L2, index=start_und_endpunkt_indizes.out1)

# group: Mittelpunkt von jeder Kurve erfassen
mittelpunkt_index = CodeBlock { 1; }
# note: Verwenden Sie die Liste Ebene der list-Eingabe. Vorgabemäßig ist das Ergebnis des Blocks die Liste mit dem Index 1 (zweite Kurve). Klicken Sie mit der rechten Maustaste auf die list-Eingabe, und wählen Sie Ebenen verwenden bei @L2. Dadurch wird das Element mit Index 1 aus jeder verschachtelten Liste ausgewählt (Mittelpunkte von jeder Kurve).
getItemAtIndex_3 = List.GetItemAtIndex(list=pointAtParameter@L2, index=mittelpunkt_index)

# group: Sinuswelle erstellen
# note: Zählen, wie viele Quellkurven ausgewählt sind
count = List.Count(list=kanten_auswählen)
# note: Sequenz von N Werten von 0 bis 1 erstellen
sequence = CodeBlock(steps=count) { 0..1..#steps; }
# note: Sinuswelle erstellen
sin = Math.Sin(angle=sequence)
# note: Werte der Sinuswelle einem neuen Maximal- und Minimalwert zuordnen
remapRange = Math.RemapRange(numbers=sin, newMin=min_verschiebung, newMax=max_verschiebung)

# group: Mittelpunkte verschieben
# note: Wert für die Y-Verschiebung umkehren, sodass diese in Richtung Außenseite der Fassade hin erfolgt
wert_umkehren = CodeBlock(y=remapRange) { -y; }
# note: Mittelpunkte der Rippe verschieben
translate = Geometry.Translate(geometry=getItemAtIndex_3, yTranslation=wert_umkehren, zTranslation=remapRange)

# note: Wert für die Y-Verschiebung umkehren, sodass diese in Richtung Außenseite der Fassade hin erfolgt
wert_umkehren_2 = CodeBlock(y=remapRange) { y; }
# note: Mittelpunkte der Rippe verschieben
translate_2 = Geometry.Translate(geometry=getItemAtIndex_3, yTranslation=wert_umkehren_2, zTranslation=remapRange)

# group: Punkte in Listen neu verbinden
list_create = List.Create(item0=getItemAtIndex, item1=translate, item2=getItemAtIndex_2, item3=translate_2)
# note: Matrix umkehren und Listen in Dreiergruppen organisieren
transpose = List.Transpose(lists=list_create)

# group: Nach Revit: Bauteil platzieren
# note: Adaptive Bauteile können mithilfe von Punktmengen positioniert werden, die der Anzahl der Platzierungspunkte der Familie entsprechen.
byPoints = AdaptiveComponent.ByPoints(points=transpose, familyType=family_types)
