# Dynamo graph Revit Color.dyn (Dynamo 4.0.0.3076)
# author: Dynamo Team
# Dieses Diagramm wertet den Oberflächenbereich ausgewählter Elemente aus und wendet grafische Überschreibungen an, um die Elemente basierend auf diesem Wert farbig zu kennzeichnen.

# group: Info
# note: Run this graph the Snowdon Towers Sample Architectural.rvt file in the Samples folder located with your Revit installation
# C:\Program Files\Autodesk\Revit 2027\Samples
# note: In diesem Diagramm werden Revit-Elemente anhand messbarer Kriterien (Oberflächenbereich) farbig dargestellt.
# Die Farbe von Elementen wird mithilfe der Methode unter Grafik in Ansicht überschreiben > Nach Element bestimmt.

# group: Modellelemente auswählen
# Fassaden auswählen
# note: Auf Ändern klicken, um Elemente aus dem Revit-Modell auszuwählen
modellelemente_auswählen = DSModelElementsSelection()  # 33 picked in the model; graph input

# group: Oberflächenbereich des Elements auswerten
# note: Geometrie des Elements abrufen
getGeometry = Element.GetGeometry(element=modellelemente_auswählen)
flatten = List.Flatten(list=getGeometry)
# note: Flächeninhalt von Oberfläche aus Geometrie extrahieren
area = Solid.Area(solid=flatten)
# note: Höchsten Wert abrufen
maximumItem = List.MaximumItem(list=area)
# note: Am höchsten Wert normalisieren
div = area / maximumItem  # graph output

# group: Farben erstellen
# Farbschema zur farblichen Kennzeichnung der Elemente vorbereiten
number = DoubleInput(0)
number_2 = DoubleInput(255)
# note: grün darstellen
byARGB = Color.ByARGB(alpha=number, red=number, green=number_2, blue=number, lacing=Longest)
number_3 = DoubleInput(0)
number_4 = DoubleInput(255)
# note: rot darstellen
byARGB_2 = Color.ByARGB(alpha=number_3, red=number_4, green=number_3, blue=number_3, lacing=Longest)
create = List.Create(item0=byARGB, item1=byARGB_2)
code_block = CodeBlock { [0,1]; }
# note: Farbbereich festlegen
color_range = ColorRange(colors=create, indices=code_block, value=div)

# group: Nach Revit: Elementfarbe in Ansicht überschreiben
# note: Dadurch wird die Farbe des Elements in der aktiven Ansicht überschrieben
overrideColorInView = Element.OverrideColorInView(element=modellelemente_auswählen, color=color_range, lacing=Longest)

# group: Schwellenwert
number_5 = DoubleInput(100)

# group: Alternativ - Auswerten, wenn Kriterien einen bestimmten Grenzwert überschreiten
# note: Mit einem Schwellenwert vergleichen
gt = area > number_5
# note: Zahlen geben die Position im Farbspektrum an - von 0 bis 1
number_6 = DoubleInput(1)
number_7 = DoubleInput(0)
# note: Bereiche innerhalb eines Toleranzbereichs ermitteln
if_ = RefactoredIf(test=gt, true=number_6, false=number_7)
# note: dieses Ergebnis kann als indices-Eingabe des Farbbereichblocks verwendet werden
watch = Watch(if_)
