# Dynamo graph Revit Floors and Framing.dyn (Dynamo 4.0.0.3076)
# author: Dynamo Team
# In diesem Diagramm wird ein architektonisches Folly erstellt, indem eine Reihe von Linien und deren Verschiebung zur Positionierung von Tragwerks- und Geschossdeckenelementen in Revit verwendet werden.
# packages: PythonNet3-Engine 1.4.5

# group: Info
# note: Dieses Diagramm ausführen: Datei Snowdon Towers Sample Architectural.rvt im Ordner Samples in Ihrer Revit-Installation
# C:\Programme\Autodesk\Revit 2027\Samples
# note: In diesem Diagramm wird ein architektonisches Folly erstellt, indem eine Reihe von Linien verwendet wird, um die Platzierung von Tragwerken und Geschossdecken zu steuern.

# group: Position für Mittelpunkt des Folly
x_position = DoubleSlider(30, range=25..40 step 1)  # graph input
y_position = DoubleSlider(30, range=25..40 step 1)  # graph input
z_position = DoubleSlider(62, range=60..80 step 1)  # graph input

# group: Folly-Konfiguration
# Beschreibung <Hier doppelklicken, um die Gruppenbeschreibung zu bearbeiten>
geschossdeckenradius_unten = DoubleSlider(10, range=8..20 step 1)  # graph input
anz_geschossdecken = DoubleSlider(7, range=3..10 step 1)  # graph input
radius_verringern = DoubleSlider(-1.25, range=-2..-0.5 step 0.25)  # graph input
anzahl_der_polygonseiten = IntegerSlider(5, range=3..10 step 1)  # graph input
höhe_obere_geschossdecke = DoubleSlider(38.4, range=15..50 step 0.1)  # graph input
maximale_drehung_grad = DoubleSlider(130, range=10..180 step 5)  # graph input

# group: Polygone konstruieren
# Reihe von Polygonen mit abnehmendem Radius erstellen, die vertikal versetzt und nacheinander gedreht sind
# note: Mittelpunkt des Folly
byCoordinates = Point.ByCoordinates(x=x_position, y=y_position, z=z_position)
# note: Sequenz von Kreisradien
sequence = Sequence(start=geschossdeckenradius_unten, amount=anz_geschossdecken, step=radius_verringern, lacing=Longest)
# note: Reihe von Kreisen erstellen
byCenterPointRadius = Circle.ByCenterPointRadius(centerPoint=byCoordinates, radius=sequence)
# note: Reihe von Polygonen erstellen
regularPolygon = Polygon.RegularPolygon(circle=byCenterPointRadius, numberSides=anzahl_der_polygonseiten)
# note: Sequenz von Geschossdeckenansichten
geschossdeckenhöhen_sequenz = CodeBlock(top_floor=höhe_obere_geschossdecke, count=anz_geschossdecken) { 0..top_floor..#count; }
byCoordinates_2 = Vector.ByCoordinates(z=geschossdeckenhöhen_sequenz)
# note: Polygone um die angegebene Höhe nach oben verschieben
translate = Geometry.Translate(geometry=regularPolygon, direction=byCoordinates_2)
ZAxis = Vector.ZAxis()
# note: Sequenz von Drehungen für jede Geschossdecke
drehwinkelsequenz = CodeBlock(max_degrees=maximale_drehung_grad, count=anz_geschossdecken) { 0..max_degrees..#count; }
# note: Polygone mit einer Reihe von Winkeln drehen
rotate = Geometry.Rotate(geometry=translate, origin=byCoordinates, axis=ZAxis, degrees=drehwinkelsequenz)
# note: Extrahiert einzelne Kurven aus den Polygonen.
curves = PolyCurve.Curves(polyCurve=rotate)

# group: Geschossdeckentyp und -ebene
# note: Geschossdeckentyp für erstellte Geschossdecken aus den im Projekt vorhandenen Typen über die Dropdown-Liste auswählen
floor_types = FloorTypes("Concrete Slab 6\"")  # graph input
levels = Levels("Green Roof Hardscape")  # graph input

# group: Nach Revit: Geschossdecken erstellen
# Reihe geschlossener Kurvenschleifen als Eingabe für die Geschossdeckenerstellung verwenden
# note: Übergibt Gruppen von Kurven zum Erstellen von Geschossdecken.
byOutlineTypeAndLevel = Floor.ByOutlineTypeAndLevel(outline=curves, floorType=floor_types, level=levels)

# group: Vertikale Verbindungen
# Polygonecken zwischen Folly-Ebenen verbinden
# note: Endpunkte der einzelnen Polygonkurven abrufen
endPoint = Curve.EndPoint(curve=curves)
# note: Matrix umkehren und vertikal ausgerichtete Endpunktlisten abrufen
transpose = List.Transpose(lists=endPoint)
# note: Übereinstimmende Ecken von Polygonen von der niedrigsten zur höchsten Folly-Ebene als Polykurven verbinden
byPoints = PolyCurve.ByPoints(points=transpose)
# note: Polykurven zerlegen und Kurvenlisten abrufen, die als Eingabe für Tragwerkselemente verwendet werden können
curves_2 = PolyCurve.Curves(polyCurve=byPoints)

# group: Tragwerkstyp und -ebene
levels_2 = Levels("Green Roof Hardscape")  # graph input
# note: Tragwerkstyp aus den im Projekt geladenen Typen über die Dropdown-Liste auswählen
structural_framing_types = StructuralFramingTypes("W12X26")  # graph input

# group: Nach Revit: Tragwerk erstellen
# Kurven zum Erstellen von Tragwerkselementen sowie einen Python-Block verwenden, um Verbindungen zwischen einzelnen Trägern zu unterbinden
# note: Übergibt einzelne Kurven für die einzelnen Tragwerkselemente.
beamByCurve = StructuralFraming.BeamByCurve(curve=curves_2, level=levels_2, structuralFramingType=structural_framing_types)
# note: Liste vorbereiten
flatten = List.Flatten(list=beamByCurve)
# note: Dies ist ein umbenannter Python-Block, der die Revit-API referenziert, um die Möglichkeiten von Dynamo über die vordefinierten Blöcke hinaus zu erweitern. Um den Python-Code zu lesen, klicken Sie mit der rechten Maustaste auf den Block und wählen Bearbeiten…
verbindungen_für_tragwerke = Python(structuralFraming=flatten)  # "Verbindungen für Tragwerke unterbinden"; PythonNet3
# ---------- verbindungen_für_tragwerke.python (35 lines) ----------
# Load the Python Standard and DesignScript Libraries
import sys
import clr
clr.AddReference('ProtoGeometry')
from Autodesk.DesignScript.Geometry import *
from Autodesk.Revit.DB import *
from RevitServices.Transactions import TransactionManager
from RevitServices.Persistence import DocumentManager 

doc = DocumentManager.Instance.CurrentDBDocument

# The inputs to this node will be stored as a list in the IN variables.
dataEnteringNode = IN

# Place your code below this line
structural_framing = UnwrapElement(IN[0])

unjoined_elements = []
# start a Transaction
TransactionManager.Instance.EnsureInTransaction(doc)
# iterate through each structural framing element
for sf in structural_framing:
    # check if the element passed in of Structural Framing Category
    sf_category = sf.Category # get the element's Category
    # use the Structural Framing's Category Id to check
    if sf_category.Id.Value == -2001320:
        # disallow joins at start and end of the structural framing element
        Structure.StructuralFramingUtils.DisallowJoinAtEnd(sf, 0)
        Structure.StructuralFramingUtils.DisallowJoinAtEnd(sf, 1)
        unjoined_elements.append(sf)
TransactionManager.Instance.TransactionTaskDone()

    
# Output the list of elements with Disallowed Join
OUT = unjoined_elements
# ----------------------------------------
