# Dynamo graph Revit Geometry Creation Curves.dyn (Dynamo 4.0.0.3076)
# author: Dynamo Team
# In diesem Diagramm werden verschiedene Methoden zum Erstellen von Kurven in Dynamo und deren Verwendung zum Erstellen von Revit-Elementen (Modelllinien) vorgestellt

# group: Info
# note: In diesem Diagramm werden verschiedene Methoden zum Erstellen von Kurven verwendet, die als Eingabe für die Erstellung von Revit-Modellkurven verwendet werden können
# note: Run this graph the Snowdon Towers Sample Architectural.rvt file in the Samples folder located with your Revit installation
# C:\Program Files\Autodesk\Revit 2027\Samples

# group: Vier Punkte
# Beschreibung <Hier doppelklicken, um die Gruppenbeschreibung zu bearbeiten>
number = DoubleInput(-35)
number_2 = DoubleInput(-55)
byCoordinates = Point.ByCoordinates(x=number, y=number_2)
number_3 = DoubleInput(-40)
byCoordinates_2 = Point.ByCoordinates(x=number, y=number_3)
number_4 = DoubleInput(-10)
byCoordinates_3 = Point.ByCoordinates(x=number_4, y=number_3)
number_5 = DoubleInput(-17)
number_6 = DoubleInput(-60)
byCoordinates_4 = Point.ByCoordinates(x=number_5, y=number_6)

list_create = List.Create(item0=byCoordinates, item1=byCoordinates_2, item2=byCoordinates_3, item3=byCoordinates_4)

# group: Modellkurve aus NURBS-Kurve erstellen (anhand von Punkten)
# note: NURBS-Kurve aus einer Punktliste erstellen
byPoints = NurbsCurve.ByPoints(points=list_create)
# note: NURBS-Kurve zum Erstellen einer Revit-Modelllinie verwenden
byCurve = ModelCurve.ByCurve(curve=byPoints)

# group: Modellkurve aus NURBS-Kurve erstellen (anhand von Steuerpunkten)
boolean = BoolSelector(false)
# note: NURBS-Kurve aus einer Punktliste als Steuerpunkte erstellen
byControlPoints = NurbsCurve.ByControlPoints(points=list_create, closeCurve=boolean)
# note: NURBS-Kurve zum Erstellen einer Revit-Modelllinie verwenden
byCurve_2 = ModelCurve.ByCurve(curve=byControlPoints)

# group: Modellkurve aus Polykurve erstellen
# note: Polykurve aus einer Punktliste erstellen
byPoints_2 = PolyCurve.ByPoints(points=list_create)
curves = PolyCurve.Curves(polyCurve=byPoints_2)
# note: Kurvenliste verwenden, um einen Satz von Revit-Modelllinien zu erstellen
byCurve_3 = ModelCurve.ByCurve(curve=curves)

# group: Modellkurve aus Linie erstellen
# note: Kurve aus zwei Punkten erstellen
byStartPointEndPoint = Line.ByStartPointEndPoint(startPoint=byCoordinates, endPoint=byCoordinates_2)
# note: Linie (Kurve) verwenden, um eine Revit-Modellkurve zu erstellen
byCurve_4 = ModelCurve.ByCurve(curve=byStartPointEndPoint)
