# Dynamo graph Revit Geometry Creation Points.dyn "Revit_GeometryCreation_Points" (Dynamo 3.4.0.6752)
# author: Dynamo Team
# In der Umgebung für Entwurfskörperfamilien werden in diesem Diagramm eine Modelllinie und ein Referenzpunkt erstellt.

# group: Info
# note: Sie können mit den Schaltflächen in der oberen rechten Ecke des Bildschirms (Strg+B) zwischen 3D-Hintergrundnavigation und Diagrammansichtsnavigation wechseln. Die Hintergrundvorschau kann auch im Menü Ansicht für Dynamo und Revit aktiviert bzw. deaktiviert werden.
# note: Führen Sie dieses Diagramm in einer Umgebung für Entwurfskörper- oder allgemeine adaptive Modellfamilien aus.
# Um eine neue Familie zu erstellen, wechseln Sie zu Datei > Neue Familie, und wählen Sie die im folgenden Ordner befindliche Vorlage aus:
# C:\ProgramData\Autodesk\RVT 2026\Family Templates\English-Imperial\Generic Model Adaptive.rft
# note: In diesem Diagramm werden eine Modelllinie und ein Referenzpunkt in der Familienumgebung erstellt

# group: Punktkoordinaten
x_wert_für_punkt = DoubleSlider(50, range=5..50 step 5)  # graph input
y_wert_für_punkt = DoubleSlider(25, range=5..50 step 5)  # graph input
z_wert_für_punkt = DoubleSlider(25, range=5..50 step 5)  # graph input

# note: Ändern Sie die Position des Punkts in der Dynamo-Umgebung: Wählen Sie den Point.ByCoordinates-Block aus, und wechseln Sie zur Hintergrundvorschau, um den Punkt entlang seiner drei Achsen zu ziehen.
byCoordinates = Point.ByCoordinates(x=x_wert_für_punkt, y=y_wert_für_punkt, z=z_wert_für_punkt)
# note: Geometrische Daten können entweder als Textinformationen oder im 3D-Raum visualisiert werden.
watch = Watch(byCoordinates)
byCoordinates_2 = Point.ByCoordinates()
byStartPointEndPoint = Line.ByStartPointEndPoint(startPoint=byCoordinates_2, endPoint=byCoordinates)
# note: Vorschau der Geometrie anzeigen
watch_3d = Watch3D(byStartPointEndPoint)
# note: Modellkurve durch Verbinden von zwei Punkten erstellen
byCurve = ModelCurve.ByCurve(curve=byStartPointEndPoint)
# note: Dynamo kann nur Elemente erstellen und ändern, die für die Datei, mit der Dynamo verknüpft ist, geeignet sind. So können z. B. Referenzpunkte nur in bestimmten Familienumgebungen (z. B. Allgemeines Modell adaptiv) erstellt werden, Modelllinien hingegen nahezu überall.
byPoint = ReferencePoint.ByPoint(pt=byCoordinates)
