# Dynamo graph Revit Geometry Creation Solids.dyn (Dynamo 4.0.0.3076)
# author: Dynamo Team
# In diesem Diagramm werden verschiedene Methoden zum Erstellen von Volumenkörpergeometrie in Dynamo und zum Integrieren der Geometrie in Revit vorgestellt. Einige Methoden können in einer Projektumgebung, andere jedoch nur in bestimmten Familienumgebungen verwendet werden (Entwurfskörper).

# group: Info
# note: Für die meisten Volumenkörper stehen mehrere Erstellungsmethoden zur Verfügung. In diesen Beispielen werden geschlossene Profile als Basis verwendet, es ist jedoch auch möglich, mehrere Polysurfaces zusammenzufügen. Es stehen zahlreiche Grundkörper zur Verfügung (Flächen, Quader, Kegel usw.).
# Um Geometrie in die Revit-Umgebung zu integrieren, muss sie zunächst in ein Revit-Element konvertiert werden.
# Volumenkörper können in ein Importexemplar umgewandelt werden, das sowohl in der Projekt- als auch in der Modellfamilienumgebung sichtbar ist.
# Die Volumenkörpergeometrie kann auch in ein Formelement konvertiert werden, das nur für Entwurfskörper- und adaptive Bauteilfamilienumgebungen verfügbar ist.
# note: In diesem Diagramm werden verschiedene Methoden zum Erstellen von Volumenkörpergeometrie in Revit verwendet. Einige Methoden können in einer Projektumgebung, andere nur in bestimmten Familienumgebungen verwendet werden.
# Verwenden Sie eine Entwurfskörper-Familienvorlage, um alle Methoden anzuzeigen.
# Öffnen Sie eine Entwurfskörperfamilie, indem Sie Datei > Neu > Familie und dann die Vorlage Mass.rft unter \Conceptual Mass\Mass.rft auswählen

# group: Punkte vorbereiten
# Punktmenge zum Erstellen von Geometrie generieren
byCoordinates = Point.ByCoordinates()
number = DoubleInput(10)
byCoordinates_2 = Point.ByCoordinates(x=number)
number_2 = DoubleInput(5)
byCoordinates_3 = Point.ByCoordinates(z=number_2)
number_3 = DoubleInput(10)
byCoordinates_4 = Point.ByCoordinates(y=number_3)
number_4 = DoubleInput(15)
byCoordinates_5 = Point.ByCoordinates(x=number_4, y=number_4)
number_5 = DoubleInput(5)
number_6 = DoubleInput(10)
byCoordinates_6 = Point.ByCoordinates(x=number_5, y=number_6, z=number_6)
number_7 = DoubleInput(-2)
number_8 = DoubleInput(5)
byCoordinates_7 = Point.ByCoordinates(x=number_7, y=number_8)

# group: Erstes Profil
# Erstes Profil als geschlossene Kurve aus einem Bogen und einer Linie erstellen
byStartPointEndPoint = Line.ByStartPointEndPoint(startPoint=byCoordinates, endPoint=byCoordinates_2)
byThreePoints = Arc.ByThreePoints(firstPoint=byCoordinates, secondPoint=byCoordinates_3, thirdPoint=byCoordinates_2)
create = List.Create(item0=byStartPointEndPoint, item1=byThreePoints)
# note: Erstes Profil für die Erhebung
byJoinedCurves = PolyCurve.ByJoinedCurves(curves=create)

# group: Zweites Profil
# Zweites Profil als geschlossene Kurve aus einem Bogen und einer Linie erstellen
byStartPointEndPoint_2 = Line.ByStartPointEndPoint(startPoint=byCoordinates_4, endPoint=byCoordinates_5)
byThreePoints_2 = Arc.ByThreePoints(firstPoint=byCoordinates_4, secondPoint=byCoordinates_6, thirdPoint=byCoordinates_5)
create_2 = List.Create(item0=byStartPointEndPoint_2, item1=byThreePoints_2)
# note: Zweites Profil für die Erhebung
byJoinedCurves_2 = PolyCurve.ByJoinedCurves(curves=create_2)

# note: Zwei Profile in einer Liste verbinden
create_3 = List.Create(item0=byJoinedCurves, item1=byJoinedCurves_2)

# group: Volumenkörper-Erhebung nach Querschnitten
# Beschreibung <Hier doppelklicken, um die Gruppenbeschreibung zu bearbeiten>
byLoft = Solid.ByLoft(crossSections=create_3)

# note: Volumen des Volumenkörpers untersuchen
volume = Solid.Volume(solid=byLoft)

# group: Schale erstellen
code_block = CodeBlock { 0; }
# note: Tipp: Deaktivieren Sie "Vorschau" im Kontextmenü von Blöcken, um Elemente von der Anzeige auszuschließen.
thinShell = Solid.ThinShell(solid=byLoft, internalFaceThickness=code_block)

# group: Geometrie verschieben
code_block_2 = CodeBlock { Vector.ByCoordinates(20,0,0); }
# note: Geometrie zur Seite verschieben, um eine Vorschau des ursprünglichen und des endgültigen Ergebnisses anzuzeigen
translate = Geometry.Translate(geometry=thinShell, direction=code_block_2)

# group: Volumenkörper stutzen
# Verwenden Sie die Operation Stutzen, um den Schalenvolumenkörper mit einer Ebene zu schneiden.
code_block_3 = CodeBlock { Point.ByCoordinates(0,0,5); }
ZAxis = Vector.ZAxis()
byOriginNormal = Plane.ByOriginNormal(origin=code_block_3, normal=ZAxis)
number_9 = DoubleInput(10)
# note: Wählen Sie, welche Seite der Stutzung beibehalten werden soll (die Seite, die dem Punkt am nächsten liegt, wird verworfen).
byCoordinates_8 = Point.ByCoordinates(x=number_9, y=number_9, z=number_9)
# note: Geometrische boolesche Operationen (Schnitt, Differenz, Vereinigung usw.) stehen in der Kategorie Geometrie zur Verfügung.
trim = Geometry.Trim(geometry=translate, other=byOriginNormal, pick=byCoordinates_8)

# group: Führungskurve
# NURBS-Kurve erstellen, die als Führungskurve für die Erhebungs-Volumenkörperform verwendet werden soll
create_4 = List.Create(item0=byCoordinates, item1=byCoordinates_7, item2=byCoordinates_4)
# note: Als NURBS-Kurve konstruierte Führungskurve
byPoints = NurbsCurve.ByPoints(points=create_4)

# group: Volumenkörper-Erhebung nach Querschnitten und Führungskurven
# note: Tipp: Deaktivieren Sie "Vorschau" im Kontextmenü von Blöcken, um Elemente von der Anzeige auszuschließen.
byLoft_2 = Solid.ByLoft(crossSections=create_3, guideCurves=byPoints)

# group: Importexemplar erstellen
code_block_4 = CodeBlock { Vector.ByCoordinates(-20,0,0); }
translate_2 = Geometry.Translate(geometry=byLoft_2, direction=code_block_4)
# note: Geometrie ist nicht identisch mit Revit-Elementen:
# Verwenden Sie ImportInstance zum Erstellen von Revit-Importen aus Oberflächen und Volumenkörpern in Revit-Umgebungen. Verwenden Sie Punkte und Kurven zum Platzieren von Familienexemplaren oder zum Erstellen von Formen in Körperfamilien oder allgemeinen Modellfamilien nach Punkt (bei adaptiven Bauteilen)
byGeometries = ImportInstance.ByGeometries(geometries=translate_2)
byCoordinates_9 = Vector.ByCoordinates()

# group: Form erstellen
# Mithilfe von zwei Profilkurvenschleifen ein Formelement erstellen (in der Umgebung für Entwurfskörperfamilien)
curves = PolyCurve.Curves(polyCurve=create_3)
# note: Modellkurven aus Kurven erstellen
referenceCurveByCurve = ModelCurve.ReferenceCurveByCurve(curve=curves)
# note: Formen können nur als Teil einer Entwurfskörperfamilie erstellt werden
byLoftCrossSections = Form.ByLoftCrossSections(curves=referenceCurveByCurve)
