# Dynamo graph Revit Structural Framing.dyn "Revit_StructuralFraming" (Dynamo 3.4.0.6752)
# author: Dynamo Team
# Dieses Diagramm erstellt eine Konstruktion aus Tragwerken und Stützen relativ zu einer ausgewählten Revit-Geschossdecke.

# group: Info
# note: Platzieren Sie Träger und Stützen von Tragwerken relativ zu einem in einem Revit-Modell ausgewählten Element.
# note: Dieses Diagramm ausführen: Datei Snowdon Towers Sample Architectural.rvt im Ordner Samples in Ihrer Revit-Installation
# C:\Programme\Autodesk\Revit 2026\Samples

# group: Eingaben
# note: Revit-Geschossdeckenelement auswählen, relativ zu dem die neue Pergola-Konstruktion erstellt wird
quellgeschossdecke_auswählen = DSModelElementSelection()  # 1 picked in the model; graph input
# note: Konstruktionshöhe
höhe = DoubleSlider(8.4, range=0..10 step 0.1)  # graph input
anzahl_der_träger = IntegerSlider(9, range=2..10 step 1)  # graph input
# note: Ebene auswählen, auf der die Konstruktion platziert werden soll
konstruktionsebene = Levels("L1 - Block 43")  # graph input
# note: Wählen Sie einen Tragwerkstyp für die Umfangsträger aus. Dieser Typ wird auch zum Erstellen eines neuen Tragwerkstyps verwendet
structural_framing_types = StructuralFramingTypes("W12X26")  # graph input
# note: Familientyp der erstellten Stützen auswählen
tragwerksstützentypen = StructuralColumnTypes(index=0)  # graph input

# group: Geometrie vorbereiten
# Sauberen Volumenkörperausdruck der Geometrie des ausgewählten Elements vorbereiten
# note: Geometrie des Revit-Elements abrufen
getGeometry = Element.GetGeometry(element=quellgeschossdecke_auswählen)
# note: Um die Elementöffnungen schnell zu verwerfen, den Begrenzungsrahmen abrufen - einen virtuellen Quader, der das Element enthält
byMinimumVolume = BoundingBox.ByMinimumVolume(geom=getGeometry)
# note: Für Volumenkörper stehen mehr Aktionen zur Verfügung als für Begrenzungsrahmen. Um weitere Transformationen zu ermöglichen, konvertieren Sie zunächst den Begrenzungsrahmen in einen Quader (einen Typ von Volumenkörper)
toCuboid = BoundingBox.ToCuboid(boundingBox=byMinimumVolume)
# note: Quaderförmigen Volumenkörper um eine Höhe verschieben (zTranslation), die mit dem numerischen Schieberegler im Bereich der Diagrammeingaben festgelegt wurde
translate = Geometry.Translate(geometry=toCuboid, zTranslation=höhe)

# group: Obere Fläche des Volumenkörpers abrufen
# Alle Flächen des Volumenkörpers nach der Höhe in ihrer Mitte auswerten und die obere Fläche abrufen
# note: Volumenkörper in Flächen auflösen
explode = Geometry.Explode(geometry=translate)
code_block = CodeBlock { 0.5; }
# note: Punkt in der Mitte der Fläche positionieren
pointAtParameter = Surface.PointAtParameter(surface=explode, u=code_block, v=code_block)
# note: Numerischen Wert für die Höhe jedes Mittelpunkts abrufen
Z = Point.Z(point=pointAtParameter)
# note: Eine Liste anhand einer anderen Liste sortieren: Höhenwerte zum Sortieren der Flächen verwenden
sortByKey = List.SortByKey(list=explode, keys=Z)
# note: Die letzte Fläche in der Liste ist die obere Fläche
lastItem = List.LastItem(list=sortByKey.sortedList)

# group: Punktreihen auf der Fläche versetzen
# note: Erstellen Sie mit einer einfachen Formel eine Sequenz von Werten von min. (0.1) bis max. (0.9) mit einer n-Anzahl von Schritten
sequenz_der_u_werte = CodeBlock(n=anzahl_der_träger) { 0.1..0.9..#n; }
kantenversätze = CodeBlock { [0.1,0.9]; }
# note: Positionieren Sie eine Punktgruppe mithilfe der U- und V-Parameter auf der Fläche. Verwenden Sie die Option Kartesisches Produkt - Vergitterung (klicken Sie mit der rechten Maustaste auf den Block, und wählen Sie Vergitterung), um eine Gruppe zu erstellen.
pointAtParameter_2 = Surface.PointAtParameter(surface=lastItem, u=sequenz_der_u_werte, v=kantenversätze, lacing=CrossProduct)

# group: Linien für Innenträger erstellen
# Punkte verbinden und Linien erstellen
indizes = CodeBlock { 0; 1; }
# note: Klicken Sie auf das Symbol > neben der list-Eingabe, um Ebenen zu verwenden. Das Ergebnis ist das Element mit dem Index 0 aus jeder untersten verschachtelten Liste (@L2)
getItemAtIndex = List.GetItemAtIndex(list=pointAtParameter_2@L2, index=indizes.out0)
getItemAtIndex_2 = List.GetItemAtIndex(list=pointAtParameter_2@L2, index=indizes.out1)
byStartPointEndPoint = Line.ByStartPointEndPoint(startPoint=getItemAtIndex, endPoint=getItemAtIndex_2)

# group: Kurven für Umfangsträger
# Beschreibung <Hier doppelklicken, um die Gruppenbeschreibung zu bearbeiten>
firstItem = List.FirstItem(list=pointAtParameter_2)
lastItem_2 = List.LastItem(list=pointAtParameter_2)
byStartPointEndPoint_2 = Line.ByStartPointEndPoint(startPoint=firstItem, endPoint=lastItem_2)

# group: Kurven für Stützen
# Jede zweite Reihe von Punkten zum Erstellen von Linien für die Spaltenplatzierung verwenden
code_block_2 = CodeBlock { 2; }
# note: Liste in Listen mit 2 Elementen zerlegen
chop = List.Chop(list=pointAtParameter_2, lengths=code_block_2)
# note: Logik der Listenebenen verwenden und nur die erste Liste bei @L3 verwenden
firstItem_2 = List.FirstItem(list=chop@L3)
höhe_umkehren = CodeBlock(H=höhe) { -H; }
# note: Punkte wieder nach unten verschieben
translate_2 = Geometry.Translate(geometry=firstItem_2, zTranslation=höhe_umkehren)
# note: Punkte verbinden, um Linien zu erstellen
byStartPointEndPoint_3 = Line.ByStartPointEndPoint(startPoint=translate_2, endPoint=firstItem_2)

# group: Nach Revit: Träger nach Kurve platzieren
# note: Innenträger platzieren
beamByCurve = StructuralFraming.BeamByCurve(curve=byStartPointEndPoint, level=konstruktionsebene, structuralFramingType=structural_framing_types)
# note: Umfangsträger platzieren
beamByCurve_2 = StructuralFraming.BeamByCurve(curve=byStartPointEndPoint_2, level=konstruktionsebene, structuralFramingType=structural_framing_types)
# note: Tragwerksstützen platzieren
columnByCurve = StructuralFraming.ColumnByCurve(curve=byStartPointEndPoint_3, level=konstruktionsebene, structuralColumnType=tragwerksstützentypen)
