# Dynamo graph Revit Floors and Framing.dyn (Dynamo 4.0.0.3076)
# author: Dynamo Team
# This graph creates an architectural folly by using a series of lines and their displacement to position Structural Framing and Floor elements in Revit.
# packages: PythonNet3 Engine 1.4.5

# group: Info
# note: Run this graph the Snowdon Towers Sample Architectural.rvt file in the Samples folder located with your Revit installation
# C:\Program Files\Autodesk\Revit 2027\Samples
# note: This graph creates an architectural folly, using a series of lines and uses them to drive the placement of Structural Framing and Floors.

# group: Center of Folly position
x_position = DoubleSlider(30, range=25..40 step 1)  # graph input
y_position = DoubleSlider(30, range=25..40 step 1)  # graph input
z_position = DoubleSlider(62, range=60..80 step 1)  # graph input

# group: Folly configuration
lower_floor_radius = DoubleSlider(10, range=8..20 step 1)  # graph input
nr_floors = DoubleSlider(7, range=3..10 step 1)  # graph input
radius_decrease = DoubleSlider(-1.25, range=-2..-0.5 step 0.25)  # graph input
number_of_polygon_sides = IntegerSlider(5, range=3..10 step 1)  # graph input
top_floor_height = DoubleSlider(38.4, range=15..50 step 0.1)  # graph input
maximum_rotation_degrees = DoubleSlider(130, range=10..180 step 5)  # graph input

# group: Construct Polygons
# Create a series of polygons of a decreasing radius, offset vertically, sequentially rotated
# note: Center Of Folly
byCoordinates = Point.ByCoordinates(x=x_position, y=y_position, z=z_position)
# note: Sequence of circle radii
sequence = Sequence(start=lower_floor_radius, amount=nr_floors, step=radius_decrease, lacing=Longest)
# note: Create a series of circles
byCenterPointRadius = Circle.ByCenterPointRadius(centerPoint=byCoordinates, radius=sequence)
# note: Make a series of polygons
regularPolygon = Polygon.RegularPolygon(circle=byCenterPointRadius, numberSides=number_of_polygon_sides)
# note: A sequence of floor elevations
floor_heigts_sequence = CodeBlock(top_floor=top_floor_height, count=nr_floors) { 0..top_floor..#count; }
byCoordinates_2 = Vector.ByCoordinates(z=floor_heigts_sequence)
# note: Move the Polygons up by given heights
translate = Geometry.Translate(geometry=regularPolygon, direction=byCoordinates_2)
ZAxis = Vector.ZAxis()
# note: A sequence of rotations for each floor
rotation_angles_sequence = CodeBlock(max_degrees=maximum_rotation_degrees, count=nr_floors) { 0..max_degrees..#count; }
# note: Rotate the polygons with a series of angles
rotate = Geometry.Rotate(geometry=translate, origin=byCoordinates, axis=ZAxis, degrees=rotation_angles_sequence)
# note: Extract individual curves from the polygons
curves = PolyCurve.Curves(polyCurve=rotate)

# group: Floor Type & Level
# note: Select the Floor Type for created Floors from the types existing in the project using the dropdown
floor_types = FloorTypes("Concrete Slab 6\"")  # graph input
levels = Levels("Green Roof Hardscape")  # graph input

# group: To Revit: Create Floors
# Use the series of closed curve loops as input for Floor creation
# note: Pass Groups of Curves to create Floors
byOutlineTypeAndLevel = Floor.ByOutlineTypeAndLevel(outline=curves, floorType=floor_types, level=levels)

# group: Vertical connections
# Connect polygon corners between folly levels
# note: Get End Points of each Polygon curve
endPoint = Curve.EndPoint(curve=curves)
# note: Flip the matrix and get lists of End Points aligned vertically
transpose = List.Transpose(lists=endPoint)
# note: Connect up matching corners of polygons from lowest to highext folly level, joining them as Polycurves
byPoints = PolyCurve.ByPoints(points=transpose)
# note: Deconstruct polycurves and obtain lists of curves to serve as input for Structural Framing elements
curves_2 = PolyCurve.Curves(polyCurve=byPoints)

# group: Structural Framing Type & Level
levels_2 = Levels("Green Roof Hardscape")  # graph input
# note: Select the Structural Framing Type from the types loaded in the project using the dropdown
structural_framing_types = StructuralFramingTypes("W12X26")  # graph input

# group: To Revit: Create Structural Framing
# Use curves to create Structural Framing elements and use a Python node to Disallow join between individual beams
# note: Pass individual curves for each structural element
beamByCurve = StructuralFraming.BeamByCurve(curve=curves_2, level=levels_2, structuralFramingType=structural_framing_types)
# note: Prepare the list
flatten = List.Flatten(list=beamByCurve)
# note: This is a renamed Python node that references the Revit API to extend what Dynamo can do beyond the out-of-the-box nodes. To read the Python code, right-click on the node and click Edit…
disallow_joins_on_structural = Python(structuralFraming=flatten)  # "Disallow Joins on Structural Framing"; PythonNet3
# ---------- disallow_joins_on_structural.python (35 lines) ----------
# Load the Python Standard and DesignScript Libraries
import sys
import clr
clr.AddReference('ProtoGeometry')
from Autodesk.DesignScript.Geometry import *
from Autodesk.Revit.DB import *
from RevitServices.Transactions import TransactionManager
from RevitServices.Persistence import DocumentManager 

doc = DocumentManager.Instance.CurrentDBDocument

# The inputs to this node will be stored as a list in the IN variables.
dataEnteringNode = IN

# Place your code below this line
structural_framing = UnwrapElement(IN[0])

unjoined_elements = []
# start a Transaction
TransactionManager.Instance.EnsureInTransaction(doc)
# iterate through each structural framing element
for sf in structural_framing:
    # check if the element passed in of Structural Framing Category
    sf_category = sf.Category # get the element's Category
    # use the Structural Framing's Category Id to check
    if sf_category.Id.Value == -2001320:
        # disallow joins at start and end of the structural framing element
        Structure.StructuralFramingUtils.DisallowJoinAtEnd(sf, 0)
        Structure.StructuralFramingUtils.DisallowJoinAtEnd(sf, 1)
        unjoined_elements.append(sf)
TransactionManager.Instance.TransactionTaskDone()

    
# Output the list of elements with Disallowed Join
OUT = unjoined_elements
# ----------------------------------------
