# Dynamo graph Revit Geometry Creation Points.dyn (Dynamo 4.0.0.3076)
# author: Dynamo Team
# This graph creates a Model Line and a Reference Point when in Conceptual Mass Family environment.

# group: Info
# note: You can toggle between 3D Background navigation and Graph View navigation with the butttons in the upper right corner of the screen (Ctrl + B shortcut). Background Preview can also be turned on and off in the View Menu, for Dynamo and Revit.
# note: Run this graph in a Conceptual Mass or Generic Model Adaptive family environment.
# To create a new family, go to File > New Family > and select the template located in the folder:
# C:\ProgramData\Autodesk\RVT 2027\Family Templates\English-Imperial\Generic Model Adaptive.rft
# note: This graph creates a Model Line and a Reference Point in Family environment

# group: Point coordinates
point_x_value = DoubleSlider(50, range=5..50 step 5)  # graph input
point_y_value = DoubleSlider(25, range=5..50 step 5)  # graph input
point_z_value = DoubleSlider(25, range=5..50 step 5)  # graph input

# note: Manipulate the position of the point in the Dynamo environment : Select the Point.ByCoordinates node and swicth to Background preview to pull the point along its three axes.
byCoordinates = Point.ByCoordinates(x=point_x_value, y=point_y_value, z=point_z_value)
# note: Geometric Data can be visualized as either textual information or in 3d space
watch = Watch(byCoordinates)
byCoordinates_2 = Point.ByCoordinates()
byStartPointEndPoint = Line.ByStartPointEndPoint(startPoint=byCoordinates_2, endPoint=byCoordinates)
# note: Preview the geometry
watch_3d = Watch3D(byStartPointEndPoint)
# note: Create a model curve by connecting two points
byCurve = ModelCurve.ByCurve(curve=byStartPointEndPoint)
# note: Dynamo can only create and modify elements that are appropriate to the file that Dynamo is associated with.  For instance, Reference Points can only be made in certain Family environments (such as Generic Model Adaptive), while Model Lines can be created almost anywhere.
byPoint = ReferencePoint.ByPoint(pt=byCoordinates)
