# Dynamo graph Revit Geometry Creation Surfaces.dyn (Dynamo 4.0.0.3076)
# author: Dynamo Team
# This graph presents several methods of creating Surfaces in Dynamo and two methods of converting geometry into Revit Geometry.

# group: Info
# note: This graph uses several methods to create Surface geometry in Revit - some methods can be used in a project environment, others - only in certain Family environments.
# Use a Conceptual Mass family template to view all methods.
# Create a Conceptual Mass family by going to File > New > Family  and select the Mass.rft template in the Conceptual Mass folder.
# note: Multiple creation methods exist for most Surfaces.  Surfaces, Polysurfaces (collections of Surfaces), and NURBS Surfaces can be created by Points, Curves, and derived from other surfaces and solids by various operations.
# note: In order to integrate geometry into the Revit environment, it first needs to be converted into a Revit Element.
# Surfaces and Solids can be transformed into an Import Instance that will be visible both Project and model Family environments.
# The Surface geometry can also be converted into a Form element that is only available for Conceptual Mass and Adaptive Component Family environments.

# group: Prepare Points
# Generate a set of points to build geometry
number = DoubleInput(10)
byCoordinates = Point.ByCoordinates(y=number)
number_2 = DoubleInput(5)
number_3 = DoubleInput(10)
byCoordinates_2 = Point.ByCoordinates(x=number_2, y=number_3, z=number_3)
number_4 = DoubleInput(15)
byCoordinates_3 = Point.ByCoordinates(x=number_4, y=number_4)
byCoordinates_4 = Point.ByCoordinates()
number_5 = DoubleInput(5)
byCoordinates_5 = Point.ByCoordinates(z=number_5)
byCoordinates_6 = Point.ByCoordinates(x=number)
number_6 = DoubleInput(-5)
number_7 = DoubleInput(5)
byCoordinates_7 = Point.ByCoordinates(x=number_6, y=number_7)
number_8 = DoubleInput(10)
number_9 = DoubleInput(-10)
byCoordinates_8 = Point.ByCoordinates(x=number_8, y=number_9)
byCoordinates_9 = Point.ByCoordinates(y=number_9)

# group: Create Profiles
byThreePoints = Arc.ByThreePoints(firstPoint=byCoordinates, secondPoint=byCoordinates_2, thirdPoint=byCoordinates_3)
byThreePoints_2 = Arc.ByThreePoints(firstPoint=byCoordinates_4, secondPoint=byCoordinates_5, thirdPoint=byCoordinates_6)
byThreePoints_3 = Arc.ByThreePoints(firstPoint=byCoordinates_4, secondPoint=byCoordinates_7, thirdPoint=byCoordinates)
byStartPointEndPoint = Line.ByStartPointEndPoint(startPoint=byCoordinates_8, endPoint=byCoordinates_9)

# group: Surface by Sweep
# Use a profile, a path curve and a guide rail to create a sweep surface
bySweep2Rails = Surface.BySweep2Rails(path=byThreePoints, guideRail=byThreePoints_2, profile=byThreePoints_3)

# group: Create Import
# note: Use Import Instance to create Revit Imports from Surfaces and Solids - these will be visible in any Revit Environment.
byGeometries = ImportInstance.ByGeometries(geometries=bySweep2Rails)

create = List.Create(item0=byStartPointEndPoint, item1=byThreePoints_2)

# group: Create Surface by Loft
# Join Cross Sections to create a Loft surface
byLoft = Surface.ByLoft(crossSections=create)

# group: Evaluate Surface Area
area = Surface.Area(surface=byLoft)
watch = Watch(area)
create_2 = List.Create(item0=byLoft, item1=bySweep2Rails)
# note: Surfaces Joined as Polysurfaces can be evalued as a single entity
byJoinedSurfaces = PolySurface.ByJoinedSurfaces(surfaces=create_2)
area_2 = Surface.Area(surface=byJoinedSurfaces)
watch_2 = Watch(area_2)
area_3 = Surface.Area(surface=bySweep2Rails)
watch_3 = Watch(area_3)

# group: NURBS Surface from Control Points
# Convert a sweep into a NURBS surface from Control Points
code_block = CodeBlock { 0..1..0.1; }
# note: Edges, Points and other features can be derived from Surfaces using "Actions" appropriate to those geometries.
pointAtParameter = Surface.PointAtParameter(surface=bySweep2Rails, u=code_block, v=code_block, lacing=CrossProduct)
# note: Reconstruct the surface as a NURBS surface from Control Points
byControlPoints = NurbsSurface.ByControlPoints(controlVertices=pointAtParameter)
# note: Use Watch 3D node to preview the geometry in isolation
watch_3d = Watch3D(byControlPoints)

# group: Surface by Extrude Curve
# Use a Curve to create an Extrusion with a given distance
code_block_2 = CodeBlock { 10; }
extrude = Curve.Extrude(curve=byThreePoints, distance=code_block_2)

# group: Create Form
# Create a Loft shape from two curves
referenceCurveByCurve = ModelCurve.ReferenceCurveByCurve(curve=create)
byLoftCrossSections = Form.ByLoftCrossSections(curves=referenceCurveByCurve)
