# Dynamo graph Revit Import Solid.dyn (Dynamo 4.0.0.3076)
# author: Dynamo Team
# This graph demonstrates a method of creating Dynamo Solid geometry and using it to create a Revit Import Instance element. Construct a new roof shape by creating a series of arc profiles and using them to create a loft surface.

# group: Info
# note: Source element (Roof) has been pre-selected from Revit, with Element IDs saved with the Dynamo file
# note: Run this graph the Snowdon Towers Sample Architectural.rvt file in the Samples folder located with your Revit installation
# C:\Program Files\Autodesk\Revit 2027\Samples
# note: Construct a new roof shape from a selected roof element by creating a series of arc profiles and using them to create a loft surface. The geometry is converted into an Import Instance to integrate it into the Revit environment

# group: New Roof configuration
# note: The number of profiles from which the Loft surface will be created
number_of_profiles = IntegerSlider(6, range=3..10 step 1)
# note: The height at the short ends of the new roof
roof_section_min = DoubleSlider(2.1, range=1..5 step 0.1)
# note: The height at the middle of the roof
roof_section_max = DoubleSlider(7, range=5..10 step 0.1)
# note: Extend the arc profiles sideways by this value
roof_sides_extension = DoubleSlider(0.5, range=0.1..3 step 0.1)
# note: Thickness of the new Roof shape
roof_thickness = DoubleSlider(0.5, range=0.1..2 step 0.1)

nr_of_profiles = CodeBlock(steps=number_of_profiles) { steps; }

# group: Select Roof
# Select source roof element
# note: All inputs marked at 'IsInput' can be set from Dynamo Player
select_flat_roof = DSModelElementSelection()  # 1 picked in the model

# group: Get Roof Face
# Explode the source element's geometry and pick one face with the largest area
# note: In order to get the face of the seleced element, first get its geometry
# note: Right-click and untick 'Preview Geometry' for a clearer view of the final result
getGeometry = Element.GetGeometry(element=select_flat_roof)
# note: Explode the geometry to get individual faces
explode = Geometry.Explode(geometry=getGeometry)
# note: Dispose of list structure. Note that this step will not be required if multiple source objects are used
flatten = List.Flatten(list=explode)
area = Surface.Area(surface=flatten)
# note: Sort the list of surfaces by their area. The surface with the largest ares will be the last item in the list of sortedList output
sortByKey = List.SortByKey(list=flatten, keys=area)
lastItem = List.LastItem(list=sortByKey.sortedList)
number = DoubleInput(1.5)
# note: Translate the surface upwards
translate = Geometry.Translate(geometry=lastItem, zTranslation=number)

# group: Offset outwards (scale)
# Scale the surface to extend its edges outwards
uv_position = CodeBlock { 0.5; }
pointAtParameter = Surface.PointAtParameter(surface=translate, u=uv_position, v=uv_position)
scale_from_point_to_point = CodeBlock { point1 = Point.ByCoordinates(1, 1); point2 = Point.ByCoordinates(-40, -40); }
scale = Geometry.Scale(geometry=translate, basePoint=pointAtParameter, from=scale_from_point_to_point.point1, to=scale_from_point_to_point.point2)

# group: Points on surface
# Generate three lists of equally spaced points  - two rows along the longer edges and one row in the middle
# note: 0 and 1 are positions along longer edges of the surface
u_positions_for_edge_rows = CodeBlock { [0,1]; }
# note: V positions along the longer edges, in a sequence from 0 to 1 and N steps
v_positions_for_edge_rows = CodeBlock(steps=nr_of_profiles) { [0..1..#steps]; }
# note: Use the Longest Lacing setting by right-click on the node > Lacing.
# The longest lacing will match inputs with different list structures. In this case the result will be two lists of points, where number of points in each list matches the longest input list.
pointAtParameter_2 = Surface.PointAtParameter(surface=scale, u=u_positions_for_edge_rows, v=v_positions_for_edge_rows, lacing=Longest)
# note: The U value of 0.5 will position points along the middle of the surface
u_position_for_middle_row = CodeBlock { [0.5]; }
# note: V positions along the middle row of points, in a sequence from 0 to 1 and N steps
v_positions_for_middle_row = CodeBlock(steps=nr_of_profiles) { [0..1..#steps]; }
# note: Longest Lacing is used for this node. The result is one list of points, where the number of points in the list matches the longest input list.
pointAtParameter_3 = Surface.PointAtParameter(surface=scale, u=u_position_for_middle_row, v=v_positions_for_middle_row, lacing=Longest)

# group: Offset points up
# Offset the points of the middle row in the shape of a cosine wave
# note: a sequence of values to generate a series of offsets
sequence_of_angles = CodeBlock(steps=nr_of_profiles) { -1..1..#steps; }
# note: Alternative: Use the Sine for a different roof shape
sin = Math.Sin(angle=sequence_of_angles)
# note: values in a cosine wave
cos = Math.Cos(angle=sequence_of_angles)
# note: remap the values to a new domain
remapRange = Math.RemapRange(numbers=cos, newMin=roof_section_min, newMax=roof_section_max)
# note: translate the points of the middle row
translate_2 = Geometry.Translate(geometry=pointAtParameter_3@L2, zTranslation=remapRange)

# group: Create profiles from arcs
# Use the points to create arcs
# note: Join the edge and middle rows into one list
join = List.Join(list0=pointAtParameter_2, list1=translate_2)
item_index = CodeBlock { 0; 1; 2; }
getItemAtIndex = List.GetItemAtIndex(list=join, index=item_index.out0)
getItemAtIndex_2 = List.GetItemAtIndex(list=join, index=item_index.out2)
getItemAtIndex_3 = List.GetItemAtIndex(list=join, index=item_index.out1)
byThreePoints = Arc.ByThreePoints(firstPoint=getItemAtIndex, secondPoint=getItemAtIndex_2, thirdPoint=getItemAtIndex_3)

# group: Extend profiles
# Extend the curves of each profile by a given distance
# note: The value of exension is set as input in the left side of the graph.
extend_edges = CodeBlock(roof_extension=roof_sides_extension) { roof_extension; }
extendStart = Curve.ExtendStart(curve=byThreePoints, distance=extend_edges)
extendEnd = Curve.ExtendEnd(curve=extendStart, distance=extend_edges)

# group: Loft and Thicken
# Create a loft surface and give it a thickness
byLoft = Surface.ByLoft(crossSections=extendEnd)
thicken = Surface.Thicken(surface=byLoft, thickness=roof_thickness)

# group: To Revit:
# Convert Dynamo geometry into a Revit element via ImportInstance and Set Level parameter
# note: In order to integrate geometry into the Revit environment, it first needs to be converted into a Revit Element.
# Solids can be transformed into an Import Instance that will be visible both Project and model Family environments.
byGeometry = ImportInstance.ByGeometry(geometry=thicken)
code_block = CodeBlock { "Work Plane"; }
levels = Levels("L1 - Block 43")
# note: Correct the height of the placed Import Instance by setting the Work Plane parameter to the Level which elevation matches the Internal Origin position.
setParameterByName = Element.SetParameterByName(element=byGeometry, parameterName=code_block, value=levels)
