# Dynamo graph Revit Place Families By Level Set Parameters.dyn (Dynamo 4.0.0.3076)
# author: Dynamo Team
# This graph demonstrates how to place Revit elements by point. Place rows of chairs in a selected room and write unique numbers to their Mark Parameter

# group: Info
# note: Run this graph the Snowdon Towers Sample Architectural.rvt file in the Samples folder located with your Revit installation
# C:\Program Files\Autodesk\Revit 2027\Samples
# note: Place rows of chairs in a selected room and write unique numbers to their Mark Parameter

# group: Select Revit Elements
# note: Select Family Type for the instances being placed from the Family Types in the Project
family_types = FamilyTypes("Chair-Breuer:Chair-Breuer")  # graph input
# note: Select a Room in which to place the elements. You will need to navigate to a view where rooms are visible (Floor Plan)
select_room = DSModelElementSelection()  # 1 picked in the model; graph input
circle_radius = DoubleSlider(6.4, range=5..8 step 0.1)  # graph input
# note: Select the Level on which to place elements
levels = Levels("L3")  # graph input

# group: Set row offsets
# The values for row offsets are not distance but the U and V values
row_start = DoubleSlider(0.3, range=0..3 step 0.1)  # graph input
row_end = DoubleSlider(2.2, range=0..3 step 0.1)  # graph input
nr_chairs_in_a_row = IntegerSlider(8, range=2..12 step 1)  # graph input
first_row_position = DoubleSlider(0.2, range=0..3 step 0.1)  # graph input
last_row_position = DoubleSlider(1.4, range=0..3 step 0.1)  # graph input
row_spacing = DoubleSlider(0.35, range=0.15..1 step 0.05)  # graph input

# group: Generate offsets for rows
# Series of numbers corresponding to the U and V positions on the surface. Values can exceed the 0 to 1 domain
# note: An alternative to creating a sequence by defining the sequence start, finish and the number of steps
rows_offset_sequence = CodeBlock(start=row_start, finish=row_end, steps=nr_chairs_in_a_row) { start..finish..#steps; }
# note: Generate a series of numbers within a range, with a given step
range = Range(start=first_row_position, end=last_row_position, step=row_spacing)

# group: Prepare location points
# note: The placement point of the selected room
location = Room.Location(room=select_room)
# note: Circle defining an initial area of placement. The shape of the circle does not matter in this case, but it is the quickest way to define a closed surface
byCenterPointRadius = Circle.ByCenterPointRadius(centerPoint=location, radius=circle_radius)
# note: Convert the circle into a surface in order to use it for positioning points
patch = Curve.Patch(curve=byCenterPointRadius)
# note: Using sequences of U and V values, create a matrix of points. Set the lacing of the node to Cross-Product by right-clicking and selecting Lacing.
pointAtParameter = Surface.PointAtParameter(surface=patch, u=rows_offset_sequence, v=range, lacing=CrossProduct)

# group: To Revit: Place Family Instances
# note: Place Family Instances
# Most Families Can also be placed by Point location.  Adaptive Components can be placed with multiple points, Structural Framing is placed with Curves
byPointAndLevel = FamilyInstance.ByPointAndLevel(familyType=family_types, point=pointAtParameter, level=levels)

# note: Dispose of list structure - get one list containing all items
flatten = List.Flatten(list=byPointAndLevel)

# group: Mark Prefix
# Use a custom prefix for placed elements Mark number
mark_prefix = StringInput("C-")  # graph input

# group: Generate Mark Numbers
number = DoubleInput(1)
# note: Count the number of items in the list
count = List.Count(list=flatten)
# note: Generate the numbers from 1 to n
sequence = Sequence(start=number, amount=count, step=number, lacing=Longest)
# note: To participate in string operations, the number must be first converted into a string
string_from_object = FromObject(obj=sequence)
index = CodeBlock { 0; }
# note: Insert a custom prefix to the item number
insert = String.Insert(string=string_from_object, index=index, toInsert=mark_prefix)

# group: To Revit: Set Parameter Values
string = StringInput("Mark")
# note: Set the Mark parameter with a list of values. The list structure of elements and values inputs must match, or just one value can be used. Parameters can also be read using an Element.GetParameterByName node
setParameterByName = Element.SetParameterByName(element=flatten, parameterName=string, value=insert)

# group: Check Results
# note: Watch node can be used to check if the results are as expected
watch = Watch(insert)  # graph output
