# Dynamo graph Revit Structural Framing.dyn (Dynamo 4.0.0.3076)
# author: Dynamo Team
# This graph creates a structure out of Structural Framing and Columns relative to a selected Revit Floor.

# group: Info
# note: Place Structural Framing Beams and Columns relative to an element selected in a Revit model.
# note: Run this graph the Snowdon Towers Sample Architectural.rvt file in the Samples folder located with your Revit installation
# C:\Program Files\Autodesk\Revit 2027\Samples

# group: Inputs
# note: Select a Revit Floor element relative to which the new pergola structure will be created
select_source_floor = DSModelElementSelection()  # 1 picked in the model; graph input
# note: Structure Height
height = DoubleSlider(8.4, range=0..10 step 0.1)  # graph input
number_of_beams = IntegerSlider(9, range=2..10 step 1)  # graph input
# note: Select the Level on which to place the structure
structure_level = Levels("L1 - Block 43")  # graph input
# note: Select a Framing type for the perimeter beams. This type will also be used to create a new Structural Framing type
structural_framing_types = StructuralFramingTypes("W12X26")  # graph input
# note: Select a Family Type of the created Columns
structural_column_types = StructuralColumnTypes(index=0)  # graph input

# group: Prepare geometry
# Prepare a clean solid expression of the selected element's geometry
# note: Get the geometry of the Revit element
getGeometry = Element.GetGeometry(element=select_source_floor)
# note: As a quick way to discard the element openings, get its bounding box - a virtual cuboid containing the element
byMinimumVolume = BoundingBox.ByMinimumVolume(geom=getGeometry)
# note: More actions are available for Solids than Bounding boxes. To allow for further transformations, first convert the Bounding Box to a cuboid (which is type of a Solid)
toCuboid = BoundingBox.ToCuboid(boundingBox=byMinimumVolume)
# note: Translate the Solid Cuboid by a Height (zTranslation) set by the Numeric Slider in the graph Inputs section
translate = Geometry.Translate(geometry=toCuboid, zTranslation=height)

# group: Get the solids's top surface
# Evaluate all solid's surfaces by the elevation in their center and get the top one
# note: Explode the solid into surfaces
explode = Geometry.Explode(geometry=translate)
code_block = CodeBlock { 0.5; }
# note: Locate a point at the center of the surface
pointAtParameter = Surface.PointAtParameter(surface=explode, u=code_block, v=code_block)
# note: Get a numeric value for each centerpoint's elevation
Z = Point.Z(point=pointAtParameter)
# note: Sort one list by another: use the elevation values to sort the surfaces
sortByKey = List.SortByKey(list=explode, keys=Z)
# note: The last surface in the list is the top surface
lastItem = List.LastItem(list=sortByKey.sortedList)

# group: Offset series of points on the surface
# note: Use a simple formula to create a sequence of values from min (0.1) to max (0.9) with an 'n' number of steps
sequence_of_u_values = CodeBlock(n=number_of_beams) { 0.1..0.9..#n; }
edge_offsets = CodeBlock { [0.1,0.9]; }
# note: Position an array of points on the surface by using U and V parameters. Use the Cross Product Lacing (right-click on the node and choose Lacing) to generate an array.
pointAtParameter_2 = Surface.PointAtParameter(surface=lastItem, u=sequence_of_u_values, v=edge_offsets, lacing=CrossProduct)

# group: Create Lines for Interior Beams
# Connect points and create lines
indices = CodeBlock { 0; 1; }
# note: Click on the > symbol next to the 'list' input to Use Levels. This means that the result will be the item with the index 0 from each lowest nested list (@L2)
getItemAtIndex = List.GetItemAtIndex(list=pointAtParameter_2@L2, index=indices.out0)
getItemAtIndex_2 = List.GetItemAtIndex(list=pointAtParameter_2@L2, index=indices.out1)
byStartPointEndPoint = Line.ByStartPointEndPoint(startPoint=getItemAtIndex, endPoint=getItemAtIndex_2)

# group: Curves for Perimeter Beams
firstItem = List.FirstItem(list=pointAtParameter_2)
lastItem_2 = List.LastItem(list=pointAtParameter_2)
byStartPointEndPoint_2 = Line.ByStartPointEndPoint(startPoint=firstItem, endPoint=lastItem_2)

# group: Curves for Columns
# Take each second row of points to create lines for columns placement
code_block_2 = CodeBlock { 2; }
# note: Chop the list into lists of 2
chop = List.Chop(list=pointAtParameter_2, lengths=code_block_2)
# note: Use list levels logic and only take the first list at @L3
firstItem_2 = List.FirstItem(list=chop@L3)
reverse_height = CodeBlock(H=height) { -H; }
# note: Translate the points back down
translate_2 = Geometry.Translate(geometry=firstItem_2, zTranslation=reverse_height)
# note: Connect the points to create lines
byStartPointEndPoint_3 = Line.ByStartPointEndPoint(startPoint=translate_2, endPoint=firstItem_2)

# group: To Revit: Place beams by curve
# note: Place Interior Beams
beamByCurve = StructuralFraming.BeamByCurve(curve=byStartPointEndPoint, level=structure_level, structuralFramingType=structural_framing_types)
# note: Place the perimeter beams
beamByCurve_2 = StructuralFraming.BeamByCurve(curve=byStartPointEndPoint_2, level=structure_level, structuralFramingType=structural_framing_types)
# note: Place the structural columns
columnByCurve = StructuralFraming.ColumnByCurve(curve=byStartPointEndPoint_3, level=structure_level, structuralColumnType=structural_column_types)
