# Dynamo graph Revit Adaptive Component Placement.dyn "Colocación de componentes adaptativos de Revit" (Dynamo 4.0.0.3076)
# author: Dynamo Team
# Este gráfico coloca los componentes adaptativos por puntos en un modelo.

# group: Información
# note: Las líneas de rejilla de muro cortina se han preseleccionado en Revit; los ID de elemento se han guardado con el archivo de Dynamo.
# note: Ejecute el archivo de gráfico Snowdon Towers Sample Architectural.rvt de la carpeta Samples que se incluye con la instalación de Revit:
# C:\Archivos de programa\Autodesk\Revit 2027\Samples
# Ejecute este gráfico después de cargar la familia adaptativa AdaptivePanel.rfa desde la ubicación de los conjuntos de datos de Dynamo.
# note: Inserte componentes adaptativos con respecto a algunos elementos seleccionados en un archivo de Revit.
# Los componentes adaptativos requieren un conjunto de puntos igual al número de puntos de colocación de la familia que se va a insertar.

# group: Entradas
# note: Seleccionar líneas de rejilla de muro cortina
seleccionar_bordes = SelectEdges()  # 7 picked in the model; graph input
# note: Establecer el desplazamiento mínimo y máximo para el punto medio de la aleta
desplazamiento_mín = DoubleSlider(1.4, range=0.2..3 step 0.1)
desplazamiento_máx = DoubleSlider(4.3, range=3..8 step 0.1)
# note: Seleccionar familia de componentes adaptativos
family_types = FamilyTypes("AdaptivePanel:AdaptivePanel")  # graph input

# note: Cree una lista de posiciones de punto a lo largo de una curva; utilice 0 como el inicio, 0,5 como el centro y 1 como el final.
lista_de_parámetros = CodeBlock { [0,0.5,1]; }
# note: Localizar los puntos inicial, medio y final en cada curva
pointAtParameter = Curve.PointAtParameter(curve=seleccionar_bordes, param=lista_de_parámetros, lacing=CrossProduct)

# group: Obtener los puntos inicial y final de cada curva
índices_de_puntos_iniciales_y = CodeBlock { 0; 2; }  # "Índices de puntos iniciales y finales"
getItemAtIndex = List.GetItemAtIndex(list=pointAtParameter@L2, index=índices_de_puntos_iniciales_y.out0)
# note: De forma similar a la selección del punto medio, utilice Niveles para seleccionar los puntos inicial y final de cada curva.
getItemAtIndex_2 = List.GetItemAtIndex(list=pointAtParameter@L2, index=índices_de_puntos_iniciales_y.out1)

# group: Obtener el punto medio de cada curva
índice_de_punto_medio = CodeBlock { 1; }
# note: Utilice los niveles de lista de la entrada "list". Por defecto, el resultado del nodo será la lista con el índice uno (la segunda curva). Haga clic con el botón derecho en la entrada "list" y seleccione "Usar niveles" en @L2. De este modo, se seleccionará el elemento con el índice 1 de cada lista anidada (puntos medios de cada curva).
getItemAtIndex_3 = List.GetItemAtIndex(list=pointAtParameter@L2, index=índice_de_punto_medio)

# group: Crear una onda sinusoidal
# note: Contar cuántas curvas de origen se seleccionan
count = List.Count(list=seleccionar_bordes)
# note: Crear una secuencia de valores N de 0 a 1
sequence = CodeBlock(steps=count) { 0..1..#steps; }
# note: Crear una onda sinusoidal
sin = Math.Sin(angle=sequence)
# note: Volver a asignar los valores de la onda sinusoidal a un nuevo valor máx. y mín.
remapRange = Math.RemapRange(numbers=sin, newMin=desplazamiento_mín, newMax=desplazamiento_máx)

# group: Desplazar puntos medios
# note: Para el desplazamiento Y, desactive el valor que se desplazará hacia el exterior del muro cortina.
valor_negativo = CodeBlock(y=remapRange) { -y; }
# note: Desplazar los puntos medios de la aleta
translate = Geometry.Translate(geometry=getItemAtIndex_3, yTranslation=valor_negativo, zTranslation=remapRange)

# note: Para el desplazamiento Y, desactive el valor que se desplazará hacia el exterior del muro cortina.
valor_negativo_2 = CodeBlock(y=remapRange) { y; }
# note: Desplazar los puntos medios de la aleta
translate_2 = Geometry.Translate(geometry=getItemAtIndex_3, yTranslation=valor_negativo_2, zTranslation=remapRange)

# group: Volver a unir puntos en listas
list_create = List.Create(item0=getItemAtIndex, item1=translate, item2=getItemAtIndex_2, item3=translate_2)
# note: Voltear la matriz y organizar las listas en conjuntos de tres
transpose = List.Transpose(lists=list_create)

# group: Para Revit: colocar componente
# note: Los componentes adaptativos se pueden colocar mediante conjuntos de puntos iguales al número de puntos de colocación de la familia.
byPoints = AdaptiveComponent.ByPoints(points=transpose, familyType=family_types)
