# Dynamo graph Revit Color.dyn "Color de Revit" (Dynamo 4.0.0.3076)
# author: Dynamo Team
# Este gráfico evalúa el área de superficie de los elementos seleccionados y aplica modificaciones de gráficos para colorear los elementos en función de ese valor.

# group: Información
# note: Ejecute el archivo de gráfico Snowdon Towers Sample Architectural.rvt de la carpeta Samples que se incluye con la instalación de Revit.
# C:\Archivos de programa\Autodesk\Revit 2027\Samples
# note: Este gráfico colorea los elementos de Revit según criterios medibles (Área de superficie).
# Los elementos se colorean mediante el método Modificar gráficos en vista > Por elemento.

# group: Seleccionar elementos de modelo
# Seleccione muros de fachada.
# note: Haga clic en "Cambiar" para elegir elementos del modelo de Revit
seleccionar_elementos_de_modelo = DSModelElementsSelection()  # 33 picked in the model; graph input

# group: Evaluar área de superficie de elemento
# note: Obtener geometría del elemento
getGeometry = Element.GetGeometry(element=seleccionar_elementos_de_modelo)
flatten = List.Flatten(list=getGeometry)
# note: Extraer área de superficie de Geometry
area = Solid.Area(solid=flatten)
# note: Obtener el valor máximo
maximumItem = List.MaximumItem(list=area)
# note: Normalizar en el valor máximo
div = area / maximumItem  # graph output

# group: Crear colores
# Prepare el esquema de color para codificar los elementos por colores.
number = DoubleInput(0)
number_2 = DoubleInput(255)
# note: color verde
byARGB = Color.ByARGB(alpha=number, red=number, green=number_2, blue=number, lacing=Longest)
number_3 = DoubleInput(0)
number_4 = DoubleInput(255)
# note: color rojo
byARGB_2 = Color.ByARGB(alpha=number_3, red=number_4, green=number_3, blue=number_3, lacing=Longest)
create = List.Create(item0=byARGB, item1=byARGB_2)
code_block = CodeBlock { [0,1]; }
# note: Definir rango de colores
color_range = ColorRange(colors=create, indices=code_block, value=div)

# group: Para Revit: reemplazar color del elemento en la vista
# note: Esto modifica el color del elemento en la vista activa.
overrideColorInView = Element.OverrideColorInView(element=seleccionar_elementos_de_modelo, color=color_range, lacing=Longest)

# group: Umbral
number_5 = DoubleInput(100)

# group: Alternativa: evaluar si el criterio supera el umbral especificado
# note: Comparar con un valor de umbral
gt = area > number_5
# note: Los números indicarán la posición en el espectro de color, de 0 a 1.
number_6 = DoubleInput(1)
number_7 = DoubleInput(0)
# note: Identificar áreas dentro de una tolerancia
if_ = RefactoredIf(test=gt, true=number_6, false=number_7)
# note: Este resultado se puede utilizar como entrada "indices" del nodo de rango de colores
watch = Watch(if_)
