# Dynamo graph Revit Floors and Framing.dyn "Suelos y armazones de Revit" (Dynamo 4.0.0.3076)
# author: Dynamo Team
# Esta definición crea un folly arquitectónico mediante una serie de líneas y su desplazamiento para colocar los elementos de suelo y armazón estructural en Revit.
# packages: Motor PythonNet3 1.4.5

# group: Información
# note: Ejecute el archivo de gráfico Snowdon Towers Sample Architectural.rvt de la carpeta Samples que se incluye con la instalación de Revit.
# C:\Archivos de programa\Autodesk\Revit 2027\Samples
# note: Este gráfico crea un folly arquitectónico mediante una serie de líneas y las utiliza para situar la colocación de suelos y armazones estructurales.

# group: Centro de la posición de folly
posición_x = DoubleSlider(30, range=25..40 step 1)  # graph input
posición_y = DoubleSlider(30, range=25..40 step 1)  # graph input
posición_z = DoubleSlider(62, range=60..80 step 1)  # graph input

# group: Configuración de folly
# Descripción <Haga doble clic aquí para editar la descripción del grupo>
radio_de_suelo_inferior = DoubleSlider(10, range=8..20 step 1)  # graph input
n_º_de_suelos = DoubleSlider(7, range=3..10 step 1)  # graph input
reducción_del_radio = DoubleSlider(-1.25, range=-2..-0.5 step 0.25)  # graph input
número_de_lados_del_polígono = IntegerSlider(5, range=3..10 step 1)  # graph input
altura_de_suelo_superior = DoubleSlider(38.4, range=15..50 step 0.1)  # graph input
rotación_máxima_grados = DoubleSlider(130, range=10..180 step 5)  # graph input

# group: Crear polígonos
# Cree una serie de polígonos de un radio decreciente, desfasados verticalmente y girados secuencialmente.
# note: Centro de folly
byCoordinates = Point.ByCoordinates(x=posición_x, y=posición_y, z=posición_z)
# note: Secuencia de radios circulares
sequence = Sequence(start=radio_de_suelo_inferior, amount=n_º_de_suelos, step=reducción_del_radio, lacing=Longest)
# note: Crear una serie de círculos
byCenterPointRadius = Circle.ByCenterPointRadius(centerPoint=byCoordinates, radius=sequence)
# note: Crear una serie de polígonos
regularPolygon = Polygon.RegularPolygon(circle=byCenterPointRadius, numberSides=número_de_lados_del_polígono)
# note: Una secuencia de elevaciones de suelo
secuencia_de_alturas_de_suelo = CodeBlock(top_floor=altura_de_suelo_superior, count=n_º_de_suelos) { 0..top_floor..#count; }
byCoordinates_2 = Vector.ByCoordinates(z=secuencia_de_alturas_de_suelo)
# note: Subir los polígonos según las alturas especificadas
translate = Geometry.Translate(geometry=regularPolygon, direction=byCoordinates_2)
ZAxis = Vector.ZAxis()
# note: Una secuencia de rotaciones para cada suelo
secuencia_de_ángulos_de_rotación = CodeBlock(max_degrees=rotación_máxima_grados, count=n_º_de_suelos) { 0..max_degrees..#count; }
# note: Rotar los polígonos con una serie de ángulos
rotate = Geometry.Rotate(geometry=translate, origin=byCoordinates, axis=ZAxis, degrees=secuencia_de_ángulos_de_rotación)
# note: Extraer curvas individuales de los polígonos
curves = PolyCurve.Curves(polyCurve=rotate)

# group: Tipo y nivel de suelo
# note: Seleccionar el tipo de los suelos creados entre los tipos existentes en el proyecto mediante el menú desplegable
floor_types = FloorTypes("Concrete Slab 6\"")  # graph input
levels = Levels("Green Roof Hardscape")  # graph input

# group: Para Revit: crear suelos
# Utilice la serie de bucles de curva cerrados como entrada para la creación de suelos.
# note: Pasar grupos de curvas para crear suelos
byOutlineTypeAndLevel = Floor.ByOutlineTypeAndLevel(outline=curves, floorType=floor_types, level=levels)

# group: Conexiones verticales
# Conecte esquinas de polígono entre niveles de folly.
# note: Obtener puntos finales de cada curva de polígono
endPoint = Curve.EndPoint(curve=curves)
# note: Voltear la matriz y obtener listas de puntos finales alineados verticalmente
transpose = List.Transpose(lists=endPoint)
# note: Conectar esquinas coincidentes de polígonos desde el nivel de folly inferior al superior uniéndolas como PolyCurves
byPoints = PolyCurve.ByPoints(points=transpose)
# note: Deconstruir PolyCurves y obtener listas de curvas que sirvan como entrada para elementos de armazón estructural
curves_2 = PolyCurve.Curves(polyCurve=byPoints)

# group: Tipo y nivel de armazón estructural
levels_2 = Levels("Green Roof Hardscape")  # graph input
# note: Seleccionar el tipo de armazón estructural entre los tipos cargados en el proyecto mediante el menú desplegable
structural_framing_types = StructuralFramingTypes("W12X26")  # graph input

# group: Para Revit: crear armazón estructural
# Utilice curvas para crear elementos de armazón estructural y utilice un nodo de Python para impedir la unión entre vigas individuales.
# note: Pasar curvas individuales para cada elemento estructural
beamByCurve = StructuralFraming.BeamByCurve(curve=curves_2, level=levels_2, structuralFramingType=structural_framing_types)
# note: Preparar la lista
flatten = List.Flatten(list=beamByCurve)
# note: Se trata de un nodo de Python renombrado que hace referencia a la API de Revit para ampliar la funcionalidad de Dynamo más allá de los nodos predefinidos. Para leer el código de Python, haga clic con el botón derecho en el nodo y haga clic en Editar.
no_permitir_uniones_en_armazón = Python(structuralFraming=flatten)  # "No permitir uniones en armazón estructural"; PythonNet3
# ---------- no_permitir_uniones_en_armazón.python (35 lines) ----------
# Load the Python Standard and DesignScript Libraries
import sys
import clr
clr.AddReference('ProtoGeometry')
from Autodesk.DesignScript.Geometry import *
from Autodesk.Revit.DB import *
from RevitServices.Transactions import TransactionManager
from RevitServices.Persistence import DocumentManager 

doc = DocumentManager.Instance.CurrentDBDocument

# The inputs to this node will be stored as a list in the IN variables.
dataEnteringNode = IN

# Place your code below this line
structural_framing = UnwrapElement(IN[0])

unjoined_elements = []
# start a Transaction
TransactionManager.Instance.EnsureInTransaction(doc)
# iterate through each structural framing element
for sf in structural_framing:
    # check if the element passed in of Structural Framing Category
    sf_category = sf.Category # get the element's Category
    # use the Structural Framing's Category Id to check
    if sf_category.Id.Value == -2001320:
        # disallow joins at start and end of the structural framing element
        Structure.StructuralFramingUtils.DisallowJoinAtEnd(sf, 0)
        Structure.StructuralFramingUtils.DisallowJoinAtEnd(sf, 1)
        unjoined_elements.append(sf)
TransactionManager.Instance.TransactionTaskDone()

    
# Output the list of elements with Disallowed Join
OUT = unjoined_elements
# ----------------------------------------
