# Dynamo graph Revit Geometry Creation Curves.dyn "Curvas de creación de geometría de Revit" (Dynamo 4.0.0.3076)
# author: Dynamo Team
# En este gráfico, se muestran varios métodos para crear curvas en Dynamo y utilizarlas para crear elementos de Revit (líneas de modelo).

# group: Información
# note: Este gráfico emplea varios métodos para crear curvas que se utilizarán como entrada para crear curvas de modelo de Revit
# note: Ejecute el archivo de gráfico Snowdon Towers Sample Architectural.rvt de la carpeta Samples que se incluye con la instalación de Revit:
# C:\Archivos de programa\Autodesk\Revit 2027\Samples

# group: Cuatro puntos
# Descripción <Haga doble clic aquí para editar la descripción del grupo>
number = DoubleInput(-35)
number_2 = DoubleInput(-55)
byCoordinates = Point.ByCoordinates(x=number, y=number_2)
number_3 = DoubleInput(-40)
byCoordinates_2 = Point.ByCoordinates(x=number, y=number_3)
number_4 = DoubleInput(-10)
byCoordinates_3 = Point.ByCoordinates(x=number_4, y=number_3)
number_5 = DoubleInput(-17)
number_6 = DoubleInput(-60)
byCoordinates_4 = Point.ByCoordinates(x=number_5, y=number_6)

list_create = List.Create(item0=byCoordinates, item1=byCoordinates_2, item2=byCoordinates_3, item3=byCoordinates_4)

# group: Crear una curva de modelo a partir de una curva NURBS (por puntos)
# note: Crear una curva NURBS a partir de una lista de puntos
byPoints = NurbsCurve.ByPoints(points=list_create)
# note: Usar la curva NURBS para crear una línea de modelo de Revit
byCurve = ModelCurve.ByCurve(curve=byPoints)

# group: Crear curva de modelo a partir de una curva NURBS (mediante puntos de control)
boolean = BoolSelector(false)
# note: Crear una curva NURBS a partir de una lista de puntos como puntos de control
byControlPoints = NurbsCurve.ByControlPoints(points=list_create, closeCurve=boolean)
# note: Usar la curva NURBS para crear una línea de modelo de Revit
byCurve_2 = ModelCurve.ByCurve(curve=byControlPoints)

# group: Crear una curva de modelo a partir de una PolyCurve
# note: Crear una PolyCurve a partir de una lista de puntos
byPoints_2 = PolyCurve.ByPoints(points=list_create)
curves = PolyCurve.Curves(polyCurve=byPoints_2)
# note: Utilizar la lista de curvas para crear un conjunto de líneas de modelo de Revit
byCurve_3 = ModelCurve.ByCurve(curve=curves)

# group: Crear una curva de modelo a partir de una línea
# note: Crear una curva a partir de dos puntos
byStartPointEndPoint = Line.ByStartPointEndPoint(startPoint=byCoordinates, endPoint=byCoordinates_2)
# note: Utilizar la línea (curva) para crear una curva de modelo de Revit
byCurve_4 = ModelCurve.ByCurve(curve=byStartPointEndPoint)
