# Dynamo graph Revit Geometry Creation Points.dyn "Puntos de creación de geometría de Revit" (Dynamo 4.0.0.3076)
# author: Dynamo Team
# Este gráfico crea una línea de modelo y un punto de referencia en el entorno de familia de masas conceptuales.

# group: Información
# note: Puede alternar entre la navegación en segundo plano 3D y la navegación por la vista de gráfico con los botones de la esquina superior derecha de la pantalla (método abreviado de teclado Ctrl + B). La vista preliminar en segundo plano también se puede activar y desactivar en el menú Vista de Dynamo y Revit.
# note: Ejecute este gráfico en un entorno de familia adaptativo de modelos genéricos o masas conceptuales.
# Para crear una familia nueva, vaya a Archivo > Nueva familia > y seleccione la plantilla ubicada en la carpeta:
# C:\ProgramData\Autodesk\RVT 2027\Family Templates\English-Imperial\Generic Model Adaptive.rft
# note: Este gráfico crea una línea de modelo y un punto de referencia en un entorno de familia

# group: Coordenadas del punto
valor_x_del_punto = DoubleSlider(50, range=5..50 step 5)  # graph input
valor_y_del_punto = DoubleSlider(25, range=5..50 step 5)  # graph input
valor_z_del_punto = DoubleSlider(25, range=5..50 step 5)  # graph input

# note: Manipule la posición del punto en el entorno de Dynamo: seleccione el nodo Point.ByCoordinates y cambie a la vista preliminar en segundo plano para tirar del punto a lo largo de sus tres ejes.
byCoordinates = Point.ByCoordinates(x=valor_x_del_punto, y=valor_y_del_punto, z=valor_z_del_punto)
# note: Los datos geométricos se pueden visualizar como información textual o en un espacio 3D.
watch = Watch(byCoordinates)
byCoordinates_2 = Point.ByCoordinates()
byStartPointEndPoint = Line.ByStartPointEndPoint(startPoint=byCoordinates_2, endPoint=byCoordinates)
# note: Vista preliminar de la geometría
watch_3d = Watch3D(byStartPointEndPoint)
# note: Crear una curva de modelo mediante la conexión de dos puntos
byCurve = ModelCurve.ByCurve(curve=byStartPointEndPoint)
# note: Dynamo solo puede crear y modificar elementos adecuados para el archivo al que está asociado. Por ejemplo, los puntos de referencia solo se pueden crear en determinados entornos de familia (como el modelo genérico adaptativo), mientras que las líneas de modelo se pueden crear prácticamente en cualquier lugar.
byPoint = ReferencePoint.ByPoint(pt=byCoordinates)
