# Dynamo graph Revit Geometry Creation Solids.dyn "Sólidos de creación de geometría de Revit" (Dynamo 4.0.0.3076)
# author: Dynamo Team
# Este gráfico presenta varios métodos de creación de geometría sólida en Dynamo e integrarla en Revit; algunos métodos pueden utilizarse en un entorno de proyecto, otros solo en determinados entornos de familia (masa conceptual).

# group: Información
# note: La mayoría de los sólidos se pueden crear de varias maneras. Estos ejemplos muestran perfiles cerrados como base, pero se les pueden unir PolySurfaces y hay disponibles muchas primitivas (superficies, ortoedro, cono, etc.).
#  Para integrar la geometría en el entorno de Revit, primero debe convertirse en un elemento de Revit.
# Los sólidos se pueden transformar en un ejemplar de importación que estará visible en los entornos de familia de modelos y proyectos.
# La geometría sólida también se puede convertir en un elemento de forma para que solo esté disponible para los entornos de familia de masas conceptuales y componentes adaptativos.
# note: Este gráfico utiliza varios métodos para crear geometría sólida en Revit; algunos métodos se pueden utilizar en un entorno de proyecto, otros solo en determinados entornos de familia.
# Utilice una plantilla de familia de masas conceptuales para ver todos los métodos.
# Para abrir una familia de masas conceptuales, vaya a Archivo > Nuevo > Familia > y seleccione la plantilla Mass.rft, \Conceptual Mass\Mass.rft.

# group: Preparar puntos
# Genere un conjunto de puntos para crear geometría.
byCoordinates = Point.ByCoordinates()
number = DoubleInput(10)
byCoordinates_2 = Point.ByCoordinates(x=number)
number_2 = DoubleInput(5)
byCoordinates_3 = Point.ByCoordinates(z=number_2)
number_3 = DoubleInput(10)
byCoordinates_4 = Point.ByCoordinates(y=number_3)
number_4 = DoubleInput(15)
byCoordinates_5 = Point.ByCoordinates(x=number_4, y=number_4)
number_5 = DoubleInput(5)
number_6 = DoubleInput(10)
byCoordinates_6 = Point.ByCoordinates(x=number_5, y=number_6, z=number_6)
number_7 = DoubleInput(-2)
number_8 = DoubleInput(5)
byCoordinates_7 = Point.ByCoordinates(x=number_7, y=number_8)

# group: Primer perfil
# Cree el primer perfil como una curva cerrada a partir de un arco y una línea.
byStartPointEndPoint = Line.ByStartPointEndPoint(startPoint=byCoordinates, endPoint=byCoordinates_2)
byThreePoints = Arc.ByThreePoints(firstPoint=byCoordinates, secondPoint=byCoordinates_3, thirdPoint=byCoordinates_2)
create = List.Create(item0=byStartPointEndPoint, item1=byThreePoints)
# note: Primer perfil de la solevación
byJoinedCurves = PolyCurve.ByJoinedCurves(curves=create)

# group: Segundo perfil
# Cree el segundo perfil como una curva cerrada a partir de un arco y una línea.
byStartPointEndPoint_2 = Line.ByStartPointEndPoint(startPoint=byCoordinates_4, endPoint=byCoordinates_5)
byThreePoints_2 = Arc.ByThreePoints(firstPoint=byCoordinates_4, secondPoint=byCoordinates_6, thirdPoint=byCoordinates_5)
create_2 = List.Create(item0=byStartPointEndPoint_2, item1=byThreePoints_2)
# note: Segundo perfil para la solevación
byJoinedCurves_2 = PolyCurve.ByJoinedCurves(curves=create_2)

# note: Unir dos perfiles en una lista
create_3 = List.Create(item0=byJoinedCurves, item1=byJoinedCurves_2)

# group: Solevación de sólidos por secciones transversales
# Descripción <Haga doble clic aquí para editar la descripción del grupo>
byLoft = Solid.ByLoft(crossSections=create_3)

# note: Investigar el volumen del sólido
volume = Solid.Volume(solid=byLoft)

# group: Crear vaciado
code_block = CodeBlock { 0; }
# note: Sugerencia: desactive "Vista preliminar" en el menú contextual del nodo para excluir elementos de la visualización.
thinShell = Solid.ThinShell(solid=byLoft, internalFaceThickness=code_block)

# group: Trasladar geometría
code_block_2 = CodeBlock { Vector.ByCoordinates(20,0,0); }
# note: Trasladar la geometría al lado para obtener una vista preliminar tanto del resultado original como del final
translate = Geometry.Translate(geometry=thinShell, direction=code_block_2)

# group: Recortar sólido
# Utilice la operación de recorte para cortar el sólido de vaciado con un plano.
code_block_3 = CodeBlock { Point.ByCoordinates(0,0,5); }
ZAxis = Vector.ZAxis()
byOriginNormal = Plane.ByOriginNormal(origin=code_block_3, normal=ZAxis)
number_9 = DoubleInput(10)
# note: Seleccione el lado del recorte que se va a conservar (se descartará el lado más cercano al punto).
byCoordinates_8 = Point.ByCoordinates(x=number_9, y=number_9, z=number_9)
# note: Las operaciones booleanas geométricas (intersección, diferencia, unión, etc.) están disponibles en la categoría Geometry.
trim = Geometry.Trim(geometry=translate, other=byOriginNormal, pick=byCoordinates_8)

# group: Curva guía
# Cree una curva NURBS para utilizarla como curva guía para la forma de sólido de solevación.
create_4 = List.Create(item0=byCoordinates, item1=byCoordinates_7, item2=byCoordinates_4)
# note: Curva guía creada como una curva NURBS
byPoints = NurbsCurve.ByPoints(points=create_4)

# group: Solevación de sólidos por secciones transversales y curvas guía
# note: Sugerencia: desactive "Vista preliminar" en el menú contextual del nodo para excluir elementos de la visualización.
byLoft_2 = Solid.ByLoft(crossSections=create_3, guideCurves=byPoints)

# group: Crear ejemplar de importación
code_block_4 = CodeBlock { Vector.ByCoordinates(-20,0,0); }
translate_2 = Geometry.Translate(geometry=byLoft_2, direction=code_block_4)
# note: Geometry no es la misma que la de un elemento de Revit:
# utilice ImportInstance para crear importaciones de Revit a partir de superficies y sólidos en cualquier entorno de Revit; utilice puntos y curvas para colocar ejemplares de familias, o cree formas en familias de masas y familias de modelos genéricos por punto (componente adaptativo).
byGeometries = ImportInstance.ByGeometries(geometries=translate_2)
byCoordinates_9 = Vector.ByCoordinates()

# group: Crear forma
# Mediante dos contornos de curva de perfil, cree un elemento de forma (en el entorno de familia de masas conceptuales).
curves = PolyCurve.Curves(polyCurve=create_3)
# note: Crear curvas de modelo a partir de curvas
referenceCurveByCurve = ModelCurve.ReferenceCurveByCurve(curve=curves)
# note: Las formas solo se pueden crear como parte de una familia de masas conceptuales
byLoftCrossSections = Form.ByLoftCrossSections(curves=referenceCurveByCurve)
