# Dynamo graph Revit Geometry Creation Surfaces.dyn "Superficies de creación de geometría de Revit" (Dynamo 4.0.0.3076)
# author: Dynamo Team
# Este gráfico presenta varios métodos de creación de superficies en Dynamo y dos métodos de conversión de geometría en geometría de Revit.

# group: Información
# note: Este gráfico utiliza varios métodos para crear geometría de superficie en Revit (algunos métodos se pueden utilizar en un entorno de proyecto, otros solo en determinados entornos de familia).
#  Utilice una plantilla de familia de masas conceptuales para ver todos los métodos.
# Cree una familia de masas conceptuales en Archivo > Nuevo > Familia y seleccione la plantilla Mass.rft en la carpeta "Conceptual Mass".
# note: Existen varios métodos de creación para la mayoría de las superficies. Las superficies, las PolySurfaces (colecciones de superficies) y las superficies NURBS se pueden crear mediante puntos y curvas, y se pueden derivar de otras superficies y sólidos mediante diversas operaciones.
# note: Para integrar la geometría en el entorno de Revit, debe convertirse primero en un elemento de Revit.
# Las superficies y los sólidos se pueden transformar en un ejemplar de importación que estará visible tanto en los entornos de familia de modelos y proyectos.
# La geometría de superficie también se puede convertir en un elemento de forma que solo esté disponible para los entornos de familia de componentes adaptativos y masas conceptuales.

# group: Preparar puntos
# Genere un conjunto de puntos para crear geometría.
number = DoubleInput(10)
byCoordinates = Point.ByCoordinates(y=number)
number_2 = DoubleInput(5)
number_3 = DoubleInput(10)
byCoordinates_2 = Point.ByCoordinates(x=number_2, y=number_3, z=number_3)
number_4 = DoubleInput(15)
byCoordinates_3 = Point.ByCoordinates(x=number_4, y=number_4)
byCoordinates_4 = Point.ByCoordinates()
number_5 = DoubleInput(5)
byCoordinates_5 = Point.ByCoordinates(z=number_5)
byCoordinates_6 = Point.ByCoordinates(x=number)
number_6 = DoubleInput(-5)
number_7 = DoubleInput(5)
byCoordinates_7 = Point.ByCoordinates(x=number_6, y=number_7)
number_8 = DoubleInput(10)
number_9 = DoubleInput(-10)
byCoordinates_8 = Point.ByCoordinates(x=number_8, y=number_9)
byCoordinates_9 = Point.ByCoordinates(y=number_9)

# group: Crear perfiles
byThreePoints = Arc.ByThreePoints(firstPoint=byCoordinates, secondPoint=byCoordinates_2, thirdPoint=byCoordinates_3)
byThreePoints_2 = Arc.ByThreePoints(firstPoint=byCoordinates_4, secondPoint=byCoordinates_5, thirdPoint=byCoordinates_6)
byThreePoints_3 = Arc.ByThreePoints(firstPoint=byCoordinates_4, secondPoint=byCoordinates_7, thirdPoint=byCoordinates)
byStartPointEndPoint = Line.ByStartPointEndPoint(startPoint=byCoordinates_8, endPoint=byCoordinates_9)

# group: Superficie por barrido
# Utilice un perfil, una curva de trayectoria y un carril guía para crear una superficie de barrido.
bySweep2Rails = Surface.BySweep2Rails(path=byThreePoints, guideRail=byThreePoints_2, profile=byThreePoints_3)

# group: Crear importación
# note: Utilice Ejemplar de importación para crear importaciones de Revit a partir de superficies y sólidos; estos estarán visibles en cualquier entorno de Revit.
byGeometries = ImportInstance.ByGeometries(geometries=bySweep2Rails)

create = List.Create(item0=byStartPointEndPoint, item1=byThreePoints_2)

# group: Crear superficie por solevación
# Una secciones transversales para crear una superficie de solevación.
byLoft = Surface.ByLoft(crossSections=create)

# group: Evaluar área de superficie
area = Surface.Area(surface=byLoft)
watch = Watch(area)
create_2 = List.Create(item0=byLoft, item1=bySweep2Rails)
# note: Las superficies unidas como PolySurfaces se pueden evaluar como una sola entidad.
byJoinedSurfaces = PolySurface.ByJoinedSurfaces(surfaces=create_2)
area_2 = Surface.Area(surface=byJoinedSurfaces)
watch_2 = Watch(area_2)
area_3 = Surface.Area(surface=bySweep2Rails)
watch_3 = Watch(area_3)

# group: Superficie NURBS desde puntos de control
# Convierta un barrido en una superficie NURBS a partir de puntos de control.
code_block = CodeBlock { 0..1..0.1; }
# note: Se pueden derivar bordes, puntos y otros elementos de superficies mediante las "Acciones" adecuadas para esas geometrías.
pointAtParameter = Surface.PointAtParameter(surface=bySweep2Rails, u=code_block, v=code_block, lacing=CrossProduct)
# note: Reconstruir la superficie como superficie NURBS a partir de puntos de control
byControlPoints = NurbsSurface.ByControlPoints(controlVertices=pointAtParameter)
# note: Utilizar el nodo Watch 3D para obtener una vista preliminar de la geometría de forma aislada
watch_3d = Watch3D(byControlPoints)

# group: Superficie por curva de extrusión
# Utilice una curva para crear una extrusión con la distancia especificada.
code_block_2 = CodeBlock { 10; }
extrude = Curve.Extrude(curve=byThreePoints, distance=code_block_2)

# group: Crear forma
# Cree una forma de solevación a partir de dos curvas.
referenceCurveByCurve = ModelCurve.ReferenceCurveByCurve(curve=create)
byLoftCrossSections = Form.ByLoftCrossSections(curves=referenceCurveByCurve)
