# Dynamo graph Revit Import Solid.dyn "Importar sólido de Revit" (Dynamo 4.0.0.3076)
# author: Dynamo Team
# En este gráfico, se muestra un método para crear geometría de sólidos de Dynamo y utilizarla para crear un elemento de ejemplar de importación de Revit. Cree una nueva forma de cubierta. Para ello, cree una serie de perfiles de arco y utilícelos para crear una superficie de solevación.

# group: Información
# note: El elemento de origen (cubierta) se ha preseleccionado en Revit con los ID de elemento guardados con el archivo de Dynamo
# note: Ejecute el archivo de gráfico Snowdon Towers Sample Architectural.rvt de la carpeta Samples que se incluye con la instalación de Revit.
# C:\Archivos de programa\Autodesk\Revit 2027\Samples
# note: Cree una nueva forma de cubierta a partir de un elemento de cubierta seleccionado. Para ello, cree una serie de perfiles de arco y utilícelos para crear una superficie de solevación. La geometría se convierte en un ejemplar de importación para integrarla en el entorno de Revit.

# group: Configuración de la nueva cubierta
# note: El número de perfiles a partir de los que se creará la superficie de solevación
número_de_perfiles = IntegerSlider(6, range=3..10 step 1)
# note: La altura en los extremos cortos de la nueva cubierta
sección_de_cubierta_mín = DoubleSlider(2.1, range=1..5 step 0.1)
# note: La altura en el centro de la cubierta
sección_de_cubierta_máx = DoubleSlider(7, range=5..10 step 0.1)
# note: Extender los perfiles de arco lateralmente según este valor
extensión_de_lados_de_cubierta = DoubleSlider(0.5, range=0.1..3 step 0.1)
# note: Grosor de la nueva forma de cubierta
grosor_de_cubierta = DoubleSlider(0.5, range=0.1..2 step 0.1)

n_º_de_perfiles = CodeBlock(steps=número_de_perfiles) { steps; }

# group: Seleccionar cubierta
# Seleccionar elemento de cubierta de origen
# note: Todas las entradas marcadas como "IsInput" se pueden establecer en el Reproductor de Dynamo
seleccionar_cubierta_plana = DSModelElementSelection()  # 1 picked in the model

# group: Obtener cara de cubierta
# Descomponga la geometría del elemento de origen y seleccione una cara con el área más grande.
# note: Para obtener la cara del elemento seleccionado, debe obtener primero su geometría.
# note: Haga clic con el botón derecho y desactive "Vista preliminar de geometría" para obtener una vista más clara del resultado final.
getGeometry = Element.GetGeometry(element=seleccionar_cubierta_plana)
# note: Descomponer la geometría para obtener caras individuales
explode = Geometry.Explode(geometry=getGeometry)
# note: Deseche la estructura de lista. Tenga en cuenta que este paso no será necesario si se utilizan varios objetos de origen.
flatten = List.Flatten(list=explode)
area = Surface.Area(surface=flatten)
# note: Ordene la lista de superficies por su área. La superficie con las áreas más grandes será el último elemento de la lista de salida "sortedList".
sortByKey = List.SortByKey(list=flatten, keys=area)
lastItem = List.LastItem(list=sortByKey.sortedList)
number = DoubleInput(1.5)
# note: Trasladar la superficie hacia arriba
translate = Geometry.Translate(geometry=lastItem, zTranslation=number)

# group: Desfase hacia fuera (escala)
# Ajuste la escala de la superficie para extender sus bordes hacia fuera.
posición_uv = CodeBlock { 0.5; }
pointAtParameter = Surface.PointAtParameter(surface=translate, u=posición_uv, v=posición_uv)
escala_de_punto_a_punto = CodeBlock { point1 = Point.ByCoordinates(1, 1); point2 = Point.ByCoordinates(-40, -40); }
scale = Geometry.Scale(geometry=translate, basePoint=pointAtParameter, from=escala_de_punto_a_punto.point1, to=escala_de_punto_a_punto.point2)

# group: Puntos en la superficie
# Genere tres listas de puntos espaciados uniformemente, dos filas a lo largo de los bordes más largos y una fila en el medio.
# note: 0 y 1 son posiciones a lo largo de bordes más largos de la superficie.
posiciones_u_para_las_filas_de = CodeBlock { [0,1]; }  # "Posiciones U para las filas de borde"
# note: Posiciones V a lo largo de los bordes más largos en una secuencia de 0 a 1 y N pasos
posiciones_v_para_las_filas_de = CodeBlock(steps=n_º_de_perfiles) { [0..1..#steps]; }  # "Posiciones V para las filas de borde"
# note: Utilice el parámetro de encaje más largo. Para ello, haga clic con el botón derecho en el nodo > Encaje.
# El encaje más largo coincidirá con las entradas de las distintas estructuras de lista. En este caso, el resultado será dos listas de puntos, donde el número de puntos de cada lista coincide con la lista de entrada más larga.
pointAtParameter_2 = Surface.PointAtParameter(surface=scale, u=posiciones_u_para_las_filas_de, v=posiciones_v_para_las_filas_de, lacing=Longest)
# note: El valor de U de 0,5 colocará los puntos a lo largo del centro de la superficie
posición_u_para_la_fila_central = CodeBlock { [0.5]; }
# note: Posiciones V a lo largo de la fila central de puntos en una secuencia de 0 a 1 y N pasos
posiciones_v_para_la_fila = CodeBlock(steps=n_º_de_perfiles) { [0..1..#steps]; }  # "Posiciones V para la fila central"
# note: Se utiliza el encaje más largo para este nodo. El resultado es una lista de puntos, donde el número de puntos de la lista coincide con la lista de entrada más larga.
pointAtParameter_3 = Surface.PointAtParameter(surface=scale, u=posición_u_para_la_fila_central, v=posiciones_v_para_la_fila, lacing=Longest)

# group: Desfasar puntos hacia arriba
# Desfase los puntos de la fila central en forma de onda de coseno.
# note: Una secuencia de valores para generar una serie de desfases
secuencia_de_ángulos = CodeBlock(steps=n_º_de_perfiles) { -1..1..#steps; }
# note: Alternativa: usar el seno para una forma de cubierta diferente
sin = Math.Sin(angle=secuencia_de_ángulos)
# note: Valores de una onda de coseno
cos = Math.Cos(angle=secuencia_de_ángulos)
# note: Volver a asignar los valores a un nuevo dominio
remapRange = Math.RemapRange(numbers=cos, newMin=sección_de_cubierta_mín, newMax=sección_de_cubierta_máx)
# note: Trasladar los puntos de la fila central
translate_2 = Geometry.Translate(geometry=pointAtParameter_3@L2, zTranslation=remapRange)

# group: Crear perfiles a partir de arcos
# Utilice los puntos para crear arcos.
# note: Unir el borde y las filas centrales en una lista
join = List.Join(list0=pointAtParameter_2, list1=translate_2)
índice_de_elemento = CodeBlock { 0; 1; 2; }
getItemAtIndex = List.GetItemAtIndex(list=join, index=índice_de_elemento.out0)
getItemAtIndex_2 = List.GetItemAtIndex(list=join, index=índice_de_elemento.out2)
getItemAtIndex_3 = List.GetItemAtIndex(list=join, index=índice_de_elemento.out1)
byThreePoints = Arc.ByThreePoints(firstPoint=getItemAtIndex, secondPoint=getItemAtIndex_2, thirdPoint=getItemAtIndex_3)

# group: Extender perfiles
# Extienda las curvas de cada perfil según la distancia especificada.
# note: El valor de la extensión se establece como entrada en el lado izquierdo del gráfico.
extender_bordes = CodeBlock(roof_extension=extensión_de_lados_de_cubierta) { roof_extension; }
extendStart = Curve.ExtendStart(curve=byThreePoints, distance=extender_bordes)
extendEnd = Curve.ExtendEnd(curve=extendStart, distance=extender_bordes)

# group: Solevar y engrosar
# Cree una superficie de solevación y asígnele un espesor.
byLoft = Surface.ByLoft(crossSections=extendEnd)
thicken = Surface.Thicken(surface=byLoft, thickness=grosor_de_cubierta)

# group: Para Revit:
# Convierta la geometría de Dynamo en un elemento de Revit mediante los parámetros ImportInstance y Establecer nivel.
# note: Para integrar la geometría en el entorno de Revit, esta debe convertirse primero en un elemento de Revit.
# Los sólidos se pueden transformar en un ejemplar de importación que estará visible tanto en los entornos de familia de modelos y proyectos.
byGeometry = ImportInstance.ByGeometry(geometry=thicken)
code_block = CodeBlock { "Plano de trabajo"; }
levels = Levels("L1 - Block 43")
# note: Corrija la altura del ejemplar de importación colocado mediante la configuración del parámetro Plano de trabajo en el nivel cuya elevación coincida con la posición del origen interno.
setParameterByName = Element.SetParameterByName(element=byGeometry, parameterName=code_block, value=levels)
