# Dynamo graph Revit Place Families By Level Set Parameters.dyn "Parámetros de Colocar familia por nivel definido" (Dynamo 4.0.0.3076)
# author: Dynamo Team
# En este gráfico, se muestra cómo colocar elementos de Revit por punto. Coloque filas de sillas en una habitación seleccionada y escriba números únicos en su parámetro Marca.

# group: Información
# note: Ejecute el archivo de gráfico Snowdon Towers Sample Architectural.rvt de la carpeta Samples que se incluye con la instalación de Revit:
# C:\Archivos de programa\Autodesk\Revit 2027\Samples
# note: Colocar filas de sillas en una habitación seleccionada y escribir números únicos en su parámetro Marca

# group: Seleccionar elementos de Revit
# note: Seleccionar el tipo de familia para los ejemplares que se van a colocar desde los tipos de familia del proyecto
family_types = FamilyTypes("Chair-Breuer:Chair-Breuer")  # graph input
# note: Seleccione una habitación en la que colocar los elementos. Deberá desplazarse a una vista en la que las habitaciones estén visibles (plano de planta).
seleccionar_habitación = DSModelElementSelection()  # 1 picked in the model; graph input
radio_de_círculo = DoubleSlider(6.4, range=5..8 step 0.1)  # graph input
# note: Seleccionar el nivel en el que se colocarán elementos
levels = Levels("L3")  # graph input

# group: Establecer desfases de fila
# Los valores de desfases de filas no son de distancia, sino los valores de U y V.
inicio_de_la_fila = DoubleSlider(0.3, range=0..3 step 0.1)  # graph input
fin_de_la_fila = DoubleSlider(2.2, range=0..3 step 0.1)  # graph input
n_º_de_sillas_en_una_fila = IntegerSlider(8, range=2..12 step 1)  # graph input
posición_de_la_primera_fila = DoubleSlider(0.2, range=0..3 step 0.1)  # graph input
posición_de_la_última_fila = DoubleSlider(1.4, range=0..3 step 0.1)  # graph input
espacio_entre_filas = DoubleSlider(0.35, range=0.15..1 step 0.05)  # graph input

# group: Generar desfases de filas
# Serie de números correspondientes a las posiciones U y V de la superficie. Los valores pueden superar el dominio de 0 a 1.
# note: Una alternativa a la creación de una secuencia mediante la definición del inicio, el fin y el número de pasos de la secuencia
secuencia_de_desfase_de_filas = CodeBlock(start=inicio_de_la_fila, finish=fin_de_la_fila, steps=n_º_de_sillas_en_una_fila) { start..finish..#steps; }
# note: Generar una serie de números dentro de un rango con el paso especificado
range = Range(start=posición_de_la_primera_fila, end=posición_de_la_última_fila, step=espacio_entre_filas)

# group: Preparar puntos de ubicación
# Descripción <Haga doble clic aquí para editar la descripción del grupo>
# note: El punto de colocación de la habitación seleccionada
location = Room.Location(room=seleccionar_habitación)
# note: Círculo que define un área inicial de colocación. La forma del círculo es irrelevante en este caso, pero es el método más rápido para definir una superficie cerrada.
byCenterPointRadius = Circle.ByCenterPointRadius(centerPoint=location, radius=radio_de_círculo)
# note: Convertir el círculo en una superficie a fin de utilizarlo para colocar puntos
patch = Curve.Patch(curve=byCenterPointRadius)
# note: Mediante secuencias de valores U y V, cree una matriz de puntos. Establezca el encaje del nodo en Producto vectorial. Para ello, haga clic con el botón derecho y seleccione Encaje.
pointAtParameter = Surface.PointAtParameter(surface=patch, u=secuencia_de_desfase_de_filas, v=range, lacing=CrossProduct)

# group: Para Revit: colocar ejemplares de familia
# note: Colocar ejemplares de familia
# La mayoría de las familias también se pueden colocar mediante la ubicación de puntos. Los componentes adaptativos se pueden colocar con varios puntos; el armazón estructural se coloca con curvas.
byPointAndLevel = FamilyInstance.ByPointAndLevel(familyType=family_types, point=pointAtParameter, level=levels)

# note: Desechar estructura de lista: obtener una lista que contenga todos los elementos
flatten = List.Flatten(list=byPointAndLevel)

# group: Prefijo de marca
# Usar un prefijo personalizado para el número de marca de los elementos colocados
prefijo_de_marca = StringInput("C-")  # graph input

# group: Generar números de marca
number = DoubleInput(1)
# note: Contar el número de elementos de la lista
count = List.Count(list=flatten)
# note: Generar los números de 1 a n
sequence = Sequence(start=number, amount=count, step=number, lacing=Longest)
# note: Para participar en operaciones de cadena, el número debe convertirse primero en una cadena.
string_from_object = FromObject(obj=sequence)
índice = CodeBlock { 0; }
# note: Insertar un prefijo personalizado en el número de elemento
insert = String.Insert(string=string_from_object, index=índice, toInsert=prefijo_de_marca)

# group: Para Revit: establecer valores de parámetro
string = StringInput("Marca")
# note: Establezca el parámetro Marca con una lista de valores. La estructura de lista de entradas de valores y elementos debe coincidir o solo se puede utilizar un valor. Los parámetros también se pueden leer mediante un nodo Element.GetParameterByName.
setParameterByName = Element.SetParameterByName(element=flatten, parameterName=string, value=insert)

# group: Comprobar resultados
# note: El nodo Watch se puede utilizar para comprobar si los resultados son los esperados.
watch = Watch(insert)  # graph output
