# Dynamo graph Revit Structural Framing.dyn "Armazón estructural de Revit" (Dynamo 4.0.0.3076)
# author: Dynamo Team
# Este gráfico crea una estructura a partir del armazón estructural y los pilares en relación con un suelo de Revit seleccionado.

# group: Información
# note: Coloque pilares y vigas de armazón estructural en relación con un elemento seleccionado en un modelo de Revit.
# note: Ejecute el archivo de gráfico Snowdon Towers Sample Architectural.rvt de la carpeta Samples que se incluye con la instalación de Revit:
# C:\Archivos de programa\Autodesk\Revit 2027\Samples

# group: Entradas
# note: Seleccionar un elemento de suelo de Revit con respecto al cual se creará la nueva estructura de pérgola
seleccionar_suelo_de_origen = DSModelElementSelection()  # 1 picked in the model; graph input
# note: Altura de estructura
altura = DoubleSlider(8.4, range=0..10 step 0.1)  # graph input
número_de_vigas = IntegerSlider(9, range=2..10 step 1)  # graph input
# note: Seleccionar el nivel en el que se colocará la estructura
nivel_de_estructura = Levels("L1 - Block 43")  # graph input
# note: Seleccione un tipo de armazón para las vigas de perímetro. Este tipo también se utilizará para crear un nuevo tipo de armazón estructural.
structural_framing_types = StructuralFramingTypes("W12X26")  # graph input
# note: Seleccionar un tipo de familia de los pilares creados
tipos_de_pilar_estructural = StructuralColumnTypes(index=0)  # graph input

# group: Preparar geometría
# Prepare una expresión de sólido limpia de la geometría del elemento seleccionado.
# note: Obtener la geometría del elemento de Revit
getGeometry = Element.GetGeometry(element=seleccionar_suelo_de_origen)
# note: Para descartar rápidamente los huecos de elementos, obtenga su cuadro delimitador, un ortoedro virtual que contiene el elemento.
byMinimumVolume = BoundingBox.ByMinimumVolume(geom=getGeometry)
# note: Hay más acciones disponibles para los sólidos que para los cuadros delimitadores. Para permitir más transformaciones, convierta primero el cuadro delimitador en un ortoedro (que es un tipo de sólido).
toCuboid = BoundingBox.ToCuboid(boundingBox=byMinimumVolume)
# note: Trasladar el ortoedro sólido por una altura (zTranslation) definida por el control deslizante de número en la sección Entradas del gráfico
translate = Geometry.Translate(geometry=toCuboid, zTranslation=altura)

# group: Obtener la superficie superior del sólido
# Evalúe todas las superficies del sólido según la elevación en su centro y obtenga la superior.
# note: Descomponer el sólido en superficies
explode = Geometry.Explode(geometry=translate)
code_block = CodeBlock { 0.5; }
# note: Localizar un punto en el centro de la superficie
pointAtParameter = Surface.PointAtParameter(surface=explode, u=code_block, v=code_block)
# note: Obtener un valor numérico para la elevación de cada punto central
Z = Point.Z(point=pointAtParameter)
# note: Ordenar una lista por otra: utilice los valores de elevación para ordenar las superficies
sortByKey = List.SortByKey(list=explode, keys=Z)
# note: La última superficie de la lista es la superficie superior
lastItem = List.LastItem(list=sortByKey.sortedList)

# group: Desfasar una serie de puntos en la superficie
# note: Utilice una fórmula sencilla para crear una secuencia de valores de mín. (0,1) a máx. (0,9) con un número "n" de pasos.
secuencia_de_valores_u = CodeBlock(n=número_de_vigas) { 0.1..0.9..#n; }
desfases_de_borde = CodeBlock { [0.1,0.9]; }
# note: Coloque una matriz de puntos en la superficie mediante los parámetros U y V. Utilice el encaje Producto cartesiano (haga clic con el botón derecho en el nodo y seleccione Encaje) para generar una matriz.
pointAtParameter_2 = Surface.PointAtParameter(surface=lastItem, u=secuencia_de_valores_u, v=desfases_de_borde, lacing=CrossProduct)

# group: Crear líneas para vigas interiores
# Conecte puntos y cree líneas.
índices = CodeBlock { 0; 1; }
# note: Haga clic en el símbolo > situado junto a la entrada "list" para usar niveles. Esto significa que el resultado será el elemento con el índice 0 de cada lista anidada inferior (@L2).
getItemAtIndex = List.GetItemAtIndex(list=pointAtParameter_2@L2, index=índices.out0)
getItemAtIndex_2 = List.GetItemAtIndex(list=pointAtParameter_2@L2, index=índices.out1)
byStartPointEndPoint = Line.ByStartPointEndPoint(startPoint=getItemAtIndex, endPoint=getItemAtIndex_2)

# group: Curvas para vigas de perímetro
# Descripción <Haga doble clic aquí para editar la descripción del grupo>
firstItem = List.FirstItem(list=pointAtParameter_2)
lastItem_2 = List.LastItem(list=pointAtParameter_2)
byStartPointEndPoint_2 = Line.ByStartPointEndPoint(startPoint=firstItem, endPoint=lastItem_2)

# group: Curvas para pilares
# Utilice cada segunda fila de puntos para crear líneas para la colocación de pilares.
code_block_2 = CodeBlock { 2; }
# note: Dividir la lista en listas de dos
chop = List.Chop(list=pointAtParameter_2, lengths=code_block_2)
# note: Usar la lógica de niveles de lista y utilizar solo la primera lista en @L3
firstItem_2 = List.FirstItem(list=chop@L3)
altura_inversa = CodeBlock(H=altura) { -H; }
# note: Trasladar los puntos hacia abajo
translate_2 = Geometry.Translate(geometry=firstItem_2, zTranslation=altura_inversa)
# note: Conectar los puntos para crear líneas
byStartPointEndPoint_3 = Line.ByStartPointEndPoint(startPoint=translate_2, endPoint=firstItem_2)

# group: Para Revit: colocar vigas por curva
# note: Colocar vigas interiores
beamByCurve = StructuralFraming.BeamByCurve(curve=byStartPointEndPoint, level=nivel_de_estructura, structuralFramingType=structural_framing_types)
# note: Colocar las vigas de perímetro
beamByCurve_2 = StructuralFraming.BeamByCurve(curve=byStartPointEndPoint_2, level=nivel_de_estructura, structuralFramingType=structural_framing_types)
# note: Colocar los pilares estructurales
columnByCurve = StructuralFraming.ColumnByCurve(curve=byStartPointEndPoint_3, level=nivel_de_estructura, structuralColumnType=tipos_de_pilar_estructural)
