# Dynamo graph Revit Adaptive Component Placement.dyn "Placement de composants Revit adaptifs" (Dynamo 4.0.0.3076)
# author: Dynamo Team
# Ce graphique positionne les composants adaptatifs par points dans un modèle.

# group: Informations
# note: Les lignes de quadrillage de mur-rideau ont été présélectionnées dans Revit, les ID d'éléments ont été enregistrés avec le fichier Dynamo
# note: Exécutez ce graphique du fichier Snowdon Towers Sample Architectural.rvt dans le dossier Samples situé dans votre installation de Revit:
# C:\Program Files\Autodesk\Revit 2027\Samples
# Exécutez ce graphique après avoir chargé la famille adaptative AdaptivePanel.rfa depuis l'emplacement des ensembles de données Dynamo.
# note: Placer des composants adaptatifs par rapport à certains éléments sélectionnés dans un fichier Revit.
# Les composants adaptatifs requièrent un jeu de points égal au nombre de points de placement de la famille placée

# group: Entrées
# note: Sélectionner des lignes de quadrillage de mur-rideau
sél_arêtes = SelectEdges()  # 7 picked in the model; graph input
# note: Définir le déplacement minimal et maximal pour le point central de l'ailette
déplacement_min = DoubleSlider(1.4, range=0.2..3 step 0.1)
déplacement_max = DoubleSlider(4.3, range=3..8 step 0.1)
# note: Sélectionner la famille de composants adaptatifs
family_types = FamilyTypes("AdaptivePanel:AdaptivePanel")  # graph input

# note: Créer une liste de positions de points le long d'une courbe, 0 étant le début, 0.5 - Milieu et 1 étant la fin
liste_de_paramètres = CodeBlock { [0,0.5,1]; }
# note: Localiser les points de départ, médians et d'arrivée sur chaque courbe
pointAtParameter = Curve.PointAtParameter(curve=sél_arêtes, param=liste_de_paramètres, lacing=CrossProduct)

# group: Saisir les points de départ et d'arrivée de chaque courbe
index_des_points_de_départ_et_d = CodeBlock { 0; 2; }  # "index des points de départ et d'arrivée"
getItemAtIndex = List.GetItemAtIndex(list=pointAtParameter@L2, index=index_des_points_de_départ_et_d.out0)
# note: Comme pour la sélection du point médian, utiliser Niveaux pour sélectionner les points de départ et d'arrivée de chaque courbe
getItemAtIndex_2 = List.GetItemAtIndex(list=pointAtParameter@L2, index=index_des_points_de_départ_et_d.out1)

# group: Saisir le point médian de chaque courbe
index_du_point_médian = CodeBlock { 1; }
# note: Utiliser les niveaux de liste de l'entrée 'liste'. Par défaut, le résultat du noeud sera la liste avec l'index 1 (la seconde courbe). Cliquer avec le bouton droit sur l'entrée 'liste' et sélectionner 'Utiliser les niveaux' à @L2. Cela sélectionnera l'élément avec l'index 1 dans chaque liste imbriquée (points médians de chaque courbe)
getItemAtIndex_3 = List.GetItemAtIndex(list=pointAtParameter@L2, index=index_du_point_médian)

# group: Créer une onde sinusoïdale
# note: Compter le nombre de courbes source sélectionnées
count = List.Count(list=sél_arêtes)
# note: Créer une séquence de N valeurs de 0 à 1
sequence = CodeBlock(steps=count) { 0..1..#steps; }
# note: Créer une onde sinusoïdale
sin = Math.Sin(angle=sequence)
# note: Remapper les valeurs de l'onde sinusoïdale à de nouvelles valeurs Max et MIn
remapRange = Math.RemapRange(numbers=sin, newMin=déplacement_min, newMax=déplacement_max)

# group: Déplacer les points médians
# note: Pour le déplacement Y, annuler la valeur de déplacement vers l'extérieur du mur-rideau
valeur_négative = CodeBlock(y=remapRange) { -y; }
# note: Déplacer les points médians de l'ailette
translate = Geometry.Translate(geometry=getItemAtIndex_3, yTranslation=valeur_négative, zTranslation=remapRange)

# note: Pour le déplacement Y, annuler la valeur de déplacement vers l'extérieur du mur-rideau
valeur_négative_2 = CodeBlock(y=remapRange) { y; }
# note: Déplacer les points médians de l'ailette
translate_2 = Geometry.Translate(geometry=getItemAtIndex_3, yTranslation=valeur_négative_2, zTranslation=remapRange)

# group: Rejoindre les points dans les listes
list_create = List.Create(item0=getItemAtIndex, item1=translate, item2=getItemAtIndex_2, item3=translate_2)
# note: Inverser la matrice et organiser les listes en jeux de 3
transpose = List.Transpose(lists=list_create)

# group: Vers Revit : placer le composant
# note: Les composants adaptatifs peuvent être positionnés à l'aide de jeux de points égaux au nombre de points de placement de la famille.
byPoints = AdaptiveComponent.ByPoints(points=transpose, familyType=family_types)
