# Dynamo graph Revit Color.dyn "Couleur Revit" (Dynamo 4.0.0.3076)
# author: Dynamo Team
# Ce graphique évalue la surface des éléments sélectionnés et applique des remplacements de graphisme pour colorer les éléments en fonction de cette valeur.

# group: Informations
# note: Exécutez ce graphique du fichier Snowdon Towers Sample Architectural.rvt dans le dossier Samples situé dans votre installation de Revit
# C:\Program Files\Autodesk\Revit 2027\Samples
# note: Ce graphique colorie les éléments Revit en fonction de critères mesurables (surface).
# Les éléments sont colorés à l'aide de la méthode Remplacer les graphiques dans Affichage > Par élément.

# group: Sélectionner les éléments du modèle
# Sélectionner les murs de façade
# note: Cliquer sur Modifier pour sélectionner des éléments dans le modèle Revit
sélectionner_les_éléments_du = DSModelElementsSelection()  # "Sélectionner les éléments du modèle"; 33 picked in the model; graph input

# group: Évaluer la surface de l'élément
# note: Obtenir la géométrie de l'élément
getGeometry = Element.GetGeometry(element=sélectionner_les_éléments_du)
flatten = List.Flatten(list=getGeometry)
# note: Extraire la surface de la géométrie
area = Solid.Area(solid=flatten)
# note: Obtenir la valeur la plus élevée
maximumItem = List.MaximumItem(list=area)
# note: Normaliser à la valeur la plus élevée
div = area / maximumItem  # graph output

# group: Créer des couleurs
# Préparer le choix des couleurs pour appliquer un code de couleur aux éléments
number = DoubleInput(0)
number_2 = DoubleInput(255)
# note: vert
byARGB = Color.ByARGB(alpha=number, red=number, green=number_2, blue=number, lacing=Longest)
number_3 = DoubleInput(0)
number_4 = DoubleInput(255)
# note: rouge
byARGB_2 = Color.ByARGB(alpha=number_3, red=number_4, green=number_3, blue=number_3, lacing=Longest)
create = List.Create(item0=byARGB, item1=byARGB_2)
code_block = CodeBlock { [0,1]; }
# note: définir un intervalle de couleurs
color_range = ColorRange(colors=create, indices=code_block, value=div)

# group: Vers Revit : remplacer la couleur de l'élément dans la vue
# note: Cela remplace la couleur de l'élément dans la vue active
overrideColorInView = Element.OverrideColorInView(element=sélectionner_les_éléments_du, color=color_range, lacing=Longest)

# group: Seuil
number_5 = DoubleInput(100)

# group: Alternative - évalue si le critère passe un seuil donné
# note: Comparer avec une valeur de seuil
gt = area > number_5
# note: Les nombres indiquent la position sur le spectre de couleurs - de 0 à 1
number_6 = DoubleInput(1)
number_7 = DoubleInput(0)
# note: identifier les surfaces correspondant à une tolérance
if_ = RefactoredIf(test=gt, true=number_6, false=number_7)
# note: ce résultat peut être utilisé comme entrée 'index' du noeud Color Range
watch = Watch(if_)
