# Dynamo graph Revit Floors and Framing.dyn "Sols et ossatures Revit" (Dynamo 4.0.0.3076)
# author: Dynamo Team
# Ce graphique crée une folie architecturale en utilisant une série de lignes et leur déplacement pour positionner les éléments d'ossature et de sol dans Revit.
# packages: Moteur PythonNet3 1.4.5

# group: Informations
# note: Exécutez ce graphique du fichier Snowdon Towers Sample Architectural.rvt dans le dossier Samples situé dans votre installation de Revit
# C:\Program Files\Autodesk\Revit 2027\Samples
# note: Ce graphique crée une folie architecturale, à l'aide d'une série de lignes et les utilise pour déterminer le positionnement de l'ossature et des sols.

# group: Position du centre de la structure
position_x = DoubleSlider(30, range=25..40 step 1)  # graph input
position_y = DoubleSlider(30, range=25..40 step 1)  # graph input
position_z = DoubleSlider(62, range=60..80 step 1)  # graph input

# group: Configuration de la structure
rayon_du_sol_inférieur = DoubleSlider(10, range=8..20 step 1)  # graph input
nbre_de_sols = DoubleSlider(7, range=3..10 step 1)  # graph input
réduction_du_rayon = DoubleSlider(-1.25, range=-2..-0.5 step 0.25)  # graph input
nombre_de_côtés_du_polygone = IntegerSlider(5, range=3..10 step 1)  # graph input
hauteur_du_sol_supérieur = DoubleSlider(38.4, range=15..50 step 0.1)  # graph input
rotation_maximale_degrés = DoubleSlider(130, range=10..180 step 5)  # graph input

# group: Construire des polygones
# Créer une série de polygones d'un rayon décroissant, décalés verticalement, pivotés de manière séquentielle
# note: Centre d'architecture aléatoire
byCoordinates = Point.ByCoordinates(x=position_x, y=position_y, z=position_z)
# note: Séquence de rayons de cercle
sequence = Sequence(start=rayon_du_sol_inférieur, amount=nbre_de_sols, step=réduction_du_rayon, lacing=Longest)
# note: Créer une série de cercles
byCenterPointRadius = Circle.ByCenterPointRadius(centerPoint=byCoordinates, radius=sequence)
# note: Créer une série de polygones
regularPolygon = Polygon.RegularPolygon(circle=byCenterPointRadius, numberSides=nombre_de_côtés_du_polygone)
# note: Séquence d'élévations de sol
séquence_des_hauteurs_de_sol = CodeBlock(top_floor=hauteur_du_sol_supérieur, count=nbre_de_sols) { 0..top_floor..#count; }
byCoordinates_2 = Vector.ByCoordinates(z=séquence_des_hauteurs_de_sol)
# note: Déplacer les polygones vers le haut selon les hauteurs données
translate = Geometry.Translate(geometry=regularPolygon, direction=byCoordinates_2)
ZAxis = Vector.ZAxis()
# note: Séquence de rotations pour chaque sol
séquence_d_angles_de_rotation = CodeBlock(max_degrees=rotation_maximale_degrés, count=nbre_de_sols) { 0..max_degrees..#count; }
# note: Faire pivoter les polygones avec une série d'angles
rotate = Geometry.Rotate(geometry=translate, origin=byCoordinates, axis=ZAxis, degrees=séquence_d_angles_de_rotation)
# note: Obtenir les courbes individuelles des polygones
curves = PolyCurve.Curves(polyCurve=rotate)

# group: Type et niveau de sol
# note: Sélectionner le type de sol des sols créés dans les types existants dans le projet à l'aide de la liste déroulante
floor_types = FloorTypes("Concrete Slab 6\"")  # graph input
levels = Levels("Green Roof Hardscape")  # graph input

# group: Vers Revit : créer des sols
# Utiliser la série de boucles de courbes fermées comme entrée pour la création de sol
# note: Transmettre des groupes de courbes pour créer des sols
byOutlineTypeAndLevel = Floor.ByOutlineTypeAndLevel(outline=curves, floorType=floor_types, level=levels)

# group: Connexions verticales
# Connecter les coins du polygone entre les niveaux de la structure
# note: Obtenir les points d'arrivée de chaque courbe de polygone
endPoint = Curve.EndPoint(curve=curves)
# note: Inverser la matrice et aligner verticalement les listes de points d'arrivée
transpose = List.Transpose(lists=endPoint)
# note: Relier les coins correspondants des polygones du niveau le plus bas au niveau le plus élevé de la structure, en les joignant sous forme de polycourbes
byPoints = PolyCurve.ByPoints(points=transpose)
# note: Déconstruire des polycourbes et obtenir des listes de courbes qui serviront de données d'entrée pour les éléments d'ossature
curves_2 = PolyCurve.Curves(polyCurve=byPoints)

# group: Type et niveau de l'ossature
levels_2 = Levels("Green Roof Hardscape")  # graph input
# note: Sélectionner le type d'ossature parmi les types chargés dans le projet à l'aide de la liste déroulante
structural_framing_types = StructuralFramingTypes("W12X26")  # graph input

# group: Vers Revit : créer une ossature
# Utiliser des courbes pour créer des éléments d'ossature et utiliser un noeud Python pour interdire la jonction entre des poutres individuelles
# note: Transmettre les courbes individuelles pour chaque élément structurel
beamByCurve = StructuralFraming.BeamByCurve(curve=curves_2, level=levels_2, structuralFramingType=structural_framing_types)
# note: Préparer la liste
flatten = List.Flatten(list=beamByCurve)
# note: Il s'agit d'un noeud Python renommé qui fait référence à l'API Revit pour étendre les possibilités de Dynamo au-delà des noeuds prêts à l'emploi. Pour lire le code Python, cliquer avec le bouton droit de la souris sur le noeud et choisir Modifier...
interdire_les_jonctions_sur_l = Python(structuralFraming=flatten)  # "Interdire les jonctions sur l'ossature"; PythonNet3
# ---------- interdire_les_jonctions_sur_l.python (35 lines) ----------
# Load the Python Standard and DesignScript Libraries
import sys
import clr
clr.AddReference('ProtoGeometry')
from Autodesk.DesignScript.Geometry import *
from Autodesk.Revit.DB import *
from RevitServices.Transactions import TransactionManager
from RevitServices.Persistence import DocumentManager 

doc = DocumentManager.Instance.CurrentDBDocument

# The inputs to this node will be stored as a list in the IN variables.
dataEnteringNode = IN

# Place your code below this line
structural_framing = UnwrapElement(IN[0])

unjoined_elements = []
# start a Transaction
TransactionManager.Instance.EnsureInTransaction(doc)
# iterate through each structural framing element
for sf in structural_framing:
    # check if the element passed in of Structural Framing Category
    sf_category = sf.Category # get the element's Category
    # use the Structural Framing's Category Id to check
    if sf_category.Id.Value == -2001320:
        # disallow joins at start and end of the structural framing element
        Structure.StructuralFramingUtils.DisallowJoinAtEnd(sf, 0)
        Structure.StructuralFramingUtils.DisallowJoinAtEnd(sf, 1)
        unjoined_elements.append(sf)
TransactionManager.Instance.TransactionTaskDone()

    
# Output the list of elements with Disallowed Join
OUT = unjoined_elements
# ----------------------------------------
