# Dynamo graph Revit Geometry Creation Curves.dyn "Création de géométrie Revit - Courbes" (Dynamo 4.0.0.3076)
# author: Dynamo Team
# Ce graphique présente plusieurs méthodes de création de courbes dans Dynamo et de leur utilisation pour créer des éléments Revit (lignes de modèle)

# group: Informations
# note: Ce graphique utilise plusieurs méthodes de création de courbes à utiliser comme entrée pour la création de courbes de modèle Revit
# note: Exécutez ce graphique du fichier Snowdon Towers Sample Architectural.rvt dans le dossier Samples situé dans votre installation de Revit
# C:\Program Files\Autodesk\Revit 2027\Samples

# group: Quatre points
number = DoubleInput(-35)
number_2 = DoubleInput(-55)
byCoordinates = Point.ByCoordinates(x=number, y=number_2)
number_3 = DoubleInput(-40)
byCoordinates_2 = Point.ByCoordinates(x=number, y=number_3)
number_4 = DoubleInput(-10)
byCoordinates_3 = Point.ByCoordinates(x=number_4, y=number_3)
number_5 = DoubleInput(-17)
number_6 = DoubleInput(-60)
byCoordinates_4 = Point.ByCoordinates(x=number_5, y=number_6)

list_create = List.Create(item0=byCoordinates, item1=byCoordinates_2, item2=byCoordinates_3, item3=byCoordinates_4)

# group: Créer une courbe de modèle à partir d'une courbe NURBS (par points)
# note: Créer une courbe NURBS à partir d'une liste de points
byPoints = NurbsCurve.ByPoints(points=list_create)
# note: Utiliser la courbe NURBS pour créer une ligne de modèle Revit
byCurve = ModelCurve.ByCurve(curve=byPoints)

# group: Créer une courbe de modèle à partir d'une courbe NURBS (par des points de contrôle)
boolean = BoolSelector(false)
# note: Créer une courbe NURBS à partir d'une liste de points en tant que points de contrôle
byControlPoints = NurbsCurve.ByControlPoints(points=list_create, closeCurve=boolean)
# note: Utiliser la courbe NURBS pour créer une ligne de modèle Revit
byCurve_2 = ModelCurve.ByCurve(curve=byControlPoints)

# group: Créer une courbe de modèle à partir d'une polycourbe
# note: Créer une polycourbe à partir d'une liste de points
byPoints_2 = PolyCurve.ByPoints(points=list_create)
curves = PolyCurve.Curves(polyCurve=byPoints_2)
# note: Utiliser la liste des courbes pour créer un jeu de lignes de modèle Revit
byCurve_3 = ModelCurve.ByCurve(curve=curves)

# group: Créer une courbe de modèle à partir d'une ligne
# note: Créer une courbe à partir de deux points
byStartPointEndPoint = Line.ByStartPointEndPoint(startPoint=byCoordinates, endPoint=byCoordinates_2)
# note: Utiliser la ligne (courbe) pour créer une courbe de modèle Revit
byCurve_4 = ModelCurve.ByCurve(curve=byStartPointEndPoint)
