# Dynamo graph Revit Geometry Creation Points.dyn "Création de géométrie Revit - Points" (Dynamo 4.0.0.3076)
# author: Dynamo Team
# Ce graphique crée une ligne de modèle et un point de référence dans l'environnement de la famille de volumes conceptuels.

# group: Informations
# note: Vous pouvez basculer entre la navigation en arrière-plan 3D et la navigation dans la vue graphique à l'aide des boutons situés dans le coin supérieur droit de l'écran (raccourci Ctrl + B). L'aperçu en arrière-plan peut également être activé et désactivé dans le menu Affichage, pour Dynamo et Revit.
# note: Exécutez ce graphique dans un environnement de familles de volumes conceptuels ou adaptatifs de modèles génériques.
# Pour créer une famille, accéder à Fichier > Nouvelle famille > et sélectionnez le gabarit situé dans le dossier:
# C:\ProgramData\Autodesk\RVT 2027\Family Templates\English-Imperial\Generic Model Adaptive.rft
# note: Ce graphique crée une ligne de modèle et un point de référence dans l'environnement de famille

# group: Coordonnées des points
valeur_x_du_point = DoubleSlider(50, range=5..50 step 5)  # graph input
valeur_y_du_point = DoubleSlider(25, range=5..50 step 5)  # graph input
valeur_z_du_point = DoubleSlider(25, range=5..50 step 5)  # graph input

# note: Manipuler la position du point dans l'environnement Dynamo : sélectionner le noeud Point.ByCoordinates et passez à l'aperçu en arrière-plan pour tirer le point le long de ses trois axes.
byCoordinates = Point.ByCoordinates(x=valeur_x_du_point, y=valeur_y_du_point, z=valeur_z_du_point)
# note: Les données géométriques peuvent être affichées comme des informations textuelles ou dans un espace 3D
watch = Watch(byCoordinates)
byCoordinates_2 = Point.ByCoordinates()
byStartPointEndPoint = Line.ByStartPointEndPoint(startPoint=byCoordinates_2, endPoint=byCoordinates)
# note: Afficher un aperçu de la géométrie
watch_3d = Watch3D(byStartPointEndPoint)
# note: Créer une courbe de modèle en reliant deux points
byCurve = ModelCurve.ByCurve(curve=byStartPointEndPoint)
# note: Dynamo peut uniquement créer et modifier des éléments appropriés au fichier auquel Dynamo est associé. Par exemple, les points de référence peuvent uniquement être créés dans certains environnements de famille (par exemple, adaptatif de modèle générique), tandis que les lignes de modèle peuvent être créées pratiquement n'importe où.
byPoint = ReferencePoint.ByPoint(pt=byCoordinates)
