# Dynamo graph Revit Geometry Creation Solids.dyn "Création de géométrie Revit - Solides" (Dynamo 4.0.0.3076)
# author: Dynamo Team
# Ce graphique présente plusieurs méthodes de création de géométrie solide dans Dynamo et d'intégration dans Revit. Certaines méthodes peuvent être utilisées dans un environnement de projet, d'autres uniquement dans certains environnements de famille (volume conceptuel).

# group: Informations
# note: Plusieurs méthodes de création sont disponibles pour la plupart des solides. Ces exemples montrent des profils fermés comme base, mais les polysurfaces peuvent être assemblées, de nombreuses primitives sont disponibles (surfaces, cuboïdes, cônes, etc.).
# Pour intégrer la géométrie dans l'environnement Revit, elle doit d'abord être convertie en élément Revit.
# Les solides peuvent être transformés en une occurrence d'importation qui sera visible dans les environnements de projet et de famille de modèles.
# La géométrie solide peut également être convertie en un élément de forme disponible uniquement pour les environnements de volumes conceptuels et de familles de composants adaptatifs.
# note: Ce graphique utilise plusieurs méthodes pour créer une géométrie solide dans Revit. Certaines méthodes peuvent être utilisées dans un environnement de projet, d'autres uniquement dans certains environnements de famille.
# Utiliser un gabarit de famille Volume conceptuel pour afficher toutes les méthodes.
# Pour ouvrir une famille Volume conceptuel, accéder à Fichier > Nouveau > Famille > et sélectionner le gabarit Mass.rft\Conceptual Mass\Mass.rft

# group: Préparer les points
# Générer un jeu de points pour construire la géométrie
byCoordinates = Point.ByCoordinates()
number = DoubleInput(10)
byCoordinates_2 = Point.ByCoordinates(x=number)
number_2 = DoubleInput(5)
byCoordinates_3 = Point.ByCoordinates(z=number_2)
number_3 = DoubleInput(10)
byCoordinates_4 = Point.ByCoordinates(y=number_3)
number_4 = DoubleInput(15)
byCoordinates_5 = Point.ByCoordinates(x=number_4, y=number_4)
number_5 = DoubleInput(5)
number_6 = DoubleInput(10)
byCoordinates_6 = Point.ByCoordinates(x=number_5, y=number_6, z=number_6)
number_7 = DoubleInput(-2)
number_8 = DoubleInput(5)
byCoordinates_7 = Point.ByCoordinates(x=number_7, y=number_8)

# group: Premier profil
# Créer un premier profil en tant que courbe fermée à partir d'un arc et d'une ligne
byStartPointEndPoint = Line.ByStartPointEndPoint(startPoint=byCoordinates, endPoint=byCoordinates_2)
byThreePoints = Arc.ByThreePoints(firstPoint=byCoordinates, secondPoint=byCoordinates_3, thirdPoint=byCoordinates_2)
create = List.Create(item0=byStartPointEndPoint, item1=byThreePoints)
# note: Premier profil pour le lissage
byJoinedCurves = PolyCurve.ByJoinedCurves(curves=create)

# group: Deuxième profil
# Créer un second profil en tant que courbe fermée à partir d'un arc et d'une ligne
byStartPointEndPoint_2 = Line.ByStartPointEndPoint(startPoint=byCoordinates_4, endPoint=byCoordinates_5)
byThreePoints_2 = Arc.ByThreePoints(firstPoint=byCoordinates_4, secondPoint=byCoordinates_6, thirdPoint=byCoordinates_5)
create_2 = List.Create(item0=byStartPointEndPoint_2, item1=byThreePoints_2)
# note: Deuxième profil pour le lissage
byJoinedCurves_2 = PolyCurve.ByJoinedCurves(curves=create_2)

# note: Joindre deux profils dans une liste
create_3 = List.Create(item0=byJoinedCurves, item1=byJoinedCurves_2)

# group: Lissage de solide par coupes
byLoft = Solid.ByLoft(crossSections=create_3)

# note: Examiner le volume du solide
volume = Solid.Volume(solid=byLoft)

# group: Créer une coque
code_block = CodeBlock { 0; }
# note: Conseil: désactiver l'"aperçu" dans le menu contextuel du noeud pour exclure des éléments de l'affichage
thinShell = Solid.ThinShell(solid=byLoft, internalFaceThickness=code_block)

# group: Translater la géométrie
code_block_2 = CodeBlock { Vector.ByCoordinates(20,0,0); }
# note: Translater la géométrie sur le côté pour afficher un aperçu du résultat d'origine et du résultat final
translate = Geometry.Translate(geometry=thinShell, direction=code_block_2)

# group: Découpe de solide
# Utiliser l'opération de découpe pour couper le solide de la coque à l'aide d'un plan.
code_block_3 = CodeBlock { Point.ByCoordinates(0,0,5); }
ZAxis = Vector.ZAxis()
byOriginNormal = Plane.ByOriginNormal(origin=code_block_3, normal=ZAxis)
number_9 = DoubleInput(10)
# note: Choisir le côté de découpe à conserver (le côté le plus proche du point sera ignoré).
byCoordinates_8 = Point.ByCoordinates(x=number_9, y=number_9, z=number_9)
# note: Les opérations booléennes géométriques (intersection, différence, union, etc.) sont disponibles dans la catégorie Geometry.
trim = Geometry.Trim(geometry=translate, other=byOriginNormal, pick=byCoordinates_8)

# group: Courbe-guide
# Créer une courbe NURBS à utiliser comme courbe-guide pour la forme de solide de lissage
create_4 = List.Create(item0=byCoordinates, item1=byCoordinates_7, item2=byCoordinates_4)
# note: Courbe de guidage construite en tant que courbe NURBS
byPoints = NurbsCurve.ByPoints(points=create_4)

# group: Lissage de solide par coupes et courbes-guides
# note: Conseil: désactiver l'"aperçu" dans le menu contextuel du noeud pour exclure des éléments de l'affichage
byLoft_2 = Solid.ByLoft(crossSections=create_3, guideCurves=byPoints)

# group: Créer une occurrence d'importation
code_block_4 = CodeBlock { Vector.ByCoordinates(-20,0,0); }
translate_2 = Geometry.Translate(geometry=byLoft_2, direction=code_block_4)
# note: La géométrie ne correspond pas à un élément Revit:
# Utilisez ImportInstance pour créer des importations Revit à partir des surfaces et des solides dans n'importe quel environnement Revit, utilisez des points et des courbes pour placer des occurrences de familles, ou créez des formes dans des familles de volumes ou de modèles génériques par point (composant adaptatif)
byGeometries = ImportInstance.ByGeometries(geometries=translate_2)
byCoordinates_9 = Vector.ByCoordinates()

# group: Créer une forme
# A l'aide de deux boucles de courbe de profil, créer un élément de forme (dans l'environnement de famille Volume conceptuel)
curves = PolyCurve.Curves(polyCurve=create_3)
# note: Créer des courbes de modèle à partir de courbes
referenceCurveByCurve = ModelCurve.ReferenceCurveByCurve(curve=curves)
# note: Les formes peuvent uniquement être créées en tant que partie d'une famille de volumes conceptuels
byLoftCrossSections = Form.ByLoftCrossSections(curves=referenceCurveByCurve)
