# Dynamo graph Revit Geometry Creation Surfaces.dyn "Création de géométrie Revit - Surfaces" (Dynamo 4.0.0.3076)
# author: Dynamo Team
# Ce graphique présente plusieurs méthodes de création de surfaces dans Dynamo et deux méthodes de conversion de géométrie en géométrie Revit.

# group: Informations
# note: Ce graphique utilise plusieurs méthodes pour créer une géométrie de surface dans Revit. Certaines méthodes peuvent être utilisées dans un environnement de projet, d'autres uniquement dans certains environnements de famille.
# Utiliser un gabarit de famille Volume conceptuel pour afficher toutes les méthodes.
# Créer une famille Volume conceptuel en accédant à Fichier > Nouveau > Famille et sélectionner le gabarit Mass.rft dans le dossier Conceptual Mass.
# note: Plusieurs méthodes de création sont disponibles pour la plupart des surfaces. Les surfaces, les polysurfaces (ensembles de surfaces) et les surfaces NURBS peuvent être créées à partir de points, de courbes et dérivées d'autres surfaces et solides par diverses opérations.
# note: Pour intégrer une géométrie dans l'environnement Revit, elle doit d'abord être convertie en élément Revit.
# Les surfaces et les solides peuvent être transformés en une occurrence importée qui sera visible dans les environnements de projet et de famille de modèles. La géométrie de surface peut également être convertie en un élément de forme qui n'est disponible que pour les environnements de volumes conceptuels et de familles de composants adaptatifs.

# group: Préparer les points
# Générer un jeu de points pour construire la géométrie
number = DoubleInput(10)
byCoordinates = Point.ByCoordinates(y=number)
number_2 = DoubleInput(5)
number_3 = DoubleInput(10)
byCoordinates_2 = Point.ByCoordinates(x=number_2, y=number_3, z=number_3)
number_4 = DoubleInput(15)
byCoordinates_3 = Point.ByCoordinates(x=number_4, y=number_4)
byCoordinates_4 = Point.ByCoordinates()
number_5 = DoubleInput(5)
byCoordinates_5 = Point.ByCoordinates(z=number_5)
byCoordinates_6 = Point.ByCoordinates(x=number)
number_6 = DoubleInput(-5)
number_7 = DoubleInput(5)
byCoordinates_7 = Point.ByCoordinates(x=number_6, y=number_7)
number_8 = DoubleInput(10)
number_9 = DoubleInput(-10)
byCoordinates_8 = Point.ByCoordinates(x=number_8, y=number_9)
byCoordinates_9 = Point.ByCoordinates(y=number_9)

# group: Créer des profils
byThreePoints = Arc.ByThreePoints(firstPoint=byCoordinates, secondPoint=byCoordinates_2, thirdPoint=byCoordinates_3)
byThreePoints_2 = Arc.ByThreePoints(firstPoint=byCoordinates_4, secondPoint=byCoordinates_5, thirdPoint=byCoordinates_6)
byThreePoints_3 = Arc.ByThreePoints(firstPoint=byCoordinates_4, secondPoint=byCoordinates_7, thirdPoint=byCoordinates)
byStartPointEndPoint = Line.ByStartPointEndPoint(startPoint=byCoordinates_8, endPoint=byCoordinates_9)

# group: Surface par balayage
# Utiliser un profil, une courbe de trajectoire et un rail de guidage pour créer une surface de balayage
bySweep2Rails = Surface.BySweep2Rails(path=byThreePoints, guideRail=byThreePoints_2, profile=byThreePoints_3)

# group: Créer une importation
# note: Utiliser l'option Importer une occurrence pour créer des importations Revit à partir de surfaces et de solides. Ces derniers seront visibles dans n'importe quel environnement Revit.
byGeometries = ImportInstance.ByGeometries(geometries=bySweep2Rails)

create = List.Create(item0=byStartPointEndPoint, item1=byThreePoints_2)

# group: Créer une surface par lissage
# Joindre les coupes pour créer une surface de lissage
byLoft = Surface.ByLoft(crossSections=create)

# group: Évaluer la surface
area = Surface.Area(surface=byLoft)
watch = Watch(area)
create_2 = List.Create(item0=byLoft, item1=bySweep2Rails)
# note: Les surfaces jointes sous forme de polysurfaces peuvent être évaluées en tant qu'entité unique
byJoinedSurfaces = PolySurface.ByJoinedSurfaces(surfaces=create_2)
area_2 = Surface.Area(surface=byJoinedSurfaces)
watch_2 = Watch(area_2)
area_3 = Surface.Area(surface=bySweep2Rails)
watch_3 = Watch(area_3)

# group: Surface NURBS à partir de points de contrôle
# Convertir un balayage en surface NURBS à partir de points de contrôle
code_block = CodeBlock { 0..1..0.1; }
# note: Les arêtes, les points et d'autres fonctions peuvent être dérivés des surfaces à l'aide des "actions" appropriées à ces géométries.
pointAtParameter = Surface.PointAtParameter(surface=bySweep2Rails, u=code_block, v=code_block, lacing=CrossProduct)
# note: Reconstruire la surface en tant que surface NURBS à partir des points de contrôle
byControlPoints = NurbsSurface.ByControlPoints(controlVertices=pointAtParameter)
# note: Utiliser le noeud Watch 3D pour afficher un aperçu de la géométrie de manière isolée
watch_3d = Watch3D(byControlPoints)

# group: Surface par courbe d'extrusion
# Utiliser une courbe pour créer une extrusion avec une distance donnée
code_block_2 = CodeBlock { 10; }
extrude = Curve.Extrude(curve=byThreePoints, distance=code_block_2)

# group: Créer une forme
# Créer une forme de lissage à partir de deux courbes
referenceCurveByCurve = ModelCurve.ReferenceCurveByCurve(curve=create)
byLoftCrossSections = Form.ByLoftCrossSections(curves=referenceCurveByCurve)
