# Dynamo graph Revit Import Solid.dyn "Importation de solide Revit" (Dynamo 4.0.0.3076)
# author: Dynamo Team
# Ce graphique illustre une méthode de création de géométrie de solide Dynamo et son utilisation pour créer un élément d'occurrence importée Revit. Créer une forme de toit en créant une série de profils en arc et en les utilisant pour créer une surface de lissage.

# group: Informations
# note: L'élément source (toit) a été présélectionné dans Revit, avec les ID d'éléments enregistrés avec le fichier Dynamo
# note: Exécutez ce graphique du fichier Snowdon Towers Sample Architectural.rvt dans le dossier Samples situé dans votre installation de Revit
# C:\Program Files\Autodesk\Revit 2027\Samples
# note: Construire une forme de toit à partir d'un élément de toit sélectionné en créant une série de profils en arc et en les utilisant pour créer une surface de lissage. La géométrie est convertie en occurrence d'importation pour l'intégrer à l'environnement Revit

# group: Nouvelle configuration de toit
# note: Nombre de profils à partir desquels la surface de lissage sera créée
nombre_de_profils = IntegerSlider(6, range=3..10 step 1)
# note: Hauteur aux extrémités courtes du nouveau toit
section_min_du_toit = DoubleSlider(2.1, range=1..5 step 0.1)
# note: Hauteur au milieu du toit
section_max_du_toit = DoubleSlider(7, range=5..10 step 0.1)
# note: Prolonger les profils en arc latéralement en fonction de cette valeur
extension_des_côtés_du_toit = DoubleSlider(0.5, range=0.1..3 step 0.1)
# note: Épaisseur de la nouvelle forme de toit
épaisseur_du_toit = DoubleSlider(0.5, range=0.1..2 step 0.1)

nbre_de_profils = CodeBlock(steps=nombre_de_profils) { steps; }

# group: Sélectionner le toit
# Sélectionner l'élément de toit source
# note: Toutes les entrées marquées sur 'IsInput' peuvent être définies à partir du Lecteur Dynamo
sélectionner_un_toit_plat = DSModelElementSelection()  # 1 picked in the model

# group: Importer une face de toit
# Décomposer la géométrie de l'élément source et choisir une face avec la plus grande zone
# note: Pour obtenir la face de l'élément sélectionné, vous devez d'abord obtenir sa géométrie
# note: Cliquer avec le bouton droit de la souris et désélectionner l'option 'Aperçu de la géométrie' pour obtenir une vue plus claire du résultat final
getGeometry = Element.GetGeometry(element=sélectionner_un_toit_plat)
# note: Décomposer la géométrie pour obtenir des faces individuelles
explode = Geometry.Explode(geometry=getGeometry)
# note: Supprimer la structure de liste. Noter que cette étape n'est pas nécessaire si plusieurs objets source sont utilisés
flatten = List.Flatten(list=explode)
area = Surface.Area(surface=flatten)
# note: Trier la liste des surfaces par zone. La surface avec les zones les plus grandes sera le dernier élément dans la liste de sortie SortedList
sortByKey = List.SortByKey(list=flatten, keys=area)
lastItem = List.LastItem(list=sortByKey.sortedList)
number = DoubleInput(1.5)
# note: Transposer la surface vers le haut
translate = Geometry.Translate(geometry=lastItem, zTranslation=number)

# group: Décaler vers l'extérieur (échelle)
# Mettre à l'échelle la surface pour étendre ses arêtes vers l'extérieur
position_uv = CodeBlock { 0.5; }
pointAtParameter = Surface.PointAtParameter(surface=translate, u=position_uv, v=position_uv)
échelle_du_point_à_point = CodeBlock { point1 = Point.ByCoordinates(1, 1); point2 = Point.ByCoordinates(-40, -40); }
scale = Geometry.Scale(geometry=translate, basePoint=pointAtParameter, from=échelle_du_point_à_point.point1, to=échelle_du_point_à_point.point2)

# group: Points sur la surface
# Générer trois listes de points espacés régulièrement - deux lignes le long des arêtes les plus longues et une ligne au milieu
# note: 0 et 1 sont des positions le long des arêtes les plus longues de la surface
positions_u_pour_les_rangées_d = CodeBlock { [0,1]; }  # "Positions U pour les rangées d'arêtes"
# note: Positions V le long des arêtes les plus longues, dans une séquence de 0 à 1 et N étapes
positions_v_pour_les_rangées_d = CodeBlock(steps=nbre_de_profils) { [0..1..#steps]; }  # "Positions V pour les rangées d'arêtes"
# note: Utiliser le paramètre Combinaison la plus longue en cliquant avec le bouton droit de la souris sur le noeud > Combinaison. La combinaison la plus longue correspondra aux entrées avec différentes structures de listes. Dans ce cas, le résultat sera deux listes de points, où le nombre de points dans chaque liste correspond à la liste d'entrée la plus longue.
pointAtParameter_2 = Surface.PointAtParameter(surface=scale, u=positions_u_pour_les_rangées_d, v=positions_v_pour_les_rangées_d, lacing=Longest)
# note: La valeur U de 0,5 positionnera les points le long du milieu de la surface
position_u_pour_la_rangée_du = CodeBlock { [0.5]; }  # "Position U pour la rangée du milieu"
# note: Positions V le long de la rangée centrale de points, dans une séquence de 0 à 1 et N étapes
positions_v_pour_la_rangée_du = CodeBlock(steps=nbre_de_profils) { [0..1..#steps]; }  # "Positions V pour la rangée du milieu"
# note: La combinaison la plus longue est utilisée pour ce noeud. Le résultat est une liste de points, où le nombre de points dans la liste correspond à la liste d'entrée la plus longue.
pointAtParameter_3 = Surface.PointAtParameter(surface=scale, u=position_u_pour_la_rangée_du, v=positions_v_pour_la_rangée_du, lacing=Longest)

# group: Décaler les points vers le haut
# Décaler les points de la rangée du milieu en forme d'onde cosinus
# note: une séquence de valeurs pour générer une série de décalages
séquence_des_angles = CodeBlock(steps=nbre_de_profils) { -1..1..#steps; }
# note: Alternative : utiliser le sinus pour une forme de toit différente
sin = Math.Sin(angle=séquence_des_angles)
# note: valeurs dans une onde cosinus
cos = Math.Cos(angle=séquence_des_angles)
# note: remapper les valeurs à un nouveau domaine
remapRange = Math.RemapRange(numbers=cos, newMin=section_min_du_toit, newMax=section_max_du_toit)
# note: translater les points de la rangée du milieu
translate_2 = Geometry.Translate(geometry=pointAtParameter_3@L2, zTranslation=remapRange)

# group: Créer des profils à partir d'arcs
# Utiliser les points pour créer des arcs
# note: Joindre les rangées d'arêtes et du milieu dans une liste
join = List.Join(list0=pointAtParameter_2, list1=translate_2)
index_de_l_élément = CodeBlock { 0; 1; 2; }
getItemAtIndex = List.GetItemAtIndex(list=join, index=index_de_l_élément.out0)
getItemAtIndex_2 = List.GetItemAtIndex(list=join, index=index_de_l_élément.out2)
getItemAtIndex_3 = List.GetItemAtIndex(list=join, index=index_de_l_élément.out1)
byThreePoints = Arc.ByThreePoints(firstPoint=getItemAtIndex, secondPoint=getItemAtIndex_2, thirdPoint=getItemAtIndex_3)

# group: Prolonger les profils
# Prolonger les courbes de chaque profil d'une distance donnée
# note: La valeur d'extension est définie comme entrée dans la partie gauche du graphique.
prolonger_les_arêtes = CodeBlock(roof_extension=extension_des_côtés_du_toit) { roof_extension; }
extendStart = Curve.ExtendStart(curve=byThreePoints, distance=prolonger_les_arêtes)
extendEnd = Curve.ExtendEnd(curve=extendStart, distance=prolonger_les_arêtes)

# group: Lissage et épaississement
# Créer une surface de lissage et lui donner une épaisseur
byLoft = Surface.ByLoft(crossSections=extendEnd)
thicken = Surface.Thicken(surface=byLoft, thickness=épaisseur_du_toit)

# group: Vers Revit :
# Convertir la géométrie Dynamo en un élément Revit à l'aide des paramètres ImportInstance et Set Level
# note: Pour intégrer une géométrie dans l'environnement Revit, elle doit d'abord être convertie en élément Revit.
# Les solides peuvent être transformés en une occurrence importée qui sera visible dans les environnements de projet et de famille de modèles.
byGeometry = ImportInstance.ByGeometry(geometry=thicken)
code_block = CodeBlock { "Plan de construction"; }
levels = Levels("L1 - Block 43")
# note: Corriger la hauteur de l'occurrence importée placée en définissant le paramètre Plan de construction sur le niveau dont l'élévation correspond à la position d'origine interne.
setParameterByName = Element.SetParameterByName(element=byGeometry, parameterName=code_block, value=levels)
