# Dynamo graph Revit Place Families By Level Set Parameters.dyn "Placer des familles par paramètres définis de niveau Revit" (Dynamo 4.0.0.3076)
# author: Dynamo Team
# Ce graphique montre comment placer des éléments Revit par point. Placer des rangées de chaises dans une pièce sélectionnée et entrer des numéros uniques dans leur paramètre Identifiant

# group: Informations
# note: Exécutez ce graphique du fichier Snowdon Towers Sample Architectural.rvt dans le dossier Samples situé dans votre installation de Revit
# C:\Program Files\Autodesk\Revit 2027\Samples
# note: Placer des rangées de chaises dans une pièce sélectionnée et écrire des numéros uniques dans leur paramètre Identifiant

# group: Sélectionner les éléments Revit
# note: Sélectionner le type de famille pour les occurrences placées à partir des types de familles dans le projet
family_types = FamilyTypes("Chair-Breuer:Chair-Breuer")  # graph input
# note: Sélectionner la pièce dans laquelle placer les éléments. Vous devez accéder à une vue dans laquelle les pièces sont visibles (Plan de sol)
sélectionner_une_pièce = DSModelElementSelection()  # 1 picked in the model; graph input
rayon_du_cercle = DoubleSlider(6.4, range=5..8 step 0.1)  # graph input
# note: Sélectionner le niveau sur lequel placer les éléments
levels = Levels("L3")  # graph input

# group: Définir les décalages de ligne
# Les valeurs des décalages de ligne ne sont pas des valeurs de distance, mais des valeurs U et V
début_de_ligne = DoubleSlider(0.3, range=0..3 step 0.1)  # graph input
fin_de_ligne = DoubleSlider(2.2, range=0..3 step 0.1)  # graph input
nombre_de_chaises_dans_une = IntegerSlider(8, range=2..12 step 1)  # "Nombre de chaises dans une rangée"; graph input
position_de_la_première_rangée = DoubleSlider(0.2, range=0..3 step 0.1)  # graph input
position_de_la_dernière_rangée = DoubleSlider(1.4, range=0..3 step 0.1)  # graph input
espacement_des_lignes = DoubleSlider(0.35, range=0.15..1 step 0.05)  # graph input

# group: Générer des décalages pour les lignes
# Série de nombres correspondant aux positions U et V sur la surface. Les valeurs peuvent dépasser le domaine 0 à 1
# note: Une alternative à la création d'une séquence en définissant le début, la fin et le nombre d'étapes de la séquence
séquence_de_décalage_des_lignes = CodeBlock(start=début_de_ligne, finish=fin_de_ligne, steps=nombre_de_chaises_dans_une) { start..finish..#steps; }
# note: Générer une série de nombres dans un intervalle, suivant une étape donnée
range = Range(start=position_de_la_première_rangée, end=position_de_la_dernière_rangée, step=espacement_des_lignes)

# group: Préparer les points d'emplacement
# note: Le point de placement de la pièce sélectionnée
location = Room.Location(room=sélectionner_une_pièce)
# note: Cercle définissant une zone initiale de placement. La forme du cercle importe peu dans ce cas, mais il s'agit de la méthode la plus rapide pour définir une surface fermée
byCenterPointRadius = Circle.ByCenterPointRadius(centerPoint=location, radius=rayon_du_cercle)
# note: Convertir le cercle en une surface afin de l'utiliser pour le positionnement des points
patch = Curve.Patch(curve=byCenterPointRadius)
# note: A l'aide de séquences de valeurs U et V, créer une matrice de points. Définir la combinaison du noeud sur Produit vectoriel en cliquant avec le bouton droit de la souris et en choisissant Combinaison.
pointAtParameter = Surface.PointAtParameter(surface=patch, u=séquence_de_décalage_des_lignes, v=range, lacing=CrossProduct)

# group: Vers Revit : placer des occurrences de famille
# note: Placer des occurrences de familles
# La plupart des familles peuvent également être placées en fonction d'un emplacement de point. Les composants adaptatifs peuvent être placés avec plusieurs points, l'ossature est placée avec des courbes
byPointAndLevel = FamilyInstance.ByPointAndLevel(familyType=family_types, point=pointAtParameter, level=levels)

# note: Disposer de la structure de liste - permet d'obtenir une liste contenant tous les éléments
flatten = List.Flatten(list=byPointAndLevel)

# group: Préfixe Identifiant
# Utiliser un préfixe personnalisé pour les éléments placés Numéro d'identifiant
préfixe_identifiant = StringInput("C-")  # graph input

# group: Générer des numéros d'identifiant
number = DoubleInput(1)
# note: Compter le nombre d'éléments dans la liste
count = List.Count(list=flatten)
# note: Générer les nombres de 1 à n
sequence = Sequence(start=number, amount=count, step=number, lacing=Longest)
# note: Pour participer à des opérations de chaîne, le nombre doit d'abord être converti en chaîne
string_from_object = FromObject(obj=sequence)
index = CodeBlock { 0; }
# note: Insérer un préfixe personnalisé au numéro d'élément
insert = String.Insert(string=string_from_object, index=index, toInsert=préfixe_identifiant)

# group: Vers Revit : définir les valeurs des paramètres
string = StringInput("Identifiant")
# note: Définir le paramètre Identifiant avec une liste de valeurs. La structure de liste des éléments et des valeurs des entrées doit correspondre, ou une seule valeur peut être utilisée. Les paramètres peuvent également être lus à l'aide d'un noeud Element.GetParameterByName
setParameterByName = Element.SetParameterByName(element=flatten, parameterName=string, value=insert)

# group: Vérifier les résultats
# note: Le noeud Watch peut être utilisé pour vérifier si les résultats sont tels qu'attendus
watch = Watch(insert)  # graph output
