# Dynamo graph Revit Structural Framing.dyn "Ossature structurelle Revit" (Dynamo 4.0.0.3076)
# author: Dynamo Team
# Ce graphique crée une structure à partir de l'ossature et des poteaux par rapport à un sol Revit sélectionné.

# group: Informations
# note: Placer des poutres et des poteaux d'ossature par rapport à un élément sélectionné dans un modèle Revit.
# note: Exécutez ce graphique du fichier Snowdon Towers Sample Architectural.rvt dans le dossier Samples situé dans le dossier d'installation de Revit
# C:\Program Files\Autodesk\Revit 2027\Samples

# group: Entrées
# note: Sélectionner un élément Revit Floor par rapport auquel la nouvelle structure de pergola sera créée
sélectionner_le_sol_source = DSModelElementSelection()  # 1 picked in the model; graph input
# note: Hauteur de la structure
hauteur = DoubleSlider(8.4, range=0..10 step 0.1)  # graph input
nombre_de_poutres = IntegerSlider(9, range=2..10 step 1)  # graph input
# note: Sélectionner le niveau sur lequel placer la structure
niveau_de_la_structure = Levels("L1 - Block 43")  # graph input
# note: Sélectionnez un type d'ossature pour les poutres de périmètre. Ce type sera également utilisé pour créer un type d'ossature
structural_framing_types = StructuralFramingTypes("W12X26")  # graph input
# note: Sélectionner un type de famille pour les poteaux créés
types_de_poteaux_porteurs = StructuralColumnTypes(index=0)  # graph input

# group: Préparer la géométrie
# Préparer une expression solide propre de la géométrie de l'élément sélectionné
# note: Obtenir la géométrie de l'élément Revit
getGeometry = Element.GetGeometry(element=sélectionner_le_sol_source)
# note: Pour supprimer rapidement les ouvertures de l'élément, récupérer sa zone de délimitation, un cuboïde virtuel contenant l'élément
byMinimumVolume = BoundingBox.ByMinimumVolume(geom=getGeometry)
# note: Plus d'actions sont disponibles pour les solides que pour les zones de délimitation. Pour permettre d'autres transformations, convertir d'abord la zone de délimitation en cuboïde (qui est un type de solide)
toCuboid = BoundingBox.ToCuboid(boundingBox=byMinimumVolume)
# note: Translater le cuboïde en fonction d'une hauteur (zTranslation) définie par le curseur numérique dans la section Entrées du graphique
translate = Geometry.Translate(geometry=toCuboid, zTranslation=hauteur)

# group: Obtenir la surface supérieure des solides
# Évaluer toutes les surfaces du solide par l'élévation au centre et obtenir la surface supérieure
# note: Décomposer le solide en surfaces
explode = Geometry.Explode(geometry=translate)
code_block = CodeBlock { 0.5; }
# note: Localiser un point au centre de la surface
pointAtParameter = Surface.PointAtParameter(surface=explode, u=code_block, v=code_block)
# note: Obtenir une valeur numérique pour l'altitude de chaque point central
Z = Point.Z(point=pointAtParameter)
# note: Trier une liste par rapport à une autre : utiliser les valeurs d'élévation pour trier les surfaces
sortByKey = List.SortByKey(list=explode, keys=Z)
# note: La dernière surface de la liste est la surface supérieure
lastItem = List.LastItem(list=sortByKey.sortedList)

# group: Décaler une série de points sur la surface
# note: Utiliser une formule simple pour créer une séquence de valeurs allant de min (0.1) à max (0.9) avec un nombre d'étapes "n"
séquence_des_valeurs_u = CodeBlock(n=nombre_de_poutres) { 0.1..0.9..#n; }
décalages_des_arêtes = CodeBlock { [0.1,0.9]; }
# note: Positionner un réseau de points sur la surface à l'aide des paramètres U et V. Utiliser la combinaison de produits cartésiens (cliquer avec le bouton droit de la souris sur le noeud et choisissez Combinaison) pour générer un réseau.
pointAtParameter_2 = Surface.PointAtParameter(surface=lastItem, u=séquence_des_valeurs_u, v=décalages_des_arêtes, lacing=CrossProduct)

# group: Créer des lignes pour les poutres intérieures
# Relier des points et créer des lignes
index = CodeBlock { 0; 1; }
# note: Cliquer sur le symbole > à côté de l'entrée "list" pour utiliser les niveaux. Cela signifie que le résultat sera l'élément avec l'index 0 de chaque liste imbriquée la plus basse (@L2)
getItemAtIndex = List.GetItemAtIndex(list=pointAtParameter_2@L2, index=index.out0)
getItemAtIndex_2 = List.GetItemAtIndex(list=pointAtParameter_2@L2, index=index.out1)
byStartPointEndPoint = Line.ByStartPointEndPoint(startPoint=getItemAtIndex, endPoint=getItemAtIndex_2)

# group: Courbes pour les poutres de périmètre
firstItem = List.FirstItem(list=pointAtParameter_2)
lastItem_2 = List.LastItem(list=pointAtParameter_2)
byStartPointEndPoint_2 = Line.ByStartPointEndPoint(startPoint=firstItem, endPoint=lastItem_2)

# group: Courbes pour les poteaux
# Prendre chaque seconde rangée de points pour créer des lignes pour le placement des colonnes
code_block_2 = CodeBlock { 2; }
# note: Couper la liste en listes de 2
chop = List.Chop(list=pointAtParameter_2, lengths=code_block_2)
# note: Utiliser la logique des niveaux de liste et prendre uniquement la première liste à @L3
firstItem_2 = List.FirstItem(list=chop@L3)
inverser_la_hauteur = CodeBlock(H=hauteur) { -H; }
# note: Translater les points vers le bas
translate_2 = Geometry.Translate(geometry=firstItem_2, zTranslation=inverser_la_hauteur)
# note: Relier les points pour créer des lignes
byStartPointEndPoint_3 = Line.ByStartPointEndPoint(startPoint=translate_2, endPoint=firstItem_2)

# group: Vers Revit : placer des poutres en fonction de la courbe
# note: Placer des poutres intérieures
beamByCurve = StructuralFraming.BeamByCurve(curve=byStartPointEndPoint, level=niveau_de_la_structure, structuralFramingType=structural_framing_types)
# note: Placer les poutres du périmètre
beamByCurve_2 = StructuralFraming.BeamByCurve(curve=byStartPointEndPoint_2, level=niveau_de_la_structure, structuralFramingType=structural_framing_types)
# note: Placer les poteaux porteurs
columnByCurve = StructuralFraming.ColumnByCurve(curve=byStartPointEndPoint_3, level=niveau_de_la_structure, structuralColumnType=types_de_poteaux_porteurs)
