# Dynamo graph Revit Adaptive Component Placement.dyn (Dynamo 4.0.0.3076)
# author: Dynamo Team
# Questo grafico posiziona i componenti adattivi in base ai punti in un modello.

# group: Informazioni
# note: Le linee della griglia della facciata continua sono state preselezionate da Revit; gli ID elemento sono stati salvati con il file di Dynamo.
# note: Run this graph the Snowdon Towers Sample Architectural.rvt file in the Samples folder located with your Revit installation:
# C:\Program Files\Autodesk\Revit 2027\Samples
# Run this graph after you load the adaptive family AdaptivePanel.rfa from the Dynamo datasets location.
# note: Posiziona componenti adattivi rispetto ad alcuni elementi selezionati in un file di Revit.
# I componenti adattivi richiedono un gruppo di punti pari al numero di punti di posizionamento della famiglia in fase di posizionamento.

# group: Input
# note: Seleziona linee della griglia della facciata continua
seleziona_bordi = SelectEdges()  # 7 picked in the model; graph input
# note: Imposta lo spostamento minimo e massimo per il punto medio dell'aletta.
spostamento_minimo = DoubleSlider(1.4, range=0.2..3 step 0.1)
spostamento_massimo = DoubleSlider(4.3, range=3..8 step 0.1)
# note: Seleziona famiglia Componente adattivo
family_types = FamilyTypes("AdaptivePanel:AdaptivePanel")  # graph input

# note: Crea un elenco di posizioni dei punti lungo una curva, dove 0 è l'inizio, 0.5 è il centro e 1 è la fine.
elenco_di_parametri = CodeBlock { [0,0.5,1]; }
# note: Individua i punti iniziale, centrale e finale su ogni curva.
pointAtParameter = Curve.PointAtParameter(curve=seleziona_bordi, param=elenco_di_parametri, lacing=CrossProduct)

# group: Ottiene i punti iniziale e finale da ogni curva.
indici_dei_punti_iniziali_e = CodeBlock { 0; 2; }  # "indici dei punti iniziali e finali"
getItemAtIndex = List.GetItemAtIndex(list=pointAtParameter@L2, index=indici_dei_punti_iniziali_e.out0)
# note: Analogamente alla selezione del punto medio, utilizzare i livelli per selezionare i punti iniziale e finale da ogni curva.
getItemAtIndex_2 = List.GetItemAtIndex(list=pointAtParameter@L2, index=indici_dei_punti_iniziali_e.out1)

# group: Ottiene il punto medio da ogni curva.
indice_punto_medio = CodeBlock { 1; }
# note: Utilizzare i livelli dell'elenco dell'input "list". Per default, il risultato del nodo sarà l'elenco con l'indice uno (la seconda curva). Fare clic con il pulsante destro del mouse sull'input "list" e selezionare Usa livelli in corrispondenza di @L2. In questo modo verrà selezionato l'elemento con indice 1 da ogni elenco nidificato (punti centrali da ciascuna curva).
getItemAtIndex_3 = List.GetItemAtIndex(list=pointAtParameter@L2, index=indice_punto_medio)

# group: Crea un'onda sinusoidale.
# note: Conta il numero di curve di origine selezionate.
count = List.Count(list=seleziona_bordi)
# note: Crea una sequenza di valori N da 0 a 1.
sequence = CodeBlock(steps=count) { 0..1..#steps; }
# note: Crea un'onda sinusoidale.
sin = Math.Sin(angle=sequence)
# note: Riassocia i valori dell'onda sinusoidale ad un nuovo valore massimo e minimo.
remapRange = Math.RemapRange(numbers=sin, newMin=spostamento_minimo, newMax=spostamento_massimo)

# group: Sposta i punti medi.
# note: Per lo spostamento Y, negare il valore di spostamento verso l'esterno della facciata continua.
valore_negativo = CodeBlock(y=remapRange) { -y; }
# note: Sposta i punti centrali dell'aletta.
translate = Geometry.Translate(geometry=getItemAtIndex_3, yTranslation=valore_negativo, zTranslation=remapRange)

# note: Per lo spostamento Y, negare il valore di spostamento verso l'esterno della facciata continua.
valore_negativo_2 = CodeBlock(y=remapRange) { y; }
# note: Sposta i punti centrali dell'aletta.
translate_2 = Geometry.Translate(geometry=getItemAtIndex_3, yTranslation=valore_negativo_2, zTranslation=remapRange)

# group: Riunisce i punti in elenchi.
list_create = List.Create(item0=getItemAtIndex, item1=translate, item2=getItemAtIndex_2, item3=translate_2)
# note: Inverte la matrice e organizza gli elenchi in gruppi di 3.
transpose = List.Transpose(lists=list_create)

# group: In Revit: Posiziona componente
# note: I componenti adattivi possono essere posizionati utilizzando gruppi di punti uguali al numero di punti di posizionamento della famiglia.
byPoints = AdaptiveComponent.ByPoints(points=transpose, familyType=family_types)
