# Dynamo graph Revit Color.dyn "Colore di Revit" (Dynamo 4.0.0.3076)
# author: Dynamo Team
# Questo grafico valuta l'area di superficie degli elementi selezionati e applica Sostituzioni grafiche per colorare gli elementi in base a tale valore.

# group: Informazioni
# note: Eseguire questo grafico del file Snowdon Towers Sample Architectural.rvt nella cartella Esempi dell'installazione di Revit
# C:\Program Files\Autodesk\Revit 2027\Esempi
# note: Questo grafico colora gli elementi di Revit in base a criteri misurabili (Area superficie).
# Gli elementi vengono colorati utilizzando il metodo Sostituisci grafica vista > Per elemento.

# group: Seleziona elementi del modello
# Seleziona i muri della facciata.
# note: Fare clic su Modifica per scegliere elementi dal modello di Revit.
seleziona_elementi_modello = DSModelElementsSelection()  # 33 picked in the model; graph input

# group: Valuta area di superficie dell'elemento
# note: Ottieni geometria dell'elemento
getGeometry = Element.GetGeometry(element=seleziona_elementi_modello)
flatten = List.Flatten(list=getGeometry)
# note: Estrai area di superficie della geometria
area = Solid.Area(solid=flatten)
# note: Ottiene il valore massimo.
maximumItem = List.MaximumItem(list=area)
# note: Normalizza al valore massimo.
div = area / maximumItem  # graph output

# group: Crea colori
# Prepara lo schema colori per codificare gli elementi.
number = DoubleInput(0)
number_2 = DoubleInput(255)
# note: colore verde
byARGB = Color.ByARGB(alpha=number, red=number, green=number_2, blue=number, lacing=Longest)
number_3 = DoubleInput(0)
number_4 = DoubleInput(255)
# note: colore rosso
byARGB_2 = Color.ByARGB(alpha=number_3, red=number_4, green=number_3, blue=number_3, lacing=Longest)
create = List.Create(item0=byARGB, item1=byARGB_2)
code_block = CodeBlock { [0,1]; }
# note: Imposta gamma di colori
color_range = ColorRange(colors=create, indices=code_block, value=div)

# group: In Revit: Sostituisci il colore dell'elemento nella vista
# note: In questo modo viene sostituito il colore dell'elemento nella vista attiva.
overrideColorInView = Element.OverrideColorInView(element=seleziona_elementi_modello, color=color_range, lacing=Longest)

# group: Soglia
number_5 = DoubleInput(100)

# group: In alternativa, valutare se i criteri superano una determinata soglia.
# note: Esegue il confronto con un valore soglia.
gt = area > number_5
# note: I numeri indicano la posizione nello spettro dei colori, da 0 a 1.
number_6 = DoubleInput(1)
number_7 = DoubleInput(0)
# note: Identifica le aree all'interno di una tolleranza
if_ = RefactoredIf(test=gt, true=number_6, false=number_7)
# note: questo risultato può essere utilizzato come input "indices" del nodo Color Range
watch = Watch(if_)
