# Dynamo graph Revit Floors and Framing.dyn "Pavimenti e telai di Revit" (Dynamo 4.0.0.3076)
# author: Dynamo Team
# Questo grafico crea un capriccio architettonico utilizzando una serie di linee e il relativo spostamento per posizionare gli elementi Telaio strutturale e Pavimento in Revit.
# packages: Motore PythonNet3 1.4.5

# group: Informazioni
# note: Eseguire questo grafico del file Snowdon Towers Sample Architectural.rvt nella cartella Esempi dell'installazione di Revit
# C:\Program Files\Autodesk\Revit 2027\Esempi
# note: Questo grafico crea un capriccio architettonico, utilizzando una serie di linee che vengono poi impiegate per guidare il posizionamento di telaio strutturale e pavimenti.

# group: Posizione del centro del capriccio
posizione_x = DoubleSlider(30, range=25..40 step 1)  # graph input
posizione_y = DoubleSlider(30, range=25..40 step 1)  # graph input
posizione_z = DoubleSlider(62, range=60..80 step 1)  # graph input

# group: Configurazione del capriccio
# Descrizione <Fare doppio clic qui per modificare la descrizione del gruppo>
raggio_pavimento_inferiore = DoubleSlider(10, range=8..20 step 1)  # graph input
n_di_pavimenti = DoubleSlider(7, range=3..10 step 1)  # graph input
riduzione_raggio = DoubleSlider(-1.25, range=-2..-0.5 step 0.25)  # graph input
numero_di_lati_del_poligono = IntegerSlider(5, range=3..10 step 1)  # graph input
altezza_pavimento_superiore = DoubleSlider(38.4, range=15..50 step 0.1)  # graph input
rotazione_massima_gradi = DoubleSlider(130, range=10..180 step 5)  # graph input

# group: Costruisci poligoni
# Crea una serie di poligoni con un raggio decrescente, con offset verticale, ruotati in sequenza.
# note: Centro edificio decorativo
byCoordinates = Point.ByCoordinates(x=posizione_x, y=posizione_y, z=posizione_z)
# note: Sequenza di raggi del cerchio
sequence = Sequence(start=raggio_pavimento_inferiore, amount=n_di_pavimenti, step=riduzione_raggio, lacing=Longest)
# note: Crea una serie di cerchi
byCenterPointRadius = Circle.ByCenterPointRadius(centerPoint=byCoordinates, radius=sequence)
# note: Crea una serie di poligoni
regularPolygon = Polygon.RegularPolygon(circle=byCenterPointRadius, numberSides=numero_di_lati_del_poligono)
# note: Sequenza di quote altimetriche del pavimento
sequenza_altezze_pavimento = CodeBlock(top_floor=altezza_pavimento_superiore, count=n_di_pavimenti) { 0..top_floor..#count; }
byCoordinates_2 = Vector.ByCoordinates(z=sequenza_altezze_pavimento)
# note: Sposta i poligoni in alto di un'altezza specificata
translate = Geometry.Translate(geometry=regularPolygon, direction=byCoordinates_2)
ZAxis = Vector.ZAxis()
# note: Sequenza di rotazioni per ogni pavimento
sequenza_angoli_di_rotazione = CodeBlock(max_degrees=rotazione_massima_gradi, count=n_di_pavimenti) { 0..max_degrees..#count; }
# note: Ruota i poligoni con una serie di angoli.
rotate = Geometry.Rotate(geometry=translate, origin=byCoordinates, axis=ZAxis, degrees=sequenza_angoli_di_rotazione)
# note: Estrae singole curve dai poligoni
curves = PolyCurve.Curves(polyCurve=rotate)

# group: Tipo e livello di pavimento
# note: Selezionare il tipo per i pavimenti creati dai tipi esistenti nel progetto utilizzando l'elenco a discesa.
floor_types = FloorTypes("Concrete Slab 6\"")  # graph input
levels = Levels("Green Roof Hardscape")  # graph input

# group: In Revit: Crea pavimenti
# Utilizza la serie di linee chiuse delle curve come input per la creazione del pavimento.
# note: Passa gruppi di curve per creare pavimenti
byOutlineTypeAndLevel = Floor.ByOutlineTypeAndLevel(outline=curves, floorType=floor_types, level=levels)

# group: Collegamenti verticali
# Collega gli angoli dei poligoni tra i livelli del capriccio.
# note: Ottieni punti finali di ogni curva del poligono
endPoint = Curve.EndPoint(curve=curves)
# note: Inverte la matrice e ottiene elenchi di punti finali allineati verticalmente.
transpose = List.Transpose(lists=endPoint)
# note: Collega gli angoli corrispondenti dei poligoni dal livello del capriccio più basso al più alto, unendoli come PolyCurve.
byPoints = PolyCurve.ByPoints(points=transpose)
# note: Decostruisce PolyCurve e ottiene elenchi di curve da utilizzare come input per elementi telaio strutturale.
curves_2 = PolyCurve.Curves(polyCurve=byPoints)

# group: Tipo e livello di telaio strutturale
levels_2 = Levels("Green Roof Hardscape")  # graph input
# note: Selezionare il tipo di telaio strutturale dai tipi caricati nel progetto utilizzando l'elenco a discesa.
structural_framing_types = StructuralFramingTypes("W12X26")  # graph input

# group: In Revit: Crea telaio strutturale
# Utilizza le curve per creare elementi Telaio strutturale e utilizza un nodo Python per impedire il giunto tra singole travi.
# note: Passa singole curve per ogni elemento strutturale
beamByCurve = StructuralFraming.BeamByCurve(curve=curves_2, level=levels_2, structuralFramingType=structural_framing_types)
# note: Prepara l'elenco.
flatten = List.Flatten(list=beamByCurve)
# note: Questo è un nodo Python rinominato che fa riferimento all'API di Revit per estendere le funzionalità di Dynamo al di là dei nodi predefiniti. Per leggere il codice Python, fare clic con il pulsante destro del mouse sul nodo e scegliere Modifica.
impedisci_giunti_sul_telaio = Python(structuralFraming=flatten)  # "Impedisci giunti sul telaio strutturale"; PythonNet3
# ---------- impedisci_giunti_sul_telaio.python (35 lines) ----------
# Load the Python Standard and DesignScript Libraries
import sys
import clr
clr.AddReference('ProtoGeometry')
from Autodesk.DesignScript.Geometry import *
from Autodesk.Revit.DB import *
from RevitServices.Transactions import TransactionManager
from RevitServices.Persistence import DocumentManager 

doc = DocumentManager.Instance.CurrentDBDocument

# The inputs to this node will be stored as a list in the IN variables.
dataEnteringNode = IN

# Place your code below this line
structural_framing = UnwrapElement(IN[0])

unjoined_elements = []
# start a Transaction
TransactionManager.Instance.EnsureInTransaction(doc)
# iterate through each structural framing element
for sf in structural_framing:
    # check if the element passed in of Structural Framing Category
    sf_category = sf.Category # get the element's Category
    # use the Structural Framing's Category Id to check
    if sf_category.Id.Value == -2001320:
        # disallow joins at start and end of the structural framing element
        Structure.StructuralFramingUtils.DisallowJoinAtEnd(sf, 0)
        Structure.StructuralFramingUtils.DisallowJoinAtEnd(sf, 1)
        unjoined_elements.append(sf)
TransactionManager.Instance.TransactionTaskDone()

    
# Output the list of elements with Disallowed Join
OUT = unjoined_elements
# ----------------------------------------
