# Dynamo graph Revit Geometry Creation Curves.dyn "Curve di creazione della geometria di Revit" (Dynamo 4.0.0.3076)
# author: Dynamo Team
# Questo grafico mostra diversi metodi per creare curve in Dynamo e utilizzarle per creare elementi di Revit (linee modello).

# group: Informazioni
# note: Questo grafico utilizza diversi metodi per creare curve da impiegare come input per la creazione di curve modello di Revit.
# note: Eseguire questo grafico del file Snowdon Towers Sample Architectural.rvt nella cartella Esempi dell'installazione di Revit
# C:\Program Files\Autodesk\Revit 2027\Esempi

# group: Quattro punti
# Descrizione <Fare doppio clic qui per modificare la descrizione del gruppo>
number = DoubleInput(-35)
number_2 = DoubleInput(-55)
byCoordinates = Point.ByCoordinates(x=number, y=number_2)
number_3 = DoubleInput(-40)
byCoordinates_2 = Point.ByCoordinates(x=number, y=number_3)
number_4 = DoubleInput(-10)
byCoordinates_3 = Point.ByCoordinates(x=number_4, y=number_3)
number_5 = DoubleInput(-17)
number_6 = DoubleInput(-60)
byCoordinates_4 = Point.ByCoordinates(x=number_5, y=number_6)

list_create = List.Create(item0=byCoordinates, item1=byCoordinates_2, item2=byCoordinates_3, item3=byCoordinates_4)

# group: Crea la curva modello dalla curva NURBS (da punti).
# note: Crea una curva NURBS da un elenco di punti.
byPoints = NurbsCurve.ByPoints(points=list_create)
# note: Utilizza la curva NURBS per creare una linea modello di Revit.
byCurve = ModelCurve.ByCurve(curve=byPoints)

# group: Crea la curva modello dalla curva NURBS (da punti di controllo).
boolean = BoolSelector(false)
# note: Crea una curva NURBS da un elenco di punti come punti di controllo.
byControlPoints = NurbsCurve.ByControlPoints(points=list_create, closeCurve=boolean)
# note: Utilizza la curva NURBS per creare una linea modello di Revit.
byCurve_2 = ModelCurve.ByCurve(curve=byControlPoints)

# group: Crea la curva modello da PolyCurve.
# note: Crea una PolyCurve da un elenco di punti.
byPoints_2 = PolyCurve.ByPoints(points=list_create)
curves = PolyCurve.Curves(polyCurve=byPoints_2)
# note: Utilizza l'elenco di curve per creare un gruppo di linee modello di Revit.
byCurve_3 = ModelCurve.ByCurve(curve=curves)

# group: Crea la curva modello dalla linea.
# note: Crea una curva da due punti.
byStartPointEndPoint = Line.ByStartPointEndPoint(startPoint=byCoordinates, endPoint=byCoordinates_2)
# note: Utilizza la linea (curva) per creare una curva modello di Revit.
byCurve_4 = ModelCurve.ByCurve(curve=byStartPointEndPoint)
