# Dynamo graph Revit Geometry Creation Points.dyn "Punti di creazione della geometria di Revit" (Dynamo 4.0.0.3076)
# author: Dynamo Team
# Questo grafico crea una linea modello e un punto di riferimento nell'ambiente della famiglia Massa concettuale.

# group: Informazioni
# note: È possibile passare dalla navigazione nell'anteprima sfondo 3D alla navigazione nella vista grafico e viceversa utilizzando i pulsanti nell'angolo superiore destro della schermata (tasto di scelta rapida CTRL+B). È inoltre possibile attivare e disattivare Anteprima sfondo nel menu Visualizza, per Dynamo e Revit.
# note: Eseguire questo grafico in un ambiente della famiglia Massa concettuale o Modelli generico adattivo.
# Per creare una nuova famiglia, accedere a File > Nuova famiglia > e selezionare il modello che si trova nella cartella:
# C:\ProgramData\Autodesk\RVT 2027\Family Templates\English-Imperial\Generic Model Adaptive.rft
# note: Questo grafico crea una linea modello e un punto di riferimento nell'ambiente della famiglia.

# group: Coordinate del punto
valore_x_del_punto = DoubleSlider(50, range=5..50 step 5)  # graph input
valore_y_del_punto = DoubleSlider(25, range=5..50 step 5)  # graph input
valore_z_del_punto = DoubleSlider(25, range=5..50 step 5)  # graph input

# note: Manipola la posizione del punto nell'ambiente di Dynamo: selezionare il nodo Point.ByCoordinates e passare ad Anteprima Sfondo per trascinare il punto lungo i suoi tre assi.
byCoordinates = Point.ByCoordinates(x=valore_x_del_punto, y=valore_y_del_punto, z=valore_z_del_punto)
# note: I dati geometrici possono essere visualizzati come informazioni di testo o in uno spazio 3D
watch = Watch(byCoordinates)
byCoordinates_2 = Point.ByCoordinates()
byStartPointEndPoint = Line.ByStartPointEndPoint(startPoint=byCoordinates_2, endPoint=byCoordinates)
# note: Visualizza l'anteprima della geometria.
watch_3d = Watch3D(byStartPointEndPoint)
# note: Crea una curva modello collegando due punti.
byCurve = ModelCurve.ByCurve(curve=byStartPointEndPoint)
# note: Dynamo è in grado di creare e modificare solo gli elementi appropriati al file a cui è associato. Ad esempio, è possibile creare punti di riferimento solo in alcuni ambienti delle famiglie (ad esempio, Modello generico adattivo), mentre le linee modello possono essere create quasi ovunque.
byPoint = ReferencePoint.ByPoint(pt=byCoordinates)
