# Dynamo graph Revit Geometry Creation Solids.dyn "Solidi di creazione della geometria di Revit" (Dynamo 4.0.0.3076)
# author: Dynamo Team
# Questo grafico presenta diversi metodi per la creazione di geometria solida in Dynamo e l'integrazione in Revit. Alcuni metodi possono essere utilizzati in un ambiente di progetto, mentre altri solo in alcuni ambienti delle famiglie (Massa concettuale).

# group: Informazioni
# note: Esistono più metodi di creazione per la maggior parte dei solidi. Questi esempi mostrano i profili chiusi come base, ma le PolySurface possono essere unite, sono disponibili molte primitive (superfici, cuboide, cono e così via).
# Per integrare la geometria nell'ambiente di Revit, è necessario prima convertirla in un elemento di Revit.
# I solidi possono essere trasformati in un'istanza importata che sarà visibile sia negli ambienti di progetto che in quelli della famiglia di modelli.
# È possibile convertire anche la geometria dei solidi in un elemento Forma disponibile solo per gli ambienti della famiglia Massa concettuale e Componente adattivo.
# note: Questo grafico utilizza diversi metodi per creare la geometria dei solidi in Revit. Alcuni metodi possono essere utilizzati in un ambiente di progetto, mentre altri solo in alcuni ambienti delle famiglie.
# Utilizzare un modello della famiglia Massa concettuale per visualizzare tutti i metodi.
# Per aprire una famiglia Massa concettuale, accedere a File > Nuovo > Famiglia > e selezionare il modello Mass.rft\Conceptual Mass\Mass.rft.

# group: Prepara punti
# Genera un gruppo di punti per creare la geometria.
byCoordinates = Point.ByCoordinates()
number = DoubleInput(10)
byCoordinates_2 = Point.ByCoordinates(x=number)
number_2 = DoubleInput(5)
byCoordinates_3 = Point.ByCoordinates(z=number_2)
number_3 = DoubleInput(10)
byCoordinates_4 = Point.ByCoordinates(y=number_3)
number_4 = DoubleInput(15)
byCoordinates_5 = Point.ByCoordinates(x=number_4, y=number_4)
number_5 = DoubleInput(5)
number_6 = DoubleInput(10)
byCoordinates_6 = Point.ByCoordinates(x=number_5, y=number_6, z=number_6)
number_7 = DoubleInput(-2)
number_8 = DoubleInput(5)
byCoordinates_7 = Point.ByCoordinates(x=number_7, y=number_8)

# group: Primo profilo
# Crea un primo profilo come curva chiusa da un arco e una linea.
byStartPointEndPoint = Line.ByStartPointEndPoint(startPoint=byCoordinates, endPoint=byCoordinates_2)
byThreePoints = Arc.ByThreePoints(firstPoint=byCoordinates, secondPoint=byCoordinates_3, thirdPoint=byCoordinates_2)
create = List.Create(item0=byStartPointEndPoint, item1=byThreePoints)
# note: Primo profilo per il loft
byJoinedCurves = PolyCurve.ByJoinedCurves(curves=create)

# group: Secondo profilo
# Crea un secondo profilo come curva chiusa da un arco e una linea.
byStartPointEndPoint_2 = Line.ByStartPointEndPoint(startPoint=byCoordinates_4, endPoint=byCoordinates_5)
byThreePoints_2 = Arc.ByThreePoints(firstPoint=byCoordinates_4, secondPoint=byCoordinates_6, thirdPoint=byCoordinates_5)
create_2 = List.Create(item0=byStartPointEndPoint_2, item1=byThreePoints_2)
# note: Secondo profilo per il loft
byJoinedCurves_2 = PolyCurve.ByJoinedCurves(curves=create_2)

# note: Unisce due profili in un elenco.
create_3 = List.Create(item0=byJoinedCurves, item1=byJoinedCurves_2)

# group: Loft del solido per sezioni trasversali
# Descrizione <Fare doppio clic qui per modificare la descrizione del gruppo>
byLoft = Solid.ByLoft(crossSections=create_3)

# note: Esamina il volume del solido.
volume = Solid.Volume(solid=byLoft)

# group: Crea involucro
code_block = CodeBlock { 0; }
# note: Suggerimento: disattivare l'anteprima nei menu di scelta rapida dei nodi per escludere elementi dalla visualizzazione
thinShell = Solid.ThinShell(solid=byLoft, internalFaceThickness=code_block)

# group: Trasla geometria
code_block_2 = CodeBlock { Vector.ByCoordinates(20,0,0); }
# note: Trasla la geometria sul lato per visualizzare in anteprima sia il risultato originale che quello finale.
translate = Geometry.Translate(geometry=thinShell, direction=code_block_2)

# group: Ritaglia solido
# Utilizza l'operazione di ritaglio per tagliare l'involucro solido con un piano.
code_block_3 = CodeBlock { Point.ByCoordinates(0,0,5); }
ZAxis = Vector.ZAxis()
byOriginNormal = Plane.ByOriginNormal(origin=code_block_3, normal=ZAxis)
number_9 = DoubleInput(10)
# note: Scegliere il lato del ritaglio da mantenere (il lato più vicino al punto verrà ignorato).
byCoordinates_8 = Point.ByCoordinates(x=number_9, y=number_9, z=number_9)
# note: Le operazioni booleane geometriche (intersezione, differenza, unione e così via) sono disponibili nella categoria Geometria.
trim = Geometry.Trim(geometry=translate, other=byOriginNormal, pick=byCoordinates_8)

# group: Curva guida
# Crea una curva NURBS da utilizzare come curva guida per la forma del solido di loft.
create_4 = List.Create(item0=byCoordinates, item1=byCoordinates_7, item2=byCoordinates_4)
# note: Curva guida costruita come curva NURBS
byPoints = NurbsCurve.ByPoints(points=create_4)

# group: Loft del solido per sezioni trasversali e curve guida
# note: Suggerimento: disattivare l'anteprima nei menu di scelta rapida dei nodi per escludere elementi dalla visualizzazione
byLoft_2 = Solid.ByLoft(crossSections=create_3, guideCurves=byPoints)

# group: Crea istanza importata
code_block_4 = CodeBlock { Vector.ByCoordinates(-20,0,0); }
translate_2 = Geometry.Translate(geometry=byLoft_2, direction=code_block_4)
# note: Un elemento di geometria è diverso da un elemento di Revit.
# Utilizzare ImportInstance per creare importazioni di Revit da superfici e solidi in qualsiasi ambiente Revit o i punti e le curve per posizionare istanze di famiglia. In alternativa, creare famiglie di forme di massa e di modelli generici in base a punti (componenti adattivi)
byGeometries = ImportInstance.ByGeometries(geometries=translate_2)
byCoordinates_9 = Vector.ByCoordinates()

# group: Crea forma
# Utilizzando due linee chiuse delle curve di profilo, crea un elemento Forma (nell'ambiente della famiglia Massa concettuale).
curves = PolyCurve.Curves(polyCurve=create_3)
# note: Crea curve modello da curve.
referenceCurveByCurve = ModelCurve.ReferenceCurveByCurve(curve=curves)
# note: Le forme possono essere create solo come parte di una famiglia Massa concettuale.
byLoftCrossSections = Form.ByLoftCrossSections(curves=referenceCurveByCurve)
