# Dynamo graph Revit Geometry Creation Surfaces.dyn "Superfici di creazione della geometria di Revit" (Dynamo 4.0.0.3076)
# author: Dynamo Team
# Questo grafico presenta diversi metodi di creazione delle superfici in Dynamo e due metodi di conversione della geometria in geometria di Revit.

# group: Informazioni
# note: Questo grafico utilizza diversi metodi per creare la geometria di superficie in Revit. Alcuni metodi possono essere utilizzati in un ambiente di progetto, altri solo in determinati ambienti delle famiglie.
# Utilizzare un modello della famiglia Massa concettuale per visualizzare tutti i metodi.
# Creare una famiglia Massa concettuale accedendo a File > Nuovo > Famiglia e selezionare il modello Mass.rft nella cartella Conceptual Mass.
# note: Esistono più metodi di creazione per la maggior parte delle superfici. Le superfici, le PolySurface (raccolte di superfici) e le superfici NURBS possono essere create da punti, curve e derivate da altre superfici e solidi mediante varie operazioni.
# note: Per integrare la geometria nell'ambiente di Revit, prima è necessario convertirla in un elemento di Revit.
# È possibile trasformare le superfici e i solidi in un'istanza importata che sarà visibile sia negli ambienti di progetto che della famiglia di modelli.
# È inoltre possibile convertire la geometria di superficie in un elemento Forma disponibile solo per gli ambienti della famiglia Massa concettuale e Componente adattivo.

# group: Prepara punti
# Genera un gruppo di punti per creare la geometria.
number = DoubleInput(10)
byCoordinates = Point.ByCoordinates(y=number)
number_2 = DoubleInput(5)
number_3 = DoubleInput(10)
byCoordinates_2 = Point.ByCoordinates(x=number_2, y=number_3, z=number_3)
number_4 = DoubleInput(15)
byCoordinates_3 = Point.ByCoordinates(x=number_4, y=number_4)
byCoordinates_4 = Point.ByCoordinates()
number_5 = DoubleInput(5)
byCoordinates_5 = Point.ByCoordinates(z=number_5)
byCoordinates_6 = Point.ByCoordinates(x=number)
number_6 = DoubleInput(-5)
number_7 = DoubleInput(5)
byCoordinates_7 = Point.ByCoordinates(x=number_6, y=number_7)
number_8 = DoubleInput(10)
number_9 = DoubleInput(-10)
byCoordinates_8 = Point.ByCoordinates(x=number_8, y=number_9)
byCoordinates_9 = Point.ByCoordinates(y=number_9)

# group: Crea profili
byThreePoints = Arc.ByThreePoints(firstPoint=byCoordinates, secondPoint=byCoordinates_2, thirdPoint=byCoordinates_3)
byThreePoints_2 = Arc.ByThreePoints(firstPoint=byCoordinates_4, secondPoint=byCoordinates_5, thirdPoint=byCoordinates_6)
byThreePoints_3 = Arc.ByThreePoints(firstPoint=byCoordinates_4, secondPoint=byCoordinates_7, thirdPoint=byCoordinates)
byStartPointEndPoint = Line.ByStartPointEndPoint(startPoint=byCoordinates_8, endPoint=byCoordinates_9)

# group: Superficie da estrusione su percorso
# Utilizza un profilo, una curva di traiettoria e una guida per creare una superficie di estrusione su percorso.
bySweep2Rails = Surface.BySweep2Rails(path=byThreePoints, guideRail=byThreePoints_2, profile=byThreePoints_3)

# group: Crea importazione
# note: Utilizzare Istanza importata per creare importazioni di Revit da superfici e solidi. Queste importazioni saranno visibili in qualsiasi ambiente di Revit.
byGeometries = ImportInstance.ByGeometries(geometries=bySweep2Rails)

create = List.Create(item0=byStartPointEndPoint, item1=byThreePoints_2)

# group: Crea superficie da loft
# Unisce sezioni trasversali per creare una superficie di loft.
byLoft = Surface.ByLoft(crossSections=create)

# group: Valuta area di superficie
area = Surface.Area(surface=byLoft)
watch = Watch(area)
create_2 = List.Create(item0=byLoft, item1=bySweep2Rails)
# note: Le superfici unite come PolySurface possono essere valutate come se si trattasse di un'entità singola
byJoinedSurfaces = PolySurface.ByJoinedSurfaces(surfaces=create_2)
area_2 = Surface.Area(surface=byJoinedSurfaces)
watch_2 = Watch(area_2)
area_3 = Surface.Area(surface=bySweep2Rails)
watch_3 = Watch(area_3)

# group: Superficie NURBS da punti di controllo
# Converte un'estrusione su percorso in una superficie NURBS da punti di controllo.
code_block = CodeBlock { 0..1..0.1; }
# note: I bordi, i punti e altre funzionalità possono essere derivati da superfici utilizzando operazioni appropriate per tali geometrie.
pointAtParameter = Surface.PointAtParameter(surface=bySweep2Rails, u=code_block, v=code_block, lacing=CrossProduct)
# note: Ricostruisce la superficie come superficie NURBS da punti di controllo.
byControlPoints = NurbsSurface.ByControlPoints(controlVertices=pointAtParameter)
# note: Utilizzare il nodo 3D Watch per visualizzare l'anteprima della geometria isolata.
watch_3d = Watch3D(byControlPoints)

# group: Superficie da curva di estrusione
# Utilizza una curva per creare un'estrusione con una distanza specificata.
code_block_2 = CodeBlock { 10; }
extrude = Curve.Extrude(curve=byThreePoints, distance=code_block_2)

# group: Crea forma
# Crea una forma di loft da due curve.
referenceCurveByCurve = ModelCurve.ReferenceCurveByCurve(curve=create)
byLoftCrossSections = Form.ByLoftCrossSections(curves=referenceCurveByCurve)
