# Dynamo graph Revit Import Solid.dyn "Solido di importazione di Revit" (Dynamo 4.0.0.3076)
# author: Dynamo Team
# Questo grafico illustra un metodo per creare la geometria solida di Dynamo e utilizzarla per creare un elemento Istanza importata di Revit. Costruire una nuova forma di tetto creando una serie di profili di arco e utilizzandoli per creare una superficie di loft.

# group: Informazioni
# note: L'elemento di origine (tetto) è stato preselezionato da Revit, con gli ID elemento salvati con il file di Dynamo.
# note: Eseguire questo grafico del file Snowdon Towers Sample Architectural.rvt nella cartella Esempi dell'installazione di Revit
# C:\Program Files\Autodesk\Revit 2027\Esempi
# note: Costruisce una nuova forma del tetto da un elemento del tetto selezionato creando una serie di profili di arco e utilizzandoli per creare una superficie di loft. La geometria viene convertita in un'istanza importata per integrarla nell'ambiente di Revit.

# group: Configurazione del nuovo tetto
# note: Numero di profili da cui verrà creata la superficie di loft
numero_di_profili = IntegerSlider(6, range=3..10 step 1)
# note: Altezza alle estremità corte del nuovo tetto
sezione_tetto_minima = DoubleSlider(2.1, range=1..5 step 0.1)
# note: Altezza al centro del tetto
sezione_tetto_massima = DoubleSlider(7, range=5..10 step 0.1)
# note: Estende i profili arco lateralmente in base a questo valore.
estensione_lati_tetto = DoubleSlider(0.5, range=0.1..3 step 0.1)
# note: Spessore della forma del nuovo tetto
spessore_tetto = DoubleSlider(0.5, range=0.1..2 step 0.1)

n_di_profili = CodeBlock(steps=numero_di_profili) { steps; }

# group: Seleziona tetto
# Seleziona l'elemento tetto di origine.
# note: Tutti gli input contrassegnati come "IsInput" possono essere impostati dal Lettore Dynamo.
seleziona_tetto_piano = DSModelElementSelection()  # 1 picked in the model

# group: Ottieni faccia tetto
# Esplode la geometria dell'elemento di origine e seleziona una faccia con l'area più grande.
# note: Per ottenere la faccia dell'elemento selezionato, innanzitutto ottenere la geometria corrispondente.
# note: Fare clic con il pulsante destro del mouse e deselezionare Anteprima geometria per una vista più chiara del risultato finale.
getGeometry = Element.GetGeometry(element=seleziona_tetto_piano)
# note: Esplode la geometria per ottenere singole facce.
explode = Geometry.Explode(geometry=getGeometry)
# note: Elimina la struttura dell'elenco. Tenere presente che questo passaggio non è necessario se vengono utilizzati più oggetti di origine.
flatten = List.Flatten(list=explode)
area = Surface.Area(surface=flatten)
# note: Ordina l'elenco delle superfici in base alla relativa area. La superficie con le aree più grandi sarà l'ultimo elemento dell'elenco dell'output SortList.
sortByKey = List.SortByKey(list=flatten, keys=area)
lastItem = List.LastItem(list=sortByKey.sortedList)
number = DoubleInput(1.5)
# note: Trasla la superficie verso l'alto.
translate = Geometry.Translate(geometry=lastItem, zTranslation=number)

# group: Offset verso l'esterno (scala)
# Mette in scala la superficie per estenderne i bordi verso l'esterno.
posizione_uv = CodeBlock { 0.5; }
pointAtParameter = Surface.PointAtParameter(surface=translate, u=posizione_uv, v=posizione_uv)
scala_da_punto_a_punto = CodeBlock { point1 = Point.ByCoordinates(1, 1); point2 = Point.ByCoordinates(-40, -40); }
scale = Geometry.Scale(geometry=translate, basePoint=pointAtParameter, from=scala_da_punto_a_punto.point1, to=scala_da_punto_a_punto.point2)

# group: Punti sulla superficie
# Genera tre elenchi di punti equidistanti: due righe lungo i bordi più lunghi e una riga al centro.
# note: 0 e 1 sono posizioni lungo i bordi più lunghi della superficie.
posizioni_u_per_le_righe_dei = CodeBlock { [0,1]; }  # "Posizioni U per le righe dei bordi"
# note: Posizioni V lungo i bordi più lunghi, in una sequenza da 0 a 1 e N incrementi
posizioni_v_per_le_righe_dei = CodeBlock(steps=n_di_profili) { [0..1..#steps]; }  # "Posizioni V per le righe dei bordi"
# note: Utilizzare l'impostazione Collegamento più lungo facendo clic con il pulsante destro del mouse sul nodo > Collegamento.
# Il collegamento più lungo corrisponderà agli input con diverse strutture di elenchi. In questo caso, il risultato sarà costituito da due elenchi di punti, dove il numero di punti in ogni elenco corrisponde all'elenco di input più lungo.
pointAtParameter_2 = Surface.PointAtParameter(surface=scale, u=posizioni_u_per_le_righe_dei, v=posizioni_v_per_le_righe_dei, lacing=Longest)
# note: Il valore U di 0.5 posizionerà i punti lungo il centro della superficie.
posizione_u_per_la_riga_centrale = CodeBlock { [0.5]; }
# note: Posizioni V lungo la riga centrale dei punti, in una sequenza da 0 a 1 e N incrementi
posizioni_v_per_la_riga_centrale = CodeBlock(steps=n_di_profili) { [0..1..#steps]; }
# note: Per questo nodo viene utilizzato Collegamento più lungo. Il risultato è un elenco di punti, dove il numero di punti nell'elenco corrisponde all'elenco di input più lungo.
pointAtParameter_3 = Surface.PointAtParameter(surface=scale, u=posizione_u_per_la_riga_centrale, v=posizioni_v_per_la_riga_centrale, lacing=Longest)

# group: Offset di punti verso l'alto
# Esegue l'offset dei punti della riga centrale nella forma di un'onda coseno.
# note: una sequenza di valori per generare una serie di offset
sequenza_di_angoli = CodeBlock(steps=n_di_profili) { -1..1..#steps; }
# note: Alternativa: utilizzare il seno per una forma del tetto diversa
sin = Math.Sin(angle=sequenza_di_angoli)
# note: valori in un'onda coseno
cos = Math.Cos(angle=sequenza_di_angoli)
# note: Riassegna i valori ad un nuovo dominio.
remapRange = Math.RemapRange(numbers=cos, newMin=sezione_tetto_minima, newMax=sezione_tetto_massima)
# note: Trasla i punti della riga centrale.
translate_2 = Geometry.Translate(geometry=pointAtParameter_3@L2, zTranslation=remapRange)

# group: Crea profili da archi
# Utilizza i punti per creare archi.
# note: Unisce il bordo e le righe centrali in un elenco.
join = List.Join(list0=pointAtParameter_2, list1=translate_2)
indice_elemento = CodeBlock { 0; 1; 2; }
getItemAtIndex = List.GetItemAtIndex(list=join, index=indice_elemento.out0)
getItemAtIndex_2 = List.GetItemAtIndex(list=join, index=indice_elemento.out2)
getItemAtIndex_3 = List.GetItemAtIndex(list=join, index=indice_elemento.out1)
byThreePoints = Arc.ByThreePoints(firstPoint=getItemAtIndex, secondPoint=getItemAtIndex_2, thirdPoint=getItemAtIndex_3)

# group: Estendi profili
# Estende le curve di ogni profilo di una distanza specificata.
# note: Il valore dell'estensione viene impostato come input nel lato sinistro del grafico.
estendi_bordi = CodeBlock(roof_extension=estensione_lati_tetto) { roof_extension; }
extendStart = Curve.ExtendStart(curve=byThreePoints, distance=estendi_bordi)
extendEnd = Curve.ExtendEnd(curve=extendStart, distance=estendi_bordi)

# group: Esegui loft e ispessisci
# Crea una superficie loft e le conferisce spessore.
byLoft = Surface.ByLoft(crossSections=extendEnd)
thicken = Surface.Thicken(surface=byLoft, thickness=spessore_tetto)

# group: In Revit:
# Converte la geometria di Dynamo in un elemento di Revit tramite ImportInstance e imposta il parametro del livello.
# note: Per integrare la geometria nell'ambiente di Revit, è necessario convertirla in un elemento di Revit.
# I solidi possono essere trasformati in un'istanza importata che sarà visibile sia negli ambienti di progetto che in quella della famiglia di modelli.
byGeometry = ImportInstance.ByGeometry(geometry=thicken)
code_block = CodeBlock { "Piano di lavoro"; }
levels = Levels("L1 - Block 43")
# note: Correggere l'altezza dell'istanza importata posizionata impostando il parametro Piano di lavoro sul livello al quale la quota altimetrica corrisponde alla posizione dell'origine interna.
setParameterByName = Element.SetParameterByName(element=byGeometry, parameterName=code_block, value=levels)
