# Dynamo graph Revit Place Families By Level Set Parameters.dyn "Impostazione parametri posizionamento famiglie per livello di Revit" (Dynamo 4.0.0.3076)
# author: Dynamo Team
# Questo grafico illustra come posizionare gli elementi di Revit in base al punto. Posiziona le righe di sedie nel locale selezionato e scrive numeri univoci nel parametro Contrassegno.

# group: Informazioni
# note: Eseguire questo grafico del file Snowdon Towers Sample Architectural.rvt nella cartella Esempi dell'installazione di Revit
# C:\Programmi\Autodesk\Revit 2027\Esempi
# note: Posiziona le righe di sedie nel locale selezionato e scrive numeri univoci nel parametro Contrassegno.

# group: Seleziona elementi di Revit
# note: Selezionare il tipo di famiglia per le istanze in fase di posizionamento dai tipi di famiglia nel progetto.
family_types = FamilyTypes("Chair-Breuer:Chair-Breuer")  # graph input
# note: Selezionare un locale in cui posizionare gli elementi. Sarà necessario passare ad una vista in cui i locali sono visibili (pianta del pavimento).
seleziona_locale = DSModelElementSelection()  # 1 picked in the model; graph input
raggio_cerchio = DoubleSlider(6.4, range=5..8 step 0.1)  # graph input
# note: Selezionare il livello su cui posizionare gli elementi.
levels = Levels("L3")  # graph input

# group: Imposta offset righe
# I valori per gli offset delle righe non sono la distanza ma i valori U e V.
inizio_riga = DoubleSlider(0.3, range=0..3 step 0.1)  # graph input
fine_riga = DoubleSlider(2.2, range=0..3 step 0.1)  # graph input
numero_di_sedie_in_una_riga = IntegerSlider(8, range=2..12 step 1)  # graph input
posizione_prima_riga = DoubleSlider(0.2, range=0..3 step 0.1)  # graph input
posizione_ultima_riga = DoubleSlider(1.4, range=0..3 step 0.1)  # graph input
spaziatura_righe = DoubleSlider(0.35, range=0.15..1 step 0.05)  # graph input

# group: Genera offset per le righe
# Serie di numeri corrispondenti alle posizioni U e V sulla superficie. I valori possono superare il dominio 0-1
# note: Un'alternativa alla creazione di una sequenza è quella di definire l'inizio, la fine e il numero di incrementi della sequenza.
sequenza_offset_righe = CodeBlock(start=inizio_riga, finish=fine_riga, steps=numero_di_sedie_in_una_riga) { start..finish..#steps; }
# note: Genera una serie di numeri all'interno di un intervallo, con un determinato incremento.
range = Range(start=posizione_prima_riga, end=posizione_ultima_riga, step=spaziatura_righe)

# group: Prepara punti di posizione
# Descrizione <Fare doppio clic qui per modificare la descrizione del gruppo>
# note: Punto di posizionamento del locale selezionato
location = Room.Location(room=seleziona_locale)
# note: Cerchio che definisce un'area iniziale di posizionamento. La forma del cerchio non è importante in questo caso, ma è il modo più rapido per definire una superficie chiusa
byCenterPointRadius = Circle.ByCenterPointRadius(centerPoint=location, radius=raggio_cerchio)
# note: Converte il cerchio in una superficie per utilizzarlo per il posizionamento di punti.
patch = Curve.Patch(curve=byCenterPointRadius)
# note: Utilizzando sequenze di valori U e V, creare una matrice di punti. Impostare il collegamento del nodo su Globale facendo clic con il pulsante destro del mouse e selezionando Collegamento.
pointAtParameter = Surface.PointAtParameter(surface=patch, u=sequenza_offset_righe, v=range, lacing=CrossProduct)

# group: In Revit: Posiziona istanze di famiglia
# note: Posiziona istanze di famiglia
# La maggior parte delle famiglie possono essere inserite anche in base alla posizione del punto. I componenti adattivi possono essere posizionati con più punti, mentre i telai strutturali vengono posizionati con curve
byPointAndLevel = FamilyInstance.ByPointAndLevel(familyType=family_types, point=pointAtParameter, level=levels)

# note: Elimina la struttura dell'elenco; ottiene un elenco contenente tutti gli elementi.
flatten = List.Flatten(list=byPointAndLevel)

# group: Prefisso contrassegno
# Usa un prefisso personalizzato per il numero di contrassegno degli elementi posizionati
prefisso_contrassegno = StringInput("C-")  # graph input

# group: Genera numeri di contrassegni
number = DoubleInput(1)
# note: Conta il numero di elementi nell'elenco.
count = List.Count(list=flatten)
# note: Genera numeri da 1 a n.
sequence = Sequence(start=number, amount=count, step=number, lacing=Longest)
# note: Per essere utilizzato nelle operazioni con le stringhe, il numero deve essere prima convertito in una stringa.
string_from_object = FromObject(obj=sequence)
indice = CodeBlock { 0; }
# note: Inserisce un prefisso personalizzato nel numero dell'elemento.
insert = String.Insert(string=string_from_object, index=indice, toInsert=prefisso_contrassegno)

# group: In Revit: Imposta valori dei parametri
string = StringInput("Contrassegno")
# note: Imposta il parametro Contrassegno con un elenco di valori. È necessario che la struttura dell'elenco di elementi e valori di input corrisponda oppure è possibile utilizzare un solo valore. È anche possibile leggere i parametri utilizzando un nodo Element.GetParameterByName.
setParameterByName = Element.SetParameterByName(element=flatten, parameterName=string, value=insert)

# group: Verifica risultati
# note: Il nodo Watch può essere utilizzato per verificare se i risultati sono quelli previsti.
watch = Watch(insert)  # graph output
