# Dynamo graph Revit Structural Framing.dyn "Telaio strutturale di Revit" (Dynamo 4.0.0.3076)
# author: Dynamo Team
# Questo grafico crea una struttura a partire dal telaio strutturale e dai pilastri rispetto al pavimento di Revit selezionato.

# group: Informazioni
# note: Posiziona le travi e i pilastri del telaio strutturale rispetto ad un elemento selezionato in un modello di Revit.
# note: Eseguire questo grafico del file Snowdon Towers Sample Architectural.rvt nella cartella Esempi dell'installazione di Revit
# C:\Programmi\Autodesk\Revit 2027\Esempi

# group: Input
# note: Selezionare un elemento pavimento di Revit rispetto al quale verrà creata la nuova struttura della pergola.
seleziona_pavimento_di_origine = DSModelElementSelection()  # 1 picked in the model; graph input
# note: Altezza struttura
altezza = DoubleSlider(8.4, range=0..10 step 0.1)  # graph input
numero_di_travi = IntegerSlider(9, range=2..10 step 1)  # graph input
# note: Selezionare il livello su cui posizionare la struttura.
livello_struttura = Levels("L1 - Block 43")  # graph input
# note: Selezionare un tipo di telaio per le travi perimetrali. Questo tipo verrà utilizzato anche per creare un nuovo tipo di telaio strutturale
structural_framing_types = StructuralFramingTypes("W12X26")  # graph input
# note: Selezionare un tipo di famiglia dei pilastri creati.
tipi_di_pilastro_strutturale = StructuralColumnTypes(index=0)  # graph input

# group: Prepara geometria
# Prepara un'espressione corretta per i solidi della geometria dell'elemento selezionato.
# note: Ottiene la geometria dell'elemento di Revit.
getGeometry = Element.GetGeometry(element=seleziona_pavimento_di_origine)
# note: Per eliminare rapidamente le aperture degli elementi, ottenere il relativo riquadro di delimitazione, ovvero un cuboide virtuale contenente l'elemento.
byMinimumVolume = BoundingBox.ByMinimumVolume(geom=getGeometry)
# note: Sono disponibili più azioni per i solidi che per i riquadri di delimitazione. Per consentire ulteriori trasformazioni, convertire prima il riquadro di delimitazione in un cuboide (che è un tipo di solido).
toCuboid = BoundingBox.ToCuboid(boundingBox=byMinimumVolume)
# note: Trasla il cuboide solido in base ad un'altezza (zTranslation) impostata dal dispositivo di scorrimento numerico nella sezione Input del grafico.
translate = Geometry.Translate(geometry=toCuboid, zTranslation=altezza)

# group: Ottiene la superficie superiore del solido.
# Valuta tutte le superfici del solido in base alla quota altimetrica al centro e ottiene quella superiore.
# note: Esplode il solido in superfici.
explode = Geometry.Explode(geometry=translate)
code_block = CodeBlock { 0.5; }
# note: Individua un punto al centro della superficie.
pointAtParameter = Surface.PointAtParameter(surface=explode, u=code_block, v=code_block)
# note: Ottiene un valore numerico per la quota altimetrica di ogni punto centrale.
Z = Point.Z(point=pointAtParameter)
# note: Ordina un elenco in base ad un altro: utilizzare i valori di quota altimetrica per ordinare le superfici.
sortByKey = List.SortByKey(list=explode, keys=Z)
# note: L'ultima superficie nell'elenco è la superficie superiore.
lastItem = List.LastItem(list=sortByKey.sortedList)

# group: Esegue l'offset serie di punti sulla superficie.
# note: Utilizzare una formula semplice per creare una sequenza di valori dal minimo (0.1) al massimo (0.9) con un numero 'n' di incrementi.
sequenza_di_valori_u = CodeBlock(n=numero_di_travi) { 0.1..0.9..#n; }
offset_bordi = CodeBlock { [0.1,0.9]; }
# note: Posiziona una serie di punti sulla superficie utilizzando i parametri U e V. Utilizzare Collegamento Prodotto cartesiano (fare clic con il pulsante destro del mouse sul nodo e scegliere Collegamento) per generare una serie.
pointAtParameter_2 = Surface.PointAtParameter(surface=lastItem, u=sequenza_di_valori_u, v=offset_bordi, lacing=CrossProduct)

# group: Crea linee per le travi interne
# Collega i punti e crea le linee.
indici = CodeBlock { 0; 1; }
# note: Fare clic sul simbolo > accanto all'input "list" per utilizzare i livelli. Ciò significa che il risultato sarà l'elemento con indice 0 da ogni elenco nidificato più basso (@L2).
getItemAtIndex = List.GetItemAtIndex(list=pointAtParameter_2@L2, index=indici.out0)
getItemAtIndex_2 = List.GetItemAtIndex(list=pointAtParameter_2@L2, index=indici.out1)
byStartPointEndPoint = Line.ByStartPointEndPoint(startPoint=getItemAtIndex, endPoint=getItemAtIndex_2)

# group: Curve per travi perimetrali
# Descrizione <Fare doppio clic qui per modificare la descrizione del gruppo>
firstItem = List.FirstItem(list=pointAtParameter_2)
lastItem_2 = List.LastItem(list=pointAtParameter_2)
byStartPointEndPoint_2 = Line.ByStartPointEndPoint(startPoint=firstItem, endPoint=lastItem_2)

# group: Curve per colonne
# Utilizza ogni seconda riga di punti per creare linee per il posizionamento di pilastri.
code_block_2 = CodeBlock { 2; }
# note: Suddivide l'elenco in elenchi di 2.
chop = List.Chop(list=pointAtParameter_2, lengths=code_block_2)
# note: Utilizza la logica dei livelli di elenco e considera solo il primo elenco in corrispondenza di @L3.
firstItem_2 = List.FirstItem(list=chop@L3)
inverti_altezza = CodeBlock(H=altezza) { -H; }
# note: Trasla i punti verso il basso.indietro
translate_2 = Geometry.Translate(geometry=firstItem_2, zTranslation=inverti_altezza)
# note: Collega i punti per creare le linee.
byStartPointEndPoint_3 = Line.ByStartPointEndPoint(startPoint=translate_2, endPoint=firstItem_2)

# group: In Revit: Posiziona travi in base alla curva
# note: Posiziona travi interne
beamByCurve = StructuralFraming.BeamByCurve(curve=byStartPointEndPoint, level=livello_struttura, structuralFramingType=structural_framing_types)
# note: Posiziona travi perimetrali
beamByCurve_2 = StructuralFraming.BeamByCurve(curve=byStartPointEndPoint_2, level=livello_struttura, structuralFramingType=structural_framing_types)
# note: Posiziona i pilastri strutturali
columnByCurve = StructuralFraming.ColumnByCurve(curve=byStartPointEndPoint_3, level=livello_struttura, structuralColumnType=tipi_di_pilastro_strutturale)
