# Dynamo graph Revit Adaptive Component Placement.dyn (Dynamo 4.0.0.3076)
# author: Dynamo Team
# このグラフでは、モデル内の点によってアダプティブ コンポーネントが配置されます。

# group: 情報
# note: カーテン ウォールのグリッド ラインは Revit から事前に選択され、要素 ID が Dynamo ファイルに保存されました
# note: Run this graph the Snowdon Towers Sample Architectural.rvt file in the Samples folder located with your Revit installation:
# C:\Program Files\Autodesk\Revit 2027\Samples
# Run this graph after you load the adaptive family AdaptivePanel.rfa from the Dynamo datasets location.
# note: Revit ファイルで選択した要素に対してアダプティブ コンポーネントを配置します。
# アダプティブ コンポーネントには、配置する Family の配置点と同じ数の点のセットが必要です

# group: 入力
# note: カーテン ウォールのグリッド ラインを選択
エッジを選択 = SelectEdges()  # 7 picked in the model; graph input
# note: フィンの中点の最小変位と最大変位を設定
最小変位 = DoubleSlider(1.4, range=0.2..3 step 0.1)
最大変位 = DoubleSlider(4.3, range=3..8 step 0.1)
# note: アダプティブ コンポーネント ファミリを選択
family_types = FamilyTypes("AdaptivePanel:AdaptivePanel")  # graph input

# note: 曲線に沿って点の位置のリストを作成します。0 は始点、0.5 は中点、1 は終点
パラメータのリスト = CodeBlock { [0,0.5,1]; }
# note: 各曲線の始点、中点、終点を検出
pointAtParameter = Curve.PointAtParameter(curve=エッジを選択, param=パラメータのリスト, lacing=CrossProduct)

# group: 各曲線から始点と終点を取得
始点と終点のインデックス = CodeBlock { 0; 2; }
getItemAtIndex = List.GetItemAtIndex(list=pointAtParameter@L2, index=始点と終点のインデックス.out0)
# note: 中点の選択と同様に、レベルを使用して各曲線から始点と終点を選択
getItemAtIndex_2 = List.GetItemAtIndex(list=pointAtParameter@L2, index=始点と終点のインデックス.out1)

# group: 各曲線から中点を取得
中点インデックス = CodeBlock { 1; }
# note: 入力した 'list' のリスト レベルを使用します。既定では、ノードの結果はインデックス 1 のリスト(2 番目の曲線)になります。'list' 入力上を右クリックし、@L2 の[レベルを使用]を選択します。これにより、ネストされた各リスト(各曲線の中点)からインデックス 1 の項目が選択されます。
getItemAtIndex_3 = List.GetItemAtIndex(list=pointAtParameter@L2, index=中点インデックス)

# group: 正弦波を作成
# note: 選択されているソース曲線の数をカウント
count = List.Count(list=エッジを選択)
# note: 0 から 1 までの N 値のシーケンスを作成
sequence = CodeBlock(steps=count) { 0..1..#steps; }
# note: 正弦波を作成
sin = Math.Sin(angle=sequence)
# note: 正弦波を新しい最大値および最小値に再マッピング
remapRange = Math.RemapRange(numbers=sin, newMin=最小変位, newMax=最大変位)

# group: 中点を移動
# note: Y 変位には、カーテン ウォールの外側に向かって変位するように符号を反転
符号を反転 = CodeBlock(y=remapRange) { -y; }
# note: フィンの中点を移動
translate = Geometry.Translate(geometry=getItemAtIndex_3, yTranslation=符号を反転, zTranslation=remapRange)

# note: Y 変位には、カーテン ウォールの外側に向かって変位するように符号を反転
符号を反転_2 = CodeBlock(y=remapRange) { y; }
# note: フィンの中点を移動
translate_2 = Geometry.Translate(geometry=getItemAtIndex_3, yTranslation=符号を反転_2, zTranslation=remapRange)

# group: リスト内の点を再接合
list_create = List.Create(item0=getItemAtIndex, item1=translate, item2=getItemAtIndex_2, item3=translate_2)
# note: 行列を反転し、リストを 3 つのセットに編成
transpose = List.Transpose(lists=list_create)

# group: Revit 用: コンポーネントを配置
# note: アダプティブ コンポーネントは、ファミリの配置点と同じ数の点のセットを使用して配置できます。
byPoints = AdaptiveComponent.ByPoints(points=transpose, familyType=family_types)
