# Dynamo graph Revit Color.dyn (Dynamo 4.0.0.3076)
# author: Dynamo Team
# このグラフでは、選択した要素のサーフェス面積が評価され、グラフィックスの上書きが適用されて、その値に基づく要素に色付けされます。

# group: 情報
# note: Run this graph the Snowdon Towers Sample Architectural.rvt file in the Samples folder located with your Revit installation
# C:\Program Files\Autodesk\Revit 2027\Samples
# note: このグラフでは、測定可能な基準(Surface Area)に基づいて Revit 要素が色付けされます。
# 要素は[ビューのグラフィックスを上書き] > [要素別]メソッドを使用して色付けされます。

# group: モデル要素を選択
# ファサード壁を選択します
# note: [変更]をクリックして Revit モデルから要素を選択
select_model_elements = DSModelElementsSelection()  # 33 picked in the model; graph input

# group: 要素のサーフェス面積を評価
# note: 要素のジオメトリを取得
getGeometry = Element.GetGeometry(element=select_model_elements)
flatten = List.Flatten(list=getGeometry)
# note: Geometry の Surface Area を抽出
area = Solid.Area(solid=flatten)
# note: 最高値を取得
maximumItem = List.MaximumItem(list=area)
# note: 最高値で正規化
div = area / maximumItem  # graph output

# group: 色を作成
# 要素を色分けするカラー スキームを準備します
number = DoubleInput(0)
number_2 = DoubleInput(255)
# note: 色: 緑
byARGB = Color.ByARGB(alpha=number, red=number, green=number_2, blue=number, lacing=Longest)
number_3 = DoubleInput(0)
number_4 = DoubleInput(255)
# note: 色: 赤
byARGB_2 = Color.ByARGB(alpha=number_3, red=number_4, green=number_3, blue=number_3, lacing=Longest)
create = List.Create(item0=byARGB, item1=byARGB_2)
code_block = CodeBlock { [0,1]; }
# note: 色域を設定
color_range = ColorRange(colors=create, indices=code_block, value=div)

# group: Revit 用: ビューの要素の色を上書き
# note: これにより、アクティブ ビューの要素の色が上書きされます
overrideColorInView = Element.OverrideColorInView(element=select_model_elements, color=color_range, lacing=Longest)

# group: しきい値
number_5 = DoubleInput(100)

# group: 別の方法 - 基準が指定のしきい値を超えるかどうかを評価します
# note: しきい値と比較
gt = area > number_5
# note: 数値は色のスペクトル上の位置(0 から 1 まで)を示します
number_6 = DoubleInput(1)
number_7 = DoubleInput(0)
# note: 許容値内の領域を特定
if_ = RefactoredIf(test=gt, true=number_6, false=number_7)
# note: この結果は、Color Range ノードの「インデックス」入力として使用できます
watch = Watch(if_)
