# Dynamo graph Revit Floors and Framing.dyn "Revit の床およびフレーム" (Dynamo 4.0.0.3076)
# author: Dynamo Team
# このグラフでは、一連の線分とその変位を使用してフォリー建築物が作成され、Revit の構造フレーム要素と床要素を配置できます。
# packages: PythonNet3 エンジン 1.4.5

# group: 情報
# note: 次の Revit のインストール場所にある Samples フォルダ内の Snowdon Towers Sample Architectural.rvt ファイルを使用して、このグラフを実行します
# C:\Program Files\Autodesk\Revit 2027\Samples
# note: このグラフでは、一連の線分を使用してフォリー建築物が作成され、その線分を基準にして構造フレームと床が配置されます。

# group: フォリーの中心の位置
x_位置 = DoubleSlider(30, range=25..40 step 1)  # graph input
y_位置 = DoubleSlider(30, range=25..40 step 1)  # graph input
z_位置 = DoubleSlider(62, range=60..80 step 1)  # graph input

# group: フォリーの設定
# 説明<グループの説明を編集するにはここをダブル クリック>
下位フロアの半径 = DoubleSlider(10, range=8..20 step 1)  # graph input
フロアの数 = DoubleSlider(7, range=3..10 step 1)  # graph input
半径の減少 = DoubleSlider(-1.25, range=-2..-0.5 step 0.25)  # graph input
ポリゴンの辺の数 = IntegerSlider(5, range=3..10 step 1)  # graph input
上部フロアの高さ = DoubleSlider(38.4, range=15..50 step 0.1)  # graph input
最大回転_度 = DoubleSlider(130, range=10..180 step 5)  # graph input

# group: ポリゴンを作成
# 半径を小さくし、垂直にオフセットし、順番に回転する一連のポリゴンを作成します
# note: フォリーの中心
byCoordinates = Point.ByCoordinates(x=x_位置, y=y_位置, z=z_位置)
# note: 円の半径のシーケンス
sequence = Sequence(start=下位フロアの半径, amount=フロアの数, step=半径の減少, lacing=Longest)
# note: 一連の円を作成
byCenterPointRadius = Circle.ByCenterPointRadius(centerPoint=byCoordinates, radius=sequence)
# note: 一連のポリゴンを作成
regularPolygon = Polygon.RegularPolygon(circle=byCenterPointRadius, numberSides=ポリゴンの辺の数)
# note: 床高のシーケンス
フロアの高さのシーケンス = CodeBlock(top_floor=上部フロアの高さ, count=フロアの数) { 0..top_floor..#count; }
byCoordinates_2 = Vector.ByCoordinates(z=フロアの高さのシーケンス)
# note: 指定された高さでポリゴンを上に移動
translate = Geometry.Translate(geometry=regularPolygon, direction=byCoordinates_2)
ZAxis = Vector.ZAxis()
# note: 各階の回転のシーケンス
回転角のシーケンス = CodeBlock(max_degrees=最大回転_度, count=フロアの数) { 0..max_degrees..#count; }
# note: 一連の角度でポリゴンを回転
rotate = Geometry.Rotate(geometry=translate, origin=byCoordinates, axis=ZAxis, degrees=回転角のシーケンス)
# note: ポリゴンから個々の曲線を抽出
curves = PolyCurve.Curves(polyCurve=rotate)

# group: フロア タイプとレベル
# note: ドロップダウンを使用して、プロジェクト内に存在するタイプから、作成した床のフロア タイプを選択
floor_types = FloorTypes("Concrete Slab 6\"")  # graph input
levels = Levels("Green Roof Hardscape")  # graph input

# group: Revit 用: フロアを作成
# フロア作成の入力に一連の閉じた曲線ループを使用します
# note: Floor を作成するために Curve の Group を渡す
byOutlineTypeAndLevel = Floor.ByOutlineTypeAndLevel(outline=curves, floorType=floor_types, level=levels)

# group: 鉛直接合
# フォリーのレベル間のポリゴン コーナーを接続します
# note: 各ポリゴン曲線の終点を取得
endPoint = Curve.EndPoint(curve=curves)
# note: 行列を反転し、垂直に位置合わせされた[終点]のリストを取得
transpose = List.Transpose(lists=endPoint)
# note: ポリゴンの一致するコーナーをフォリーの最下レベルから最上レベルに接続し、ポリカーブとして結合
byPoints = PolyCurve.ByPoints(points=transpose)
# note: ポリカーブを分解し、構造フレーム要素の入力として使用する曲線のリストを取得
curves_2 = PolyCurve.Curves(polyCurve=byPoints)

# group: 構造フレーム タイプとレベル
levels_2 = Levels("Green Roof Hardscape")  # graph input
# note: ドロップダウンを使用して、プロジェクト内にロードされたタイプから構造フレーム タイプを選択
structural_framing_types = StructuralFramingTypes("W12X26")  # graph input

# group: Revit 用: 構造フレームを作成
# 曲線を使用して構造フレームの要素を作成し、Python ノードを使用して個々の梁間の結合を禁止します
# note: 各構造要素の個々のパスを渡す
beamByCurve = StructuralFraming.BeamByCurve(curve=curves_2, level=levels_2, structuralFramingType=structural_framing_types)
# note: リストを準備
flatten = List.Flatten(list=beamByCurve)
# note: これは名前が変更された Python ノードで、Revit API を参照して Dynamo の設定済みノードを超える機能を拡張します。Python コードを読み込むには、ノードを右クリックして[編集]をクリックします。
構造フレームでの結合を禁止 = Python(structuralFraming=flatten)  # PythonNet3
# ---------- 構造フレームでの結合を禁止.python (35 lines) ----------
# Load the Python Standard and DesignScript Libraries
import sys
import clr
clr.AddReference('ProtoGeometry')
from Autodesk.DesignScript.Geometry import *
from Autodesk.Revit.DB import *
from RevitServices.Transactions import TransactionManager
from RevitServices.Persistence import DocumentManager 

doc = DocumentManager.Instance.CurrentDBDocument

# The inputs to this node will be stored as a list in the IN variables.
dataEnteringNode = IN

# Place your code below this line
structural_framing = UnwrapElement(IN[0])

unjoined_elements = []
# start a Transaction
TransactionManager.Instance.EnsureInTransaction(doc)
# iterate through each structural framing element
for sf in structural_framing:
    # check if the element passed in of Structural Framing Category
    sf_category = sf.Category # get the element's Category
    # use the Structural Framing's Category Id to check
    if sf_category.Id.Value == -2001320:
        # disallow joins at start and end of the structural framing element
        Structure.StructuralFramingUtils.DisallowJoinAtEnd(sf, 0)
        Structure.StructuralFramingUtils.DisallowJoinAtEnd(sf, 1)
        unjoined_elements.append(sf)
TransactionManager.Instance.TransactionTaskDone()

    
# Output the list of elements with Disallowed Join
OUT = unjoined_elements
# ----------------------------------------
