# Dynamo graph Revit Geometry Creation Curves.dyn (Dynamo 4.0.0.3076)
# author: Dynamo Team
# このグラフでは、Dynamo で曲線を作成し、その曲線を使用して Revit の要素(モデル線分)を作成する方法を示します

# group: 情報
# note: このグラフでは、Revit のモデル曲線を作成するための入力として使用する曲線の作成メソッドを使用します
# note: Run this graph the Snowdon Towers Sample Architectural.rvt file in the Samples folder located with your Revit installation
# C:\Program Files\Autodesk\Revit 2027\Samples

# group: 4 つの点
# 説明<グループの説明を編集するにはここをダブル クリック>
number = DoubleInput(-35)
number_2 = DoubleInput(-55)
byCoordinates = Point.ByCoordinates(x=number, y=number_2)
number_3 = DoubleInput(-40)
byCoordinates_2 = Point.ByCoordinates(x=number, y=number_3)
number_4 = DoubleInput(-10)
byCoordinates_3 = Point.ByCoordinates(x=number_4, y=number_3)
number_5 = DoubleInput(-17)
number_6 = DoubleInput(-60)
byCoordinates_4 = Point.ByCoordinates(x=number_5, y=number_6)

list_create = List.Create(item0=byCoordinates, item1=byCoordinates_2, item2=byCoordinates_3, item3=byCoordinates_4)

# group: NURBS 曲線からモデル曲線を作成(点を使用)
# note: 点のリストから NURBS 曲線を作成
byPoints = NurbsCurve.ByPoints(points=list_create)
# note: NURBS 曲線を使用して、Revit モデル線分を作成
byCurve = ModelCurve.ByCurve(curve=byPoints)

# group: NURBS 曲線からモデル曲線を作成(制御点を使用)
boolean = BoolSelector(false)
# note: 制御点として、点のリストから NURBS 曲線を作成
byControlPoints = NurbsCurve.ByControlPoints(points=list_create, closeCurve=boolean)
# note: NURBS 曲線を使用して、Revit モデル線分を作成
byCurve_2 = ModelCurve.ByCurve(curve=byControlPoints)

# group: ポリカーブからモデル曲線を作成
# note: 点のリストからポリカーブを作成
byPoints_2 = PolyCurve.ByPoints(points=list_create)
curves = PolyCurve.Curves(polyCurve=byPoints_2)
# note: 曲線のリストを使用して、Revit モデル線分のセットを作成
byCurve_3 = ModelCurve.ByCurve(curve=curves)

# group: 線分からモデル曲線を作成
# note: 2 つの点から曲線を作成
byStartPointEndPoint = Line.ByStartPointEndPoint(startPoint=byCoordinates, endPoint=byCoordinates_2)
# note: 線分(曲線)を使用して Revit モデル曲線を作成
byCurve_4 = ModelCurve.ByCurve(curve=byStartPointEndPoint)
