# Dynamo graph Revit Geometry Creation Points.dyn (Dynamo 4.0.0.3076)
# author: Dynamo Team
# このグラフでは、コンセプト マス ファミリ環境でモデル線分と参照点を作成します。

# group: 情報
# note: 画面の右上コーナーにあるボタン([Ctrl] + [B]ショートカット)を使用して、3D 背景ナビゲーションとグラフ ビューのナビゲーションを切り替えることができます。Dynamo と Revit の場合は、[表示(V)]メニューで背景プレビューのオン/オフを切り替えることもできます。
# note: Run this graph in a Conceptual Mass or Generic Model Adaptive family environment.
# To create a new family, go to File > New Family > and select the template located in the folder:
# C:\ProgramData\Autodesk\RVT 2027\Family Templates\English-Imperial\Generic Model Adaptive.rft
# note: このグラフでは、ファミリ環境でモデル線分と参照点が作成されます

# group: 点座標
点_x_値 = DoubleSlider(50, range=5..50 step 5)  # graph input
点_y_値 = DoubleSlider(25, range=5..50 step 5)  # graph input
点_z_値 = DoubleSlider(25, range=5..50 step 5)  # graph input

# note: Dynamo 環境で点の位置を操作: Point.ByCoordinates ノードを選択し、背景プレビューに切り替えて、3 つの軸に沿って点を引きます。
byCoordinates = Point.ByCoordinates(x=点_x_値, y=点_y_値, z=点_z_値)
# note: ジオメトリ データは文字情報として、または 3D 空間で視覚化できます
watch = Watch(byCoordinates)
byCoordinates_2 = Point.ByCoordinates()
byStartPointEndPoint = Line.ByStartPointEndPoint(startPoint=byCoordinates_2, endPoint=byCoordinates)
# note: ジオメトリをプレビュー
watch_3d = Watch3D(byStartPointEndPoint)
# note: 2 つの点を接続してモデル曲線を作成
byCurve = ModelCurve.ByCurve(curve=byStartPointEndPoint)
# note: Dynamo では、Dynamo が関連付けられているファイルに適した要素の作成と修正のみが可能です。たとえば、参照点は特定のファミリ環境(一般モデルのアダプティブなど)でのみ作成できますが、モデル線分はほぼどこにでも作成できます。
byPoint = ReferencePoint.ByPoint(pt=byCoordinates)
