# Dynamo graph Revit Geometry Creation Solids.dyn "Revit のジオメトリ作成ソリッド" (Dynamo 4.0.0.3076)
# author: Dynamo Team
# このグラフでは、Dynamo で Solid ジオメトリを作成して Revit に統合するメソッドがいくつか示されています。プロジェクト環境で使用できるメソッドと、特定のファミリ環境(コンセプト マス)でのみ使用できるメソッドがあります。

# group: 情報
# note: ほとんどのソリッドに複数の作成メソッドが存在します。これらの例では、閉じたプロファイルを基準として使用していますが、ポリサーフェスをステッチして多くのプリミティブ(Surface、Cuboid、Cone など)を使用できます。
# ジオメトリを Revit 環境に統合するには、まず Revit 要素に変換する必要があります。
# ソリッドは読み込みインスタンスに変換して、プロジェクト環境とモデル ファミリ環境の両方で表示できます。
# また Solid ジオメトリは、コンセプト マス環境とアダプティブ コンポーネント ファミリ環境でのみ使用できるフォーム要素に変換できます。
# note: このグラフでは、いくつかのメソッドを使用して Revit でソリッド ジオメトリを作成します。一部のメソッドはプロジェクト環境でのみ使用でき、他の方法は特定のファミリ環境でのみ使用できます。
# すべてのメソッドを表示するには、コンセプト マス ファミリのテンプレートを使用します。
# コンセプト マス ファミリを開くには、[ファイル] > [新規作成(N)] > [ファミリ] > に移動して、\Conceptual Mass\Mass.rft の Mass.rft テンプレートを選択します。

# group: 点を準備
# 点のセットを生成して、ジオメトリを作成します
byCoordinates = Point.ByCoordinates()
number = DoubleInput(10)
byCoordinates_2 = Point.ByCoordinates(x=number)
number_2 = DoubleInput(5)
byCoordinates_3 = Point.ByCoordinates(z=number_2)
number_3 = DoubleInput(10)
byCoordinates_4 = Point.ByCoordinates(y=number_3)
number_4 = DoubleInput(15)
byCoordinates_5 = Point.ByCoordinates(x=number_4, y=number_4)
number_5 = DoubleInput(5)
number_6 = DoubleInput(10)
byCoordinates_6 = Point.ByCoordinates(x=number_5, y=number_6, z=number_6)
number_7 = DoubleInput(-2)
number_8 = DoubleInput(5)
byCoordinates_7 = Point.ByCoordinates(x=number_7, y=number_8)

# group: 1 番目のプロファイル
# 円弧と線分から閉じた曲線として 1 番目のプロファイルを作成します
byStartPointEndPoint = Line.ByStartPointEndPoint(startPoint=byCoordinates, endPoint=byCoordinates_2)
byThreePoints = Arc.ByThreePoints(firstPoint=byCoordinates, secondPoint=byCoordinates_3, thirdPoint=byCoordinates_2)
create = List.Create(item0=byStartPointEndPoint, item1=byThreePoints)
# note: ロフトの 1 番目のプロファイル
byJoinedCurves = PolyCurve.ByJoinedCurves(curves=create)

# group: 2 番目のプロファイル
# 円弧と線分から 2 番目のプロファイルを閉じた曲線として作成します
byStartPointEndPoint_2 = Line.ByStartPointEndPoint(startPoint=byCoordinates_4, endPoint=byCoordinates_5)
byThreePoints_2 = Arc.ByThreePoints(firstPoint=byCoordinates_4, secondPoint=byCoordinates_6, thirdPoint=byCoordinates_5)
create_2 = List.Create(item0=byStartPointEndPoint_2, item1=byThreePoints_2)
# note: ロフトの 2 番目のプロファイル
byJoinedCurves_2 = PolyCurve.ByJoinedCurves(curves=create_2)

# note: リスト内の 2 つのプロファイルを結合
create_3 = List.Create(item0=byJoinedCurves, item1=byJoinedCurves_2)

# group: 断面によるソリッド ロフト
# 説明<グループの説明を編集するにはここをダブル クリック>
byLoft = Solid.ByLoft(crossSections=create_3)

# note: ソリッドの体積を調査
volume = Solid.Volume(solid=byLoft)

# group: シェルを作成
code_block = CodeBlock { 0; }
# note: ヒント: ノードの右クリック メニューで[プレビュー]をオフにすると、表示から要素を除外できます
thinShell = Solid.ThinShell(solid=byLoft, internalFaceThickness=code_block)

# group: ジオメトリを変換
code_block_2 = CodeBlock { Vector.ByCoordinates(20,0,0); }
# note: ジオメトリを側面に移動して、元の結果と最終結果の両方をプレビュー
translate = Geometry.Translate(geometry=thinShell, direction=code_block_2)

# group: ソリッドをトリム
# トリム操作を使用して、平面でシェル ソリッドを切り取ります。
code_block_3 = CodeBlock { Point.ByCoordinates(0,0,5); }
ZAxis = Vector.ZAxis()
byOriginNormal = Plane.ByOriginNormal(origin=code_block_3, normal=ZAxis)
number_9 = DoubleInput(10)
# note: トリムの維持する側を選択します(ポイントに最も近い側は破棄されます)。
byCoordinates_8 = Point.ByCoordinates(x=number_9, y=number_9, z=number_9)
# note: ジオメトリのブール演算(積、差、和など)は、Geometry Category で使用できます。
trim = Geometry.Trim(geometry=translate, other=byOriginNormal, pick=byCoordinates_8)

# group: ガイド曲線
# ロフト ソリッド 形状のガイド曲線として使用する NURBS 曲線を作成します
create_4 = List.Create(item0=byCoordinates, item1=byCoordinates_7, item2=byCoordinates_4)
# note: NURBS 曲線として作成されたガイド曲線
byPoints = NurbsCurve.ByPoints(points=create_4)

# group: 断面とガイド曲線によるソリッド ロフト
# note: ヒント: ノードの右クリック メニューで[プレビュー]をオフにすると、表示から要素を除外できます
byLoft_2 = Solid.ByLoft(crossSections=create_3, guideCurves=byPoints)

# group: 読み込みインスタンスを作成
code_block_4 = CodeBlock { Vector.ByCoordinates(-20,0,0); }
translate_2 = Geometry.Translate(geometry=byLoft_2, direction=code_block_4)
# note: ジオメトリは Revit 要素と同じではありません。
# Revit Environment で Surface や Solid から Revit Import を作成するには ImportInstance を使用し、Family Instance を配置するには Point と Curve を使用し、Mass と Generic Model By Point (Adaptive Component) Family に Form を作成します
byGeometries = ImportInstance.ByGeometries(geometries=translate_2)
byCoordinates_9 = Vector.ByCoordinates()

# group: フォームを作成
# 2 つのプロファイル曲線ループを使用して、(コンセプト マス ファミリ環境で)フォーム要素を作成します
curves = PolyCurve.Curves(polyCurve=create_3)
# note: 曲線からモデル曲線を作成
referenceCurveByCurve = ModelCurve.ReferenceCurveByCurve(curve=curves)
# note: フォームはコンセプト マス ファミリの一部としてのみ作成できます
byLoftCrossSections = Form.ByLoftCrossSections(curves=referenceCurveByCurve)
