# Dynamo graph Revit Geometry Creation Surfaces.dyn "Revit のジオメトリ作成サーフェス" (Dynamo 4.0.0.3076)
# author: Dynamo Team
# このグラフでは、Dynamo でサーフェスを作成するいくつかのメソッドと、ジオメトリを Revit ジオメトリに変換する 2 つのメソッドを示します。

# group: 情報
# note: このグラフでは、いくつかのメソッドを使用して Revit でサーフェス ジオメトリが作成されます。いくつかのメソッドはプロジェクト環境でのみ使用でき、その他は特定のファミリ環境でのみ使用できます。
# すべてのメソッドを表示するには、コンセプト マス ファミリのテンプレートを使用します。
# コンセプト マス ファミリを作成するには、[ファイル] > [新規作成] > [ファミリ]に移動して、Conceptual Mass フォルダ内の Mass.rft テンプレートを選択します。
# note: ほとんどの Surface には複数の作成方法があります。Surface、Polysurface(サーフェスの集合)、NURBS サーフェスは、点、曲線によって作成することができ、さまざまな操作によって他のサーフェスやソリッドから派生できます。
# note: Revit 環境にジオメトリを統合するには、まず Revit 要素に変換する必要があります。
# サーフェスとソリッドは読み込みインスタンスに変換して、プロジェクト環境とモデル ファミリ環境の両方で表示できます。
# またサーフェス ジオメトリは、コンセプト マス環境とアダプティブ コンポーネント ファミリ環境でのみ使用できるフォーム要素に変換できます。

# group: 点を準備
# 点のセットを生成して、ジオメトリを作成します
number = DoubleInput(10)
byCoordinates = Point.ByCoordinates(y=number)
number_2 = DoubleInput(5)
number_3 = DoubleInput(10)
byCoordinates_2 = Point.ByCoordinates(x=number_2, y=number_3, z=number_3)
number_4 = DoubleInput(15)
byCoordinates_3 = Point.ByCoordinates(x=number_4, y=number_4)
byCoordinates_4 = Point.ByCoordinates()
number_5 = DoubleInput(5)
byCoordinates_5 = Point.ByCoordinates(z=number_5)
byCoordinates_6 = Point.ByCoordinates(x=number)
number_6 = DoubleInput(-5)
number_7 = DoubleInput(5)
byCoordinates_7 = Point.ByCoordinates(x=number_6, y=number_7)
number_8 = DoubleInput(10)
number_9 = DoubleInput(-10)
byCoordinates_8 = Point.ByCoordinates(x=number_8, y=number_9)
byCoordinates_9 = Point.ByCoordinates(y=number_9)

# group: プロファイルを作成
byThreePoints = Arc.ByThreePoints(firstPoint=byCoordinates, secondPoint=byCoordinates_2, thirdPoint=byCoordinates_3)
byThreePoints_2 = Arc.ByThreePoints(firstPoint=byCoordinates_4, secondPoint=byCoordinates_5, thirdPoint=byCoordinates_6)
byThreePoints_3 = Arc.ByThreePoints(firstPoint=byCoordinates_4, secondPoint=byCoordinates_7, thirdPoint=byCoordinates)
byStartPointEndPoint = Line.ByStartPointEndPoint(startPoint=byCoordinates_8, endPoint=byCoordinates_9)

# group: スイープによるサーフェス
# プロファイル、パス曲線、ガイド レールを使用して、スイープ サーフェスを作成します
bySweep2Rails = Surface.BySweep2Rails(path=byThreePoints, guideRail=byThreePoints_2, profile=byThreePoints_3)

# group: 読み込みを作成
# note: 読み込みインスタンスを使用して、サーフェスとソリッドから Revit 読み込みを作成します。この読み込みは、すべての Revit 環境で表示されます。
byGeometries = ImportInstance.ByGeometries(geometries=bySweep2Rails)

create = List.Create(item0=byStartPointEndPoint, item1=byThreePoints_2)

# group: ロフトによりサーフェスを作成
# 断面を結合してロフト サーフェスを作成します
byLoft = Surface.ByLoft(crossSections=create)

# group: サーフェス面積を評価
area = Surface.Area(surface=byLoft)
watch = Watch(area)
create_2 = List.Create(item0=byLoft, item1=bySweep2Rails)
# note: Polysurfaces として結合されたサーフェスは 1 つのエンティティとして評価できます
byJoinedSurfaces = PolySurface.ByJoinedSurfaces(surfaces=create_2)
area_2 = Surface.Area(surface=byJoinedSurfaces)
watch_2 = Watch(area_2)
area_3 = Surface.Area(surface=bySweep2Rails)
watch_3 = Watch(area_3)

# group: 制御点からの NURBS サーフェス
# スイープを制御点から NURBS サーフェスに変換します
code_block = CodeBlock { 0..1..0.1; }
# note: これらのジオメトリに最適な「Action」を使用すると、サーフェスからエッジ、点、その他のフィーチャを派生させることができます。
pointAtParameter = Surface.PointAtParameter(surface=bySweep2Rails, u=code_block, v=code_block, lacing=CrossProduct)
# note: サーフェスを NURBS サーフェスとして制御点から再作成
byControlPoints = NurbsSurface.ByControlPoints(controlVertices=pointAtParameter)
# note: Watch 3D ノードを使用して、ジオメトリを分離してプレビュー
watch_3d = Watch3D(byControlPoints)

# group: 押し出し曲線によるサーフェス
# 曲線を使用して、指定した距離で押し出しを作成します
code_block_2 = CodeBlock { 10; }
extrude = Curve.Extrude(curve=byThreePoints, distance=code_block_2)

# group: フォームを作成
# 2 つの曲線からロフト形状を作成します
referenceCurveByCurve = ModelCurve.ReferenceCurveByCurve(curve=create)
byLoftCrossSections = Form.ByLoftCrossSections(curves=referenceCurveByCurve)
