# Dynamo graph Revit Import Solid.dyn (Dynamo 4.0.0.3076)
# author: Dynamo Team
# このグラフでは、Dynamo ソリッド ジオメトリを作成し、そのジオメトリを使用して Revit の読み込みインスタンス要素を作成する方法が示されます。一連の円弧プロファイルを作成し、そのプロファイルを使用してロフト サーフェスを作成し、新しい屋根形状を作成します。

# group: 情報
# note: ソース要素(屋根)は Revit から事前に選択され、要素 ID が Dynamo ファイルに保存されました
# note: Run this graph the Snowdon Towers Sample Architectural.rvt file in the Samples folder located with your Revit installation
# C:\Program Files\Autodesk\Revit 2027\Samples
# note: 一連の円弧プロファイルを作成し、そのプロファイルを使用してロフト サーフェスを作成して、選択した屋根要素から新しい屋根形状を作成します。ジオメトリは読み込みインスタンスに変換され、Revit 環境に統合されます

# group: 新しい屋根の設定
# note: ロフト サーフェスの作成元となるプロファイルの数
プロファイルの数 = IntegerSlider(6, range=3..10 step 1)
# note: 新しい屋根の短い方の端の高さ
屋根断面_最小 = DoubleSlider(2.1, range=1..5 step 0.1)
# note: 屋根の中央の高さ
屋根断面_最大 = DoubleSlider(7, range=5..10 step 0.1)
# note: 円弧プロファイルをこの値だけ横方向に延長
屋根側面の延長 = DoubleSlider(0.5, range=0.1..3 step 0.1)
# note: 新しい屋根形状の厚さ
屋根の厚さ = DoubleSlider(0.5, range=0.1..2 step 0.1)

プロファイルの数_2 = CodeBlock(steps=プロファイルの数) { steps; }

# group: 屋根を選択
# ソース屋根要素を選択します
# note: 「IsInput」とマークされたすべての入力は、Dynamo プレーヤで設定できます
陸屋根を選択 = DSModelElementSelection()  # 1 picked in the model

# group: 屋根面を取得
# ソース要素のジオメトリを分解し、最大面積の面を 1 つ選択します
# note: 選択した要素の面を取得するには、まずジオメトリを取得します
# note: 右クリックして[ジオメトリをプレビュー]のチェックを外すと、最終結果が明確に表示されます
getGeometry = Element.GetGeometry(element=陸屋根を選択)
# note: ジオメトリを分解して個々の面を取得
explode = Geometry.Explode(geometry=getGeometry)
# note: リスト構造を破棄します。複数のソース オブジェクトが使用されている場合、この手順は必要ありません
flatten = List.Flatten(list=explode)
area = Surface.Area(surface=flatten)
# note: サーフェスのリストを面積別に並べ替えます。最大面積を持つサーフェスが sortedList 出力のリストの最後の項目になります
sortByKey = List.SortByKey(list=flatten, keys=area)
lastItem = List.LastItem(list=sortByKey.sortedList)
number = DoubleInput(1.5)
# note: サーフェスを上方に移動
translate = Geometry.Translate(geometry=lastItem, zTranslation=number)

# group: 外側にオフセット(スケール)
# サーフェスをスケールして、エッジを外向きに延長します
uv_位置 = CodeBlock { 0.5; }
pointAtParameter = Surface.PointAtParameter(surface=translate, u=uv_位置, v=uv_位置)
点からスケール_点へスケール = CodeBlock { point1 = Point.ByCoordinates(1, 1); point2 = Point.ByCoordinates(-40, -40); }
scale = Geometry.Scale(geometry=translate, basePoint=pointAtParameter, from=点からスケール_点へスケール.point1, to=点からスケール_点へスケール.point2)

# group: サーフェス上の点
# 長い方のエッジに沿って 2 行、中央に 1 行の等間隔の点の 3 つのリストを生成します
# note: 0 と 1 はサーフェスの長い方のエッジに沿った位置のことです
エッジ行の_u_位置 = CodeBlock { [0,1]; }
# note: V は 0 から 1 および N ステップのシーケンスで、長い方のエッジに沿って配置されます
エッジ行の_v_位置 = CodeBlock(steps=プロファイルの数_2) { [0..1..#steps]; }
# note: ノード上を右クリック > [レーシング]で[最長レーシング]設定を使用します。
# 最長レーシングは、別のリスト構造の入力と一致します。この場合、結果は点の 2 つのリストになり、各リストの点の数は最長の入力リストと一致します。
pointAtParameter_2 = Surface.PointAtParameter(surface=scale, u=エッジ行の_u_位置, v=エッジ行の_v_位置, lacing=Longest)
# note: U 値が 0.5 の場合、点はサーフェスの中央に沿って配置されます
中央行の_u_位置 = CodeBlock { [0.5]; }
# note: V は 0 から 1 および N ステップのシーケンスで、点の中央行に沿って配置されます
中央行の_v_位置 = CodeBlock(steps=プロファイルの数_2) { [0..1..#steps]; }
# note: 最長レーシングはこのノードに使用されます。結果は点の 1 つのリストで、リスト内の点の数が最長の入力リストと一致します。
pointAtParameter_3 = Surface.PointAtParameter(surface=scale, u=中央行の_u_位置, v=中央行の_v_位置, lacing=Longest)

# group: 点を上にオフセット
# 余弦波の形状で中央行の点をオフセットします
# note: 一連のオフセットを生成する値のシーケンス
角度のシーケンス = CodeBlock(steps=プロファイルの数_2) { -1..1..#steps; }
# note: 別の方法: 別の屋根の形状に正弦を使用します
sin = Math.Sin(angle=角度のシーケンス)
# note: 余弦波の値
cos = Math.Cos(angle=角度のシーケンス)
# note: 新しいドメインに値を再マッピング
remapRange = Math.RemapRange(numbers=cos, newMin=屋根断面_最小, newMax=屋根断面_最大)
# note: 中央行の点を移動
translate_2 = Geometry.Translate(geometry=pointAtParameter_3@L2, zTranslation=remapRange)

# group: 円弧からプロファイルを作成
# ポイントを使用して円弧を作成します
# note: エッジと中央行を 1 つのリストに結合
join = List.Join(list0=pointAtParameter_2, list1=translate_2)
項目インデックス = CodeBlock { 0; 1; 2; }
getItemAtIndex = List.GetItemAtIndex(list=join, index=項目インデックス.out0)
getItemAtIndex_2 = List.GetItemAtIndex(list=join, index=項目インデックス.out2)
getItemAtIndex_3 = List.GetItemAtIndex(list=join, index=項目インデックス.out1)
byThreePoints = Arc.ByThreePoints(firstPoint=getItemAtIndex, secondPoint=getItemAtIndex_2, thirdPoint=getItemAtIndex_3)

# group: プロファイルを延長
# 各プロファイルの曲線を指定の距離で延長します
# note: 延長の値はグラフの左側の入力として設定されます。
エッジを延長 = CodeBlock(roof_extension=屋根側面の延長) { roof_extension; }
extendStart = Curve.ExtendStart(curve=byThreePoints, distance=エッジを延長)
extendEnd = Curve.ExtendEnd(curve=extendStart, distance=エッジを延長)

# group: ロフトと厚み付け
# ロフト サーフェスを作成して厚さを指定します
byLoft = Surface.ByLoft(crossSections=extendEnd)
thicken = Surface.Thicken(surface=byLoft, thickness=屋根の厚さ)

# group: Revit 用:
# 読み込みインスタンスと設定レベルのパラメータを使用して Dynamo ジオメトリを Revit 要素に変換します
# note: ジオメトリを Revit 環境に統合するには、まず Revit 要素に変換する必要があります。
# ソリッドは、プロジェクト環境とモデル ファミリ環境の両方に表示される読み込みインスタンスに変換できます。
byGeometry = ImportInstance.ByGeometry(geometry=thicken)
code_block = CodeBlock { "作業面"; }
levels = Levels("L1 - Block 43")
# note: 配置された読み込みインスタンスの高さを修正するには、作業面パラメータを、高さが内部原点の位置と一致するレベルに設定します。
setParameterByName = Element.SetParameterByName(element=byGeometry, parameterName=code_block, value=levels)
