# Dynamo graph Revit Structural Framing.dyn "Revit_StructuralFraming" (Dynamo 3.4.0.6752)
# author: Dynamo Team
# このグラフでは、選択した Revit の床を基準にして、構造フレームと柱の構成が作成されます。

# group: 情報
# note: Revit モデルで選択した要素を基準にして、構造フレームの梁と柱を配置します。
# note: 次の Revit のインストール場所にある Samples フォルダ内の Snowdon Towers Sample Architectural.rvt ファイルを使用して、このグラフを実行します
# C:\Program Files\Autodesk\Revit 2026\Samples

# group: 入力
# note: 新しいパーゴラ構造を作成する Revit の床要素を選択
ソース_フロアを選択 = DSModelElementSelection()  # 1 picked in the model; graph input
# note: 構造物の高さ
高さ = DoubleSlider(8.4, range=0..10 step 0.1)  # graph input
梁の数 = IntegerSlider(9, range=2..10 step 1)  # graph input
# note: 構造を配置するレベルを選択
構造物のレベル = Levels("L1 - Block 43")  # graph input
# note: ペリメータ梁のフレーム タイプを選択します。このタイプは新しい構造フレーム タイプの作成にも使用されます
structural_framing_types = StructuralFramingTypes("W12X26")  # graph input
# note: 作成した柱のファミリ タイプを選択
構造柱タイプ = StructuralColumnTypes(index=0)  # graph input

# group: ジオメトリを準備
# 選択した要素のジオメトリのクリーンなソリッド式を準備します
# note: Revit 要素のジオメトリを取得
getGeometry = Element.GetGeometry(element=ソース_フロアを選択)
# note: 要素の開口部をすばやく破棄するには、その境界ボックス(要素を含む仮想の立方体)を取得します
byMinimumVolume = BoundingBox.ByMinimumVolume(geom=getGeometry)
# note: ソリッドには境界ボックス以外にも多くのアクションが使用できます。さらに変換を行うには、まず境界ボックスを立方体(ソリッドのタイプ)に変換します
toCuboid = BoundingBox.ToCuboid(boundingBox=byMinimumVolume)
# note: グラフの入力セクションの数値スライダで設定された高さ(zTranslation)で、ソリッドの立方体を移動
translate = Geometry.Translate(geometry=toCuboid, zTranslation=高さ)

# group: ソリッドの上部サーフェスを取得
# 中心の高さですべてのソリッドのサーフェスを評価し、最上部のサーフェスを取得します
# note: ソリッドをサーフェスに分解
explode = Geometry.Explode(geometry=translate)
code_block = CodeBlock { 0.5; }
# note: サーフェスの中心に点を配置
pointAtParameter = Surface.PointAtParameter(surface=explode, u=code_block, v=code_block)
# note: 各中心点の高さの数値を取得
Z = Point.Z(point=pointAtParameter)
# note: リストを別のリストで並べ替え: 高さの値を使用してサーフェスを並べ替えます
sortByKey = List.SortByKey(list=explode, keys=Z)
# note: リストの最後のサーフェスは上部サーフェスです
lastItem = List.LastItem(list=sortByKey.sortedList)

# group: サーフェス上の一連の点をオフセット
# note: 単純な式を使用して、n ステップ数を指定して最小(0.1)から最大(0.9)までの値のシーケンスを作成
u_値のシーケンス = CodeBlock(n=梁の数) { 0.1..0.9..#n; }
エッジ_オフセット = CodeBlock { [0.1,0.9]; }
# note: U パラメータと V パラメータを使用して、サーフェス上に点の配列を配置します。外積レーシングを使用(ノード上を右クリックして[レーシング]を選択)して、配列を生成します。
pointAtParameter_2 = Surface.PointAtParameter(surface=lastItem, u=u_値のシーケンス, v=エッジ_オフセット, lacing=CrossProduct)

# group: 内部の梁の線分を作成
# 点を接続して線分を作成します
インデックス = CodeBlock { 0; 1; }
# note: 'list' 入力の横にある[>]記号をクリックして、[レベルを使用]します。結果として、ネストされたリスト(@L2)で最も低い順からインデックス 0 の項目となります
getItemAtIndex = List.GetItemAtIndex(list=pointAtParameter_2@L2, index=インデックス.out0)
getItemAtIndex_2 = List.GetItemAtIndex(list=pointAtParameter_2@L2, index=インデックス.out1)
byStartPointEndPoint = Line.ByStartPointEndPoint(startPoint=getItemAtIndex, endPoint=getItemAtIndex_2)

# group: ペリメータ梁の曲線
# 説明<グループの説明を編集するにはここをダブル クリック>
firstItem = List.FirstItem(list=pointAtParameter_2)
lastItem_2 = List.LastItem(list=pointAtParameter_2)
byStartPointEndPoint_2 = Line.ByStartPointEndPoint(startPoint=firstItem, endPoint=lastItem_2)

# group: 柱の曲線
# 点の各 2 行目を取得して、柱を配置する線分を作成します
code_block_2 = CodeBlock { 2; }
# note: リストを 2 のリストに分割
chop = List.Chop(list=pointAtParameter_2, lengths=code_block_2)
# note: リスト レベル ロジックを使用して、@L3 の 1 番目のリストのみを取得
firstItem_2 = List.FirstItem(list=chop@L3)
高さを反転 = CodeBlock(H=高さ) { -H; }
# note: 点を下に移動
translate_2 = Geometry.Translate(geometry=firstItem_2, zTranslation=高さを反転)
# note: 点を接続して線分を作成
byStartPointEndPoint_3 = Line.ByStartPointEndPoint(startPoint=translate_2, endPoint=firstItem_2)

# group: Revit 用: 曲線で梁を配置
# note: 内部の梁を配置
beamByCurve = StructuralFraming.BeamByCurve(curve=byStartPointEndPoint, level=構造物のレベル, structuralFramingType=structural_framing_types)
# note: ペリメータ梁を配置
beamByCurve_2 = StructuralFraming.BeamByCurve(curve=byStartPointEndPoint_2, level=構造物のレベル, structuralFramingType=structural_framing_types)
# note: 構造柱を配置
columnByCurve = StructuralFraming.ColumnByCurve(curve=byStartPointEndPoint_3, level=構造物のレベル, structuralColumnType=構造柱タイプ)
