# Dynamo graph Revit Adaptive Component Placement.dyn (Dynamo 4.0.0.3076)
# author: Dynamo Team
# 이 그래프는 모델에서 점별로 가변 구성요소를 배치합니다.

# group: 정보
# note: 커튼월 그리드 선이 Revit에서 미리 선택되어 있으며 요소 ID는 Dynamo 파일과 함께 저장되어 있습니다
# note: Run this graph the Snowdon Towers Sample Architectural.rvt file in the Samples folder located with your Revit installation:
# C:\Program Files\Autodesk\Revit 2027\Samples
# Run this graph after you load the adaptive family AdaptivePanel.rfa from the Dynamo datasets location.
# note: Revit 파일에서 선택한 일부 요소를 기준으로 가변 구성요소를 배치합니다.
# 가변 구성요소에는 배치되는 패밀리의 배치 점 수와 동일한 점 세트가 필요합니다

# group: 입력
# note: 커튼월 그리드 선 선택
모서리_선택 = SelectEdges()  # 7 picked in the model; graph input
# note: 핀 중간점에 대한 최소 및 최대 변위를 설정합니다
최소_변위 = DoubleSlider(1.4, range=0.2..3 step 0.1)
최대_변위 = DoubleSlider(4.3, range=3..8 step 0.1)
# note: 가변 구성요소 패밀리 선택
family_types = FamilyTypes("AdaptivePanel:AdaptivePanel")  # graph input

# note: 곡선을 따라 점 위치 리스트를 작성합니다. 0은 시작점이고 0.5는 중간점이며 1은 끝점입니다
매개변수_리스트 = CodeBlock { [0,0.5,1]; }
# note: 각 곡선에서 시작점, 중간점 및 끝점을 찾습니다
pointAtParameter = Curve.PointAtParameter(curve=모서리_선택, param=매개변수_리스트, lacing=CrossProduct)

# group: 각 곡선에서 시작 및 끝점을 선택합니다
시작_및_끝점_색인 = CodeBlock { 0; 2; }
getItemAtIndex = List.GetItemAtIndex(list=pointAtParameter@L2, index=시작_및_끝점_색인.out0)
# note: 중간점을 선택하는 것과 유사하게 레벨을 사용하여 각 곡선에서 시작과 끝점을 선택합니다
getItemAtIndex_2 = List.GetItemAtIndex(list=pointAtParameter@L2, index=시작_및_끝점_색인.out1)

# group: 각 곡선에서 중간점을 선택합니다
중간점_색인 = CodeBlock { 1; }
# note: 입력 '리스트'의 리스트 레벨을 사용합니다. 기본적으로 노드의 결과는 색인이 1인 리스트가 됩니다(두 번째 곡선). '리스트' 입력을 마우스 오른쪽 버튼으로 클릭하고 @L2에서 '레벨 사용'을 선택합니다. 그러면 내포된 각 리스트에서 색인이 1인 항목이 선택됩니다(각 커브의 중간점).
getItemAtIndex_3 = List.GetItemAtIndex(list=pointAtParameter@L2, index=중간점_색인)

# group: 사인파를 작성합니다
# note: 선택된 소스 곡선의 개수를 계산합니다
count = List.Count(list=모서리_선택)
# note: 0에서 1까지의 N 값 시퀀스를 작성합니다
sequence = CodeBlock(steps=count) { 0..1..#steps; }
# note: 사인파를 작성합니다
sin = Math.Sin(angle=sequence)
# note: 사인파의 값을 새 최대값 및 최소값으로 다시 매핑합니다
remapRange = Math.RemapRange(numbers=sin, newMin=최소_변위, newMax=최대_변위)

# group: 중간점을 변위합니다
# note: Y 변위의 경우, 값을 음수화하여 커튼월 바깥쪽으로 변위합니다
값_음수화 = CodeBlock(y=remapRange) { -y; }
# note: 핀의 중간점을 변위합니다
translate = Geometry.Translate(geometry=getItemAtIndex_3, yTranslation=값_음수화, zTranslation=remapRange)

# note: Y 변위의 경우, 값을 음수화하여 커튼월 바깥쪽으로 변위합니다
값_음수화_2 = CodeBlock(y=remapRange) { y; }
# note: 핀의 중간점을 변위합니다
translate_2 = Geometry.Translate(geometry=getItemAtIndex_3, yTranslation=값_음수화_2, zTranslation=remapRange)

# group: 리스트의 점을 다시 결합합니다
list_create = List.Create(item0=getItemAtIndex, item1=translate, item2=getItemAtIndex_2, item3=translate_2)
# note: 매트릭스를 반전하고 3개 세트로 리스트를 구성합니다
transpose = List.Transpose(lists=list_create)

# group: Revit에: 구성요소 배치
# note: 가변 구성요소는 패밀리의 배치 점 수와 동일한 점 세트를 사용하여 배치할 수 있습니다.
byPoints = AdaptiveComponent.ByPoints(points=transpose, familyType=family_types)
