# Dynamo graph Revit Color.dyn (Dynamo 4.0.0.3076)
# author: Dynamo Team
# 이 그래프는 선택한 요소의 표면적을 평가하고 그래픽 재지정을 적용하여 해당 값을 기준으로 요소의 색상을 지정합니다.

# group: 정보
# note: Run this graph the Snowdon Towers Sample Architectural.rvt file in the Samples folder located with your Revit installation
# C:\Program Files\Autodesk\Revit 2027\Samples
# note: 이 그래프는 측정 가능한 기준에 따라 Revit 요소의 색상을 지정합니다(표면적).
# 요소는 뷰 > 요소별 방법에서 그래픽 재지정을 사용하여 색상이 지정됩니다.

# group: 모델 요소 선택
# 정면 벽을 선택합니다
# note: '변경'을 클릭하여 Revit 모델에서 요소를 선택합니다
select_model_elements = DSModelElementsSelection()  # 33 picked in the model; graph input

# group: 요소 표면적을 평가합니다
# note: 요소의 형상 가져오기
getGeometry = Element.GetGeometry(element=select_model_elements)
flatten = List.Flatten(list=getGeometry)
# note: 형상의 표면적 추출
area = Solid.Area(solid=flatten)
# note: 가장 높은 값 가져오기
maximumItem = List.MaximumItem(list=area)
# note: 가장 높은 값에서 정규화
div = area / maximumItem  # graph output

# group: 색상 작성
# 요소의 색상 코드를 지정할 색상 구성표를 준비합니다.
number = DoubleInput(0)
number_2 = DoubleInput(255)
# note: 색상 초록색
byARGB = Color.ByARGB(alpha=number, red=number, green=number_2, blue=number, lacing=Longest)
number_3 = DoubleInput(0)
number_4 = DoubleInput(255)
# note: 색상 빨간색
byARGB_2 = Color.ByARGB(alpha=number_3, red=number_4, green=number_3, blue=number_3, lacing=Longest)
create = List.Create(item0=byARGB, item1=byARGB_2)
code_block = CodeBlock { [0,1]; }
# note: 색상 범위 설정
color_range = ColorRange(colors=create, indices=code_block, value=div)

# group: Revit에: 뷰에서 요소 색상 재지정
# note: 활성 뷰에 있는 요소의 색상이 재지정됩니다
overrideColorInView = Element.OverrideColorInView(element=select_model_elements, color=color_range, lacing=Longest)

# group: 임계값
number_5 = DoubleInput(100)

# group: 대안 - 기준이 지정된 임계값을 통과하는지 평가합니다
# note: 임계값과 비교합니다
gt = area > number_5
# note: 숫자는 색상 스펙트럼에서 0부터 1까지의 위치를 나타냅니다
number_6 = DoubleInput(1)
number_7 = DoubleInput(0)
# note: 공차 내에서 영역 식별
if_ = RefactoredIf(test=gt, true=number_6, false=number_7)
# note: 이 결과를 색상 범위 노드의 '색인' 입력으로 사용할 수 있습니다
watch = Watch(if_)
