# Dynamo graph Revit Floors and Framing.dyn "Revit 바닥 및 프레임" (Dynamo 4.0.0.3076)
# author: Dynamo Team
# 이 그래프는 일련의 선과 변위를 사용하여 장식용 건물을 작성하고 Revit에서 구조 프레임 및 바닥 요소를 배치합니다.
# packages: PythonNet3 엔진 1.4.5

# group: 정보
# note: Revit이 설치된 위치에 있는 Samples 폴더의 Snowdon Towers Sample Architectural.rvt 파일을 열고 이 그래프를 실행합니다.
# C:\Program Files\Autodesk\Revit 2027\Samples
# note: 이 그래프는 일련의 선을 사용하여 장식용 건물을 작성하고 이러한 선으로 구조 프레임 및 바닥을 배치합니다.

# group: 장식용 건물 위치의 중심
x_위치 = DoubleSlider(30, range=25..40 step 1)  # graph input
y_위치 = DoubleSlider(30, range=25..40 step 1)  # graph input
z_위치 = DoubleSlider(62, range=60..80 step 1)  # graph input

# group: 장식용 건물 구성
# 설명 <그룹 설명을 편집하려면 여기를 두 번 클릭하십시오.>
아래_바닥_반지름 = DoubleSlider(10, range=8..20 step 1)  # graph input
바닥_수 = DoubleSlider(7, range=3..10 step 1)  # graph input
반지름_감소 = DoubleSlider(-1.25, range=-2..-0.5 step 0.25)  # graph input
다각형_변의_수 = IntegerSlider(5, range=3..10 step 1)  # graph input
맨_위_바닥_높이 = DoubleSlider(38.4, range=15..50 step 0.1)  # graph input
최대_회전_도 = DoubleSlider(130, range=10..180 step 5)  # graph input

# group: 다각형 구성
# 반지름이 감소하면서 수직으로 간격띄우기되고 순차적으로 회전하는 일련의 다각형을 작성합니다.
# note: 장식용 건물의 중심
byCoordinates = Point.ByCoordinates(x=x_위치, y=y_위치, z=z_위치)
# note: 원 반지름의 시퀀스
sequence = Sequence(start=아래_바닥_반지름, amount=바닥_수, step=반지름_감소, lacing=Longest)
# note: 일련의 원을 작성합니다
byCenterPointRadius = Circle.ByCenterPointRadius(centerPoint=byCoordinates, radius=sequence)
# note: 일련의 다각형을 만듭니다
regularPolygon = Polygon.RegularPolygon(circle=byCenterPointRadius, numberSides=다각형_변의_수)
# note: 바닥 표고 시퀀스
바닥_높이_시퀀스 = CodeBlock(top_floor=맨_위_바닥_높이, count=바닥_수) { 0..top_floor..#count; }
byCoordinates_2 = Vector.ByCoordinates(z=바닥_높이_시퀀스)
# note: 다각형을 지정된 높이만큼 위로 이동합니다
translate = Geometry.Translate(geometry=regularPolygon, direction=byCoordinates_2)
ZAxis = Vector.ZAxis()
# note: 각 바닥에 대한 회전 시퀀스
회전_각도_시퀀스 = CodeBlock(max_degrees=최대_회전_도, count=바닥_수) { 0..max_degrees..#count; }
# note: 일련의 각도로 다각형을 회전합니다
rotate = Geometry.Rotate(geometry=translate, origin=byCoordinates, axis=ZAxis, degrees=회전_각도_시퀀스)
# note: 다각형에서 개별 곡선 추출
curves = PolyCurve.Curves(polyCurve=rotate)

# group: 바닥 유형 및 레벨
# note: 드롭다운을 사용하여 프로젝트에 있는 유형에서 작성된 바닥의 바닥 유형을 선택합니다
floor_types = FloorTypes("Concrete Slab 6\"")  # graph input
levels = Levels("Green Roof Hardscape")  # graph input

# group: Revit에: 바닥 작성
# 일련의 닫힌 곡선 루프를 바닥 작성을 위한 입력으로 사용합니다.
# note: 곡선 그룹을 전달하여 바닥 만들기
byOutlineTypeAndLevel = Floor.ByOutlineTypeAndLevel(outline=curves, floorType=floor_types, level=levels)

# group: 수직 연결
# 장식용 건물 레벨 간 다각형 모서리 연결
# note: 각 다각형 곡선의 끝점 가져오기
endPoint = Curve.EndPoint(curve=curves)
# note: 매트릭스를 반전하고 수직으로 정렬된 끝점 리스트를 가져옵니다
transpose = List.Transpose(lists=endPoint)
# note: 장식용 건물의 가장 낮은 수준에서 가장 높은 수준까지 다각형의 일치하는 모서리를 연결하여 Polycurve로 결합합니다
byPoints = PolyCurve.ByPoints(points=transpose)
# note: Polycurve를 분해하고 구조 프레임 요소에 대한 입력으로 사용할 곡선 리스트를 확보합니다
curves_2 = PolyCurve.Curves(polyCurve=byPoints)

# group: 구조 프레임 유형 및 레벨
levels_2 = Levels("Green Roof Hardscape")  # graph input
# note: 드롭다운을 사용하여 프로젝트에 로드된 유형에서 구조 프레임 유형을 선택합니다
structural_framing_types = StructuralFramingTypes("W12X26")  # graph input

# group: Revit에: 구조 프레임 작성
# 곡선을 사용하여 구조 프레임 요소를 작성하고 Python 노드를 사용하여 개별 보 간의 결합을 허용하지 않습니다.
# note: 각 구조 요소에 대한 개별 곡선 전달
beamByCurve = StructuralFraming.BeamByCurve(curve=curves_2, level=levels_2, structuralFramingType=structural_framing_types)
# note: 리스트를 준비합니다
flatten = List.Flatten(list=beamByCurve)
# note: 이 노드는 Revit API를 참조하는 이름이 변경된 Python 노드로, 기본 제공 노드 이상으로 Dynamo가 수행할 수 있는 작업을 확장합니다. Python 코드를 읽으려면 노드를 마우스 오른쪽 버튼으로 클릭하고 편집...을 클릭합니다
구조_프레임에서_결합_허용하지_않음 = Python(structuralFraming=flatten)  # PythonNet3
# ---------- 구조_프레임에서_결합_허용하지_않음.python (35 lines) ----------
# Load the Python Standard and DesignScript Libraries
import sys
import clr
clr.AddReference('ProtoGeometry')
from Autodesk.DesignScript.Geometry import *
from Autodesk.Revit.DB import *
from RevitServices.Transactions import TransactionManager
from RevitServices.Persistence import DocumentManager 

doc = DocumentManager.Instance.CurrentDBDocument

# The inputs to this node will be stored as a list in the IN variables.
dataEnteringNode = IN

# Place your code below this line
structural_framing = UnwrapElement(IN[0])

unjoined_elements = []
# start a Transaction
TransactionManager.Instance.EnsureInTransaction(doc)
# iterate through each structural framing element
for sf in structural_framing:
    # check if the element passed in of Structural Framing Category
    sf_category = sf.Category # get the element's Category
    # use the Structural Framing's Category Id to check
    if sf_category.Id.Value == -2001320:
        # disallow joins at start and end of the structural framing element
        Structure.StructuralFramingUtils.DisallowJoinAtEnd(sf, 0)
        Structure.StructuralFramingUtils.DisallowJoinAtEnd(sf, 1)
        unjoined_elements.append(sf)
TransactionManager.Instance.TransactionTaskDone()

    
# Output the list of elements with Disallowed Join
OUT = unjoined_elements
# ----------------------------------------
