# Dynamo graph Revit Geometry Creation Curves.dyn (Dynamo 4.0.0.3076)
# author: Dynamo Team
# 이 그래프는 Dynamo에서 곡선을 작성하고 이를 사용하여 Revit 요소(모델 선)를 작성하는 몇 가지 방법을 보여줍니다.

# group: 정보
# note: 이 그래프에서는 Revit 모델 곡선을 작성하기 위한 입력으로 사용할 곡선을 작성하는 여러 가지 방법을 사용합니다
# note: Run this graph the Snowdon Towers Sample Architectural.rvt file in the Samples folder located with your Revit installation
# C:\Program Files\Autodesk\Revit 2027\Samples

# group: 4개의 점
# 설명 <그룹 설명을 편집하려면 여기를 두 번 클릭하십시오.>
number = DoubleInput(-35)
number_2 = DoubleInput(-55)
byCoordinates = Point.ByCoordinates(x=number, y=number_2)
number_3 = DoubleInput(-40)
byCoordinates_2 = Point.ByCoordinates(x=number, y=number_3)
number_4 = DoubleInput(-10)
byCoordinates_3 = Point.ByCoordinates(x=number_4, y=number_3)
number_5 = DoubleInput(-17)
number_6 = DoubleInput(-60)
byCoordinates_4 = Point.ByCoordinates(x=number_5, y=number_6)

list_create = List.Create(item0=byCoordinates, item1=byCoordinates_2, item2=byCoordinates_3, item3=byCoordinates_4)

# group: Nurbs 곡선에서 모델 곡선을 작성합니다(점으로)
# note: 점 리스트에서 NURBS 곡선을 작성합니다
byPoints = NurbsCurve.ByPoints(points=list_create)
# note: NURBS 곡선을 사용하여 Revit 모델 선을 작성합니다
byCurve = ModelCurve.ByCurve(curve=byPoints)

# group: Nurbs 곡선에서 모델 곡선을 작성합니다(제어점으로)
boolean = BoolSelector(false)
# note: 점 리스트에서 제어점으로 NURBS 곡선을 작성합니다
byControlPoints = NurbsCurve.ByControlPoints(points=list_create, closeCurve=boolean)
# note: NURBS 곡선을 사용하여 Revit 모델 선을 작성합니다
byCurve_2 = ModelCurve.ByCurve(curve=byControlPoints)

# group: NURBS 곡선에서 모델 곡선을 작성합니다
# note: 점 리스트에서 Polycurve를 작성합니다
byPoints_2 = PolyCurve.ByPoints(points=list_create)
curves = PolyCurve.Curves(polyCurve=byPoints_2)
# note: 곡선 리스트를 사용하여 Revit 모델 선 세트를 작성합니다
byCurve_3 = ModelCurve.ByCurve(curve=curves)

# group: 선에서 모델 곡선을 작성합니다
# note: 두 점에서 곡선을 작성합니다
byStartPointEndPoint = Line.ByStartPointEndPoint(startPoint=byCoordinates, endPoint=byCoordinates_2)
# note: 선(곡선)을 사용하여 Revit 모델 곡선을 작성합니다
byCurve_4 = ModelCurve.ByCurve(curve=byStartPointEndPoint)
