# Dynamo graph Revit Geometry Creation Points.dyn (Dynamo 4.0.0.3076)
# author: Dynamo Team
# 이 그래프는 개념 매스 패밀리 환경에서 모델 선 및 참조점을 작성합니다.

# group: 정보
# note: 화면 오른쪽 위 모소리에 있는 버튼(단축키: Ctrl+B)을 사용하여 3D 배경 탐색과 그래프 뷰 탐색 간에 전환할 수 있습니다. Dynamo 및 Revit의 경우 뷰 메뉴에서도 배경 미리보기를 켜고 끌 수 있습니다.
# note: Run this graph in a Conceptual Mass or Generic Model Adaptive family environment.
# To create a new family, go to File > New Family > and select the template located in the folder:
# C:\ProgramData\Autodesk\RVT 2027\Family Templates\English-Imperial\Generic Model Adaptive.rft
# note: 이 그래프는 패밀리 환경에서 모델 선 및 참조점을 작성합니다

# group: 점 좌표
점_x_값 = DoubleSlider(50, range=5..50 step 5)  # graph input
점_y_값 = DoubleSlider(25, range=5..50 step 5)  # graph input
점_z_값 = DoubleSlider(25, range=5..50 step 5)  # graph input

# note: Dynamo 환경에서 점의 위치 조작: Point.ByCoordinates 노드를 선택하고 배경 미리보기로 전환하여 3개의 축을 따라 점을 당깁니다.
byCoordinates = Point.ByCoordinates(x=점_x_값, y=점_y_값, z=점_z_값)
# note: 기하학적 데이터는 텍스트 정보로 또는 3D 공간에서 시각화할 수 있습니다
watch = Watch(byCoordinates)
byCoordinates_2 = Point.ByCoordinates()
byStartPointEndPoint = Line.ByStartPointEndPoint(startPoint=byCoordinates_2, endPoint=byCoordinates)
# note: 형상을 미리 봅니다
watch_3d = Watch3D(byStartPointEndPoint)
# note: 두 점을 연결하여 모델 곡선을 작성합니다
byCurve = ModelCurve.ByCurve(curve=byStartPointEndPoint)
# note: Dynamo에서는 Dynamo와 연관된 파일에 적합한 요소만 작성하고 수정할 수 있습니다. 예를 들어, 참조점은 특정 패밀리 환경(예: 일반 모델 가변)에서만 만들 수 있고 모델 선은 거의 모든 곳에서 작성할 수 있습니다.
byPoint = ReferencePoint.ByPoint(pt=byCoordinates)
