# Dynamo graph Revit Geometry Creation Solids.dyn "Revit 형상 작성 솔리드" (Dynamo 4.0.0.3076)
# author: Dynamo Team
# 이 그래프는 Dynamo에서 솔리드 형상을 작성하고 Revit에서 통합하는 여러 가지 방법을 보여줍니다. 일부 방법은 프로젝트 환경에서 사용할 수 있고 다른 방법은 특정 패밀리 환경(개념 매스)에서만 사용할 수 있습니다.

# group: 정보
# note: 대부분의 솔리드는 여러 가지 방법으로 작성할 수 있습니다. 이 예에서는 닫힌 프로파일을 기본으로 보여주지만, Polysurface를 스티치할 수 있고, 여러 기본체(표면, 직육면체, 원추 등)를 사용할 수 있습니다.
# 형상을 Revit 환경에 통합하려면 먼저 Revit 요소로 변환해야 합니다.
# 솔리드는 프로젝트와 모델 패밀리 환경에 모두 표시되는 가져오기 인스턴스로 변환할 수 있습니다.
# 또한 솔리드 형상은 개념 매스 및 가변 구성요소 패밀리 환경에서만 사용할 수 있는 양식 요소로 변환할 수도 있습니다.
# note: 이 그래프에서는 Revit에서 솔리드 형상을 작성하는 여러 가지 방법을 사용합니다. 일부 방법은 프로젝트 환경에서 사용할 수 있고 다른 방법은 특정 패밀리 환경에서만 사용할 수 있습니다.
# 개념 매스 패밀리 템플릿을 사용하여 모든 방법을 확인합니다.
# 파일 > 새로 만들기 > 패밀리로 이동하여 개념 매스 패밀리를 열고 Mass.rft 템플릿\Conceptual Mass\Mass.rft를 선택합니다

# group: 점 준비
# 점 세트를 생성하여 형상을 작성합니다.
byCoordinates = Point.ByCoordinates()
number = DoubleInput(10)
byCoordinates_2 = Point.ByCoordinates(x=number)
number_2 = DoubleInput(5)
byCoordinates_3 = Point.ByCoordinates(z=number_2)
number_3 = DoubleInput(10)
byCoordinates_4 = Point.ByCoordinates(y=number_3)
number_4 = DoubleInput(15)
byCoordinates_5 = Point.ByCoordinates(x=number_4, y=number_4)
number_5 = DoubleInput(5)
number_6 = DoubleInput(10)
byCoordinates_6 = Point.ByCoordinates(x=number_5, y=number_6, z=number_6)
number_7 = DoubleInput(-2)
number_8 = DoubleInput(5)
byCoordinates_7 = Point.ByCoordinates(x=number_7, y=number_8)

# group: 첫 번째 프로파일
# 첫 번째 프로파일을 호 및 선의 닫힌 곡선으로 작성합니다.
byStartPointEndPoint = Line.ByStartPointEndPoint(startPoint=byCoordinates, endPoint=byCoordinates_2)
byThreePoints = Arc.ByThreePoints(firstPoint=byCoordinates, secondPoint=byCoordinates_3, thirdPoint=byCoordinates_2)
create = List.Create(item0=byStartPointEndPoint, item1=byThreePoints)
# note: 로프트의 첫 번째 프로파일
byJoinedCurves = PolyCurve.ByJoinedCurves(curves=create)

# group: 두 번째 프로파일
# 두 번째 프로파일을 호 및 선의 닫힌 곡선으로 작성합니다.
byStartPointEndPoint_2 = Line.ByStartPointEndPoint(startPoint=byCoordinates_4, endPoint=byCoordinates_5)
byThreePoints_2 = Arc.ByThreePoints(firstPoint=byCoordinates_4, secondPoint=byCoordinates_6, thirdPoint=byCoordinates_5)
create_2 = List.Create(item0=byStartPointEndPoint_2, item1=byThreePoints_2)
# note: 로프트의 두 번째 프로파일
byJoinedCurves_2 = PolyCurve.ByJoinedCurves(curves=create_2)

# note: 리스트의 프로파일 2개 결합
create_3 = List.Create(item0=byJoinedCurves, item1=byJoinedCurves_2)

# group: 횡단면으로 솔리드 로프트
# 설명 <그룹 설명을 편집하려면 여기를 두 번 클릭하십시오.>
byLoft = Solid.ByLoft(crossSections=create_3)

# note: 솔리드의 체적 조사
volume = Solid.Volume(solid=byLoft)

# group: 쉘 작성
code_block = CodeBlock { 0; }
# note: 팁: 요소가 표시되지 않도록 하려면 노드 오른쪽 클릭 메뉴에서 "미리보기"를 끄십시오
thinShell = Solid.ThinShell(solid=byLoft, internalFaceThickness=code_block)

# group: 형상 이동
code_block_2 = CodeBlock { Vector.ByCoordinates(20,0,0); }
# note: 형상을 측면으로 이동하여 원래 결과와 최종 결과를 모두 미리 봅니다
translate = Geometry.Translate(geometry=thinShell, direction=code_block_2)

# group: 솔리드 자르기
# 자르기 작업을 사용하여 평면으로 쉘 솔리드를 자릅니다.
code_block_3 = CodeBlock { Point.ByCoordinates(0,0,5); }
ZAxis = Vector.ZAxis()
byOriginNormal = Plane.ByOriginNormal(origin=code_block_3, normal=ZAxis)
number_9 = DoubleInput(10)
# note: 자를 때 유지할 변을 선택합니다(점에 가장 가까운 변은 무시됨).
byCoordinates_8 = Point.ByCoordinates(x=number_9, y=number_9, z=number_9)
# note: 형상 카테고리에서는 (교차, 차이, 결합 등) 기하학적 부울 연산을 사용할 수 있습니다.
trim = Geometry.Trim(geometry=translate, other=byOriginNormal, pick=byCoordinates_8)

# group: 안내 곡선
# 로프트 솔리드 모양의 안내 곡선으로 사용할 NURBS 곡선을 작성합니다.
create_4 = List.Create(item0=byCoordinates, item1=byCoordinates_7, item2=byCoordinates_4)
# note: NURBS 곡선으로 구성된 안내 곡선
byPoints = NurbsCurve.ByPoints(points=create_4)

# group: 횡단면 및 안내 곡선으로 솔리드 로프트
# note: 팁: 요소가 표시되지 않도록 하려면 노드 오른쪽 클릭 메뉴에서 "미리보기"를 끄십시오
byLoft_2 = Solid.ByLoft(crossSections=create_3, guideCurves=byPoints)

# group: 가져오기 인스턴스 작성
code_block_4 = CodeBlock { Vector.ByCoordinates(-20,0,0); }
translate_2 = Geometry.Translate(geometry=byLoft_2, direction=code_block_4)
# note: 형상은 Revit 요소와 같지 않습니다.
# ImportInstance를 사용하여 Revit 환경의 표면과 솔리드에서 Revit 가져오기를 만들거나, 점 및 곡선을 사용하여 패밀리 인스턴스(instance)를 배치하거나, 점(가변 구성요소) 기준 매스 및 일반 모델 패밀리에서 양식을 만드십시오
byGeometries = ImportInstance.ByGeometries(geometries=translate_2)
byCoordinates_9 = Vector.ByCoordinates()

# group: 양식 작성
# 두 개의 프로파일 곡선 루프를 사용하여 양식 요소를 작성합니다(개념 매스 패밀리 환경에서).
curves = PolyCurve.Curves(polyCurve=create_3)
# note: 곡선에서 모델 곡선 작성
referenceCurveByCurve = ModelCurve.ReferenceCurveByCurve(curve=curves)
# note: 양식은 개념 매스 패밀리의 일부로만 작성할 수 있습니다
byLoftCrossSections = Form.ByLoftCrossSections(curves=referenceCurveByCurve)
