# Dynamo graph Revit Geometry Creation Surfaces.dyn "Revit 형상 작성 표면" (Dynamo 4.0.0.3076)
# author: Dynamo Team
# 이 그래프는 Dynamo에서 표면을 작성하는 여러 가지 방법과 형상을 Revit 형상으로 변환하는 두 가지 방법을 보여줍니다.

# group: 정보
# note: 이 그래프는 Revit에서 표면 형상을 작성하는 여러 가지 방법을 사용합니다. 일부 방법은 프로젝트 환경에서 사용할 수 있고 다른 방법은 특정 패밀리 환경에서만 사용할 수 있습니다.
# 개념 매스 패밀리 템플릿을 사용하여 모든 방법을 확인합니다.
# 파일 > 새로 만들기 > 패밀리로 이동하여 개념 매스 패밀리를 작성하고 Conceptual Mass 폴더에서 Mass.rft 템플릿을 선택합니다.
# note: 대부분의 표면은 여러 가지 방법으로 작성할 수 있습니다. 표면, Polysurface(표면 모음) 및 NURBS 표면은 점, 곡선으로 작성할 수 있고 다양한 작업을 통해 기타 표면 및 솔리드에서 파생될 수 있습니다.
# note: 형상을 Revit 환경에 통합하려면 먼저 Revit 요소로 변환해야 합니다.
# 표면 및 솔리드는 프로젝트 및 모델 패밀리 환경에 모두 표시되는 가져오기 인스턴스로 변환할 수 있습니다.
# 또한 표면 형상은 개념 매스 및 가변 구성요소 패밀리 환경에서만 사용할 수 있는 양식 요소로 변환할 수도 있습니다.

# group: 점 준비
# 점 세트를 생성하여 형상을 작성합니다.
number = DoubleInput(10)
byCoordinates = Point.ByCoordinates(y=number)
number_2 = DoubleInput(5)
number_3 = DoubleInput(10)
byCoordinates_2 = Point.ByCoordinates(x=number_2, y=number_3, z=number_3)
number_4 = DoubleInput(15)
byCoordinates_3 = Point.ByCoordinates(x=number_4, y=number_4)
byCoordinates_4 = Point.ByCoordinates()
number_5 = DoubleInput(5)
byCoordinates_5 = Point.ByCoordinates(z=number_5)
byCoordinates_6 = Point.ByCoordinates(x=number)
number_6 = DoubleInput(-5)
number_7 = DoubleInput(5)
byCoordinates_7 = Point.ByCoordinates(x=number_6, y=number_7)
number_8 = DoubleInput(10)
number_9 = DoubleInput(-10)
byCoordinates_8 = Point.ByCoordinates(x=number_8, y=number_9)
byCoordinates_9 = Point.ByCoordinates(y=number_9)

# group: 프로파일 작성
byThreePoints = Arc.ByThreePoints(firstPoint=byCoordinates, secondPoint=byCoordinates_2, thirdPoint=byCoordinates_3)
byThreePoints_2 = Arc.ByThreePoints(firstPoint=byCoordinates_4, secondPoint=byCoordinates_5, thirdPoint=byCoordinates_6)
byThreePoints_3 = Arc.ByThreePoints(firstPoint=byCoordinates_4, secondPoint=byCoordinates_7, thirdPoint=byCoordinates)
byStartPointEndPoint = Line.ByStartPointEndPoint(startPoint=byCoordinates_8, endPoint=byCoordinates_9)

# group: 스윕별 표면
# 프로파일, 경로 곡선 및 안내 레일을 사용하여 스윕 표면을 작성합니다.
bySweep2Rails = Surface.BySweep2Rails(path=byThreePoints, guideRail=byThreePoints_2, profile=byThreePoints_3)

# group: 가져오기 작성
# note: 인스턴스 가져오기를 사용하여 표면 및 솔리드에서 Revit 가져오기를 작성합니다. 가져온 항목은 모든 Revit 환경에서 볼 수 있습니다.
byGeometries = ImportInstance.ByGeometries(geometries=bySweep2Rails)

create = List.Create(item0=byStartPointEndPoint, item1=byThreePoints_2)

# group: 로프트로 표면 작성
# 횡단면을 결합하여 로프트 표면을 작성합니다.
byLoft = Surface.ByLoft(crossSections=create)

# group: 표면적 평가
area = Surface.Area(surface=byLoft)
watch = Watch(area)
create_2 = List.Create(item0=byLoft, item1=bySweep2Rails)
# note: Polysurface로 결합된 표면은 단일 도면요소로 평가할 수 있습니다
byJoinedSurfaces = PolySurface.ByJoinedSurfaces(surfaces=create_2)
area_2 = Surface.Area(surface=byJoinedSurfaces)
watch_2 = Watch(area_2)
area_3 = Surface.Area(surface=bySweep2Rails)
watch_3 = Watch(area_3)

# group: 제어점의 NURBS 표면
# 제어점에서 스윕을 NURBS 표면으로 변환합니다.
code_block = CodeBlock { 0..1..0.1; }
# note: 모서리, 점 및 기타 피쳐는 해당 형상에 적합한 "작업"을 사용하여 곡면에서 파생될 수 있습니다.
pointAtParameter = Surface.PointAtParameter(surface=bySweep2Rails, u=code_block, v=code_block, lacing=CrossProduct)
# note: 제어점에서 NURBS 표면으로 표면을 재구성합니다
byControlPoints = NurbsSurface.ByControlPoints(controlVertices=pointAtParameter)
# note: Watch 3D 노드를 사용하여 형상을 개별적으로 미리 봅니다
watch_3d = Watch3D(byControlPoints)

# group: 돌출 곡선별 표면
# 곡선을 사용하여 지정된 거리의 돌출을 작성합니다.
code_block_2 = CodeBlock { 10; }
extrude = Curve.Extrude(curve=byThreePoints, distance=code_block_2)

# group: 양식 작성
# 두 곡선에서 로프트 모양을 작성합니다.
referenceCurveByCurve = ModelCurve.ReferenceCurveByCurve(curve=create)
byLoftCrossSections = Form.ByLoftCrossSections(curves=referenceCurveByCurve)
