# Dynamo graph Revit Import Solid.dyn (Dynamo 4.0.0.3076)
# author: Dynamo Team
# 이 그래프는 Dynamo 솔리드 형상을 작성하고 이를 사용하여 Revit 가져오기 인스턴스 요소를 작성하는 방법을 보여줍니다. 일련의 호 프로파일을 작성하고 이를 사용해 로프트 표면을 작성하여 새 지붕 모양을 구성합니다.

# group: 정보
# note: 소스 요소(지붕)가 Revit에서 미리 선택되어 있으며 요소 ID는 Dynamo 파일과 함께 저장되어 있습니다
# note: Run this graph the Snowdon Towers Sample Architectural.rvt file in the Samples folder located with your Revit installation
# C:\Program Files\Autodesk\Revit 2027\Samples
# note: 일련의 호 프로파일을 작성하고 이를 사용해 로프트 표면을 작성하여 선택한 지붕 요소에서 새 지붕 모양을 구성합니다. 형상은 가져오기 인스턴스로 변환되어 Revit 환경에 통합됩니다

# group: 새 지붕 구성
# note: 로프트 표면을 작성할 프로파일 수
프로파일_수 = IntegerSlider(6, range=3..10 step 1)
# note: 새 지붕의 짧은 끝 부분 높이
지붕_단면_최소값 = DoubleSlider(2.1, range=1..5 step 0.1)
# note: 지붕의 중간 부분 높이
지붕_단면_최대값 = DoubleSlider(7, range=5..10 step 0.1)
# note: 이 값만큼 옆으로 호 프로파일 연장합니다
지붕_측면_연장 = DoubleSlider(0.5, range=0.1..3 step 0.1)
# note: 새 지붕 모양의 두께
지붕_두께 = DoubleSlider(0.5, range=0.1..2 step 0.1)

프로파일_수_2 = CodeBlock(steps=프로파일_수) { steps; }

# group: 지붕 선택
# 요소의 소스 지붕을 선택합니다
# note: 'IsInput'으로 표시된 모든 입력은 Dynamo 플레이어에서 설정할 수 있습니다
평지붕_선택 = DSModelElementSelection()  # 1 picked in the model

# group: 지붕 면 가져오기
# 소스 요소의 형상을 분해하고 면적이 가장 큰 한 면을 선택합니다.
# note: 선택한 요소의 면을 가져오려면 먼저 해당 형상을 가져와야 합니다
# note: 마우스 오른쪽 버튼을 클릭하고 '형상 미리보기'를 선택 취소하여 최종 결과를 보다 명확하게 확인합니다
getGeometry = Element.GetGeometry(element=평지붕_선택)
# note: 형상을 분해하여 개별 면을 가져옵니다
explode = Geometry.Explode(geometry=getGeometry)
# note: 리스트 구조를 제거합니다. 여러 소스 객체가 사용되는 경우 이 단계는 필요하지 않습니다
flatten = List.Flatten(list=explode)
area = Surface.Area(surface=flatten)
# note: 면적별로 표면 리스트를 정렬합니다. 면적이 가장 큰 표면이 sortedList 출력 리스트의 마지막 항목이 됩니다
sortByKey = List.SortByKey(list=flatten, keys=area)
lastItem = List.LastItem(list=sortByKey.sortedList)
number = DoubleInput(1.5)
# note: 표면을 위쪽으로 이동합니다
translate = Geometry.Translate(geometry=lastItem, zTranslation=number)

# group: 바깥쪽으로 간격띄우기(축척 조정)
# 표면의 축척을 조정하여 표면의 모서리를 바깥쪽으로 연장합니다.
uv_위치 = CodeBlock { 0.5; }
pointAtParameter = Surface.PointAtParameter(surface=translate, u=uv_위치, v=uv_위치)
점에서_점으로_축척_조정 = CodeBlock { point1 = Point.ByCoordinates(1, 1); point2 = Point.ByCoordinates(-40, -40); }
scale = Geometry.Scale(geometry=translate, basePoint=pointAtParameter, from=점에서_점으로_축척_조정.point1, to=점에서_점으로_축척_조정.point2)

# group: 표면의 점
# 간격이 균등한 점 리스트 3개(긴 모서리를 따라 2개 행, 중간에 1개 행)를 생성합니다.
# note: 0과 1은 표면의 더 긴 모서리를 따르는 위치입니다
모서리_행의_u_위치 = CodeBlock { [0,1]; }
# note: 0에서 1 및 N 단계의 시퀀스로 긴 모서리를 따르는 V 위치
모서리_행의_v_위치 = CodeBlock(steps=프로파일_수_2) { [0..1..#steps]; }
# note: 노드 > 레이싱을 마우스 오른쪽 버튼으로 클릭하여 가장 긴 레이싱 설정을 사용합니다.
# 가장 긴 레이싱은 리스트 구조가 다른 입력과 일치합니다. 이 경우 두 개의 점 리스트가 결과로 생성되며, 각 리스트의 각 점 수는 가장 긴 입력 리스트와 일치합니다.
pointAtParameter_2 = Surface.PointAtParameter(surface=scale, u=모서리_행의_u_위치, v=모서리_행의_v_위치, lacing=Longest)
# note: U 값이 0.5이면 표면의 중간을 따라 점이 배치됩니다
중간_행의_u_위치 = CodeBlock { [0.5]; }
# note: 0에서 1 및 N단계의 시퀀스로 점의 중간 행을 따르는 V 위치
중간_행의_v_위치 = CodeBlock(steps=프로파일_수_2) { [0..1..#steps]; }
# note: 가장 긴 레이싱이 이 노드에 사용됩니다. 결과는 하나의 점 리스트로, 리스트의 점 수가 가장 긴 입력 리스트와 일치합니다.
pointAtParameter_3 = Surface.PointAtParameter(surface=scale, u=중간_행의_u_위치, v=중간_행의_v_위치, lacing=Longest)

# group: 점을 위쪽으로 간격띄우기
# 중간 행의 점을 코사인파 모양으로 간격띄우기합니다.
# note: 일련의 간격띄우기를 생성하는 값 시퀀스
각도_시퀀스 = CodeBlock(steps=프로파일_수_2) { -1..1..#steps; }
# note: 대안: 다른 지붕 모양에 사인을 사용합니다
sin = Math.Sin(angle=각도_시퀀스)
# note: 코사인파의 값
cos = Math.Cos(angle=각도_시퀀스)
# note: 새 도메인으로 값을 다시 매핑합니다
remapRange = Math.RemapRange(numbers=cos, newMin=지붕_단면_최소값, newMax=지붕_단면_최대값)
# note: 중간 행의 점을 이동합니다
translate_2 = Geometry.Translate(geometry=pointAtParameter_3@L2, zTranslation=remapRange)

# group: 호에서 프로파일 작성
# 점을 사용하여 호를 작성합니다.
# note: 모서리와 중간 행을 하나의 리스트로 결합합니다
join = List.Join(list0=pointAtParameter_2, list1=translate_2)
항목_색인 = CodeBlock { 0; 1; 2; }
getItemAtIndex = List.GetItemAtIndex(list=join, index=항목_색인.out0)
getItemAtIndex_2 = List.GetItemAtIndex(list=join, index=항목_색인.out2)
getItemAtIndex_3 = List.GetItemAtIndex(list=join, index=항목_색인.out1)
byThreePoints = Arc.ByThreePoints(firstPoint=getItemAtIndex, secondPoint=getItemAtIndex_2, thirdPoint=getItemAtIndex_3)

# group: 프로파일 연장
# 각 프로파일의 곡선을 지정된 거리만큼 연장합니다.
# note: 연장 값은 그래프 왼쪽의 입력으로 설정됩니다.
모서리_연장 = CodeBlock(roof_extension=지붕_측면_연장) { roof_extension; }
extendStart = Curve.ExtendStart(curve=byThreePoints, distance=모서리_연장)
extendEnd = Curve.ExtendEnd(curve=extendStart, distance=모서리_연장)

# group: 로프트 및 두께 지정
# 로프트 표면을 작성하고 두께를 지정합니다.
byLoft = Surface.ByLoft(crossSections=extendEnd)
thicken = Surface.Thicken(surface=byLoft, thickness=지붕_두께)

# group: Revit에:
# ImportInstance 및 레벨 설정 매개변수를 통해 Dynamo 형상을 Revit 요소로 변환합니다.
# note: 형상을 Revit 환경에 통합하려면 먼저 Revit 요소로 변환해야 합니다.
# 솔리드는 프로젝트와 모델 패밀리 환경에 모두 표시되는 가져오기 인스턴스로 변환할 수 있습니다.
byGeometry = ImportInstance.ByGeometry(geometry=thicken)
code_block = CodeBlock { "작업 기준면"; }
levels = Levels("L1 - Block 43")
# note: 작업 기준면 매개변수를 표고와 내부 원점 위치가 일치하는 레벨로 설정하여 배치된 가져오기 인스턴스의 높이를 수정합니다.
setParameterByName = Element.SetParameterByName(element=byGeometry, parameterName=code_block, value=levels)
