# Dynamo graph Revit Structural Framing.dyn (Dynamo 4.0.0.3076)
# author: Dynamo Team
# 이 그래프는 선택한 Revit 바닥을 기준으로 구조 프레임 및 기둥의 구조를 작성합니다.

# group: 정보
# note: Revit 모델에서 선택한 요소를 기준으로 구조 프레임 보 및 기둥을 배치합니다.
# note: Run this graph the Snowdon Towers Sample Architectural.rvt file in the Samples folder located with your Revit installation
# C:\Program Files\Autodesk\Revit 2027\Samples

# group: 입력
# note: 새 퍼걸러 구조를 작성할 기준이 되는 Revit 바닥 요소를 선택합니다
소스_바닥_선택 = DSModelElementSelection()  # 1 picked in the model; graph input
# note: 구조물 높이
높이 = DoubleSlider(8.4, range=0..10 step 0.1)  # graph input
보_수 = IntegerSlider(9, range=2..10 step 1)  # graph input
# note: 구조물을 배치할 레벨을 선택합니다
구조_레벨 = Levels("L1 - Block 43")  # graph input
# note: 둘레 보의 프레임 유형을 선택합니다. 이 유형은 새 구조 프레임 유형을 작성하는 데도 사용됩니다
structural_framing_types = StructuralFramingTypes("W12X26")  # graph input
# note: 작성된 기둥의 패밀리 유형을 선택합니다
구조_기둥_유형 = StructuralColumnTypes(index=0)  # graph input

# group: 형상 준비
# 선택한 요소의 형상을 깔끔한 솔리드 표현으로 준비합니다.
# note: Revit 요소의 형상을 가져옵니다
getGeometry = Element.GetGeometry(element=소스_바닥_선택)
# note: 요소 개구부를 제거하는 빠른 방법으로, 해당 경계 상자(요소가 포함된 가상 직육면체)를 가져옵니다
byMinimumVolume = BoundingBox.ByMinimumVolume(geom=getGeometry)
# note: 솔리드에 대해서는 경계 상자보다 더 많은 작업을 수행할 수 있습니다. 추가 변환을 허용하려면 먼저 경계 상자를 솔리드 유형인 직육면체로 변환해야 합니다
toCuboid = BoundingBox.ToCuboid(boundingBox=byMinimumVolume)
# note: 그래프 입력 섹션에서 숫자 슬라이더로 설정한 높이(zTranslation)로 솔리드 직육면체를 이동합니다
translate = Geometry.Translate(geometry=toCuboid, zTranslation=높이)

# group: 솔리드의 상단 표면을 가져옵니다
# 모든 솔리드의 표면을 중심의 고도로 평가하고 가장 높은 표면을 구합니다.
# note: 솔리드를 표면으로 분해합니다
explode = Geometry.Explode(geometry=translate)
code_block = CodeBlock { 0.5; }
# note: 표면의 중심에서 점을 찾습니다
pointAtParameter = Surface.PointAtParameter(surface=explode, u=code_block, v=code_block)
# note: 각 중심점의 표고에 대한 숫자 값을 가져옵니다
Z = Point.Z(point=pointAtParameter)
# note: 한 리스트를 다른 리스트로 정렬: 표고 값을 사용하여 표면을 정렬합니다
sortByKey = List.SortByKey(list=explode, keys=Z)
# note: 리스트의 마지막 표면은 상단 표면입니다
lastItem = List.LastItem(list=sortByKey.sortedList)

# group: 표면에서 일련의 점 간격띄우기
# note: 간단한 공식을 사용하여 최소(0.1)에서 최대(0.9)의 값 시퀀스를 'n'의 단계 수로 작성합니다
u_값의_시퀀스 = CodeBlock(n=보_수) { 0.1..0.9..#n; }
모서리_간격띄우기 = CodeBlock { [0.1,0.9]; }
# note: U 및 V 매개변수를 사용하여 표면에 점의 배열을 배치합니다. 외적 레이싱(노드를 마우스 오른쪽 버튼으로 클릭하고 레이싱 선택)을 사용하여 배열을 생성합니다.
pointAtParameter_2 = Surface.PointAtParameter(surface=lastItem, u=u_값의_시퀀스, v=모서리_간격띄우기, lacing=CrossProduct)

# group: 내부 보에 대한 선 작성
# 점을 연결하고 선을 작성합니다.
색인 = CodeBlock { 0; 1; }
# note: '리스트' 입력 옆에 있는 > 기호를 클릭하여 레벨을 사용합니다. 즉, 내포된 각 최하위 리스트(@L2)에서 색인이 0인 항목이 결과가 됩니다
getItemAtIndex = List.GetItemAtIndex(list=pointAtParameter_2@L2, index=색인.out0)
getItemAtIndex_2 = List.GetItemAtIndex(list=pointAtParameter_2@L2, index=색인.out1)
byStartPointEndPoint = Line.ByStartPointEndPoint(startPoint=getItemAtIndex, endPoint=getItemAtIndex_2)

# group: 둘레 보의 곡선
# 설명 <그룹 설명을 편집하려면 여기를 두 번 클릭하십시오.>
firstItem = List.FirstItem(list=pointAtParameter_2)
lastItem_2 = List.LastItem(list=pointAtParameter_2)
byStartPointEndPoint_2 = Line.ByStartPointEndPoint(startPoint=firstItem, endPoint=lastItem_2)

# group: 기둥 곡선
# 점의 두 번째 행을 각각 사용하여 기둥 배치를 위한 선을 작성합니다.
code_block_2 = CodeBlock { 2; }
# note: 리스트를 2개의 리스트로 자릅니다
chop = List.Chop(list=pointAtParameter_2, lengths=code_block_2)
# note: 리스트 레벨 논리를 사용하여 @L3에 있는 첫 번째 리스트만 가져옵니다
firstItem_2 = List.FirstItem(list=chop@L3)
높이_반전 = CodeBlock(H=높이) { -H; }
# note: 점을 아래로 이동합니다
translate_2 = Geometry.Translate(geometry=firstItem_2, zTranslation=높이_반전)
# note: 점을 연결하여 선을 작성합니다
byStartPointEndPoint_3 = Line.ByStartPointEndPoint(startPoint=translate_2, endPoint=firstItem_2)

# group: Revit에: 곡선으로 보 배치
# note: 내부 보 배치
beamByCurve = StructuralFraming.BeamByCurve(curve=byStartPointEndPoint, level=구조_레벨, structuralFramingType=structural_framing_types)
# note: 둘레 보 배치
beamByCurve_2 = StructuralFraming.BeamByCurve(curve=byStartPointEndPoint_2, level=구조_레벨, structuralFramingType=structural_framing_types)
# note: 구조 기둥을 배치합니다
columnByCurve = StructuralFraming.ColumnByCurve(curve=byStartPointEndPoint_3, level=구조_레벨, structuralColumnType=구조_기둥_유형)
