# Dynamo graph Revit Adaptive Component Placement.dyn "Umieszczanie komponentów adaptacyjnych programu Revit" (Dynamo 4.0.0.3076)
# author: Dynamo Team
# Ten wykres umieszcza komponenty adaptacyjne według punktów w modelu.

# group: Informacje
# note: Linie siatki ściany kurtynowej zostały wstępnie wybrane z programu Revit, a identyfikatory elementów zapisano w pliku dodatku Dynamo
# note: Uruchom ten wykres w pliku Snowdon Towers Sample Architectural.rvt w folderze Samples znajdującym się w lokalizacji instalacji programu Revit:
# C:\Program Files\Autodesk\Revit 2027\Samples
# Uruchom ten wykres po wczytaniu pliku rodziny adaptacyjnej AdaptivePanel.rfa z lokalizacji zestawów danych dodatku Dynamo.
# note: Umieść komponenty adaptacyjne względem niektórych elementów wybranych w pliku programu Revit.
# Komponenty adaptacyjne wymagają zestawu punktów o liczności równej liczbie punktów umieszczenia umieszczanej rodziny

# group: Dane wejściowe
# note: Wybierz linie siatki ściany kurtynowej
wybierz_krawędzie = SelectEdges()  # 7 picked in the model; graph input
# note: Ustaw minimalne i maksymalne przemieszczenie dla punktu środkowego żebra
przemieszczenie_minimalne = DoubleSlider(1.4, range=0.2..3 step 0.1)
przemieszczenie_maksymalne = DoubleSlider(4.3, range=3..8 step 0.1)
# note: Wybierz rodzinę komponentów adaptacyjnych
family_types = FamilyTypes("AdaptivePanel:AdaptivePanel")  # graph input

# note: Utwórz listę położeń punktów wzdłuż krzywej, 0 oznacza początek, 0,5 — środek, a 1 — koniec
lista_parametrów = CodeBlock { [0,0.5,1]; }
# note: Zlokalizuj punkty początkowy, środkowy i końcowy na każdej krzywej
pointAtParameter = Curve.PointAtParameter(curve=wybierz_krawędzie, param=lista_parametrów, lacing=CrossProduct)

# group: Pobierz punkty początkowy i końcowy z każdej krzywej
indeksy_punktów_początkowego_i = CodeBlock { 0; 2; }  # "indeksy punktów początkowego i końcowego"
getItemAtIndex = List.GetItemAtIndex(list=pointAtParameter@L2, index=indeksy_punktów_początkowego_i.out0)
# note: Podobnie jak w przypadku wybierania punktu środkowego, użyj opcji poziomów, aby wybrać punkty początkowy i końcowy z każdej krzywej
getItemAtIndex_2 = List.GetItemAtIndex(list=pointAtParameter@L2, index=indeksy_punktów_początkowego_i.out1)

# group: Pobierz punkt środkowy z każdej krzywej
indeks_punktu_środkowego = CodeBlock { 1; }
# note: Użyj opcji poziomów listy pozycji danych wejściowych 'list'. Domyślnie wynikiem węzła będzie lista o indeksie jeden (druga krzywa). Kliknij prawym przyciskiem myszy pozycję danych wejściowych 'list' i wybierz opcję 'Użyj poziomów' na poziomie 2 (L2). Spowoduje to wybranie elementu o indeksie 1 z każdej listy zagnieżdżonej (punkty środkowe poszczególnych krzywych)
getItemAtIndex_3 = List.GetItemAtIndex(list=pointAtParameter@L2, index=indeks_punktu_środkowego)

# group: Utwórz sinusoidę
# note: Policz liczbę wybranych krzywych źródłowych
count = List.Count(list=wybierz_krawędzie)
# note: Utwórz sekwencję wartości N z zakresu od 0 do 1
sequence = CodeBlock(steps=count) { 0..1..#steps; }
# note: Utwórz sinusoidę
sin = Math.Sin(angle=sequence)
# note: Ponownie odwzoruj wartości sinusoidy do nowych wartości maks. i min.
remapRange = Math.RemapRange(numbers=sin, newMin=przemieszczenie_minimalne, newMax=przemieszczenie_maksymalne)

# group: Przemieść punkty środkowe
# note: W przypadku przemieszczenia w kierunku osi Y w celu dokonania przemieszczenia na zewnątrz ściany kurtynowej zaneguj wartość
zaneguj_wartość = CodeBlock(y=remapRange) { -y; }
# note: Przemieść punkty środkowe żebra
translate = Geometry.Translate(geometry=getItemAtIndex_3, yTranslation=zaneguj_wartość, zTranslation=remapRange)

# note: W przypadku przemieszczenia w kierunku osi Y w celu dokonania przemieszczenia na zewnątrz ściany kurtynowej zaneguj wartość
zaneguj_wartość_2 = CodeBlock(y=remapRange) { y; }
# note: Przemieść punkty środkowe żebra
translate_2 = Geometry.Translate(geometry=getItemAtIndex_3, yTranslation=zaneguj_wartość_2, zTranslation=remapRange)

# group: Ponownie połącz punkty na listach
list_create = List.Create(item0=getItemAtIndex, item1=translate, item2=getItemAtIndex_2, item3=translate_2)
# note: Odwróć macierz i uporządkuj listy w zestawach po 3
transpose = List.Transpose(lists=list_create)

# group: Do programu Revit: umieść komponent
# note: Komponenty adaptacyjne można umieszczać za pomocą zestawów punktów o liczności równej liczbie punktów umieszczania rodziny.
byPoints = AdaptiveComponent.ByPoints(points=transpose, familyType=family_types)
