# Dynamo graph Revit Color.dyn "Kolor Revit" (Dynamo 4.0.0.3076)
# author: Dynamo Team
# Ten wykres oblicza pole powierzchni wybranych elementów i stosuje nadpisania grafiki w celu pokolorowania elementów na podstawie tej wartości.

# group: Informacje
# note: Uruchom ten wykres w pliku Snowdon Towers Sample Architectural.rvt w folderze Samples znajdującym się w lokalizacji instalacji programu Revit
# C:\Program Files\Autodesk\Revit 2027\Samples
# note: Ten wykres koloruje elementy programu Revit na podstawie mierzalnych kryteriów (pole powierzchni).
# Elementy są kolorowane przy użyciu metody Nadpisz grafikę w widoku > Według elementu.

# group: Wybierz elementy modelu
# Wybierz ściany fasady
# note: Kliknij przycisk 'Zmień', aby wybrać elementy z modelu programu Revit
wybierz_elementy_modelu = DSModelElementsSelection()  # 33 picked in the model; graph input

# group: Oblicz pole powierzchni elementu
# note: Pobierz geometrię elementu
getGeometry = Element.GetGeometry(element=wybierz_elementy_modelu)
flatten = List.Flatten(list=getGeometry)
# note: Wyodrębnij obszar powierzchni geometrii
area = Solid.Area(solid=flatten)
# note: Pobierz najwyższą wartość
maximumItem = List.MaximumItem(list=area)
# note: Normalizuj dla najwyższej wartości
div = area / maximumItem  # graph output

# group: Utwórz kolory
# Przygotuj schemat kolorów do kodowania elementów kolorami
number = DoubleInput(0)
number_2 = DoubleInput(255)
# note: kolor zielony
byARGB = Color.ByARGB(alpha=number, red=number, green=number_2, blue=number, lacing=Longest)
number_3 = DoubleInput(0)
number_4 = DoubleInput(255)
# note: kolor czerwony
byARGB_2 = Color.ByARGB(alpha=number_3, red=number_4, green=number_3, blue=number_3, lacing=Longest)
create = List.Create(item0=byARGB, item1=byARGB_2)
code_block = CodeBlock { [0,1]; }
# note: ustaw zakres kolorów
color_range = ColorRange(colors=create, indices=code_block, value=div)

# group: Do programu Revit: nadpisz kolor elementu w widoku
# note: Nadpisuje to kolor elementu w aktywnym widoku
overrideColorInView = Element.OverrideColorInView(element=wybierz_elementy_modelu, color=color_range, lacing=Longest)

# group: Próg
number_5 = DoubleInput(100)

# group: Alternatywa — oceń, czy kryteria spełniają zadany próg
# note: Porównaj z wartością progową
gt = area > number_5
# note: Liczby wskazują położenie w spektrum kolorów — od 0 do 1
number_6 = DoubleInput(1)
number_7 = DoubleInput(0)
# note: zidentyfikuj obszary w granicach tolerancji
if_ = RefactoredIf(test=gt, true=number_6, false=number_7)
# note: tego wyniku można używać jako pozycji danych wejściowych 'indices' węzła Color Range
watch = Watch(if_)
