# Dynamo graph Revit Floors and Framing.dyn "Stropy i ramy programu Revit" (Dynamo 4.0.0.3076)
# author: Dynamo Team
# Ten wykres tworzy model architektoniczny za pomocą serii linii i ich przemieszczenia w celu umieszczenia elementów stropów i ram konstrukcyjnych w programie Revit.
# packages: Aparat PythonNet3 1.4.5

# group: Informacje
# note: Uruchom ten wykres w pliku Snowdon Towers Sample Architectural.rvt w folderze Samples znajdującym się w lokalizacji instalacji programu Revit
# C:\Program Files\Autodesk\Revit 2027\Samples
# note: Ten wykres tworzy model architektoniczny za pomocą serii linii, które służą do sterowania położeniem stropów i ram konstrukcyjnych.

# group: Środek położenia modelu
położenie_na_osi_x = DoubleSlider(30, range=25..40 step 1)  # graph input
położenie_na_osi_y = DoubleSlider(30, range=25..40 step 1)  # graph input
położenie_na_osi_z = DoubleSlider(62, range=60..80 step 1)  # graph input

# group: Konfiguracja modelu
# Opis <Kliknij dwukrotnie tutaj, aby edytować opis grupy>
promień_stropu_dolnego = DoubleSlider(10, range=8..20 step 1)  # graph input
liczba_stropów = DoubleSlider(7, range=3..10 step 1)  # graph input
zmniejszenie_promienia = DoubleSlider(-1.25, range=-2..-0.5 step 0.25)  # graph input
liczba_boków_wieloboku = IntegerSlider(5, range=3..10 step 1)  # graph input
wysokość_stropu_górnego = DoubleSlider(38.4, range=15..50 step 0.1)  # graph input
obrót_maksymalny_stopnie = DoubleSlider(130, range=10..180 step 5)  # graph input

# group: Skonstruuj wieloboki
# Utwórz serię wieloboków o malejących promieniach, odsuniętych w pionie i obróconych sekwencyjnie
# note: Środek modelu
byCoordinates = Point.ByCoordinates(x=położenie_na_osi_x, y=położenie_na_osi_y, z=położenie_na_osi_z)
# note: Sekwencja promieni okręgu
sequence = Sequence(start=promień_stropu_dolnego, amount=liczba_stropów, step=zmniejszenie_promienia, lacing=Longest)
# note: Utwórz serię okręgów
byCenterPointRadius = Circle.ByCenterPointRadius(centerPoint=byCoordinates, radius=sequence)
# note: Utwórz serię wieloboków
regularPolygon = Polygon.RegularPolygon(circle=byCenterPointRadius, numberSides=liczba_boków_wieloboku)
# note: Sekwencja rzędnych stropu
sekwencja_wysokości_stropów = CodeBlock(top_floor=wysokość_stropu_górnego, count=liczba_stropów) { 0..top_floor..#count; }
byCoordinates_2 = Vector.ByCoordinates(z=sekwencja_wysokości_stropów)
# note: Przesuń wieloboki w górę o podaną wysokość
translate = Geometry.Translate(geometry=regularPolygon, direction=byCoordinates_2)
ZAxis = Vector.ZAxis()
# note: Sekwencja obrotów dla każdego stropu
sekwencja_kątów_obrotu = CodeBlock(max_degrees=obrót_maksymalny_stopnie, count=liczba_stropów) { 0..max_degrees..#count; }
# note: Obróć wieloboki o serię kątów
rotate = Geometry.Rotate(geometry=translate, origin=byCoordinates, axis=ZAxis, degrees=sekwencja_kątów_obrotu)
# note: Wyodrębnij poszczególne krzywe z wielokątów
curves = PolyCurve.Curves(polyCurve=rotate)

# group: Typ i poziom stropu
# note: Wybierz typ stropu dla utworzonych stropów z typów istniejących w projekcie za pomocą listy rozwijanej
floor_types = FloorTypes("Concrete Slab 6\"")  # graph input
levels = Levels("Green Roof Hardscape")  # graph input

# group: Do programu Revit: utwórz stropy
# Użyj serii pętli krzywych zamkniętych jako danych wejściowych na potrzeby tworzenia stropu
# note: Przenieś grupy krzywych, aby utworzyć stropy
byOutlineTypeAndLevel = Floor.ByOutlineTypeAndLevel(outline=curves, floorType=floor_types, level=levels)

# group: Połączenia pionowe
# Połącz narożniki wieloboków między poziomami modelu
# note: Pobierz punkty końcowe każdej krzywej wieloboku
endPoint = Curve.EndPoint(curve=curves)
# note: Odwróć macierz i pobierz listy punktów końcowych wyrównane pionowo
transpose = List.Transpose(lists=endPoint)
# note: Połącz zgodne narożniki wieloboków od najniższego do najwyższego poziomu modelu, łącząc je jako krzywe PolyCurve
byPoints = PolyCurve.ByPoints(points=transpose)
# note: Zdekonstruuj krzywe PolyCurve i uzyskaj listy krzywych, które posłużą jako dane wejściowe dla elementów ram konstrukcyjnych
curves_2 = PolyCurve.Curves(polyCurve=byPoints)

# group: Typ i poziom ram konstrukcyjnych
levels_2 = Levels("Green Roof Hardscape")  # graph input
# note: Wybierz typ ram konstrukcyjnych z typów wczytanych do projektu za pomocą listy rozwijanej
structural_framing_types = StructuralFramingTypes("W12X26")  # graph input

# group: Do programu Revit: utwórz ramy konstrukcyjne
# Użyj krzywych, aby utworzyć elementy ram konstrukcyjnych, i użyj węzła w języku Python, aby uniemożliwić utworzenie połączeń między poszczególnymi belkami
# note: Przenieś poszczególne krzywe dla każdego elementu konstrukcyjnego
beamByCurve = StructuralFraming.BeamByCurve(curve=curves_2, level=levels_2, structuralFramingType=structural_framing_types)
# note: Przygotuj listę
flatten = List.Flatten(list=beamByCurve)
# note: To jest węzeł w języku Python o zmienionej nazwie, który odwołuje się do interfejsu API programu Revit w celu rozszerzenia możliwości dodatku Dynamo poza gotowe węzły. Aby odczytać kod w języku Python, kliknij węzeł prawym przyciskiem myszy i kliknij opcję Edytuj…
nie_zezwalaj_na_połączenia_na = Python(structuralFraming=flatten)  # "Nie zezwalaj na połączenia na ramach konstrukcyjnych"; PythonNet3
# ---------- nie_zezwalaj_na_połączenia_na.python (35 lines) ----------
# Load the Python Standard and DesignScript Libraries
import sys
import clr
clr.AddReference('ProtoGeometry')
from Autodesk.DesignScript.Geometry import *
from Autodesk.Revit.DB import *
from RevitServices.Transactions import TransactionManager
from RevitServices.Persistence import DocumentManager 

doc = DocumentManager.Instance.CurrentDBDocument

# The inputs to this node will be stored as a list in the IN variables.
dataEnteringNode = IN

# Place your code below this line
structural_framing = UnwrapElement(IN[0])

unjoined_elements = []
# start a Transaction
TransactionManager.Instance.EnsureInTransaction(doc)
# iterate through each structural framing element
for sf in structural_framing:
    # check if the element passed in of Structural Framing Category
    sf_category = sf.Category # get the element's Category
    # use the Structural Framing's Category Id to check
    if sf_category.Id.Value == -2001320:
        # disallow joins at start and end of the structural framing element
        Structure.StructuralFramingUtils.DisallowJoinAtEnd(sf, 0)
        Structure.StructuralFramingUtils.DisallowJoinAtEnd(sf, 1)
        unjoined_elements.append(sf)
TransactionManager.Instance.TransactionTaskDone()

    
# Output the list of elements with Disallowed Join
OUT = unjoined_elements
# ----------------------------------------
