# Dynamo graph Revit Geometry Creation Curves.dyn "Tworzenie geometrii programu Revit — krzywe" (Dynamo 4.0.0.3076)
# author: Dynamo Team
# Za pomocą tego wykresu przedstawiono kilka metod tworzenia krzywych w dodatku Dynamo i tworzenia przy ich użyciu elementów programu Revit (linii modelu)

# group: Informacje
# note: W tym wykresie używanych jest kilka metod tworzenia krzywych, które mają służyć jako dane wejściowe na potrzeby tworzenia krzywych modelu programu Revit
# note: Uruchom ten wykres w pliku Snowdon Towers Sample Architectural.rvt w folderze Samples znajdującym się w lokalizacji instalacji programu Revit
# C:\Program Files\Autodesk\Revit 2027\Samples

# group: Cztery punkty
# Opis <Kliknij dwukrotnie tutaj, aby edytować opis grupy>
number = DoubleInput(-35)
number_2 = DoubleInput(-55)
byCoordinates = Point.ByCoordinates(x=number, y=number_2)
number_3 = DoubleInput(-40)
byCoordinates_2 = Point.ByCoordinates(x=number, y=number_3)
number_4 = DoubleInput(-10)
byCoordinates_3 = Point.ByCoordinates(x=number_4, y=number_3)
number_5 = DoubleInput(-17)
number_6 = DoubleInput(-60)
byCoordinates_4 = Point.ByCoordinates(x=number_5, y=number_6)

list_create = List.Create(item0=byCoordinates, item1=byCoordinates_2, item2=byCoordinates_3, item3=byCoordinates_4)

# group: Utwórz krzywą modelu na podstawie krzywej Nurbs (według punktów)
# note: Utwórz krzywą NURBS na podstawie listy punktów
byPoints = NurbsCurve.ByPoints(points=list_create)
# note: Użyj krzywej NURBS, aby utworzyć krzywą modelu programu Revit
byCurve = ModelCurve.ByCurve(curve=byPoints)

# group: Utwórz krzywą modelu na podstawie krzywej Nurbs (według punktów kontrolnych)
boolean = BoolSelector(false)
# note: Utwórz krzywą NURBS na podstawie listy punktów służących jako punkty kontrolne
byControlPoints = NurbsCurve.ByControlPoints(points=list_create, closeCurve=boolean)
# note: Użyj krzywej NURBS, aby utworzyć krzywą modelu programu Revit
byCurve_2 = ModelCurve.ByCurve(curve=byControlPoints)

# group: Utwórz krzywą modelu na podstawie krzywej PolyCurve
# note: Utwórz krzywą PolyCurve na podstawie listy punktów
byPoints_2 = PolyCurve.ByPoints(points=list_create)
curves = PolyCurve.Curves(polyCurve=byPoints_2)
# note: Utwórz zestaw linii modelu programu Revit za pomocą listy krzywych
byCurve_3 = ModelCurve.ByCurve(curve=curves)

# group: Utwórz krzywą modelu na podstawie linii
# note: Utwórz krzywą z dwóch punktów
byStartPointEndPoint = Line.ByStartPointEndPoint(startPoint=byCoordinates, endPoint=byCoordinates_2)
# note: Użyj linii (krzywej), aby utworzyć krzywą modelu programu Revit
byCurve_4 = ModelCurve.ByCurve(curve=byStartPointEndPoint)
