# Dynamo graph Revit Geometry Creation Points.dyn "Tworzenie geometrii programu Revit — punkty" (Dynamo 4.0.0.3076)
# author: Dynamo Team
# Ten wykres tworzy linię modelu i punkt odniesienia w środowisku rodziny brył koncepcyjnych.

# group: Informacje
# note: Za pomocą przycisków w prawym górnym rogu ekranu (skrót Ctrl + B) można przełączać między nawigacją w tle 3D a nawigacją w widoku wykresu. Podgląd tła można też włączać i wyłączać w menu Widok w dodatku Dynamo i w programie Revit.
# note: Uruchom ten wykres w środowisku rodziny Bryła koncepcyjna lub Model ogólny adaptacyjny.
# Aby utworzyć nową rodzinę, przejdź do menu Plik > Nowa rodzina > i wybierz szablon znajdujący się w folderze:
# C:\ProgramData\Autodesk\RVT 2027\Family Templates\English-Imperial\Generic Model Adaptive.rft
# note: Ten wykres tworzy linię modelu i punkt odniesienia w środowisku rodziny

# group: Współrzędne punktu
wartość_punktu_x = DoubleSlider(50, range=5..50 step 5)  # graph input
wartość_punktu_y = DoubleSlider(25, range=5..50 step 5)  # graph input
wartość_z_punktu = DoubleSlider(25, range=5..50 step 5)  # graph input

# note: Manipuluj położeniem punktu w środowisku Dynamo: wybierz węzeł Point.ByCoordinates i przełącz na podgląd tła, aby przeciągnąć punkt wzdłuż jego trzech osi.
byCoordinates = Point.ByCoordinates(x=wartość_punktu_x, y=wartość_punktu_y, z=wartość_z_punktu)
# note: Dane geometryczne można wyświetlać jako informacje tekstowe lub w przestrzeni 3D
watch = Watch(byCoordinates)
byCoordinates_2 = Point.ByCoordinates()
byStartPointEndPoint = Line.ByStartPointEndPoint(startPoint=byCoordinates_2, endPoint=byCoordinates)
# note: Podgląd geometrii
watch_3d = Watch3D(byStartPointEndPoint)
# note: Utwórz krzywą modelu przez połączenie dwóch punktów
byCurve = ModelCurve.ByCurve(curve=byStartPointEndPoint)
# note: Dodatek Dynamo może tworzyć i modyfikować tylko elementy odpowiednie dla pliku, z którym jest skojarzony wykres Dynamo. Na przykład punkty odniesienia można tworzyć tylko w niektórych środowiskach rodziny (takich jak model ogólny adaptacyjny), natomiast linie modelu można tworzyć w niemal dowolnym miejscu.
byPoint = ReferencePoint.ByPoint(pt=byCoordinates)
