# Dynamo graph Revit Geometry Creation Solids.dyn "Tworzenie geometrii programu Revit — bryły" (Dynamo 4.0.0.3076)
# author: Dynamo Team
# W tym wykresie przedstawiono kilka metod tworzenia geometrii bryły w dodatku Dynamo i integrowania jej w programie Revit — niektóre metody mogą być używane w środowisku projektu, inne — tylko w niektórych środowiskach rodziny (bryła koncepcyjna).

# group: Informacje
# note: Większość brył można tworzyć wieloma metodami. W przykładach przedstawiono profile zamknięte jako podstawę, ale można zszywać powierzchnie PolySurface i dostępnych jest wiele prymitywów, czyli siatek elementarnych (powierzchni, prostopadłościanów, stożków itp.).
# Aby zintegrować geometrię ze środowiskiem programu Revit, najpierw należy ją przekształcić w element programu Revit. Bryły można przekształcić w wystąpienie importu, które będzie widoczny w środowisku zarówno projektów, jak i rodzin.
# Geometrię bryły można też przekształcić w element formy dostępny tylko w środowiskach bryły koncepcyjnej i rodziny komponentów adaptacyjnych.
# note: Ten wykres używa kilku metod tworzenia geometrii bryły w programie Revit — niektórych metod można używać w środowisku projektu, innych — tylko w niektórych środowiskach rodziny.
# Użyj szablonu rodziny Conceptual Mass, aby wyświetlić wszystkie metody.
# Aby otworzyć rodzinę Conceptual Mass, przejdź do menu Plik > Nowy > Rodzina > i wybierz szablon Mass.rft w \Conceptual Mass\Mass.rft

# group: Przygotuj punkty
# Wygeneruj zestaw punktów, aby utworzyć geometrię
byCoordinates = Point.ByCoordinates()
number = DoubleInput(10)
byCoordinates_2 = Point.ByCoordinates(x=number)
number_2 = DoubleInput(5)
byCoordinates_3 = Point.ByCoordinates(z=number_2)
number_3 = DoubleInput(10)
byCoordinates_4 = Point.ByCoordinates(y=number_3)
number_4 = DoubleInput(15)
byCoordinates_5 = Point.ByCoordinates(x=number_4, y=number_4)
number_5 = DoubleInput(5)
number_6 = DoubleInput(10)
byCoordinates_6 = Point.ByCoordinates(x=number_5, y=number_6, z=number_6)
number_7 = DoubleInput(-2)
number_8 = DoubleInput(5)
byCoordinates_7 = Point.ByCoordinates(x=number_7, y=number_8)

# group: Pierwszy profil
# Utwórz pierwszy profil jako krzywą zamkniętą na podstawie łuku i linii
byStartPointEndPoint = Line.ByStartPointEndPoint(startPoint=byCoordinates, endPoint=byCoordinates_2)
byThreePoints = Arc.ByThreePoints(firstPoint=byCoordinates, secondPoint=byCoordinates_3, thirdPoint=byCoordinates_2)
create = List.Create(item0=byStartPointEndPoint, item1=byThreePoints)
# note: Pierwszy profil wyciągnięcia złożonego
byJoinedCurves = PolyCurve.ByJoinedCurves(curves=create)

# group: Drugi profil
# Utwórz drugi profil jako krzywą zamkniętą na podstawie łuku i linii
byStartPointEndPoint_2 = Line.ByStartPointEndPoint(startPoint=byCoordinates_4, endPoint=byCoordinates_5)
byThreePoints_2 = Arc.ByThreePoints(firstPoint=byCoordinates_4, secondPoint=byCoordinates_6, thirdPoint=byCoordinates_5)
create_2 = List.Create(item0=byStartPointEndPoint_2, item1=byThreePoints_2)
# note: Drugi profil wyciągnięcia złożonego
byJoinedCurves_2 = PolyCurve.ByJoinedCurves(curves=create_2)

# note: Połącz dwa profile z listy
create_3 = List.Create(item0=byJoinedCurves, item1=byJoinedCurves_2)

# group: Wyciągnięcie złożone bryły na podstawie przekrojów poprzecznych
# Opis <Kliknij dwukrotnie tutaj, aby edytować opis grupy>
byLoft = Solid.ByLoft(crossSections=create_3)

# note: Zbadaj objętość bryły
volume = Solid.Volume(solid=byLoft)

# group: Utwórz powłokę
code_block = CodeBlock { 0; }
# note: Wskazówka: Wyłącz funkcję „Podgląd” w menu węzłów, dostępnym po kliknięciu prawym przyciskiem myszy, aby nie wyświetlać elementów
thinShell = Solid.ThinShell(solid=byLoft, internalFaceThickness=code_block)

# group: Przekształć geometrię
code_block_2 = CodeBlock { Vector.ByCoordinates(20,0,0); }
# note: Przekształć geometrię w bok, aby wyświetlić podgląd zarówno oryginału, jak i wyniku końcowego
translate = Geometry.Translate(geometry=thinShell, direction=code_block_2)

# group: Przytnij bryłę
# Użyj operacji Utnij, aby przeciąć bryłę powłoki płaszczyzną.
code_block_3 = CodeBlock { Point.ByCoordinates(0,0,5); }
ZAxis = Vector.ZAxis()
byOriginNormal = Plane.ByOriginNormal(origin=code_block_3, normal=ZAxis)
number_9 = DoubleInput(10)
# note: Wybierz, którą stronę ucięcia zachować (strona najbliższa punktu zostanie odrzucona).
byCoordinates_8 = Point.ByCoordinates(x=number_9, y=number_9, z=number_9)
# note: Geometryczne operacje logiczne (przecięcie, różnica, połączenie itp.) są dostępne w kategorii Geometria.
trim = Geometry.Trim(geometry=translate, other=byOriginNormal, pick=byCoordinates_8)

# group: Krzywa prowadząca
# Utwórz krzywą NURBS, która będzie służyć jako krzywa prowadząca dla kształtu bryły wyciągnięcia złożonego
create_4 = List.Create(item0=byCoordinates, item1=byCoordinates_7, item2=byCoordinates_4)
# note: Krzywa prowadząca skonstruowana jako krzywa NURBS
byPoints = NurbsCurve.ByPoints(points=create_4)

# group: Wyciągnięcie złożone bryły na podstawie przekrojów poprzecznych i krzywych prowadzących
# note: Wskazówka: Wyłącz funkcję „Podgląd” w menu węzłów, dostępnym po kliknięciu prawym przyciskiem myszy, aby nie wyświetlać elementów
byLoft_2 = Solid.ByLoft(crossSections=create_3, guideCurves=byPoints)

# group: Utwórz wystąpienie importu
code_block_4 = CodeBlock { Vector.ByCoordinates(-20,0,0); }
translate_2 = Geometry.Translate(geometry=byLoft_2, direction=code_block_4)
# note: Geometria nie jest taka sama jak w przypadku elementu programu Revit:
# Użyj elementu ImportInstance, aby ustawić import w programie Revit z powierzchni i brył w dowolnym środowisku programu Revit. Użyj punktów i krzywych, aby umieścić wystąpienia rodziny, lub utwórz formę w rodzinach brył lub modelu ogólnego przez punkty (komponenty adaptacyjne)
byGeometries = ImportInstance.ByGeometries(geometries=translate_2)
byCoordinates_9 = Vector.ByCoordinates()

# group: Utwórz formę
# Za pomocą dwóch pętli krzywych profilu utwórz element formy (w środowisku rodziny brył koncepcyjnych)
curves = PolyCurve.Curves(polyCurve=create_3)
# note: Utwórz krzywe modelu na podstawie krzywych
referenceCurveByCurve = ModelCurve.ReferenceCurveByCurve(curve=curves)
# note: Formy można tworzyć tylko jako część rodziny brył koncepcyjnych
byLoftCrossSections = Form.ByLoftCrossSections(curves=referenceCurveByCurve)
