# Dynamo graph Revit Geometry Creation Surfaces.dyn "Tworzenie geometrii programu Revit — powierzchnie" (Dynamo 4.0.0.3076)
# author: Dynamo Team
# W tym wykresie przedstawiono kilka metod tworzenia powierzchni w dodatku Dynamo i dwie metody przekształcania geometrii w geometrię programu Revit.

# group: Informacje
# note: Ten wykres używa kilku metod tworzenia geometrii powierzchni w programie Revit — niektórych metod można używać w środowisku projektu, innych — tylko w niektórych środowiskach rodziny.
# Użyj szablonu rodziny brył koncepcyjnych, aby wyświetlić wszystkie metody.
# Utwórz rodzinę brył koncepcyjnych, przechodząc do menu Plik > Nowy > Rodzina i wybierając szablon Mass.rft w folderze Conceptual Mass.
# note: Większość powierzchni można tworzyć wieloma metodami. Powierzchnie, powierzchnie PolySurface (kolekcje powierzchni) i powierzchnie NURBS można tworzyć za pomocą punktów i krzywych oraz wyprowadzać z innych powierzchni i brył za pomocą różnych operacji.
# note: Aby zintegrować geometrię ze środowiskiem programu Revit, najpierw należy ją przekształcić w element programu Revit. Powierzchnie i bryły można przekształcić w wystąpienie importu, które będzie widoczny w środowisku zarówno projektów, jak i rodzin.
# Geometrię powierzchni można też przekształcić w element formy dostępny tylko w środowiskach bryły koncepcyjnej i rodziny komponentów adaptacyjnych.

# group: Przygotuj punkty
# Wygeneruj zestaw punktów, aby utworzyć geometrię
number = DoubleInput(10)
byCoordinates = Point.ByCoordinates(y=number)
number_2 = DoubleInput(5)
number_3 = DoubleInput(10)
byCoordinates_2 = Point.ByCoordinates(x=number_2, y=number_3, z=number_3)
number_4 = DoubleInput(15)
byCoordinates_3 = Point.ByCoordinates(x=number_4, y=number_4)
byCoordinates_4 = Point.ByCoordinates()
number_5 = DoubleInput(5)
byCoordinates_5 = Point.ByCoordinates(z=number_5)
byCoordinates_6 = Point.ByCoordinates(x=number)
number_6 = DoubleInput(-5)
number_7 = DoubleInput(5)
byCoordinates_7 = Point.ByCoordinates(x=number_6, y=number_7)
number_8 = DoubleInput(10)
number_9 = DoubleInput(-10)
byCoordinates_8 = Point.ByCoordinates(x=number_8, y=number_9)
byCoordinates_9 = Point.ByCoordinates(y=number_9)

# group: Utwórz profile
byThreePoints = Arc.ByThreePoints(firstPoint=byCoordinates, secondPoint=byCoordinates_2, thirdPoint=byCoordinates_3)
byThreePoints_2 = Arc.ByThreePoints(firstPoint=byCoordinates_4, secondPoint=byCoordinates_5, thirdPoint=byCoordinates_6)
byThreePoints_3 = Arc.ByThreePoints(firstPoint=byCoordinates_4, secondPoint=byCoordinates_7, thirdPoint=byCoordinates)
byStartPointEndPoint = Line.ByStartPointEndPoint(startPoint=byCoordinates_8, endPoint=byCoordinates_9)

# group: Powierzchnia przez przeciągnięcie
# Utwórz powierzchnię przeciągnięcia za pomocą profilu, krzywej definiującej i toru prowadnicy
bySweep2Rails = Surface.BySweep2Rails(path=byThreePoints, guideRail=byThreePoints_2, profile=byThreePoints_3)

# group: Utwórz import
# note: Utwórz za pomocą wystąpienia importu importy programu Revit z powierzchni i brył — będą one widoczne w dowolnym środowisku programu Revit.
byGeometries = ImportInstance.ByGeometries(geometries=bySweep2Rails)

create = List.Create(item0=byStartPointEndPoint, item1=byThreePoints_2)

# group: Utwórz powierzchnię za pomocą wyciągnięcia złożonego
# Połącz przekroje poprzeczne, aby utworzyć powierzchnię wyciągnięcia złożonego
byLoft = Surface.ByLoft(crossSections=create)

# group: Oblicz pole powierzchni
area = Surface.Area(surface=byLoft)
watch = Watch(area)
create_2 = List.Create(item0=byLoft, item1=bySweep2Rails)
# note: Powierzchnie połączone jako polipowierzchnie mogą być oceniane jako pojedynczy element.
byJoinedSurfaces = PolySurface.ByJoinedSurfaces(surfaces=create_2)
area_2 = Surface.Area(surface=byJoinedSurfaces)
watch_2 = Watch(area_2)
area_3 = Surface.Area(surface=bySweep2Rails)
watch_3 = Watch(area_3)

# group: Powierzchnia NURBS na podstawie punktów kontrolnych
# Przekształć przeciągnięcie w powierzchnię NURBS na podstawie punktów kontrolnych
code_block = CodeBlock { 0..1..0.1; }
# note: Krawędzie, punkty i inne elementy można wyprowadzać z powierzchni za pomocą „operacji” odpowiednich dla tych geometrii.
pointAtParameter = Surface.PointAtParameter(surface=bySweep2Rails, u=code_block, v=code_block, lacing=CrossProduct)
# note: Odtwórz powierzchnię jako powierzchnię NURBS na podstawie punktów kontrolnych
byControlPoints = NurbsSurface.ByControlPoints(controlVertices=pointAtParameter)
# note: Wyświetlaj podgląd geometrii w izolacji za pomocą węzła Watch 3D
watch_3d = Watch3D(byControlPoints)

# group: Powierzchnia przez wyciągnięcie krzywej
# Utwórz wyciągnięcie o określonej odległości za pomocą krzywej
code_block_2 = CodeBlock { 10; }
extrude = Curve.Extrude(curve=byThreePoints, distance=code_block_2)

# group: Utwórz formę
# Utwórz kształt wyciągnięcia złożonego na podstawie dwóch krzywych
referenceCurveByCurve = ModelCurve.ReferenceCurveByCurve(curve=create)
byLoftCrossSections = Form.ByLoftCrossSections(curves=referenceCurveByCurve)
