# Dynamo graph Revit Import Solid.dyn "Revit — importowanie bryły" (Dynamo 4.0.0.3076)
# author: Dynamo Team
# W tym wykresie przedstawiono metodę tworzenia geometrii bryły dodatku Dynamo i tworzenia za jej pomocą elementu wystąpienia importu programu Revit. Skonstruuj nowy kształt dachu, tworząc serię profili łukowych i tworząc za ich pomocą powierzchnię wyciągnięcia złożonego.

# group: Informacje
# note: Element źródłowy (dach) został wstępnie wybrany z programu Revit, a identyfikatory elementów zapisano w pliku dodatku Dynamo
# note: Uruchom ten wykres w pliku Snowdon Towers Sample Architectural.rvt w folderze Samples znajdującym się w lokalizacji instalacji programu Revit
# C:\Program Files\Autodesk\Revit 2027\Samples
# note: Utwórz nowy kształt dachu na podstawie wybranego elementu dachu, tworząc serię profili łukowych i tworząc za ich pomocą powierzchnię wyciągnięcia złożonego. Geometria jest przekształcana w wystąpienie importu w celu zintegrowania jej ze środowiskiem programu Revit

# group: Nowa konfiguracja dachu
# note: Liczba profili, na podstawie których zostanie utworzona powierzchnia wyciągnięcia złożonego
liczba_profili = IntegerSlider(6, range=3..10 step 1)
# note: Wysokość przy krótkich końcach nowego dachu
min_przekrój_dachu = DoubleSlider(2.1, range=1..5 step 0.1)
# note: Wysokość w środku dachu
maks_przekrój_dachu = DoubleSlider(7, range=5..10 step 0.1)
# note: Wydłuż profile łukowe bocznie o tę wartość
wydłużenie_boków_dachu = DoubleSlider(0.5, range=0.1..3 step 0.1)
# note: Grubość nowego kształtu dachu
grubość_dachu = DoubleSlider(0.5, range=0.1..2 step 0.1)

liczba_profili_2 = CodeBlock(steps=liczba_profili) { steps; }

# group: Wybierz dach
# Wybierz element źródłowy dachu
# note: Wszystkie dane wejściowe oznaczone jako 'IsInput' można ustawić w Odtwarzaczu Dynamo
wybierz_dach_płaski = DSModelElementSelection()  # 1 picked in the model

# group: Pobierz powierzchnię dachu
# Rozbij geometrię elementu źródłowego i wybierz jedną powierzchnię o największym polu
# note: Aby pobrać powierzchnię wybranego elementu, najpierw pobierz jego geometrię
# note: Kliknij prawym przyciskiem myszy i wyczyść zaznaczenie opcji 'Podgląd geometrii', aby uzyskać czytelniejszy widok wyniku końcowego
getGeometry = Element.GetGeometry(element=wybierz_dach_płaski)
# note: Rozbij geometrię, aby pobrać pojedyncze powierzchnie
explode = Geometry.Explode(geometry=getGeometry)
# note: Usuń strukturę listy. Pamiętaj, że ten krok nie jest wymagany w razie użycia wielu obiektów źródłowych
flatten = List.Flatten(list=explode)
area = Surface.Area(surface=flatten)
# note: Sortuj listę powierzchni według pól powierzchni. Powierzchnia o największym polu będzie ostatnim elementem na liście danych wyjściowych sortedList
sortByKey = List.SortByKey(list=flatten, keys=area)
lastItem = List.LastItem(list=sortByKey.sortedList)
number = DoubleInput(1.5)
# note: Przekształć powierzchnię w górę
translate = Geometry.Translate(geometry=lastItem, zTranslation=number)

# group: Odsuń na zewnątrz (skala)
# Skaluj powierzchnię, aby wydłużyć jej krawędzie na zewnątrz
położenie_uv = CodeBlock { 0.5; }
pointAtParameter = Surface.PointAtParameter(surface=translate, u=położenie_uv, v=położenie_uv)
skaluj_od_punktu_do_punktu = CodeBlock { point1 = Point.ByCoordinates(1, 1); point2 = Point.ByCoordinates(-40, -40); }
scale = Geometry.Scale(geometry=translate, basePoint=pointAtParameter, from=skaluj_od_punktu_do_punktu.point1, to=skaluj_od_punktu_do_punktu.point2)

# group: Punkty na powierzchni
# Wygeneruj trzy listy równomiernie rozmieszczonych punktów — dwa rzędy wzdłuż dłuższych krawędzi i jeden rząd w środku
# note: 0 i 1 są położeniami wzdłuż dłuższych krawędzi powierzchni
położenia_u_dla_rzędów_krawędzi = CodeBlock { [0,1]; }
# note: Położenia V wzdłuż dłuższych krawędzi, w kolejności od 0 do 1 i przy N krokach
położenia_v_dla_rzędów_krawędzi = CodeBlock(steps=liczba_profili_2) { [0..1..#steps]; }
# note: Użyj ustawienia Najdłuższe skratowanie, klikając prawym przyciskiem myszy węzeł > Skratowanie. Najdłuższe skratowanie będzie odpowiadać danym wejściowym z różnymi strukturami list. W tym przypadku wynikiem będą dwie listy punktów, dla których liczba punktów na każdej liście będzie odpowiadać najdłuższej liście wejściowej.
pointAtParameter_2 = Surface.PointAtParameter(surface=scale, u=położenia_u_dla_rzędów_krawędzi, v=położenia_v_dla_rzędów_krawędzi, lacing=Longest)
# note: Wartość U równa 0,5 spowoduje umieszczenie punktów wzdłuż środka powierzchni
położenie_u_dla_środkowego_rzędu = CodeBlock { [0.5]; }
# note: Położenia V wzdłuż środkowego rzędu punktów, w kolejności od 0 do 1 i przy N krokach
położenie_v_dla_środkowego_rzędu = CodeBlock(steps=liczba_profili_2) { [0..1..#steps]; }
# note: Dla tego węzła jest używane najdłuższe skratowanie. Wynik to jedna lista punktów, w przypadku której liczba punktów na liście jest zgodna z najdłuższą listą wejściową.
pointAtParameter_3 = Surface.PointAtParameter(surface=scale, u=położenie_u_dla_środkowego_rzędu, v=położenie_v_dla_środkowego_rzędu, lacing=Longest)

# group: Odsuń punkty w górę
# Odsuń punkty środkowego rzędu w kształcie cosinusoidy
# note: sekwencja wartości do wygenerowania serii odsunięć
sekwencja_kątów = CodeBlock(steps=liczba_profili_2) { -1..1..#steps; }
# note: Alternatywa: użyj sinusoidy w przypadku innego kształtu dachu
sin = Math.Sin(angle=sekwencja_kątów)
# note: wartości tworzące cosinusoidę
cos = Math.Cos(angle=sekwencja_kątów)
# note: ponownie odwzoruj wartości w nowej domenie
remapRange = Math.RemapRange(numbers=cos, newMin=min_przekrój_dachu, newMax=maks_przekrój_dachu)
# note: przekształć punkty środkowego rzędu
translate_2 = Geometry.Translate(geometry=pointAtParameter_3@L2, zTranslation=remapRange)

# group: Utwórz profile na podstawie łuków
# Utwórz łuki na podstawie punktów
# note: Połącz krawędź i środkowe rzędy w jedną listę
join = List.Join(list0=pointAtParameter_2, list1=translate_2)
indeks_elementu = CodeBlock { 0; 1; 2; }
getItemAtIndex = List.GetItemAtIndex(list=join, index=indeks_elementu.out0)
getItemAtIndex_2 = List.GetItemAtIndex(list=join, index=indeks_elementu.out2)
getItemAtIndex_3 = List.GetItemAtIndex(list=join, index=indeks_elementu.out1)
byThreePoints = Arc.ByThreePoints(firstPoint=getItemAtIndex, secondPoint=getItemAtIndex_2, thirdPoint=getItemAtIndex_3)

# group: Wydłuż profile
# Wydłuż krzywe poszczególnych profili o podaną odległość
# note: Wartość wydłużenia jest ustawiana jako wartość wejściowa po lewej stronie wykresu.
wydłuż_krawędzie = CodeBlock(roof_extension=wydłużenie_boków_dachu) { roof_extension; }
extendStart = Curve.ExtendStart(curve=byThreePoints, distance=wydłuż_krawędzie)
extendEnd = Curve.ExtendEnd(curve=extendStart, distance=wydłuż_krawędzie)

# group: Wyciągnięcie złożone i pogrubienie
# Utwórz powierzchnię wyciągnięcia złożonego i nadaj jej grubość
byLoft = Surface.ByLoft(crossSections=extendEnd)
thicken = Surface.Thicken(surface=byLoft, thickness=grubość_dachu)

# group: Do programu Revit:
# Przekształć geometrię dodatku Dynamo w element programu Revit za pomocą elementu ImportInstance i parametru Ustaw poziom
# note: Aby zintegrować geometrię ze środowiskiem programu Revit, należy najpierw przekształcić ją w element programu Revit.
# Bryły można przekształcić w wystąpienie importu, które będzie widoczne zarówno w środowisku projektu, jak i w środowisku rodziny modelu.
byGeometry = ImportInstance.ByGeometry(geometry=thicken)
code_block = CodeBlock { "Płaszczyzna robocza"; }
levels = Levels("L1 - Block 43")
# note: Popraw wysokość umieszczonego wystąpienia importu, ustawiając parametr płaszczyzny roboczej na poziom, którego rzędna jest zgodna z położeniem początku wewnętrznego.
setParameterByName = Element.SetParameterByName(element=byGeometry, parameterName=code_block, value=levels)
