# Dynamo graph Revit Place Families By Level Set Parameters.dyn "Revit — umieszczanie rodzin według parametrów ustawionych dla poziomu" (Dynamo 4.0.0.3076)
# author: Dynamo Team
# W tym wykresie przedstawiono sposób umieszczania elementów programu Revit na podstawie punktu. Umieść rzędy krzeseł w wybranym pomieszczeniu i zapisz unikatowe numery w ich parametrze znaku

# group: Informacje
# note: Uruchom ten wykres w pliku Snowdon Towers Sample Architectural.rvt w folderze Samples znajdującym się w lokalizacji instalacji programu Revit
# C:\Program Files\Autodesk\Revit 2027\Samples
# note: Umieść rzędy krzeseł w wybranym pomieszczeniu i zapisz unikatowe numery w ich parametrze znaku

# group: Wybierz elementy programu Revit
# note: Wybierz typ rodziny dla umieszczanych wystąpień z typów rodzin w projekcie
family_types = FamilyTypes("Chair-Breuer:Chair-Breuer")  # graph input
# note: Wybierz pomieszczenie, w którym mają zostać umieszczone elementy. Musisz przejść do widoku, w którym są widoczne pomieszczenia (rzut kondygnacji)
wybierz_pomieszczenie = DSModelElementSelection()  # 1 picked in the model; graph input
promień_okręgu = DoubleSlider(6.4, range=5..8 step 0.1)  # graph input
# note: Wybierz poziom, na którym mają zostać umieszczone elementy
levels = Levels("L3")  # graph input

# group: Ustaw odsunięcia rzędów
# Wartości odsunięć rzędów nie są odległościami, lecz wartościami U i V
początek_rzędu = DoubleSlider(0.3, range=0..3 step 0.1)  # graph input
koniec_rzędu = DoubleSlider(2.2, range=0..3 step 0.1)  # graph input
liczba_krzeseł_w_rzędzie = IntegerSlider(8, range=2..12 step 1)  # graph input
położenie_pierwszego_rzędu = DoubleSlider(0.2, range=0..3 step 0.1)  # graph input
położenie_ostatniego_rzędu = DoubleSlider(1.4, range=0..3 step 0.1)  # graph input
odstęp_między_rzędami = DoubleSlider(0.35, range=0.15..1 step 0.05)  # graph input

# group: Wygeneruj odsunięcia rzędów
# Seria liczb odpowiadających położeniom U i V na powierzchni. Wartości mogą wykraczać poza domenę od 0 do 1
# note: Alternatywa dla tworzenia sekwencji przez określenie początku i końca sekwencji oraz liczby kroków
sekwencja_odsunięć_rzędów = CodeBlock(start=początek_rzędu, finish=koniec_rzędu, steps=liczba_krzeseł_w_rzędzie) { start..finish..#steps; }
# note: Wygeneruj serię liczb w danym zakresie i o podanym kroku
range = Range(start=położenie_pierwszego_rzędu, end=położenie_ostatniego_rzędu, step=odstęp_między_rzędami)

# group: Przygotuj punkty położenia
# Opis <Kliknij dwukrotnie tutaj, aby edytować opis grupy>
# note: Punkt umieszczenia wybranego pomieszczenia
location = Room.Location(room=wybierz_pomieszczenie)
# note: Okrąg definiujący początkowy obszar umieszczania. Kształt okręgu nie ma w tym przypadku znaczenia, ale zapewnia najszybszy sposób zdefiniowania powierzchni zamkniętej
byCenterPointRadius = Circle.ByCenterPointRadius(centerPoint=location, radius=promień_okręgu)
# note: Przekształć okrąg w powierzchnię, aby użyć go do pozycjonowania punktów
patch = Curve.Patch(curve=byCenterPointRadius)
# note: Za pomocą sekwencji wartości U i V utwórz macierz punktów. Jako skratowanie węzła ustaw opcję Iloczyn wektorowy, klikając prawym przyciskiem myszy i wybierając polecenie Skratowanie.
pointAtParameter = Surface.PointAtParameter(surface=patch, u=sekwencja_odsunięć_rzędów, v=range, lacing=CrossProduct)

# group: Do programu Revit: umieść wystąpienia rodziny
# note: Umieść wystąpienia rodziny
# Większość rodzin można także umieścić według położenia punktu. Komponenty adaptacyjne mogą być umieszczone z wieloma punktami, ramy konstrukcyjne są umieszczane z krzywymi
byPointAndLevel = FamilyInstance.ByPointAndLevel(familyType=family_types, point=pointAtParameter, level=levels)

# note: Usuń strukturę listy — pobierz jedną listę zawierającą wszystkie elementy
flatten = List.Flatten(list=byPointAndLevel)

# group: Przedrostek znaku
# Użyj przedrostka niestandardowego w numerach znaków umieszczonych elementów
przedrostek_znaku = StringInput("C-")  # graph input

# group: Wygeneruj numery znaków
number = DoubleInput(1)
# note: Zlicz liczbę elementów na liście
count = List.Count(list=flatten)
# note: Wygeneruj liczby z zakresu od 1 do n
sequence = Sequence(start=number, amount=count, step=number, lacing=Longest)
# note: Aby można było używać liczby w operacjach na ciągach, należy najpierw przekształcić ją w ciąg
string_from_object = FromObject(obj=sequence)
indeks = CodeBlock { 0; }
# note: Wstaw przedrostek niestandardowy do numeru elementu
insert = String.Insert(string=string_from_object, index=indeks, toInsert=przedrostek_znaku)

# group: Do programu Revit: ustaw wartości parametrów
string = StringInput("Znak")
# note: Ustaw parametr znaku za pomocą listy wartości. Struktura listy elementów i dane wejściowe wartości muszą być zgodne — w przeciwnym razie można użyć tylko jednej wartości. Parametry można też odczytywać za pomocą węzła Element.GetParameterByName
setParameterByName = Element.SetParameterByName(element=flatten, parameterName=string, value=insert)

# group: Sprawdź wyniki
# note: Za pomocą węzła Watch można sprawdzić, czy wyniki są zgodne z oczekiwaniami
watch = Watch(insert)  # graph output
