# Dynamo graph Revit Structural Framing.dyn "Ramy konstrukcyjne programu Revit" (Dynamo 4.0.0.3076)
# author: Dynamo Team
# Ten wykres tworzy strukturę na podstawie słupów i ram konstrukcyjnych względem wybranego stropu programu Revit.

# group: Informacje
# note: Umieść słupy i belki ram konstrukcyjnych względem elementu wybranego w modelu programu Revit.
# note: Uruchom ten wykres w pliku Snowdon Towers Sample Architectural.rvt w folderze Samples znajdującym się w lokalizacji instalacji programu Revit
# C:\Program Files\Autodesk\Revit 2027\Samples

# group: Dane wejściowe
# note: Wybierz element stropu programu Revit, względem którego zostanie utworzona nowa struktura pergoli
wybierz_strop_źródłowy = DSModelElementSelection()  # 1 picked in the model; graph input
# note: Wysokość struktury
wysokość = DoubleSlider(8.4, range=0..10 step 0.1)  # graph input
liczba_belek = IntegerSlider(9, range=2..10 step 1)  # graph input
# note: Wybierz poziom, na którym ma zostać umieszczona konstrukcja
poziom_konstrukcji = Levels("L1 - Block 43")  # graph input
# note: Wybierz typ ramy dla belek obwodowych. Ten typ zostanie też użyty do utworzenia nowego typu ram konstrukcyjnych
structural_framing_types = StructuralFramingTypes("W12X26")  # graph input
# note: Wybierz typ rodziny utworzonych słupów
typy_słupów_konstrukcyjnych = StructuralColumnTypes(index=0)  # graph input

# group: Przygotuj geometrię
# Przygotuj wyrażenie czystej bryły dla geometrii wybranego elementu
# note: Pobierz geometrię elementu programu Revit
getGeometry = Element.GetGeometry(element=wybierz_strop_źródłowy)
# note: Szybkim sposobem na odrzucenie otworów w elemencie jest pobranie jego ramki ograniczającej — wirtualnego prostopadłościanu zawierającego ten element
byMinimumVolume = BoundingBox.ByMinimumVolume(geom=getGeometry)
# note: Dla brył jest dostępnych więcej operacji niż dla ramek ograniczających. Aby umożliwić dalsze przekształcenia, najpierw przekształć ramkę ograniczającą w prostopadłościan (typ bryły)
toCuboid = BoundingBox.ToCuboid(boundingBox=byMinimumVolume)
# note: Przekształć prostopadłościan bryłowy o wysokość (zTranslation) ustawioną za pomocą suwaka Numeric Slider w sekcji danych wejściowych wykresu
translate = Geometry.Translate(geometry=toCuboid, zTranslation=wysokość)

# group: Pobierz powierzchnię górną brył
# Oblicz wszystkie powierzchnie bryły na podstawie rzędnej w ich środku i pobierz powierzchnię górną
# note: Rozbij bryłę na powierzchnie
explode = Geometry.Explode(geometry=translate)
code_block = CodeBlock { 0.5; }
# note: Zlokalizuj punkt w środku powierzchni
pointAtParameter = Surface.PointAtParameter(surface=explode, u=code_block, v=code_block)
# note: Pobierz wartość liczbową dla rzędnej każdego punktu środkowego
Z = Point.Z(point=pointAtParameter)
# note: Sortuj jedną listę na podstawie drugiej: użyj wartości rzędnych, aby posortować powierzchnie
sortByKey = List.SortByKey(list=explode, keys=Z)
# note: Ostatnią powierzchnią na liście jest powierzchnia górna
lastItem = List.LastItem(list=sortByKey.sortedList)

# group: Odsuń serię punktów na powierzchni
# note: Użyj prostego wzoru, aby utworzyć sekwencję wartości z zakresu od wartości minimalnej (0,1) do maksymalnej (0,9) z liczbą kroków 'n'
sekwencja_wartości_u = CodeBlock(n=liczba_belek) { 0.1..0.9..#n; }
odsunięcia_krawędzi = CodeBlock { [0.1,0.9]; }
# note: Umieść szyk punktów na powierzchni za pomocą parametrów U i V. Wygeneruj szyk za pomocą skratowania z opcją iloczynu wektorowego (kliknij węzeł prawym przyciskiem myszy i wybierz opcję Skratowanie).
pointAtParameter_2 = Surface.PointAtParameter(surface=lastItem, u=sekwencja_wartości_u, v=odsunięcia_krawędzi, lacing=CrossProduct)

# group: Utwórz linie dla belek wewnętrznych
# Połącz punkty i utwórz linie
indeksy = CodeBlock { 0; 1; }
# note: Kliknij symbol > obok wartości wejściowej 'list', aby użyć poziomów. Oznacza to, że wynikiem będzie element z indeksem 0 z każdej najniższej listy zagnieżdżonej (na poziomie 2, L2)
getItemAtIndex = List.GetItemAtIndex(list=pointAtParameter_2@L2, index=indeksy.out0)
getItemAtIndex_2 = List.GetItemAtIndex(list=pointAtParameter_2@L2, index=indeksy.out1)
byStartPointEndPoint = Line.ByStartPointEndPoint(startPoint=getItemAtIndex, endPoint=getItemAtIndex_2)

# group: Krzywe dla belek obwodowych
# Opis <Kliknij dwukrotnie tutaj, aby edytować opis grupy>
firstItem = List.FirstItem(list=pointAtParameter_2)
lastItem_2 = List.LastItem(list=pointAtParameter_2)
byStartPointEndPoint_2 = Line.ByStartPointEndPoint(startPoint=firstItem, endPoint=lastItem_2)

# group: Krzywe dla słupów
# Zbierz poszczególne drugie rzędy punktów, aby utworzyć linie do umieszczenia słupów
code_block_2 = CodeBlock { 2; }
# note: Podziel listę na listy zawierające po 2 elementy
chop = List.Chop(list=pointAtParameter_2, lengths=code_block_2)
# note: Użyj logiki poziomów listy i pobierz tylko pierwszą listę na poziomie 3 (L3)
firstItem_2 = List.FirstItem(list=chop@L3)
odwróć_wysokość = CodeBlock(H=wysokość) { -H; }
# note: Przekształć punkty z powrotem w dół
translate_2 = Geometry.Translate(geometry=firstItem_2, zTranslation=odwróć_wysokość)
# note: Połącz punkty, aby utworzyć linie
byStartPointEndPoint_3 = Line.ByStartPointEndPoint(startPoint=translate_2, endPoint=firstItem_2)

# group: Do programu Revit: umieść belki na podstawie krzywej
# note: Umieść belki wewnętrzne
beamByCurve = StructuralFraming.BeamByCurve(curve=byStartPointEndPoint, level=poziom_konstrukcji, structuralFramingType=structural_framing_types)
# note: Umieść belki obwodowe
beamByCurve_2 = StructuralFraming.BeamByCurve(curve=byStartPointEndPoint_2, level=poziom_konstrukcji, structuralFramingType=structural_framing_types)
# note: Umieść słupy konstrukcyjne
columnByCurve = StructuralFraming.ColumnByCurve(curve=byStartPointEndPoint_3, level=poziom_konstrukcji, structuralColumnType=typy_słupów_konstrukcyjnych)
