# Dynamo graph Revit Adaptive Component Placement.dyn "Colocação de componentes adaptativos do Revit" (Dynamo 4.0.0.3076)
# author: Dynamo Team
# Esse gráfico posiciona os componentes adaptativos por pontos em um modelo.

# group: Informações
# note: As linhas de eixo das paredes cortina foram pré-selecionadas no Revit e a IDs dos elementos salvas com o arquivo do Dynamo
# note: Execute esse gráfico no arquivo de exemplo “Snowdon Towers Sample Architectural.rvt” localizado na pasta “Samples” da instalação do Revit:
# C:\Arquivos de Programa\Autodesk\Revit 2027\Samples
# Execute esse gráfico depois de carregar a família adaptativa AdaptivePanel.rfa da localização dos conjuntos de dados do Dynamo.
# note: Coloque componentes adaptativos relativos a alguns elementos selecionados em um arquivo do Revit.
# Os componentes adaptativos requerem um conjunto de pontos igual ao número de pontos de posicionamento da família que está sendo colocada

# group: Entradas
# note: Selecionar linhas de eixo das paredes cortina
selecionar_arestas = SelectEdges()  # 7 picked in the model; graph input
# note: Definir o deslocamento mínimo e máximo para o ponto central da aleta
deslocamento_mínimo = DoubleSlider(1.4, range=0.2..3 step 0.1)
deslocamento_máximo = DoubleSlider(4.3, range=3..8 step 0.1)
# note: Selecionar família de componentes adaptativos
family_types = FamilyTypes("AdaptivePanel:AdaptivePanel")  # graph input

# note: Criar uma lista de posições de pontos ao longo de uma curva, 0 sendo o início, 0,5 o meio e 1 sendo o fim
lista_de_parâmetros = CodeBlock { [0,0.5,1]; }
# note: Localizar pontos inicial, central e final em cada curva
pointAtParameter = Curve.PointAtParameter(curve=selecionar_arestas, param=lista_de_parâmetros, lacing=CrossProduct)

# group: Capturar pontos inicial e final de cada curva
índices_de_pontos_iniciais_e = CodeBlock { 0; 2; }  # "índices de pontos iniciais e finais"
getItemAtIndex = List.GetItemAtIndex(list=pointAtParameter@L2, index=índices_de_pontos_iniciais_e.out0)
# note: Similar à seleção do ponto médio, use níveis para selecionar os pontos inicial e final de cada curva
getItemAtIndex_2 = List.GetItemAtIndex(list=pointAtParameter@L2, index=índices_de_pontos_iniciais_e.out1)

# group: Capturar ponto médio de cada curva
índice_de_ponto_médio = CodeBlock { 1; }
# note: Use os níveis de listas da entrada 'list'. Por padrão, o resultado do nó será a lista com o índice um (a segunda curva). Clique com o botão direito do mouse na entrada 'list' e selecione 'Use Levels' em @L2. Isso selecionará o item com índice 1 de cada lista aninhada (pontos médios de cada curva)
getItemAtIndex_3 = List.GetItemAtIndex(list=pointAtParameter@L2, index=índice_de_ponto_médio)

# group: Criar uma onda senoidal
# note: Contar quantas curvas de origem são selecionadas
count = List.Count(list=selecionar_arestas)
# note: Criar uma sequência de valores N de 0 a 1
sequence = CodeBlock(steps=count) { 0..1..#steps; }
# note: Criar uma onda senoidal
sin = Math.Sin(angle=sequence)
# note: Remapear os valores da onda senoidal para um novo máx. e mín.
remapRange = Math.RemapRange(numbers=sin, newMin=deslocamento_mínimo, newMax=deslocamento_máximo)

# group: Deslocar pontos médios
# note: Para o deslocamento Y, impedir que o valor se desloque para fora da parede cortina
valor_negativo = CodeBlock(y=remapRange) { -y; }
# note: Deslocar os pontos centrais da aleta
translate = Geometry.Translate(geometry=getItemAtIndex_3, yTranslation=valor_negativo, zTranslation=remapRange)

# note: Para o deslocamento Y, impedir que o valor se desloque para fora da parede cortina
valor_negativo_2 = CodeBlock(y=remapRange) { y; }
# note: Deslocar os pontos centrais da aleta
translate_2 = Geometry.Translate(geometry=getItemAtIndex_3, yTranslation=valor_negativo_2, zTranslation=remapRange)

# group: Reunir pontos em listas
list_create = List.Create(item0=getItemAtIndex, item1=translate, item2=getItemAtIndex_2, item3=translate_2)
# note: Inverter a matriz e organizar as listas em conjuntos de 3
transpose = List.Transpose(lists=list_create)

# group: Para o Revit: Colocar componente
# note: É possível posicionar os componentes adaptativos usando conjuntos de pontos iguais ao número de pontos de posicionamento da família.
byPoints = AdaptiveComponent.ByPoints(points=transpose, familyType=family_types)
