# Dynamo graph Revit Color.dyn "Cor do Revit" (Dynamo 4.0.0.3076)
# author: Dynamo Team
# Esse gráfico avalia a área da superfície dos elementos selecionados e aplica sobreposições gráficas para colorir os elementos com base naquele valor.

# group: Informações
# note: Execute esse gráfico no arquivo de exemplo “Snowdon Towers Sample Architectural.rvt” localizado na pasta “Samples” da instalação do Revit
# C:\Arquivos de Programa\Autodesk\Revit 2027\Samples
# note: Esse gráfico colore os elementos do Revit com base em um critério mensurável (Área da superfície).
# Os elementos são coloridos usando o método Sobrepor gráficos na vista > Por elemento.

# group: Selecionar elementos do modelo
# Selecionar paredes faceadas
# note: Clique em “Alterar” para selecionar elementos do modelo do Revit
selecionar_elementos_do_modelo = DSModelElementsSelection()  # 33 picked in the model; graph input

# group: Avaliar área da superfície do elemento
# note: Obter geometria do elemento
getGeometry = Element.GetGeometry(element=selecionar_elementos_do_modelo)
flatten = List.Flatten(list=getGeometry)
# note: Extrair a área da superfície da geometria
area = Solid.Area(solid=flatten)
# note: Obter o valor mais alto
maximumItem = List.MaximumItem(list=area)
# note: Normalizar no valor mais alto
div = area / maximumItem  # graph output

# group: Criar cores
# Preparar o esquema de cores para codificar as cores dos elementos
number = DoubleInput(0)
number_2 = DoubleInput(255)
# note: cor verde
byARGB = Color.ByARGB(alpha=number, red=number, green=number_2, blue=number, lacing=Longest)
number_3 = DoubleInput(0)
number_4 = DoubleInput(255)
# note: cor vermelha
byARGB_2 = Color.ByARGB(alpha=number_3, red=number_4, green=number_3, blue=number_3, lacing=Longest)
create = List.Create(item0=byARGB, item1=byARGB_2)
code_block = CodeBlock { [0,1]; }
# note: definir a faixa de cores
color_range = ColorRange(colors=create, indices=code_block, value=div)

# group: Para o Revit: Substituir cor do elemento na vista
# note: Isso substitui a cor do elemento na vista ativa
overrideColorInView = Element.OverrideColorInView(element=selecionar_elementos_do_modelo, color=color_range, lacing=Longest)

# group: Limite
number_5 = DoubleInput(100)

# group: Alternativa – avaliar se os critérios ultrapassam um determinado limite
# note: Comparar com um valor de limite
gt = area > number_5
# note: Os números indicam a posição no espectro de cores – de 0 a 1
number_6 = DoubleInput(1)
number_7 = DoubleInput(0)
# note: identificar áreas dentro de uma tolerância
if_ = RefactoredIf(test=gt, true=number_6, false=number_7)
# note: é possível usar esse resultado como a entrada 'indices' do nó Color Range
watch = Watch(if_)
