# Dynamo graph Revit Floors and Framing.dyn "Pisos e estruturas do Revit" (Dynamo 4.0.0.3076)
# author: Dynamo Team
# Esse gráfico cria uma extravagância arquitetônica usando uma série de linhas e seu deslocamento para posicionar os elementos de esqueleto estrutural e piso no Revit.
# packages: Mecanismo PythonNet3 1.4.5

# group: Informações
# note: Execute esse gráfico no arquivo de exemplo “Snowdon Towers Sample Architectural.rvt” localizado na pasta “Samples” da instalação do Revit
# C:\Arquivos de Programa\Autodesk\Revit 2027\Samples
# note: Esse gráfico cria uma extravagância arquitetônica, usando uma série de linhas e as usa para direcionar a colocação do esqueleto estrutural e dos pisos.

# group: Centro da posição da extravagância
posição_x = DoubleSlider(30, range=25..40 step 1)  # graph input
posição_y = DoubleSlider(30, range=25..40 step 1)  # graph input
posição_z = DoubleSlider(62, range=60..80 step 1)  # graph input

# group: Configuração da extravagância
# Descrição <Clique duas vezes aqui para editar a descrição do grupo>
raio_do_piso_inferior = DoubleSlider(10, range=8..20 step 1)  # graph input
nº_de_pisos = DoubleSlider(7, range=3..10 step 1)  # graph input
diminuição_do_raio = DoubleSlider(-1.25, range=-2..-0.5 step 0.25)  # graph input
número_de_lados_do_polígono = IntegerSlider(5, range=3..10 step 1)  # graph input
altura_do_piso_superior = DoubleSlider(38.4, range=15..50 step 0.1)  # graph input
rotação_máxima_graus = DoubleSlider(130, range=10..180 step 5)  # graph input

# group: Construir polígonos
# Criar uma série de polígonos de um raio decrescente, deslocamento vertical, rotacionado sequencialmente
# note: Centro da arquitetura extravagante
byCoordinates = Point.ByCoordinates(x=posição_x, y=posição_y, z=posição_z)
# note: Sequência de raios do círculo
sequence = Sequence(start=raio_do_piso_inferior, amount=nº_de_pisos, step=diminuição_do_raio, lacing=Longest)
# note: Criar uma série de círculos
byCenterPointRadius = Circle.ByCenterPointRadius(centerPoint=byCoordinates, radius=sequence)
# note: Criar uma série de polígonos
regularPolygon = Polygon.RegularPolygon(circle=byCenterPointRadius, numberSides=número_de_lados_do_polígono)
# note: Uma sequência de elevações de piso
sequência_de_alturas_do_piso = CodeBlock(top_floor=altura_do_piso_superior, count=nº_de_pisos) { 0..top_floor..#count; }
byCoordinates_2 = Vector.ByCoordinates(z=sequência_de_alturas_do_piso)
# note: Mover os polígonos para cima por alturas determinadas
translate = Geometry.Translate(geometry=regularPolygon, direction=byCoordinates_2)
ZAxis = Vector.ZAxis()
# note: Uma sequência de rotações para cada piso
sequência_de_ângulos_de_rotação = CodeBlock(max_degrees=rotação_máxima_graus, count=nº_de_pisos) { 0..max_degrees..#count; }
# note: Rotacionar os polígonos com uma série de ângulos
rotate = Geometry.Rotate(geometry=translate, origin=byCoordinates, axis=ZAxis, degrees=sequência_de_ângulos_de_rotação)
# note: Extrair curvas individuais dos polígonos
curves = PolyCurve.Curves(polyCurve=rotate)

# group: Nível e tipo de piso
# note: Selecione o tipo de piso dos pisos criados com base nos tipos existentes no projeto usando o menu suspenso
floor_types = FloorTypes("Concrete Slab 6\"")  # graph input
levels = Levels("Green Roof Hardscape")  # graph input

# group: Para o Revit: Criar pisos
# Usar a série de contornos de curva fechada como entrada para a criação de piso
# note: Passar grupos de curvas para criar pisos
byOutlineTypeAndLevel = Floor.ByOutlineTypeAndLevel(outline=curves, floorType=floor_types, level=levels)

# group: Conexões verticais
# Conectar cantos do polígono entre níveis de extravagância
# note: Obter pontos finais de cada curva do polígono
endPoint = Curve.EndPoint(curve=curves)
# note: Inverter a matriz e obter listas de pontos finais alinhados verticalmente
transpose = List.Transpose(lists=endPoint)
# note: Conectar cantos de polígonos correspondentes do nível de extravagância mais baixo para o mais alto, unindo-os como PolyCurves
byPoints = PolyCurve.ByPoints(points=transpose)
# note: Desconstruir PolyCurves e obter listas de curvas para servir como entrada para elementos de esqueleto estrutural
curves_2 = PolyCurve.Curves(polyCurve=byPoints)

# group: Tipo e nível de esqueleto estrutural
levels_2 = Levels("Green Roof Hardscape")  # graph input
# note: Selecione o tipo de esqueleto estrutural nos tipos carregados no projeto usando o menu suspenso
structural_framing_types = StructuralFramingTypes("W12X26")  # graph input

# group: Para o Revit: Criar esqueleto estrutural
# Usar curvas para criar elementos de esqueleto estrutural e usar um nó Python para não permitir a união entre vigas individuais
# note: Passar curvas individuais para cada elemento estrutural
beamByCurve = StructuralFraming.BeamByCurve(curve=curves_2, level=levels_2, structuralFramingType=structural_framing_types)
# note: Preparar a lista
flatten = List.Flatten(list=beamByCurve)
# note: Esse é um nó Python renomeado que faz referência à API do Revit para estender o que o Dynamo pode fazer além dos nós prontos. Para ler o código Python, clique com o botão direito do mouse no nó e clique em Editar…
não_permitir_uniões_no_esqueleto = Python(structuralFraming=flatten)  # "Não permitir uniões no esqueleto estrutural"; PythonNet3
# ---------- não_permitir_uniões_no_esqueleto.python (35 lines) ----------
# Load the Python Standard and DesignScript Libraries
import sys
import clr
clr.AddReference('ProtoGeometry')
from Autodesk.DesignScript.Geometry import *
from Autodesk.Revit.DB import *
from RevitServices.Transactions import TransactionManager
from RevitServices.Persistence import DocumentManager 

doc = DocumentManager.Instance.CurrentDBDocument

# The inputs to this node will be stored as a list in the IN variables.
dataEnteringNode = IN

# Place your code below this line
structural_framing = UnwrapElement(IN[0])

unjoined_elements = []
# start a Transaction
TransactionManager.Instance.EnsureInTransaction(doc)
# iterate through each structural framing element
for sf in structural_framing:
    # check if the element passed in of Structural Framing Category
    sf_category = sf.Category # get the element's Category
    # use the Structural Framing's Category Id to check
    if sf_category.Id.Value == -2001320:
        # disallow joins at start and end of the structural framing element
        Structure.StructuralFramingUtils.DisallowJoinAtEnd(sf, 0)
        Structure.StructuralFramingUtils.DisallowJoinAtEnd(sf, 1)
        unjoined_elements.append(sf)
TransactionManager.Instance.TransactionTaskDone()

    
# Output the list of elements with Disallowed Join
OUT = unjoined_elements
# ----------------------------------------
