# Dynamo graph Revit Geometry Creation Curves.dyn "Curvas de criação de geometria do Revit" (Dynamo 4.0.0.3076)
# author: Dynamo Team
# Esse gráfico mostra diversos métodos de criação de curvas no Dynamo e de uso para criar elementos do Revit (linhas de modelo)

# group: Informações
# note: Esse gráfico usa diversos métodos de criação de curvas a serem usados como entrada para a criação de curvas do modelo do Revit
# note: Execute esse gráfico no arquivo de exemplo “Snowdon Towers Sample Architectural.rvt” localizado na pasta “Samples” da instalação do Revit
# C:\Arquivos de Programa\Autodesk\Revit 2027\Samples

# group: Quatro pontos
# Descrição <Clique duas vezes aqui para editar a descrição do grupo>
number = DoubleInput(-35)
number_2 = DoubleInput(-55)
byCoordinates = Point.ByCoordinates(x=number, y=number_2)
number_3 = DoubleInput(-40)
byCoordinates_2 = Point.ByCoordinates(x=number, y=number_3)
number_4 = DoubleInput(-10)
byCoordinates_3 = Point.ByCoordinates(x=number_4, y=number_3)
number_5 = DoubleInput(-17)
number_6 = DoubleInput(-60)
byCoordinates_4 = Point.ByCoordinates(x=number_5, y=number_6)

list_create = List.Create(item0=byCoordinates, item1=byCoordinates_2, item2=byCoordinates_3, item3=byCoordinates_4)

# group: Criar curva de modelo com base na curva Nurbs (por pontos)
# note: Criar uma curva NURBS com base em uma lista de pontos
byPoints = NurbsCurve.ByPoints(points=list_create)
# note: Usar a curva NURBS para criar uma linha de modelo do Revit
byCurve = ModelCurve.ByCurve(curve=byPoints)

# group: Criar curva modelo com base na curva Nurbs (por Pontos de controle)
boolean = BoolSelector(false)
# note: Criar uma curva NURBS com base em uma lista de pontos como Pontos de controle
byControlPoints = NurbsCurve.ByControlPoints(points=list_create, closeCurve=boolean)
# note: Usar a curva NURBS para criar uma linha de modelo do Revit
byCurve_2 = ModelCurve.ByCurve(curve=byControlPoints)

# group: Criar curva modelo com base na Polycurve
# note: Criar uma PolyCurve com base em uma lista de pontos
byPoints_2 = PolyCurve.ByPoints(points=list_create)
curves = PolyCurve.Curves(polyCurve=byPoints_2)
# note: Usar a lista de curvas para criar um conjunto de linhas do modelo do Revit
byCurve_3 = ModelCurve.ByCurve(curve=curves)

# group: Criar curva de modelo com base na linha
# note: Criar uma curva com base em dois pontos
byStartPointEndPoint = Line.ByStartPointEndPoint(startPoint=byCoordinates, endPoint=byCoordinates_2)
# note: Usar a linha (curva) para criar uma curva de modelo do Revit
byCurve_4 = ModelCurve.ByCurve(curve=byStartPointEndPoint)
