# Dynamo graph Revit Geometry Creation Points.dyn "Pontos de criação de geometria do Revit" (Dynamo 4.0.0.3076)
# author: Dynamo Team
# Esse gráfico cria uma linha de modelo e um ponto de referência quando no ambiente de família de massa conceitual.

# group: Informações
# note: É possível alternar entre a navegação 3D no plano de fundo e a navegação na vista gráfica com os botões no canto superior direito da tela (atalho Ctrl + B). A visualização do plano de fundo também pode ser ativada e desativada no menu Exibir, para o Dynamo e o Revit.
# note: Execute esse gráfico em um ambiente da família adaptativa Massa conceitual ou Modelo genérico.
# Para criar uma nova família, acesse Arquivo > Nova família > e selecione o modelo localizado na pasta:
# C:\ProgramData\Autodesk\RVT 2027\Family Templates\English-Imperial\Generic Model Adaptive.rft
# note: Esse gráfico cria uma linha de modelo e um ponto de referência no ambiente de família

# group: Coordenadas do pontos
valor_x_do_ponto = DoubleSlider(50, range=5..50 step 5)  # graph input
valor_y_do_ponto = DoubleSlider(25, range=5..50 step 5)  # graph input
valor_z_do_ponto = DoubleSlider(25, range=5..50 step 5)  # graph input

# note: Manipule a posição do ponto no ambiente do Dynamo: selecione o nó Point.ByCoordinates e alterne para a visualização do plano de fundo para puxar o ponto ao longo de seus três eixos.
byCoordinates = Point.ByCoordinates(x=valor_x_do_ponto, y=valor_y_do_ponto, z=valor_z_do_ponto)
# note: Os dados geométricos podem ser visualizados como informações textuais ou no espaço 3D
watch = Watch(byCoordinates)
byCoordinates_2 = Point.ByCoordinates()
byStartPointEndPoint = Line.ByStartPointEndPoint(startPoint=byCoordinates_2, endPoint=byCoordinates)
# note: Visualizar a geometria
watch_3d = Watch3D(byStartPointEndPoint)
# note: Criar uma curva de modelo conectando dois pontos
byCurve = ModelCurve.ByCurve(curve=byStartPointEndPoint)
# note: O Dynamo só pode criar e modificar elementos apropriados para o arquivo ao qual o Dynamo está associado. Por exemplo, os pontos de referência só podem ser feitos em determinados ambientes de família (como o Modelo genérico adaptativo), enquanto as linhas de modelo podem ser criadas em praticamente qualquer lugar.
byPoint = ReferencePoint.ByPoint(pt=byCoordinates)
