# Dynamo graph Revit Geometry Creation Solids.dyn "Sólidos de criação de geometria do Revit" (Dynamo 4.0.0.3076)
# author: Dynamo Team
# Esse gráfico apresenta diversos métodos de criação de geometria sólida no Dynamo e sua integração no Revit – alguns métodos podem ser usados em um ambiente de projeto, outros somente em determinados ambientes de família (massa conceitual).

# group: Informações
# note: Existem vários métodos de criação para a maioria dos sólidos. Estes exemplos mostram perfis fechados como base, mas é possível unir PolySurfaces, muitas primitivas estão disponíveis (superfícies, cuboide, cone, etc).
# Para integrar a geometria ao ambiente do Revit, primeiro ele precisa ser convertido em um elemento do Revit.
# É possível transformar os sólidos em uma instância de importação que ficará visível nos ambientes de projeto e família de modelos.
# A geometria dos sólidos também pode ser convertida em um elemento de forma que somente está disponível para ambientes de massa conceitual e família de componentes adaptativos.
# note: Esse gráfico usa diversos métodos para criar a geometria sólida no Revit – alguns métodos podem ser usados em um ambiente de projeto, outros somente em determinados ambientes de família.
# Use um modelo de família de massa conceitual para exibir todos os métodos.
# Para abrir uma família de massa conceitual, vá para Arquivo > Nova > Família > e selecione o modelo Mass.rft em \Conceptual Mass\Mass.rft

# group: Preparar pontos
# Gerar um conjunto de pontos para construir a geometria
byCoordinates = Point.ByCoordinates()
number = DoubleInput(10)
byCoordinates_2 = Point.ByCoordinates(x=number)
number_2 = DoubleInput(5)
byCoordinates_3 = Point.ByCoordinates(z=number_2)
number_3 = DoubleInput(10)
byCoordinates_4 = Point.ByCoordinates(y=number_3)
number_4 = DoubleInput(15)
byCoordinates_5 = Point.ByCoordinates(x=number_4, y=number_4)
number_5 = DoubleInput(5)
number_6 = DoubleInput(10)
byCoordinates_6 = Point.ByCoordinates(x=number_5, y=number_6, z=number_6)
number_7 = DoubleInput(-2)
number_8 = DoubleInput(5)
byCoordinates_7 = Point.ByCoordinates(x=number_7, y=number_8)

# group: Primeiro perfil
# Criar um primeiro perfil como uma curva fechada com base em um arco e uma linha
byStartPointEndPoint = Line.ByStartPointEndPoint(startPoint=byCoordinates, endPoint=byCoordinates_2)
byThreePoints = Arc.ByThreePoints(firstPoint=byCoordinates, secondPoint=byCoordinates_3, thirdPoint=byCoordinates_2)
create = List.Create(item0=byStartPointEndPoint, item1=byThreePoints)
# note: Primeiro perfil da transição
byJoinedCurves = PolyCurve.ByJoinedCurves(curves=create)

# group: Segundo perfil
# Criar um segundo perfil como uma curva fechada com base em um arco e uma linha
byStartPointEndPoint_2 = Line.ByStartPointEndPoint(startPoint=byCoordinates_4, endPoint=byCoordinates_5)
byThreePoints_2 = Arc.ByThreePoints(firstPoint=byCoordinates_4, secondPoint=byCoordinates_6, thirdPoint=byCoordinates_5)
create_2 = List.Create(item0=byStartPointEndPoint_2, item1=byThreePoints_2)
# note: Segundo perfil da transição
byJoinedCurves_2 = PolyCurve.ByJoinedCurves(curves=create_2)

# note: Unir dois perfis em uma lista
create_3 = List.Create(item0=byJoinedCurves, item1=byJoinedCurves_2)

# group: Transição de sólido por seções transversais
# Descrição <Clique duas vezes aqui para editar a descrição do grupo>
byLoft = Solid.ByLoft(crossSections=create_3)

# note: Investigar o volume do sólido
volume = Solid.Volume(solid=byLoft)

# group: Criar casca
code_block = CodeBlock { 0; }
# note: Dica: desative "Visualizar" nos menus de contexto do nó para excluir elementos da exibição
thinShell = Solid.ThinShell(solid=byLoft, internalFaceThickness=code_block)

# group: Converter geometria
code_block_2 = CodeBlock { Vector.ByCoordinates(20,0,0); }
# note: Converta a geometria para o lado para visualizar o resultado original e o final
translate = Geometry.Translate(geometry=thinShell, direction=code_block_2)

# group: Recortar sólido
# Use a operação Recortar para cortar o sólido de casca com um plano.
code_block_3 = CodeBlock { Point.ByCoordinates(0,0,5); }
ZAxis = Vector.ZAxis()
byOriginNormal = Plane.ByOriginNormal(origin=code_block_3, normal=ZAxis)
number_9 = DoubleInput(10)
# note: Selecione qual lado da apara deve ser mantido (o lado mais próximo do ponto será descartado).
byCoordinates_8 = Point.ByCoordinates(x=number_9, y=number_9, z=number_9)
# note: As operações booleanas geométricas (Intersecção, Diferença, União etc.) estão disponíveis na categoria da geometria.
trim = Geometry.Trim(geometry=translate, other=byOriginNormal, pick=byCoordinates_8)

# group: Curva guia
# Criar uma curva NURBS a ser usada como curva guia para a forma de sólido de transição
create_4 = List.Create(item0=byCoordinates, item1=byCoordinates_7, item2=byCoordinates_4)
# note: Curva guia construída como uma curva NURBS
byPoints = NurbsCurve.ByPoints(points=create_4)

# group: Transição de sólido por seções transversais e curvas guia
# note: Dica: desative "Visualizar" nos menus de contexto do nó para excluir elementos da exibição
byLoft_2 = Solid.ByLoft(crossSections=create_3, guideCurves=byPoints)

# group: Criar instância de importação
code_block_4 = CodeBlock { Vector.ByCoordinates(-20,0,0); }
translate_2 = Geometry.Translate(geometry=byLoft_2, direction=code_block_4)
# note: Geometria não é o mesmo que um elemento do Revit:
# Use Importar instância para criar importações do Revit com base nas superfícies e nos sólidos em qualquer ambiente do Revit, use Pontos e curvas para colocar instâncias de família ou crie famílias de formas na massa e no modelo genérico por ponto (componente adaptativo)
byGeometries = ImportInstance.ByGeometries(geometries=translate_2)
byCoordinates_9 = Vector.ByCoordinates()

# group: Criar forma
# Usando dois contornos de curva de perfil, crie um elemento de forma (no ambiente de família de massa conceitual)
curves = PolyCurve.Curves(polyCurve=create_3)
# note: Criar curvas do modelo com base em curvas
referenceCurveByCurve = ModelCurve.ReferenceCurveByCurve(curve=curves)
# note: Só é possível criar formas como parte de uma família de massa conceitual
byLoftCrossSections = Form.ByLoftCrossSections(curves=referenceCurveByCurve)
