# Dynamo graph Revit Geometry Creation Surfaces.dyn "Superfícies de criação de geometria do Revit" (Dynamo 4.0.0.3076)
# author: Dynamo Team
# Esse gráfico apresenta diversos métodos de criação de superfícies no Dynamo e dois métodos de conversão de geometria em geometria do Revit.

# group: Informações
# note: Esse gráfico usa diversos métodos para criar a geometria da superfície no Revit – alguns métodos podem ser usados em um ambiente de projeto, outros somente em determinados ambientes de família.
# Use um modelo de família de massa conceitual para exibir todos os métodos.
# Crie uma família de massa conceitual indo para Arquivo > Nova > Família e selecione o modelo Mass.rft na pasta Conceptual Mass.
# note: Existem vários métodos de criação para a maioria das superfícies. É possível criar superfícies, PolySurfaces (coleções de superfícies) e superfícies NURBS por pontos, curvas e derivadas de outras superfícies e sólidos por várias operações.
# note: Para integrar a geometria no ambiente do Revit, ela precisa ser convertida em um elemento do Revit.
# É possível transformar superfícies e sólidos em uma instância de importação que será visível nos ambientes de projeto e família de modelos.
# A geometria da superfície também pode ser convertida em um elemento de forma que somente está disponível para ambientes de massa conceitual e família de componentes adaptativos.

# group: Preparar pontos
# Gerar um conjunto de pontos para construir a geometria
number = DoubleInput(10)
byCoordinates = Point.ByCoordinates(y=number)
number_2 = DoubleInput(5)
number_3 = DoubleInput(10)
byCoordinates_2 = Point.ByCoordinates(x=number_2, y=number_3, z=number_3)
number_4 = DoubleInput(15)
byCoordinates_3 = Point.ByCoordinates(x=number_4, y=number_4)
byCoordinates_4 = Point.ByCoordinates()
number_5 = DoubleInput(5)
byCoordinates_5 = Point.ByCoordinates(z=number_5)
byCoordinates_6 = Point.ByCoordinates(x=number)
number_6 = DoubleInput(-5)
number_7 = DoubleInput(5)
byCoordinates_7 = Point.ByCoordinates(x=number_6, y=number_7)
number_8 = DoubleInput(10)
number_9 = DoubleInput(-10)
byCoordinates_8 = Point.ByCoordinates(x=number_8, y=number_9)
byCoordinates_9 = Point.ByCoordinates(y=number_9)

# group: Criar perfis
byThreePoints = Arc.ByThreePoints(firstPoint=byCoordinates, secondPoint=byCoordinates_2, thirdPoint=byCoordinates_3)
byThreePoints_2 = Arc.ByThreePoints(firstPoint=byCoordinates_4, secondPoint=byCoordinates_5, thirdPoint=byCoordinates_6)
byThreePoints_3 = Arc.ByThreePoints(firstPoint=byCoordinates_4, secondPoint=byCoordinates_7, thirdPoint=byCoordinates)
byStartPointEndPoint = Line.ByStartPointEndPoint(startPoint=byCoordinates_8, endPoint=byCoordinates_9)

# group: Superfície por varredura
# Usar um perfil, uma curva de caminho e um guia para criar uma superfície de varredura
bySweep2Rails = Surface.BySweep2Rails(path=byThreePoints, guideRail=byThreePoints_2, profile=byThreePoints_3)

# group: Criar importação
# note: Use Importar instância para criar importações do Revit com base em superfícies e sólidos, que serão visíveis em qualquer ambiente do Revit.
byGeometries = ImportInstance.ByGeometries(geometries=bySweep2Rails)

create = List.Create(item0=byStartPointEndPoint, item1=byThreePoints_2)

# group: Criar superfície por elevação
# Unir seções transversais para criar uma superfície de transição
byLoft = Surface.ByLoft(crossSections=create)

# group: Avaliar área da superfície
area = Surface.Area(surface=byLoft)
watch = Watch(area)
create_2 = List.Create(item0=byLoft, item1=bySweep2Rails)
# note: As superfícies unidas como Polissuperfícies podem ser consideradas como uma entidade única
byJoinedSurfaces = PolySurface.ByJoinedSurfaces(surfaces=create_2)
area_2 = Surface.Area(surface=byJoinedSurfaces)
watch_2 = Watch(area_2)
area_3 = Surface.Area(surface=bySweep2Rails)
watch_3 = Watch(area_3)

# group: Superfície NURBS com base nos de pontos de controle
# Converter uma varredura em uma superfície NURBS com base nos pontos de controle
code_block = CodeBlock { 0..1..0.1; }
# note: É possível derivar arestas, pontos e outros recursos de superfícies usando “Ações” apropriadas para essas geometrias.
pointAtParameter = Surface.PointAtParameter(surface=bySweep2Rails, u=code_block, v=code_block, lacing=CrossProduct)
# note: Reconstruir a superfície como uma superfície NURBS com base nos pontos de controle
byControlPoints = NurbsSurface.ByControlPoints(controlVertices=pointAtParameter)
# note: Usar o nó Watch 3D para visualizar a geometria isolada
watch_3d = Watch3D(byControlPoints)

# group: Superfície por curva de extrusão
# Use uma curva para criar uma extrusão com uma determinada distância
code_block_2 = CodeBlock { 10; }
extrude = Curve.Extrude(curve=byThreePoints, distance=code_block_2)

# group: Criar forma
# Criar uma forma de transição com base em duas curvas
referenceCurveByCurve = ModelCurve.ReferenceCurveByCurve(curve=create)
byLoftCrossSections = Form.ByLoftCrossSections(curves=referenceCurveByCurve)
