# Dynamo graph Revit Import Solid.dyn "Sólido de importação do Revit" (Dynamo 4.0.0.3076)
# author: Dynamo Team
# Esse gráfico demonstra um método de criação da geometria dos sólidos do Dynamo e de uso para criar um elemento de instância de importação do Revit. Crie uma nova forma de telhado criando uma série de perfis de arco e usando-os para criar uma superfície de transição.

# group: Informações
# note: O elemento de origem (telhado) foi pré-selecionado no Revit e as IDs dos elemento salvas com o arquivo do Dynamo
# note: Execute esse gráfico no arquivo de exemplo “Snowdon Towers Sample Architectural.rvt” localizado na pasta “Samples” da instalação do Revit
# C:\Arquivos de Programa\Autodesk\Revit 2027\Samples
# note: Construa uma nova forma de telhado com base em um elemento de telhado selecionado criando uma série de perfis de arco e usando-os para criar uma superfície de transição. A geometria é convertida em uma instância de importação para integrá-la ao ambiente do Revit

# group: Nova configuração de telhado
# note: O número de perfis dos quais a superfície de transição será criada
número_de_perfis = IntegerSlider(6, range=3..10 step 1)
# note: A altura nas extremidades curtas do novo telhado
seção_mínima_do_telhado = DoubleSlider(2.1, range=1..5 step 0.1)
# note: A altura no meio do telhado
seção_máxima_do_telhado = DoubleSlider(7, range=5..10 step 0.1)
# note: Estender os perfis de arco para os lados por esse valor
extensão_dos_lados_do_telhado = DoubleSlider(0.5, range=0.1..3 step 0.1)
# note: Espessura da nova forma do telhado
espessura_do_telhado = DoubleSlider(0.5, range=0.1..2 step 0.1)

nº_de_perfis = CodeBlock(steps=número_de_perfis) { steps; }

# group: Selecionar telhado
# Selecionar elemento de telhado de origem
# note: É possível definir todas as entradas marcadas em 'IsInput' no Reprodutor do Dynamo
selecionar_telhado_plano = DSModelElementSelection()  # 1 picked in the model

# group: Obter face do telhado
# Explodir a geometria do elemento de origem e selecionar uma face com a maior área
# note: Para obter a face do elemento selecionado, primeiro obtenha sua geometria
# note: Clique com o botão direito do mouse e desmarque “Visualizar geometria” para obter uma vista mais clara do resultado final
getGeometry = Element.GetGeometry(element=selecionar_telhado_plano)
# note: Explodir a geometria para obter faces individuais
explode = Geometry.Explode(geometry=getGeometry)
# note: Descarte a estrutura da lista. Observe que essa etapa não será necessária se vários objetos de origem forem usados
flatten = List.Flatten(list=explode)
area = Surface.Area(surface=flatten)
# note: Classifique a lista de superfícies por área. A superfície com as maiores áreas será o último item na lista da saída sortedList
sortByKey = List.SortByKey(list=flatten, keys=area)
lastItem = List.LastItem(list=sortByKey.sortedList)
number = DoubleInput(1.5)
# note: Converter a superfície para cima
translate = Geometry.Translate(geometry=lastItem, zTranslation=number)

# group: Deslocar para fora (escala)
# Dimensionar a superfície para estender suas arestas para fora
posição_uv = CodeBlock { 0.5; }
pointAtParameter = Surface.PointAtParameter(surface=translate, u=posição_uv, v=posição_uv)
escala_de_ponto_a_ponto = CodeBlock { point1 = Point.ByCoordinates(1, 1); point2 = Point.ByCoordinates(-40, -40); }
scale = Geometry.Scale(geometry=translate, basePoint=pointAtParameter, from=escala_de_ponto_a_ponto.point1, to=escala_de_ponto_a_ponto.point2)

# group: Pontos na superfície
# Gere três listas de pontos igualmente espaçados – duas linhas ao longo das arestas mais longas e uma linha no meio
# note: 0 e 1 são posições ao longo de arestas mais longas da superfície
posições_u_das_linhas_de_aresta = CodeBlock { [0,1]; }
# note: Posições V ao longo das arestas mais longas, em uma sequência de 0 a 1 e N etapas
posições_v_das_linhas_de_aresta = CodeBlock(steps=nº_de_perfis) { [0..1..#steps]; }
# note: Use a configuração Amarra mais longa clicando com o botão direito no nó > Amarra.
# A amarra mais longa corresponderá às entradas com diferentes estruturas de listas. Neste caso, o resultado será duas listas de pontos, em que o número de pontos em cada lista corresponde ao da lista de entradas mais longa.
pointAtParameter_2 = Surface.PointAtParameter(surface=scale, u=posições_u_das_linhas_de_aresta, v=posições_v_das_linhas_de_aresta, lacing=Longest)
# note: O valor U de 0,5 posicionará pontos ao longo do meio da superfície
posição_u_da_linha_média = CodeBlock { [0.5]; }
# note: Posições V ao longo da linha média de pontos, em uma sequência de 0 a 1 e N etapas
posições_v_da_linha_média = CodeBlock(steps=nº_de_perfis) { [0..1..#steps]; }
# note: a amarra mais longa é usada para esse nó. O resultado é uma lista de pontos, em que o número de pontos na lista corresponde à lista de entradas mais longa.
pointAtParameter_3 = Surface.PointAtParameter(surface=scale, u=posição_u_da_linha_média, v=posições_v_da_linha_média, lacing=Longest)

# group: Desviar pontos para cima
# Deslocar os pontos da linha do meio na forma de uma onda cosseno
# note: uma sequência de valores para gerar uma série de deslocamentos
sequência_de_ângulos = CodeBlock(steps=nº_de_perfis) { -1..1..#steps; }
# note: Alternativa: Usar o seno para uma forma de telhado diferente
sin = Math.Sin(angle=sequência_de_ângulos)
# note: valores em uma onda cosseno
cos = Math.Cos(angle=sequência_de_ângulos)
# note: remapear os valores para um novo domínio
remapRange = Math.RemapRange(numbers=cos, newMin=seção_mínima_do_telhado, newMax=seção_máxima_do_telhado)
# note: converter os pontos da linha do meio
translate_2 = Geometry.Translate(geometry=pointAtParameter_3@L2, zTranslation=remapRange)

# group: Criar perfis com base em arcos
# Usar os pontos para criar arcos
# note: Unir as linhas de aresta e do meio em uma lista
join = List.Join(list0=pointAtParameter_2, list1=translate_2)
índice_de_itens = CodeBlock { 0; 1; 2; }
getItemAtIndex = List.GetItemAtIndex(list=join, index=índice_de_itens.out0)
getItemAtIndex_2 = List.GetItemAtIndex(list=join, index=índice_de_itens.out2)
getItemAtIndex_3 = List.GetItemAtIndex(list=join, index=índice_de_itens.out1)
byThreePoints = Arc.ByThreePoints(firstPoint=getItemAtIndex, secondPoint=getItemAtIndex_2, thirdPoint=getItemAtIndex_3)

# group: Estender perfis
# Estender as curvas de cada perfil por uma determinada distância
# note: O valor da extensão é definido como entrada no lado esquerdo do gráfico.
estender_arestas = CodeBlock(roof_extension=extensão_dos_lados_do_telhado) { roof_extension; }
extendStart = Curve.ExtendStart(curve=byThreePoints, distance=estender_arestas)
extendEnd = Curve.ExtendEnd(curve=extendStart, distance=estender_arestas)

# group: Elevar e engrossar
# Criar uma superfície de transição e atribuir uma espessura
byLoft = Surface.ByLoft(crossSections=extendEnd)
thicken = Surface.Thicken(surface=byLoft, thickness=espessura_do_telhado)

# group: Para o Revit:
# Converter geometria do Dynamo em um elemento do Revit por meio do parâmetro ImportInstance e Definir nível
# note: Para integrar a geometria no ambiente do Revit, ela precisa ser convertida em um elemento do Revit.
# É possível transformar os sólidos em uma instância de importação que será visível nos ambientes de projeto e família de modelos.
byGeometry = ImportInstance.ByGeometry(geometry=thicken)
code_block = CodeBlock { "Plano de trabalho"; }
levels = Levels("L1 - Block 43")
# note: Corrija a altura da instância de importação colocada definindo o parâmetro Plano de trabalho como Nível no qual a elevação corresponde à posição da origem interna.
setParameterByName = Element.SetParameterByName(element=byGeometry, parameterName=code_block, value=levels)
