# Dynamo graph Revit Place Families By Level Set Parameters.dyn "Parâmetros de definição de colocação de famílias por nível do Revit" (Dynamo 4.0.0.3076)
# author: Dynamo Team
# Esse gráfico demonstra como colocar elementos do Revit por ponto. Coloque linhas de cadeiras em um ambiente selecionado e escreva números exclusivos para seu parâmetro de marca

# group: Informações
# note: Execute esse gráfico no arquivo de exemplo “Snowdon Towers Sample Architectural.rvt” localizado na pasta “Samples” da instalação do Revit
# C:\Arquivos de Programa\Autodesk\Revit 2027\Samples
# note: Colocar filas de cadeiras em um ambiente selecionado e escreva números exclusivos para seu parâmetro de marca

# group: Selecionar elementos do Revit
# note: Selecione o tipo de família das instâncias que estão sendo colocadascom base nos tipos de família no projeto
family_types = FamilyTypes("Chair-Breuer:Chair-Breuer")  # graph input
# note: Selecione um ambiente no qual deseja colocar os elementos. Você precisará navegar para uma vista onde os ambientes estão visíveis (Planta de piso)
selecionar_ambiente = DSModelElementSelection()  # 1 picked in the model; graph input
raio_do_círculo = DoubleSlider(6.4, range=5..8 step 0.1)  # graph input
# note: Selecionar o nível no qual deseja colocar os elementos
levels = Levels("L3")  # graph input

# group: Definir deslocamentos das linhas
# Os valores dos deslocamentos das linhas não são a distância, mas os valores U e V
início_da_linha = DoubleSlider(0.3, range=0..3 step 0.1)  # graph input
extremidade_da_linha = DoubleSlider(2.2, range=0..3 step 0.1)  # graph input
nº_de_cadeiras_em_uma_linha = IntegerSlider(8, range=2..12 step 1)  # graph input
posição_da_primeira_linha = DoubleSlider(0.2, range=0..3 step 0.1)  # graph input
posição_da_última_linha = DoubleSlider(1.4, range=0..3 step 0.1)  # graph input
espaçamento_da_linha = DoubleSlider(0.35, range=0.15..1 step 0.05)  # graph input

# group: Gerar deslocamentos das linhas
# Série de números correspondentes às posições U e V na superfície. Os valores podem exceder o domínio 0 a 1
# note: Uma alternativa para criar uma sequência definindo o início, o fim e o número de passos da sequência
sequência_de_deslocamento_das = CodeBlock(start=início_da_linha, finish=extremidade_da_linha, steps=nº_de_cadeiras_em_uma_linha) { start..finish..#steps; }  # "Sequência de deslocamento das linhas"
# note: Gerar uma série de números dentro de um intervalo, com uma determinada etapa
range = Range(start=posição_da_primeira_linha, end=posição_da_última_linha, step=espaçamento_da_linha)

# group: Preparar pontos de localização
# Descrição <Clique duas vezes aqui para editar a descrição do grupo>
# note: O ponto de colocação do ambiente selecionado
location = Room.Location(room=selecionar_ambiente)
# note: Círculo que define uma área inicial de posicionamento. A forma do círculo não importa neste caso, mas é a maneira mais rápida de definir uma superfície fechada
byCenterPointRadius = Circle.ByCenterPointRadius(centerPoint=location, radius=raio_do_círculo)
# note: Converter o círculo numa superfície para usá-lo para o posicionamento de pontos
patch = Curve.Patch(curve=byCenterPointRadius)
# note: Usando sequências de valores U e V, crie uma matriz de pontos. Defina a amarra do nó como Produto transversal clicando com o botão direito do mouse e selecionando Amarra.
pointAtParameter = Surface.PointAtParameter(surface=patch, u=sequência_de_deslocamento_das, v=range, lacing=CrossProduct)

# group: Para o Revit: Colocar instâncias de família
# note: Colocar instâncias da família
# A maioria das famílias também podem ser colocadas por localização dos pontos. Os componentes adaptativos podem ser colocados com múltiplos pontos, o esqueleto estrutural é colocado com curvas
byPointAndLevel = FamilyInstance.ByPointAndLevel(familyType=family_types, point=pointAtParameter, level=levels)

# note: Dispor a estrutura da lista – obter uma lista contendo todos os itens
flatten = List.Flatten(list=byPointAndLevel)

# group: Prefixo de marca
# Usar um prefixo personalizado para elementos inseridos no número de marca
prefixo_de_marca = StringInput("C-")  # graph input

# group: Gerar números de marca
number = DoubleInput(1)
# note: Contar o número de itens na lista
count = List.Count(list=flatten)
# note: Gerar os números de 1 a n
sequence = Sequence(start=number, amount=count, step=number, lacing=Longest)
# note: Para participar de operações de sequência de caracteres, o número deve ser convertido primeiro em uma sequência de caracteres
string_from_object = FromObject(obj=sequence)
índice = CodeBlock { 0; }
# note: Inserir um prefixo personalizado no número do item
insert = String.Insert(string=string_from_object, index=índice, toInsert=prefixo_de_marca)

# group: Para o Revit: Definir valores de parâmetros
string = StringInput("Marca")
# note: Defina o parâmetro de marca com uma lista de valores. A estrutura da lista de elementos e entradas de valores deve coincidir; caso contrário, só será possível usar um valor. Os parâmetros também podem ser lidos usando um nó Element.GetParameterByName
setParameterByName = Element.SetParameterByName(element=flatten, parameterName=string, value=insert)

# group: Resultados da verificação
# note: É possível usar o nó de inspeção para verificar se os resultados são os esperados
watch = Watch(insert)  # graph output
