# Dynamo graph Revit Structural Framing.dyn "Framing estrutural do Revit" (Dynamo 4.0.0.3076)
# author: Dynamo Team
# Esse gráfico cria uma estrutura com base no esqueleto estrutural e nas colunas relativas a um piso do Revit selecionado.

# group: Informações
# note: Coloque vigas e colunas de esqueleto estrutural relativas a um elemento selecionado em um modelo do Revit.
# note: Execute este gráfico no arquivo de exemplo “Snowdon Towers Sample Architectural.rvt” localizado na pasta “Samples” da instalação do Revit
# C:\Arquivos de Programa\Autodesk\Revit 2027\Samples

# group: Entradas
# note: Selecione um elemento de piso do Revit relativo ao qual a nova estrutura pergola será criada
selecionar_piso_de_origem = DSModelElementSelection()  # 1 picked in the model; graph input
# note: Altura da estrutura
altura = DoubleSlider(8.4, range=0..10 step 0.1)  # graph input
número_de_vigas = IntegerSlider(9, range=2..10 step 1)  # graph input
# note: Selecionar o nível no qual deseja colocar a estrutura
nível_de_estrutura = Levels("L1 - Block 43")  # graph input
# note: Selecione um tipo de estrutura para as vigas de perímetro. Esse tipo também será usado para criar um novo tipo de esqueleto estrutural
structural_framing_types = StructuralFramingTypes("W12X26")  # graph input
# note: Selecionar um tipo de família das colunas criadas
tipos_de_colunas_estruturais = StructuralColumnTypes(index=0)  # graph input

# group: Preparar geometria
# Preparar uma expressão sólida limpa da geometria do elemento selecionado
# note: Obter a geometria do elemento do Revit
getGeometry = Element.GetGeometry(element=selecionar_piso_de_origem)
# note: Como uma forma rápida de descartar as aberturas do elemento, obtenha sua caixa delimitadora – um cuboide virtual contendo o elemento
byMinimumVolume = BoundingBox.ByMinimumVolume(geom=getGeometry)
# note: Mais ações estão disponíveis para sólidos do que caixas de delimitação. Para permitir transformações adicionais, primeiro converta a caixa delimitadora em um cuboide (que é o tipo de sólido)
toCuboid = BoundingBox.ToCuboid(boundingBox=byMinimumVolume)
# note: Converter o sólido cuboide por uma altura (zTranslation) definida pelo controle deslizante numérico na seção Entradas do gráfico
translate = Geometry.Translate(geometry=toCuboid, zTranslation=altura)

# group: Obter a superfície superior dos sólidos
# Avaliar todas as superfícies do sólido pela elevação em seu centro e obter a superior
# note: Explodir o sólido em superfícies
explode = Geometry.Explode(geometry=translate)
code_block = CodeBlock { 0.5; }
# note: Localizar um ponto no centro da superfície
pointAtParameter = Surface.PointAtParameter(surface=explode, u=code_block, v=code_block)
# note: Obter um valor numérico para a elevação de cada ponto de centro
Z = Point.Z(point=pointAtParameter)
# note: Classificar uma lista por outra: usar os valores de elevação para classificar as superfícies
sortByKey = List.SortByKey(list=explode, keys=Z)
# note: A última superfície na lista é a superfície superior
lastItem = List.LastItem(list=sortByKey.sortedList)

# group: Deslocar série de pontos na superfície
# note: Usar uma fórmula simples para criar uma sequência de valores de mín. (0,1) a máx. (0,9) com um número 'n' de passos
sequência_de_valores_u = CodeBlock(n=número_de_vigas) { 0.1..0.9..#n; }
deslocamentos_das_arestas = CodeBlock { [0.1,0.9]; }
# note: Posicione uma matriz de pontos na superfície usando os parâmetros U e V. Use a Treliça do produto cartesiano (clique com o botão direito do mouse no nó e escolha Treliça) para gerar uma matriz.
pointAtParameter_2 = Surface.PointAtParameter(surface=lastItem, u=sequência_de_valores_u, v=deslocamentos_das_arestas, lacing=CrossProduct)

# group: Criar linhas para vigas internas
# Conectar pontos e criar linhas
índices = CodeBlock { 0; 1; }
# note: Clique no símbolo > ao lado da entrada 'list' para Usar níveis. Isso significa que o resultado será o item com o índice 0 em cada lista aninhada mais baixa (@L2)
getItemAtIndex = List.GetItemAtIndex(list=pointAtParameter_2@L2, index=índices.out0)
getItemAtIndex_2 = List.GetItemAtIndex(list=pointAtParameter_2@L2, index=índices.out1)
byStartPointEndPoint = Line.ByStartPointEndPoint(startPoint=getItemAtIndex, endPoint=getItemAtIndex_2)

# group: Curvas para vigas de perímetro
# Descrição <Clique duas vezes aqui para editar a descrição do grupo>
firstItem = List.FirstItem(list=pointAtParameter_2)
lastItem_2 = List.LastItem(list=pointAtParameter_2)
byStartPointEndPoint_2 = Line.ByStartPointEndPoint(startPoint=firstItem, endPoint=lastItem_2)

# group: Curvas para colunas
# Obtenha cada segunda linha de pontos para criar linhas para o posicionamento das colunas
code_block_2 = CodeBlock { 2; }
# note: Cortar a lista em listas de 2
chop = List.Chop(list=pointAtParameter_2, lengths=code_block_2)
# note: Usar lógica de níveis de listas e somente usar a primeira lista em @L3
firstItem_2 = List.FirstItem(list=chop@L3)
altura_reversa = CodeBlock(H=altura) { -H; }
# note: Converter os pontos de volta para baixo
translate_2 = Geometry.Translate(geometry=firstItem_2, zTranslation=altura_reversa)
# note: Conectar os pontos para criar linhas
byStartPointEndPoint_3 = Line.ByStartPointEndPoint(startPoint=translate_2, endPoint=firstItem_2)

# group: Para o Revit: Colocar vigas por curva
# note: Colocar vigas internas
beamByCurve = StructuralFraming.BeamByCurve(curve=byStartPointEndPoint, level=nível_de_estrutura, structuralFramingType=structural_framing_types)
# note: Colocar as vigas de perímetro
beamByCurve_2 = StructuralFraming.BeamByCurve(curve=byStartPointEndPoint_2, level=nível_de_estrutura, structuralFramingType=structural_framing_types)
# note: Colocar os pilares estruturais
columnByCurve = StructuralFraming.ColumnByCurve(curve=byStartPointEndPoint_3, level=nível_de_estrutura, structuralColumnType=tipos_de_colunas_estruturais)
