# Dynamo graph Revit Adaptive Component Placement.dyn "Размещение адаптивных компонентов Revit" (Dynamo 4.0.0.3076)
# author: Dynamo Team
# Этот график размещает адаптивные компоненты в модели по точкам.

# group: Сведения
# note: Линии схемы разрезки витража были предварительно выбраны в Revit, идентификаторы элементов были сохранены в файле Dynamo
# note: Запустите этот график из файла Snowdon Towers Sample Architectural.rvt, который находится в папке Samples, расположенной в папке установки Revit:
# C:\Program Files\Autodesk\Revit 2026\Samples
# Запустите этот график после загрузки адаптивного семейства AdaptivePanel.rfa из папки, где находятся наборы данных Dynamo.
# note: Размещение адаптивных компонентов относительно некоторых элементов, выбранных в файле Revit.
# Для адаптивных компонентов требуется набор точек, равный количеству точек размещения размещаемого семейства

# group: Входные данные
# note: Выбор линий схемы разрезки витража
select_edges = SelectEdges()  # 7 picked in the model; graph input
# note: Задание минимального и максимального смещений для средней точки пластины
min_displacement = DoubleSlider(1.4, range=0.2..3 step 0.1)
max_displacement = DoubleSlider(4.3, range=3..8 step 0.1)
# note: Выбор семейства адаптивных компонентов
family_types = FamilyTypes("AdaptivePanel:AdaptivePanel")  # graph input

# note: Создание списка положений точек вдоль кривой, где 0 — начало, 0,5 — середина, а 1 — конец
list_of_parameters = CodeBlock { [0,0.5,1]; }
# note: Поиск начальной, средней и конечной точек на каждой кривой
pointAtParameter = Curve.PointAtParameter(curve=select_edges, param=list_of_parameters, lacing=CrossProduct)

# group: Захват начальной и конечной точек каждой кривой
start_and_end_points_indices = CodeBlock { 0; 2; }
getItemAtIndex = List.GetItemAtIndex(list=pointAtParameter@L2, index=start_and_end_points_indices.out0)
# note: Аналогично выбору средней точки используйте уровни для выбора начальной и конечной точек на каждой кривой
getItemAtIndex_2 = List.GetItemAtIndex(list=pointAtParameter@L2, index=start_and_end_points_indices.out1)

# group: Захват средней точки каждой кривой
mid_point_index = CodeBlock { 1; }
# note: Используйте уровни списка порта ввода list. По умолчанию результатом узла будет список с индексом 1 (вторая кривая). Щелкните правой кнопкой мыши порт ввода list и выберите «Использовать уровни» с @L2. В этом случае из каждого вложенного списка будет выбран элемент с индексом 1 (средние точки каждой кривой)
getItemAtIndex_3 = List.GetItemAtIndex(list=pointAtParameter@L2, index=mid_point_index)

# group: Создание синусоиды
# note: Подсчет количества выбранных исходных кривых
count = List.Count(list=select_edges)
# note: Создание последовательности значений N от 0 до 1
sequence = CodeBlock(steps=count) { 0..1..#steps; }
# note: Создание синусоиды
sin = Math.Sin(angle=sequence)
# note: Повторное сопоставление значений синусоиды с новыми максимальным и минимальным значениями
remapRange = Math.RemapRange(numbers=sin, newMin=min_displacement, newMax=max_displacement)

# group: Перемещение средних точек
# note: При смещении по оси Y измените значение на отрицательное для смещения по направлению к наружной стороне витража
negate_value = CodeBlock(y=remapRange) { -y; }
# note: Перемещение средних точек пластины
translate = Geometry.Translate(geometry=getItemAtIndex_3, yTranslation=negate_value, zTranslation=remapRange)

# note: При смещении по оси Y измените значение на отрицательное для смещения по направлению к наружной стороне витража
negate_value_2 = CodeBlock(y=remapRange) { y; }
# note: Перемещение средних точек пластины
translate_2 = Geometry.Translate(geometry=getItemAtIndex_3, yTranslation=negate_value_2, zTranslation=remapRange)

# group: Повторное соединение точек в списках
list_create = List.Create(item0=getItemAtIndex, item1=translate, item2=getItemAtIndex_2, item3=translate_2)
# note: Разворот матрицы и упорядочивание списков в наборы по три элемента
transpose = List.Transpose(lists=list_create)

# group: В Revit: размещение компонентов
# note: Адаптивные компоненты можно разместить с помощью наборов точек, равных количеству точек размещения семейства.
byPoints = AdaptiveComponent.ByPoints(points=transpose, familyType=family_types)
