# Dynamo graph Revit Color.dyn "Цвет Revit" (Dynamo 4.0.0.3076)
# author: Dynamo Team
# Этот график оценивает площадь поверхности выбранных элементов и применяет переопределения графики для окрашивания элементов на основе этого значения.

# group: Сведения
# note: Запустите этот график из файла Snowdon Towers Sample Architectural.rvt, который находится в папке Samples, расположенной в папке установки Revit
# C:\Program Files\Autodesk\Revit 2027\Samples
# note: Этот график окрашивает элементы Revit на основе измеряемых критериев (площадь поверхности).
# Элементы окрашиваются с помощью метода «Переопределить графику на виде» > «По элементу».

# group: Выбор элементов модели
# Выбор фасадных стен
# note: Нажмите «Изменить», чтобы выбрать элементы из модели Revit
select_model_elements = DSModelElementsSelection()  # 33 picked in the model; graph input

# group: Оценка площади поверхности элемента
# note: Получение геометрии элемента
getGeometry = Element.GetGeometry(element=select_model_elements)
flatten = List.Flatten(list=getGeometry)
# note: Извлечение площади поверхности геометрии
area = Solid.Area(solid=flatten)
# note: Получение наибольшего значения
maximumItem = List.MaximumItem(list=area)
# note: Нормализация по наибольшему значению
div = area / maximumItem  # graph output

# group: Создание цветов
# Подготовка цветовой схемы для присвоения цветовых кодов элементам
number = DoubleInput(0)
number_2 = DoubleInput(255)
# note: окрашивание в зеленый
byARGB = Color.ByARGB(alpha=number, red=number, green=number_2, blue=number, lacing=Longest)
number_3 = DoubleInput(0)
number_4 = DoubleInput(255)
# note: окрашивание в красный
byARGB_2 = Color.ByARGB(alpha=number_3, red=number_4, green=number_3, blue=number_3, lacing=Longest)
create = List.Create(item0=byARGB, item1=byARGB_2)
code_block = CodeBlock { [0,1]; }
# note: задать диапазон цветов
color_range = ColorRange(colors=create, indices=code_block, value=div)

# group: В Revit: переопределение цвета элемента в виде
# note: Переопределение цвета элемента на активном виде
overrideColorInView = Element.OverrideColorInView(element=select_model_elements, color=color_range, lacing=Longest)

# group: Порог
number_5 = DoubleInput(100)

# group: Альтернатива: выполнить оценку, если критерии соответствуют заданному порогу
# note: Сравнение с пороговым значением
gt = area > number_5
# note: Цифры будут указывать положение в цветовом спектре: от 0 до 1
number_6 = DoubleInput(1)
number_7 = DoubleInput(0)
# note: выявить области в пределах допуска
if_ = RefactoredIf(test=gt, true=number_6, false=number_7)
# note: этот результат может использоваться как порт ввода indices узла Color Range
watch = Watch(if_)
