# Dynamo graph Revit Floors and Framing.dyn "Перекрытия и каркасы Revit" (Dynamo 4.0.0.3076)
# author: Dynamo Team
# Этот график создает архитектурный «каприз», используя набор линий и их смещение для размещения элементов несущего каркаса и перекрытия в Revit.
# packages: Компонент PythonNet3 1.4.5

# group: Сведения
# note: Запустите этот график из файла Snowdon Towers Sample Architectural.rvt, который находится в папке Samples, расположенной в папке установки Revit
# C:\Program Files\Autodesk\Revit 2027\Samples
# note: Этот график создает архитектурный «каприз», используя набор линий для регулировки размещения несущего каркаса и перекрытий.

# group: Положение центра «каприза»
x_position = DoubleSlider(30, range=25..40 step 1)  # graph input
y_position = DoubleSlider(30, range=25..40 step 1)  # graph input
z_position = DoubleSlider(62, range=60..80 step 1)  # graph input

# group: Конфигурация «каприза»
# Описание <Дважды нажмите здесь, чтобы изменить описание группы>
lower_floor_radius = DoubleSlider(10, range=8..20 step 1)  # graph input
nr_floors = DoubleSlider(7, range=3..10 step 1)  # graph input
radius_decrease = DoubleSlider(-1.25, range=-2..-0.5 step 0.25)  # graph input
number_of_polygon_sides = IntegerSlider(5, range=3..10 step 1)  # graph input
top_floor_height = DoubleSlider(38.4, range=15..50 step 0.1)  # graph input
maximum_rotation_degrees = DoubleSlider(130, range=10..180 step 5)  # graph input

# group: Построение многоугольников
# Создание набора многоугольников с уменьшающимся радиусом, смещением по вертикали и последовательным поворотом
# note: Центр «каприза»
byCoordinates = Point.ByCoordinates(x=x_position, y=y_position, z=z_position)
# note: Последовательность радиусов окружностей
sequence = Sequence(start=lower_floor_radius, amount=nr_floors, step=radius_decrease, lacing=Longest)
# note: Создание набора окружностей
byCenterPointRadius = Circle.ByCenterPointRadius(centerPoint=byCoordinates, radius=sequence)
# note: Создание серии многоугольников
regularPolygon = Polygon.RegularPolygon(circle=byCenterPointRadius, numberSides=number_of_polygon_sides)
# note: Последовательность отметок перекрытий
floor_heigts_sequence = CodeBlock(top_floor=top_floor_height, count=nr_floors) { 0..top_floor..#count; }
byCoordinates_2 = Vector.ByCoordinates(z=floor_heigts_sequence)
# note: Перемещение многоугольников вверх на заданную высоту
translate = Geometry.Translate(geometry=regularPolygon, direction=byCoordinates_2)
ZAxis = Vector.ZAxis()
# note: Последовательность поворотов для каждого перекрытия
rotation_angles_sequence = CodeBlock(max_degrees=maximum_rotation_degrees, count=nr_floors) { 0..max_degrees..#count; }
# note: Поворот многоугольников на основе набора углов
rotate = Geometry.Rotate(geometry=translate, origin=byCoordinates, axis=ZAxis, degrees=rotation_angles_sequence)
# note: Извлечение отдельных кривых из полигонов
curves = PolyCurve.Curves(polyCurve=rotate)

# group: Тип и уровень перекрытия
# note: Выбор типа перекрытия для созданных перекрытий из типов, существующих в проекте, с помощью раскрывающегося списка
floor_types = FloorTypes("Concrete Slab 6\"")  # graph input
levels = Levels("Green Roof Hardscape")  # graph input

# group: В Revit: создание перекрытий
# Использование набора замкнутых контуров кривых в качестве входных данных для создания перекрытия
# note: Передача групп кривых для создания перекрытий
byOutlineTypeAndLevel = Floor.ByOutlineTypeAndLevel(outline=curves, floorType=floor_types, level=levels)

# group: Вертикальные соединения
# Соединение углов многоугольника между уровнями «каприза»
# note: Получение конечных точек каждой кривой многоугольника
endPoint = Curve.EndPoint(curve=curves)
# note: Обращение матрицы и получение списков конечных точек с вертикальным выравниванием
transpose = List.Transpose(lists=endPoint)
# note: Соединение соответствующих углов многоугольников от нижнего до верхнего уровня «каприза» в виде сложных кривых
byPoints = PolyCurve.ByPoints(points=transpose)
# note: Разделение сложных кривых и получение списков кривых, которые будут использоваться в качестве входных данных для элементов несущего каркаса
curves_2 = PolyCurve.Curves(polyCurve=byPoints)

# group: Тип и уровень несущего каркаса
levels_2 = Levels("Green Roof Hardscape")  # graph input
# note: Выбор типа несущего каркаса из типов, загруженных в проект, с помощью раскрывающегося списка
structural_framing_types = StructuralFramingTypes("W12X26")  # graph input

# group: В Revit: создание несущего каркаса
# Использование кривых для создания элементов несущего каркаса и узла Python для отмены соединения отдельных балок
# note: Передача отдельных кривых для каждого несущего элемента
beamByCurve = StructuralFraming.BeamByCurve(curve=curves_2, level=levels_2, structuralFramingType=structural_framing_types)
# note: Подготовка списка
flatten = List.Flatten(list=beamByCurve)
# note: Это переименованный узел Python, который с помощью API Revit расширяет возможности Dynamo, доступные при использовании готовых узлов. Чтобы прочитать код Python, щелкните правой кнопкой мыши узел и выберите «Редактировать…».
disallow_joins_on_structural = Python(structuralFraming=flatten)  # "Disallow Joins on Structural Framing"; PythonNet3
# ---------- disallow_joins_on_structural.python (35 lines) ----------
# Load the Python Standard and DesignScript Libraries
import sys
import clr
clr.AddReference('ProtoGeometry')
from Autodesk.DesignScript.Geometry import *
from Autodesk.Revit.DB import *
from RevitServices.Transactions import TransactionManager
from RevitServices.Persistence import DocumentManager 

doc = DocumentManager.Instance.CurrentDBDocument

# The inputs to this node will be stored as a list in the IN variables.
dataEnteringNode = IN

# Place your code below this line
structural_framing = UnwrapElement(IN[0])

unjoined_elements = []
# start a Transaction
TransactionManager.Instance.EnsureInTransaction(doc)
# iterate through each structural framing element
for sf in structural_framing:
    # check if the element passed in of Structural Framing Category
    sf_category = sf.Category # get the element's Category
    # use the Structural Framing's Category Id to check
    if sf_category.Id.Value == -2001320:
        # disallow joins at start and end of the structural framing element
        Structure.StructuralFramingUtils.DisallowJoinAtEnd(sf, 0)
        Structure.StructuralFramingUtils.DisallowJoinAtEnd(sf, 1)
        unjoined_elements.append(sf)
TransactionManager.Instance.TransactionTaskDone()

    
# Output the list of elements with Disallowed Join
OUT = unjoined_elements
# ----------------------------------------
