# Dynamo graph Revit Geometry Creation Curves.dyn "Создание геометрии Revit: кривые" (Dynamo 4.0.0.3076)
# author: Dynamo Team
# Этот график иллюстрирует несколько способов создания кривых в Dynamo и их использование для создания элементов Revit (линий модели)

# group: Сведения
# note: В этом графике используется несколько методов создания кривых, которые будут использоваться в качестве входных данных для создания кривых модели Revit
# note: Запустите этот график из файла Snowdon Towers Sample Architectural.rvt, который находится в папке Samples, расположенной в папке установки Revit
# C:\Program Files\Autodesk\Revit 2027\Samples

# group: Четыре точки
# Описание <Дважды нажмите здесь, чтобы изменить описание группы>
number = DoubleInput(-35)
number_2 = DoubleInput(-55)
byCoordinates = Point.ByCoordinates(x=number, y=number_2)
number_3 = DoubleInput(-40)
byCoordinates_2 = Point.ByCoordinates(x=number, y=number_3)
number_4 = DoubleInput(-10)
byCoordinates_3 = Point.ByCoordinates(x=number_4, y=number_3)
number_5 = DoubleInput(-17)
number_6 = DoubleInput(-60)
byCoordinates_4 = Point.ByCoordinates(x=number_5, y=number_6)

list_create = List.Create(item0=byCoordinates, item1=byCoordinates_2, item2=byCoordinates_3, item3=byCoordinates_4)

# group: Создание кривой модели из NURBS-кривой (по точкам)
# note: Создание NURBS-кривой из списка точек
byPoints = NurbsCurve.ByPoints(points=list_create)
# note: Использование NURBS-кривой для создания линии модели Revit
byCurve = ModelCurve.ByCurve(curve=byPoints)

# group: Создание кривой модели из NURBS-кривой (по контрольным точкам)
boolean = BoolSelector(false)
# note: Создание NURBS-кривой из списка точек, используемых в качестве контрольных точек
byControlPoints = NurbsCurve.ByControlPoints(points=list_create, closeCurve=boolean)
# note: Использование NURBS-кривой для создания линии модели Revit
byCurve_2 = ModelCurve.ByCurve(curve=byControlPoints)

# group: Создание кривой модели из сложной кривой
# note: Создание сложной кривой из списка точек
byPoints_2 = PolyCurve.ByPoints(points=list_create)
curves = PolyCurve.Curves(polyCurve=byPoints_2)
# note: Использование списка кривых для создания набора линий модели Revit
byCurve_3 = ModelCurve.ByCurve(curve=curves)

# group: Создание кривой модели из линии
# note: Создание кривой по двум точкам
byStartPointEndPoint = Line.ByStartPointEndPoint(startPoint=byCoordinates, endPoint=byCoordinates_2)
# note: Использование линии (кривой) для создания кривой модели Revit
byCurve_4 = ModelCurve.ByCurve(curve=byStartPointEndPoint)
