# Dynamo graph Revit Geometry Creation Points.dyn "Создание геометрии Revit: точки" (Dynamo 4.0.0.3076)
# author: Dynamo Team
# Этот график создает линию модели и опорную точку во время работы в среде семейств формообразующих элементов.

# group: Сведения
# note: Можно переключаться между навигацией по виду фонового просмотра в 3D и по виду графика с помощью кнопок в верхнем правом углу экрана (CTRL + B). Фоновый просмотр также можно включать и отключать в меню «Вид» для Dynamo и Revit.
# note: Запустите этот график в среде семейств концептуальных форм или общих адаптивных моделей.
# Чтобы создать семейство, щелкните «Файл» > «Новое семейство» и выберите шаблон в папке:
# C:\ProgramData\Autodesk\RVT 2027\Family Templates\English-Imperial\Generic Model Adaptive.rft
# note: Этот график создает линию модели и опорную точку в среде семейств

# group: Координаты точки
point_x_value = DoubleSlider(50, range=5..50 step 5)  # graph input
point_y_value = DoubleSlider(25, range=5..50 step 5)  # graph input
point_z_value = DoubleSlider(25, range=5..50 step 5)  # graph input

# note: Изменение положения точки в среде Dynamo: выберите узел Point.ByCoordinates и перейдите к фоновому просмотру, чтобы перетащить точку вдоль трех ее осей.
byCoordinates = Point.ByCoordinates(x=point_x_value, y=point_y_value, z=point_z_value)
# note: Геометрические данные можно просматривать в виде текстовой информации или в 3D-пространстве
watch = Watch(byCoordinates)
byCoordinates_2 = Point.ByCoordinates()
byStartPointEndPoint = Line.ByStartPointEndPoint(startPoint=byCoordinates_2, endPoint=byCoordinates)
# note: Предварительный просмотр геометрии
watch_3d = Watch3D(byStartPointEndPoint)
# note: Создание кривой модели путем соединения двух точек
byCurve = ModelCurve.ByCurve(curve=byStartPointEndPoint)
# note: Dynamo может создавать и изменять только элементы, соответствующие файлу, с которым связана программа Dynamo. Например, опорные точки можно создавать только в определенных средах семейств (таких как общая адаптивная модель), а линии модели можно создавать практически в любом месте.
byPoint = ReferencePoint.ByPoint(pt=byCoordinates)
