# Dynamo graph Revit Geometry Creation Solids.dyn "Создание геометрии Revit: тела" (Dynamo 4.0.0.3076)
# author: Dynamo Team
# В этом графике представлено несколько способов создания твердотельной геометрии в Dynamo и ее интеграции в Revit: одни способы можно использовать в среде проекта, другие — только в средах некоторых семейств (например, концептуальных форм).

# group: Сведения
# note: Для большинства тел существует несколько методов создания. В этих примерах показаны замкнутые профили в качестве основы, но сложные поверхности можно сшить, а также доступно множество примитивов (поверхности, кубоиды, конусы и т. д.).
# Для интеграции геометрии в среду Revit сначала необходимо преобразовать ее в элемент Revit.
# Тела могут быть преобразованы в импортированный экземпляр, который будет видим как в среде проекта, так и в среде семейства модели.
# Твердотельную геометрию также можно преобразовать в элемент формы, доступный только в средах семейств концептуальных форм и адаптивных компонентов.
# note: В этом графике используется несколько методов создания твердотельной геометрии в Revit: одни из них можно использовать в среде проекта, другие — только в средах некоторых семейств.
# Для просмотра всех методов используйте шаблон семейства формообразующих элементов.
# Чтобы открыть семейство формообразующих элементов, щелкните «Файл» > «Создать» > «Семейство» и выберите шаблон Mass.rft в папке Conceptual Mass

# group: Подготовка точек
# Создание набора точек для построения геометрии
byCoordinates = Point.ByCoordinates()
number = DoubleInput(10)
byCoordinates_2 = Point.ByCoordinates(x=number)
number_2 = DoubleInput(5)
byCoordinates_3 = Point.ByCoordinates(z=number_2)
number_3 = DoubleInput(10)
byCoordinates_4 = Point.ByCoordinates(y=number_3)
number_4 = DoubleInput(15)
byCoordinates_5 = Point.ByCoordinates(x=number_4, y=number_4)
number_5 = DoubleInput(5)
number_6 = DoubleInput(10)
byCoordinates_6 = Point.ByCoordinates(x=number_5, y=number_6, z=number_6)
number_7 = DoubleInput(-2)
number_8 = DoubleInput(5)
byCoordinates_7 = Point.ByCoordinates(x=number_7, y=number_8)

# group: Первый профиль
# Создание первого профиля в виде замкнутой кривой из дуги и отрезка
byStartPointEndPoint = Line.ByStartPointEndPoint(startPoint=byCoordinates, endPoint=byCoordinates_2)
byThreePoints = Arc.ByThreePoints(firstPoint=byCoordinates, secondPoint=byCoordinates_3, thirdPoint=byCoordinates_2)
create = List.Create(item0=byStartPointEndPoint, item1=byThreePoints)
# note: Первый профиль для лофта
byJoinedCurves = PolyCurve.ByJoinedCurves(curves=create)

# group: Второй профиль
# Создание второго профиля в виде замкнутой кривой из дуги и отрезка
byStartPointEndPoint_2 = Line.ByStartPointEndPoint(startPoint=byCoordinates_4, endPoint=byCoordinates_5)
byThreePoints_2 = Arc.ByThreePoints(firstPoint=byCoordinates_4, secondPoint=byCoordinates_6, thirdPoint=byCoordinates_5)
create_2 = List.Create(item0=byStartPointEndPoint_2, item1=byThreePoints_2)
# note: Второй профиль для лофта
byJoinedCurves_2 = PolyCurve.ByJoinedCurves(curves=create_2)

# note: Объединение двух профилей в списке
create_3 = List.Create(item0=byJoinedCurves, item1=byJoinedCurves_2)

# group: Лофт-тело по поперечным сечениям
# Описание <Дважды нажмите здесь, чтобы изменить описание группы>
byLoft = Solid.ByLoft(crossSections=create_3)

# note: Оценка объема тела
volume = Solid.Volume(solid=byLoft)

# group: Создание оболочки
code_block = CodeBlock { 0; }
# note: Совет: снимите флажок «Просмотр» в контекстном меню узла, чтобы исключить элементы из режима отображения
thinShell = Solid.ThinShell(solid=byLoft, internalFaceThickness=code_block)

# group: Преобразование геометрии
code_block_2 = CodeBlock { Vector.ByCoordinates(20,0,0); }
# note: Переместите геометрию в сторону для предварительного просмотра исходного объекта и конечного результата
translate = Geometry.Translate(geometry=thinShell, direction=code_block_2)

# group: Обрезка тела
# Используйте операцию обрезки для обрезки тела оболочки плоскостью.
code_block_3 = CodeBlock { Point.ByCoordinates(0,0,5); }
ZAxis = Vector.ZAxis()
byOriginNormal = Plane.ByOriginNormal(origin=code_block_3, normal=ZAxis)
number_9 = DoubleInput(10)
# note: Выбор сохраняемой стороны при обрезке (ближайшая к точке сторона будет удалена).
byCoordinates_8 = Point.ByCoordinates(x=number_9, y=number_9, z=number_9)
# note: Геометрические логические операции («Пересечение», «Разница», «Соединение» и т. д.) доступны в категории «Геометрия».
trim = Geometry.Trim(geometry=translate, other=byOriginNormal, pick=byCoordinates_8)

# group: Направляющая кривая
# Создание NURBS-кривой, которая будет использоваться в качестве направляющей для формы лофт-тела
create_4 = List.Create(item0=byCoordinates, item1=byCoordinates_7, item2=byCoordinates_4)
# note: Направляющая кривая, построенная как NURBS-кривая
byPoints = NurbsCurve.ByPoints(points=create_4)

# group: Лофт-тело по поперечным сечениям и направляющим кривым
# note: Совет: снимите флажок «Просмотр» в контекстном меню узла, чтобы исключить элементы из режима отображения
byLoft_2 = Solid.ByLoft(crossSections=create_3, guideCurves=byPoints)

# group: Создание импортированного экземпляра
code_block_4 = CodeBlock { Vector.ByCoordinates(-20,0,0); }
translate_2 = Geometry.Translate(geometry=byLoft_2, direction=code_block_4)
# note: Геометрия отличается от имеющейся в элементе Revit.
# Используйте элемент ImportInstance, чтобы создать элементы импорта Revit из поверхностей и тел в любой среде Revit. Используйте точки и кривые для размещения экземпляров семейств или создайте семейства форм формообразующих элементов и типовых моделей по точкам (адаптивный компонент).
byGeometries = ImportInstance.ByGeometries(geometries=translate_2)
byCoordinates_9 = Vector.ByCoordinates()

# group: Создание формы
# Создание элемента формы с помощью двух контуров кривых профиля (в среде семейств формообразующих элементов)
curves = PolyCurve.Curves(polyCurve=create_3)
# note: Создание кривых модели из кривых
referenceCurveByCurve = ModelCurve.ReferenceCurveByCurve(curve=curves)
# note: Формы можно создавать только в пределах семейства формообразующих элементов
byLoftCrossSections = Form.ByLoftCrossSections(curves=referenceCurveByCurve)
