# Dynamo graph Revit Geometry Creation Surfaces.dyn "Создание геометрии Revit: поверхности" (Dynamo 4.0.0.3076)
# author: Dynamo Team
# В этом графике представлено несколько способов создания поверхностей в Dynamo и два способа преобразования геометрии в геометрию Revit.

# group: Сведения
# note: В этом графике используется несколько методов создания геометрии поверхности в Revit: одни из них можно использовать в среде проекта, другие — только в средах некоторых семейств.
# Для просмотра всех методов используйте шаблон семейства формообразующих элементов.
# Чтобы создать семейство формообразующих элементов, щелкните «Файл» > «Создать» > «Семейство» и выберите шаблон Mass.rft в папке Conceptual Mass.
# note: Для большинства поверхностей существует несколько методов создания. Поверхности, сложные поверхности (коллекции поверхностей) и NURBS-поверхности могут создаваться с помощью точек, кривых и заимствоваться из других поверхностей и тел с помощью различных операций.
# note: Для интеграции геометрии в среду Revit сначала необходимо преобразовать ее в элемент Revit.
# Поверхности и тела можно преобразовать в импортированный экземпляр, который будет видим как в среде проекта, так и в среде семейства моделей.
# Геометрия поверхности также может быть преобразована в элемент формы, доступный только в средах семейств концептуальных форм и семейств адаптивных компонентов.

# group: Подготовка точек
# Создание набора точек для построения геометрии
number = DoubleInput(10)
byCoordinates = Point.ByCoordinates(y=number)
number_2 = DoubleInput(5)
number_3 = DoubleInput(10)
byCoordinates_2 = Point.ByCoordinates(x=number_2, y=number_3, z=number_3)
number_4 = DoubleInput(15)
byCoordinates_3 = Point.ByCoordinates(x=number_4, y=number_4)
byCoordinates_4 = Point.ByCoordinates()
number_5 = DoubleInput(5)
byCoordinates_5 = Point.ByCoordinates(z=number_5)
byCoordinates_6 = Point.ByCoordinates(x=number)
number_6 = DoubleInput(-5)
number_7 = DoubleInput(5)
byCoordinates_7 = Point.ByCoordinates(x=number_6, y=number_7)
number_8 = DoubleInput(10)
number_9 = DoubleInput(-10)
byCoordinates_8 = Point.ByCoordinates(x=number_8, y=number_9)
byCoordinates_9 = Point.ByCoordinates(y=number_9)

# group: Создание профилей
byThreePoints = Arc.ByThreePoints(firstPoint=byCoordinates, secondPoint=byCoordinates_2, thirdPoint=byCoordinates_3)
byThreePoints_2 = Arc.ByThreePoints(firstPoint=byCoordinates_4, secondPoint=byCoordinates_5, thirdPoint=byCoordinates_6)
byThreePoints_3 = Arc.ByThreePoints(firstPoint=byCoordinates_4, secondPoint=byCoordinates_7, thirdPoint=byCoordinates)
byStartPointEndPoint = Line.ByStartPointEndPoint(startPoint=byCoordinates_8, endPoint=byCoordinates_9)

# group: Поверхность по сдвигу
# Использование профиля, криволинейной траектории и направляющей для создания поверхности сдвига
bySweep2Rails = Surface.BySweep2Rails(path=byThreePoints, guideRail=byThreePoints_2, profile=byThreePoints_3)

# group: Создание импорта
# note: Используйте импортированный экземпляр для создания импорта Revit на основе поверхностей и тел. Эти объекты будут видимы в любой среде Revit.
byGeometries = ImportInstance.ByGeometries(geometries=bySweep2Rails)

create = List.Create(item0=byStartPointEndPoint, item1=byThreePoints_2)

# group: Создание поверхности по лофту
# Объединение поперечных сечений для создания лофт-поверхности
byLoft = Surface.ByLoft(crossSections=create)

# group: Оценка площади поверхности
area = Surface.Area(surface=byLoft)
watch = Watch(area)
create_2 = List.Create(item0=byLoft, item1=bySweep2Rails)
# note: Поверхности соединены в форме сложных поверхностей и могут оцениваться как единое целое
byJoinedSurfaces = PolySurface.ByJoinedSurfaces(surfaces=create_2)
area_2 = Surface.Area(surface=byJoinedSurfaces)
watch_2 = Watch(area_2)
area_3 = Surface.Area(surface=bySweep2Rails)
watch_3 = Watch(area_3)

# group: NURBS-поверхность по управляющим точкам
# Преобразование сдвига в NURBS-поверхность по управляющим точкам
code_block = CodeBlock { 0..1..0.1; }
# note: Ребра, точки и другие элементы можно получить из поверхностей с помощью операций, соответствующих этим геометрическим объектам.
pointAtParameter = Surface.PointAtParameter(surface=bySweep2Rails, u=code_block, v=code_block, lacing=CrossProduct)
# note: Реконструкция поверхности в виде NURBS-поверхности по управляющим точкам
byControlPoints = NurbsSurface.ByControlPoints(controlVertices=pointAtParameter)
# note: Используйте узел Watch 3D для просмотра геометрии изолированно
watch_3d = Watch3D(byControlPoints)

# group: Создание поверхности путем выдавливания кривой
# Использование кривой для выдавливания на заданное расстояние
code_block_2 = CodeBlock { 10; }
extrude = Curve.Extrude(curve=byThreePoints, distance=code_block_2)

# group: Создание формы
# Создание лофт-формы из двух кривых
referenceCurveByCurve = ModelCurve.ReferenceCurveByCurve(curve=create)
byLoftCrossSections = Form.ByLoftCrossSections(curves=referenceCurveByCurve)
