# Dynamo graph Revit Import Solid.dyn "Импорт тела из Revit" (Dynamo 4.0.0.3076)
# author: Dynamo Team
# Этот график демонстрирует метод создания твердотельной геометрии Dynamo и ее использование для создания элемента импортированного экземпляра Revit. Сконструируйте новую форму крыши, создав набор дуговых профилей и используя их для создания лофт-поверхности.

# group: Сведения
# note: Исходный элемент (крыша) был предварительно выбран в Revit, а идентификаторы элементов были сохранены в файле Dynamo
# note: Запустите этот график из файла Snowdon Towers Sample Architectural.rvt, который находится в папке Samples, расположенной в папке установки Revit
# C:\Program Files\Autodesk\Revit 2027\Samples
# note: Конструирование новой формы крыши на основе выбранного элемента крыши путем создания набора дуговых профилей и их использования для создания лофт-поверхности. Геометрия преобразуется в экземпляр импорта для интеграции в среду Revit

# group: Новая конфигурация крыши
# note: Количество профилей, на основе которых будет создана лофт-поверхность
number_of_profiles = IntegerSlider(6, range=3..10 step 1)
# note: Высота на коротких концах новой крыши
roof_section_min = DoubleSlider(2.1, range=1..5 step 0.1)
# note: Высота в центре крыши
roof_section_max = DoubleSlider(7, range=5..10 step 0.1)
# note: Удлинение дуговых профилей в сторону на это значение
roof_sides_extension = DoubleSlider(0.5, range=0.1..3 step 0.1)
# note: Толщина новой формы крыши
roof_thickness = DoubleSlider(0.5, range=0.1..2 step 0.1)

nr_of_profiles = CodeBlock(steps=number_of_profiles) { steps; }

# group: Выбор крыши
# Выбор исходного элемента крыши
# note: Все входные данные, помеченные как IsInput, можно задать в Проигрывателе Dynamo
select_flat_roof = DSModelElementSelection()  # 1 picked in the model

# group: Получение грани крыши
# Расчленение геометрии исходного элемента и выбор одной грани с наибольшей площадью
# note: Для получения грани выбранного элемента сначала необходимо получить его геометрию
# note: Для более четкого отображения конечного результата щелкните правой кнопкой мыши и снимите флажок «Предварительный просмотр геометрии»
getGeometry = Element.GetGeometry(element=select_flat_roof)
# note: Расчленение геометрии для получения отдельных граней
explode = Geometry.Explode(geometry=getGeometry)
# note: Удаление структуры списка. Этот шаг не требуется, если используется несколько исходных объектов
flatten = List.Flatten(list=explode)
area = Surface.Area(surface=flatten)
# note: Сортировка списка поверхностей по площади. Поверхность с наибольшей площадью будет последним элементом в выходном списке sortedList
sortByKey = List.SortByKey(list=flatten, keys=area)
lastItem = List.LastItem(list=sortByKey.sortedList)
number = DoubleInput(1.5)
# note: Перемещение поверхности вверх
translate = Geometry.Translate(geometry=lastItem, zTranslation=number)

# group: Смещение наружу (масштаб)
# Масштабирование поверхности для удлинения ребер наружу
uv_position = CodeBlock { 0.5; }
pointAtParameter = Surface.PointAtParameter(surface=translate, u=uv_position, v=uv_position)
scale_from_point_to_point = CodeBlock { point1 = Point.ByCoordinates(1, 1); point2 = Point.ByCoordinates(-40, -40); }
scale = Geometry.Scale(geometry=translate, basePoint=pointAtParameter, from=scale_from_point_to_point.point1, to=scale_from_point_to_point.point2)

# group: Точки на поверхности
# Создание трех списков точек с равным интервалом —- два ряда вдоль длинных ребер и один ряд посередине
# note: 0 и 1 — это положения вдоль длинных ребер поверхности
u_positions_for_edge_rows = CodeBlock { [0,1]; }
# note: V — это положения вдоль длинных ребер, в последовательности от 0 до 1 и с количеством шагов N
v_positions_for_edge_rows = CodeBlock(steps=nr_of_profiles) { [0..1..#steps]; }
# note: Используйте параметр «Переплетение самого длинного списка», щелкнув правой кнопкой мыши узел и выбрав «Переплетение».
# Переплетение самого длинного списка будет соответствовать входным данным с различными структурами списка. В этом случае результатом будут два списка точек, количество которых в каждом списке соответствует самому длинному списку входных данных.
pointAtParameter_2 = Surface.PointAtParameter(surface=scale, u=u_positions_for_edge_rows, v=v_positions_for_edge_rows, lacing=Longest)
# note: Значение U, равное 0,5, размещает точки вдоль середины поверхности
u_position_for_middle_row = CodeBlock { [0.5]; }
# note: V — это положения вдоль среднего ряда точек, в последовательности от 0 до 1 и с количеством шагов N
v_positions_for_middle_row = CodeBlock(steps=nr_of_profiles) { [0..1..#steps]; }
# note: Для этого узла используется переплетение самого длинного списка. Результатом является список точек, в котором количество точек соответствует самому длинному списку входных данных.
pointAtParameter_3 = Surface.PointAtParameter(surface=scale, u=u_position_for_middle_row, v=v_positions_for_middle_row, lacing=Longest)

# group: Смещение точек вверх
# Смещение точек среднего ряда в форме косинусоиды
# note: последовательность значений для создания набора смещений
sequence_of_angles = CodeBlock(steps=nr_of_profiles) { -1..1..#steps; }
# note: Альтернатива: использование синуса для крыши другой формы
sin = Math.Sin(angle=sequence_of_angles)
# note: значения в косинусоиде
cos = Math.Cos(angle=sequence_of_angles)
# note: повторное сопоставление значений с новой областью
remapRange = Math.RemapRange(numbers=cos, newMin=roof_section_min, newMax=roof_section_max)
# note: перемещение точек среднего ряда
translate_2 = Geometry.Translate(geometry=pointAtParameter_3@L2, zTranslation=remapRange)

# group: Создание профилей из дуг
# Использование точек для создания дуг
# note: Объединение ребра и средних рядов в один список
join = List.Join(list0=pointAtParameter_2, list1=translate_2)
item_index = CodeBlock { 0; 1; 2; }
getItemAtIndex = List.GetItemAtIndex(list=join, index=item_index.out0)
getItemAtIndex_2 = List.GetItemAtIndex(list=join, index=item_index.out2)
getItemAtIndex_3 = List.GetItemAtIndex(list=join, index=item_index.out1)
byThreePoints = Arc.ByThreePoints(firstPoint=getItemAtIndex, secondPoint=getItemAtIndex_2, thirdPoint=getItemAtIndex_3)

# group: Удлинение профилей
# Удлинение кривых каждого профиля на заданное расстояние
# note: Значение удлинения задается как входное значение в левой части графика.
extend_edges = CodeBlock(roof_extension=roof_sides_extension) { roof_extension; }
extendStart = Curve.ExtendStart(curve=byThreePoints, distance=extend_edges)
extendEnd = Curve.ExtendEnd(curve=extendStart, distance=extend_edges)

# group: Лофт и утолщение
# Создание лофт-поверхности и задание ее толщины
byLoft = Surface.ByLoft(crossSections=extendEnd)
thicken = Surface.Thicken(surface=byLoft, thickness=roof_thickness)

# group: В Revit:
# Преобразование геометрии Dynamo в элемент Revit с помощью ImportInstance и параметра «Задать уровень»
# note: Для интеграции геометрии в среду Revit сначала необходимо преобразовать ее в элемент Revit.
# Тела можно преобразовать в импортированный экземпляр, который будет видим как в среде проекта, так и в среде семейства модели.
byGeometry = ImportInstance.ByGeometry(geometry=thicken)
code_block = CodeBlock { "Рабочая плоскость"; }
levels = Levels("L1 - Block 43")
# note: Исправление высоты размещенного импортированного экземпляра путем установки для параметра «Рабочая плоскость» значения «Уровень», отметка которого соответствует положению внутреннего начала координат.
setParameterByName = Element.SetParameterByName(element=byGeometry, parameterName=code_block, value=levels)
