# Dynamo graph Revit Place Families By Level Set Parameters.dyn "Задание параметров размещения семейств Revit по уровню" (Dynamo 4.0.0.3076)
# author: Dynamo Team
# Этот график демонстрирует размещение элементов Revit по точкам. Разместите ряды стульев в выбранном помещении и запишите уникальные номера в параметре «Марка»

# group: Сведения
# note: Запустите этот график из файла Snowdon Towers Sample Architectural.rvt, который находится в папке Samples, расположенной в папке установки Revit
# C:\Program Files\Autodesk\Revit 2027\Samples
# note: Размещение рядов стульев в выбранном помещении и запись уникальных номеров в соответствующий параметр «Марка»

# group: Выбор элементов Revit
# note: Выберите тип семейства для вставляемых экземпляров из типов семейств в проекте
family_types = FamilyTypes("Chair-Breuer:Chair-Breuer")  # graph input
# note: Выберите помещение для размещения элементов. Необходимо перейти к виду, на котором отображаются помещения (план этажа)
select_room = DSModelElementSelection()  # 1 picked in the model; graph input
circle_radius = DoubleSlider(6.4, range=5..8 step 0.1)  # graph input
# note: Выберите уровень, на котором требуется разместить элементы
levels = Levels("L3")  # graph input

# group: Задание смещений рядов
# Значения смещений рядов указывают не расстояние, а значения U и V
row_start = DoubleSlider(0.3, range=0..3 step 0.1)  # graph input
row_end = DoubleSlider(2.2, range=0..3 step 0.1)  # graph input
nr_chairs_in_a_row = IntegerSlider(8, range=2..12 step 1)  # graph input
first_row_position = DoubleSlider(0.2, range=0..3 step 0.1)  # graph input
last_row_position = DoubleSlider(1.4, range=0..3 step 0.1)  # graph input
row_spacing = DoubleSlider(0.35, range=0.15..1 step 0.05)  # graph input

# group: Создание смещений для рядов
# Набор чисел, соответствующих положениям U и V на поверхности. Значения могут превышать область от 0 до 1
# note: Альтернатива созданию последовательности путем определения начала, конца и количества шагов
последовательность_смещения = CodeBlock(start=row_start, finish=row_end, steps=nr_chairs_in_a_row) { start..finish..#steps; }  # "Последовательность смещения рядов"
# note: Создание набора чисел в диапазоне с заданным шагом
range = Range(start=first_row_position, end=last_row_position, step=row_spacing)

# group: Подготовка точек местоположения
# Описание <Дважды нажмите здесь, чтобы изменить описание группы>
# note: Точка размещения выбранного помещения
location = Room.Location(room=select_room)
# note: Окружность, определяющая исходную область размещения. Форма окружности в данном случае не имеет значения, но это самый быстрый способ определения замкнутой поверхности
byCenterPointRadius = Circle.ByCenterPointRadius(centerPoint=location, radius=circle_radius)
# note: Преобразование окружности в поверхность для позиционирования точек
patch = Curve.Patch(curve=byCenterPointRadius)
# note: Используя последовательности значений U и V, создайте матрицу точек. Задайте для переплетения узла векторное произведение, щелкнув правой кнопкой мыши и выбрав «Переплетение».
pointAtParameter = Surface.PointAtParameter(surface=patch, u=последовательность_смещения, v=range, lacing=CrossProduct)

# group: В Revit: размещение экземпляров семейства
# note: Размещение экземпляров семейств
# Большинство семейств также можно разместить по местоположению точки. Адаптивные компоненты можно разместить при помощи нескольких точек, а несущий каркас — при помощи кривых
byPointAndLevel = FamilyInstance.ByPointAndLevel(familyType=family_types, point=pointAtParameter, level=levels)

# note: Удаление структуры списка — получение одного списка, содержащего все элементы
flatten = List.Flatten(list=byPointAndLevel)

# group: Префикс марки
# Использование пользовательского префикса для номера марки размещаемых элементов
префикс_марки = StringInput("C-")  # graph input

# group: Создание номеров марок
number = DoubleInput(1)
# note: Подсчет количества элементов в списке
count = List.Count(list=flatten)
# note: Создание чисел от 1 до n
sequence = Sequence(start=number, amount=count, step=number, lacing=Longest)
# note: Для использования в строковых операциях число сначала необходимо преобразовать в строку
string_from_object = FromObject(obj=sequence)
index = CodeBlock { 0; }
# note: Вставка пользовательского префикса в номер элемента
insert = String.Insert(string=string_from_object, index=index, toInsert=префикс_марки)

# group: В Revit: задание значений параметров
string = StringInput("Марка")
# note: Укажите для параметра «Марка» список значений. Структура списка элементов и входных значений должны совпадать, или можно использовать только одно значение. Параметры также можно прочитать с помощью узла Element.GetParameterByName
setParameterByName = Element.SetParameterByName(element=flatten, parameterName=string, value=insert)

# group: Проверка результатов
# note: Узел Watch позволяет проверить, соответствуют ли результаты ожидаемым
watch = Watch(insert)  # graph output
