# Dynamo graph Revit Adaptive Component Placement.dyn (Dynamo 4.0.0.3076)
# author: Dynamo Team
# 此图形在模型中按点定位自适应构件。

# group: 信息
# note: 幕墙网格线已从 Revit 中预先选择，图元 ID 与 Dynamo 文件一起保存
# note: Run this graph the Snowdon Towers Sample Architectural.rvt file in the Samples folder located with your Revit installation:
# C:\Program Files\Autodesk\Revit 2027\Samples
# Run this graph after you load the adaptive family AdaptivePanel.rfa from the Dynamo datasets location.
# note: 相对于在 Revit 文件中选定的某些图元放置自适应构件。
# 自适应构件需要一组与要放置的族的放置点数相等的点

# group: 输入
# note: 选择幕墙网格线
选择边 = SelectEdges()  # 7 picked in the model; graph input
# note: 设置翅片中点的最小和最大位移
最小位移 = DoubleSlider(1.4, range=0.2..3 step 0.1)
最大位移 = DoubleSlider(4.3, range=3..8 step 0.1)
# note: 选择自适应构件族
family_types = FamilyTypes("AdaptivePanel:AdaptivePanel")  # graph input

# note: 创建沿曲线的点位置列表，0 为起点，0.5 为中点，1 为终点
参数列表 = CodeBlock { [0,0.5,1]; }
# note: 定位每条曲线上的起点、中点和终点
pointAtParameter = Curve.PointAtParameter(curve=选择边, param=参数列表, lacing=CrossProduct)

# group: 从每条曲线中抓取起点和终点
起点和终点索引 = CodeBlock { 0; 2; }
getItemAtIndex = List.GetItemAtIndex(list=pointAtParameter@L2, index=起点和终点索引.out0)
# note: 与选择中点类似，“级别”可用于从每条曲线中选择起点和终点
getItemAtIndex_2 = List.GetItemAtIndex(list=pointAtParameter@L2, index=起点和终点索引.out1)

# group: 从每条曲线中抓取中点
中点索引 = CodeBlock { 1; }
# note: 使用输入“列表”的列表级别。默认情况下，节点的结果将是索引为 1 的列表(第二条曲线)。在“列表”输入上单击鼠标右键，然后选择 @L2 处的“使用级别”。这将从每个嵌套列表中选择索引为 1 的项目(每条曲线的中点)
getItemAtIndex_3 = List.GetItemAtIndex(list=pointAtParameter@L2, index=中点索引)

# group: 创建正弦波
# note: 计数选定的源曲线数量
count = List.Count(list=选择边)
# note: 创建从 0 到 1 的 N 个值序列
sequence = CodeBlock(steps=count) { 0..1..#steps; }
# note: 创建正弦波
sin = Math.Sin(angle=sequence)
# note: 将正弦波的值重新映射到新的最大值和最小值
remapRange = Math.RemapRange(numbers=sin, newMin=最小位移, newMax=最大位移)

# group: 移动中点
# note: 对于 Y 位移，求反要向幕墙外部位移的值
求反值 = CodeBlock(y=remapRange) { -y; }
# note: 移动翅片的中点
translate = Geometry.Translate(geometry=getItemAtIndex_3, yTranslation=求反值, zTranslation=remapRange)

# note: 对于 Y 位移，求反要向幕墙外部位移的值
求反值_2 = CodeBlock(y=remapRange) { y; }
# note: 移动翅片的中点
translate_2 = Geometry.Translate(geometry=getItemAtIndex_3, yTranslation=求反值_2, zTranslation=remapRange)

# group: 重新连接列表中的点
list_create = List.Create(item0=getItemAtIndex, item1=translate, item2=getItemAtIndex_2, item3=translate_2)
# note: 翻转矩阵，将列表组织成 3 组
transpose = List.Transpose(lists=list_create)

# group: 到 Revit: 放置构件
# note: 可以使用与族的放置点数相等的点集来定位自适应构件。
byPoints = AdaptiveComponent.ByPoints(points=transpose, familyType=family_types)
