# Dynamo graph Revit Color.dyn (Dynamo 4.0.0.3076)
# author: Dynamo Team
# 此图形将计算选定图元的表面积，并应用“图形替换”以基于该值为图元着色。

# group: 信息
# note: Run this graph the Snowdon Towers Sample Architectural.rvt file in the Samples folder located with your Revit installation
# C:\Program Files\Autodesk\Revit 2027\Samples
# note: 此图形基于可测量标准(表面积)为 Revit 图元着色。
# 使用“视图”>“按图元”方法中的“替换图形”为图元着色。

# group: 选择模型图元
# 选择外立面墙
# note: 单击“更改”以从 Revit 模型中选择图元
select_model_elements = DSModelElementsSelection()  # 33 picked in the model; graph input

# group: 计算图元表面积
# note: 获取图元的几何图形
getGeometry = Element.GetGeometry(element=select_model_elements)
flatten = List.Flatten(list=getGeometry)
# note: 提取几何图形的曲面面积
area = Solid.Area(solid=flatten)
# note: 获取最高值
maximumItem = List.MaximumItem(list=area)
# note: 以最高值规格化
div = area / maximumItem  # graph output

# group: 创建颜色
# 准备颜色方案以对图元进行颜色编码
number = DoubleInput(0)
number_2 = DoubleInput(255)
# note: 绿色
byARGB = Color.ByARGB(alpha=number, red=number, green=number_2, blue=number, lacing=Longest)
number_3 = DoubleInput(0)
number_4 = DoubleInput(255)
# note: 红色
byARGB_2 = Color.ByARGB(alpha=number_3, red=number_4, green=number_3, blue=number_3, lacing=Longest)
create = List.Create(item0=byARGB, item1=byARGB_2)
code_block = CodeBlock { [0,1]; }
# note: 设置颜色范围
color_range = ColorRange(colors=create, indices=code_block, value=div)

# group: 到 Revit: 替代视图中的图元颜色
# note: 这将替代活动视图中图元的颜色
overrideColorInView = Element.OverrideColorInView(element=select_model_elements, color=color_range, lacing=Longest)

# group: 阈值
number_5 = DoubleInput(100)

# group: 备选方案 - 评估标准是否超过给定阈值
# note: 与阈值比较
gt = area > number_5
# note: 数字将指示色谱上的位置 - 从 0 到 1
number_6 = DoubleInput(1)
number_7 = DoubleInput(0)
# note: 确定公差范围内的面积
if_ = RefactoredIf(test=gt, true=number_6, false=number_7)
# note: 此结果可用作“Color Range”节点的“索引”输入
watch = Watch(if_)
