# Dynamo graph Revit Floors and Framing.dyn "Revit 楼板和框架" (Dynamo 4.0.0.3076)
# author: Dynamo Team
# 此图形通过使用一系列线及其位移以在 Revit 中定位“结构框架”和“楼板”图元，创建了一个装饰性建筑。
# packages: PythonNet3 引擎 1.4.5

# group: 信息
# note: 运行此图形(即“Snowdon Towers Sample Architectural.rvt”文件)，该文件位于 Revit 安装目录下的“Samples”文件夹中
# C:\Program Files\Autodesk\Revit 2027\Samples
# note: 此图形使用一些列线并将它们用于驱动对结构框架和楼板的放置，创建了一个装饰性建筑。

# group: 装饰性建筑的中心位置
x_位置 = DoubleSlider(30, range=25..40 step 1)  # graph input
y_位置 = DoubleSlider(30, range=25..40 step 1)  # graph input
z_位置 = DoubleSlider(62, range=60..80 step 1)  # graph input

# group: 装饰性建筑配置
# 说明 <双击此处编辑组说明>
下部楼板半径 = DoubleSlider(10, range=8..20 step 1)  # graph input
楼板数量 = DoubleSlider(7, range=3..10 step 1)  # graph input
半径减小 = DoubleSlider(-1.25, range=-2..-0.5 step 0.25)  # graph input
多边形边数 = IntegerSlider(5, range=3..10 step 1)  # graph input
顶部楼板高度 = DoubleSlider(38.4, range=15..50 step 0.1)  # graph input
最大旋转_度 = DoubleSlider(130, range=10..180 step 5)  # graph input

# group: 构造多边形
# 创建一系列半径减小、垂直偏移、顺序旋转的多边形
# note: 装饰性建筑的中心
byCoordinates = Point.ByCoordinates(x=x_位置, y=y_位置, z=z_位置)
# note: 圆半径序列
sequence = Sequence(start=下部楼板半径, amount=楼板数量, step=半径减小, lacing=Longest)
# note: 创建一系列圆
byCenterPointRadius = Circle.ByCenterPointRadius(centerPoint=byCoordinates, radius=sequence)
# note: 创建一系列多边形
regularPolygon = Polygon.RegularPolygon(circle=byCenterPointRadius, numberSides=多边形边数)
# note: 楼板高程序列
楼板高度序列 = CodeBlock(top_floor=顶部楼板高度, count=楼板数量) { 0..top_floor..#count; }
byCoordinates_2 = Vector.ByCoordinates(z=楼板高度序列)
# note: 按给定高度上移多边形
translate = Geometry.Translate(geometry=regularPolygon, direction=byCoordinates_2)
ZAxis = Vector.ZAxis()
# note: 每个楼板的旋转序列
旋转角度序列 = CodeBlock(max_degrees=最大旋转_度, count=楼板数量) { 0..max_degrees..#count; }
# note: 使用一系列角度旋转多边形
rotate = Geometry.Rotate(geometry=translate, origin=byCoordinates, axis=ZAxis, degrees=旋转角度序列)
# note: 从多边形提取单个曲线
curves = PolyCurve.Curves(polyCurve=rotate)

# group: 楼板类型和标高
# note: 使用下拉列表从项目中现有的类型中为创建的楼板选择“楼板类型”
floor_types = FloorTypes("Concrete Slab 6\"")  # graph input
levels = Levels("Green Roof Hardscape")  # graph input

# group: 到 Revit: 创建楼板
# 使用闭合曲线回路序列作为楼板创建的输入
# note: 穿过各组曲线以创建楼板
byOutlineTypeAndLevel = Floor.ByOutlineTypeAndLevel(outline=curves, floorType=floor_types, level=levels)

# group: 垂直连接
# 连接装饰性建筑级别之间的多边形角点
# note: 获取每条多边形曲线的终点
endPoint = Curve.EndPoint(curve=curves)
# note: 翻转矩阵并获取垂直对齐的终点列表
transpose = List.Transpose(lists=endPoint)
# note: 将多边形的匹配角点从最低到最高装饰性建筑级别连接起来，以将它们连接为多段线
byPoints = PolyCurve.ByPoints(points=transpose)
# note: 解构多段线并获取曲线列表以用作结构框架图元的输入
curves_2 = PolyCurve.Curves(polyCurve=byPoints)

# group: 结构框架类型和标高
levels_2 = Levels("Green Roof Hardscape")  # graph input
# note: 使用下拉列表从项目中载入的类型中选择“结构框架类型”
structural_framing_types = StructuralFramingTypes("W12X26")  # graph input

# group: 到 Revit: 创建结构框架
# 使用曲线创建结构框架图元，使用 Python 节点禁止各个梁之间的连接
# note: 穿过每个结构图元的单个曲线
beamByCurve = StructuralFraming.BeamByCurve(curve=curves_2, level=levels_2, structuralFramingType=structural_framing_types)
# note: 准备列表
flatten = List.Flatten(list=beamByCurve)
# note: 这是一个重命名的 Python 节点，该节点引用 Revit API 以将 Dynamo 可以执行的操作超越现有节点。要阅读 Python 代码，请在该节点上单击鼠标右键，然后单击“编辑…”
禁止在结构框架上连接 = Python(structuralFraming=flatten)  # PythonNet3
# ---------- 禁止在结构框架上连接.python (35 lines) ----------
# Load the Python Standard and DesignScript Libraries
import sys
import clr
clr.AddReference('ProtoGeometry')
from Autodesk.DesignScript.Geometry import *
from Autodesk.Revit.DB import *
from RevitServices.Transactions import TransactionManager
from RevitServices.Persistence import DocumentManager 

doc = DocumentManager.Instance.CurrentDBDocument

# The inputs to this node will be stored as a list in the IN variables.
dataEnteringNode = IN

# Place your code below this line
structural_framing = UnwrapElement(IN[0])

unjoined_elements = []
# start a Transaction
TransactionManager.Instance.EnsureInTransaction(doc)
# iterate through each structural framing element
for sf in structural_framing:
    # check if the element passed in of Structural Framing Category
    sf_category = sf.Category # get the element's Category
    # use the Structural Framing's Category Id to check
    if sf_category.Id.Value == -2001320:
        # disallow joins at start and end of the structural framing element
        Structure.StructuralFramingUtils.DisallowJoinAtEnd(sf, 0)
        Structure.StructuralFramingUtils.DisallowJoinAtEnd(sf, 1)
        unjoined_elements.append(sf)
TransactionManager.Instance.TransactionTaskDone()

    
# Output the list of elements with Disallowed Join
OUT = unjoined_elements
# ----------------------------------------
