# Dynamo graph Revit Geometry Creation Curves.dyn (Dynamo 4.0.0.3076)
# author: Dynamo Team
# 此图形展示了在 Dynamo 中创建曲线并将其用于创建 Revit 图元(模型线)的多种方法

# group: 信息
# note: 此图形使用多种方法来创建要用作创建 Revit 模型曲线的输入的曲线
# note: Run this graph the Snowdon Towers Sample Architectural.rvt file in the Samples folder located with your Revit installation
# C:\Program Files\Autodesk\Revit 2027\Samples

# group: 四个点
# 说明 <双击此处编辑组说明>
number = DoubleInput(-35)
number_2 = DoubleInput(-55)
byCoordinates = Point.ByCoordinates(x=number, y=number_2)
number_3 = DoubleInput(-40)
byCoordinates_2 = Point.ByCoordinates(x=number, y=number_3)
number_4 = DoubleInput(-10)
byCoordinates_3 = Point.ByCoordinates(x=number_4, y=number_3)
number_5 = DoubleInput(-17)
number_6 = DoubleInput(-60)
byCoordinates_4 = Point.ByCoordinates(x=number_5, y=number_6)

list_create = List.Create(item0=byCoordinates, item1=byCoordinates_2, item2=byCoordinates_3, item3=byCoordinates_4)

# group: 从 Nurbs 曲线创建模型曲线(通过点)
# note: 从点列表创建 NURBS 曲线
byPoints = NurbsCurve.ByPoints(points=list_create)
# note: 使用 NURBS 曲线来创建 Revit 模型线
byCurve = ModelCurve.ByCurve(curve=byPoints)

# group: 从 Nurbs 曲线创建模型曲线(通过控制点)
boolean = BoolSelector(false)
# note: 从点列表作为控制点来创建 NURBS 曲线
byControlPoints = NurbsCurve.ByControlPoints(points=list_create, closeCurve=boolean)
# note: 使用 NURBS 曲线来创建 Revit 模型线
byCurve_2 = ModelCurve.ByCurve(curve=byControlPoints)

# group: 从复合线创建模型曲线
# note: 从点列表创建多段线
byPoints_2 = PolyCurve.ByPoints(points=list_create)
curves = PolyCurve.Curves(polyCurve=byPoints_2)
# note: 使用曲线列表来创建一组 Revit 模型线
byCurve_3 = ModelCurve.ByCurve(curve=curves)

# group: 从线创建模型曲线
# note: 从两点创建曲线
byStartPointEndPoint = Line.ByStartPointEndPoint(startPoint=byCoordinates, endPoint=byCoordinates_2)
# note: 使用线(曲线)创建 Revit 模型曲线
byCurve_4 = ModelCurve.ByCurve(curve=byStartPointEndPoint)
