# Dynamo graph Revit Geometry Creation Points.dyn (Dynamo 4.0.0.3076)
# author: Dynamo Team
# 当处于概念体量族环境中时，此图形创建了模型线和参照点。

# group: 信息
# note: 可以使用屏幕右上角的按钮(Ctrl+B 快捷方式)，在三维背景导航和图形视图导航之间切换。对于 Dynamo 和 Revit，还可以在“视图”菜单中启用和禁用背景预览。
# note: Run this graph in a Conceptual Mass or Generic Model Adaptive family environment.
# To create a new family, go to File > New Family > and select the template located in the folder:
# C:\ProgramData\Autodesk\RVT 2027\Family Templates\English-Imperial\Generic Model Adaptive.rft
# note: 此图形在族环境中创建了模型线和参照点

# group: 点坐标
点_x_值 = DoubleSlider(50, range=5..50 step 5)  # graph input
点_y_值 = DoubleSlider(25, range=5..50 step 5)  # graph input
点_z_值 = DoubleSlider(25, range=5..50 step 5)  # graph input

# note: 在 Dynamo 环境中操纵点的位置 : 选择“Point.ByCoordinates”节点并切换到背景预览，以沿其三个轴拉动点。
byCoordinates = Point.ByCoordinates(x=点_x_值, y=点_y_值, z=点_z_值)
# note: 可将几何数据可视化为文字信息或三维空间
watch = Watch(byCoordinates)
byCoordinates_2 = Point.ByCoordinates()
byStartPointEndPoint = Line.ByStartPointEndPoint(startPoint=byCoordinates_2, endPoint=byCoordinates)
# note: 预览几何图形
watch_3d = Watch3D(byStartPointEndPoint)
# note: 通过连接两点创建模型曲线
byCurve = ModelCurve.ByCurve(curve=byStartPointEndPoint)
# note: Dynamo 只能创建和修改与 Dynamo 关联的文件相适合的图元。例如，参照点只能在某些族环境(例如“常规模型自适应”)中创建，而模型线几乎可以在任意位置创建。
byPoint = ReferencePoint.ByPoint(pt=byCoordinates)
