# Dynamo graph Revit Geometry Creation Solids.dyn "Revit 几何图形创建实体" (Dynamo 4.0.0.3076)
# author: Dynamo Team
# 此图形演示了在 Dynamo 中创建实体几何图形并将其集成到 Revit 中的多种方法 - 某些方法可用于项目环境，其他方法仅用于某些族环境(概念体量)。

# group: 信息
# note: 大多数实体都有多种创建方法。这些示例演示了将闭合轮廓作为基础，但可以缝合多边形曲面，可以使用许多基本体(曲面、长方体、圆锥体等)。
# 为了将几何图形集成到 Revit 环境中，首先需要将其转换为 Revit 图元。
# 实体可以转换为在项目和模型族环境都可见的输入实例。
# 实体几何图形还可以转换为仅适用于“概念体量”和“自适应构件族”环境的“形状”图元。
# note: 此图形使用多种方法在 Revit 中创建了实体几何图形 - 某些方法可以在项目环境中使用，其他方法只能在某些族环境中使用。
# 使用概念体量族样板查看所有方法。
# 要打开概念体量族，请转到“文件”>“新建”>“族”，然后选择 Mass.rft 样板\Conceptual Mass\Mass.rft

# group: 准备点
# 生成一组点以构建几何图形
byCoordinates = Point.ByCoordinates()
number = DoubleInput(10)
byCoordinates_2 = Point.ByCoordinates(x=number)
number_2 = DoubleInput(5)
byCoordinates_3 = Point.ByCoordinates(z=number_2)
number_3 = DoubleInput(10)
byCoordinates_4 = Point.ByCoordinates(y=number_3)
number_4 = DoubleInput(15)
byCoordinates_5 = Point.ByCoordinates(x=number_4, y=number_4)
number_5 = DoubleInput(5)
number_6 = DoubleInput(10)
byCoordinates_6 = Point.ByCoordinates(x=number_5, y=number_6, z=number_6)
number_7 = DoubleInput(-2)
number_8 = DoubleInput(5)
byCoordinates_7 = Point.ByCoordinates(x=number_7, y=number_8)

# group: 第一个轮廓
# 从圆弧和线创建第一个轮廓作为闭合曲线
byStartPointEndPoint = Line.ByStartPointEndPoint(startPoint=byCoordinates, endPoint=byCoordinates_2)
byThreePoints = Arc.ByThreePoints(firstPoint=byCoordinates, secondPoint=byCoordinates_3, thirdPoint=byCoordinates_2)
create = List.Create(item0=byStartPointEndPoint, item1=byThreePoints)
# note: 放样的第一个轮廓
byJoinedCurves = PolyCurve.ByJoinedCurves(curves=create)

# group: 第二个轮廓
# 从圆弧和线创建第二个轮廓作为闭合曲线
byStartPointEndPoint_2 = Line.ByStartPointEndPoint(startPoint=byCoordinates_4, endPoint=byCoordinates_5)
byThreePoints_2 = Arc.ByThreePoints(firstPoint=byCoordinates_4, secondPoint=byCoordinates_6, thirdPoint=byCoordinates_5)
create_2 = List.Create(item0=byStartPointEndPoint_2, item1=byThreePoints_2)
# note: 放样的第二个轮廓
byJoinedCurves_2 = PolyCurve.ByJoinedCurves(curves=create_2)

# note: 连接列表中的两个轮廓
create_3 = List.Create(item0=byJoinedCurves, item1=byJoinedCurves_2)

# group: 按横截面放样实体
# 说明 <双击此处编辑组说明>
byLoft = Solid.ByLoft(crossSections=create_3)

# note: 研究实体的体积
volume = Solid.Volume(solid=byLoft)

# group: 创建壳
code_block = CodeBlock { 0; }
# note: 提示: 禁用节点右键菜单中的“预览”，以禁止显示图元
thinShell = Solid.ThinShell(solid=byLoft, internalFaceThickness=code_block)

# group: 平移几何图形
code_block_2 = CodeBlock { Vector.ByCoordinates(20,0,0); }
# note: 将几何图形平移到侧面以预览原始结果和最终结果
translate = Geometry.Translate(geometry=thinShell, direction=code_block_2)

# group: 修剪实体
# 使用“修剪”操作以通过平面剪切壳实体。
code_block_3 = CodeBlock { Point.ByCoordinates(0,0,5); }
ZAxis = Vector.ZAxis()
byOriginNormal = Plane.ByOriginNormal(origin=code_block_3, normal=ZAxis)
number_9 = DoubleInput(10)
# note: 选择要保留的修剪边(将丢弃离点最近的边)。
byCoordinates_8 = Point.ByCoordinates(x=number_9, y=number_9, z=number_9)
# note: 几何图形类别中可使用几何图形各项布尔运算(交集、差集、并集等)。
trim = Geometry.Trim(geometry=translate, other=byOriginNormal, pick=byCoordinates_8)

# group: 导向曲线
# 创建 NURBS 曲线以用作放样实体形状的导向曲线
create_4 = List.Create(item0=byCoordinates, item1=byCoordinates_7, item2=byCoordinates_4)
# note: 导向曲线构建为 NURBS 曲线
byPoints = NurbsCurve.ByPoints(points=create_4)

# group: 按横截面和导向曲线放样实体
# note: 提示: 禁用节点右键菜单中的“预览”，以禁止显示图元
byLoft_2 = Solid.ByLoft(crossSections=create_3, guideCurves=byPoints)

# group: 创建输入实例
code_block_4 = CodeBlock { Vector.ByCoordinates(-20,0,0); }
translate_2 = Geometry.Translate(geometry=byLoft_2, direction=code_block_4)
# note: 几何图形与 Revit 图元不同:
# 使用 ImportInstance 由任意 Revit 环境中的曲面和实体来创建 Revit 导入，使用点和曲线放置族实例，或通过点(自适应构件)族在体量和常规模型中创建表格
byGeometries = ImportInstance.ByGeometries(geometries=translate_2)
byCoordinates_9 = Vector.ByCoordinates()

# group: 创建形状
# 使用两个轮廓曲线回路，创建“形状”图元(在概念体量族环境中)
curves = PolyCurve.Curves(polyCurve=create_3)
# note: 从曲线创建模型曲线
referenceCurveByCurve = ModelCurve.ReferenceCurveByCurve(curve=curves)
# note: 只能将形状创建为概念体量族的一部分
byLoftCrossSections = Form.ByLoftCrossSections(curves=referenceCurveByCurve)
