# Dynamo graph Revit Geometry Creation Surfaces.dyn "Revit 几何图形创建表面" (Dynamo 4.0.0.3076)
# author: Dynamo Team
# 此图形演示了在 Dynamo 中创建曲面的几种方法，以及将几何图形转换为 Revit 几何图形的两种方法。

# group: 信息
# note: 此图形使用多种方法在 Revit 中创建了曲面几何图形 - 某些方法可以在项目环境中使用，其他方法只能在某些族环境中使用。
# 使用概念体量族样板查看所有方法。
# 通过转到“文件”>“新建”>“族”，然后选择“Conceptual Mass”文件夹中的“Mass.rft”样板来创建概念体量族。
# note: 大多数曲面都有多种创建方法。曲面、多边形曲面(曲面集合)和 NURBS 曲面可以通过点、曲线创建，也可以通过各种操作从其他曲面和实体派生。
# note: 为了将几何图形集成到 Revit 环境中，首先需要将其转换为 Revit 图元。
# 曲面和实体可以转换为将在项目和模型族环境中都可见的输入实例。
# 曲面几何图形还可以转换为仅适用于概念体量和自适应构件族环境的形状图元。

# group: 准备点
# 生成一组点以构建几何图形
number = DoubleInput(10)
byCoordinates = Point.ByCoordinates(y=number)
number_2 = DoubleInput(5)
number_3 = DoubleInput(10)
byCoordinates_2 = Point.ByCoordinates(x=number_2, y=number_3, z=number_3)
number_4 = DoubleInput(15)
byCoordinates_3 = Point.ByCoordinates(x=number_4, y=number_4)
byCoordinates_4 = Point.ByCoordinates()
number_5 = DoubleInput(5)
byCoordinates_5 = Point.ByCoordinates(z=number_5)
byCoordinates_6 = Point.ByCoordinates(x=number)
number_6 = DoubleInput(-5)
number_7 = DoubleInput(5)
byCoordinates_7 = Point.ByCoordinates(x=number_6, y=number_7)
number_8 = DoubleInput(10)
number_9 = DoubleInput(-10)
byCoordinates_8 = Point.ByCoordinates(x=number_8, y=number_9)
byCoordinates_9 = Point.ByCoordinates(y=number_9)

# group: 创建轮廓
byThreePoints = Arc.ByThreePoints(firstPoint=byCoordinates, secondPoint=byCoordinates_2, thirdPoint=byCoordinates_3)
byThreePoints_2 = Arc.ByThreePoints(firstPoint=byCoordinates_4, secondPoint=byCoordinates_5, thirdPoint=byCoordinates_6)
byThreePoints_3 = Arc.ByThreePoints(firstPoint=byCoordinates_4, secondPoint=byCoordinates_7, thirdPoint=byCoordinates)
byStartPointEndPoint = Line.ByStartPointEndPoint(startPoint=byCoordinates_8, endPoint=byCoordinates_9)

# group: 按扫掠创建曲面
# 使用轮廓、路径曲线和引导轨道创建扫掠曲面
bySweep2Rails = Surface.BySweep2Rails(path=byThreePoints, guideRail=byThreePoints_2, profile=byThreePoints_3)

# group: 创建输入
# note: 使用“输入实例”从曲面和实体创建 Revit 输入 - 这些输入将在任何 Revit 环境中都可见。
byGeometries = ImportInstance.ByGeometries(geometries=bySweep2Rails)

create = List.Create(item0=byStartPointEndPoint, item1=byThreePoints_2)

# group: 按放样创建曲面
# 连接横截面以创建放样曲面
byLoft = Surface.ByLoft(crossSections=create)

# group: 评估曲面面积
area = Surface.Area(surface=byLoft)
watch = Watch(area)
create_2 = List.Create(item0=byLoft, item1=bySweep2Rails)
# note: 已连接为 Polysurfaces 的曲面可以作为单个实体计算
byJoinedSurfaces = PolySurface.ByJoinedSurfaces(surfaces=create_2)
area_2 = Surface.Area(surface=byJoinedSurfaces)
watch_2 = Watch(area_2)
area_3 = Surface.Area(surface=bySweep2Rails)
watch_3 = Watch(area_3)

# group: 从控制点创建 NURBS 曲面
# 从控制点将扫掠转化为 NURBS 曲面
code_block = CodeBlock { 0..1..0.1; }
# note: 边、点和其他特征可以使用适用于这些几何图形的“操作”从曲面衍生。
pointAtParameter = Surface.PointAtParameter(surface=bySweep2Rails, u=code_block, v=code_block, lacing=CrossProduct)
# note: 从控制点将曲面重建为 NURBS 曲面
byControlPoints = NurbsSurface.ByControlPoints(controlVertices=pointAtParameter)
# note: 使用“Watch 3D”节点以在隔离模式下预览几何图形
watch_3d = Watch3D(byControlPoints)

# group: 按拉伸曲线创建曲面
# 使用曲线以给定距离创建拉伸
code_block_2 = CodeBlock { 10; }
extrude = Curve.Extrude(curve=byThreePoints, distance=code_block_2)

# group: 创建形状
# 从两条曲线创建放样形状
referenceCurveByCurve = ModelCurve.ReferenceCurveByCurve(curve=create)
byLoftCrossSections = Form.ByLoftCrossSections(curves=referenceCurveByCurve)
