# Dynamo graph Revit Import Solid.dyn (Dynamo 4.0.0.3076)
# author: Dynamo Team
# 此图形演示了一种创建 Dynamo 实体几何图形并将其用于创建 Revit 输入实例图元的方法。通过创建一系列圆弧轮廓并将其用于创建放样曲面，来构造新的屋顶形状。

# group: 信息
# note: 源图元(屋顶)已从 Revit 中预先选择，图元 ID 与 Dynamo 文件一起保存
# note: Run this graph the Snowdon Towers Sample Architectural.rvt file in the Samples folder located with your Revit installation
# C:\Program Files\Autodesk\Revit 2027\Samples
# note: 通过创建一系列圆弧轮廓并将其用于创建放样曲面，以从选定屋顶图元构造新的屋顶形状。几何图形将转换为输入实例以将其集成到 Revit 环境中

# group: 新的屋顶配置
# note: 将创建放样曲面的轮廓数
轮廓数 = IntegerSlider(6, range=3..10 step 1)
# note: 新屋顶短端的高度
屋顶剖面最小值 = DoubleSlider(2.1, range=1..5 step 0.1)
# note: 屋顶中间的高度
屋顶剖面最大值 = DoubleSlider(7, range=5..10 step 0.1)
# note: 将圆弧轮廓向侧面按此值延伸
屋顶边延伸 = DoubleSlider(0.5, range=0.1..3 step 0.1)
# note: 新屋顶形状的厚度
屋顶厚度 = DoubleSlider(0.5, range=0.1..2 step 0.1)

轮廓数量 = CodeBlock(steps=轮廓数) { steps; }

# group: 选择屋顶
# 选择源屋顶图元
# note: 所有在“IsInput”处标记的输入都可以从 Dynamo 播放器进行设置
选择平屋顶 = DSModelElementSelection()  # 1 picked in the model

# group: 获取屋顶面
# 分解源图元的几何图形并拾取面积最大的一个面
# note: 要获取选定图元的面，请首先获取其几何图形
# note: 单击鼠标右键并取消勾选“预览几何图形”以更清晰地查看最终结果
getGeometry = Element.GetGeometry(element=选择平屋顶)
# note: 分解几何图形以获取各个面
explode = Geometry.Explode(geometry=getGeometry)
# note: 处理列表结构。请注意，如果使用多个源对象，则不需要执行此步骤
flatten = List.Flatten(list=explode)
area = Surface.Area(surface=flatten)
# note: 将曲面列表按其面积进行排序。面积最大的曲面将是 sortedList 输出列表中的最后一项
sortByKey = List.SortByKey(list=flatten, keys=area)
lastItem = List.LastItem(list=sortByKey.sortedList)
number = DoubleInput(1.5)
# note: 向上平移曲面
translate = Geometry.Translate(geometry=lastItem, zTranslation=number)

# group: 向外偏移(缩放)
# 缩放曲面以向外延伸其边
uv_位置 = CodeBlock { 0.5; }
pointAtParameter = Surface.PointAtParameter(surface=translate, u=uv_位置, v=uv_位置)
从点缩放到点 = CodeBlock { point1 = Point.ByCoordinates(1, 1); point2 = Point.ByCoordinates(-40, -40); }
scale = Geometry.Scale(geometry=translate, basePoint=pointAtParameter, from=从点缩放到点.point1, to=从点缩放到点.point2)

# group: 曲面上的点
# 生成三个等间距点列表 - 沿较长边两行和中间一行
# note: 0 和 1 是沿曲面较长边的位置
边行的_u_位置 = CodeBlock { [0,1]; }
# note: 沿较长边的 V 位置，按从 0 到 1 和 N 步的序列
边行的_v_位置 = CodeBlock(steps=轮廓数量) { [0..1..#steps]; }
# note: 通过在节点上单击鼠标右键 > 选择“连缀”，以使用“最长连缀”设置。
# 最长连缀将匹配列表结构不同的输入。在这种情况下，结果将是两个点列表，其中每个列表中的点数与最长输入列表匹配。
pointAtParameter_2 = Surface.PointAtParameter(surface=scale, u=边行的_u_位置, v=边行的_v_位置, lacing=Longest)
# note: U 值 0.5 将沿着曲面的中间定位点
中间行的_u_位置 = CodeBlock { [0.5]; }
# note: 沿中间一行点的 V 位置，按从 0 到 1 和 N 步序列
中间行的_v_位置 = CodeBlock(steps=轮廓数量) { [0..1..#steps]; }
# note: 最长连缀用于此节点。结果是一个点列表，其中列表中的点数与最长输入列表匹配。
pointAtParameter_3 = Surface.PointAtParameter(surface=scale, u=中间行的_u_位置, v=中间行的_v_位置, lacing=Longest)

# group: 向上偏移点
# 偏移余弦波形中中间行的点
# note: 用于生成偏移序列的值序列
角度序列 = CodeBlock(steps=轮廓数量) { -1..1..#steps; }
# note: 备选方案: 对其他屋顶形状使用正弦
sin = Math.Sin(angle=角度序列)
# note: 余弦波中的值
cos = Math.Cos(angle=角度序列)
# note: 将值重新映射到新域
remapRange = Math.RemapRange(numbers=cos, newMin=屋顶剖面最小值, newMax=屋顶剖面最大值)
# note: 平移中间行的点
translate_2 = Geometry.Translate(geometry=pointAtParameter_3@L2, zTranslation=remapRange)

# group: 从圆弧创建轮廓
# 使用点创建圆弧
# note: 将边和中间行合并到一个列表中
join = List.Join(list0=pointAtParameter_2, list1=translate_2)
项目索引 = CodeBlock { 0; 1; 2; }
getItemAtIndex = List.GetItemAtIndex(list=join, index=项目索引.out0)
getItemAtIndex_2 = List.GetItemAtIndex(list=join, index=项目索引.out2)
getItemAtIndex_3 = List.GetItemAtIndex(list=join, index=项目索引.out1)
byThreePoints = Arc.ByThreePoints(firstPoint=getItemAtIndex, secondPoint=getItemAtIndex_2, thirdPoint=getItemAtIndex_3)

# group: 延伸轮廓
# 将每个轮廓的曲线按给定距离延伸
# note: 延伸值设置为图形左侧的输入。
延伸边 = CodeBlock(roof_extension=屋顶边延伸) { roof_extension; }
extendStart = Curve.ExtendStart(curve=byThreePoints, distance=延伸边)
extendEnd = Curve.ExtendEnd(curve=extendStart, distance=延伸边)

# group: 放样和加厚
# 创建放样曲面并为其指定厚度
byLoft = Surface.ByLoft(crossSections=extendEnd)
thicken = Surface.Thicken(surface=byLoft, thickness=屋顶厚度)

# group: 到 Revit:
# 通过“ImportInstance”和“Set Level”参数将 Dynamo 几何图形转换为 Revit 图元
# note: 为了将几何图形集成到 Revit 环境中，首先需要将其转换为 Revit 图元。
# 实体可以转换为将在项目和模型族环境中都可见的输入实例。
byGeometry = ImportInstance.ByGeometry(geometry=thicken)
code_block = CodeBlock { "工作平面"; }
levels = Levels("L1 - Block 43")
# note: 通过将“工作平面”参数设置为高程与“内部原点”位置匹配的标高，来更正放置的输入实例的高度。
setParameterByName = Element.SetParameterByName(element=byGeometry, parameterName=code_block, value=levels)
