# Dynamo graph Revit Structural Framing.dyn (Dynamo 4.0.0.3076)
# author: Dynamo Team
# 此图形基于结构框架和柱相对于选定的 Revit 楼板创建了一个结构。

# group: 信息
# note: 相对于在 Revit 模型中选定的图元放置结构框架梁和柱。
# note: Run this graph the Snowdon Towers Sample Architectural.rvt file in the Samples folder located with your Revit installation
# C:\Program Files\Autodesk\Revit 2027\Samples

# group: 输入
# note: 选择将相对于其创建新的凉棚结构的 Revit 楼板图元
选择源楼板 = DSModelElementSelection()  # 1 picked in the model; graph input
# note: 结构高度
高度 = DoubleSlider(8.4, range=0..10 step 0.1)  # graph input
柱数 = IntegerSlider(9, range=2..10 step 1)  # graph input
# note: 选择要放置结构的标高
结构标高 = Levels("L1 - Block 43")  # graph input
# note: 选择周边梁的框架类型。此类型还将用于创建新的结构框架类型
structural_framing_types = StructuralFramingTypes("W12X26")  # graph input
# note: 选择所创建柱的族类型
结构柱类型 = StructuralColumnTypes(index=0)  # graph input

# group: 准备几何图形
# 准备选定图元的几何图形的清晰实体表达式
# note: 获取 Revit 图元的几何图形
getGeometry = Element.GetGeometry(element=选择源楼板)
# note: 作为放弃图元洞口的一种快速方法，获取其边界框 - 包含图元的虚拟长方体
byMinimumVolume = BoundingBox.ByMinimumVolume(geom=getGeometry)
# note: 对实体可执行的操作比边界框多。要允许进一步变换，请首先将边界框转换为长方体(它属于实体类型)
toCuboid = BoundingBox.ToCuboid(boundingBox=byMinimumVolume)
# note: 按“图形输入”部分中的“数值滑块”所设置的高度(zTranslation)平移实心长方体
translate = Geometry.Translate(geometry=toCuboid, zTranslation=高度)

# group: 获取实体的顶部曲面
# 根据实体中心的高程评估所有实体的曲面，并获取顶部曲面
# note: 将实体分解为曲面
explode = Geometry.Explode(geometry=translate)
code_block = CodeBlock { 0.5; }
# note: 在曲面中心处定位点
pointAtParameter = Surface.PointAtParameter(surface=explode, u=code_block, v=code_block)
# note: 获取每个中心点高程的数值
Z = Point.Z(point=pointAtParameter)
# note: 按另一个列表对一个列表进行排序: 使用高程值对曲面进行排序
sortByKey = List.SortByKey(list=explode, keys=Z)
# note: 列表中的最后一个曲面是顶部曲面
lastItem = List.LastItem(list=sortByKey.sortedList)

# group: 偏移曲面上的点序列
# note: 使用简单公式来创建从最小值(0.1)到最大值(0.9)且步数为“n”的值序列
u_值序列 = CodeBlock(n=柱数) { 0.1..0.9..#n; }
边偏移 = CodeBlock { [0.1,0.9]; }
# note: 使用 U 和 V 参数在曲面上定位点阵列。使用“叉积连缀”(在节点上单击鼠标右键并选择“连缀”)生成阵列。
pointAtParameter_2 = Surface.PointAtParameter(surface=lastItem, u=u_值序列, v=边偏移, lacing=CrossProduct)

# group: 创建内部梁的线
# 连接点并创建线
索引 = CodeBlock { 0; 1; }
# note: 单击“列表”输入旁边的“>”符号以使用级别。这意味着结果将是每个最低嵌套列表(@L2)中索引为 0 的项
getItemAtIndex = List.GetItemAtIndex(list=pointAtParameter_2@L2, index=索引.out0)
getItemAtIndex_2 = List.GetItemAtIndex(list=pointAtParameter_2@L2, index=索引.out1)
byStartPointEndPoint = Line.ByStartPointEndPoint(startPoint=getItemAtIndex, endPoint=getItemAtIndex_2)

# group: 周边梁的曲线
# 说明 <双击此处编辑组说明>
firstItem = List.FirstItem(list=pointAtParameter_2)
lastItem_2 = List.LastItem(list=pointAtParameter_2)
byStartPointEndPoint_2 = Line.ByStartPointEndPoint(startPoint=firstItem, endPoint=lastItem_2)

# group: 柱的曲线
# 使用第二行的每一个点来创建用于放置柱的线
code_block_2 = CodeBlock { 2; }
# note: 将列表切成 2 个列表
chop = List.Chop(list=pointAtParameter_2, lengths=code_block_2)
# note: 使用列表级别逻辑，并仅获取 @L3 处的第一个列表
firstItem_2 = List.FirstItem(list=chop@L3)
反向高度 = CodeBlock(H=高度) { -H; }
# note: 向下平移点
translate_2 = Geometry.Translate(geometry=firstItem_2, zTranslation=反向高度)
# note: 连接点以创建线
byStartPointEndPoint_3 = Line.ByStartPointEndPoint(startPoint=translate_2, endPoint=firstItem_2)

# group: 到 Revit: 按曲线放置梁
# note: 放置内部梁
beamByCurve = StructuralFraming.BeamByCurve(curve=byStartPointEndPoint, level=结构标高, structuralFramingType=structural_framing_types)
# note: 放置周边梁
beamByCurve_2 = StructuralFraming.BeamByCurve(curve=byStartPointEndPoint_2, level=结构标高, structuralFramingType=structural_framing_types)
# note: 放置结构柱
columnByCurve = StructuralFraming.ColumnByCurve(curve=byStartPointEndPoint_3, level=结构标高, structuralColumnType=结构柱类型)
