# Dynamo graph Revit Adaptive Component Placement.dyn (Dynamo 4.0.0.3076)
# author: Dynamo Team
# 此圖表在模型中依點定位自適應元件。

# group: 資訊
# note: 已從 Revit 預先選取帷幕牆網格線，元素 ID 會隨 Dynamo 檔案一起儲存
# note: Run this graph the Snowdon Towers Sample Architectural.rvt file in the Samples folder located with your Revit installation:
# C:\Program Files\Autodesk\Revit 2027\Samples
# Run this graph after you load the adaptive family AdaptivePanel.rfa from the Dynamo datasets location.
# note: 相對於 Revit 檔案中選取的某些元素放置自適應元件。
# 自適應元件需要一組與要放置之族群的放置點數相等的點

# group: 輸入
# note: 選取帷幕牆網格線
選取邊 = SelectEdges()  # 7 picked in the model; graph input
# note: 設定鰭片中點的最小位移和最大位移
最小位移 = DoubleSlider(1.4, range=0.2..3 step 0.1)
最大位移 = DoubleSlider(4.3, range=3..8 step 0.1)
# note: 選取自適應元件族群
family_types = FamilyTypes("AdaptivePanel:AdaptivePanel")  # graph input

# note: 沿曲線建立點位置清單，0 表示起點，0.5 表示中點，1 表示終點
參數清單 = CodeBlock { [0,0.5,1]; }
# note: 找出每條曲線上的起點、中點和終點
pointAtParameter = Curve.PointAtParameter(curve=選取邊, param=參數清單, lacing=CrossProduct)

# group: 取得每條曲線的起點和終點
起點和終點索引 = CodeBlock { 0; 2; }
getItemAtIndex = List.GetItemAtIndex(list=pointAtParameter@L2, index=起點和終點索引.out0)
# note: 與選取中點類似，使用「層級」選取每條曲線的起點和終點
getItemAtIndex_2 = List.GetItemAtIndex(list=pointAtParameter@L2, index=起點和終點索引.out1)

# group: 取得每條曲線的中點
中點索引 = CodeBlock { 1; }
# note: 使用輸入「list」的清單層級。節點的結果預設是索引為 1 (第二條曲線) 的清單。在「list」輸入上按一下右鍵，然後選取 @L2 的「使用層級」。這會選取每個巢狀清單中索引為 1 的項目 (每條曲線的中點)
getItemAtIndex_3 = List.GetItemAtIndex(list=pointAtParameter@L2, index=中點索引)

# group: 建立正弦波
# note: 計算選取的來源曲線數
count = List.Count(list=選取邊)
# note: 建立從 0 到 1 的 N 值序列
sequence = CodeBlock(steps=count) { 0..1..#steps; }
# note: 建立正弦波
sin = Math.Sin(angle=sequence)
# note: 將正弦波的值重新對映到新的最大值和最小值
remapRange = Math.RemapRange(numbers=sin, newMin=最小位移, newMax=最大位移)

# group: 位移中點
# note: 對於 Y 位移，否定要向帷幕牆外側位移的值
否定值 = CodeBlock(y=remapRange) { -y; }
# note: 位移鰭片的中點
translate = Geometry.Translate(geometry=getItemAtIndex_3, yTranslation=否定值, zTranslation=remapRange)

# note: 對於 Y 位移，否定要向帷幕牆外側位移的值
否定值_2 = CodeBlock(y=remapRange) { y; }
# note: 位移鰭片的中點
translate_2 = Geometry.Translate(geometry=getItemAtIndex_3, yTranslation=否定值_2, zTranslation=remapRange)

# group: 重新接合清單中的點
list_create = List.Create(item0=getItemAtIndex, item1=translate, item2=getItemAtIndex_2, item3=translate_2)
# note: 翻轉矩陣並以 3 個為一組整理清單
transpose = List.Transpose(lists=list_create)

# group: 到 Revit: 放置元件
# note: 可以使用與族群的放置點數相等的點來定位自適應元件。
byPoints = AdaptiveComponent.ByPoints(points=transpose, familyType=family_types)
