# Dynamo graph Revit Color.dyn (Dynamo 4.0.0.3076)
# author: Dynamo Team
# 此圖表會演算所選元素的表面積，並根據該值套用「圖形取代」為元素著色。

# group: 資訊
# note: Run this graph the Snowdon Towers Sample Architectural.rvt file in the Samples folder located with your Revit installation
# C:\Program Files\Autodesk\Revit 2027\Samples
# note: 此圖表會根據可測量的準則 (表面積) 為 Revit 元素著色。
# 程式會使用「取代視圖中的圖形」>「依元素」方法為元素著色。

# group: 選取模型元素
# 選取正面牆
# note: 按一下「變更」從 Revit 模型中選擇元素
select_model_elements = DSModelElementsSelection()  # 33 picked in the model; graph input

# group: 演算元素表面積
# note: 取得元素的幾何圖形
getGeometry = Element.GetGeometry(element=select_model_elements)
flatten = List.Flatten(list=getGeometry)
# note: 萃取幾何圖形的曲面區域
area = Solid.Area(solid=flatten)
# note: 取得最高值
maximumItem = List.MaximumItem(list=area)
# note: 在最高值正規化
div = area / maximumItem  # graph output

# group: 建立顏色
# 準備色彩計畫讓元素顯示不同顏色
number = DoubleInput(0)
number_2 = DoubleInput(255)
# note: 綠色
byARGB = Color.ByARGB(alpha=number, red=number, green=number_2, blue=number, lacing=Longest)
number_3 = DoubleInput(0)
number_4 = DoubleInput(255)
# note: 紅色
byARGB_2 = Color.ByARGB(alpha=number_3, red=number_4, green=number_3, blue=number_3, lacing=Longest)
create = List.Create(item0=byARGB, item1=byARGB_2)
code_block = CodeBlock { [0,1]; }
# note: 設定顏色範圍
color_range = ColorRange(colors=create, indices=code_block, value=div)

# group: 到 Revit: 取代視圖中的元素顏色
# note: 這會取代作用中視圖中元素的顏色
overrideColorInView = Element.OverrideColorInView(element=select_model_elements, color=color_range, lacing=Longest)

# group: 閾值
number_5 = DoubleInput(100)

# group: 替代方法 - 演算準則是否通過給定的閾值
# note: 與閾值比較
gt = area > number_5
# note: 數字將指出在色譜 (0 到 1) 上的位置
number_6 = DoubleInput(1)
number_7 = DoubleInput(0)
# note: 識別公差內的區域
if_ = RefactoredIf(test=gt, true=number_6, false=number_7)
# note: 此結果可用作 Color Range 節點的「indices」輸入
watch = Watch(if_)
