# Dynamo graph Revit Floors and Framing.dyn (Dynamo 4.0.0.3076)
# author: Dynamo Team
# 此圖表使用一系列線條及其位移，在 Revit 中定位結構構架和樓板元素，建立一個裝飾性建物。

# group: 資訊
# note: Run this graph the Snowdon Towers Sample Architectural.rvt file in the Samples folder located with your Revit installation
# C:\Program Files\Autodesk\Revit 2027\Samples
# note: 此圖表使用一系列線條協助放置結構構架和樓板，建立一個裝飾性建物。

# group: 裝飾性建物中心位置
x_位置 = DoubleSlider(30, range=25..40 step 1)  # graph input
y_位置 = DoubleSlider(30, range=25..40 step 1)  # graph input
z_位置 = DoubleSlider(62, range=60..80 step 1)  # graph input

# group: 裝飾性建物規劃
# 描述 <按兩下這裡以編輯群組描述>
下方樓板半徑 = DoubleSlider(10, range=8..20 step 1)  # graph input
樓板數 = DoubleSlider(7, range=3..10 step 1)  # graph input
半徑減少 = DoubleSlider(-1.25, range=-2..-0.5 step 0.25)  # graph input
多邊形邊數 = IntegerSlider(5, range=3..10 step 1)  # graph input
頂部樓板高度 = DoubleSlider(38.4, range=15..50 step 0.1)  # graph input
最大旋轉_度 = DoubleSlider(130, range=10..180 step 5)  # graph input

# group: 建構多邊形
# 建立一系列半徑遞減、垂直偏移、循序旋轉的多邊形
# note: Folly 中心
byCoordinates = Point.ByCoordinates(x=x_位置, y=y_位置, z=z_位置)
# note: 一系列圓的半徑
sequence = Sequence(start=下方樓板半徑, amount=樓板數, step=半徑減少, lacing=Longest)
# note: 建立一系列圓
byCenterPointRadius = Circle.ByCenterPointRadius(centerPoint=byCoordinates, radius=sequence)
# note: 製作一系列多邊形
regularPolygon = Polygon.RegularPolygon(circle=byCenterPointRadius, numberSides=多邊形邊數)
# note: 一系列樓板高程
樓板高度序列 = CodeBlock(top_floor=頂部樓板高度, count=樓板數) { 0..top_floor..#count; }
byCoordinates_2 = Vector.ByCoordinates(z=樓板高度序列)
# note: 將多邊形上移給定高度
translate = Geometry.Translate(geometry=regularPolygon, direction=byCoordinates_2)
ZAxis = Vector.ZAxis()
# note: 一系列旋轉每個樓板
旋轉角度序列 = CodeBlock(max_degrees=最大旋轉_度, count=樓板數) { 0..max_degrees..#count; }
# note: 以一系列角度旋轉多邊形
rotate = Geometry.Rotate(geometry=translate, origin=byCoordinates, axis=ZAxis, degrees=旋轉角度序列)
# note: 從多邊形萃取個別曲線
curves = PolyCurve.Curves(polyCurve=rotate)

# group: 樓板類型與樓層
# note: 使用下拉式清單，從專案中既有的類型選取已建立樓板的樓板類型
floor_types = FloorTypes("Concrete Slab 6\"")  # graph input
levels = Levels("Green Roof Hardscape")  # graph input

# group: 到 Revit: 建立樓板
# 使用一系列封閉曲線迴路作為建立樓板的輸入
# note: 傳送曲線群組來建立樓板
byOutlineTypeAndLevel = Floor.ByOutlineTypeAndLevel(outline=curves, floorType=floor_types, level=levels)

# group: 垂直連接
# 連接裝飾性建物各樓層之間的多邊形角點
# note: 取得每條多邊形曲線的端點
endPoint = Curve.EndPoint(curve=curves)
# note: 翻轉矩陣並取得垂直對齊的端點清單
transpose = List.Transpose(lists=endPoint)
# note: 將多邊形各個對應角點從裝飾性建物的最低樓層連接到最高樓層，將其接合為 Polycurve
byPoints = PolyCurve.ByPoints(points=transpose)
# note: 解構 PolyCurve 並取得曲線清單，以用作結構構架元素的輸入
curves_2 = PolyCurve.Curves(polyCurve=byPoints)

# group: 結構構架類型與樓層
levels_2 = Levels("Green Roof Hardscape")  # graph input
# note: 使用下拉式清單，從專案中載入的類型選取「結構構架類型」
structural_framing_types = StructuralFramingTypes("W12X26")  # graph input

# group: 到 Revit: 建立結構構架
# 使用曲線建立結構構架元素，並使用 Python 節點阻止個別樑之間接合
# note: 傳送每個結構元素的個別曲線
beamByCurve = StructuralFraming.BeamByCurve(curve=curves_2, level=levels_2, structuralFramingType=structural_framing_types)
# note: 準備清單
flatten = List.Flatten(list=beamByCurve)
# note: 這是一個更名的 Python 節點，此節點參考了 Revit API 因而擴充 Dynamo 即裝即用節點的功能。若要查看 Python 程式碼，請在節點上按一下右鍵，然後按一下「編輯...」
不允許結構構架接合 = Python(structuralFraming=flatten)  # PythonNet3
# ---------- 不允許結構構架接合.python (35 lines) ----------
# Load the Python Standard and DesignScript Libraries
import sys
import clr
clr.AddReference('ProtoGeometry')
from Autodesk.DesignScript.Geometry import *
from Autodesk.Revit.DB import *
from RevitServices.Transactions import TransactionManager
from RevitServices.Persistence import DocumentManager 

doc = DocumentManager.Instance.CurrentDBDocument

# The inputs to this node will be stored as a list in the IN variables.
dataEnteringNode = IN

# Place your code below this line
structural_framing = UnwrapElement(IN[0])

unjoined_elements = []
# start a Transaction
TransactionManager.Instance.EnsureInTransaction(doc)
# iterate through each structural framing element
for sf in structural_framing:
    # check if the element passed in of Structural Framing Category
    sf_category = sf.Category # get the element's Category
    # use the Structural Framing's Category Id to check
    if sf_category.Id.Value == -2001320:
        # disallow joins at start and end of the structural framing element
        Structure.StructuralFramingUtils.DisallowJoinAtEnd(sf, 0)
        Structure.StructuralFramingUtils.DisallowJoinAtEnd(sf, 1)
        unjoined_elements.append(sf)
TransactionManager.Instance.TransactionTaskDone()

    
# Output the list of elements with Disallowed Join
OUT = unjoined_elements
# ----------------------------------------
