# Dynamo graph Revit Geometry Creation Curves.dyn (Dynamo 4.0.0.3076)
# author: Dynamo Team
# 此圖表示範在 Dynamo 中建立曲線，並使用這些曲線建立 Revit 元素 (模型線) 的幾種方法

# group: 資訊
# note: 此圖表使用幾種方法建立曲線，這些曲線將用作建立 Revit 模型曲線的輸入
# note: Run this graph the Snowdon Towers Sample Architectural.rvt file in the Samples folder located with your Revit installation
# C:\Program Files\Autodesk\Revit 2027\Samples

# group: 四個點
# 描述 <按兩下這裡以編輯群組描述>
number = DoubleInput(-35)
number_2 = DoubleInput(-55)
byCoordinates = Point.ByCoordinates(x=number, y=number_2)
number_3 = DoubleInput(-40)
byCoordinates_2 = Point.ByCoordinates(x=number, y=number_3)
number_4 = DoubleInput(-10)
byCoordinates_3 = Point.ByCoordinates(x=number_4, y=number_3)
number_5 = DoubleInput(-17)
number_6 = DoubleInput(-60)
byCoordinates_4 = Point.ByCoordinates(x=number_5, y=number_6)

list_create = List.Create(item0=byCoordinates, item1=byCoordinates_2, item2=byCoordinates_3, item3=byCoordinates_4)

# group: 從 Nurbs 曲線 (依點) 建立模型曲線
# note: 從點清單建立 NURBS 曲線
byPoints = NurbsCurve.ByPoints(points=list_create)
# note: 使用 NURBS 曲線建立 Revit 模型線
byCurve = ModelCurve.ByCurve(curve=byPoints)

# group: 從 Nurbs 曲線 (依控制點) 建立模型曲線。
boolean = BoolSelector(false)
# note: 從點清單建立 NURBS 曲線做為控制點
byControlPoints = NurbsCurve.ByControlPoints(points=list_create, closeCurve=boolean)
# note: 使用 NURBS 曲線建立 Revit 模型線
byCurve_2 = ModelCurve.ByCurve(curve=byControlPoints)

# group: 從 Polycurve 建立模型曲線
# note: 從點清單建立 Polycurve
byPoints_2 = PolyCurve.ByPoints(points=list_create)
curves = PolyCurve.Curves(polyCurve=byPoints_2)
# note: 使用曲線清單建立一組 Revit 模型線
byCurve_3 = ModelCurve.ByCurve(curve=curves)

# group: 從直線建立模型曲線
# note: 從兩點建立曲線
byStartPointEndPoint = Line.ByStartPointEndPoint(startPoint=byCoordinates, endPoint=byCoordinates_2)
# note: 使用直線 (曲線) 建立 Revit 模型曲線
byCurve_4 = ModelCurve.ByCurve(curve=byStartPointEndPoint)
