# Dynamo graph Revit Geometry Creation Points.dyn (Dynamo 4.0.0.3076)
# author: Dynamo Team
# 此圖表會在概念量體族群環境中建立模型線和參考點。

# group: 資訊
# note: 您可以使用螢幕右上角的按鈕 (Ctrl + B 快速鍵) 在「3D 背景」導覽和「圖表視圖」導覽之間切換。您也可以在 Dynamo 和 Revit 的「視圖」功能表中開啟和關閉「背景預覽」。
# note: Run this graph in a Conceptual Mass or Generic Model Adaptive family environment.
# To create a new family, go to File > New Family > and select the template located in the folder:
# C:\ProgramData\Autodesk\RVT 2027\Family Templates\English-Imperial\Generic Model Adaptive.rft
# note: 此圖表會在族群環境中建立模型線和參考點

# group: 點座標
點_x_值 = DoubleSlider(50, range=5..50 step 5)  # graph input
點_y_值 = DoubleSlider(25, range=5..50 step 5)  # graph input
點_z_值 = DoubleSlider(25, range=5..50 step 5)  # graph input

# note: 在 Dynamo 環境中操控點的位置: 選取 Point.ByCoordinates 節點，然後切換至背景預覽，沿點的三個軸拉動點。
byCoordinates = Point.ByCoordinates(x=點_x_值, y=點_y_值, z=點_z_值)
# note: 可將幾何資料視覺化為文字資訊 3D 空間
watch = Watch(byCoordinates)
byCoordinates_2 = Point.ByCoordinates()
byStartPointEndPoint = Line.ByStartPointEndPoint(startPoint=byCoordinates_2, endPoint=byCoordinates)
# note: 預覽幾何圖形
watch_3d = Watch3D(byStartPointEndPoint)
# note: 透過連接兩點建立模型曲線
byCurve = ModelCurve.ByCurve(curve=byStartPointEndPoint)
# note: Dynamo 只能建立和修改適用於 Dynamo 相關聯檔案的元素。例如，只能在特定族群環境 (例如「自適應通用模型」) 中建立參考點，但幾乎可以在任何地方建立模型線。
byPoint = ReferencePoint.ByPoint(pt=byCoordinates)
