# Dynamo graph Revit Geometry Creation Solids.dyn "Revit 幾何圖形建立實體" (Dynamo 4.0.0.3076)
# author: Dynamo Team
# 此圖表示範在 Dynamo 中建立實體幾何圖形並在 Revit 中整合該實體幾何圖形的幾種方法 - 某些方法可在專案環境中使用，某些方法則只能在特定族群環境 (概念量體) 中使用。

# group: 資訊
# note: 有多種方法可以建立大多數實體。這些範例以「封閉輪廓」當作基礎，但 Polysurface 可以縫合，也有許多基本型 (曲面、立方體、圓錐等) 可用。
# 若要將幾何圖形整合到 Revit 環境，必須先將其轉換為 Revit 元素。
# 實體可以轉換為在專案和模型族群環境中都可見的匯入實體。
# 實體幾何圖形也可以轉換為僅適用於概念量體和自適應元件族群環境的塑形元素。
# note: 此圖表使用幾種方法在 Revit 中建立實體幾何圖形 - 某些方法可在專案環境中使用，某些方法則只能在特定族群環境中使用。
# 請使用概念量體族群樣板檢視所有方法。
# 若要開啟概念量體族群，請移至「檔案」>「新建」>「族群」，選取 Mass.rft 樣板 (\Conceptual Mass\Mass.rft)

# group: 準備點
# 產生一組點來建置幾何圖形
byCoordinates = Point.ByCoordinates()
number = DoubleInput(10)
byCoordinates_2 = Point.ByCoordinates(x=number)
number_2 = DoubleInput(5)
byCoordinates_3 = Point.ByCoordinates(z=number_2)
number_3 = DoubleInput(10)
byCoordinates_4 = Point.ByCoordinates(y=number_3)
number_4 = DoubleInput(15)
byCoordinates_5 = Point.ByCoordinates(x=number_4, y=number_4)
number_5 = DoubleInput(5)
number_6 = DoubleInput(10)
byCoordinates_6 = Point.ByCoordinates(x=number_5, y=number_6, z=number_6)
number_7 = DoubleInput(-2)
number_8 = DoubleInput(5)
byCoordinates_7 = Point.ByCoordinates(x=number_7, y=number_8)

# group: 第一個輪廓
# 從弧和直線建立第一個輪廓做為封閉曲線
byStartPointEndPoint = Line.ByStartPointEndPoint(startPoint=byCoordinates, endPoint=byCoordinates_2)
byThreePoints = Arc.ByThreePoints(firstPoint=byCoordinates, secondPoint=byCoordinates_3, thirdPoint=byCoordinates_2)
create = List.Create(item0=byStartPointEndPoint, item1=byThreePoints)
# note: 斷面混成的第一個輪廓
byJoinedCurves = PolyCurve.ByJoinedCurves(curves=create)

# group: 第二個輪廓
# 從弧和直線建立第二個輪廓做為封閉曲線
byStartPointEndPoint_2 = Line.ByStartPointEndPoint(startPoint=byCoordinates_4, endPoint=byCoordinates_5)
byThreePoints_2 = Arc.ByThreePoints(firstPoint=byCoordinates_4, secondPoint=byCoordinates_6, thirdPoint=byCoordinates_5)
create_2 = List.Create(item0=byStartPointEndPoint_2, item1=byThreePoints_2)
# note: 斷面混成的第二個輪廓
byJoinedCurves_2 = PolyCurve.ByJoinedCurves(curves=create_2)

# note: 接合清單中的兩個輪廓
create_3 = List.Create(item0=byJoinedCurves, item1=byJoinedCurves_2)

# group: 透過斷面建立實體斷面混成
# 描述 <按兩下這裡以編輯群組描述>
byLoft = Solid.ByLoft(crossSections=create_3)

# note: 調查實體體積
volume = Solid.Volume(solid=byLoft)

# group: 建立薄殼
code_block = CodeBlock { 0; }
# note: 秘訣：關閉節點右鍵功能表中的「預覽」，以從展示中排除元素
thinShell = Solid.ThinShell(solid=byLoft, internalFaceThickness=code_block)

# group: 平移幾何圖形
code_block_2 = CodeBlock { Vector.ByCoordinates(20,0,0); }
# note: 將幾何圖形平移到旁邊，以預覽原始結果和最終結果
translate = Geometry.Translate(geometry=thinShell, direction=code_block_2)

# group: 修剪實體
# 使用「修剪」作業以平面切割薄殼實體。
code_block_3 = CodeBlock { Point.ByCoordinates(0,0,5); }
ZAxis = Vector.ZAxis()
byOriginNormal = Plane.ByOriginNormal(origin=code_block_3, normal=ZAxis)
number_9 = DoubleInput(10)
# note: 選擇修剪時要保留的一側 (將捨棄最接近點的一側)。
byCoordinates_8 = Point.ByCoordinates(x=number_9, y=number_9, z=number_9)
# note: 幾何布林運算 (交集、差集、聯集等) 均可在幾何圖形品類中使用。
trim = Geometry.Trim(geometry=translate, other=byOriginNormal, pick=byCoordinates_8)

# group: 導引曲線
# 建立 NURBS 曲線，以用作斷面混成實體造型的導引曲線
create_4 = List.Create(item0=byCoordinates, item1=byCoordinates_7, item2=byCoordinates_4)
# note: 以 NURBS 曲線建構的導引曲線
byPoints = NurbsCurve.ByPoints(points=create_4)

# group: 透過斷面和導引曲線建立實體斷面混成
# note: 秘訣：關閉節點右鍵功能表中的「預覽」，以從展示中排除元素
byLoft_2 = Solid.ByLoft(crossSections=create_3, guideCurves=byPoints)

# group: 建立匯入實體
code_block_4 = CodeBlock { Vector.ByCoordinates(-20,0,0); }
translate_2 = Geometry.Translate(geometry=byLoft_2, direction=code_block_4)
# note: 幾何圖形與 Revit 元素不相同:
# 使用 ImportInstance。若要在任何 Revit 環境中從曲面和實體建立 Revit 匯入，請使用點和曲線來放置族群實體，或建立「大量形式」及「依點的一般模型」(自適應元件) 族群
byGeometries = ImportInstance.ByGeometries(geometries=translate_2)
byCoordinates_9 = Vector.ByCoordinates()

# group: 建立塑形
# 使用兩個輪廓曲線迴路，建立塑形元素 (在概念量體族群環境中)
curves = PolyCurve.Curves(polyCurve=create_3)
# note: 從曲線建立模型曲線
referenceCurveByCurve = ModelCurve.ReferenceCurveByCurve(curve=curves)
# note: 只能將塑形建立為概念量體族群的一部分
byLoftCrossSections = Form.ByLoftCrossSections(curves=referenceCurveByCurve)
