# Dynamo graph Revit Geometry Creation Surfaces.dyn "Revit 幾何圖形建立曲面" (Dynamo 4.0.0.3076)
# author: Dynamo Team
# 此圖表示範在 Dynamo 中建立曲面的幾種方法，以及將幾何圖形轉換為 Revit 幾何圖形的兩種方法。

# group: 資訊
# note: 此圖表使用幾種方法在 Revit 中建立曲面幾何圖形 - 某些方法可在專案環境中使用，某些方法則只能在特定族群環境中使用。
# 請使用概念量體族群樣板檢視所有方法。
# 請移至「檔案」>「新建」>「族群」，選取「Conceptual Mass」資料夾中的 Mass.rft 樣板，建立概念量體族群。
# note: 有多種方法可以建立大多數曲面。曲面、Polysurface (曲面集合) 和 NURBS 曲面可以透過點、曲線建立，也可以從其他曲面和實體透過各種作業衍生。
# note: 若要將幾何圖形整合到 Revit 環境，必須先將其轉換為 Revit 元素。
# 曲面和實體可以轉換為在專案和模型族群環境中都可見的匯入實體。
# 曲面幾何圖形也可以轉換為僅適用於概念量體和自適應元件族群環境的塑形元素。

# group: 準備點
# 產生一組點來建置幾何圖形
number = DoubleInput(10)
byCoordinates = Point.ByCoordinates(y=number)
number_2 = DoubleInput(5)
number_3 = DoubleInput(10)
byCoordinates_2 = Point.ByCoordinates(x=number_2, y=number_3, z=number_3)
number_4 = DoubleInput(15)
byCoordinates_3 = Point.ByCoordinates(x=number_4, y=number_4)
byCoordinates_4 = Point.ByCoordinates()
number_5 = DoubleInput(5)
byCoordinates_5 = Point.ByCoordinates(z=number_5)
byCoordinates_6 = Point.ByCoordinates(x=number)
number_6 = DoubleInput(-5)
number_7 = DoubleInput(5)
byCoordinates_7 = Point.ByCoordinates(x=number_6, y=number_7)
number_8 = DoubleInput(10)
number_9 = DoubleInput(-10)
byCoordinates_8 = Point.ByCoordinates(x=number_8, y=number_9)
byCoordinates_9 = Point.ByCoordinates(y=number_9)

# group: 建立輪廓
byThreePoints = Arc.ByThreePoints(firstPoint=byCoordinates, secondPoint=byCoordinates_2, thirdPoint=byCoordinates_3)
byThreePoints_2 = Arc.ByThreePoints(firstPoint=byCoordinates_4, secondPoint=byCoordinates_5, thirdPoint=byCoordinates_6)
byThreePoints_3 = Arc.ByThreePoints(firstPoint=byCoordinates_4, secondPoint=byCoordinates_7, thirdPoint=byCoordinates)
byStartPointEndPoint = Line.ByStartPointEndPoint(startPoint=byCoordinates_8, endPoint=byCoordinates_9)

# group: 透過掃掠建立曲面
# 使用輪廓、路徑曲線和導引軌跡建立掃掠曲面
bySweep2Rails = Surface.BySweep2Rails(path=byThreePoints, guideRail=byThreePoints_2, profile=byThreePoints_3)

# group: 建立匯入
# note: 使用「匯入實體」從曲面和實體建立 Revit 匯入 - 在任何 Revit 環境中都可以看見這些項目。
byGeometries = ImportInstance.ByGeometries(geometries=bySweep2Rails)

create = List.Create(item0=byStartPointEndPoint, item1=byThreePoints_2)

# group: 透過斷面混成建立曲面
# 接合斷面以建立斷面混成曲面
byLoft = Surface.ByLoft(crossSections=create)

# group: 演算表面積
area = Surface.Area(surface=byLoft)
watch = Watch(area)
create_2 = List.Create(item0=byLoft, item1=bySweep2Rails)
# note: 接合為 Polysurface 的曲面可以做為單一圖元來演算
byJoinedSurfaces = PolySurface.ByJoinedSurfaces(surfaces=create_2)
area_2 = Surface.Area(surface=byJoinedSurfaces)
watch_2 = Watch(area_2)
area_3 = Surface.Area(surface=bySweep2Rails)
watch_3 = Watch(area_3)

# group: 從控制點建立 NURBS 曲面
# 從控制點將掃掠轉換為 NURBS 曲面
code_block = CodeBlock { 0..1..0.1; }
# note: 使用適用於幾何圖形的「動作」，可以從曲面衍生邊、點和其他特徵。
pointAtParameter = Surface.PointAtParameter(surface=bySweep2Rails, u=code_block, v=code_block, lacing=CrossProduct)
# note: 從控制點將曲面重新建構為 NURBS 曲面
byControlPoints = NurbsSurface.ByControlPoints(controlVertices=pointAtParameter)
# note: 使用 Watch 3D 節點以隔離方式預覽幾何圖形
watch_3d = Watch3D(byControlPoints)

# group: 透過擠出曲線建立曲面
# 使用曲線建立具有給定距離的擠出
code_block_2 = CodeBlock { 10; }
extrude = Curve.Extrude(curve=byThreePoints, distance=code_block_2)

# group: 建立塑形
# 從兩條曲線建立斷面混成造型
referenceCurveByCurve = ModelCurve.ReferenceCurveByCurve(curve=create)
byLoftCrossSections = Form.ByLoftCrossSections(curves=referenceCurveByCurve)
