# Dynamo graph Revit Import Solid.dyn (Dynamo 4.0.0.3076)
# author: Dynamo Team
# 此圖表示範建立 Dynamo 實體幾何圖形，並使用該幾何圖形建立 Revit 匯入實體元素的方法。透過建立一系列弧輪廓，並使用這些輪廓建立斷面混成曲面，來建構新的屋頂造型。

# group: 資訊
# note: 已從 Revit 預先選取來源元素 (屋頂)，元素 ID 會隨 Dynamo 檔案一起儲存
# note: Run this graph the Snowdon Towers Sample Architectural.rvt file in the Samples folder located with your Revit installation
# C:\Program Files\Autodesk\Revit 2027\Samples
# note: 透過建立一系列弧輪廓，並使用這些輪廓建立斷面混成曲面，從選取的屋頂元素建構新屋頂造型。幾何圖形會轉換為匯入實體，以將其整合到 Revit 環境

# group: 新的屋頂規劃
# note: 將從中建立斷面混成曲面的輪廓數
輪廓數 = IntegerSlider(6, range=3..10 step 1)
# note: 新屋頂短端的高度
屋頂剖面最小值 = DoubleSlider(2.1, range=1..5 step 0.1)
# note: 屋頂中央的高度
屋頂剖面最大值 = DoubleSlider(7, range=5..10 step 0.1)
# note: 將弧輪廓向側邊延伸此值
屋頂側延伸 = DoubleSlider(0.5, range=0.1..3 step 0.1)
# note: 新屋頂造型的厚度
屋頂厚度 = DoubleSlider(0.5, range=0.1..2 step 0.1)

輪廓數_2 = CodeBlock(steps=輪廓數) { steps; }

# group: 選取屋頂
# 選取來源屋頂元素
# note: 從 Dynamo 播放器可以設定標記為「IsInput」的所有輸入
選取平屋頂 = DSModelElementSelection()  # 1 picked in the model

# group: 取得屋頂面
# 分解來源元素的幾何圖形並點選面積最大的一面
# note: 若要取得所選元素的面，請先取得其幾何圖形
# note: 按一下右鍵並取消勾選「預覽幾何圖形」，更清楚地檢視最終結果
getGeometry = Element.GetGeometry(element=選取平屋頂)
# note: 分解幾何圖形以取得個別面
explode = Geometry.Explode(geometry=getGeometry)
# note: 處置清單結構。請注意，如果使用多個來源物件，則不需要此步驟
flatten = List.Flatten(list=explode)
area = Surface.Area(surface=flatten)
# note: 依面積排序曲面清單。面積最大的曲面是 sortedList 輸出清單中的最後一個項目
sortByKey = List.SortByKey(list=flatten, keys=area)
lastItem = List.LastItem(list=sortByKey.sortedList)
number = DoubleInput(1.5)
# note: 向上平移曲面
translate = Geometry.Translate(geometry=lastItem, zTranslation=number)

# group: 向外偏移 (比例)
# 調整曲面比例以向外延伸其邊
uv_位置 = CodeBlock { 0.5; }
pointAtParameter = Surface.PointAtParameter(surface=translate, u=uv_位置, v=uv_位置)
透過兩點調整比例 = CodeBlock { point1 = Point.ByCoordinates(1, 1); point2 = Point.ByCoordinates(-40, -40); }
scale = Geometry.Scale(geometry=translate, basePoint=pointAtParameter, from=透過兩點調整比例.point1, to=透過兩點調整比例.point2)

# group: 曲面上的點
# 產生三個等距的點清單 - 兩列沿較長邊，一列在中間
# note: 0 和 1 是沿著曲面較長邊的位置
邊列的_u_位置 = CodeBlock { [0,1]; }
# note: V 是沿著較長邊，在一個從 0 到 1 的序列中 N 個步長的位置
邊列的_v_位置 = CodeBlock(steps=輪廓數_2) { [0..1..#steps]; }
# note: 在節點上按一下右鍵 >「交織」，使用「最長交織」設定。
# 最長交織會讓輸入配合不同清單結構。在此案例中，結果將是兩個點清單，每個清單中的點數與最長輸入清單相符。
pointAtParameter_2 = Surface.PointAtParameter(surface=scale, u=邊列的_u_位置, v=邊列的_v_位置, lacing=Longest)
# note: U 值 0.5 會把點定位在曲面中點
中間列的_u_位置 = CodeBlock { [0.5]; }
# note: V 是沿著點的中間列，在一個從 0 到 1 的序列中 N 個步長的位置
中間列的_v_位置 = CodeBlock(steps=輪廓數_2) { [0..1..#steps]; }
# note: 此節點使用「最長交織」。結果是一個點清單，清單中的點數與最長輸入清單相符。
pointAtParameter_3 = Surface.PointAtParameter(surface=scale, u=中間列的_u_位置, v=中間列的_v_位置, lacing=Longest)

# group: 向上偏移點
# 以餘弦波形偏移中間列的點
# note: 產生一系列偏移的一系列值
角度序列 = CodeBlock(steps=輪廓數_2) { -1..1..#steps; }
# note: 替代方法: 對不同屋頂造型使用正弦
sin = Math.Sin(angle=角度序列)
# note: 餘弦波的值
cos = Math.Cos(angle=角度序列)
# note: 將值重新對映至新資料範圍
remapRange = Math.RemapRange(numbers=cos, newMin=屋頂剖面最小值, newMax=屋頂剖面最大值)
# note: 平移中間列的點
translate_2 = Geometry.Translate(geometry=pointAtParameter_3@L2, zTranslation=remapRange)

# group: 從弧建立輪廓
# 使用點建立弧
# note: 將邊和中間列接合成一個清單中
join = List.Join(list0=pointAtParameter_2, list1=translate_2)
項目索引 = CodeBlock { 0; 1; 2; }
getItemAtIndex = List.GetItemAtIndex(list=join, index=項目索引.out0)
getItemAtIndex_2 = List.GetItemAtIndex(list=join, index=項目索引.out2)
getItemAtIndex_3 = List.GetItemAtIndex(list=join, index=項目索引.out1)
byThreePoints = Arc.ByThreePoints(firstPoint=getItemAtIndex, secondPoint=getItemAtIndex_2, thirdPoint=getItemAtIndex_3)

# group: 延伸輪廓
# 將每個輪廓的曲線延伸給定距離
# note: 延伸的值會設定為圖表左側的輸入。
延伸邊 = CodeBlock(roof_extension=屋頂側延伸) { roof_extension; }
extendStart = Curve.ExtendStart(curve=byThreePoints, distance=延伸邊)
extendEnd = Curve.ExtendEnd(curve=extendStart, distance=延伸邊)

# group: 斷面混成和增厚
# 建立斷面混成曲面並為其指定厚度
byLoft = Surface.ByLoft(crossSections=extendEnd)
thicken = Surface.Thicken(surface=byLoft, thickness=屋頂厚度)

# group: 到 Revit:
# 透過 ImportInstance 和 Set Level 參數，將 Dynamo 幾何圖形轉換為 Revit 元素
# note: 若要將幾何圖形整合到 Revit 環境，必須先將其轉換為 Revit 元素。
# 實體可以轉換為在專案和模型族群環境中都可見的匯入實體。
byGeometry = ImportInstance.ByGeometry(geometry=thicken)
code_block = CodeBlock { "工作平面"; }
levels = Levels("L1 - Block 43")
# note: 透過將「工作平面」參數設定為高程符合「內部原點」位置的樓層，修正所放置匯入實體的高度。
setParameterByName = Element.SetParameterByName(element=byGeometry, parameterName=code_block, value=levels)
