# Dynamo graph Revit Place Families By Level Set Parameters.dyn (Dynamo 4.0.0.3076)
# author: Dynamo Team
# 此圖表示範如何按點放置 Revit 元素。在選取的房間中放置多排椅子，並在「標記參數」中寫入唯一的編號

# group: 資訊
# note: Run this graph the Snowdon Towers Sample Architectural.rvt file in the Samples folder located with your Revit installation
# C:\Program Files\Autodesk\Revit 2027\Samples
# note: 在選取的房間中放置多排椅子，並在「標記參數」中寫入唯一的編號

# group: 選取 Revit 元素
# note: 從專案中的族群類型，為要放置的實體選取族群類型
family_types = FamilyTypes("Chair-Breuer:Chair-Breuer")  # graph input
# note: 選取要放置元素的房間。您必須導覽至可看見房間的視圖 (樓板平面圖)
選取房間 = DSModelElementSelection()  # 1 picked in the model; graph input
圓半徑 = DoubleSlider(6.4, range=5..8 step 0.1)  # graph input
# note: 選取要放置元素的樓層
levels = Levels("L3")  # graph input

# group: 設定列偏移
# 列偏移的值不是距離，而是 U 和 V 值
列起點 = DoubleSlider(0.3, range=0..3 step 0.1)  # graph input
列終點 = DoubleSlider(2.2, range=0..3 step 0.1)  # graph input
一列的椅子數 = IntegerSlider(8, range=2..12 step 1)  # graph input
第一列位置 = DoubleSlider(0.2, range=0..3 step 0.1)  # graph input
最後一列位置 = DoubleSlider(1.4, range=0..3 step 0.1)  # graph input
列間距 = DoubleSlider(0.35, range=0.15..1 step 0.05)  # graph input

# group: 產生列偏移
# 對應到曲面上 U 和 V 位置的一系列數字。值可以超出 0 到 1 的範圍
# note: 透過定義序列開始值、結束值和步數建立序列的替代方法
列偏移序列 = CodeBlock(start=列起點, finish=列終點, steps=一列的椅子數) { start..finish..#steps; }
# note: 在一個範圍內，使用給定的步長，產生一系列數字
range = Range(start=第一列位置, end=最後一列位置, step=列間距)

# group: 準備位置點
# 描述 <按兩下這裡以編輯群組描述>
# note: 所選房間的放置點
location = Room.Location(room=選取房間)
# note: 定義初始放置區域的圓。在此情況下，圓的形狀無關緊要，但這是定義封閉曲面最快的方式
byCenterPointRadius = Circle.ByCenterPointRadius(centerPoint=location, radius=圓半徑)
# note: 將圓轉換為曲面，以便用於定位點
patch = Curve.Patch(curve=byCenterPointRadius)
# note: 使用 U 和 V 值的序列，建立一個點矩陣。按一下右鍵並選取「交織」，將節點的交織設定為「笛卡兒積」。
pointAtParameter = Surface.PointAtParameter(surface=patch, u=列偏移序列, v=range, lacing=CrossProduct)

# group: 到 Revit: 放置族群實體
# note: 放置族群例證
# 大多數族群也可以透過點位置來放置。自適應元件可以搭配多個點放置，而結構框架會搭配曲線放置
byPointAndLevel = FamilyInstance.ByPointAndLevel(familyType=family_types, point=pointAtParameter, level=levels)

# note: 處置清單結構 - 取得一個包含所有項目的清單
flatten = List.Flatten(list=byPointAndLevel)

# group: 標記字首
# 為放置元素的標記號碼使用自訂字首
標記字首 = StringInput("C-")  # graph input

# group: 產生標記號碼
number = DoubleInput(1)
# note: 計算清單中的項目數
count = List.Count(list=flatten)
# note: 產生從 1 到 n 的數字
sequence = Sequence(start=number, amount=count, step=number, lacing=Longest)
# note: 若要參與字串運算，必須先將數字轉換為字串
string_from_object = FromObject(obj=sequence)
索引 = CodeBlock { 0; }
# note: 在項目號碼插入自訂字首
insert = String.Insert(string=string_from_object, index=索引, toInsert=標記字首)

# group: 到 Revit: 設定參數值
string = StringInput("標記")
# note: 使用值清單設定「標記」參數。元素輸入和值輸入的清單結構必須相符，也可以只用一個值。使用 Element.GetParameterByName 節點也可以讀取參數
setParameterByName = Element.SetParameterByName(element=flatten, parameterName=string, value=insert)

# group: 檢查結果
# note: 您可以使用 Watch 節點查看結果是否如預期
watch = Watch(insert)  # graph output
