# Dynamo graph Revit Structural Framing.dyn (Dynamo 4.0.0.3076)
# author: Dynamo Team
# 此圖表會相對於所選 Revit 樓板建立結構構架或柱的結構。

# group: 資訊
# note: 相對於 Revit 模型中選取的元素放置結構構架的樑和柱。
# note: Run this graph the Snowdon Towers Sample Architectural.rvt file in the Samples folder located with your Revit installation
# C:\Program Files\Autodesk\Revit 2027\Samples

# group: 輸入
# note: 選取要相對其建立新藤架結構的 Revit 樓板元素
選取來源樓板 = DSModelElementSelection()  # 1 picked in the model; graph input
# note: 結構高度
高度 = DoubleSlider(8.4, range=0..10 step 0.1)  # graph input
樑數 = IntegerSlider(9, range=2..10 step 1)  # graph input
# note: 選取要放置結構的樓層
結構樓層 = Levels("L1 - Block 43")  # graph input
# note: 選取周圍樑的構架類型。此類型也將用於建立新的結構構架類型
structural_framing_types = StructuralFramingTypes("W12X26")  # graph input
# note: 選取已建立柱的族群類型
結構柱類型 = StructuralColumnTypes(index=0)  # graph input

# group: 準備幾何圖形
# 為所選元素的幾何圖形準備清楚的實體表示式
# note: 取得 Revit 元素的幾何圖形
getGeometry = Element.GetGeometry(element=選取來源樓板)
# note: 若要快速捨棄元素開口，請取得其邊界框 (包含元素的虛擬立方體)
byMinimumVolume = BoundingBox.ByMinimumVolume(geom=getGeometry)
# note: 對實體可做的動作比對邊界框多。若要允許進一步轉換，請先將邊界框轉換為立方體 (是實體類型)
toCuboid = BoundingBox.ToCuboid(boundingBox=byMinimumVolume)
# note: 將實體立方體平移圖表「輸入」區段中以「數值滑棒」設定的高度 (zTranslation)
translate = Geometry.Translate(geometry=toCuboid, zTranslation=高度)

# group: 取得實體的頂部曲面
# 依中心的高程演算所有實體曲面，並取得頂部曲面
# note: 將實體分解成曲面
explode = Geometry.Explode(geometry=translate)
code_block = CodeBlock { 0.5; }
# note: 找出曲面中心點
pointAtParameter = Surface.PointAtParameter(surface=explode, u=code_block, v=code_block)
# note: 取得每個中心點高程的數值
Z = Point.Z(point=pointAtParameter)
# note: 依另一個清單排序清單: 使用高程值排序曲面
sortByKey = List.SortByKey(list=explode, keys=Z)
# note: 清單中最後一個曲面是頂部曲面
lastItem = List.LastItem(list=sortByKey.sortedList)

# group: 在曲面上偏移一系列點
# note: 使用簡單公式，在最小值 (0.1) 到最大值 (0.9) 之間建立有「n」個步長數的一系列值
u_值的序列 = CodeBlock(n=樑數) { 0.1..0.9..#n; }
邊偏移 = CodeBlock { [0.1,0.9]; }
# note: 使用 U 和 V 參數在曲面上定位點陣列。使用笛卡兒積交織 (在節點上按一下右鍵，然後選擇「交織」) 產生陣列。
pointAtParameter_2 = Surface.PointAtParameter(surface=lastItem, u=u_值的序列, v=邊偏移, lacing=CrossProduct)

# group: 建立內部樑的直線
# 連接點並建立直線
索引 = CodeBlock { 0; 1; }
# note: 按一下「使用層級」之「list」輸入旁的 > 符號。這表示結果將是每個最低巢狀清單 (@L2) 中索引 0 的項目
getItemAtIndex = List.GetItemAtIndex(list=pointAtParameter_2@L2, index=索引.out0)
getItemAtIndex_2 = List.GetItemAtIndex(list=pointAtParameter_2@L2, index=索引.out1)
byStartPointEndPoint = Line.ByStartPointEndPoint(startPoint=getItemAtIndex, endPoint=getItemAtIndex_2)

# group: 周圍樑的曲線
# 描述 <按兩下這裡以編輯群組描述>
firstItem = List.FirstItem(list=pointAtParameter_2)
lastItem_2 = List.LastItem(list=pointAtParameter_2)
byStartPointEndPoint_2 = Line.ByStartPointEndPoint(startPoint=firstItem, endPoint=lastItem_2)

# group: 柱的曲線
# 取得每個第二列的點，建立用來放置柱的線
code_block_2 = CodeBlock { 2; }
# note: 將清單分為 2 個清單
chop = List.Chop(list=pointAtParameter_2, lengths=code_block_2)
# note: 使用清單層級邏輯，只取得 @L3 的第一個清單
firstItem_2 = List.FirstItem(list=chop@L3)
反轉高度 = CodeBlock(H=高度) { -H; }
# note: 將點向下平移回去
translate_2 = Geometry.Translate(geometry=firstItem_2, zTranslation=反轉高度)
# note: 連接點以建立直線
byStartPointEndPoint_3 = Line.ByStartPointEndPoint(startPoint=translate_2, endPoint=firstItem_2)

# group: 到 Revit: 依曲線放置樑
# note: 放置內部樑
beamByCurve = StructuralFraming.BeamByCurve(curve=byStartPointEndPoint, level=結構樓層, structuralFramingType=structural_framing_types)
# note: 放置周圍樑
beamByCurve_2 = StructuralFraming.BeamByCurve(curve=byStartPointEndPoint_2, level=結構樓層, structuralFramingType=structural_framing_types)
# note: 放置結構柱
columnByCurve = StructuralFraming.ColumnByCurve(curve=byStartPointEndPoint_3, level=結構樓層, structuralColumnType=結構柱類型)
