# Dynamo graph Collect All Elements Of Category And Get Parameters.dyn "Shromáždit všechny prvky kategorie a získat parametry" (Dynamo 3.4.0.6892)
# author: Autodesk
# Shromáždí všechny prvky vybrané kategorie (výchozí pro místnosti) a získá hodnotu Plocha místnosti všech prvků

# note: Vybrat kategorii aplikace Revit
kategorie = Categories("OST_Rooms")
# note: Shromáždit všechny prvky vybrané kategorie
všechny_prvky_kategorie = ElementsOfCategory(Category=kategorie)
# note: Zadejte název parametru a ujistěte se, že zohledňujete velká a malá písmena
string = StringInput("Plocha")
# note: Získat hodnoty parametrů z možnosti Prvky podle kategorie přes název parametru
getParameterValueByName = Element.GetParameterValueByName(element=všechny_prvky_kategorie, parameterName=string)
