# Dynamo graph CollectAllElementsOfCategory.dyn (Dynamo 3.0.3.7597)
# author: Autodesk
# Shromáždí všechny prvky vybrané kategorie (výchozí pro místnosti)

# note: Vybrat kategorii aplikace Revit
kategorie = Categories("OST_Rooms")
# note: Shromáždit všechny prvky vybrané kategorie
všechny_prvky_kategorie = ElementsOfCategory(Category=kategorie)
# note: Sledovat výsledky shromažďování všech prvků vybrané kategorie
watch = Watch(všechny_prvky_kategorie)
