# Dynamo graph Export Data To Excel.dyn "Exportovat data do aplikace Excel" (Dynamo 3.4.0.6892)
# author: Autodesk
# Exportuje data do aplikace Excel podle názvu vybraného výkresu. Bude nutné připojit data k exportu.

# note: Přejít k souboru aplikace Excel, do kterého se mají exportovat data
file_path = Filename("Není vybrán žádný soubor.")
# note: Zadejte název výkresu, berte však ohled na velikost písmen
string = StringInput("")
# note: Exportovat data aplikace Excel pomocí formátu OpenXML z vybraného názvu výkresu
openXMLExportExcel = Data.OpenXMLExportExcel(filePath=file_path, sheetName=string)  # unwired: data
