# Dynamo graph Get Geometry For All Elements Of Category.dyn "Získat geometrii pro všechny prvky kategorie" (Dynamo 4.0.0.3277)
# author: Autodesk
# Shromáždí všechny prvky vybrané kategorie (výchozí nastavení na Dveře) a získá geometrie všech prvků

# note: Vybrat kategorii aplikace Revit
# note: Doporučujeme, abyste uložili graf s kategorií, která bude v modelech existovat, aby se nezobrazovalo upozornění.
# Zkuste například uložit a spustit graf s kategorií Dveře ve vzorovém modelu Snowdon Towers Sample Architectural.rvt, available at:
# C:\Program Files\Autodesk\<Revit ....>\Samples
kategorie = Categories("OST_Doors")
# note: Shromáždit všechny prvky vybrané kategorie
všechny_prvky_kategorie = ElementsOfCategory(Category=kategorie)
# note: Získá geometrii všech shromážděných prvků tam, kde je to možné. Pokud v aplikaci Revit chybí nějaké prvky nebo pokud je geometrie neřešitelná, může vrátit upozornění a hodnotu null.
geometry = Element.Geometry(element=všechny_prvky_kategorie)
