# Dynamo graph GetGeometryForAllElementsOfCategory.dyn (Dynamo 3.0.3.7597)
# author: Autodesk
# Shromáždí všechny prvky vybrané kategorie (výchozí nastavení na Dveře) a získá geometrie všech prvků

# note: Vybrat kategorii aplikace Revit
kategorie = Categories("OST_Doors")
# note: Shromáždit všechny prvky vybrané kategorie
všechny_prvky_kategorie = ElementsOfCategory(Category=kategorie)
# note: Získá geometrii všech shromážděných prvků tam, kde je to možné. Pokud v aplikaci Revit chybí nějaké prvky nebo pokud je geometrie neřešitelná, může vrátit upozornění a hodnotu null.
geometry = Element.Geometry(element=všechny_prvky_kategorie)
