# Dynamo graph ImportDataFromExcel.dyn (Dynamo 3.0.3.7597)
# author: Autodesk
# Importuje data ze souboru aplikace Excel a transponuje data, čímž převrátí sloupce a řádky

# note: Přejít k souboru aplikace Excel, ze kterého se mají importovat data
file_path = Filename("Není vybrán žádný soubor.")
# note: Zadejte název výkresu, berte však ohled na velikost písmen
string = StringInput("")
# note: Import dat aplikace Excel pomocí formátu OpenXML z vybraného názvu výkresu
openXMLImportExcel = Data.OpenXMLImportExcel(filePath=file_path, sheetName=string)
# note: Transpozice dat aplikace Excel k převrácení řádků a sloupců
transpose = List.Transpose(lists=openXMLImportExcel)
watch = Watch(transpose)
