# Dynamo graph Read Image From File.dyn "Načíst obrázek ze souboru" (Dynamo 4.0.0.3277)
# author: Autodesk
# Načte obrázek z disku, se kterým bude možné pracovat v aplikaci Dynamo

# note: Přejít k souboru obrázku k importu
file_path = Filename("Není vybrán žádný soubor.")
# note: Načíst soubor obrázku z disku do paměti aplikace Dynamo
soubor_z_cesty = FileObject(path=file_path)
# note: Načíst obrázek ze souboru v paměťovém prostoru aplikace Dynamo ve formátu rastru
readFromFile = Image.ReadFromFile(file=soubor_z_cesty)
# note: Sledovat obrázek kvůli vizuální kontrole
sledovat_obrázek = WatchImageCore(image=readFromFile)
