# Dynamo graph Collect All Elements Of Category.dyn "Alle Elemente der Kategorie sammeln" (Dynamo 4.0.0.3277)
# author: Autodesk
# Alle Elemente einer ausgewählten Kategorie sammeln (vorgabemäßig auf Räume eingestellt)

# note: Revit-Kategorie auswählen
kategorien = Categories("OST_Rooms")
# note: Alle Elemente der ausgewählten Kategorie sammeln
alle_elemente_der_kategorie = ElementsOfCategory(Category=kategorien)
# note: Ergebnisse der Sammlung aller Elemente einer ausgewählten Kategorie anzeigen
watch = Watch(alle_elemente_der_kategorie)
