# Dynamo graph CollectAllElementsOfCategoryAndGetParameters.dyn (Dynamo 3.0.3.7597)
# author: Autodesk
# Alle Elemente einer ausgewählten Kategorie sammeln (vorgabemäßig auf Räume eingestellt) und Raumfläche der einzelnen Elemente abrufen

# note: Revit-Kategorie auswählen
kategorien = Categories("OST_Rooms")
# note: Alle Elemente der ausgewählten Kategorie sammeln
alle_elemente_der_kategorie = ElementsOfCategory(Category=kategorien)
# note: Parameternamen eingeben und sicherstellen, dass die Groß- und Kleinschreibung berücksichtigt wird
string = StringInput("Fläche")
# note: Parameterwerte aus Elementen nach Kategorie über einen Parameternamen abrufen
getParameterValueByName = Element.GetParameterValueByName(element=alle_elemente_der_kategorie, parameterName=string)
