# Dynamo graph ExportDataToExcel.dyn (Dynamo 3.0.3.7597)
# author: Autodesk
# Exportieren Sie Daten nach Excel, wenn ein Planname ausgewählt wurde. Sie müssen die zu exportierenden Daten verbinden

# note: Zu Excel-Datei navigieren, in die Daten exportiert werden sollen
file_path = Filename("Keine Datei ausgewählt.")
# note: Plannamen eingeben, die Groß- und Kleinschreibung jedoch beachten
string = StringInput("")
# note: Excel-Daten im OpenXML-Format aus einem ausgewählten Plannamen exportieren
openXMLExportExcel = Data.OpenXMLExportExcel(filePath=file_path, sheetName=string)  # unwired: data
