# Dynamo graph Get Geometry For All Elements Of Category.dyn "Geometrie für alle Elemente der Kategorie abrufen" (Dynamo 3.4.0.6892)
# author: Autodesk
# Alle Elemente einer ausgewählten Kategorie sammeln (vorgabemäßig auf Türen eingestellt) und Geometrie der einzelnen Elemente abrufen

# note: Revit-Kategorie auswählen
# note: Es wird empfohlen, das Diagramm mit einer Kategorie zu speichern, die wahrscheinlich in Ihren Modellen vorhanden ist, um eine Warnung zu vermeiden.
# Versuchen Sie beispielsweise, das Diagramm mit der Kategorie Türen im Beispielmodell Snowdon Towers Sample Architectural.rvt zu speichern und auszuführen, das unter folgendem Link verfügbar ist:
# C:\Programme\Autodesk\<Revit ....>\Samples
kategorien = Categories("OST_Doors")
# note: Alle Elemente der ausgewählten Kategorie sammeln
alle_elemente_der_kategorie = ElementsOfCategory(Category=kategorien)
# note: Rufen Sie die Geometrie aller gesammelten Elemente ab, wo möglich. Es wird möglicherweise eine Warnung ausgegeben, und null wird zurückgegeben, wenn in Revit Daten fehlen oder die Geometrie nicht auflösbar ist
geometry = Element.Geometry(element=alle_elemente_der_kategorie)
