# Dynamo graph GetGeometryForAllElementsOfCategory.dyn (Dynamo 3.0.3.7597)
# author: Autodesk
# Alle Elemente einer ausgewählten Kategorie sammeln (vorgabemäßig auf Türen eingestellt) und Geometrie der einzelnen Elemente abrufen

# note: Revit-Kategorie auswählen
kategorien = Categories("OST_Doors")
# note: Alle Elemente der ausgewählten Kategorie sammeln
alle_elemente_der_kategorie = ElementsOfCategory(Category=kategorien)
# note: Rufen Sie die Geometrie aller gesammelten Elemente ab, wo möglich. Es wird möglicherweise eine Warnung ausgegeben, und null wird zurückgegeben, wenn in Revit Daten fehlen oder die Geometrie nicht auflösbar ist
geometry = Element.Geometry(element=alle_elemente_der_kategorie)
