# Dynamo graph Import Data From Excel.dyn "Daten aus Excel importieren" (Dynamo 4.0.0.3277)
# author: Autodesk
# Daten aus einer Excel-Datei importieren und die Daten zum Umkehren von Spalten und Zeilen umstellen

# note: Zu Excel-Datei navigieren, aus der Daten importiert werden sollen
file_path = Filename("Keine Datei ausgewählt.")
# note: Plannamen eingeben, die Groß- und Kleinschreibung jedoch beachten
string = StringInput("")
# note: Excel-Daten im OpenXML-Format von einem ausgewählten Plannamen importieren
openXMLImportExcel = Data.OpenXMLImportExcel(filePath=file_path, sheetName=string)
# note: Excel-Daten zum Umkehren von Zeilen und Spalten umstellen
transpose = List.Transpose(lists=openXMLImportExcel)
watch = Watch(transpose)
