# Dynamo graph Read Image From File.dyn "Bild aus Datei lesen" (Dynamo 4.0.0.3277)
# author: Autodesk
# Bild von der Festplatte lesen, um in Dynamo arbeiten zu können

# note: Zu importierende Bilddatei suchen
file_path = Filename("Keine Datei ausgewählt.")
# note: Bilddatei von der Festplatte in den Dynamo-Speicher laden
datei_aus_pfad = FileObject(path=file_path)
# note: Bild aus Datei im Dynamo-Arbeitsspeicher im Bitmap-Format lesen
readFromFile = Image.ReadFromFile(file=datei_aus_pfad)
# note: Bild für die visuelle Überprüfung ansehen
bild_ansehen = WatchImageCore(image=readFromFile)
