# Dynamo graph SKRIPT 1. Anschlagseite Türen.dyn (Dynamo 4.0.0.3277)

code_block = CodeBlock { "Levels"; }
byName = Category.ByName(name=code_block)
all_elements_of_category = ElementsOfCategory(Category=byName)
current = Document.Current()
activeView = Document.ActiveView(document=current)
code_block_2 = CodeBlock { "Verknüpfte Ebene"; }
getParameterValueByName = Element.GetParameterValueByName(element=activeView, parameterName=code_block_2)
name = Level.Name(level=all_elements_of_category)
eq = getParameterValueByName == name
filterByBoolMask = List.FilterByBoolMask(list=all_elements_of_category, mask=eq)
all_elements_at_level = ElementsAtLevel(Level=filterByBoolMask.in)
flatten = List.Flatten(list=all_elements_at_level)
getCategory = Element.GetCategory(element=flatten)
name_2 = Category.Name(category=getCategory)
code_block_3 = CodeBlock { "Doors"; }
byName_2 = Category.ByName(name=code_block_3)
name_3 = Category.Name(category=byName_2)
eq_2 = name_2 == name_3
filterByBoolMask_2 = List.FilterByBoolMask(list=flatten, mask=eq_2)
code_block_4 = CodeBlock { "Anschlagseite"; }
geometry = Element.Geometry(element=filterByBoolMask_2.in)
byUnion = Solid.ByUnion(solids=geometry)
centroid = Solid.Centroid(solid=byUnion)
python_script = Python(IN[0]=filterByBoolMask_2.in)  # PythonNet3
# ---------- python_script.python (17 lines) ----------
import clr
clr.AddReference('RevitAPI')
from Autodesk.Revit.DB import *

clr.AddReference("RevitNodes")
import Revit
clr.ImportExtensions(Revit.Elements)
clr.ImportExtensions(Revit.GeometryConversion)

objects = UnwrapElement(IN[0])
listofvectors = list()
for item in objects:
	try:
		listofvectors.append(item.HandOrientation.ToVector())
	except:
		listofvectors.append(list())
OUT = listofvectors
# ----------------------------------------
facingOrientation = FamilyInstance.FacingOrientation(familyInstance=filterByBoolMask_2.in)
byOriginVectors = CoordinateSystem.ByOriginVectors(origin=centroid, xAxis=python_script, yAxis=facingOrientation)
ZAxis = CoordinateSystem.ZAxis(coordinateSystem=byOriginVectors)
Z = Vector.Z(vector=ZAxis)
code_block_5 = CodeBlock { 1; }
eq_3 = Z == code_block_5
code_block_6 = CodeBlock { "Links"; "Rechts"; }
if_ = RefactoredIf(test=eq_3, true=code_block_6.out0, false=code_block_6.out1)
setParameterByName = Element.SetParameterByName(element=filterByBoolMask_2.in, parameterName=code_block_4, value=if_)
