# Dynamo graph SKRIPT 2. Tischlein Deck Dich.dyn (Dynamo 4.0.0.3277)

select_model_elements = DSModelElementsSelection()  # 6 picked in the model; graph input
end = Revit.Transaction.Transaction.End(input=select_model_elements)
start = Revit.Transaction.Transaction.Start(input=end)
getLocation = Element.GetLocation(element=select_model_elements)
select_model_elements_2 = DSModelElementsSelection()  # 6 picked in the model; graph input
getLocation_2 = Element.GetLocation(element=select_model_elements_2)
byTwoPoints = Vector.ByTwoPoints(start=getLocation, end=getLocation_2)
length = Vector.Length(vector=byTwoPoints)
select_model_elements_3 = DSModelElementsSelection()  # 6 picked in the model; graph input
getLocation_3 = Element.GetLocation(element=select_model_elements_3)
byTwoPoints_2 = Vector.ByTwoPoints(start=getLocation, end=getLocation_3)
length_2 = Vector.Length(vector=byTwoPoints_2)
gt = length > length_2
if_ = RefactoredIf(test=gt, true=byTwoPoints, false=byTwoPoints_2)
moveByVector = Element.MoveByVector(element=start, vector=if_)
YAxis = Vector.YAxis()
select_edge = DSEdgeSelection()  # 1 picked in the model; graph input
direction = Line.Direction(line=select_edge)
ZAxis = Vector.ZAxis()
angleAboutAxis = Vector.AngleAboutAxis(vector=YAxis, otherVector=direction, rotationAxis=ZAxis)
code_block = CodeBlock(x=angleAboutAxis) { 360-x; }
code_block_2 = CodeBlock(x=code_block) { x+[90,0,0,0,90,90]; }
YAxis_2 = Vector.YAxis()
facingOrientation = FamilyInstance.FacingOrientation(familyInstance=start)
ZAxis_2 = Vector.ZAxis()
angleAboutAxis_2 = Vector.AngleAboutAxis(vector=YAxis_2, otherVector=facingOrientation, rotationAxis=ZAxis_2)
code_block_3 = CodeBlock(x=angleAboutAxis_2) { 360-x; }
code_block_4 = CodeBlock(x=code_block_3) { x+[65,0,68,68,-25,250]; }
if_2 = RefactoredIf(test=gt, true=code_block_2, false=code_block_4)
setRotation = FamilyInstance.SetRotation(familyInstance=start, degree=if_2)
select_model_elements_4 = DSModelElementsSelection()  # 7 picked in the model; graph input
end_2 = Revit.Transaction.Transaction.End(input=select_model_elements_4)
start_2 = Revit.Transaction.Transaction.Start(input=end_2)
getLocation_4 = Element.GetLocation(element=select_model_elements_4)
select_model_elements_5 = DSModelElementsSelection()  # 7 picked in the model; graph input
getLocation_5 = Element.GetLocation(element=select_model_elements_5)
byTwoPoints_3 = Vector.ByTwoPoints(start=getLocation_4, end=getLocation_5)
length_3 = Vector.Length(vector=byTwoPoints_3)
select_model_elements_6 = DSModelElementsSelection()  # 7 picked in the model; graph input
getLocation_6 = Element.GetLocation(element=select_model_elements_6)
byTwoPoints_4 = Vector.ByTwoPoints(start=getLocation_4, end=getLocation_6)
length_4 = Vector.Length(vector=byTwoPoints_4)
gt_2 = length_3 > length_4
YAxis_3 = Vector.YAxis()
facingOrientation_2 = FamilyInstance.FacingOrientation(familyInstance=start_2)
ZAxis_3 = Vector.ZAxis()
angleAboutAxis_3 = Vector.AngleAboutAxis(vector=YAxis_3, otherVector=facingOrientation_2, rotationAxis=ZAxis_3)
code_block_5 = CodeBlock(x=angleAboutAxis_3) { 360-x; }
code_block_6 = CodeBlock(x=code_block_5) { x+[70,0,0,0,250,0]; }
if_3 = RefactoredIf(test=gt_2, true=code_block, false=code_block_6)
setRotation_2 = FamilyInstance.SetRotation(familyInstance=start_2, degree=if_3)
if_4 = RefactoredIf(test=gt_2, true=byTwoPoints_3, false=byTwoPoints_4)
moveByVector_2 = Element.MoveByVector(element=start_2, vector=if_4)
select_model_element = DSModelElementSelection()  # 1 picked in the model; graph input
code_block_7 = CodeBlock { "Öffnungsweite Schiebetüre in %"; }
code_block_8 = CodeBlock { 5; 100; }
if_5 = RefactoredIf(test=gt_2, true=code_block_8.out0, false=code_block_8.out1)
setParameterByName = Element.SetParameterByName(element=select_model_element, parameterName=code_block_7, value=if_5)
