# Dynamo graph SKRIPT 3. Fassadenfarbe ändern (auf EINGABEN BEARBEITEN klicken).dyn (Dynamo 4.0.0.3277)

select_model_elements = DSModelElementsSelection()  # 7 picked in the model
python_script = Python(IN[0]=select_model_elements)  # PythonNet3
# ---------- python_script.python (12 lines) ----------
import clr
clr.AddReference('RevitAPI')
from Autodesk.Revit.DB import *

furniture = UnwrapElement(IN[0])
listofelements = list()
for item in furniture:
	try: 
		listofelements.append(item.Document.GetElement(item.GetTypeId()))
	except:
		listofelements.append(list())
OUT = listofelements
# ----------------------------------------
code_block = CodeBlock { 0; }
count = List.Count(list=select_model_elements)
ofRepeatedItem = List.OfRepeatedItem(item=code_block, amount=count)
code_block_2 = CodeBlock { "Metall - Goldfassade Brass Schindeln"; }
code_block_3 = CodeBlock { "Putz - gold"; }
code_block_4 = CodeBlock { "Holz - Fassadenschalung horizontal"; }
code_block_5 = CodeBlock { "Dachdeckung - Holzschindeln"; }
create = List.Create(item0=code_block_2, item1=code_block_3, item2=code_block_4, item3=code_block_5)
change_facade_s_material = DoubleSlider(0, range=0..3 step 1)  # graph input
getItemAtIndex = List.GetItemAtIndex(list=create, index=change_facade_s_material)
byName = Material.ByName(name=getItemAtIndex)
ofRepeatedItem_2 = List.OfRepeatedItem(item=byName, amount=count)
python_script_2 = Python(IN[0]=python_script, IN[1]=ofRepeatedItem, IN[2]=ofRepeatedItem_2)  # PythonNet3
# ---------- python_script_2.python (31 lines) ----------
import clr
clr.AddReference('RevitAPI')
from Autodesk.Revit.DB import *

clr.AddReference("RevitServices")
import RevitServices
from RevitServices.Persistence import DocumentManager
from RevitServices.Transactions import TransactionManager


document = DocumentManager.Instance.CurrentDBDocument
walls = UnwrapElement(IN[0])
index = IN[1]
materials = UnwrapElement(IN[2])
truefalse = list()
amount = 0


TransactionManager.Instance.EnsureInTransaction(document)
for layers in walls:
	try:
			cs = layers.GetCompoundStructure()
			cs.SetMaterialId(index[amount],materials[amount].Id)
			layers.SetCompoundStructure(cs)
			truefalse.append(True)
	except:
			truefalse.append(False)
	amount += 1	
TransactionManager.Instance.TransactionTaskDone()

OUT = (walls,truefalse)
# ----------------------------------------
