# Dynamo graph Export Data To Excel.dyn (Dynamo 4.0.0.3277)
# author: Autodesk
# Export data to Excel given a chosen sheet name. You will need to connect the data to be exported

# note: Browse to Excel file to export data to
file_path = Filename("No file selected.")
# note: Type in a Sheet Name, but be mindful of capitalization
string = StringInput("")
# note: Export Excel data using the OpenXML format from a chosen sheet name
openXMLExportExcel = Data.OpenXMLExportExcel(filePath=file_path, sheetName=string)  # unwired: data
