# Dynamo graph Get Geometry For All Elements Of Category.dyn (Dynamo 4.0.0.3277)
# author: Autodesk
# Collect all elements of a chosen category (Defaulting to Doors) and getting each elements Geometry

# note: Select Revit Category
# note: We recommend you save your graph with a category you expect to exist in your models to prevent a warning.
# For example, try saving and running the graph with the Doors category on the sample model Snowdon Towers Sample Architectural.rvt, available at:
# C:\Program Files\Autodesk\<Revit ....>\Samples
categories = Categories("OST_Doors")
# note: Collect all elements of that selected Category
all_elements_of_category = ElementsOfCategory(Category=categories)
# note: Get the geometry of all collected elements where possible. It may return a warning and null should there be something missing in Revit, or the geometry be unresolvable
geometry = Element.Geometry(element=all_elements_of_category)
