# Dynamo graph Collect All Elements Of Category And Get Parameters.dyn (Dynamo 3.0.3.7597)
# author: Autodesk
# Collect all elements of a chosen category (Defaulting to Rooms) and getting each elements Room Area

# note: Select Revit Category
categories = Categories("OST_Rooms")
# note: Collect all elements of that selected Category
all_elements_of_category = ElementsOfCategory(Category=categories)
# note: Input parameter name, and make sure you take capitalization into account
string = StringInput("Area")
# note: Get parameter values from Elements by Category via a parameter name
getParameterValueByName = Element.GetParameterValueByName(element=all_elements_of_category, parameterName=string)
