# Dynamo graph Collect All Elements Of Category.dyn (Dynamo 4.0.0.3277)
# author: Autodesk
# Collect all elements of a chosen category (Defaulting to Rooms)

# note: Select Revit Category
categories = Categories("OST_Rooms")
# note: Collect all elements of that selected Category
all_elements_of_category = ElementsOfCategory(Category=categories)
# note: Watch results of collecting every element of a chosen category
watch = Watch(all_elements_of_category)
