# Dynamo graph Get Geometry For All Elements Of Category.dyn (Dynamo 3.0.3.7597)
# author: Autodesk
# Collect all elements of a chosen category (Defaulting to Doors) and getting each elements Geometry

# note: Select Revit Category
categories = Categories("OST_Doors")
# note: Collect all elements of that selected Category
all_elements_of_category = ElementsOfCategory(Category=categories)
# note: Get the geometry of all collected elements where possible. It may return a warning and null should there be something missing in Revit, or the geometry be unresolvable
geometry = Element.Geometry(element=all_elements_of_category)
