# Dynamo graph Import Data From Excel.dyn (Dynamo 4.0.0.3277)
# author: Autodesk
# Import data from an Excel file and transpose the data to flip columns and rows

# note: Browse to Excel file to import data from
file_path = Filename("No file selected.")
# note: Type in a Sheet Name, but be mindful of capitalization
string = StringInput("")
# note: Import Excel data using the OpenXML format from a chosen sheet name
openXMLImportExcel = Data.OpenXMLImportExcel(filePath=file_path, sheetName=string)
# note: Transpose the Excel data to flip Rows and Columns
transpose = List.Transpose(lists=openXMLImportExcel)
watch = Watch(transpose)
