# Dynamo graph Collect All Elements Of Category And Get Parameters.dyn "Recopilar todos los elementos de categoría y obtener parámetros" (Dynamo 3.4.0.6892)
# author: Autodesk
# Recopile todos los elementos de una categoría seleccionada (por defecto, Habitaciones) y obtenga el área de habitación de cada elemento.

# note: Seleccionar categoría de Revit
categorías = Categories("OST_Rooms")
# note: Recopile todos los elementos de la categoría seleccionada.
todos_los_elementos_de_la = ElementsOfCategory(Category=categorías)  # "Todos los elementos de la categoría"
# note: Introduzca el nombre del parámetro y asegúrese de tener en cuenta el uso de mayúsculas y minúsculas.
string = StringInput("Área")
# note: Obtenga valores de parámetro de elementos por categoría mediante un nombre de parámetro.
getParameterValueByName = Element.GetParameterValueByName(element=todos_los_elementos_de_la, parameterName=string)
