# Dynamo graph CollectAllElementsOfCategory.dyn (Dynamo 3.0.3.7597)
# author: Autodesk
# Recopile todos los elementos de la categoría elegida (por defecto, Habitaciones).

# note: Seleccionar categoría de Revit
categorías = Categories("OST_Rooms")
# note: Recopile todos los elementos de la categoría seleccionada.
todos_los_elementos_de_la = ElementsOfCategory(Category=categorías)  # "Todos los elementos de la categoría"
# note: Vea los resultados de la recopilación de todos los elementos de una categoría seleccionada.
watch = Watch(todos_los_elementos_de_la)
