# Dynamo graph Export Data To Excel.dyn "Exportar datos a Excel" (Dynamo 4.0.0.3277)
# author: Autodesk
# Exporte datos a Excel con un nombre de plano seleccionado. Deberá conectar los datos para exportarlos.

# note: Busque el archivo de Excel al que exportar los datos.
file_path = Filename("No se ha seleccionado ningún archivo.")
# note: Escriba un nombre de plano, pero tenga en cuenta las mayúsculas y minúsculas.
string = StringInput("")
# note: Exporte los datos de Excel con el formato OpenXML desde un nombre de plano seleccionado.
openXMLExportExcel = Data.OpenXMLExportExcel(filePath=file_path, sheetName=string)  # unwired: data
