# Dynamo graph Get Geometry For All Elements Of Category.dyn "Obtener geometría para todos los elementos de categoría" (Dynamo 4.0.0.3277)
# author: Autodesk
# Recopile todos los elementos de una categoría seleccionada (por defecto, Puertas) y obtenga la geometría de cada elemento.

# note: Seleccionar categoría de Revit
# note: Le recomendamos que guarde el gráfico con una categoría que espere que exista en los modelos para evitar un aviso.
# Por ejemplo, intente guardar y ejecutar el gráfico de la categoría Puertas en el modelo Muestra arquitectónica de Torres Snowdown.rvt, disponible en:
# C:\Archivos de programa\Autodesk\<Revit ....>\Samples
categorías = Categories("OST_Doors")
# note: Recopile todos los elementos de la categoría seleccionada.
todos_los_elementos_de_la = ElementsOfCategory(Category=categorías)  # "Todos los elementos de la categoría"
# note: Obtenga la geometría de todos los elementos recopilados siempre que sea posible. Puede devolver un aviso y un valor "null" si falta algún elemento en Revit o si la geometría no se puede resolver.
geometry = Element.Geometry(element=todos_los_elementos_de_la)
