# Dynamo graph GetGeometryForAllElementsOfCategory.dyn (Dynamo 3.0.3.7597)
# author: Autodesk
# Recopile todos los elementos de una categoría seleccionada (por defecto, Puertas) y obtenga la geometría de cada elemento.

# note: Seleccionar categoría de Revit
categorías = Categories("OST_Doors")
# note: Recopile todos los elementos de la categoría seleccionada.
todos_los_elementos_de_la = ElementsOfCategory(Category=categorías)  # "Todos los elementos de la categoría"
# note: Obtenga la geometría de todos los elementos recopilados siempre que sea posible. Puede devolver un aviso y un valor "null" si falta algún elemento en Revit o si la geometría no se puede resolver.
geometry = Element.Geometry(element=todos_los_elementos_de_la)
