# Dynamo graph Import Data From Excel.dyn "Importar datos de Excel" (Dynamo 3.4.0.6892)
# author: Autodesk
# Importe datos de un archivo de Excel y transponga los datos para voltear columnas y filas.

# note: Busque el archivo de Excel del que importar los datos.
file_path = Filename("No se ha seleccionado ningún archivo.")
# note: Escriba un nombre de plano, pero tenga en cuenta las mayúsculas y minúsculas
string = StringInput("")
# note: Importe datos de Excel utilizando el formato OpenXML a partir de un nombre de plano elegido.
openXMLImportExcel = Data.OpenXMLImportExcel(filePath=file_path, sheetName=string)
# note: Transponga los datos de Excel para voltear filas y columnas.
transpose = List.Transpose(lists=openXMLImportExcel)
watch = Watch(transpose)
