# Dynamo graph Read Image From File.dyn "Leer imagen de archivo" (Dynamo 4.0.0.3277)
# author: Autodesk
# Lea la imagen del disco para poder trabajar con ella dentro de Dynamo.

# note: Busque el archivo de imagen que desea importar.
file_path = Filename("No se ha seleccionado ningún archivo.")
# note: Cargue el archivo de imagen del disco en la memoria de Dynamo.
archivo_desde_ruta = FileObject(path=file_path)
# note: Lea la imagen del archivo en el espacio de memoria de Dynamo con el formato de mapa de bits.
readFromFile = Image.ReadFromFile(file=archivo_desde_ruta)
# note: Vea la imagen para realizar una comprobación visual.
ver_imagen = WatchImageCore(image=readFromFile)
