# Dynamo graph Collect All Elements Of Category And Get Parameters.dyn "Recueillir tous les éléments de la catégorie et obtenir les paramètres" (Dynamo 4.0.0.3277)
# author: Autodesk
# Rassembler tous les éléments d'une catégorie choisie (par défaut : les pièces) et obtenir chaque élément Surface de la pièce

# note: Sélectionner une catégorie Revit
catégories = Categories("OST_Rooms")
# note: Rassembler tous les éléments de la catégorie sélectionnée
tous_les_éléments_de_la = ElementsOfCategory(Category=catégories)  # "Tous les éléments de la catégorie"
# note: Saisir le nom du paramètre. Bien prendre en compte la casse
string = StringInput("Surface")
# note: Obtenir les valeurs de paramètre des éléments par catégorie via un nom de paramètre
getParameterValueByName = Element.GetParameterValueByName(element=tous_les_éléments_de_la, parameterName=string)
