# Dynamo graph CollectAllElementsOfCategory.dyn "RassemblerTousElémentsDeCatégorie" (Dynamo 3.0.3.7597)
# author: Autodesk
# Rassembler tous les éléments d'une catégorie choisie (valeurs par défaut : pièces)

# note: Sélectionner une catégorie Revit
catégories = Categories("OST_Rooms")
# note: Collecter tous les éléments de cette catégorie sélectionnée
tous_les_éléments_de_la = ElementsOfCategory(Category=catégories)  # "Tous les éléments de la catégorie"
# note: Visualiser les résultats de la collecte de chaque élément d'une catégorie choisie
watch = Watch(tous_les_éléments_de_la)
