# Dynamo graph Export Data To Excel.dyn "Exporter les données vers Excel" (Dynamo 4.0.0.3277)
# author: Autodesk
# Exporter les données vers Excel en fonction du nom de feuille choisi. Vous devez connecter les données à exporter

# note: Accéder au fichier Excel vers lequel exporter les données
file_path = Filename("Aucun fichier sélectionné.")
# note: Saisir un nom de feuille, sans oublier les majuscules
string = StringInput("")
# note: Exporter des données Excel au format OpenXML à partir d'un nom de feuille choisi
openXMLExportExcel = Data.OpenXMLExportExcel(filePath=file_path, sheetName=string)  # unwired: data
