# Dynamo graph Get Geometry For All Elements Of Category.dyn "Obtenir la géométrie pour tous les éléments de la catégorie" (Dynamo 4.0.0.3277)
# author: Autodesk
# Collecter tous les éléments d'une catégorie choisie (par défaut : les portes) et obtenir chaque géométrie d'élément

# note: Sélectionner une catégorie Revit
# note: Nous vous recommandons d’enregistrer votre graphique avec une catégorie que vous pensez exister dans vos modèles afin d’éviter tout avertissement.
# Par exemple, essayez d’enregistrer et d’exécuter le graphique avec la catégorie Doors (Portes) dans l’exemple de modèle Snowdon Towers Sample Architectural.rvt, disponible à l’adresse suivante :
# C:\Program Files\Autodesk\<Revit ....>\Samples
catégories = Categories("OST_Doors")
# note: Collecter tous les éléments de cette catégorie sélectionnée
tous_les_éléments_de_la = ElementsOfCategory(Category=catégories)  # "Tous les éléments de la catégorie"
# note: Obtenez la géométrie de tous les éléments collectés lorsque cela est possible. Peut renvoyer un avertissement et une valeur nulle si un élément est manquant dans Revit ou si la géométrie ne peut pas être résolue
geometry = Element.Geometry(element=tous_les_éléments_de_la)
