# Dynamo graph GetGeometryForAllElementsOfCategory.dyn "Obtenir la géométrie pour toues les éléments de la catégorie" (Dynamo 3.0.3.7597)
# author: Autodesk
# Collecter tous les éléments d'une catégorie choisie (par défaut : les portes) et obtenir chaque géométrie d'élément

# note: Sélectionner une catégorie Revit
catégories = Categories("OST_Doors")
# note: Collecter tous les éléments de cette catégorie sélectionnée
tous_les_éléments_de_la = ElementsOfCategory(Category=catégories)  # "Tous les éléments de la catégorie"
# note: Obtenez la géométrie de tous les éléments collectés lorsque cela est possible. Peut renvoyer un avertissement et une valeur nulle si un élément est manquant dans Revit ou si la géométrie ne peut pas être résolue
geometry = Element.Geometry(element=tous_les_éléments_de_la)
