# Dynamo graph Import Data From Excel.dyn "Importer les données depuis Excel" (Dynamo 4.0.0.3277)
# author: Autodesk
# Importer des données à partir d'un fichier Excel et les transposer pour inverser les colonnes et les lignes

# note: Accéder au fichier Excel à partir duquel importer les données
file_path = Filename("Aucun fichier sélectionné.")
# note: Saisir un nom de feuille, sans oublier les majuscules
string = StringInput("")
# note: Importer des données Excel au format OpenXML à partir d'un nom de feuille choisi
openXMLImportExcel = Data.OpenXMLImportExcel(filePath=file_path, sheetName=string)
# note: Transposer les données Excel pour inverser les lignes et les colonnes
transpose = List.Transpose(lists=openXMLImportExcel)
watch = Watch(transpose)
