# Dynamo graph Read Image From File.dyn "Lire l’image à partir du fichier" (Dynamo 4.0.0.3277)
# author: Autodesk
# Lire l'image à partir du disque pour pouvoir travailler dans Dynamo

# note: Accéder au fichier image à importer
file_path = Filename("Aucun fichier sélectionné")
# note: Charger le fichier image à partir du disque dans la mémoire Dynamo
fichier_à_partir_du_chemin = FileObject(path=file_path)
# note: Lire l'image à partir d'un fichier dans l'espace mémoire de Dynamo au format bitmap
readFromFile = Image.ReadFromFile(file=fichier_à_partir_du_chemin)
# note: Regarder l'image pour procéder à une inspection visuelle
regarder_l_image = WatchImageCore(image=readFromFile)
