# Dynamo graph ReadImageFromFile.dyn (Dynamo 3.0.3.7597)
# author: Autodesk
# Read Image from disc to be able to work with inside of Dynamo

# note: Browse to Image file to import
file_path = Filename("No file selected.")
# note: Load the Image file from disk into Dynamo's memory
file_from_path = FileObject(path=file_path)
# note: Read Image from File in Dynamo's memory space in the Bitmap format
readFromFile = Image.ReadFromFile(file=file_from_path)
# note: Watch the Image to visually check
watch_image = WatchImageCore(image=readFromFile)
