# Dynamo graph Collect All Elements Of Category And Get Parameters.dyn "Raccogli tutti gli elementi della categoria e ottiene i parametri" (Dynamo 4.0.0.3277)
# author: Autodesk
# Raccoglie tutti gli elementi della categoria selezionata (l'impostazione di default è Locali) e ottiene l'area del locale di ogni elemento.

# note: Selezionare la categoria di Revit
categorie = Categories("OST_Rooms")
# note: Raccogliere tutti gli elementi della categoria selezionata
tutti_gli_elementi_della = ElementsOfCategory(Category=categorie)  # "Tutti gli elementi della categoria"
# note: Inserire il nome del parametro e assicurarsi di tenere conto delle maiuscole
string = StringInput("Area")
# note: Ottenere i valori dei parametri dagli elementi per categoria tramite un nome di parametro
getParameterValueByName = Element.GetParameterValueByName(element=tutti_gli_elementi_della, parameterName=string)
