# Dynamo graph CollectAllElementsOfCategory.dyn (Dynamo 3.0.3.7597)
# author: Autodesk
# Raccoglie tutti gli elementi della categoria scelta (l'impostazione di default è Locali).

# note: Selezionare la categoria di Revit
categorie = Categories("OST_Rooms")
# note: Raccogliere tutti gli elementi della categoria selezionata
tutti_gli_elementi_della = ElementsOfCategory(Category=categorie)  # "Tutti gli elementi della categoria"
# note: Guardare i risultati della raccolta di ogni elemento della categoria scelta
watch = Watch(tutti_gli_elementi_della)
