# Dynamo graph Export Data To Excel.dyn "Esporta dati in Excel" (Dynamo 4.0.0.3277)
# author: Autodesk
# Esporta i dati in formato Excel in base al nome della tavola scelto. È necessario connettere i dati da esportare.

# note: Cercare il file di Excel in cui esportare i dati
file_path = Filename("Nessun file selezionato.")
# note: Digitare un nome di tavola, ma prestare attenzione alle maiuscole
string = StringInput("")
# note: Esportare i dati di Excel utilizzando il formato OpenXML dal nome di tavola scelto
openXMLExportExcel = Data.OpenXMLExportExcel(filePath=file_path, sheetName=string)  # unwired: data
