# Dynamo graph Get Geometry For All Elements Of Category.dyn "Ottieni geometria per tutti gli elementi della categoria" (Dynamo 4.0.0.3277)
# author: Autodesk
# Raccoglie tutti gli elementi della categoria scelta (l'impostazione di default è Porte) e ottiene la geometria di ogni elemento.

# note: Selezionare la categoria di Revit
# note: Si consiglia di salvare il grafico con una categoria che si prevede esista nei modelli per evitare la visualizzazione di un avviso.
# Ad esempio, provare a salvare ed eseguire il grafico con la categoria Doors nel modello di esempio Snowdon Towers Sample Architectural.rvt, disponibile in:
# C:\Programmi\Autodesk\<Revit ....>\Samples
categorie = Categories("OST_Doors")
# note: Raccogliere tutti gli elementi della categoria selezionata
tutti_gli_elementi_della = ElementsOfCategory(Category=categorie)  # "Tutti gli elementi della categoria"
# note: Ottenere la geometria di tutti gli elementi raccolti, laddove possibile. È possibile che venga restituito un avviso e che sia nullo se in Revit manca qualcosa o se la geometria non è risolvibile
geometry = Element.Geometry(element=tutti_gli_elementi_della)
