# Dynamo graph GetGeometryForAllElementsOfCategory.dyn (Dynamo 3.0.3.7597)
# author: Autodesk
# Raccoglie tutti gli elementi della categoria scelta (l'impostazione di default è Porte) e ottiene la geometria di ogni elemento.

# note: Selezionare la categoria di Revit
categorie = Categories("OST_Doors")
# note: Raccogliere tutti gli elementi della categoria selezionata
tutti_gli_elementi_della = ElementsOfCategory(Category=categorie)  # "Tutti gli elementi della categoria"
# note: Ottenere la geometria di tutti gli elementi raccolti, laddove possibile. È possibile che venga restituito un avviso e che sia nullo se in Revit manca qualcosa o se la geometria non è risolvibile
geometry = Element.Geometry(element=tutti_gli_elementi_della)
