# Dynamo graph Import Data From Excel.dyn "Importa dati da Excel" (Dynamo 4.0.0.3277)
# author: Autodesk
# Importa i dati da un file di Excel e li traspone per invertire le colonne e le righe.

# note: Cercare il file di Excel da cui importare i dati
file_path = Filename("Nessun file selezionato.")
# note: Digitare un nome di tavola, ma prestare attenzione alle maiuscole
string = StringInput("")
# note: Importare i dati di Excel utilizzando il formato OpenXML dal nome di tavola scelto
openXMLImportExcel = Data.OpenXMLImportExcel(filePath=file_path, sheetName=string)
# note: Trasporre i dati di Excel per invertire righe e colonne
transpose = List.Transpose(lists=openXMLImportExcel)
watch = Watch(transpose)
