# Dynamo graph ReadImageFromFile.dyn (Dynamo 3.0.3.7597)
# author: Autodesk
# Legge l'immagine dal disco per poter lavorare all'interno di Dynamo.

# note: Cercare il file di immagine da importare
file_path = Filename("Nessun file selezionato.")
# note: Caricare il file di immagine dal disco nella memoria di Dynamo
file_da_percorso = FileObject(path=file_path)
# note: Leggere l'immagine da file nello spazio dello memoria di Dynamo nel formato bitmap
readFromFile = Image.ReadFromFile(file=file_da_percorso)
# note: Guardare l'immagine per controllare visivamente
guarda_immagine = WatchImageCore(image=readFromFile)
