# Dynamo graph Collect All Elements Of Category And Get Parameters.dyn "カテゴリのすべての要素を収集し、パラメータを取得" (Dynamo 4.0.0.3277)
# author: Autodesk
# 選択したカテゴリ(既定は部屋)のすべての要素を収集し、各要素の部屋面積を取得します

# note: Revit カテゴリを選択
カテゴリ = Categories("OST_Rooms")
# note: 選択したカテゴリのすべての要素を収集
カテゴリのすべての要素 = ElementsOfCategory(Category=カテゴリ)
# note: 大文字と小文字を区別してパラメータ名を入力してください
string = StringInput("面積")
# note: パラメータ名を使用して要素からカテゴリ別にパラメータ値を取得
getParameterValueByName = Element.GetParameterValueByName(element=カテゴリのすべての要素, parameterName=string)
