# Dynamo graph Collect All Elements Of Category.dyn "カテゴリのすべての要素を収集" (Dynamo 3.4.0.6892)
# author: Autodesk
# 選択したカテゴリ(既定は部屋)のすべての要素を収集します

# note: Revit カテゴリを選択
カテゴリ = Categories("OST_Rooms")
# note: 選択したカテゴリのすべての要素を収集
カテゴリのすべての要素 = ElementsOfCategory(Category=カテゴリ)
# note: 選択したカテゴリのすべての要素を収集した結果を確認
watch = Watch(カテゴリのすべての要素)
