# Dynamo graph Export Data To Excel.dyn "Excel にデータを書き出す" (Dynamo 4.0.0.3277)
# author: Autodesk
# 選択したシート名でデータを Exce lに書き出します。書き出すデータを接続する必要があります。

# note: データの書き出し先の Excel ファイルを参照
file_path = Filename("ファイルが選択されていません。")
# note: 大文字と小文字を区別してシート名を入力してください
string = StringInput("")
# note: 選択したシート名から OpenXML 形式を使用して Excel データを書き出す
openXMLExportExcel = Data.OpenXMLExportExcel(filePath=file_path, sheetName=string)  # unwired: data
