# Dynamo graph Get Geometry For All Elements Of Category.dyn "カテゴリのすべての要素のジオメトリを取得" (Dynamo 4.0.0.3277)
# author: Autodesk
# 選択したカテゴリ(既定はドア)のすべての要素を収集し、各要素のジオメトリを取得します

# note: Revit カテゴリを選択
# note: 警告が表示されないように、モデルに存在すると予想されるカテゴリでグラフを保存することをお勧めします。
# たとえば、サンプル モデル Snowdon Towers Sample Architectural.rvt の Doors カテゴリを使用してグラフを保存して実行してみてください。
# C:\Program Files\Autodesk\<Revit ....>\Samples
カテゴリ = Categories("OST_Doors")
# note: 選択したカテゴリのすべての要素を収集
カテゴリのすべての要素 = ElementsOfCategory(Category=カテゴリ)
# note: 可能な場合は、収集されたすべての要素のジオメトリを取得します。Revit で何かが見つからない場合や、ジオメトリが解決できない場合は、警告と null が返される場合があります。
geometry = Element.Geometry(element=カテゴリのすべての要素)
