# Dynamo graph Import Data From Excel.dyn "Excel からデータを読み込む" (Dynamo 3.4.0.6892)
# author: Autodesk
# Excel ファイルからデータを読み込み、データを転置して列と行を反転します。

# note: データの読み込み元の Excel ファイルを参照
file_path = Filename("ファイルが選択されていません。")
# note: 大文字と小文字を区別してシート名を入力してください
string = StringInput("")
# note: 選択したシート名から OpenXML 形式を使用して Excel データを読み込みます
openXMLImportExcel = Data.OpenXMLImportExcel(filePath=file_path, sheetName=string)
# note: Excel データを転置して行と列を反転する
transpose = List.Transpose(lists=openXMLImportExcel)
watch = Watch(transpose)
