# Dynamo graph Read Image From File.dyn "ファイルからイメージを読み込む" (Dynamo 4.0.0.3277)
# author: Autodesk
# ディスクからイメージを読み込んで、Dynamo 内で作業できるようにします

# note: 読み込むイメージ ファイルを参照
file_path = Filename("ファイルが選択されていません。")
# note: Dynamo のメモリにディスクからイメージ ファイルをロード
パスからのファイル = FileObject(path=file_path)
# note: Dynamo のメモリ スペース内のファイルからビットマップ形式でイメージを読み込む
readFromFile = Image.ReadFromFile(file=パスからのファイル)
# note: イメージを見て視覚的に確認する
イメージを見る = WatchImageCore(image=readFromFile)
