# Dynamo graph Collect All Elements Of Category And Get Parameters.dyn "카테고리의 모든 요소 수집 및 매개변수 가져오기" (Dynamo 4.0.0.3277)
# author: Autodesk
# 선택한 카테고리의 모든 요소(기본값: 룸)를 수집하고 각 요소의 룸 면적을 가져옵니다.

# note: Revit 카테고리 선택
카테고리 = Categories("OST_Rooms")
# note: 선택한 카테고리의 모든 요소 수집
카테고리의_모든_요소 = ElementsOfCategory(Category=카테고리)
# note: 매개변수 이름 입력(대소문자를 구분해야 함)
string = StringInput("면적")
# note: 카테고리별 요소에서 매개변수 이름을 통해 매개변수 값 가져오기
getParameterValueByName = Element.GetParameterValueByName(element=카테고리의_모든_요소, parameterName=string)
