# Dynamo graph Collect All Elements Of Category.dyn "카테고리의 모든 요소 수집" (Dynamo 4.0.0.3277)
# author: Autodesk
# 선택한 카테고리의 모든 요소(기본값: 룸) 수집

# note: Revit 카테고리 선택
카테고리 = Categories("OST_Rooms")
# note: 선택한 카테고리의 모든 요소 수집
카테고리의_모든_요소 = ElementsOfCategory(Category=카테고리)
# note: 선택한 카테고리의 모든 요소를 수집한 결과 보기
watch = Watch(카테고리의_모든_요소)
