# Dynamo graph Export Data To Excel.dyn "Excel로 데이터 내보내기" (Dynamo 3.4.0.6892)
# author: Autodesk
# 선택한 시트 이름을 기준으로 데이터를 Excel로 내보냅니다. 내보낼 데이터를 연결해야 합니다.

# note: 데이터를 내보낼 Excel 파일 찾아보기
file_path = Filename("선택한 파일이 없습니다.")
# note: 시트 이름 입력(대소문자를 구분해야 함)
string = StringInput("")
# note: 선택한 시트 이름에서 OpenXML 형식을 사용하여 Excel 데이터를 내보냅니다.
openXMLExportExcel = Data.OpenXMLExportExcel(filePath=file_path, sheetName=string)  # unwired: data
