# Dynamo graph Get Geometry For All Elements Of Category.dyn "카테고리의 모든 요소에 대한 형상 가져오기" (Dynamo 3.4.0.6892)
# author: Autodesk
# 선택한 카테고리의 모든 요소(기본값: 문)를 수집하고 각 요소의 형상을 가져옵니다.

# note: Revit 카테고리 선택
# note: 경고가 발생하지 않도록 모델에 있을 것으로 예상되는 카테고리로 그래프를 저장하는 것이 좋습니다.
# 예를 들어, 다음 위치에서 사용할 수 있는 샘플 모델 Snowdon Towers Sample Architectural.rvt에서는 Doors 범주를 사용하여 그래프를 저장하고 실행해 보십시오.
# C:\Program Files\Autodesk\<Revit ....>\Samples
카테고리 = Categories("OST_Doors")
# note: 선택한 카테고리의 모든 요소 수집
카테고리의_모든_요소 = ElementsOfCategory(Category=카테고리)
# note: 가능한 경우 수집된 모든 요소의 형상을 가져옵니다. 그러면 경고가 반환될 수 있고 Revit에서 누락된 항목이 있거나 형상을 해석할 수 없는 경우 null이 반환됩니다.
geometry = Element.Geometry(element=카테고리의_모든_요소)
