# Dynamo graph Import Data From Excel.dyn "Excel에서 데이터 가져오기" (Dynamo 4.0.0.3277)
# author: Autodesk
# Excel 파일에서 데이터를 가져오고 데이터를 전치하여 열과 행을 바꿉니다.

# note: 데이터를 가져올 Excel 파일 찾아보기
file_path = Filename("선택한 파일이 없습니다.")
# note: 시트 이름 입력(대소문자를 구분해야 함)
string = StringInput("")
# note: 선택한 시트 이름에서 OpenXML 형식을 사용하여 Excel 데이터 가져오기
openXMLImportExcel = Data.OpenXMLImportExcel(filePath=file_path, sheetName=string)
# note: Excel 데이터를 전치하여 행과 열 바꾸기
transpose = List.Transpose(lists=openXMLImportExcel)
watch = Watch(transpose)
