# Dynamo graph Read Image From File.dyn "파일에서 이미지 읽기" (Dynamo 4.0.0.3277)
# author: Autodesk
# Dynamo에서 작업할 수 있도록 디스크의 이미지를 읽습니다.

# note: 가져올 이미지 파일 찾아보기
file_path = Filename("선택한 파일이 없습니다.")
# note: 디스크의 이미지 파일을 Dynamo의 메모리로 로드
경로의_파일 = FileObject(path=file_path)
# note: Dynamo의 메모리 공간에 있는 파일에서 비트맵 형식으로 이미지 읽기
readFromFile = Image.ReadFromFile(file=경로의_파일)
# note: 시각적으로 확인할 이미지 보기
이미지_보기 = WatchImageCore(image=readFromFile)
