# Dynamo graph Collect All Elements Of Category And Get Parameters.dyn "Zbierz wszystkie elementy kategorii i pobierz parametry" (Dynamo 4.0.0.3277)
# author: Autodesk
# Zbierz wszystkie elementy wybranej kategorii (ustawienie domyślne to pomieszczenia) i pobierz powierzchnie pomieszczeń poszczególnych elementów

# note: Wybierz kategorię programu Revit
kategorie = Categories("OST_Rooms")
# note: Zbierz wszystkie elementy tej wybranej kategorii
wszystkie_elementy_danej = ElementsOfCategory(Category=kategorie)  # "Wszystkie elementy danej kategorii"
# note: Wprowadź nazwę parametru i zadbaj o uwzględnienie wielkości liter
string = StringInput("Powierzchnia")
# note: Pobierz wartości parametrów z elementów według kategorii za pomocą nazwy parametru
getParameterValueByName = Element.GetParameterValueByName(element=wszystkie_elementy_danej, parameterName=string)
