# Dynamo graph Collect All Elements Of Category.dyn "Zbierz wszystkie elementy kategorii" (Dynamo 3.4.0.6892)
# author: Autodesk
# Zbierz wszystkie elementy wybranej kategorii (ustawienie domyślne to pomieszczenia)

# note: Wybierz kategorię programu Revit
kategorie = Categories("OST_Rooms")
# note: Zbierz wszystkie elementy tej wybranej kategorii
wszystkie_elementy_danej = ElementsOfCategory(Category=kategorie)  # "Wszystkie elementy danej kategorii"
# note: Obejrzyj wyniki zbierania wszystkich elementów wybranej kategorii
watch = Watch(wszystkie_elementy_danej)
