# Dynamo graph ExportDataToExcel.dyn (Dynamo 3.0.3.7597)
# author: Autodesk
# Eksportuj dane do programu Excel z podaną nazwą arkusza. Należy połączyć dane, aby można było je wyeksportować

# note: Przejdź do pliku programu Excel, do którego chcesz wyeksportować dane
file_path = Filename("Nie wybrano pliku.")
# note: Wpisz nazwę arkusza, pamiętając o wielkości liter
string = StringInput("")
# note: Eksportuj dane programu Excel z użyciem formatu OpenXML z wybranej nazwy arkusza
openXMLExportExcel = Data.OpenXMLExportExcel(filePath=file_path, sheetName=string)  # unwired: data
