# Dynamo graph Get Geometry For All Elements Of Category.dyn "Pobierz geometrię dla wszystkich elementów kategorii" (Dynamo 4.0.0.3277)
# author: Autodesk
# Zbierz wszystkie elementy wybranej kategorii (ustawienie domyślne to drzwi) i pobierz geometrię poszczególnych elementów

# note: Wybierz kategorię programu Revit
# note: Zalecamy zapisanie wykresu przy użyciu kategorii, której istnienia oczekuje się w modelach, aby zapobiec ostrzeżeniu.
# Na przykład spróbuj zapisać i uruchomić wykres z kategorią Drzwi (Doors) w przykładowym modelu Snowdon Towers Sample Architectural.rvt dostępnym tutaj:
# C:\Program Files\Autodesk\<Revit ....>\Samples
kategorie = Categories("OST_Doors")
# note: Zbierz wszystkie elementy tej wybranej kategorii
wszystkie_elementy_danej = ElementsOfCategory(Category=kategorie)  # "Wszystkie elementy danej kategorii"
# note: Pobiera geometrię wszystkich zebranych elementów, jeśli jest to możliwe. Może spowodować zwrócenie ostrzeżenia i wartości null, jeśli w programie Revit czegoś brakuje lub nie można rozpoznać geometrii
geometry = Element.Geometry(element=wszystkie_elementy_danej)
