# Dynamo graph GetGeometryForAllElementsOfCategory.dyn (Dynamo 3.0.3.7597)
# author: Autodesk
# Zbierz wszystkie elementy wybranej kategorii (ustawienie domyślne to drzwi) i pobierz geometrię poszczególnych elementów

# note: Wybierz kategorię programu Revit
kategorie = Categories("OST_Doors")
# note: Zbierz wszystkie elementy tej wybranej kategorii
wszystkie_elementy_danej = ElementsOfCategory(Category=kategorie)  # "Wszystkie elementy danej kategorii"
# note: Pobiera geometrię wszystkich zebranych elementów, jeśli jest to możliwe. Może spowodować zwrócenie ostrzeżenia i wartości null, jeśli w programie Revit czegoś brakuje lub nie można rozpoznać geometrii
geometry = Element.Geometry(element=wszystkie_elementy_danej)
