# Dynamo graph Import Data From Excel.dyn "Importuj dane z programu Excel" (Dynamo 3.4.0.6892)
# author: Autodesk
# Importuj dane z pliku programu Excel i przekształć dane, zamieniając kolumny i wiersze

# note: Przejdź do pliku programu Excel, z którego chcesz zaimportować dane
file_path = Filename("Nie wybrano pliku.")
# note: Wpisz nazwę arkusza, pamiętając o wielkości liter
string = StringInput("")
# note: Importuj dane programu Excel z użyciem formatu OpenXML z wybranej nazwy arkusza
openXMLImportExcel = Data.OpenXMLImportExcel(filePath=file_path, sheetName=string)
# note: Przekształć dane programu Excel, zamieniając wiersze i kolumny
transpose = List.Transpose(lists=openXMLImportExcel)
watch = Watch(transpose)
