# Dynamo graph Read Image From File.dyn "Odczytaj obraz z pliku" (Dynamo 4.0.0.3277)
# author: Autodesk
# Odczytaj obraz z dysku, aby pracować z wewnętrznym środowiskiem dodatku Dynamo

# note: Przejdź do pliku obrazu do zaimportowania
file_path = Filename("Nie wybrano pliku.")
# note: Wczytaj plik obrazu z dysku do pamięci dodatku Dynamo
plik_ze_ścieżki = FileObject(path=file_path)
# note: Odczytaj obraz z pliku w przestrzeni pamięci dodatku Dynamo w formacie bitmapy
readFromFile = Image.ReadFromFile(file=plik_ze_ścieżki)
# note: Obejrzyj obraz, aby sprawdzić go wizualnie
obejrzyj_obraz = WatchImageCore(image=readFromFile)
