# Dynamo graph CollectAllElementsOfCategory.dyn (Dynamo 3.0.3.7597)
# author: Autodesk
# Coletar todos os elementos de uma categoria escolhida (padronizando para ambientes)

# note: Selecionar categoria do Revit
categorias = Categories("OST_Rooms")
# note: Coletar todos os elementos da categoria selecionada
todos_os_elementos_da_categoria = ElementsOfCategory(Category=categorias)
# note: Inspecionar resultados da coleta de cada elemento de uma categoria selecionada
watch = Watch(todos_os_elementos_da_categoria)
