# Dynamo graph CollectAllElementsOfCategoryAndGetParameters.dyn (Dynamo 3.0.3.7597)
# author: Autodesk
# Coletar todos os elementos de uma categoria escolhida (Padronizando para ambientes) e obter a área de ambiente de cada elemento

# note: Selecionar categoria do Revit
categorias = Categories("OST_Rooms")
# note: Coletar todos os elementos da categoria selecionada
todos_os_elementos_da_categoria = ElementsOfCategory(Category=categorias)
# note: Inserir nome do parâmetro e levar em conta maiúsculas e minúsculas
string = StringInput("Área")
# note: Obter valores de parâmetro dos elementos por categoria por meio de um nome de parâmetro
getParameterValueByName = Element.GetParameterValueByName(element=todos_os_elementos_da_categoria, parameterName=string)
