# Dynamo graph Export Data To Excel.dyn "Exportar dados para o Excel" (Dynamo 4.0.0.3277)
# author: Autodesk
# Exportar dados para o Excel com base um nome de folha escolhido. Será necessário conectar os dados a serem exportados

# note: Navegar até o arquivo do Excel para o qual exportar dados
file_path = Filename("Nenhum arquivo selecionado.")
# note: Digitar um nome de folha e levar em conta maiúsculas e minúsculas
string = StringInput("")
# note: Exportar dados do Excel usando o formato OpenXML de um nome de folha escolhido
openXMLExportExcel = Data.OpenXMLExportExcel(filePath=file_path, sheetName=string)  # unwired: data
