# Dynamo graph Get Geometry For All Elements Of Category.dyn "Obter a geometria de todos os elementos da categoria" (Dynamo 4.0.0.3277)
# author: Autodesk
# Coletar todos os elementos de uma categoria selecionada (padronizando para portas) e obter a geometria de cada elemento

# note: Selecionar categoria do Revit
# note: Recomendamos salvar o gráfico com uma categoria que você espera que exista nos modelos para evitar um aviso.
# Por exemplo, tente salvar e executar o gráfico com a categoria Portas no modelo de amostra Snowdon Towers Sample Architectural.rvt, disponível em:
# C:\Arquivos de programas\Autodesk\<Revit ....>\Samples
categorias = Categories("OST_Doors")
# note: Coletar todos os elementos da categoria selecionada
todos_os_elementos_da_categoria = ElementsOfCategory(Category=categorias)
# note: Obter a geometria de todos os elementos coletados sempre que possível. Pode retornar um aviso e nulo, caso haja algo faltando no Revit, ou caso a geometria não possa ser resolvida
geometry = Element.Geometry(element=todos_os_elementos_da_categoria)
