# Dynamo graph GetGeometryForAllElementsOfCategory.dyn (Dynamo 3.0.3.7597)
# author: Autodesk
# Coletar todos os elementos de uma categoria selecionada (padronizando para portas) e obter a geometria de cada elemento

# note: Selecionar categoria do Revit
categorias = Categories("OST_Doors")
# note: Coletar todos os elementos da categoria selecionada
todos_os_elementos_da_categoria = ElementsOfCategory(Category=categorias)
# note: Obter a geometria de todos os elementos coletados sempre que possível. Pode retornar um aviso e nulo, caso haja algo faltando no Revit, ou caso a geometria não possa ser resolvida
geometry = Element.Geometry(element=todos_os_elementos_da_categoria)
