# Dynamo graph Import Data From Excel.dyn "Importar dados do Excel" (Dynamo 4.0.0.3277)
# author: Autodesk
# Importar dados de um arquivo do Excel e transpor os dados para inverter colunas e linhas

# note: Navegar até o arquivo do Excel do qual importar dados
file_path = Filename("Nenhum arquivo selecionado.")
# note: Digitar um nome de folha e levar em conta maiúsculas e minúsculas
string = StringInput("")
# note: Importar dados do Excel usando o formato OpenXML de um nome de folha escolhido
openXMLImportExcel = Data.OpenXMLImportExcel(filePath=file_path, sheetName=string)
# note: Transpor os dados do Excel para inverter linhas e colunas
transpose = List.Transpose(lists=openXMLImportExcel)
watch = Watch(transpose)
