# Dynamo graph Read Image From File.dyn "Ler imagem do arquivo" (Dynamo 3.4.0.6892)
# author: Autodesk
# Ler imagem do disco para poder trabalhar com o Dynamo

# note: Procurar arquivo de imagem para importar
file_path = Filename("Nenhum arquivo selecionado.")
# note: Carregar o arquivo de imagens do disco para a memória do Dynamo
arquivo_do_caminho = FileObject(path=file_path)
# note: Ler imagem do arquivo no espaço de memória do Dynamo no formato de bitmap
readFromFile = Image.ReadFromFile(file=arquivo_do_caminho)
# note: Inspecionar a imagem para verificar visualmente
inspecionar_imagem = WatchImageCore(image=readFromFile)
