# Dynamo graph Collect All Elements Of Category.dyn "Сбор всех элементов категории" (Dynamo 4.0.0.3277)
# author: Autodesk
# Сбор всех элементов выбранной категории (по умолчанию — «Помещения»)

# note: Выбор категории Revit
categories = Categories("OST_Rooms")
# note: Сбор всех элементов выбранной категории
all_elements_of_category = ElementsOfCategory(Category=categories)
# note: Просмотр результатов сбора элементов выбранной категории
watch = Watch(all_elements_of_category)
