# Dynamo graph CollectAllElementsOfCategory.dyn (Dynamo 3.0.3.7597)
# author: Autodesk
# Сбор всех элементов выбранной категории (по умолчанию — «Помещения»)

# note: Выбор категории Revit
categories = Categories("OST_Rooms")
# note: Сбор всех элементов выбранной категории
all_elements_of_category = ElementsOfCategory(Category=categories)
# note: Просмотр результатов сбора элементов выбранной категории
watch = Watch(all_elements_of_category)
