# Dynamo graph CollectAllElementsOfCategoryAndGetParameters.dyn (Dynamo 3.0.3.7597)
# author: Autodesk
# Сбор всех элементов выбранной категории (по умолчанию — «Помещения») и получение площади помещения для каждого элемента

# note: Выбор категории Revit
categories = Categories("OST_Rooms")
# note: Сбор всех элементов выбранной категории
all_elements_of_category = ElementsOfCategory(Category=categories)
# note: Введите имя параметра с учетом регистра
string = StringInput("Area")
# note: Получение значений параметров из элементов по категории с помощью имени параметра
getParameterValueByName = Element.GetParameterValueByName(element=all_elements_of_category, parameterName=string)
