# Dynamo graph ExportDataToExcel.dyn (Dynamo 3.0.3.7597)
# author: Autodesk
# Экспорт данных в Excel с заданным именем листа. Необходимо подключить данные для экспорта

# note: Выберите файл Excel для экспорта данных
file_path = Filename("No file selected.")
# note: Введите имя листа с учетом регистра
string = StringInput("")
# note: Экспорт данных Excel в формате OpenXML из выбранного имени листа
openXMLExportExcel = Data.OpenXMLExportExcel(filePath=file_path, sheetName=string)  # unwired: data
