# Dynamo graph Get Geometry For All Elements Of Category.dyn "Получение геометрии для всех элементов категории" (Dynamo 3.4.0.6892)
# author: Autodesk
# Сбор всех элементов выбранной категории (по умолчанию — «Двери») и получение геометрии каждого элемента

# note: Выбор категории Revit
# note: Чтобы предотвратить появление предупреждения, рекомендуется сохранить график с категорией, которая, как предполагается, присутствует в моделях.
# Например, попробуйте сохранить и запустить график с категорией «Двери» в файле примера модели Snowdon Towers Sample Architectural.rvt, который находится в следующей папке:
# C:\Program Files\Autodesk\<Revit ....>\Samples
categories = Categories("OST_Doors")
# note: Сбор всех элементов выбранной категории
all_elements_of_category = ElementsOfCategory(Category=categories)
# note: Получение геометрии всех собранных элементов, если это возможно. Может вернуться предупреждение или значение NULL, если в Revit отсутствуют какие-либо элементы или геометрию невозможно обработать
geometry = Element.Geometry(element=all_elements_of_category)
