# Dynamo graph GetGeometryForAllElementsOfCategory.dyn (Dynamo 3.0.3.7597)
# author: Autodesk
# Сбор всех элементов выбранной категории (по умолчанию — «Двери») и получение геометрии каждого элемента

# note: Выбор категории Revit
categories = Categories("OST_Doors")
# note: Сбор всех элементов выбранной категории
all_elements_of_category = ElementsOfCategory(Category=categories)
# note: Получение геометрии всех собранных элементов, если это возможно. Может вернуться предупреждение или значение NULL, если в Revit отсутствуют какие-либо элементы или геометрию невозможно обработать
geometry = Element.Geometry(element=all_elements_of_category)
