# Dynamo graph Import Data From Excel.dyn "Импорт данных из Excel" (Dynamo 4.0.0.3277)
# author: Autodesk
# Импорт данных из файла Excel и перестановка данных для преображения столбцов в строки и наоборот

# note: Выберите файл Excel для импорта данных
file_path = Filename("No file selected.")
# note: Введите имя листа с учетом регистра
string = StringInput("")
# note: Импорт данных Excel в формате OpenXML из выбранного имени листа
openXMLImportExcel = Data.OpenXMLImportExcel(filePath=file_path, sheetName=string)
# note: Перестановка данных в Excel для преобразования строк в столбцы и наоборот
transpose = List.Transpose(lists=openXMLImportExcel)
watch = Watch(transpose)
