# Dynamo graph Read Image From File.dyn "Чтение изображения из файла" (Dynamo 3.4.0.6892)
# author: Autodesk
# Чтение образа с диска для работы в Dynamo

# note: Выбор файла изображения для импорта
file_path = Filename("No file selected.")
# note: Загрузка файла изображения с диска в память Dynamo
file_from_path = FileObject(path=file_path)
# note: Чтение изображения из файла в пространстве памяти Dynamo в формате растрового изображения
readFromFile = Image.ReadFromFile(file=file_from_path)
# note: Просмотр изображения для визуальной проверки
watch_image = WatchImageCore(image=readFromFile)
