# Dynamo graph Collect All Elements Of Category And Get Parameters.dyn "收集类别的所有图元并获取参数" (Dynamo 4.0.0.3277)
# author: Autodesk
# 收集选定类别的所有图元(默认为房间)，并获取每个图元的“房间面积”

# note: 选择 Revit 类别
类别 = Categories("OST_Rooms")
# note: 收集该选定类别的所有图元
以下类别的所有图元 = ElementsOfCategory(Category=类别)
# note: 输入参数名称，并确保将大写考虑在内
string = StringInput("面积")
# note: 通过参数名称从“按类别的图元”获取参数值
getParameterValueByName = Element.GetParameterValueByName(element=以下类别的所有图元, parameterName=string)
