# Dynamo graph Collect All Elements Of Category.dyn (Dynamo 3.4.0.6892)
# author: Autodesk
# 收集选定类别的所有图元(默认为房间)

# note: 选择 Revit 类别
类别 = Categories("OST_Rooms")
# note: 收集该选定类别的所有图元
以下类别的所有图元 = ElementsOfCategory(Category=类别)
# note: 查看收集选定类别的每个图元的结果
watch = Watch(以下类别的所有图元)
