# Dynamo graph Export Data To Excel.dyn "将数据导出到 Excel" (Dynamo 4.0.0.3277)
# author: Autodesk
# 根据选定的图纸名称将数据输出到 Excel。您需要连接要输出的数据

# note: 浏览到要将数据输出到的 Excel 文件
file_path = Filename("未选择文件。")
# note: 键入图纸名称，但请注意大写
string = StringInput("")
# note: 使用所选图纸名称中的 OpenXML 格式导出 Excel 数据
openXMLExportExcel = Data.OpenXMLExportExcel(filePath=file_path, sheetName=string)  # unwired: data
