# Dynamo graph Get Geometry For All Elements Of Category.dyn "获取类别的所有图元的几何图形" (Dynamo 4.0.0.3277)
# author: Autodesk
# 收集所选类别的所有图元(默认为门)并获取每个图元几何图形

# note: 选择 Revit 类别
# note: 我们建议您使用预期存在于模型中的类别保存图形，以防止出现警告。
# 例如，尝试在样例模型“Snowdon Towers Sample Architectural.rvt”(可从以下网址获得)上保存并运行“门”类别的图形:
# C:\Program Files\Autodesk\<Revit ....>\Samples
类别 = Categories("OST_Doors")
# note: 收集该选定类别的所有图元
以下类别的所有图元 = ElementsOfCategory(Category=类别)
# note: 获取所有收集图元的几何图形(如果可能)。如果 Revit 中缺少内容，它可能会返回警告和空值，或者几何图形无法解析
geometry = Element.Geometry(element=以下类别的所有图元)
