# Dynamo graph GetGeometryForAllElementsOfCategory.dyn (Dynamo 3.0.3.7597)
# author: Autodesk
# 收集所选类别的所有图元(默认为门)并获取每个图元几何图形

# note: 选择 Revit 类别
类别 = Categories("OST_Doors")
# note: 收集该选定类别的所有图元
以下类别的所有图元 = ElementsOfCategory(Category=类别)
# note: 获取所有收集图元的几何图形(如果可能)。如果 Revit 中缺少内容，它可能会返回警告和空值，或者几何图形无法解析
geometry = Element.Geometry(element=以下类别的所有图元)
