# Dynamo graph Import Data From Excel.dyn "从 Excel 导入数据" (Dynamo 4.0.0.3277)
# author: Autodesk
# 从 Excel 文件导入数据并转置数据以翻转列和行

# note: 浏览到要从中输入数据的 Excel 文件
file_path = Filename("未选择文件。")
# note: 键入图纸名称，但请注意大写
string = StringInput("")
# note: 使用 OpenXML 格式从选定的图纸名称导入 Excel 数据
openXMLImportExcel = Data.OpenXMLImportExcel(filePath=file_path, sheetName=string)
# note: 转置 Excel 数据以翻转行和列
transpose = List.Transpose(lists=openXMLImportExcel)
watch = Watch(transpose)
