# Dynamo graph Read Image From File.dyn "从文件读取图像" (Dynamo 4.0.0.3277)
# author: Autodesk
# 从磁盘读取图像，以便能够在 Dynamo 内使用

# note: 浏览到要导入的图像文件
file_path = Filename("未选择文件。")
# note: 将图像文件从磁盘加载到 Dynamo 内存中
文件来自以下路径 = FileObject(path=file_path)
# note: 在 Dynamo 内存空间中以位图格式从文件读取图像
readFromFile = Image.ReadFromFile(file=文件来自以下路径)
# note: 观看图像以直观地进行检查
观看图像 = WatchImageCore(image=readFromFile)
