# Dynamo graph Collect All Elements Of Category And Get Parameters.dyn (Dynamo 3.4.0.6892)
# author: Autodesk
# 收集所選品類 (預設為房間) 的所有元素，並取得每個元素的房間面積

# note: 選取 Revit 品類
categories = Categories("OST_Rooms")
# note: 收集該所選品類的所有元素
all_elements_of_category = ElementsOfCategory(Category=categories)
# note: 輸入參數名稱，並請注意大小寫
string = StringInput("面積")
# note: 從 Elements by Category 透過參數名稱取得參數值
getParameterValueByName = Element.GetParameterValueByName(element=all_elements_of_category, parameterName=string)
