# Dynamo graph Collect All Elements Of Category.dyn (Dynamo 3.4.0.6892)
# author: Autodesk
# 收集所選品類 (預設為房間) 的所有元素

# note: 選取 Revit 品類
categories = Categories("OST_Rooms")
# note: 收集該所選品類的所有元素
all_elements_of_category = ElementsOfCategory(Category=categories)
# note: 觀看收集所選品類每個元素的結果
watch = Watch(all_elements_of_category)
