# Dynamo graph Export Data To Excel.dyn "將資料匯出至 Excel" (Dynamo 4.0.0.3277)
# author: Autodesk
# 給定選擇的圖紙名稱，將資料匯出到 Excel。您必須連線要匯出的資料

# note: 瀏覽至要將資料匯出到的 Excel 檔案
file_path = Filename("未選取檔案。")
# note: 輸入圖紙名稱，但請注意大小寫
string = StringInput("")
# note: 使用 OpenXML 格式從選擇的圖紙名稱匯出 Excel 資料
openXMLExportExcel = Data.OpenXMLExportExcel(filePath=file_path, sheetName=string)  # unwired: data
