# Dynamo graph Get Geometry For All Elements Of Category.dyn "取得品類所有元素的幾何圖形" (Dynamo 3.4.0.6892)
# author: Autodesk
# 收集所選品類 (預設為房間) 的所有元素，並取得每個元素的幾何圖形

# note: 選取 Revit 品類
# note: 我們建議您以模型中應該存在的品類來儲存圖表，以避免出現警告。
# 例如，請嘗試以範例模型 Snowdon Towers Sample Architectural.rvt 的「門」品類儲存圖表並執行，此範例模型位於:
# C:\Program Files\Autodesk\<Revit ....>\Samples
categories = Categories("OST_Doors")
# note: 收集該所選品類的所有元素
all_elements_of_category = ElementsOfCategory(Category=categories)
# note: 盡可能取得所有已收集元素的幾何圖形。如果 Revit 中缺少某些內容，或幾何圖形無法解析，則可能會傳回警告和空值
geometry = Element.Geometry(element=all_elements_of_category)
