# Dynamo graph Import Data From Excel.dyn "從 Excel 匯入資料" (Dynamo 3.4.0.6892)
# author: Autodesk
# 從 Excel 檔案匯入資料並轉置資料，以翻轉欄和列

# note: 瀏覽至要從中匯入資料的 Excel 檔案
file_path = Filename("未選取檔案。")
# note: 輸入圖紙名稱，但請注意大小寫
string = StringInput("")
# note: 使用 OpenXML 格式從選擇的圖紙名稱匯入 Excel 資料
openXMLImportExcel = Data.OpenXMLImportExcel(filePath=file_path, sheetName=string)
# note: 轉置 Excel 資料以翻轉列和欄
transpose = List.Transpose(lists=openXMLImportExcel)
watch = Watch(transpose)
