# Dynamo graph Read Image From File.dyn "從檔案讀取影像" (Dynamo 4.0.0.3277)
# author: Autodesk
# 從磁碟讀取影像，以便能在 Dynamo 中使用

# note: 瀏覽至要匯入的影像檔
file_path = Filename("未選取檔案。")
# note: 將磁碟中的影像檔載入至 Dynamo 的記憶體
檔案來源路徑 = FileObject(path=file_path)
# note: 將檔案中的影像以點陣圖格式讀取到 Dynamo 的記憶體空間中
readFromFile = Image.ReadFromFile(file=檔案來源路徑)
# note: 觀看影像，以視覺方式檢查
watch_image = WatchImageCore(image=readFromFile)
