# Dynamo custom node Parse Weather Data.dyf (Dynamo 0.6.3.18002)
# category: Misc

number = DoubleInput(0)
string_to_number = String2Num(lacing=Longest)
WeatherDataFilePath = Input()
dateTimeObject = Input()
python_script_with_variable = Python(WeatherDataFilePath, dateTimeObject)  # "Python Script With Variable Number of Inputs"
# ---------- python_script_with_variable.python (73 lines) ----------
# Default imports
import clr
clr.AddReference('RevitAPI')
clr.AddReference('RevitAPIUI')
from Autodesk.Revit.DB import *
import Autodesk
import sys
import clr
#import dateTime
path = r'C:\Autodesk\Dynamo\Core'
exec_path = r'C:\Autodesk\Dynamo\Core\dll'
sys.path.append(path)
sys.path.append(exec_path)
clr.AddReference('LibGNet')
from Autodesk.LibG import *
from System import DateTime
import csv

#The input to this node will be stored in the IN0...INX variable(s).
path = IN0
dateobject = IN1


monthform = 'MM'
dayform = 'dd'
hourform = 'HH'
month = dateobject.ToString(monthform)
day = dateobject.ToString(dayform)
hour = dateobject.ToString(hourform)


ifile  = open(path, "rb")

input_file = csv.reader(ifile)
rowlist = []
rownum = 0
for row in input_file:
    # ignore the first header - this file has two for some reason
    if rownum == 0:
      timeZoneOffset = row[4]
      timeZoneOffset = timeZoneOffset.split(':')[1]
      timeZoneOffset = int(timeZoneOffset)
      rownum += 1
      continue

     # Save header row.	
    if rownum == 1:
        header = row
    else:
        colnum = 0
        dict = {}
        for col in row:
           
           dict[header[colnum]] = col 
           rowlist.append(dict)
           colnum += 1
   
   #keep track of row we're at.         
    rownum += 1


ifile.close()

skydata = 0

localHour = str(int(hour) + timeZoneOffset).zfill(2)

for row in rowlist:
	if row[" Month"] == month and row[" Day"] == day and row[" Hour"] == localHour:
		skydata = (row[' GlobHorizRad (Wh/m2)'],row[' DirNormRad (Wh/m2)'],row['DiffHorizRad (Wh/m2)'])

#Assign your output to the OUT variable
OUT = skydata
# ----------------------------------------
map = Map(string_to_number, python_script_with_variable)
get_from_list = GetFromList(number, map)
GHI = Output(get_from_list)
number_2 = DoubleInput(1)
get_from_list_2 = GetFromList(number_2, map)
DNI = Output(get_from_list_2)
number_3 = DoubleInput(2)
get_from_list_3 = GetFromList(number_3, map)
DHI = Output(get_from_list_3)
watch = Watch(python_script_with_variable)
watch_2 = Watch(WeatherDataFilePath)
