# Dynamo graph AdaptiveComponent.dyn (Dynamo 2.5.2.7915)

select_model_element = DSModelElementSelection()  # 1 picked in the model
curve = CurveElement.Curve(curveElement=select_model_element)
number_slider = DoubleSlider(5, range=0..5 step 0.1)
code_block = CodeBlock(x=number_slider) { 0..1..#x; }
pointAtParameter = Curve.PointAtParameter(curve=curve, param=code_block, lacing=CrossProduct)
select_model_element_2 = DSModelElementSelection()  # 1 picked in the model
curve_2 = CurveElement.Curve(curveElement=select_model_element_2)
code_block_2 = CodeBlock(x=number_slider) { 0..1..#x; }
pointAtParameter_2 = Curve.PointAtParameter(curve=curve_2, param=code_block_2, lacing=CrossProduct)
select_model_element_3 = DSModelElementSelection()  # 1 picked in the model
curve_3 = CurveElement.Curve(curveElement=select_model_element_3)
code_block_3 = CodeBlock(x=number_slider) { 0..1..#x; }
pointAtParameter_3 = Curve.PointAtParameter(curve=curve_3, param=code_block_3, lacing=CrossProduct)
code_block_4 = CodeBlock(a=pointAtParameter, b=pointAtParameter_2, c=pointAtParameter_3) { [a<1>,b<2>,c<3>]; }
transpose = List.Transpose(lists=code_block_4)
family_types = FamilyTypes("3PointAC_wireTruss:3PointAC_wireTruss")
byPoints = AdaptiveComponent.ByPoints(points=transpose, familyType=family_types)
