# Dynamo graph AdaptiveComponentByCurve.dyn (Dynamo 0.7.0.25719)

code_block = CodeBlock { {0..1..#10}; }
select_model_element = DSModelElementSelection()  # 1 picked in the model
curve = CurveElement.Curve(select_model_element, lacing=Longest)
family_types = FamilyTypes(index=0)
byParametersOnCurveReference = AdaptiveComponent.ByParametersOnCurveReference(code_block, curve, family_types, lacing=Longest)
flatten = Flatten(byParametersOnCurveReference)
