# Dynamo graph AdaptiveComponentsByCurveInBatch.dyn (Dynamo 0.9.1.3052)

code_block = CodeBlock { {{0.0, 0.1}, {0.1, 0.2}, {0.2, 0.3}, {0.3, 0.4}}; }
select_model_element = DSModelElementSelection()  # 1 picked in the model
curve = CurveElement.Curve(select_model_element)
family_types = FamilyTypes("two_points_simple_component:two_points_simple_component")
batchByParametersOnCurveReference = AdaptiveComponent.BatchByParametersOnCurveReference(code_block, curve, family_types)
