# Dynamo graph AdaptiveComponentsByFaceInBatch.dyn (Dynamo 0.9.1.3052)

code_block = CodeBlock { {{0.0, 0.1}, {0.1, 0.2}}; }
code_block_2 = CodeBlock { {{0.0, 0.2}, {0.2, 0.4}}; }
byCoordinates = UV.ByCoordinates(code_block, code_block_2, lacing=CrossProduct)
code_block_3 = CodeBlock { 1; }
flatten = List.Flatten(list=byCoordinates, amt=code_block_3)
code_block_4 = CodeBlock(a=flatten) { {a[0], a[1], a[3], a[2]}; }
transpose = List.Transpose(code_block_4)
select_face = DSFaceSelection()  # 1 picked in the model
code_block_5 = CodeBlock(a=select_face) { a[0]; }
family_types = FamilyTypes("four_points_simple_component:four_points_simple_component")
batchByParametersOnFace = AdaptiveComponent.BatchByParametersOnFace(transpose, code_block_5, family_types)
