# Dynamo graph AdaptiveComponentsByPointsInBatch.dyn (Dynamo 0.9.1.3052)

code_block = CodeBlock()
# ---------- code_block.designscript (5 lines) ----------
data = 0..10..2;
pts1 = Point.ByCoordinates(data, 3, 0);
pts2 = Point.ByCoordinates(data, -3, 0);
pts3 = Point.ByCoordinates(data, 0, 6+5*Math.Sin(data));
pts = {pts1, pts2, pts3};
# ----------------------------------------
transpose = List.Transpose(code_block.pts)
family_types = FamilyTypes("three_points_simple_component:three_points_simple_component")
batchByPoints = AdaptiveComponent.BatchByPoints(transpose, family_types)
