# Dynamo graph AdaptiveComponentsByPointsOnFace.dyn (Dynamo 1.3.3.6540)

code_block = CodeBlock { {{0.4, 0.1}, {0.1, 0.2}}; }
code_block_2 = CodeBlock(x=code_block) { (x+1)*2; }
code_block_3 = CodeBlock { {{0.3, 0.2}, {0.5, 0.4}}; }
code_block_4 = CodeBlock(x=code_block_3) { (x+2)*2; }
byCoordinates = UV.ByCoordinates(code_block_2, code_block_4, lacing=CrossProduct)
code_block_5 = CodeBlock { 1; }
flatten = List.Flatten(list=byCoordinates, amt=code_block_5)
code_block_6 = CodeBlock(a=flatten) { {a[0], a[1], a[3], a[2]}; }
transpose = List.Transpose(code_block_6)
select_face = DSFaceSelection()  # 1 picked in the model
code_block_7 = CodeBlock(a=select_face) { a[0]; }
family_types = FamilyTypes("four_points_simple_component:four_points_simple_component")
byParametersOnFace = AdaptiveComponent.ByParametersOnFace(transpose, code_block_7, family_types)
geometry = Element.Geometry(byParametersOnFace)
volume = Solid.Volume(geometry)
flatten_2 = Flatten(volume)
sum = Math.Sum(flatten_2)
