# Dynamo graph PointAnalysisDisplay_ByViewAndPointAnalysisData.dyn (Dynamo 0.7.6.3796)

views = Views("{3D}")
# note: Select two surfaces.
select_face = DSFaceSelection()  # 1 picked in the model
code_block = CodeBlock { 0..1..0.05; }
pointAtParameter = Surface.PointAtParameter(select_face, code_block, code_block, lacing=CrossProduct)
flatten = Flatten(pointAtParameter)
select_face_2 = DSFaceSelection()  # 1 picked in the model
pointAtParameter_2 = Surface.PointAtParameter(select_face_2, code_block, code_block, lacing=CrossProduct)
flatten_2 = Flatten(pointAtParameter_2)
join = List.Join(flatten, flatten_2)
number = DoubleInput(1)
count = Count(join)
number_range = NumberRange(number, count, number, lacing=Longest)
byPointsAndValues = Analysis.PointData.ByPointsAndValues(join, number_range)
string = StringInput("&amp;quot;Test Point Analysis Display&amp;quot;")
string_2 = StringInput("&amp;quot;A test set of values.&amp;quot;")
unit_types = UnitTypes("Insolation")
byViewAndPointAnalysisData = Revit.AnalysisDisplay.PointAnalysisDisplay.ByViewAndPointAnalysisData(views, byPointsAndValues, string, string_2, unit_types)
