# Dynamo graph SurfaceAnalysisDisplay_ByViewAndPointAnalysisData.dyn (Dynamo 0.7.6.3796)

views = Views("{3D}")
select_face = DSFaceSelection()  # 1 picked in the model
firstItem = List.FirstItem(select_face)
code_block = CodeBlock { 0..1..0.05; }
byCoordinates = UV.ByCoordinates(code_block, code_block, lacing=CrossProduct)
number = DoubleInput(1)
count = Count(byCoordinates)
number_range = NumberRange(number, count, number, lacing=Longest)
bySurfacePointsAndValues = Analysis.SurfaceData.BySurfacePointsAndValues(firstItem, byCoordinates, number_range)
string = StringInput("Test Point Analysis Display")
string_2 = StringInput("A test set of values.")
unit_types = UnitTypes("Insolation")
byViewAndFaceAnalysisData = Revit.AnalysisDisplay.FaceAnalysisDisplay.ByViewAndFaceAnalysisData(views, bySurfacePointsAndValues, string, string_2, unit_types)
