# Dynamo graph VectorAnalysisDisplay_ByViewAndVectorAnalysisData.dyn (Dynamo 0.7.6.3916)

views = Views("{3D}")
select_face = DSFaceSelection()  # 1 picked in the model
code_block = CodeBlock { 0..1..0.05; }
pointAtParameter = Surface.PointAtParameter(select_face, code_block, code_block, lacing=CrossProduct)
flatten = Flatten(pointAtParameter)
# note: Select two surfaces.
select_face_2 = DSFaceSelection()  # 1 picked in the model
pointAtParameter_2 = Surface.PointAtParameter(select_face_2, code_block, code_block, lacing=CrossProduct)
flatten_2 = Flatten(pointAtParameter_2)
join = List.Join(flatten, flatten_2)
ZAxis = Vector.ZAxis()
count = Count(join)
ofRepeatedItem = List.OfRepeatedItem(ZAxis, count)
number_slider = DoubleSlider(8.229, range=0..100 step 0.01)
count_2 = Count(ofRepeatedItem)
code_block_2 = CodeBlock(max=number_slider, count=count_2) { 0.1..max..#count; }
scale = Vector.Scale(ofRepeatedItem, code_block_2)
byPointsAndValues = Analysis.VectorData.ByPointsAndValues(join, scale)
string = StringInput("Test Point Analysis Display")
string_2 = StringInput("A test set of values.")
unit_types = UnitTypes("Insolation")
byViewAndVectorAnalysisData = Revit.AnalysisDisplay.VectorAnalysisDisplay.ByViewAndVectorAnalysisData(views, byPointsAndValues, string, string_2, unit_types)
