# Dynamo graph DetailCurve.dyn (Dynamo 1.1.1.2204)

# group: View
current = Document.Current()
activeView = Document.ActiveView(current)

# group: Geometry
byCoordinates = Point.ByCoordinates()
code_block = CodeBlock { 300; }
byCoordinates_2 = Point.ByCoordinates(y=code_block)
byStartPointEndPoint = Line.ByStartPointEndPoint(startPoint=byCoordinates, endPoint=byCoordinates_2)

byCurve = DetailCurve.ByCurve(activeView, byStartPointEndPoint)
