# Dynamo graph Dimension.dyn (Dynamo 1.1.1.2204)

# group: View
current = Document.Current()

activeView = Document.ActiveView(current)
byCoordinates = Point.ByCoordinates()
code_block = CodeBlock { 1000; }
byCoordinates_2 = Point.ByCoordinates(x=code_block)
byStartPointEndPoint = Line.ByStartPointEndPoint(startPoint=byCoordinates, endPoint=byCoordinates_2)
byCurve = ModelCurve.ByCurve(byStartPointEndPoint)
code_block_2 = CodeBlock { 1000; }
byCoordinates_3 = Point.ByCoordinates(y=code_block_2)
byCoordinates_4 = Point.ByCoordinates(x=code_block_2, y=code_block_2)
byStartPointEndPoint_2 = Line.ByStartPointEndPoint(startPoint=byCoordinates_3, endPoint=byCoordinates_4)
byCurve_2 = ModelCurve.ByCurve(byStartPointEndPoint_2)
create = List.Create(byCurve, byCurve_2)
byStartPointEndPoint_3 = Line.ByStartPointEndPoint(startPoint=byCoordinates, endPoint=byCoordinates_3)
byElements = Dimension.ByElements(activeView, create, byStartPointEndPoint_3)
prefix = Dimension.Prefix(byElements)
suffix = Dimension.Suffix(byElements)
value = Dimension.Value(byElements)
