# Dynamo graph FilledRegion.dyn (Dynamo 1.1.1.2204)

# group: View
current = Document.Current()
activeView = Document.ActiveView(current)

# group: Geometry
code_block = CodeBlock { 300; }
byCenterPointRadius = Circle.ByCenterPointRadius(radius=code_block)
regularPolygon = Polygon.RegularPolygon(circle=byCenterPointRadius)
explode = Geometry.Explode(regularPolygon)

filled_region_type_selector = FilledRegionTypes("Solid Black")
byCurves = FilledRegion.ByCurves(activeView, explode, filled_region_type_selector)
