# Dynamo graph FilterRule.dyn (Dynamo 1.1.1.2204)

current = Document.Current()
activeView = Document.ActiveView(current)
code_block = CodeBlock { "MyRule"; }
categories = Categories("Walls")
select_rule_type = RuleTypes("Equals")
code_block_2 = CodeBlock { "Comments"; }
byCoordinates = Point.ByCoordinates()
code_block_3 = CodeBlock { 500; }
byCoordinates_2 = Point.ByCoordinates(x=code_block_3)
byStartPointEndPoint = Line.ByStartPointEndPoint(startPoint=byCoordinates, endPoint=byCoordinates_2)
code_block_4 = CodeBlock { 10; }
levels = Levels("Level 1")
code_block_5 = CodeBlock { "Generic - 8\""; }
byName = WallType.ByName(code_block_5)
byCurveAndHeight = Wall.ByCurveAndHeight(curve=byStartPointEndPoint, height=code_block_4, level=levels, wallType=byName)
code_block_6 = CodeBlock { "Comments"; }
parameterByName = Parameter.ParameterByName(element=byCurveAndHeight, name=code_block_6)
byRuleType = Revit.Filter.FilterRule.ByRuleType(select_rule_type, code_block_2, parameterByName)
byRules = Revit.Filter.ParameterFilterElement.ByRules(code_block, categories, byRuleType)
byProperties = Revit.Filter.OverrideGraphicSettings.ByProperties()
setFilterOverrides = View.SetFilterOverrides(activeView, byRules, byProperties)
