# Dynamo graph Location.dyn (Dynamo 1.1.1.2204)

byCoordinates = Point.ByCoordinates()
code_block = CodeBlock { 500; }
byCoordinates_2 = Point.ByCoordinates(x=code_block)
byStartPointEndPoint = Line.ByStartPointEndPoint(startPoint=byCoordinates, endPoint=byCoordinates_2)
code_block_2 = CodeBlock { 10; }
levels = Levels("Level 1")
code_block_3 = CodeBlock { "Generic - 8\""; }
byName = WallType.ByName(code_block_3)
byCurveAndHeight = Wall.ByCurveAndHeight(curve=byStartPointEndPoint, height=code_block_2, level=levels, wallType=byName)

# group: Update Location
byCoordinates_3 = Point.ByCoordinates()
code_block_4 = CodeBlock { 300; }
byCoordinates_4 = Point.ByCoordinates(y=code_block_4)
byStartPointEndPoint_2 = Line.ByStartPointEndPoint(startPoint=byCoordinates_3, endPoint=byCoordinates_4)

setLocation = Element.SetLocation(byCurveAndHeight, byStartPointEndPoint_2)
getLocation = Element.GetLocation(byCurveAndHeight)
