# Dynamo graph Material.dyn (Dynamo 1.1.1.2204)

byCoordinates = Point.ByCoordinates()
code_block = CodeBlock { 500; }
byCoordinates_2 = Point.ByCoordinates(x=code_block)
byStartPointEndPoint = Line.ByStartPointEndPoint(startPoint=byCoordinates, endPoint=byCoordinates_2)
code_block_2 = CodeBlock { 10; }
levels = Levels("Level 1")
code_block_3 = CodeBlock { "Generic - 8\""; }
byName = WallType.ByName(code_block_3)
byCurveAndHeight = Wall.ByCurveAndHeight(curve=byStartPointEndPoint, height=code_block_2, level=levels, wallType=byName)
getMaterials = Element.GetMaterials(element=byCurveAndHeight)

# group: Properties
appearanceParameters = Material.AppearanceParameters(getMaterials)
color = Material.Color(getMaterials)
cutPatternColor = Material.CutPatternColor(getMaterials)
cutPatternId = Material.CutPatternId(getMaterials)
materialCategory = Material.MaterialCategory(getMaterials)
materialClass = Material.MaterialClass(getMaterials)
name = Material.Name(getMaterials)
shininess = Material.Shininess(getMaterials)
smoothness = Material.Smoothness(getMaterials)
structuralParameters = Material.StructuralParameters(getMaterials)
surfacePatternColor = Material.SurfacePatternColor(getMaterials)
thermalParameters = Material.ThermalParameters(getMaterials)
transparency = Material.Transparency(getMaterials)
