# Dynamo graph Parameter.dyn (Dynamo 1.1.1.2204)

byCoordinates = Point.ByCoordinates()
code_block = CodeBlock { 500; }
byCoordinates_2 = Point.ByCoordinates(x=code_block)
byStartPointEndPoint = Line.ByStartPointEndPoint(startPoint=byCoordinates, endPoint=byCoordinates_2)
code_block_2 = CodeBlock { 10; }
levels = Levels("Level 1")
code_block_3 = CodeBlock { "Generic - 8\""; }
byName = WallType.ByName(code_block_3)
byCurveAndHeight = Wall.ByCurveAndHeight(curve=byStartPointEndPoint, height=code_block_2, level=levels, wallType=byName)
parameters = Element.Parameters(byCurveAndHeight)

# group: Properties
group = Parameter.Group(parameters)
isShared = Parameter.IsShared(parameters)
unitType = Parameter.UnitType(parameters)
parameterType = Parameter.ParameterType(parameters)
isReadOnly = Parameter.IsReadOnly(parameters)
value = Parameter.Value(parameters)
storageType = Parameter.StorageType(parameters)
id = Parameter.Id(parameters)

# group: SetValue
code_block_4 = CodeBlock { "Comments"; }
parameterByName = Parameter.ParameterByName(element=byCurveAndHeight, name=code_block_4)
code_block_5 = CodeBlock { "7"; }
setValue = Parameter.SetValue(parameterByName, code_block_5)

# group: Create Parameter
code_block_6 = CodeBlock { "bbAx"; }
parameter_type = ParameterType("Text")
builtin_parameter_group = BuiltInParameterGroup("PG_TEXT")
boolean = BoolSelector(false)
categories = Categories("Walls")
createSharedParameter = Parameter.CreateSharedParameter(code_block_6, code_block_6, parameter_type, builtin_parameter_group, boolean, categories)
createProjectParameter = Parameter.CreateProjectParameter(code_block_6, code_block_6, parameter_type, builtin_parameter_group, boolean, categories)
