# Dynamo graph Revisions.dyn (Dynamo 1.1.1.2204)

# group: View
current = Document.Current()
activeView = Document.ActiveView(current)

# group: Geometry
code_block = CodeBlock { 5000; }
byCenterPointRadius = Circle.ByCenterPointRadius(radius=code_block)
code_block_2 = CodeBlock { 6; }
regularPolygon = Polygon.RegularPolygon(circle=byCenterPointRadius, numberSides=code_block_2)
explode = Geometry.Explode(regularPolygon)

code_block_3 = CodeBlock { "demo"; }
code_block_4 = CodeBlock { "damoValue"; }
boolean = BoolSelector(false)
revision_visibility = RevisionVisibility("CloudAndTagVisible")
revision_number_type = RevisionNumberType("Alphanumeric")
byName = Revision.ByName(code_block_3, code_block_4, code_block_4, boolean, code_block_4, code_block_4, revision_visibility, revision_number_type)
byCurve = RevisionCloud.ByCurve(activeView, explode, byName)
revision = RevisionCloud.Revision(byCurve)

# group: Properties
issued = Revision.Issued(byName)
issuedBy = Revision.IssuedBy(byName)
issuedTo = Revision.IssuedTo(byName)
revisionDate = Revision.RevisionDate(byName)
