# Dynamo graph Room.dyn (Dynamo 1.1.1.2204)

# group: Properties
levels = Levels("Level 1")
byCoordinates = Point.ByCoordinates()
code_block = CodeBlock { "myRoom"; }
code_block_2 = CodeBlock { "myNumber"; }

byLocation = Room.ByLocation(levels, byCoordinates, code_block, code_block_2)
area = Room.Area(byLocation)
height = Room.Height(byLocation)
name = Room.Name(byLocation)
number = Room.Number(byLocation)

# group: Query
element_types = ElementTypes("SpatialElement")
all_elements_of_type = ElementsOfType(element_types)

name_2 = Room.Name(all_elements_of_type)
number_2 = Room.Number(all_elements_of_type)
height_2 = Room.Height(all_elements_of_type)
area_2 = Room.Area(all_elements_of_type)
