# Dynamo graph Room_Properties.dyn (Dynamo 1.2.3)

categories = Categories("Rooms")
all_elements_of_category = ElementsOfCategory(categories)
code_block = CodeBlock(a=all_elements_of_category) { a[0]; }
area = Room.Area(code_block)
height = Room.Height(code_block)
number = Room.Number(code_block)
