# Dynamo graph Tag.dyn (Dynamo 1.1.1.2204)

# group: View
current = Document.Current()
activeView = Document.ActiveView(current)

# group: Wall
byCoordinates = Point.ByCoordinates()
code_block = CodeBlock { 30; }
byCoordinates_2 = Point.ByCoordinates(y=code_block)
byStartPointEndPoint = Line.ByStartPointEndPoint(startPoint=byCoordinates, endPoint=byCoordinates_2)
code_block_2 = CodeBlock { 30; }
levels = Levels("Level 1")
code_block_3 = CodeBlock { "Generic - 8\""; }
byName = WallType.ByName(code_block_3)
byCurveAndHeight = Wall.ByCurveAndHeight(curve=byStartPointEndPoint, height=code_block_2, level=levels, wallType=byName)

boolean = BoolSelector(false)
center = Autodesk.Revit.DB.HorizontalAlignmentStyle.Center()
middle = Autodesk.Revit.DB.VerticalAlignmentStyle.Middle()
byCoordinates_3 = Vector.ByCoordinates()
byElement = Tag.ByElement(activeView, byCurveAndHeight, boolean, boolean, center, middle, byCoordinates_3)
