# Dynamo graph TextNote.dyn (Dynamo 1.1.1.2204)

# group: View
current = Document.Current()
activeView = Document.ActiveView(current)

# group: Geometry
byCoordinates = Point.ByCoordinates()

code_block = CodeBlock { "Hello World"; }
code_block_2 = CodeBlock { "Center"; }
default = TextNoteType.Default()
byLocation = TextNote.ByLocation(view=activeView, location=byCoordinates, text=code_block, alignment=code_block_2, type=default)

# group: Properties
verticalAlignment = TextNote.VerticalAlignment(byLocation)
text = TextNote.Text(byLocation)
horizontalAlignment = TextNote.HorizontalAlignment(byLocation)
typename = TextNote.Typename(byLocation)
height = TextNote.Height(byLocation)
