# Dynamo graph GetSetTextureImage.dyn (Dynamo 2.14.0.4641)

string = StringInput("Acoustic Ceiling Tile 24 x 24")
byName = Material.ByName(name=string)
appearanceAssetElement = Material.AppearanceAssetElement(material=byName)
getRenderingAssetTextureImages = AppearanceAssetElement.GetRenderingAssetTextureImages(appearanceAssetElement=appearanceAssetElement)
code_block = CodeBlock(a=getRenderingAssetTextureImages.imageProperties) { a[0]; }
file_path = Filename(".\TextureImageTest.txt")
setRenderingAssetTextureImage = AppearanceAssetElement.SetRenderingAssetTextureImage(appearanceAssetElement=appearanceAssetElement, imageProperty=code_block, imagePath=file_path)
getRenderingAssetTextureImages_2 = AppearanceAssetElement.GetRenderingAssetTextureImages(appearanceAssetElement=setRenderingAssetTextureImage)
firstItem = List.FirstItem(list=getRenderingAssetTextureImages_2.imagePaths)
