# Dynamo graph canGetAreaBoundaries.dyn (Dynamo 2.6.0.7237)

categories = Categories("OST_Areas")
all_elements_of_category = ElementsOfCategory(Category=categories)
boundaries = Area.Boundaries(area=all_elements_of_category)
