# Dynamo graph Defect_MAGN_2576.dyn (Dynamo 0.8.0.701)

number = DoubleInput(0)
byOrigin = CoordinateSystem.ByOrigin(number, number, number)
# note: Wall Distance
number_slider = DoubleSlider(18.833, range=1..20 step 0.1)
byWidthHeight = Rectangle.ByWidthHeight(byOrigin, number_slider, number_slider, lacing=Longest)
curves = PolyCurve.Curves(byWidthHeight)
# note: Wall Fillet Radius
number_slider_2 = DoubleSlider(4, range=1..4 step 0.1)
boolean = BoolSelector(false)
fillet = PolyCurve.Fillet(byWidthHeight, number_slider_2, boolean)
curves_2 = PolyCurve.Curves(fillet)
floor_types = FloorTypes("6\" Foundation Slab")
levels = Levels()
byOutlineTypeAndLevel = Floor.ByOutlineTypeAndLevel(outlineCurves=curves_2, floorType=floor_types, level=levels)
