# Dynamo graph MAGN_10069.dyn (Dynamo 1.0.1.1710)

family_types = FamilyTypes("Concrete-Rectangular-Column:12 x 18")
code_block = CodeBlock { Point.ByCoordinates(5..25..#11, 0, 0); }
integer_slider = IntegerSlider(1, range=1..100 step 1)
integer_slider_2 = IntegerSlider(6, range=2..100 step 1)
integer_slider_3 = IntegerSlider(1, range=1..100 step 1)
slice = List.Slice(code_block, integer_slider, integer_slider_2, integer_slider_3)
levels = Levels("Level 1")
byPointAndLevel = FamilyInstance.ByPointAndLevel(familyType=family_types, point=slice, level=levels)
location = FamilyInstance.Location(byPointAndLevel)
watch = Watch(location)
number_slider = DoubleSlider(11.7, range=0..100 step 0.1)
setRotation = FamilyInstance.SetRotation(familyInstance=byPointAndLevel, degree=number_slider)
location_2 = FamilyInstance.Location(setRotation)
