# Dynamo graph MAGN_122_wallsAndFloorsAndLevels.dyn (Dynamo 1.0.1.1821)

identity = CoordinateSystem.Identity()
number = DoubleInput(0..54..10)
formula = Formula("x+3", x=number, lacing=Longest)
byCoordinates = Point.ByCoordinates(z=formula)
asVector = Point.AsVector(byCoordinates)
translate = CoordinateSystem.Translate(identity, asVector, lacing=Longest)
number_2 = DoubleInput(20)
byWidthLength = Rectangle.ByWidthLength(cs=translate, width=number_2, length=number_2, lacing=Longest)
curves = PolyCurve.Curves(byWidthLength, lacing=Longest)
floor_types = FloorTypes("Generic - 12\"")
fromObject = String.FromObject(number, lacing=Longest)
restOfItems = List.RestOfItems(fromObject)
string = StringInput("a")
concat = String.Concat(arg1=string)
map = List.Map(list=restOfItems, f_x=concat)
byElevationAndName = Level.ByElevationAndName(number, map, lacing=Longest)
byOutlineTypeAndLevel = Floor.ByOutlineTypeAndLevel(outlineCurves=curves, floorType=floor_types, level=byElevationAndName, lacing=Longest)
number_3 = DoubleInput(10)
wall_types = WallTypes("Generic - 12\"")
byCurveAndHeight = Wall.ByCurveAndHeight(curve=curves, height=number_3, level=byElevationAndName, wallType=wall_types, lacing=Longest)
