# Dynamo graph MAGN_5870.dyn (Dynamo 0.7.5.3566)

categories = Categories("Sheets")
all_elements_of_category = ElementsOfCategory(categories)
code_block = CodeBlock(a=all_elements_of_category) { a.GetParameterValueByName("Sheet Number"); }
code_block_2 = CodeBlock(a=all_elements_of_category) { a.GetParameterValueByName("Sheet Number"); }
code_block_3 = CodeBlock(a=all_elements_of_category) { a.GetParameterValueByName("Sheet Number"); }
code_block_4 = CodeBlock { "Sheet Number"; }
getParameterValueByName = Element.GetParameterValueByName(all_elements_of_category, code_block_4)
