# Dynamo graph MAGN_66.dyn (Dynamo 1.0.1.1821)

select_model_element = DSModelElementSelection()  # 1 picked in the model
geometry = Element.Geometry(select_model_element)
number = DoubleInput(0.1)
pointAtParameter = Curve.PointAtParameter(curve=geometry, param=number, lacing=Longest)
byPoint = ReferencePoint.ByPoint(pointAtParameter, lacing=Longest)
watch = Watch(byPoint)
geometry_2 = Element.Geometry(select_model_element)
number_2 = DoubleInput(0.9)
pointAtParameter_2 = Curve.PointAtParameter(curve=geometry_2, param=number_2, lacing=Longest)
ZAxis = Vector.ZAxis()
asPoint = Vector.AsPoint(ZAxis, lacing=Longest)
asVector = Point.AsVector(asPoint)
add = Point.Add(point=pointAtParameter_2, vectorToAdd=asVector, lacing=Longest)
asVector_2 = Point.AsVector(asPoint)
add_2 = Point.Add(point=pointAtParameter, vectorToAdd=asVector_2, lacing=Longest)
byStartPointEndPoint = Line.ByStartPointEndPoint(startPoint=add, endPoint=add_2, lacing=Longest)
referenceCurveByCurve = ModelCurve.ReferenceCurveByCurve(byStartPointEndPoint, lacing=Longest)
watch_2 = Watch(referenceCurveByCurve)
