# Dynamo graph MAGN_6710.dyn (Dynamo 0.8.1.962)

code_block = CodeBlock { 1..10..1; }
byCoordinates = Point.ByCoordinates(x=code_block, y=code_block)
byCoordinates_2 = Point.ByCoordinates(x=code_block, y=code_block, z=code_block)
byStartPointEndPoint = Line.ByStartPointEndPoint(startPoint=byCoordinates, endPoint=byCoordinates_2)
byPoint = ReferencePoint.ByPoint(byCoordinates)
byReferencePoints = CurveByPoints.ByReferencePoints(byPoint)
