# Dynamo graph MAGN_7075.dyn (Dynamo 0.8.0.950)

select_model_elements = DSModelElementsSelection()
curve = CurveElement.Curve(select_model_elements)
byJoinedCurves = PolyCurve.ByJoinedCurves(curve)
number_of_floors = IntegerSlider(3, range=0..10 step 1)
floor_to_floor_height = LengthFromString(3.6576)
code_block = CodeBlock(numFloors=number_of_floors, height=floor_to_floor_height) { 0..#(numFloors+1)..height; }
byCoordinates = Vector.ByCoordinates(z=code_block)
translate = Geometry.Translate(geometry=byJoinedCurves, direction=byCoordinates)
floor_types = FloorTypes("3\" LW Concrete on 2\" Metal Deck")
code_block_2 = CodeBlock { "Roof"; }
code_block_3 = CodeBlock(numFloors=number_of_floors) { 1..numFloors; }
string_from_object = FromObject(code_block_3)
code_block_4 = CodeBlock(name=string_from_object) { "Lvl " + name; }
addItemToEnd = List.AddItemToEnd(code_block_2, code_block_4)
byElevationAndName = Level.ByElevationAndName(code_block, addItemToEnd)
byOutlineTypeAndLevel = Floor.ByOutlineTypeAndLevel(outline=translate, floorType=floor_types, level=byElevationAndName)
