# Dynamo graph MAGN_7641_simplified.dyn (Dynamo 0.8.2.1802)

code_block = CodeBlock { 2; }
byLengths = Cuboid.ByLengths(width=code_block, length=code_block, height=code_block)
byGeometry = ImportInstance.ByGeometry(byLengths)
all_elements_in_active_view = ElementsInView()
watch = Watch(all_elements_in_active_view)
