# Dynamo graph MAGN_7741.dyn (Dynamo 0.8.3.2433)

code_block = CodeBlock { pt1 = Point.ByCoordinates(0,0,0); pt2 = Point.ByCoordinates(10,0,0); l = Line.ByStartPointEndPoint(pt1, pt2); }
byCurve = ModelCurve.ByCurve(code_block.l)
code_block_2 = CodeBlock { 1; 255; 0; }
byARGB = Color.ByARGB(a=code_block_2.out0, r=code_block_2.out1, g=code_block_2.out2, b=code_block_2.out2)
overrideColorInView = Element.OverrideColorInView(element=byCurve, color=byARGB)
