# Dynamo graph MAGN_7977.dyn (Dynamo 0.8.3.2360)

select_face = DSFaceSelection()  # 1 picked in the model
code_block = CodeBlock(a=select_face) { a[0]; }
boundingBox = Geometry.BoundingBox(code_block)
maxPoint = BoundingBox.MaxPoint(boundingBox)
Z = Point.Z(maxPoint)
