# Dynamo graph MAGN_8367.dyn (Dynamo 0.9.0.2742)

select_model_element = DSModelElementSelection()  # 1 picked in the model
code_block = CodeBlock { 1; }
code_block_2 = CodeBlock { 255; }
byARGB = Color.ByARGB(a=code_block, r=code_block_2, g=code_block_2, b=code_block_2)
overrideColorInView = Element.OverrideColorInView(element=select_model_element, color=byARGB)
geometry = Element.Geometry(select_model_element)
