# Dynamo graph MAGN_8407.dyn (Dynamo 0.9.0.2770)

select_model_element = DSModelElementSelection()  # 1 picked in the model
code_block = CodeBlock { "Category"; }
getParameterValueByName = Element.GetParameterValueByName(element=select_model_element, parameterName=code_block)
watch = Watch(getParameterValueByName)
