# Dynamo graph StructuralFoundationTest.dyn (Dynamo 0.7.6.3932)

select_model_element = DSModelElementSelection()  # 1 picked in the model
location = FamilyInstance.Location(select_model_element)
watch = Watch(location)
