# Dynamo graph ByPolyCurveTypeAndLevel.dyn (Dynamo 2.10.1.3976)

byCoordinates = Point.ByCoordinates()
code_block = CodeBlock { 100; }
byCoordinates_2 = Point.ByCoordinates(x=code_block)
byStartPointEndPoint = Line.ByStartPointEndPoint(startPoint=byCoordinates, endPoint=byCoordinates_2)
byCoordinates_3 = Point.ByCoordinates(x=code_block, y=code_block)
byStartPointEndPoint_2 = Line.ByStartPointEndPoint(startPoint=byCoordinates_2, endPoint=byCoordinates_3)
byCoordinates_4 = Point.ByCoordinates(y=code_block)
byStartPointEndPoint_3 = Line.ByStartPointEndPoint(startPoint=byCoordinates_3, endPoint=byCoordinates_4)
byStartPointEndPoint_4 = Line.ByStartPointEndPoint(startPoint=byCoordinates_4, endPoint=byCoordinates)
list_create = List.Create(item0=byStartPointEndPoint, item1=byStartPointEndPoint_2, item2=byStartPointEndPoint_3, item3=byStartPointEndPoint_4)
byJoinedCurves = PolyCurve.ByJoinedCurves(curves=list_create)
ceiling_types = CeilingTypes("Generic - 4\"")
levels = Levels("Level 2")
byOutlineTypeAndLevel = Ceiling.ByOutlineTypeAndLevel(outline=byJoinedCurves, ceilingType=ceiling_types, level=levels)
