# Dynamo graph CanGetCeilingTypeThermal.dyn (Dynamo 2.10.1.3976)

select_model_element = DSModelElementSelection()  # 1 picked in the model
elementType = Element.ElementType(element=select_model_element)
getThermalProperties = CeilingType.GetThermalProperties(ceilingType=elementType)
absorptance = Watch(getThermalProperties.Absorptance)
heatTransferCoefficient = Watch(getThermalProperties.HeatTransferCoefficient)
roughness = Watch(getThermalProperties.Roughness)
thermalMass = Watch(getThermalProperties.ThermalMass)
thermalResistance = Watch(getThermalProperties.ThermalResistance)
