# Dynamo graph CurtainSystem.dyn (Dynamo 1.2.1.2802)

select_face = DSFaceSelection()  # 1 picked in the model
code_block = CodeBlock(a=select_face) { a[0]; }
code_block_2 = CodeBlock { "5' x 10'"; }
byName = CurtainSystemType.ByName(code_block_2)
byFace = CurtainSystem.ByFace(code_block, byName)
