# Dynamo graph CurveLoop.dyn (Dynamo 1.0.1.1821)

number = DoubleInput(-1)
number_2 = DoubleInput(1)
number_3 = DoubleInput(0)
byCoordinates = Point.ByCoordinates(x=number, y=number_2, z=number_3)
byCoordinates_2 = Point.ByCoordinates(x=number_2, y=number_2, z=number_3)
byStartPointEndPoint = Line.ByStartPointEndPoint(startPoint=byCoordinates, endPoint=byCoordinates_2)
byCoordinates_3 = Point.ByCoordinates(x=number_2, y=number, z=number_3)
byStartPointEndPoint_2 = Line.ByStartPointEndPoint(startPoint=byCoordinates_2, endPoint=byCoordinates_3)
byCoordinates_4 = Point.ByCoordinates(x=number, y=number, z=number_3)
byStartPointEndPoint_3 = Line.ByStartPointEndPoint(startPoint=byCoordinates_3, endPoint=byCoordinates_4)
byStartPointEndPoint_4 = Line.ByStartPointEndPoint(startPoint=byCoordinates_4, endPoint=byCoordinates)
create_list = List.Create(byStartPointEndPoint, byStartPointEndPoint_2, byStartPointEndPoint_3, byStartPointEndPoint_4)
byJoinedCurves = PolyCurve.ByJoinedCurves(create_list)
watch_3d = Watch3D(byJoinedCurves)
number_4 = DoubleInput(0.1)
ZAxis = Vector.ZAxis()
asPoint = Vector.AsPoint(ZAxis)
asVector = Point.AsVector(asPoint)
byThickeningCurve = PolyCurve.ByThickeningCurve(curve=create_list, thickness=number_4, nor=asVector, lacing=Longest)
