# Dynamo graph CurvebyPointsArc.dyn (Dynamo 1.0.1.1821)

number = DoubleInput(20)
number_2 = DoubleInput(0)
byCoordinates = Point.ByCoordinates(x=number, y=number_2, z=number_2, lacing=Longest)
byCoordinates_2 = Point.ByCoordinates(x=number_2, y=number, z=number_2, lacing=Longest)
number_3 = DoubleInput(-20)
byCoordinates_3 = Point.ByCoordinates(x=number_3, y=number_2, z=number_2, lacing=Longest)
byThreePoints = Arc.ByThreePoints(firstPoint=byCoordinates, secondPoint=byCoordinates_2, thirdPoint=byCoordinates_3, lacing=Longest)
byCurve = ModelCurve.ByCurve(byThreePoints, lacing=Longest)
