# Dynamo graph CurvebyPoints_ByReferencePoints.dyn (Dynamo 0.8.2.1521)

code_block = CodeBlock {  }
code_block_2 = CodeBlock { 1..10..1; }
byCoordinates = Point.ByCoordinates(x=code_block_2, y=code_block_2)
byCoordinates_2 = Point.ByCoordinates(x=code_block_2, y=code_block_2, z=code_block_2)
byStartPointEndPoint = Line.ByStartPointEndPoint(startPoint=byCoordinates, endPoint=byCoordinates_2)
byReferencePoints = CurveByPoints.ByReferencePoints()
byPoint = ReferencePoint.ByPoint(byCoordinates)
byReferencePoints_2 = CurveByPoints.ByReferencePoints(byPoint)
