# Dynamo graph GetCurveDomain.dyn (Dynamo 1.0.1.1821)

select_model_element = DSModelElementSelection()  # 1 picked in the model
get_curve_domain = CodeBlock { {0,1}; }
watch = Watch(get_curve_domain)
byCoordinates = Point.ByCoordinates(lacing=Longest)
ZAxis = Vector.ZAxis()
byOriginNormal = Plane.ByOriginNormal(origin=byCoordinates, normal=ZAxis)
number = DoubleInput(5)
number_2 = DoubleInput(0)
radiansToDegrees = Math.RadiansToDegrees(number_2)
PI = Math.PI()
sub = PI - number_2
radiansToDegrees_2 = Math.RadiansToDegrees(sub)
byPlaneRadiiAngles = EllipseArc.ByPlaneRadiiAngles(byOriginNormal, number, number, radiansToDegrees, radiansToDegrees_2, lacing=Longest)
get_curve_domain_2 = CodeBlock { {0,1}; }
watch_2 = Watch(get_curve_domain_2)
