# Dynamo graph OffsetCurve.dyn (Dynamo 1.0.1.1821)

number = DoubleInput(3)
number_2 = DoubleInput(5)
byOriginRadii = Ellipse.ByOriginRadii(arg1=number, arg2=number_2)
watch_3d = Watch3D()
number_3 = DoubleInput(0)
byCoordinates = Point.ByCoordinates(x=number_3, y=number_3, z=number_3)
number_4 = DoubleInput(1)
byCoordinates_2 = Point.ByCoordinates(x=number_4, y=number_3, z=number_4)
number_5 = DoubleInput(2)
byCoordinates_3 = Point.ByCoordinates(x=number_5, y=number_3, z=number_3)
number_6 = DoubleInput(3)
byCoordinates_4 = Point.ByCoordinates(x=number_6, y=number_3, z=number_4)
create_list = List.Create(byCoordinates, byCoordinates_2, byCoordinates_3, byCoordinates_4)
byControlPoints = NurbsCurve.ByControlPoints(create_list)
number_7 = DoubleInput(0.2)
offset = Curve.Offset(curve=byControlPoints, distance=number_7)
watch_3d_2 = Watch3D(offset)
radiansToDegrees = Math.RadiansToDegrees(number_3)
PI = Math.PI()
number_8 = DoubleInput(1.5)
mul = PI * number_8
radiansToDegrees_2 = Math.RadiansToDegrees(mul)
ZAxis = Vector.ZAxis()
byCenterPointRadiusAngle = Arc.ByCenterPointRadiusAngle(center=byCoordinates, radius=number, startAngle=radiansToDegrees, endAngle=radiansToDegrees_2, normal=ZAxis)
offset_2 = Curve.Offset(curve=byCenterPointRadiusAngle, distance=number_7)
watch_3d_3 = Watch3D(offset_2)
ZAxis_2 = Vector.ZAxis()
asPoint = Vector.AsPoint(ZAxis_2)
YAxis = Vector.YAxis()
asPoint_2 = Vector.AsPoint(YAxis)
byPoints = NurbsCurve.ByPoints(create_list)
offset_3 = Curve.Offset(curve=byPoints, distance=number_7)
watch_3d_4 = Watch3D(offset_3)
