# Dynamo graph ByEdges.dyn (Dynamo 2.8.0.2195)

# group: Create Dimension with window and door in Different Wall
views = Views("Level 1")
select_edges = SelectEdges()  # 4 picked in the model
select_edge = DSEdgeSelection()  # 1 picked in the model
code_block = CodeBlock { -1; }
byCoordinates = Vector.ByCoordinates(x=code_block)
code_block_2 = CodeBlock { 3; }
translate = Geometry.Translate(geometry=select_edge, direction=byCoordinates, distance=code_block_2)
byEdges = Dimension.ByEdges(view=views, referenceCurves=select_edges, line=translate)
