# Dynamo graph ByElementDirection.dyn (Dynamo 2.8.0.2195)

views = Views("Level 1")
select_model_element = DSModelElementSelection()  # 1 picked in the model
getLocation = Element.GetLocation(element=select_model_element)
direction = Line.Direction(line=getLocation)
ZAxis = Vector.ZAxis()
code_block = CodeBlock { 0; }
rotate = Vector.Rotate(vector=direction, axis=ZAxis, degrees=code_block)
byElementDirection = Dimension.ByElementDirection(view=views, element=select_model_element, direction=rotate)
