# Dynamo graph ByFaces.dyn (Dynamo 2.8.0.2195)

# group: Create Dimension on Wall with its window and door
views = Views("Level 1")
select_faces = SelectFaces()  # 6 picked in the model
flatten = List.Flatten(list=select_faces)
select_edge = DSEdgeSelection()  # 1 picked in the model
code_block = CodeBlock { -1; }
byCoordinates = Vector.ByCoordinates(y=code_block)
code_block_2 = CodeBlock { 3; }
translate = Geometry.Translate(geometry=select_edge, direction=byCoordinates, distance=code_block_2)
byFaces = Dimension.ByFaces(view=views, referenceSurfaces=flatten, line=translate)

# group: Create Dimension with 2 Walls
views_2 = Views("Level 1")
select_faces_2 = SelectFaces()  # 2 picked in the model
flatten_2 = List.Flatten(list=select_faces_2)
byFaces_2 = Dimension.ByFaces(view=views_2, referenceSurfaces=flatten_2)
