# Dynamo graph ByReferences.dyn (Dynamo 2.8.0.2195)

views = Views("Level 1")
select_face = DSFaceSelection()  # 1 picked in the model
bySurface = Revit.GeometryReferences.ElementFaceReference.BySurface(surface=select_face)
select_edge = DSEdgeSelection()  # 1 picked in the model
byCurve = Revit.GeometryReferences.ElementCurveReference.ByCurve(curve=select_edge)
select_edge_2 = DSEdgeSelection()  # 1 picked in the model
byCurve_2 = Revit.GeometryReferences.ElementCurveReference.ByCurve(curve=select_edge_2)
select_face_2 = DSFaceSelection()  # 1 picked in the model
bySurface_2 = Revit.GeometryReferences.ElementFaceReference.BySurface(surface=select_face_2)
list_create = List.Create(item0=bySurface, item1=byCurve, item2=byCurve_2, item3=bySurface_2)
flatten = List.Flatten(list=list_create)
select_edge_3 = DSEdgeSelection()  # 1 picked in the model
code_block = CodeBlock { -1; }
byCoordinates = Vector.ByCoordinates(y=code_block)
code_block_2 = CodeBlock { 3; }
translate = Geometry.Translate(geometry=select_edge_3, direction=byCoordinates, distance=code_block_2)
byReferences = Dimension.ByReferences(view=views, referenceGeometries=flatten, line=translate)
