# Dynamo graph CanSetAndGetAboveValue.dyn (Dynamo 2.6.0.7237)

select_model_element = DSModelElementSelection()  # 1 picked in the model
code_block = CodeBlock { "Above"; }
setAboveValue = Dimension.SetAboveValue(dimension=select_model_element, value=code_block)
aboveValue = Dimension.AboveValue(dimension=setAboveValue)
