# Dynamo graph CanSetAndGetBelowValue.dyn (Dynamo 2.6.0.7237)

select_model_element = DSModelElementSelection()  # 1 picked in the model
code_block = CodeBlock { "Below"; }
setBelowValue = Dimension.SetBelowValue(dimension=select_model_element, value=code_block)
belowValue = Dimension.BelowValue(dimension=setBelowValue)
