# Dynamo graph UpdateCat.dyn (Dynamo 0.8.3.2330)

number = DoubleInput(10)
code_block = CodeBlock(a=number) { Point.ByCoordinates(a,a,a); }
byCenterPointRadius = Sphere.ByCenterPointRadius(centerPoint=code_block)
code_block_2 = CodeBlock { "sphere"; }
string = StringInput("OST_Furniture")
byName = Category.ByName(string)
code_block_3 = CodeBlock { "Earth"; }
byName_2 = Material.ByName(code_block_3)
byGeometryNameCategoryMaterial = DirectShape.ByGeometryNameCategoryMaterial(byCenterPointRadius, code_block_2, byName, byName_2)
centroid = DirectShape.Centroid(byGeometryNameCategoryMaterial)
