# Dynamo graph getDirectShapeCentroid.dyn (Dynamo 0.8.3.2330)

code_block = CodeBlock { Point.ByCoordinates(10,10,10); }
byCenterPointRadius = Sphere.ByCenterPointRadius(centerPoint=code_block)
code_block_2 = CodeBlock { "sphere"; }
categories = Categories("Furniture")
code_block_3 = CodeBlock { "Earth"; }
byName = Material.ByName(code_block_3)
byGeometryNameCategoryMaterial = DirectShape.ByGeometryNameCategoryMaterial(byCenterPointRadius, code_block_2, categories, byName)
centroid = DirectShape.Centroid(byGeometryNameCategoryMaterial)
