# Dynamo graph getDirectShapesFromDocument.dyn (Dynamo 0.8.3.2330)

element_types = ElementTypes("DirectShape")
all_elements_of_type = ElementsOfType(element_types)
name = Element.Name(all_elements_of_type)
code_block = CodeBlock(a=name) { a[0]; }
categories = Categories("GenericModel")
all_elements_of_category = ElementsOfCategory(categories)
name_2 = Element.Name(all_elements_of_category)
code_block_2 = CodeBlock(b=name_2) { b[0]; }
