# Dynamo graph ModelCurveColor.dyn (Dynamo 0.8.1.1252)

select_model_element = DSModelElementSelection()  # 1 picked in the model
geometry = Element.Geometry(select_model_element)
flatten = Flatten(geometry)
code_block = CodeBlock { 0..1..#10; }
pointAtParameter = Curve.PointAtParameter(curve=flatten, param=code_block, lacing=CrossProduct)
byPoint = ReferencePoint.ByPoint(pointAtParameter)
