# Dynamo graph DividedCurve.dyn (Dynamo 2.0.0.4301)

spacing_rule_layout = SpacingRuleLayouts("FixedNumber")
number = DoubleInput(0)
geometry = Element.Geometry()  # unwired: arg0
geometry_2 = Element.Geometry()  # unwired: arg0
select_model_element = DSModelElementSelection()  # 1 picked in the model
curve = CurveElement.Curve(select_model_element, lacing=Longest)
code_block = CodeBlock { 0..1..0.1; }
pointAtParameter = Curve.PointAtParameter(curve=curve, param=code_block, lacing=Longest)
select_model_element_2 = DSModelElementSelection()  # 1 picked in the model
curve_2 = CurveElement.Curve(select_model_element_2, lacing=Longest)
pointAtParameter_2 = Curve.PointAtParameter(curve=curve_2, param=code_block, lacing=Longest)
byStartPointEndPoint = Line.ByStartPointEndPoint(startPoint=pointAtParameter, endPoint=pointAtParameter_2, lacing=Longest)
referenceCurveByCurve = ModelCurve.ReferenceCurveByCurve(byStartPointEndPoint, lacing=Longest)
number_2 = DoubleInput(3)
byCurveAndDivisions = DividedPath.ByCurveAndDivisions(referenceCurveByCurve, number_2, lacing=Longest)
end = Revit.Transaction.Transaction.End(byCurveAndDivisions)
points = DividedPath.Points(end, lacing=Longest)
watch = Watch(points)
