# Dynamo graph DividedSurface.dyn (Dynamo 2.5.2.7915)

select_face = DSFaceSelection()  # 1 picked in the model
number = DoubleInput(5)
byFaceAndUVDivisions = DividedSurface.ByFaceAndUVDivisions(elementFace=select_face, uDivs=number, vDivs=number)
