# Dynamo graph canGetElementSuperComponent.dyn (Dynamo 2.6.0.7034)

# group: Inputs
select_model_element_window = DSModelElementSelection()  # 1 picked in the model
select_model_element_beam = DSModelElementSelection()  # 1 picked in the model

# group: GetParentComponent
getParentComponent = Element.GetParentComponent(element=select_model_element_window)
getParentComponent_2 = Element.GetParentComponent(element=select_model_element_beam)

# group: Output
element_id_window_parent = Element.Id(element=getParentComponent)
element_id_beam_parent = Element.Id(element=getParentComponent_2)
