# Dynamo graph canGetIntersectingElementsOfSpeceficCategory.dyn (Dynamo 2.5.0.5905)

select_model_element = DSModelElementSelection()  # 1 picked in the model
categories = Categories("OST_Walls")
getIntersectingElementsOfCategory = Element.GetIntersectingElementsOfCategory(element=select_model_element, category=categories)
firstItem = List.FirstItem(list=getIntersectingElementsOfCategory)
id = Element.Id(element=firstItem)
