# Dynamo graph canGetPinnedStatus.dyn (Dynamo 2.5.0.5905)

# note: Variables / Inputs
# Red indicates Variables that can be altered per project and must be set accordingly before running the script.
# note: Working / Functions
# Green indicates the working of the script. No changes should be made in these groups unless advised.
# note: Checking / Outputs
# Orange indicates checking nodes to ensure the script has deployed correctly.

# group: DynamoRevit Test Graph
# note: File Name
# IsPinned_System_Test.dyn
# note: Version
# Script Version - 001
# Dynamo Version - 2.2.3
# Revit Model - rac_advanced_sample_project.rvt
# Revit Version - 2020
# note: Author
# Sylvester Knudsen
# Computational Specialist
# metaspace.co

select_model_elements = DSModelElementsSelection()  # 2 picked in the model
isPinned = Element.IsPinned(element=select_model_elements)
allFalse = List.AllFalse(list=isPinned)
