# Dynamo graph canGetSetOverrideHiddenInActiveView.dyn (Dynamo 2.6.1.9130)

select_model_element = DSModelElementSelection()  # 1 picked in the model
code_block = CodeBlock { 50; }
detail_level = DetailLevel("Medium")
byProperties = Revit.Filter.OverrideGraphicSettings.ByProperties(transparency=code_block, detailLevel=detail_level)
boolean = BoolSelector(true)
overrideInView = Element.OverrideInView(element=select_model_element, overrides=byProperties, hide=boolean)
views = Views("{3D}")
isHiddeninView = Element.IsHiddeninView(element=overrideInView, view=views)
overridesInView = Element.OverridesInView(element=overrideInView)
