# Dynamo graph canJoinTwoIntersectingElements.dyn (Dynamo 2.5.0.5905)

# note: Variables / Inputs
# Red indicates Variables that can be altered per project and must be set accordingly before running the script.
# note: Working / Functions
# Green indicates the working of the script. No changes should be made in these groups unless advised.
# note: Checking / Outputs
# Orange indicates checking nodes to ensure the script has deployed correctly.

# group: DynamoRevit Test Graph
# note: File Name
# canJoinTwoIntersectingElements_SystemTest.dyn
# note: Version
# Script Version - 001
# Dynamo Version - 2.2.3
# Revit Model - rac_advanced_sample_project.rvt
# Revit Version - 2020
# note: Author
# Sylvester Knudsen
# Computational Specialist
# metaspace.co

# group: Inputs
select_model_element = DSModelElementSelection()  # 1 picked in the model
select_model_element_2 = DSModelElementSelection()  # 1 picked in the model

# group: Element.JoinGeometry
joinGeometry = Element.JoinGeometry(element=select_model_element, otherElement=select_model_element_2)

# group: Output
firstItem = List.FirstItem(list=joinGeometry)
id = Element.Id(element=firstItem)

# group: Inputs
select_model_element_3 = DSModelElementSelection()  # 1 picked in the model
select_model_element_4 = DSModelElementSelection()  # 1 picked in the model

# group: Element.JoinGeometry - Should throw exception and return null
joinGeometry_2 = Element.JoinGeometry(element=select_model_element_3, otherElement=select_model_element_4)

# group: Output
identity = Object.Identity(obj=joinGeometry_2)
