# Dynamo graph canSuccessfullyGetHostedElements.dyn "canSuccesfullyGetHostedElements" (Dynamo 2.5.0.5905)

# group: DynamoRevit Test Graph - GetHostElements
# note: File Name
# GetHostElements_System_Test.dyn
# note: Version
# Script Version - 001
# Dynamo Version - 2.2.3
# Revit Model - rac_advanced_sample_project.rvt
# Revit Version - 2020
# note: Author
# Sylvester Knudsen
# Computational Specialist
# metaspace.co

# group: Inputs
# note: Variables / Inputs
# Red indicates Variables that can be altered per project and must be set accordingly before running the script.
select_model_element = DSModelElementSelection()  # 1 picked in the model
# note: Working / Functions
# Green indicates the working of the script. No changes should be made in these groups unless advised.
boolean = BoolSelector(true)
boolean_2 = BoolSelector(false)
boolean_3 = BoolSelector(false)
# note: Checking / Outputs
# Orange indicates checking nodes to ensure the script has deployed correctly.
boolean_4 = BoolSelector(false)

# group: GetHostedElements
getHostedElements = Element.GetHostedElements(element=select_model_element, includeOpenings=boolean, includeShadows=boolean_2, includeEmbeddedWalls=boolean_3, includeSharedEmbeddedInserts=boolean_4)

# group: Output
count = List.Count(list=getHostedElements)
