# Dynamo graph canSwitchJoinOrderOfTwoJoinedElements.dyn (Dynamo 2.5.0.5905)

select_model_element = DSModelElementSelection()  # 1 picked in the model
select_model_element_2 = DSModelElementSelection()  # 1 picked in the model
switchGeometryJoinOrder = Element.SwitchGeometryJoinOrder(cuttingElement=select_model_element, otherElement=select_model_element_2)
firstItem = List.FirstItem(list=switchGeometryJoinOrder)
id = Element.Id(element=firstItem)
