# Dynamo graph canTransformElement.dyn (Dynamo 2.6.0.7237)

# group: Input Element
select_model_elements = DSModelElementsSelection()  # 1 picked in the model

getLocation = Element.GetLocation(element=select_model_elements)

# group: Create coordinate systems
basePoint = Coordinates.BasePoint()
byOrigin = CoordinateSystem.ByOrigin(origin=basePoint)
XAxis = Vector.XAxis()
code_block = CodeBlock { 10000; }
translate = Geometry.Translate(geometry=basePoint, direction=XAxis, distance=code_block)
byOrigin_2 = CoordinateSystem.ByOrigin(origin=translate)
ZAxis = Vector.ZAxis()
code_block_2 = CodeBlock { 25; }
rotate = CoordinateSystem.Rotate(coordinateSystem=byOrigin_2, origin=translate, axis=ZAxis, degrees=code_block_2)

transform = FamilyInstance.Transform(familyInstance=select_model_elements, fromCoordinateSystem=byOrigin, contextCoordinateSystem=rotate)
getLocation_2 = Element.GetLocation(element=transform)

# group: Output
original_point_x = Point.X(point=getLocation)
transformed_point_x = Point.X(point=getLocation_2)
original_point_y = Point.Y(point=getLocation)
transformed_point_y = Point.Y(point=getLocation_2)
