# Dynamo graph canUnjoinListOfElements.dyn (Dynamo 2.5.0.5905)

# note: Working / Functions
# Green indicates the working of the script. No changes should be made in these groups unless advised.
# note: Checking / Outputs
# Orange indicates checking nodes to ensure the script has deployed correctly.

# group: DynamoRevit Test Graph
# note: File Name
# canUnjoinListOfElements_SystemTest.dyn
# note: Version
# Script Version - 001
# Dynamo Version - 2.2.3
# Revit Model - elementJoin.rvt
# Revit Version - 2020
# note: Author
# Sylvester Knudsen
# Computational Specialist
# metaspace.co

# group: Inputs
# note: Variables / Inputs
# Red indicates Variables that can be altered per project and must be set accordingly before running the script.
select_model_elements = DSModelElementsSelection()  # 5 picked in the model

# group: Make sure initial AreJoined chek happens before Unjoin
areJoined = Element.AreJoined(element=select_model_elements, otherElement=select_model_elements, lacing=CrossProduct)
boolean = BoolSelector(true)
eq = _ == boolean  # unwired: x
trueForAny = List.TrueForAny(list=areJoined@L2, predicate=eq)
filterByBoolMask = List.FilterByBoolMask(list=select_model_elements, mask=trueForAny)

# group: UnjoinAllGeometry
unjoinAllGeometry = Element.UnjoinAllGeometry(elements=filterByBoolMask.in)

# group: Output
areJoined_2 = Element.AreJoined(element=unjoinAllGeometry, otherElement=unjoinAllGeometry, lacing=CrossProduct)
allFalse = List.AllFalse(list=areJoined_2)
allTrue = List.AllTrue(list=trueForAny)
