# Dynamo graph canUnjoinTwoElements.dyn (Dynamo 2.5.0.5905)

# note: Checking / Outputs
# Orange indicates checking nodes to ensure the script has deployed correctly.

# group: DynamoRevit Test Graph
# note: File Name
# canUnjoinTwoElements_SystemTest.dyn
# note: Version
# Script Version - 001
# Dynamo Version - 2.2.3
# Revit Model - elementJoin.rvt
# Revit Version - 2020
# note: Author
# Sylvester Knudsen
# Computational Specialist
# metaspace.co

# group: Inputs
# note: Variables / Inputs
# Red indicates Variables that can be altered per project and must be set accordingly before running the script.
select_model_element = DSModelElementSelection()  # 1 picked in the model
# note: Working / Functions
# Green indicates the working of the script. No changes should be made in these groups unless advised.
select_model_element_2 = DSModelElementSelection()  # 1 picked in the model

# group: Make sure initial AreJoined chek happens before Unjoin
list_create = List.Create(item0=select_model_element, item1=select_model_element_2)
areJoined = Element.AreJoined(element=select_model_element, otherElement=select_model_element_2)
filterByBoolMask = List.FilterByBoolMask(list=list_create@L1, mask=areJoined)
flatten = List.Flatten(list=filterByBoolMask.in)
code_block = CodeBlock(elem=flatten) { elem[0]; elem[1]; }

# group: UnjoinGeometry
unjoinGeometry = Element.UnjoinGeometry(element=code_block.out0, otherElement=code_block.out1)
code_block_2 = CodeBlock(elem=unjoinGeometry) { elem[0]; elem[1]; }

# group: Output
areJoined_2 = Element.AreJoined(element=code_block_2.out0, otherElement=code_block_2.out1)
unjoinGeometry_2 = Element.UnjoinGeometry(element=code_block_2.out0, otherElement=code_block_2.out1)
identity = Object.Identity(obj=areJoined)
