# Dynamo graph CreateDifferentNumberOfPoints.dyn (Dynamo 3.0.0.5795)

integer_slider = IntegerSlider(4, range=0..10 step 1)
integer_slider_2 = IntegerSlider(2, range=0..10 step 1)
code_block = CodeBlock(x_num=integer_slider, y_num=integer_slider_2) { 0..20..#x_num; 0..10..#y_num; 0; }
byCoordinates = ReferencePoint.ByCoordinates(x=code_block.out0, y=code_block.out1, z=code_block.out2, lacing=CrossProduct)
