# Dynamo graph CreateWallInDynamo.dyn (Dynamo 3.0.0.5795)

code_block = CodeBlock { Point.ByCoordinates(0,0,0); Point.ByCoordinates(30,0,0); 10; 0; }
byStartPointEndPoint = Line.ByStartPointEndPoint(startPoint=code_block.out0, endPoint=code_block.out1)
byElevation = Level.ByElevation(elevation=code_block.out3)
wall_types = WallTypes("Generic - 12\"")
byCurveAndHeight = Wall.ByCurveAndHeight(curve=byStartPointEndPoint, height=code_block.out2, level=byElevation, wallType=wall_types)
