# Dynamo graph ErrorToNormal.dyn (Dynamo 3.0.0.5795)

origin = Point.Origin()
integer_slider = IntegerSlider(2, range=0..10 step 1)
byCenterPointRadius = Circle.ByCenterPointRadius(centerPoint=origin, radius=integer_slider)
byCurve = ModelCurve.ByCurve(curve=byCenterPointRadius)
