# Dynamo graph FamilyInstancePlacementByFace.dyn (Dynamo 3.0.0.5795)

family_types = FamilyTypes("WallFamily:WallFamily")  # graph input
select_face = DSFaceSelection()  # 1 picked in the model; graph input
code_block = CodeBlock(a=select_face) { a[0]; }
code_block_2 = CodeBlock { 0.5; }
pointAtParameter = Surface.PointAtParameter(surface=code_block, u=code_block_2, v=code_block_2)
YAxis = Vector.YAxis()
byFace = FamilyInstance.ByFace(familyType=family_types, face=code_block, location=pointAtParameter, referenceDirection=YAxis)
