# Dynamo graph PlaceMultipleRevitCustomNodes.dyn (Dynamo 3.0.0.5795)

byOrigin = CoordinateSystem.ByOrigin()
code_block = CodeBlock { 20; 20; }
levels = Levels("Level 1")
wall_types = WallTypes("Generic - 12\"")
rectangularWalls = Custom[RectangularWalls](cs=byOrigin, width=code_block.out0, length=code_block.out1, level=levels, wallType=wall_types)  # Makes some walls
code_block_2 = CodeBlock { 70; 100; }
byOrigin_2 = CoordinateSystem.ByOrigin(x=code_block_2.out0, y=code_block_2.out0)
rectangularWalls_2 = Custom[RectangularWalls](cs=byOrigin_2, width=code_block_2.out0, length=code_block_2.out1, level=levels, wallType=wall_types)
categories = Categories("OST_Walls")
all_elements_of_category = ElementsOfCategory(Category=categories)
