# Dynamo graph RebindingBatchedACs.dyn (Dynamo 3.0.0.5795)

# note: Model Lines have been  pre-selected from Revit, Element IDs saved with the Dynamo file
# note: Run this graph the DynamoSample.rvt file in the Samples folder located with your Dynamo installation
# C:\ProgramData\Dynamo\(Your Dynamo Version)\samples\Revit
# note: Place Adaptive Components relative to some elements selected in a Revit file
select_model_element = DSModelElementSelection()  # 1 picked in the model; graph input
select_model_element_2 = DSModelElementSelection()  # 1 picked in the model; graph input
select_model_element_3 = DSModelElementSelection()  # 1 picked in the model; graph input
create_list = List.Create(item0=select_model_element, item1=select_model_element_2, item2=select_model_element_3)
geometry = Element.Geometry(element=create_list)
flatten = List.Flatten(list=geometry)
integer_slider = IntegerSlider(9, range=2..10 step 1)  # graph input
code_block = CodeBlock(x=integer_slider) { 0..1..#x; }
pointAtParameter = Curve.PointAtParameter(curve=flatten, param=code_block, lacing=CrossProduct)
transpose = Transpose(list=pointAtParameter)
family_types = FamilyTypes("3PointAC_SquareTruss:3PointAC_SquareTruss")  # graph input
byPoints = AdaptiveComponent.ByPoints(points=transpose, familyType=family_types)
byPoints_2 = PolyCurve.ByPoints(points=transpose)
