# Dynamo graph RebindingMultiDimension.dyn (Dynamo 3.0.0.5795)

number = DoubleInput(5)
code_block = CodeBlock(end=number) { Autodesk.Point.ByCoordinates((0..end)<1>, (0..end)<2>,0); }
byPoint = ReferencePoint.ByPoint(pt=code_block)
