# Dynamo custom node RectangularWalls.dyf (Dynamo 1.1.1.2361)
# category: buildz
# Makes some walls

cs = Input(cs : CoordinateSystem)
width = Input(width : double)
length = Input(length : double)
byWidthLength = Rectangle.ByWidthLength(cs=cs, width=width, length=length)
curves = PolyCurve.Curves(byWidthLength)
code_block = CodeBlock { 10; }
level = Input(level : Level)
wallType = Input(wallType : WallType)
byCurveAndHeight = Wall.ByCurveAndHeight(curve=curves, height=code_block, level=level, wallType=wallType)
Wall = Output(byCurveAndHeight)
