# Dynamo graph magn-2523.dyn (Dynamo 3.0.0.5795)

number = DoubleInput(0)
byOrigin = CoordinateSystem.ByOrigin(x=number, y=number, z=number)
# note: Wall Distance
number_slider = DoubleSlider(19.89, range=1..20 step 0.1)
byWidthLength = Rectangle.ByWidthLength(coordinateSystem=byOrigin, width=number_slider, length=number_slider, lacing=Longest)
curves = PolyCurve.Curves(polyCurve=byWidthLength)
family_types = FamilyTypes("Sofa-Pensi:65\"")
# note: Wall Fillet Radius
number_slider_2 = DoubleSlider(-4, range=-4..4 step 0.1)
boolean = BoolSelector(false)
fillet = PolyCurve.Fillet(polyCurve=byWidthLength, radius=number_slider_2, clockwise_corners=boolean)
curves_2 = PolyCurve.Curves(polyCurve=fillet)
endPoint = Curve.EndPoint(curve=curves_2)
levels = Levels("Level 1")
byPointAndLevel = FamilyInstance.ByPointAndLevel(familyType=family_types, point=endPoint, level=levels)
