# Dynamo graph CanDuplicateElementType.dyn (Dynamo 2.6.0.7237)

select_model_element = DSModelElementSelection()  # 1 picked in the model
elementType = Element.ElementType(element=select_model_element)
name = ElementType.Name(elementType=elementType)
code_block = CodeBlock(name=name) { name + "_Copy"; }
duplicate = ElementType.Duplicate(elementType=elementType, name=code_block)
duplicated_elementtype_name = ElementType.Name(elementType=duplicate)
