# Dynamo graph CanGetElementTypePreviewImage.dyn (Dynamo 2.6.0.7237)

select_model_element = DSModelElementSelection()  # 1 picked in the model
elementType = Element.ElementType(element=select_model_element)
code_block = CodeBlock { 500; }
getPreviewImage = ElementType.GetPreviewImage(elementType=elementType, size=code_block)
dimensions = Image.Dimensions(image=getPreviewImage)
watch_width = Watch(dimensions.width)
watch_height = Watch(dimensions.height)
watch_image = WatchImageCore(image=getPreviewImage)
