# Dynamo graph CanGetElementTypeProperties.dyn (Dynamo 2.6.0.7237)

# group: Wall elementType properties
select_model_element = DSModelElementSelection()  # 1 picked in the model
elementType = Element.ElementType(element=select_model_element)
wall_elementtype_familyname = ElementType.FamilyName(elementType=elementType)
wall_elementtype_canbecopied = ElementType.CanBeCopied(elementType=elementType)
wall_elementtype_canbedeleted = ElementType.CanBeDeleted(elementType=elementType)
wall_elementtype_canberenamed = ElementType.CanBeRenamed(elementType=elementType)
wall_elementtype_name = ElementType.Name(elementType=elementType)

# group: Column elementType properties
select_model_element_2 = DSModelElementSelection()  # 1 picked in the model
elementType_2 = Element.ElementType(element=select_model_element_2)
column_elementtype_familyname = ElementType.FamilyName(elementType=elementType_2)
column_elementtype_name = ElementType.Name(elementType=elementType_2)
column_elementtype_canbecopied = ElementType.CanBeCopied(elementType=elementType_2)
column_elementtype_canbedeleted = ElementType.CanBeDeleted(elementType=elementType_2)
column_elementtype_canberenamed = ElementType.CanBeRenamed(elementType=elementType_2)
