# Dynamo graph CanCreateElevationMarker.dyn (Dynamo 2.5.2.7915)

view_family_types = ViewFamilyTypes("10mm Circle")
select_model_element = DSModelElementSelection()  # 1 picked in the model
getLocation = Element.GetLocation(element=select_model_element)
code_block = CodeBlock { 100; }
byViewTypeLocation = ElevationMarker.ByViewTypeLocation(viewFamilyType=view_family_types, location=getLocation, initialViewScale=code_block)
type = Object.Type(obj=byViewTypeLocation)
