# Dynamo graph CanCreateElevationViewsByMarkerIndex.dyn (Dynamo 2.6.0.7237)
# packages: archi-lab.net 2020.22.9

select_model_element = DSModelElementSelection()  # 1 picked in the model
code_block = CodeBlock { 312; }
byElementId = archilab.Revit.Selection.Select.ByElementId(id=code_block)
code_block_2 = CodeBlock { 0; }
createElevationByMarkerIndex = ElevationMarker.CreateElevationByMarkerIndex(elevationMarker=select_model_element, planView=byElementId, index=code_block_2)
name = Element.Name(element=createElevationByMarkerIndex)
