# Dynamo graph CanGetElevationMarkerViewByIndex.dyn (Dynamo 2.6.0.7237)

select_model_element = DSModelElementSelection()  # 1 picked in the model
code_block = CodeBlock { 1; }
getView = ElevationMarker.GetView(elevationMarker=select_model_element, index=code_block)
id = Element.Id(element=getView)
