# Dynamo graph GetSurfaceDomain.dyn (Dynamo 1.0.1.1821)

select_face = DSFaceSelection()  # 1 picked in the model
get_surface_domain = CodeBlock { {{0,0},{1,1}}; }
number = DoubleInput(2)
code_block = CodeBlock(domain=get_surface_domain, ucount=number, vcount=number) { domain[0][0]..domain[1][0]..#ucount+1; domain[0][1]..domain[1][1]..#vcount+1; }
byCoordinates = UV.ByCoordinates(code_block.out0, code_block.out1, lacing=CrossProduct)
flatten = Flatten(byCoordinates)
watch = Watch(flatten)
