# Dynamo graph AC_locationStandAlone.dyn (Dynamo 1.0.1.1821)

select_model_element = DSModelElementSelection()  # 1 picked in the model
location = FamilyInstance.Location(select_model_element, lacing=Longest)
watch = Watch(location)
