# Dynamo graph CreateFamilyTypeByGeometry.dyn (Dynamo 3.1.0.4724)

# group: Generate file path to family template
current = Document.Current()
filePath = Document.FilePath(document=current)
string = StringInput("empty.rvt")
indexOf = String.IndexOf(string=filePath, searchFor=string)
code_block = CodeBlock { 9; }
remove = String.Remove(string=filePath, startIndex=indexOf, count=code_block)
string_2 = StringInput("Metric Structural Column.rft")
concat = String.Concat(string0=remove, string1=string_2)

# group: Create family
byCoordinates = Point.ByCoordinates()
code_block_2 = CodeBlock { 100; }
byCoordinates_2 = Point.ByCoordinates(x=code_block_2, y=code_block_2, z=code_block_2)
byCorners = Cuboid.ByCorners(lowPoint=byCoordinates, highPoint=byCoordinates_2)
code_block_3 = CodeBlock { "MyFamilyType"; }
categories = Categories("OST_GenericModel")  # graph input
code_block_4 = CodeBlock { "Aluminum"; }
byName = Material.ByName(name=code_block_4)
byGeometry = FamilyType.ByGeometry(solidGeometry=byCorners, name=code_block_3, category=categories, templatePath=concat, material=byName)
