# Dynamo graph FamilyInstancePlacementByFace.dyn (Dynamo 1.1.0.1950)

family_types = FamilyTypes("WallFamily:WallFamily")
select_face = DSFaceSelection()  # 1 picked in the model
code_block = CodeBlock(a=select_face) { a[0]; }
code_block_2 = CodeBlock { 0.5; }
pointAtParameter = Surface.PointAtParameter(surface=code_block, u=code_block_2, v=code_block_2)
ZAxis = Vector.ZAxis()
byFace = FamilyInstance.ByFace(family_types, code_block, pointAtParameter, ZAxis)
