# Dynamo graph FamilyInstancePlacementByLine.dyn (Dynamo 1.1.1.1930)

family_types = FamilyTypes("Line based family-test:Line based family-test")
select_face = DSFaceSelection()  # 1 picked in the model
code_block = CodeBlock(a=select_face) { a[0]; }
edges = Face.Edges(code_block)
curveGeometry = Edge.CurveGeometry(edges)
code_block_2 = CodeBlock(a=curveGeometry) { a[0].StartPoint; }
code_block_3 = CodeBlock(a=curveGeometry) { a[0].EndPoint; }
byStartPointEndPoint = Line.ByStartPointEndPoint(startPoint=code_block_2, endPoint=code_block_3)
byFace = FamilyInstance.ByFace(family_types, code_block, byStartPointEndPoint)
code_block_4 = CodeBlock { 0.5; }
pointAtParameter = Surface.PointAtParameter(surface=code_block, u=code_block_4, v=code_block_4)
