# Dynamo graph SetFamilyInstanceRotation.dyn (Dynamo 0.8.1.960)

select_model_element = DSModelElementSelection()  # 1 picked in the model
number = DoubleInput(30)
setRotation = FamilyInstance.SetRotation(familyInstance=select_model_element, degree=number)
