# Dynamo graph CanAddParameterToFamilyDocument.dyn (Dynamo 2.10.1.3976)

current = Document.Current()
byDocument = FamilyDocument.ByDocument(document=current)
code_block = CodeBlock { paramName = "TestParam"; instance = false; }
group_types = GroupTypes("Data")
spec_types = SpecTypes("Text")
addParameter = FamilyDocument.AddParameter(familyDocument=byDocument, parameterName=code_block.paramName, group=group_types, spec=spec_types, isInstance=code_block.instance)
name = FamilyParameter.Name(familyParameter=addParameter)
