# Dynamo graph CanDeleteParameterFromFamilyDocument.dyn (Dynamo 2.6.0.7237)

current = Document.Current()
byDocument = FamilyDocument.ByDocument(document=current)
code_block = CodeBlock { paramName = "Width"; }
deleteParameter = FamilyDocument.DeleteParameter(familyDocument=byDocument, parameterName=code_block)
