# Dynamo graph CanGetFamilyDocumentCategory.dyn (Dynamo 2.6.0.7237)

current = Document.Current()
byDocument = FamilyDocument.ByDocument(document=current)
category = FamilyDocument.Category(familyDocument=byDocument)
