# Dynamo graph CanGetFamilyDocumentFormula.dyn (Dynamo 2.6.0.7237)

current = Document.Current()
byDocument = FamilyDocument.ByDocument(document=current)
code_block = CodeBlock { "Depth"; }
getFormula = FamilyDocument.GetFormula(familyDocument=byDocument, parameter=code_block)
