# Dynamo graph CanGetFamilyDocumentParameterValue.dyn (Dynamo 2.6.0.7745)

current = Document.Current()
byDocument = FamilyDocument.ByDocument(document=current)
code_block = CodeBlock { "1525x762mm_Student"; "Depth"; }
getParameterValueByName = FamilyDocument.GetParameterValueByName(familyDocument=byDocument, familyTypeName=code_block.out0, parameterName=code_block.out1)
