# Dynamo graph CanGetFamilyDocumentParameters.dyn (Dynamo 2.6.0.7237)

current = Document.Current()
byDocument = FamilyDocument.ByDocument(document=current)
parameters = FamilyDocument.Parameters(familyDocument=byDocument)
