# Dynamo graph CanGetFamilyDocumentValue.dyn (Dynamo 2.6.0.7534)

current = Document.Current()
byDocument = FamilyDocument.ByDocument(document=current)
code_block = CodeBlock { "Depth"; }
parameterValueByName = FamilyDocument.ParameterValueByName(familyDocument=byDocument, parameter=code_block)
