# Dynamo graph CanSetFamilyDocumentCategory.dyn (Dynamo 2.6.0.7237)

current = Document.Current()
byDocument = FamilyDocument.ByDocument(document=current)
categories = Categories("OST_Furniture")
setCategory = FamilyDocument.SetCategory(familyDocument=byDocument, category=categories)
