# Dynamo graph CanSetFamilyDocumentFormula.dyn (Dynamo 2.6.0.7237)

current = Document.Current()
byDocument = FamilyDocument.ByDocument(document=current)
code_block = CodeBlock { "Width"; "Depth * 2"; }
setFormula = FamilyDocument.SetFormula(familyDocument=byDocument, parameter=code_block.out0, formula=code_block.out1)
