# Dynamo graph CanSetFamilyDocumentParameterValue.dyn (Dynamo 2.6.0.7745)

current = Document.Current()
byDocument = FamilyDocument.ByDocument(document=current)
code_block = CodeBlock { "1525x762mm_Student"; "Width"; 2000; }
setParameterValueByName = FamilyDocument.SetParameterValueByName(familyDocument=byDocument, familyTypeName=code_block.out0, parameter=code_block.out1, value=code_block.out2)
