# Dynamo graph CanSetFamilyDocumentValue.dyn (Dynamo 2.6.0.7534)

current = Document.Current()
byDocument = FamilyDocument.ByDocument(document=current)
code_block = CodeBlock { "Width"; 2000.0; }
setParameterValueByName = FamilyDocument.SetParameterValueByName(familyDocument=byDocument, parameter=code_block.out0, value=code_block.out1)
