# Dynamo graph CanCreateFamilyInstanceWithHost.dyn (Dynamo 2.10.1.3976)

family_types = FamilyTypes("Doors_ExtDbl_Flush:1510x2110mm")
select_model_element = DSModelElementSelection()  # 1 picked in the model
byCoordinates = Point.ByCoordinates()
byHostAndPoint = FamilyInstance.ByHostAndPoint(familyType=family_types, host=select_model_element, point=byCoordinates)
location = FamilyInstance.Location(familyInstance=byHostAndPoint)
