# Dynamo graph CanGetFamilyInstanceRoom.dyn (Dynamo 2.6.0.7237)

select_model_element = DSModelElementSelection()  # 1 picked in the model
room = FamilyInstance.Room(familyInstance=select_model_element)
id = Element.Id(element=room)
