# Dynamo graph CanGetFamilyInstanceSpace.dyn (Dynamo 2.6.0.7237)

select_model_element = DSModelElementSelection()  # 1 picked in the model
space = FamilyInstance.Space(familyInstance=select_model_element)
id = Element.Id(element=space)
