# Dynamo graph CanPlaceFamilyInstanceByTypeAndCoordinateSystem.dyn (Dynamo 2.6.0.7237)

family_types = FamilyTypes("Desk:60\" x 30\"")
basePoint = Coordinates.BasePoint()
byOrigin = CoordinateSystem.ByOrigin(origin=basePoint)
byOriginNormal = Plane.ByOriginNormal()
code_block = CodeBlock { 45; }
rotate = CoordinateSystem.Rotate(coordinateSystem=byOrigin, plane=byOriginNormal, degrees=code_block)
byCoordinateSystem = FamilyInstance.ByCoordinateSystem(familyType=family_types, coordinateSystem=rotate)
facingOrientation = FamilyInstance.FacingOrientation(familyInstance=byCoordinateSystem)
X = Vector.X(vector=facingOrientation)
Y = Vector.Y(vector=facingOrientation)
Z = Vector.Z(vector=facingOrientation)
