# Dynamo graph canGetFloorTypeStructuralMaterial.dyn (Dynamo 2.6.0.7237)

select_model_element = DSModelElementSelection()  # 1 picked in the model
elementType = Element.ElementType(element=select_model_element)
getStructuralMaterial = FloorType.GetStructuralMaterial(floorType=elementType)
id = Element.Id(element=getStructuralMaterial)
