# Dynamo graph canGetFloorTypeThermalProperties.dyn (Dynamo 2.6.0.7237)

select_model_element = DSModelElementSelection()  # 1 picked in the model
elementType = Element.ElementType(element=select_model_element)
getThermalProperties = FloorType.GetThermalProperties(floorType=elementType)
absotptance_watch = Watch(getThermalProperties.Absorptance)
heattransfercoefficient_watch = Watch(getThermalProperties.HeatTransferCoefficient)
roughness_watch = Watch(getThermalProperties.Roughness)
thermalresistance_watch = Watch(getThermalProperties.ThermalResistance)
thermalmass_watch = Watch(getThermalProperties.ThermalMass)
