# Dynamo graph CanCreateGroupFromListOfElements.dyn (Dynamo 2.5.0.7460)

select_model_elements = DSModelElementsSelection()  # 2 picked in the model
byElements = Group.ByElements(elements=select_model_elements)
name = Element.Name(element=byElements)
