# Dynamo graph CanGetGroupMembers.dyn (Dynamo 2.6.0.7237)

select_model_element = DSModelElementSelection()  # 1 picked in the model
getMembers = Group.GetMembers(group=select_model_element)
id = Element.Id(element=getMembers)
