# Dynamo graph CanGetGroupProperties.dyn (Dynamo 2.6.0.7237)

# group: Model Group
select_model_element = DSModelElementSelection()  # 1 picked in the model
group_isattached_modelgroup = Group.IsAttached(group=select_model_element)
groupType = Group.GroupType(group=select_model_element)
element_id_modelgroup = Element.Id(element=groupType)
location = Group.Location(group=select_model_element)
code_block = CodeBlock(pt=location) { pt.X; pt.Y; pt.Z; }
watch_x = Watch(code_block.out0)
watch_y = Watch(code_block.out1)
watch_z = Watch(code_block.out2)
attachedDetailGroup = Group.AttachedDetailGroup(group=select_model_element)

# group: Detail Group
select_model_element_2 = DSModelElementSelection()  # 1 picked in the model
group_isattached_detailgroup = Group.IsAttached(group=select_model_element_2)
groupType_2 = Group.GroupType(group=select_model_element_2)
element_id_detailgroup = Element.Id(element=groupType_2)

element_id_modelgroup_2 = Element.Id(element=attachedDetailGroup)  # "Element.Id - ModelGroup-AttachedDetailGroup"
