# Dynamo graph CanPlaceGroupInstance.dyn (Dynamo 2.6.0.7237)

basePoint = Coordinates.BasePoint()
select_model_element = DSModelElementSelection()  # 1 picked in the model
groupType = Group.GroupType(group=select_model_element)
placeInstance = Group.PlaceInstance(location=basePoint, groupType=groupType)
location = Group.Location(group=placeInstance)
code_block = CodeBlock(pt=location) { pt.X; pt.Y; pt.Z; }
watch_x = Watch(code_block.out0)
watch_y = Watch(code_block.out1)
watch_z = Watch(code_block.out2)
