# Dynamo graph CanUngroupElementsFromGroup.dyn (Dynamo 2.6.0.7237)

select_model_element = DSModelElementSelection()  # 1 picked in the model
ungroupElements = Group.UngroupElements(group=select_model_element)
id = Element.Id(element=ungroupElements)
