# Dynamo graph ImportInstanceFromSelectModelElement.dyn (Dynamo 2.0.0.4192)

element_types = ElementTypes("ImportInstance")
all_elements_of_type = ElementsOfType(element_types)
watch = Watch(all_elements_of_type)
select_model_element = DSModelElementSelection()  # 1 picked in the model
type = Object.Type(select_model_element)
watch_2 = Watch(type)
