# Dynamo graph CurveCurveIntersection.dyn (Dynamo 1.0.1.1821)

select_model_element = DSModelElementSelection()  # 1 picked in the model
curve = CurveElement.Curve(select_model_element, lacing=Longest)
select_model_element_2 = DSModelElementSelection()  # 1 picked in the model
curve_2 = CurveElement.Curve(select_model_element_2, lacing=Longest)
intersect = Geometry.Intersect(geometry=curve, other=curve_2, lacing=Longest)
watch = Watch(intersect)
select_model_element_3 = DSModelElementSelection()  # 1 picked in the model
curve_3 = CurveElement.Curve(select_model_element_3, lacing=Longest)
intersect_2 = Geometry.Intersect(geometry=curve, other=curve_3, lacing=Longest)
parameterAtPoint = Curve.ParameterAtPoint(curve=curve, point=intersect_2)
parameterAtPoint_2 = Curve.ParameterAtPoint(curve=curve_3, point=intersect_2)
create_list = List.Create(intersect_2, intersect_2, parameterAtPoint, parameterAtPoint_2)
watch_2 = Watch(create_list)
parameterAtPoint_3 = Curve.ParameterAtPoint(curve=curve, point=intersect)
parameterAtPoint_4 = Curve.ParameterAtPoint(curve=curve_2, point=intersect)
create_list_2 = List.Create(intersect, intersect, parameterAtPoint_3, parameterAtPoint_4)
watch_3 = Watch(create_list_2)
