# Dynamo graph EdgePlaneIntersection.dyn (Dynamo 0.8.1.1441)

select_face = DSFaceSelection()  # 1 picked in the model
explode = Geometry.Explode(select_face, lacing=Longest)
watch = Watch(explode)
select_model_element = DSModelElementSelection()  # 1 picked in the model
curve = CurveElement.Curve(select_model_element, lacing=Longest)
number = DoubleInput(0.5)
coordinateSystemAtParameter = Curve.CoordinateSystemAtParameter(curve, number, lacing=Longest)
origin = CoordinateSystem.Origin(coordinateSystemAtParameter, lacing=Longest)
XAxis = CoordinateSystem.XAxis(coordinateSystemAtParameter)
asPoint = Vector.AsPoint(XAxis, lacing=Longest)
asVector = Point.AsVector(asPoint)
ZAxis = Vector.ZAxis()
asPoint_2 = Vector.AsPoint(ZAxis, lacing=Longest)
asVector_2 = Point.AsVector(asPoint_2)
cross = Vector.Cross(vector=asVector, cross=asVector_2)
asPoint_3 = Vector.AsPoint(cross, lacing=Longest)
asVector_3 = Point.AsVector(asPoint_3)
byOriginNormal = Plane.ByOriginNormal(origin=origin, normal=asVector_3, lacing=Longest)
intersect = Geometry.Intersect(geometry=explode, other=byOriginNormal, lacing=Longest)
byPoint = ReferencePoint.ByPoint(lacing=Longest)
