# Dynamo graph FaceFaceIntersection.dyn (Dynamo 1.0.1.1821)

select_face = DSFaceSelection()  # 1 picked in the model
select_face_2 = DSFaceSelection()  # 1 picked in the model
intersect = Geometry.Intersect(geometry=select_face, other=select_face_2, lacing=Longest)
watch = Watch(intersect)
watch_2 = Watch()
select_face_3 = DSFaceSelection()  # 1 picked in the model
intersect_2 = Geometry.Intersect(geometry=select_face, other=select_face_3, lacing=Longest)
watch_3 = Watch(intersect_2)
select_face_4 = DSFaceSelection()  # 1 picked in the model
intersect_3 = Geometry.Intersect(geometry=select_face, other=select_face_4, lacing=Longest)
watch_4 = Watch(intersect_3)
