# Dynamo graph Length.dyn (Dynamo 0.8.1.1441)

length_from_string = LengthFromString(0)
watch = Watch(length_from_string)
length_from_string_2 = LengthFromString(-0.13255625)
watch_2 = Watch(length_from_string_2)
length_from_string_3 = LengthFromString(-0.8334375)
watch_3 = Watch(length_from_string_3)
length_from_string_4 = LengthFromString(-8.007746875)
watch_4 = Watch(length_from_string_4)
length_from_string_5 = LengthFromString(-8.33358125)
watch_5 = Watch(length_from_string_5)
