# Dynamo graph Level.dyn (Dynamo 1.0.0.460)

number = DoubleInput(0..10..2)
concat = String.Concat()
string = StringInput("Level ")
create_list = List.Create(string)
string_from_object = FromObject(number)
cartesianProduct = List.CartesianProduct(concat, create_list, string_from_object)
flatten = Flatten(cartesianProduct)
byElevationAndName = Level.ByElevationAndName(number, flatten, lacing=Longest)
count = List.Count(number)
