# Dynamo graph GetMaterialByName.dyn (Dynamo 0.8.1.1441)

select_model_element = DSModelElementSelection()  # 1 picked in the model
string = StringInput("material")
string_2 = StringInput("Chipboard")
byName = Material.ByName(string_2)
setParameterByName = Element.SetParameterByName(element=select_model_element, parameterName=string, value=byName, lacing=Longest)
select_model_element_2 = DSModelElementSelection()  # 1 picked in the model
string_3 = StringInput("Glass")
byName_2 = Material.ByName(string_3)
setParameterByName_2 = Element.SetParameterByName(element=select_model_element_2, parameterName=string, value=byName_2, lacing=Longest)
select_model_element_3 = DSModelElementSelection()  # 1 picked in the model
string_4 = StringInput("Poche")
byName_3 = Material.ByName(string_4)
setParameterByName_3 = Element.SetParameterByName(element=select_model_element_3, parameterName=string, value=byName_3, lacing=Longest)
