# Dynamo graph TestMigration_Analyze_Measure.dyn (Dynamo 1.0.1.1821)

boundingBoxXYZ = Custom[BoundingBoxXYZ](lacing=Longest)  # This node represents an upgrade of the 0.6.3 BoundingBoxXYZ node to 0.7.x
length = Curve.Length(lacing=Longest)
get_curve_domain = CodeBlock { {0,1}; }
get_surface_domain = CodeBlock { {{0,0},{1,1}}; }
height = Height(lacing=Longest)
point = ReferencePoint.Point()
point_2 = ReferencePoint.Point()
distanceTo = Geometry.DistanceTo(geometry=point, other=point_2, lacing=Longest)
volume = Solid.Volume(lacing=Longest)
area = Surface.Area(lacing=Longest)
