# Dynamo graph TestMigration_Analyze_Solar.dyn (Dynamo 1.0.1.1821)

solar_radiation_values_from_csv = ComputeSolarRadiationValue()
current = SunSettings()  # "SunSettings.Current"
sunDirection = SunSettings.SunDirection(current)
