# Dynamo graph TestMigration_Geometry_Point.dyn (Dynamo 1.0.1.1830)

XAxis = Vector.XAxis()
asPoint = Vector.AsPoint(XAxis, lacing=Longest)
byCoordinates = Point.ByCoordinates(lacing=Longest)
identity = CoordinateSystem.Identity()
radiansToDegrees = Math.RadiansToDegrees()
byCylindricalCoordinates = Point.ByCylindricalCoordinates(identity, radiansToDegrees, lacing=Longest)
identity_2 = CoordinateSystem.Identity()
radiansToDegrees_2 = Math.RadiansToDegrees()
radiansToDegrees_3 = Math.RadiansToDegrees()
bySphericalCoordinates = Point.BySphericalCoordinates(identity_2, radiansToDegrees_2, radiansToDegrees_3, lacing=Longest)
xyzFromListOfNumbers = Custom[XyzFromListOfNumbers]()  # This node represents an upgrade of the 0.6.3 XyzFromListOfNumbers node to 0.7.x
point = ReferencePoint.Point(lacing=Longest)
YAxis = Vector.YAxis()
asPoint_2 = Vector.AsPoint(YAxis, lacing=Longest)
ZAxis = Vector.ZAxis()
asPoint_3 = Vector.AsPoint(ZAxis, lacing=Longest)
xyzGrid = Custom[XyzGrid](lacing=Longest)  # This node represents an upgrade of the 0.6.3 XyzGrid node to 0.7.x
asVector = Point.AsVector()
add = Point.Add(vectorToAdd=asVector, lacing=Longest)
byTwoPoints = Vector.ByTwoPoints()
normalized = Vector.Normalized(byTwoPoints)
asPoint_4 = Vector.AsPoint(normalized, lacing=Longest)
code_block = CodeBlock { -1; }
scale = Geometry.Scale(amount=code_block, lacing=Longest)
scale_2 = Geometry.Scale(lacing=Longest)
byTwoPoints_2 = Vector.ByTwoPoints()
scale_3 = Geometry.Scale(geometry=byTwoPoints_2)
add_2 = Point.Add(vectorToAdd=scale_3, lacing=Longest)
asVector_2 = Point.AsVector()
subtract = Point.Subtract(arg1=asVector_2, lacing=Longest)
asVector_3 = Point.AsVector()
normalized_2 = Vector.Normalized(asVector_3)
asPoint_5 = Vector.AsPoint(normalized_2, lacing=Longest)
asVector_4 = Point.AsVector()
asVector_5 = Point.AsVector()
cross = Vector.Cross(vector=asVector_4, cross=asVector_5)
asPoint_6 = Vector.AsPoint(cross, lacing=Longest)
asVector_6 = Point.AsVector()
asVector_7 = Point.AsVector()
dot = Vector.Dot(asVector_6, asVector_7, lacing=Longest)
code_block_2 = CodeBlock { Math.Average(pts.X); Math.Average(pts.Y); Math.Average(pts.Z); }
byCoordinates_2 = Point.ByCoordinates(x=code_block_2.out0, y=code_block_2.out1, z=code_block_2.out2, lacing=Longest)
xyz_components = CodeBlock { p.X; p.Y; p.Z; }
distanceTo = Geometry.DistanceTo(lacing=Longest)
asVector_8 = Point.AsVector()
length = Vector.Length(asVector_8)
code_block_3 = CodeBlock { 0; }
equals = Equals(length, code_block_3, lacing=Longest)
asVector_9 = Point.AsVector()
length_2 = Vector.Length(asVector_9, lacing=Longest)
code_block_4 = CodeBlock { Point.ByCoordinates(1,0,0); }
xyz_to_polar_coordinates = CodeBlock(p=code_block_4)
# ---------- xyz_to_polar_coordinates.designscript (4 lines) ----------
radius = Math.Sqrt(p.X*p.X + p.Y*p.Y);
rotation = Math.DegreesToRadians
(Math.Atan(p.Y/p.X));
offset = p.Z;
# ----------------------------------------
xyz_to_spherical_coordinates = CodeBlock()
# ---------- xyz_to_spherical_coordinates.designscript (6 lines) ----------
radius = Math.Sqrt(p.X*p.X + p.Y*p.Y + p.Z*p.Z);
xyrotation = (p.X == 0 && p.Y == 0) ? 0 : (p.X == 0) ?
((p.Y > 0) ? Math.PI/2 : Math.PI*3/2)
: Math.DegreesToRadians(Math.Atan(p.Y/p.X));
zrotation = (p.X == 0 && p.Y == 0) ? ((p.Z > 0) ? 0 : Math.PI) :
Math.DegreesToRadians(Math.Acos(p.Z / radius));
# ----------------------------------------
X = Point.X(lacing=Longest)
Y = Point.Y(lacing=Longest)
Z = Point.Z(lacing=Longest)
byPoints = Tessellation.ConvexHull.ByPoints()
byPoints_2 = Tessellation.Delaunay.ByPoints()
