# Dynamo graph TestMigration_Geometry_Solid.dyn (Dynamo 1.0.1.1830)

difference = Solid.Difference(lacing=Longest)
intersect = Geometry.Intersect(lacing=Longest)
union = Solid.Union(lacing=Longest)
union_2 = Solid.Union(lacing=Longest)
create_list = List.Create()
byLoft = Solid.ByLoft(create_list, lacing=Longest)
asVector = Point.AsVector()
extrudeAsSolid = Curve.ExtrudeAsSolid(direction=asVector, lacing=Longest)
revolve = CreateRevolvedGeometry(lacing=Longest)
bySweep = Solid.BySweep(lacing=Longest)
bySweep_2 = Solid.BySweep(lacing=Longest)
explode = Geometry.Explode(lacing=Longest)
solids = Element.Solids(lacing=Longest)
code_block = CodeBlock { Point.ByCoordinates(0,0,0); }
byLengths = Cuboid.ByLengths(origin=code_block, lacing=Longest)
code_block_2 = CodeBlock { Point.ByCoordinates(-1,-1,-1); }
code_block_3 = CodeBlock { Point.ByCoordinates(1,1,1); }
byCorners = Cuboid.ByCorners(lowPoint=code_block_2, highPoint=code_block_3, lacing=Longest)
code_block_4 = CodeBlock { p=Plane.ByOriginNormal(origin,axis.AsVector()); cs=CoordinateSystem.ByPlane(p); Cylinder.ByRadiusHeight(cs,r,h); }
code_block_5 = CodeBlock { Point.ByCoordinates(0,0,0); }
byCenterPointRadius = Sphere.ByCenterPointRadius(centerPoint=code_block_5, lacing=Longest)
