# Dynamo graph TestMigration_Revit_Families.dyn (Dynamo 1.0.1.1821)

byPoints = AdaptiveComponent.ByPoints()
byParametersOnCurveReference = AdaptiveComponent.ByParametersOnCurveReference(lacing=Longest)
byParametersOnFace = AdaptiveComponent.ByParametersOnFace(lacing=Longest)
byPoints_2 = AdaptiveComponent.ByPoints(lacing=Longest)
byPoint = FamilyInstance.ByPoint(lacing=Longest)
byPointAndLevel = FamilyInstance.ByPointAndLevel(lacing=Longest)
curves = Element.Curves(lacing=Longest)
getParameterValueByName = Element.GetParameterValueByName(lacing=Longest)
location = FamilyInstance.Location(lacing=Longest)
all_elements_of_family_type = ElementsOfFamilyType()
get_family_parameter = FamilyInstanceParameters()
getParameterValueByName_2 = Element.GetParameterValueByName(lacing=Longest)
asVector = Point.AsVector()
byOriginNormal = Plane.ByOriginNormal(normal=asVector)
byPlane = SketchPlane.ByPlane(byOriginNormal)
code_block = CodeBlock { 0; }
byName = ModelTextType.ByName()
byTextSketchPlaneAndPosition = ModelText.ByTextSketchPlaneAndPosition(arg1=byPlane, arg2=code_block, arg3=code_block, arg5=byName, lacing=Longest)
family_types = FamilyTypes("Level Head - Target:1/4\"")
structural_framing_types = StructuralFramingTypes("No structural framing types available.")
setParameterByName = Element.SetParameterByName(lacing=Longest)
setParameterByName_2 = Element.SetParameterByName(lacing=Longest)
code_block_2 = CodeBlock { 1; }
byElevation = Level.ByElevation(code_block_2)
beam = StructuralType.Beam()
byCurveLevelUpVectorAndType = StructuralFraming.ByCurveLevelUpVectorAndType(arg1=byElevation, arg3=beam)
