# Dynamo graph TestMigration_Revit_FamilyType.dyn (Dynamo 0.8.2.2255)

family_types = FamilyTypes("Section Head - Min:Section Head - Min")
family = FamilySymbol.Family(family_types)
name = FamilySymbol.Name(family)
all_elements_of_family_type = ElementsOfFamilyType(family_types)
symbol = FamilyInstance.Symbol(all_elements_of_family_type)
watch = Watch(all_elements_of_family_type)
symbols = Family.Symbols(family)
family_2 = FamilySymbol.Family(symbols)
byFamilyAndName = FamilySymbol.ByFamilyAndName()
byFamilyNameAndTypeName = FamilySymbol.ByFamilyNameAndTypeName()
byName = FamilySymbol.ByName()
byParametersOnCurveReference = AdaptiveComponent.ByParametersOnCurveReference()
symbol_2 = AdaptiveComponent.Symbol()
byParametersOnFace = AdaptiveComponent.ByParametersOnFace()
get_family_parameter = FamilyInstanceParameters()
byNameNumberTitleBlockAndView = Sheet.ByNameNumberTitleBlockAndView()
byNameNumberTitleBlockAndViews = Sheet.ByNameNumberTitleBlockAndViews()
byCoordinates = FamilyInstance.ByCoordinates()
byPoint = FamilyInstance.ByPoint()
byPointAndLevel = FamilyInstance.ByPointAndLevel()
byFamilySymbol = FamilyInstance.ByFamilySymbol()
symbol_3 = StructuralFraming.Symbol()
