# Dynamo graph TestMigration_Revit_Referemce.dyn (Dynamo 1.0.1.1922)

parameterAtPoint = Curve.ParameterAtPoint()
parameterAtPoint_2 = Curve.ParameterAtPoint()
trimByParameter = Curve.TrimByParameter(arg1=parameterAtPoint, arg2=parameterAtPoint_2, lacing=Longest)
byReferencePoints = CurveByPoints.ByReferencePoints(lacing=Longest)
byCurve = ModelCurve.ByCurve(lacing=Longest)
referenceCurveByCurve = ModelCurve.ReferenceCurveByCurve(lacing=Longest)
curve = CurveElement.Curve(lacing=Longest)
XYPlane = ReferencePoint.XYPlane(lacing=Longest)
referenceCurveByCurve_2 = ModelCurve.ReferenceCurveByCurve(lacing=Longest)
byPoint = ReferencePoint.ByPoint(lacing=Longest)
code_block = CodeBlock()
# ---------- code_block.designscript (7 lines) ----------
// Convert ModelCurve into CurveReference
curve.CurveReference;

// Convert normalized length into actual length
// and flip the evaluation if 'beginning' is set to false
len * (normalized ? curve.Curve.Length : 1)
* (beginning ? 1 : -1) + (beginning ? 0 : curve.Curve.Length);
# ----------------------------------------
byLengthOnCurveReference = ReferencePoint.ByLengthOnCurveReference(code_block.out0, code_block.out1, lacing=Longest)
point = ReferencePoint.Point()
asVector = Point.AsVector()
normalized = Vector.Normalized(asVector)
byPointVectorDistance = ReferencePoint.ByPointVectorDistance(point, normalized, lacing=Longest)
byParameterOnCurveReference = ReferencePoint.ByParameterOnCurveReference(lacing=Longest)
U = UV.U()
V = UV.V()
pointAtParameter = Surface.PointAtParameter(u=U, v=V)
byPoint_2 = ReferencePoint.ByPoint(pointAtParameter, lacing=Longest)
