# Dynamo graph GlobalParameter.dyn (Dynamo 2.10.1.3976)

code_block = CodeBlock { "MyGlobalParameter"; }
spec_types = SpecTypes("Text")
byName = GlobalParameter.ByName(name=code_block, forgeType=spec_types)
visible = GlobalParameter.Visible(globalParameter=byName)
name = GlobalParameter.Name(globalParameter=byName)
specType = GlobalParameter.SpecType(globalParameter=byName)
