# Dynamo graph CalculateLongestExitDistance.dyn (Dynamo 2.6.0.7956)

# group: Calculate Longest Exit Distance
# note: CATEGORY:
# Administration
# DESCRIPTION:
# Creates a single Path of Travel from a point (on the perimeter of a room within a project) that has the longest distance to its closest exit.
# MODEL PREPARATION:
# - The model must have rooms.
# NOTE:
# - The graph, in its current form, can only analyze two exits.
# - The graph analyzes each room boundary at its corner and its midpoint.
# - If the room boundary falls within solid geometry (e.g. at the centerline of a curtain wall), a Path of Travel may be blocked from consideration by the graph.
# AUTHORS:
# - Autodesk
# Copyright (c) 2019, Autodesk
# REQUIRED PACKAGES:
# - None

current = Document.Current()
activeView = Document.ActiveView(document=current)

# group: START HERE! Use the select buttons and select two exit doors in the Revit model. Then press Run in the lower left of the Dynamo applcation window to run the script.
select_exit_door = DSModelElementSelection()  # 1 picked in the model; graph input
solids = Element.Solids(element=select_exit_door)
select_2nd_exit_door = DSModelElementSelection()  # 1 picked in the model; graph input
solids_2 = Element.Solids(element=select_2nd_exit_door)

# group: Collect list of end points at exits
byUnion = Solid.ByUnion(solids=solids)
centroid = Solid.Centroid(solid=byUnion)
byUnion_2 = Solid.ByUnion(solids=solids_2)
centroid_2 = Solid.Centroid(solid=byUnion_2)
list_create = List.Create(item0=centroid, item1=centroid_2)
boolean = BoolSelector(false)
clean = List.Clean(list=list_create, preserveIndices=boolean)
number_slider = DoubleSlider(2, range=-1..3 step 1)
flatten = List.Flatten(list=clean, amt=number_slider)

longestOfShortestExitPaths = PathOfTravel.LongestOfShortestExitPaths(floorPlan=activeView, endPtsList=flatten)
