# Dynamo graph GetInsertSetRemoveWayPoints.dyn (Dynamo 2.7.0.8206)

# group: Select existing PathOfTravel element and set new WayPoint to insert.
select_path_of_travel = DSModelElementSelection()  # 1 picked in the model; graph input
number = DoubleInput(-3.669)
number_2 = DoubleInput(15)
byCoordinates = Point.ByCoordinates(x=number, y=number_2)
index = CodeBlock { 0; }

insertWayPoint = PathOfTravel.InsertWayPoint(pathOfTravel=select_path_of_travel, wayPoint=byCoordinates, index=index)
left_waypoints_after_insertion = PathOfTravel.GetWayPoints(pathOfTravel=insertWayPoint)

# group: Select existing PathOfTravel element with some WayPoints on it.
select_path_of_travel_2 = DSModelElementSelection()  # 1 picked in the model; graph input
number_3 = DoubleInput(56.372)
number_4 = DoubleInput(23.331)
byCoordinates_2 = Point.ByCoordinates(x=number_3, y=number_4)
index_2 = CodeBlock { 0; }

setWayPoint = PathOfTravel.SetWayPoint(pathOfTravel=select_path_of_travel_2, newPosition=byCoordinates_2, index=index_2)
index_3 = CodeBlock { 1; }
removeWayPoint = PathOfTravel.RemoveWayPoint(pathOfTravel=setWayPoint, index=index_3)
right_waypoints_after_removal = PathOfTravel.GetWayPoints(pathOfTravel=removeWayPoint)
right_waypoints_after_update = PathOfTravel.GetWayPoints(pathOfTravel=setWayPoint)
right_initial_waypoints = PathOfTravel.GetWayPoints(pathOfTravel=select_path_of_travel_2)
