# Dynamo graph PerformanceAdviser.dyn (Dynamo 1.2.1.2802)

performance_adviser_rules = PerformanceAdviserRules("View clipping is disabled")
name = PerformanceAdviserRule.Name(performance_adviser_rules)
ruleId = PerformanceAdviserRule.RuleId(performance_adviser_rules)
enabled = PerformanceAdviserRule.Enabled(performance_adviser_rules)
description = PerformanceAdviserRule.Description(performance_adviser_rules)
execute = PerformanceAdviserRule.Execute(performance_adviser_rules)
severity = FailureMessage.Severity(execute)
failingElements = FailureMessage.FailingElements(execute)
postInDocument = FailureMessage.PostInDocument(execute)
additionalElements = FailureMessage.AdditionalElements(execute)
description_2 = FailureMessage.Description(execute)
