# Dynamo graph CreateMultipleFloors.dyn (Dynamo 2.12.0.5650)

code_block = CodeBlock { -100..100..10; }
byCoordinates = Point.ByCoordinates(x=code_block)
number = DoubleInput(5)
byCenterPointRadius = Circle.ByCenterPointRadius(centerPoint=byCoordinates, radius=number)
floor_types = FloorTypes("Generic - 12\"")
levels = Levels("Level 2")
byOutlineTypeAndLevel = Floor.ByOutlineTypeAndLevel(outline=byCenterPointRadius, floorType=floor_types, level=levels, lacing=Longest)
