# Dynamo graph CreateMultipleWalls.dyn (Dynamo 2.12.0.5650)

code_block = CodeBlock { -50..50..1; }
byCoordinates = Point.ByCoordinates(x=code_block)
code_block_2 = CodeBlock { 1; }
byCoordinates_2 = Vector.ByCoordinates(y=code_block_2)
number = DoubleInput(10)
byStartPointDirectionLength = Line.ByStartPointDirectionLength(startPoint=byCoordinates, direction=byCoordinates_2, length=number)
levels = Levels("Level 1")
wall_types = WallTypes("Generic - 8\"")
byCurveAndHeight = Wall.ByCurveAndHeight(curve=byStartPointDirectionLength, height=number, level=levels, wallType=wall_types)
