# Dynamo graph Python_add.dyn (Dynamo 0.8.1.1441)

number = DoubleInput(2..3)
watch = Watch(number)
python_script = Python(IN[0]=watch)
# ---------- python_script.python (20 lines) ----------
# Default imports
import clr
clr.AddReference('RevitAPI')
clr.AddReference('RevitAPIUI')
from Autodesk.Revit.DB import *
import Autodesk
import sys
import clr
path = r'C:\Autodesk\Dynamo\Core'
exec_path = r'C:\Users\Ian\Documents\Dynamo\bin\AnyCPU\Debug\dll'
sys.path.append(path)
sys.path.append(exec_path)
clr.AddReference('LibGNet')
from Autodesk.LibG import *

#The input to this node will be stored in the IN[0] variable.
dataEnteringNode = IN[0]

#Assign your output to the OUT variable
OUT = IN[0][0] + IN[0][1]
# ----------------------------------------
watch_2 = Watch(python_script)
end = Revit.Transaction.Transaction.End(python_script)
