# Dynamo graph unwrapElement.dyn (Dynamo 2.16.0.2280)

select_face = DSFaceSelection()  # 1 picked in the model
code_block = CodeBlock { 2474225; }
element_by_id = ElementById(Id=code_block)
code_block_2 = CodeBlock(id=element_by_id) { {"element" : id}; }
python_script = Python(IN[0]=code_block_2)  # CPython3
# ---------- python_script.python (19 lines) ----------
# Load the Python Standard and DesignScript Libraries
import sys
import clr
clr.AddReference('ProtoGeometry')
from Autodesk.DesignScript.Geometry import *

clr.AddReference('RevitAPI')
import Autodesk
from Autodesk.Revit.DB import *
import Autodesk.Revit.DB as DB

clr.AddReference('RevitServices')
import RevitServices

# Place your code below this line
dictElem = dict(UnwrapElement(IN[0]))
type_vals = [x.GetType() for x in dictElem.values()]
# Assign your output to the OUT variable.
OUT = type_vals
# ----------------------------------------
string_from_object = FromObject(object=python_script)
