# Dynamo graph RayBounce.dyn (Dynamo 0.8.0.706)

number = DoubleInput(0)
number_2 = DoubleInput(20)
number_3 = DoubleInput(8)
byCoordinates = Point.ByCoordinates(x=number, y=number_2, z=number_3, lacing=Longest)
number_4 = DoubleInput(1)
byCenterPointRadius = Circle.ByCenterPointRadius(centerPoint=byCoordinates, radius=number_4, lacing=Longest)
number_5 = DoubleInput(12)
code_block = CodeBlock(x=number_5) { 0..1..#x; }
pointAtParameter = Curve.PointAtParameter(curve=byCenterPointRadius, param=code_block, lacing=CrossProduct)
number_6 = DoubleInput(0)
number_7 = DoubleInput(-0.8)
byCoordinates_2 = Point.ByCoordinates(x=number_6, y=number_6, z=number_7, lacing=Longest)
asVector = Point.AsVector(byCoordinates_2)
add = Point.Add(point=pointAtParameter, vectorToAdd=asVector, lacing=Longest)
byTwoPoints = Vector.ByTwoPoints(start=byCoordinates, end=add)
normalized = Vector.Normalized(byTwoPoints)
number_8 = DoubleInput(3)
current = Document.Current()
activeView = Document.ActiveView(current, lacing=Longest)
byOriginDirection = Revit.References.RayBounce.ByOriginDirection(byCoordinates, normalized, number_8, activeView, lacing=Longest)
reverse = List.Reverse(byOriginDirection.out0)
restOfItems = List.RestOfItems(reverse)
byPoints = PolyCurve.ByPoints()
map = List.Map(list=restOfItems, f_x=byPoints)
curves = PolyCurve.Curves(map)
flatten = Flatten(curves)
byCurve = ModelCurve.ByCurve(flatten, lacing=Longest)
watch = Watch(byOriginDirection.out1)
