# Dynamo graph ReferenceCurve.dyn (Dynamo 0.7.6.4011)

create_list = List.Create()
number = DoubleInput(0)
number_2 = DoubleInput(5)
number_3 = DoubleInput(1)
number_sequence = NumberSeq(number, number_2, number_3, lacing=Longest)
byCoordinates = Point.ByCoordinates(arg2=number_sequence)
number_4 = DoubleInput(2000)
number_5 = DoubleInput(-5)
byCoordinates_2 = Point.ByCoordinates(number_4, number_5, number_sequence)
number_6 = DoubleInput(10000)
byCoordinates_3 = Point.ByCoordinates(arg1=number_6, arg2=number_sequence)
byCoordinates_4 = Point.ByCoordinates(number_6, arg2=number_sequence)
combine = List.Combine(create_list, byCoordinates, byCoordinates_2, byCoordinates_3, byCoordinates_4)
byPoints = NurbsCurve.ByPoints(combine, lacing=Longest)
referenceCurveByCurve = ModelCurve.ReferenceCurveByCurve(byPoints, lacing=Longest)
