# Dynamo graph ReferencePoint.dyn (Dynamo 1.0.1.1821)

number = DoubleInput(0)
byCoordinates = Point.ByCoordinates(x=number, y=number, z=number, lacing=Longest)
byPoint = ReferencePoint.ByPoint(byCoordinates)
