# Dynamo graph ShortLine.dyn (Dynamo 0.9.0.2815)

code_block = CodeBlock { a=Point.Origin(); b=Point.ByCoordinates(0.00065104,0,0); Line.ByStartPointEndPoint(a,b); }
code_block_2 = CodeBlock { 0.0001; }
# note: 1/128" -> decimal feet = 0.00065104
byCenterPointRadius = Circle.ByCenterPointRadius(centerPoint=code_block.a, radius=code_block_2)
length = Curve.Length(byCenterPointRadius)
