# Dynamo graph ByOutLineExtrusionTypeAndLevel.dyn (Dynamo 2.5.2.7915)

code_block = CodeBlock()
# ---------- code_block.designscript (5 lines) ----------
Point.ByCoordinates(0,0,0);
Point.ByCoordinates(0,100,0);
Point.ByCoordinates(0,0,100);
Point.ByCoordinates(0,100,100);
true;
# ----------------------------------------
list_create = List.Create(item0=code_block.out0, item1=code_block.out1, item2=code_block.out3, item3=code_block.out2)
byPoints = PolyCurve.ByPoints(points=list_create)
roof_types = RoofTypes("Roof_Flat-4Felt-150Ins-50Scr-150Conc-12Plr")
levels = Levels("Level 01 - B.O. Footing")
byStartPointEndPoint = ReferencePlane.ByStartPointEndPoint(start=code_block.out0, end=code_block.out1)
code_block_2 = CodeBlock { 50.0; 200.0; }
byOutlineExtrusionTypeAndLevel = Roof.ByOutlineExtrusionTypeAndLevel(outline=byPoints, roofType=roof_types, level=levels, plane=byStartPointEndPoint, extrusionStart=code_block_2.out0, extrusionEnd=code_block_2.out1)
