# Dynamo graph ByOutlineTypeAndLevel.dyn (Dynamo 2.5.2.7915)

code_block = CodeBlock()
# ---------- code_block.designscript (4 lines) ----------
[Line.ByStartPointEndPoint(Point.ByCoordinates(0, 0, 0), Point.ByCoordinates(100, 0, 0)),
                Line.ByStartPointEndPoint(Point.ByCoordinates(100, 0, 0), Point.ByCoordinates(100, 100, 0)),
                Line.ByStartPointEndPoint(Point.ByCoordinates(100, 100, 0), Point.ByCoordinates(0, 100, 0)),
                Line.ByStartPointEndPoint(Point.ByCoordinates(0, 100, 0), Point.ByCoordinates(0, 0, 0))];
# ----------------------------------------
roof_types = RoofTypes("Generic - 12\"")
levels = Levels("Level 1")
byOutlineTypeAndLevel = Roof.ByOutlineTypeAndLevel(outline=code_block, roofType=roof_types, level=levels)
