# Dynamo graph RoomTest.dyn (Dynamo 1.0.0.1180)

# group: Create, Manipulate and Query Room
levels = Levels("L03-T/SLAB")
byCoordinates = Point.ByCoordinates()
code_block = CodeBlock { "Room 1"; }
code_block_2 = CodeBlock { "001"; }
byLocation = Room.ByLocation(levels, byCoordinates, code_block, code_block_2)
code_block_3 = CodeBlock { "Room 2"; }
setName = Room.SetName(byLocation, code_block_3)
name = Room.Name(byLocation)
watch = Watch(name)

# group: Room binding test
categories = Categories("Rooms")
all_elements_of_category = ElementsOfCategory(categories)
name_2 = Room.Name(all_elements_of_category)
watch_2 = Watch(name_2)
type = Object.Type(all_elements_of_category)
watch_3 = Watch(type)

type_2 = Object.Type(byLocation)
watch_4 = Watch(type_2)
