# Dynamo graph 2dDomain.dyn (Dynamo 1.0.1.1821)

select_face = DSFaceSelection()  # 1 picked in the model
number = DoubleInput(0.5)
byCoordinates = UV.ByCoordinates(number, number, lacing=Longest)
number_2 = DoubleInput(1)
byCoordinates_2 = UV.ByCoordinates(number_2, number_2, lacing=Longest)
uv_domain = CodeBlock(min=byCoordinates, max=byCoordinates_2) { {{min.U,min.V},{max.U,max.V}}; }
number_slider = DoubleSlider(24.023, range=0..40 step 0.1)
random_uv = CodeBlock(dom=uv_domain, ucount=number_slider, vcount=number_slider)
# ---------- random_uv.designscript (6 lines) ----------
dom[0][0]+Math.RandomList
(ucount*vcount)
*(dom[1][0]-dom[0][0]);
dom[0][1]+Math.RandomList
(ucount*vcount)
*(dom[1][1]-dom[0][1]);
# ----------------------------------------
byCoordinates_3 = UV.ByCoordinates(random_uv.out0, random_uv.out1, lacing=Longest)
number_3 = DoubleInput(2)
byCoordinates_4 = UV.ByCoordinates(number, number_3, lacing=Longest)
uv_domain_2 = CodeBlock(min=byCoordinates_2, max=byCoordinates_4) { {{min.U,min.V},{max.U,max.V}}; }
formula = Formula("x/2", x=number_slider, lacing=Longest)
code_block = CodeBlock(domain=uv_domain_2, ucount=formula, vcount=formula) { domain[0][0]..domain[1][0]..#ucount+1; domain[0][1]..domain[1][1]..#vcount+1; }
byCoordinates_5 = UV.ByCoordinates(code_block.out0, code_block.out1, lacing=CrossProduct)
flatten = Flatten(byCoordinates_5)
create_list = List.Create(byCoordinates_3, flatten)
flatten_2 = Flatten(create_list)
U = UV.U(flatten_2)
V = UV.V(flatten_2)
pointAtParameter = Surface.PointAtParameter(surface=select_face, u=U, v=V, lacing=Longest)
watch_3d = Watch3D(pointAtParameter)
byPoint = ReferencePoint.ByPoint(pointAtParameter, lacing=Longest)
