# Dynamo graph AttractorLogic_End.dyn (Dynamo 1.0.1.1821)

number = DoubleInput(15)
number_2 = DoubleInput(1)
number_3 = DoubleInput(0)
number_4 = DoubleInput(2)
# note: XYZ Point Grid
xyzGrid = Custom[XyzGrid](x_count=number, y_count=number, z_count=number_2, x0=number_3, y0=number_3, z0=number_3, x_space=number_4, y_space=number_4, z_space=number_4, lacing=Longest)  # This node represents an upgrade of the 0.6.3 XyzGrid node to 0.7.x
number_slider = DoubleSlider(16.567, range=0..30 step 0.1)
number_slider_2 = DoubleSlider(20.373, range=0..30 step 0.1)
number_5 = DoubleInput(0)
# note: 'Attractor' Point
byCoordinates = Point.ByCoordinates(x=number_slider, y=number_slider_2, z=number_5, lacing=Longest)
# note: Create a distance-based
# relationship with a single point.
distanceTo = Geometry.DistanceTo(geometry=xyzGrid, other=byCoordinates, lacing=Longest)
number_6 = DoubleInput(30)
div = distanceTo / number_6  # lacing=Longest
# note: Circle with variable radii
byCenterPointRadius = Circle.ByCenterPointRadius(centerPoint=xyzGrid, radius=div, lacing=Longest)
watch_3d = Watch3D(byCenterPointRadius)
# note: Make Revit Stuff
referenceCurveByCurve = ModelCurve.ReferenceCurveByCurve(byCenterPointRadius, lacing=Longest)
