# Dynamo graph BruteForcingParametersandRendering.dyn (Dynamo 1.0.1.1821)

# note: This wraps up the data for us to use... but it is not the function that unrwaps it and applies it
create_list = List.Create()
# note: associated revit file in sample folder where this graph was found
# note: Note that this graph execution will take some time as it alternates between updating revit parameters and sending off 24 renderings
family_types = FamilyTypes()
all_elements_of_family_type = ElementsOfFamilyType(family_types)
create_list_2 = List.Create()
create_list_3 = List.Create()
number = DoubleInput(5..20..10)
string = StringInput("Width")
create_list_4 = List.Create(string)
cartesianProduct = List.CartesianProduct(create_list_3, number, create_list_4)
create_list_5 = List.Create()
# note: this will wrap a parameter and its values into a tuple.. we can make this a function and map it to ranges of values and their associated parameters...
number_2 = DoubleInput(10..20..10)
string_2 = StringInput("Height")
create_list_6 = List.Create(string_2)
cartesianProduct_2 = List.CartesianProduct(create_list_5, number_2, create_list_6)
longest = LaceLongest(create_list_2, cartesianProduct, cartesianProduct_2)  # "List.Longest"
cartesianProduct_3 = List.CartesianProduct(create_list, all_elements_of_family_type, longest)
python_script = Python(IN[0]=cartesianProduct_3)
# ---------- python_script.python (25 lines) ----------
# Default imports
import clr
clr.AddReference('RevitAPI')
clr.AddReference('RevitAPIUI')
from Autodesk.Revit.DB import *
import Autodesk
import sys
import clr
path = r'C:\Autodesk\Dynamo\Core'
exec_path = r'C:\Autodesk\Dynamo\Core\dll'
sys.path.append(path)
sys.path.append(exec_path)
clr.AddReference('LibGNet')
from Autodesk.LibG import *



#The input to this node will be stored in the IN[0] variable.
listoflists= IN[0]

for i in range(len(listoflists)):
	list = listoflists[i]
	list.Add(i)
#Assign your output to the OUT variable
OUT = listoflists
# ----------------------------------------
# note: This Function updates the parameters before starting a rendering - mapping over the sequence below - FORMAT IS:
# [family instance, [param01,val][param02...,val]iteraton]
updateparameter_s = Custom[UpdateParameter(s)]()  # [familyinstance, [parameter1,val][parameter2,val] iteration number]
# note: This python node is finding the current sample path and then appending the weather data file path we've input into it.  THIS CAN BE REPLACED with a FILE PATH node if you get your own weather file.
string_3 = StringInput("GBS_04R20_266135.csv")
python_script_2 = Python(IN[0]=string_3)
# ---------- python_script_2.python (33 lines) ----------
# Default imports
import clr
clr.AddReference('RevitAPI')
clr.AddReference('RevitAPIUI')
from Autodesk.Revit.DB import *
import Autodesk
import sys
import clr
path = r'C:\Autodesk\Dynamo\Core'
exec_path = r'C:\Autodesk\Dynamo\Core\dll'
sys.path.append(path)
sys.path.append(exec_path)
clr.AddReference('LibGNet')
from Autodesk.LibG import *
sys.path.append(r'C:\Program Files (x86)\IronPython 2.7\Lib')
from os.path import join, abspath
clr.AddReference('DynamoPython')
clr.AddReference('DynamoCore')
clr.AddReference('FScheme')
import Dynamo


weatherDataFile = IN[0]
model = Dynamo.Utilities.dynSettings.Controller.DynamoModel;
currentFile = model.HomeSpace.FileName

samplesLoc = join(currentFile,r"..\\")
_samplesPath = abspath(samplesLoc)

weatherDataPath = join(_samplesPath,weatherDataFile)
_weatherDataPath = abspath(weatherDataPath)
#Assign your output to the OUT variable
OUT = _weatherDataPath
# ----------------------------------------
# note: Zero Intelligence in how parameters change- this is brute forcing many parameters
renderwithweatherdata_return = Custom[RenderWithWeatherData_Return List of data](weatherDataFilePath=python_script_2)
compose_function = ComposeFunctions(updateparameter_s, renderwithweatherdata_return)
string_4 = StringInput("This Python Script  finds your local samples folder so renderings can be saved there.")
python_script_3 = Python(IN[0]=string_4)
# ---------- python_script_3.python (30 lines) ----------
# Default imports
import clr
clr.AddReference('RevitAPI')
clr.AddReference('RevitAPIUI')
from Autodesk.Revit.DB import *
import Autodesk
import sys
import clr
path = r'C:\Autodesk\Dynamo\Core'
exec_path = r'C:\Autodesk\Dynamo\Core\dll'
sys.path.append(path)
sys.path.append(exec_path)
clr.AddReference('LibGNet')
from Autodesk.LibG import *
sys.path.append(r'C:\Program Files (x86)\IronPython 2.7\Lib')
from os.path import join, abspath
clr.AddReference('DynamoPython')
clr.AddReference('DynamoCore')
clr.AddReference('FScheme')
import Dynamo
# dynamo controller
model = Dynamo.Utilities.dynSettings.Controller.DynamoModel;
# get the filepath of the main sample graph.
currentFile = model.HomeSpace.FileName
# go up one level, this is the samples path
samplesLoc = join(currentFile,r"..\\")
_samplesPath = abspath(samplesLoc)

#Assign your output to the OUT variable
OUT = _samplesPath
# ----------------------------------------
# note: extract some data from render and save an image of the extracted bitmap.  We use python to get he sample folder to save the images in
getDataFromRender_WriteImage = Custom[GetDataFromRender_WriteImage](filePath=python_script_3)
compose_function_2 = ComposeFunctions(compose_function, getDataFromRender_WriteImage)
# note: This is the floor in the revit sample file provided with this sample
select_face = DSFaceSelection()
# note: We plot our lighting data on the floor of our sample room, each time we render daylighting
displayDataCall = Custom[displayDataCall](face=select_face)
compose_function_3 = ComposeFunctions(compose_function_2, displayDataCall)
map = List.Map(list=python_script, f_x=compose_function_3)
count = List.Count(cartesianProduct_3)
watch = Watch(python_script)
file_path = Filename("No file selected.")
