# Dynamo graph DaylightingMinimal.dyn (Dynamo 0.7.6.3456)

string = StringInput("{3D}")
export_cloud_render_data = ExportDocumentRenderData(string)
end = Revit.Transaction.Transaction.End(export_cloud_render_data)
upload_cloud_render_data = UploadRenderData(end)
number = DoubleInput(150)
number_2 = DoubleInput(-100)
number_3 = DoubleInput(-100)
number_4 = DoubleInput(3)
byCoordinates = Point.ByCoordinates(number_2, number_3, number_4, lacing=Longest)
# note: Associated .rvt file in the same folder where this sample is found
number_5 = DoubleInput(100)
number_6 = DoubleInput(-100)
number_7 = DoubleInput(3)
byCoordinates_2 = Point.ByCoordinates(number_5, number_6, number_7, lacing=Longest)
# note: when hitting run render will upload and take a few minutes to return - run button will grey out - check the console for progress
number_8 = DoubleInput(-100)
number_9 = DoubleInput(100)
number_10 = DoubleInput(3)
byCoordinates_3 = Point.ByCoordinates(number_8, number_9, number_10, lacing=Longest)
skyModelType = SkyModelTypeDropDown("Perez")
byTypeConstants = Analyze.Render.SkyModel.ByTypeConstants(skyModelType, lacing=Longest)
number_11 = DoubleInput(40)
number_12 = DoubleInput(-71)
number_13 = DoubleInput(12)
number_14 = DoubleInput(5)
byDateInformation = Analyze.Render.DateTime.ByDateInformation(arg3=number_13, arg6=number_14, lacing=Longest)
bySkyModelLocationDate = Analyze.Render.RenderingEnvironment.BySkyModelLocationDate(byTypeConstants, number_11, number_12, byDateInformation, lacing=Longest)
byViewNameDivisionsGridBoundary = Analyze.Daylighting.CloudDaylightingJob.ByViewNameDivisionsGridBoundary(string, number, number, byCoordinates, byCoordinates_2, byCoordinates_3, bySkyModelLocationDate, lacing=Longest)
boolean = BoolSelector(false)
do_cloud_render = CloudRender(upload_cloud_render_data, byViewNameDivisionsGridBoundary, boolean)
parse = Analyze.Daylighting.DaylightingResults.Parse(do_cloud_render, lacing=Longest)
number_15 = DoubleInput(100000)
toImage = Analyze.Daylighting.DaylightingResults.ToImage(parse, number_15, lacing=Longest)
firstItem = List.FirstItem(toImage)
watch_image = WatchImageCore(firstItem)
