# Dynamo graph DaylightingandAnalysisDisplay.dyn (Dynamo 1.0.1.1821)

string = StringInput("{3D}")
export_cloud_render_data = ExportDocumentRenderData(string)
end = Revit.Transaction.Transaction.End(export_cloud_render_data)
# note: Setup our render and push it to Autodesk 360 service
upload_cloud_render_data = UploadRenderData(end)
number = DoubleInput(150)
# note: Generate xyz corners for plane to sample
number_2 = DoubleInput(-100)
number_3 = DoubleInput(-100)
number_4 = DoubleInput(3)
byCoordinates = Point.ByCoordinates(x=number_2, y=number_3, z=number_4, lacing=Longest)
number_5 = DoubleInput(100)
number_6 = DoubleInput(-100)
number_7 = DoubleInput(3)
byCoordinates_2 = Point.ByCoordinates(x=number_5, y=number_6, z=number_7, lacing=Longest)
number_8 = DoubleInput(-100)
number_9 = DoubleInput(100)
number_10 = DoubleInput(3)
byCoordinates_3 = Point.ByCoordinates(x=number_8, y=number_9, z=number_10, lacing=Longest)
# note: There is an associated .rvt file in the rendering samples folder where this graph was located that is needed to run correctly.
# note: When you hit run there will be a delay as the rendering completes, watch the console for updates - run button will grey out for a few minutes.
skyModelType = SkyModelTypeDropDown("Perez")
byTypeConstants = Analyze.Render.SkyModel.ByTypeConstants(skyModelType, lacing=Longest)
number_11 = DoubleInput(40)
number_12 = DoubleInput(-71)
number_13 = DoubleInput(12)
number_14 = DoubleInput(5)
byDateInformation = Analyze.Render.DateTime.ByDateInformation(arg3=number_13, arg6=number_14, lacing=Longest)
bySkyModelLocationDate = Analyze.Render.RenderingEnvironment.BySkyModelLocationDate(byTypeConstants, number_11, number_12, byDateInformation, lacing=Longest)
byViewNameDivisionsGridBoundary = Analyze.Daylighting.CloudDaylightingJob.ByViewNameDivisionsGridBoundary(string, number, number, byCoordinates, byCoordinates_2, byCoordinates_3, bySkyModelLocationDate, lacing=Longest)
boolean = BoolSelector(false)
do_cloud_render = CloudRender(upload_cloud_render_data, byViewNameDivisionsGridBoundary, boolean)
parse = Analyze.Daylighting.DaylightingResults.Parse(do_cloud_render, lacing=Longest)
number_15 = DoubleInput(0)
toImage = Analyze.Daylighting.DaylightingResults.ToImage(parse, number_15, lacing=Longest)
# note: Parse various data from the returned rendering file
firstItem = List.FirstItem(toImage)
watch_image = WatchImageCore(firstItem)
select_face = DSFaceSelection()
watch_3d = Watch3D(select_face)
points = Analyze.Daylighting.DaylightingResults.Points(parse, lacing=Longest)
firstItem_2 = List.FirstItem(points)
illuminanceValues = Analyze.Daylighting.DaylightingResults.IlluminanceValues(parse, lacing=Longest)
firstItem_3 = List.FirstItem(illuminanceValues)
toSRGB = Analyze.Daylighting.Illuminance.ToSRGB(firstItem_3, lacing=Longest)
display_daylighting_data_on = Custom[Display Daylighting Data On Surface](face=select_face, xyz_sample_points=firstItem_2, data=toSRGB)  # Displays daylighting data on a surface, requires manually setting up surface analysis display style through revit. Also requires wrapping with a transaction node.
# note: using the floor of the revit model, and our (xyz points, illuminance data) plot the data onto the floor.  This will show in the revit model.
end_2 = Revit.Transaction.Transaction.End(display_daylighting_data_on)
