# Dynamo graph IndexedFamilyInstances.dyn (Dynamo 1.0.1.1821)

family_types = FamilyTypes("incrementFam_segmented:incrementFam_segmented")
number = DoubleInput(0)
number_2 = DoubleInput(1)
number_slider = DoubleSlider(20, range=0..20 step 0.1)
number_3 = DoubleInput(1)
range = Range(start=number_2, end=number_slider, step=number_3, lacing=Longest)
count = List.Count(range)
sequence = Sequence(start=number, amount=count, step=number, lacing=Longest)
byCoordinates = Point.ByCoordinates(x=sequence, lacing=Longest)
byPoint = FamilyInstance.ByPoint(familyType=family_types, point=byCoordinates, lacing=Longest)
string = StringInput("increment")
setParameterByName = Element.SetParameterByName(element=byPoint, parameterName=string, value=range, lacing=Longest)
