# Dynamo graph ScalableCircle.dyn (Dynamo 1.0.1.1821)

number = DoubleInput(0)
number_slider = DoubleSlider(4.622, range=0..6.24 step 0.1)
number_2 = DoubleInput(0.5)
range = Range(start=number, end=number_slider, step=number_2)
formula = Formula("Sin(x)", x=range, lacing=Longest)
formula_2 = Formula("Cos(x)", x=range, lacing=Longest)
number_3 = DoubleInput(0)
byCoordinates = Point.ByCoordinates(x=formula, y=formula_2, z=number_3, lacing=Longest)
number_slider_2 = DoubleSlider(54.529, range=0..100 step 0.1)
scale = Geometry.Scale(geometry=byCoordinates, amount=number_slider_2, lacing=CrossProduct)
byPoint = ReferencePoint.ByPoint(scale, lacing=Longest)
flatten = Flatten(byPoint)
