# Dynamo graph TranslateandRotate.dyn (Dynamo 1.0.1.1821)

byCoordinates = Point.ByCoordinates(lacing=Longest)
XAxis = Vector.XAxis()
asPoint = Vector.AsPoint(XAxis, lacing=Longest)
number_slider = DoubleSlider(5.879, range=0..10 step 0.1)
scale = Geometry.Scale(geometry=asPoint, amount=number_slider, lacing=Longest)
identity = CoordinateSystem.Identity()
ZAxis = Vector.ZAxis()
asPoint_2 = Vector.AsPoint(ZAxis, lacing=Longest)
asVector = Point.AsVector(asPoint_2)
number_slider_2 = DoubleSlider(1.004137931, range=0..6.24 step 0.1)
radiansToDegrees = Math.RadiansToDegrees(number_slider_2)
rotate = CoordinateSystem.Rotate(coordinateSystem=identity, origin=byCoordinates, axis=asVector, degrees=radiansToDegrees, lacing=Longest)
transform = Geometry.Transform(scale, rotate, lacing=Longest)
byStartPointEndPoint = Line.ByStartPointEndPoint(startPoint=byCoordinates, endPoint=transform, lacing=Longest)
watch_3d = Watch3D(byStartPointEndPoint)
