# Dynamo graph TranslateandRotatesequence.dyn (Dynamo 1.0.1.1821)

byCoordinates = Point.ByCoordinates(lacing=Longest)
XAxis = Vector.XAxis()
asPoint = Vector.AsPoint(XAxis, lacing=Longest)
number = DoubleInput(0.1)
number_slider = DoubleSlider(6.24, range=0..6.24 step 0.1)
number_2 = DoubleInput(0.25)
range = Range(start=number, end=number_slider, step=number_2, lacing=Longest)
scale = Geometry.Scale(geometry=asPoint, amount=range, lacing=Longest)
identity = CoordinateSystem.Identity()
ZAxis = Vector.ZAxis()
asPoint_2 = Vector.AsPoint(ZAxis, lacing=Longest)
asVector = Point.AsVector(asPoint_2)
radiansToDegrees = Math.RadiansToDegrees(range)
rotate = CoordinateSystem.Rotate(coordinateSystem=identity, origin=byCoordinates, axis=asVector, degrees=radiansToDegrees, lacing=Longest)
transform = Geometry.Transform(scale, rotate, lacing=Longest)
byStartPointEndPoint = Line.ByStartPointEndPoint(startPoint=byCoordinates, endPoint=transform, lacing=Longest)
watch_3d = Watch3D(byStartPointEndPoint)
watch = Watch(range)
