# Dynamo graph all curve test.dyn (Dynamo 1.0.1.1821)

boolean = BoolSelector(false)
byReferencePoints = CurveByPoints.ByReferencePoints(arg1=boolean, lacing=Longest)
byCurve = ModelCurve.ByCurve(lacing=Longest)
PI = Math.PI()
watch = Watch()
select_model_element = DSModelElementSelection()  # 1 picked in the model
point = ReferencePoint.Point(select_model_element, lacing=Longest)
number_slider = DoubleSlider(65.545, range=0..100 step 0.1)
number_slider_2 = DoubleSlider(0, range=0..6.2 step 0.1)
radiansToDegrees = Math.RadiansToDegrees(number_slider_2)
number_slider_3 = DoubleSlider(4.284, range=0..6.2 step 0.1)
radiansToDegrees_2 = Math.RadiansToDegrees(number_slider_3)
ZAxis = Vector.ZAxis()
byCenterPointRadiusAngle = Arc.ByCenterPointRadiusAngle(center=point, radius=number_slider, startAngle=radiansToDegrees, endAngle=radiansToDegrees_2, normal=ZAxis, lacing=Longest)
point_2 = ReferencePoint.Point(select_model_element, lacing=Longest)
select_model_element_2 = DSModelElementSelection()  # 1 picked in the model
point_3 = ReferencePoint.Point(select_model_element_2, lacing=Longest)
select_model_element_3 = DSModelElementSelection()  # 1 picked in the model
point_4 = ReferencePoint.Point(select_model_element_3, lacing=Longest)
byThreePoints = Arc.ByThreePoints(firstPoint=point_2, secondPoint=point_3, thirdPoint=point_4, lacing=Longest)
point_5 = ReferencePoint.Point(select_model_element_3, lacing=Longest)
byCenterPointRadius = Circle.ByCenterPointRadius(centerPoint=point_5, radius=number_slider, lacing=Longest)
select_model_element_4 = DSModelElementSelection()  # 1 picked in the model
point_6 = ReferencePoint.Point(select_model_element_4, lacing=Longest)
ZAxis_2 = Vector.ZAxis()
byOriginNormal = Plane.ByOriginNormal(origin=point_6, normal=ZAxis_2)
number = DoubleInput(2)
div = number_slider / number  # lacing=Longest
radiansToDegrees_3 = Math.RadiansToDegrees(number_slider_2)
sub = number_slider_3 - number_slider_2
radiansToDegrees_4 = Math.RadiansToDegrees(sub)
byPlaneRadiiAngles = EllipseArc.ByPlaneRadiiAngles(byOriginNormal, number_slider, div, radiansToDegrees_3, radiansToDegrees_4, lacing=Longest)
select_model_element_5 = DSModelElementSelection()  # 1 picked in the model
point_7 = ReferencePoint.Point(select_model_element_5, lacing=Longest)
byOriginRadii = Ellipse.ByOriginRadii(point_7, div, number_slider, lacing=Longest)
create_list = List.Create(byCenterPointRadiusAngle, byThreePoints, byCenterPointRadius, byPlaneRadiiAngles, byOriginRadii)
watch_3d = Watch3D(create_list)
byCoordinates = Point.ByCoordinates(lacing=Longest)
number_2 = DoubleInput(3.142)
number_3 = DoubleInput(6.283)
