# Dynamo graph connect two point arrays without python.dyn (Dynamo 1.0.1.1821)

create_list = List.Create()
select_model_element = DSModelElementSelection()  # 1 picked in the model
curve = CurveElement.Curve(select_model_element)
number_slider = DoubleSlider(4.267, range=0..20 step 0.1)
code_block = CodeBlock(x=number_slider) { 0..1..#x; }
pointAtParameter = Curve.PointAtParameter(curve=curve, param=code_block, lacing=CrossProduct)
byPoint = ReferencePoint.ByPoint(pointAtParameter, lacing=Longest)
select_model_element_2 = DSModelElementSelection()  # 1 picked in the model
curve_2 = CurveElement.Curve(select_model_element_2)
code_block_2 = CodeBlock(x=number_slider) { 0..1..#x; }
pointAtParameter_2 = Curve.PointAtParameter(curve=curve_2, param=code_block_2, lacing=CrossProduct)
byPoint_2 = ReferencePoint.ByPoint(pointAtParameter_2, lacing=Longest)
combine = List.Combine(create_list, byPoint, byPoint_2)
boolean = BoolSelector(true)
byReferencePoints = CurveByPoints.ByReferencePoints(arg1=boolean, lacing=Longest)
map = List.Map(list=combine, f_x=byReferencePoints)
