# Dynamo graph create sine wave from selected curve.dyn (Dynamo 1.0.1.1821)

select_model_element = DSModelElementSelection()  # 1 picked in the model
python_script = Python(IN[0]=select_model_element)
# ---------- python_script.python (35 lines) ----------
#derived from Nathan Miller's example http://theprovingground.wikidot.com/revit-api-py-curves
# Default imports
import clr
clr.AddReference('RevitAPI')
clr.AddReference('RevitAPIUI')
from Autodesk.Revit.DB import *
import Autodesk
import sys
import clr
path = r'C:\Autodesk\Dynamo\Core'
exec_path = r'C:\Users\Ian\Documents\GitHub\Dynamo\bin\AnyCPU\Debug'
sys.path.append(path)
sys.path.append(exec_path)
clr.AddReference('LibGNet')
from Autodesk.LibG import *
import math

doc = __revit__.ActiveUIDocument.Document
app = __revit__.Application

crv = IN[0]
crvRef = crv.GeometryCurve
refptarr = ReferencePointArray()

#use for loop to create a series of points
steps = 20
for i in range(0,steps+1):
    pt = crvRef.Evaluate(float(i)/steps,1) # returns and XYZ
    x = pt.X
    y = pt.Y
    z = pt.Z + math.sin(i)*steps 
    myXYZ = XYZ(x,y,z)
    refPt = doc.FamilyCreate.NewReferencePoint(myXYZ)
    refptarr.Append(refPt)
crv2 = doc.FamilyCreate.NewCurveByPoints(refptarr)
# ----------------------------------------
end = Revit.Transaction.Transaction.End(python_script)
