# Dynamo graph createpoint_sequence.dyn (Dynamo 1.0.1.1821)

number = DoubleInput(0)
number_slider = DoubleSlider(80, range=0..100 step 0.1)
number_2 = DoubleInput(10)
range = Range(start=number, end=number_slider, step=number_2, lacing=Longest)
byCoordinates = Point.ByCoordinates(x=number, y=number, z=range, lacing=Longest)
byPoint = ReferencePoint.ByPoint(byCoordinates, lacing=Longest)
number_3 = DoubleInput(0..80..10)
watch = Watch(number_3)
