# Dynamo graph createpointend.dyn (Dynamo 1.0.1.1821)

number = DoubleInput(0)
number_2 = DoubleInput(0)
number_slider = DoubleSlider(63.275, range=0..100 step 0.1)
byCoordinates = Point.ByCoordinates(x=number, y=number_2, z=number_slider, lacing=Longest)
byPoint = ReferencePoint.ByPoint(byCoordinates, lacing=Longest)
number_3 = DoubleInput(0)
