# Dynamo graph divideselectedcurve.dyn (Dynamo 1.0.1.1821)

number = DoubleInput(21)
select_model_element = DSModelElementSelection()  # 1 picked in the model
curve = CurveElement.Curve(select_model_element)
number_slider = DoubleSlider(33.333, range=0..100 step 0.1)
code_block = CodeBlock(x=number_slider) { 0..1..#x; }
pointAtParameter = Curve.PointAtParameter(curve=curve, param=code_block, lacing=CrossProduct)
byPoint = ReferencePoint.ByPoint(pointAtParameter, lacing=Longest)
