# Dynamo graph ellipse.dyn (Dynamo 1.0.1.1821)

number_slider = DoubleSlider(0, range=0..100 step 0.1)
number = DoubleInput(0)
byCoordinates = Point.ByCoordinates(x=number_slider, y=number, z=number, lacing=Longest)
number_slider_2 = DoubleSlider(30.909, range=0..200 step 0.1)
number_slider_3 = DoubleSlider(200, range=0..200 step 0.1)
byOriginRadii = Ellipse.ByOriginRadii(byCoordinates, number_slider_2, number_slider_3, lacing=Longest)
byCurve = ModelCurve.ByCurve(byOriginRadii, lacing=Longest)
ZAxis = Vector.ZAxis()
asPoint = Vector.AsPoint(ZAxis, lacing=Longest)
asVector = Point.AsVector(asPoint)
byOriginNormal = Plane.ByOriginNormal(origin=byCoordinates, normal=asVector, lacing=Longest)
byPlane = SketchPlane.ByPlane(byOriginNormal, lacing=Longest)
select_model_element = DSModelElementSelection()  # 1 picked in the model
curve = CurveElement.Curve(select_model_element, lacing=Longest)
create_list = List.Create(byOriginRadii, curve)
watch_3d = Watch3D(create_list)
