# Dynamo graph hill_climbing_daylighting.dyn (Dynamo 1.0.1.1821)

number = DoubleInput(1)
number_2 = DoubleInput(20)
create_list = List.Create(number, number_2)
string = StringInput("Width")
create_list_2 = List.Create(create_list, string)
number_3 = DoubleInput(1)
number_4 = DoubleInput(20)
create_list_3 = List.Create(number_3, number_4)
string_2 = StringInput("Height")
create_list_4 = List.Create(create_list_3, string_2)
create_list_5 = List.Create(create_list_2, create_list_4)
number_5 = DoubleInput(0)
family_types = FamilyTypes()
all_elements_of_family_type = ElementsOfFamilyType(family_types)
make_daylight_param_parent = Custom[Make Daylight param parent vector](list_of_parameters_and_ranges=create_list_5, generation_number=number_5, list_of_family_instances=all_elements_of_family_type)
evaluate_daylighting_solution = Custom[Evaluate Daylighting Solution](solution=make_daylight_param_parent)
number_6 = DoubleInput(10)
produce_new_daylight_child = Custom[Produce New DayLight Child](parent_fit=evaluate_daylighting_solution, family_instances=all_elements_of_family_type, parent=make_daylight_param_parent, mutation_rate=number_6)
watch = Watch(produce_new_daylight_child)
watch_2 = Watch(evaluate_daylighting_solution)
watch_3 = Watch(make_daylight_param_parent)
