# Dynamo graph hill_climbing_simple.dyn (Dynamo 1.0.1.1821)

number = DoubleInput(100)
# note: THIS IS THE GOAL POINT - how we evaluate fitness is distance to this point
byCoordinates = Point.ByCoordinates(x=number, y=number, z=number, lacing=Longest)
rand = Math.Rand()
# note: generate the first random parent
mul = rand * number  # lacing=Longest
byCoordinates_2 = Point.ByCoordinates(x=mul, y=mul, z=mul, lacing=Longest)
# note: This is the first parent fitness, we use distance here as a literal distance metric
distanceTo = Geometry.DistanceTo(geometry=byCoordinates, other=byCoordinates_2, lacing=Longest)
# note: This is the altered child - by adding a new vector - this is also a recursive node
produceChild = Custom[ProduceChild](parent_xyz=byCoordinates_2, goal_xyz=byCoordinates)
