# Dynamo graph refgridsliders.dyn (Dynamo 1.0.1.1821)

number_slider = DoubleSlider(5.955, range=0..10 step 0.1)
number = DoubleInput(1)
number_2 = DoubleInput(0)
number_slider_2 = DoubleSlider(30, range=0..50 step 0.1)
number_slider_3 = DoubleSlider(19, range=0..50 step 0.1)
number_3 = DoubleInput(0)
xyzGrid = Custom[XyzGrid](x_count=number_slider, y_count=number_slider, z_count=number, x0=number_2, y0=number_2, z0=number_2, x_space=number_slider_2, y_space=number_slider_3, z_space=number_3, lacing=Longest)  # This node represents an upgrade of the 0.6.3 XyzGrid node to 0.7.x
byPoint = ReferencePoint.ByPoint(xyzGrid, lacing=Longest)
