# Dynamo graph scalablegraphfunction.dyn (Dynamo 1.0.1.1821)

number = DoubleInput(-1)
PI = Math.PI()
mul = number * PI  # lacing=Longest
number_2 = DoubleInput(32)
number_3 = DoubleInput(start..end..#amount, mul, PI, number_2, lacing=Longest)
formula = Formula("sin(x)", x=number_3, lacing=Longest)
byCoordinates = Point.ByCoordinates(x=number_3, y=formula, lacing=Longest)
number_slider = DoubleSlider(1, range=0.1..10 step 0.1)
scale = Geometry.Scale(geometry=byCoordinates, amount=number_slider, lacing=Longest)
byPoint = ReferencePoint.ByPoint(scale, lacing=Longest)
reverse = List.Reverse(scale)
restOfItems = List.RestOfItems(reverse)
byStartPointEndPoint = Line.ByStartPointEndPoint(startPoint=reverse, endPoint=restOfItems)
byCurve = ModelCurve.ByCurve(byStartPointEndPoint, lacing=Longest)
