# Dynamo graph tesselation.dyn (Dynamo 1.0.1.1821)

# note: Connect these to
# make Revit Stuff
# note: Swap these connections
# For different patterning

get_surface_domain = CodeBlock { {{0,0},{1,1}}; }
number_slider = DoubleSlider(13.981, range=0..40 step 0.1)
code_block = CodeBlock(domain=get_surface_domain, ucount=number_slider, vcount=number_slider) { domain[0][0]..domain[1][0]..#ucount+1; domain[0][1]..domain[1][1]..#vcount+1; }
byCoordinates = UV.ByCoordinates(code_block.out0, code_block.out1, lacing=CrossProduct)
flatten = Flatten(byCoordinates)
random_uv = CodeBlock(dom=get_surface_domain, ucount=number_slider, vcount=number_slider)
# ---------- random_uv.designscript (6 lines) ----------
dom[0][0]+Math.RandomList
(ucount*vcount)
*(dom[1][0]-dom[0][0]);
dom[0][1]+Math.RandomList
(ucount*vcount)
*(dom[1][1]-dom[0][1]);
# ----------------------------------------
byCoordinates_2 = UV.ByCoordinates(random_uv.out0, random_uv.out1, lacing=Longest)
select_face = DSFaceSelection()  # 1 picked in the model
byParametersOnSurface = Tessellation.Voronoi.ByParametersOnSurface(byCoordinates_2, select_face)
watch_3d = Watch3D(byParametersOnSurface)
byCurve = ModelCurve.ByCurve(lacing=Longest)
