# Dynamo graph tesselation_types.dyn (Dynamo 1.0.1.1821)

get_surface_domain = CodeBlock { {{0,0},{1,1}}; }
number_slider = DoubleSlider(6.817, range=0..40 step 0.1)
random_uv = CodeBlock(dom=get_surface_domain, ucount=number_slider, vcount=number_slider)
# ---------- random_uv.designscript (6 lines) ----------
dom[0][0]+Math.RandomList
(ucount*vcount)
*(dom[1][0]-dom[0][0]);
dom[0][1]+Math.RandomList
(ucount*vcount)
*(dom[1][1]-dom[0][1]);
# ----------------------------------------
byCoordinates = UV.ByCoordinates(random_uv.out0, random_uv.out1, lacing=Longest)
select_face = DSFaceSelection()  # 1 picked in the model
byParametersOnSurface = Tessellation.Voronoi.ByParametersOnSurface(byCoordinates, select_face)
watch_3d = Watch3D(byParametersOnSurface)
U = UV.U(byCoordinates)
V = UV.V(byCoordinates)
pointAtParameter = Surface.PointAtParameter(surface=select_face, u=U, v=V, lacing=Longest)
byParametersOnSurface_2 = Tessellation.Delaunay.ByParametersOnSurface(byCoordinates, select_face)
watch_3d_2 = Watch3D(byParametersOnSurface_2)
# note: Swap these connections
# For different patterning
watch_3d_3 = Watch3D()
watch_3d_4 = Watch3D()
byCurve = ModelCurve.ByCurve(lacing=Longest)
create_list = List.Create(byParametersOnSurface, byParametersOnSurface_2)
flatten = Flatten(create_list)
