# Dynamo graph tesselationwithcoincidentgrids.dyn (Dynamo 1.0.1.1821)

select_face = DSFaceSelection()  # 1 picked in the model
get_surface_domain = CodeBlock { {{0,0},{1,1}}; }
number_slider = DoubleSlider(10.136, range=0..20 step 0.1)
code_block = CodeBlock(domain=get_surface_domain, ucount=number_slider, vcount=number_slider) { domain[0][0]..domain[1][0]..#ucount+1; domain[0][1]..domain[1][1]..#vcount+1; }
byCoordinates = UV.ByCoordinates(code_block.out0, code_block.out1, lacing=CrossProduct)
flatten = Flatten(byCoordinates)
U = UV.U(flatten)
V = UV.V(flatten)
pointAtParameter = Surface.PointAtParameter(surface=select_face, u=U, v=V, lacing=Longest)
# note: Wiggle Sliders
# for Awesome
number_slider_2 = DoubleSlider(6.515, range=0..20 step 0.1)
code_block_2 = CodeBlock(domain=get_surface_domain, ucount=number_slider_2, vcount=number_slider_2) { domain[0][0]..domain[1][0]..#ucount+1; domain[0][1]..domain[1][1]..#vcount+1; }
byCoordinates_2 = UV.ByCoordinates(code_block_2.out0, code_block_2.out1, lacing=CrossProduct)
flatten_2 = Flatten(byCoordinates_2)
join = List.Join(flatten_2, flatten)
byParametersOnSurface = Tessellation.Voronoi.ByParametersOnSurface(join, select_face)
create_list = List.Create(pointAtParameter, byParametersOnSurface)
watch_3d = Watch3D(create_list)
byCurve = ModelCurve.ByCurve(lacing=Longest)
flatten_3 = Flatten(create_list)
