# Dynamo graph CanCreateScheduleOnSheet.dyn (Dynamo 2.6.1.8772)

sheets = Sheets("Unnamed")
views = Views("View List")
byCoordinates = Point.ByCoordinates()
bySheetScheduleLocation = ScheduleOnSheet.BySheetScheduleLocation(sheet=sheets, scheduleView=views, location=byCoordinates)
scheduleView = ScheduleOnSheet.ScheduleView(scheduleOnSheet=bySheetScheduleLocation)
name = Element.Name(element=scheduleView)
sheet = ScheduleOnSheet.Sheet(scheduleOnSheet=bySheetScheduleLocation)
sheetName = Sheet.SheetName(sheet=sheet)
