# Dynamo graph CanSetGetLocation.dyn (Dynamo 2.6.1.8772)

sheets = Sheets("Unnamed")
views = Views("View List")
byCoordinates = Point.ByCoordinates()
bySheetScheduleLocation = ScheduleOnSheet.BySheetScheduleLocation(sheet=sheets, scheduleView=views, location=byCoordinates)
code_block = CodeBlock { 250; }
byCoordinates_2 = Point.ByCoordinates(x=code_block, y=code_block)
setLocation = ScheduleOnSheet.SetLocation(scheduleOnSheet=bySheetScheduleLocation, point=byCoordinates_2)
location = ScheduleOnSheet.Location(scheduleOnSheet=setLocation)
