# Dynamo graph DynamoAllSelectionNodeTests.dyn (Dynamo 0.7.6.4121)

floor_types = FloorTypes("150mm Foundation Slab")
select_divided_surface_families = DSDividedSurfaceFamiliesSelection()
structural_column_types = StructuralColumnTypes("L127X127X9.5")
structural_framing_types = StructuralFramingTypes("1 3/4x14")
views = Views("Level 1")
wall_types = WallTypes("Cavity wall_sliders")
levels = Levels("Level 2")
all_elements_at_level = ElementsAtLevel(levels)
watch = Watch(all_elements_at_level)
categories = Categories("AdaptivePoints")
all_elements_of_category = ElementsOfCategory(categories)
watch_2 = Watch(all_elements_of_category)
family_types = FamilyTypes("1pick:1pick")
name = Family.Name(family_types)
watch_3 = Watch(name)
all_elements_of_family_type = ElementsOfFamilyType(family_types)
watch_4 = Watch(all_elements_of_family_type)
element_types = ElementTypes("CurtainGridLine")
all_elements_of_type = ElementsOfType(element_types)
watch_5 = Watch(all_elements_of_type)
select_model_elements = DSModelElementsSelection()  # 8 picked in the model
watch_6 = Watch(select_model_elements)
select_edge = DSEdgeSelection()  # 1 picked in the model
watch_7 = Watch(select_edge)
select_model_element = DSModelElementSelection()  # 1 picked in the model
watch_8 = Watch(select_model_element)
select_point_on_face = DSPointOnElementSelection()  # 1 picked in the model
watch_9 = Watch(select_point_on_face)
select_face = DSFaceSelection()  # 1 picked in the model
watch_10 = Watch(select_face)
select_uv_on_face = DSUvOnElementSelection()  # 1 picked in the model
watch_11 = Watch(select_uv_on_face)
select_faces = SelectFaces()  # 5 picked in the model
watch_12 = Watch(select_faces)
flatten = Flatten(watch_12)
categories_2 = Categories("Views")
all_elements_of_category_2 = ElementsOfCategory(categories_2)
watch_13 = Watch(all_elements_of_category_2)
