# Dynamo graph SelectElementsOfCategoryInView.dyn (Dynamo 2.4.0.5694)

categories = Categories("OST_Walls")
current = Document.Current()
activeView = Document.ActiveView(document=current)
all_walls_in_current_view = ElementsOfCategoryInView(Category=categories, View=activeView)
categories_2 = Categories("OST_Rooms")
all_rooms_in_current_view = ElementsOfCategoryInView(Category=categories_2, View=activeView)
