# Dynamo graph SelectRoomsByStatus.dyn (Dynamo 2.6.0.7736)

rooms_by_status = RoomsByStatus()
watch = Watch(rooms_by_status.PlacedRooms)
watch_2 = Watch(rooms_by_status.UnplacedRooms)
watch_3 = Watch(rooms_by_status.NotEnclosedRooms)
watch_4 = Watch(rooms_by_status.RedundantRooms)
