# Dynamo graph ByNameNumberTitleBlock.dyn (Dynamo 2.6.0.7237)

code_block = CodeBlock { "Poodle"; "A1"; }
code_block_2 = CodeBlock { "E1 30 x 42 Horizontal"; "E1 30x42 Horizontal"; }
byName = Family.ByName(name=code_block_2.out0)
byFamilyAndName = FamilyType.ByFamilyAndName(family=byName, name=code_block_2.out1)
byNameNumberTitleBlock = Sheet.ByNameNumberTitleBlock(sheetName=code_block.out0, sheetNumber=code_block.out1, titleBlockFamilyType=byFamilyAndName)
