# Dynamo graph ByNameNumberTitleBlockViewAndLocation.dyn (Dynamo 2.6.1.9130)

string = StringInput("Test")
string_2 = StringInput("A1")
family_types = FamilyTypes("E1 30 x 42 Horizontal:E1 30x42 Horizontal")
views = Views("East")
code_block = CodeBlock { 1; }
byCoordinates = Point.ByCoordinates(x=code_block, y=code_block)
byNameNumberTitleBlockViewAndLocation = Sheet.ByNameNumberTitleBlockViewAndLocation(sheetName=string, sheetNumber=string_2, titleBlockFamilyType=family_types, view=views, location=byCoordinates)
