# Dynamo graph ByNameNumberTitleBlockViewsAndLocations.dyn (Dynamo 2.6.1.9130)

string = StringInput("Test")
string_2 = StringInput("A1")
family_types = FamilyTypes("E1 30 x 42 Horizontal:E1 30x42 Horizontal")
views = Views("East")
views_2 = Views("North")
list_create = List.Create(item0=views, item1=views_2)
byCoordinates = Point.ByCoordinates()
code_block = CodeBlock { 1; }
byCoordinates_2 = Point.ByCoordinates(x=code_block, y=code_block)
list_create_2 = List.Create(item0=byCoordinates, item1=byCoordinates_2)
byNameNumberTitleBlockViewsAndLocations = Sheet.ByNameNumberTitleBlockViewsAndLocations(sheetName=string, sheetNumber=string_2, titleBlockFamilyType=family_types, views=list_create, locations=list_create_2)
