# Dynamo graph CanGetSheetProperties.dyn (Dynamo 2.6.1.8772)

sheets = Sheets("Title Sheet")
titleBlock = Sheet.TitleBlock(sheet=sheets)
viewports = Sheet.Viewports(sheet=sheets)
schedules = Sheet.Schedules(sheet=sheets)
