# Dynamo graph DuplicateSheet.dyn (Dynamo 2.8.0.2195)

sheets = Sheets("Title Sheet")
boolean = BoolSelector(true)
view_duplicate_options = ViewDuplicateOptions("Duplicate")
string = StringInput("Test")
duplicateSheet = Sheet.DuplicateSheet(sheet=sheets, duplicateWithContents=boolean, duplicateWithView=boolean, viewDuplicateOption=view_duplicate_options, prefix=string)
views = Sheet.Views(sheet=duplicateSheet)
