# Dynamo graph GetSetSheetNameNumber.dyn (Dynamo 2.6.1.8772)

sheets = Sheets("Title Sheet")
sheetName = StringInput("Test")
setSheetName = Sheet.SetSheetName(sheet=sheets, sheetName=sheetName)
sheetName_2 = Sheet.SheetName(sheet=setSheetName)
sheetNumber = StringInput("A002")
setSheetNumber = Sheet.SetSheetNumber(sheet=sheets, sheetNumber=sheetNumber)
sheetNumber_2 = Sheet.SheetNumber(sheet=setSheetNumber)
