# Dynamo graph BlendSolid.dyn (Dynamo 0.8.1.1441)

number = DoubleInput(0)
byCoordinates = Point.ByCoordinates(x=number, y=number, z=number, lacing=Longest)
number_2 = DoubleInput(102)
byCoordinates_2 = Point.ByCoordinates(x=number_2, y=number, z=number, lacing=Longest)
byStartPointEndPoint = Line.ByStartPointEndPoint(startPoint=byCoordinates, endPoint=byCoordinates_2, lacing=Longest)
number_3 = DoubleInput(150)
byCoordinates_3 = Point.ByCoordinates(x=number_2, y=number_3, z=number, lacing=Longest)
byStartPointEndPoint_2 = Line.ByStartPointEndPoint(startPoint=byCoordinates_2, endPoint=byCoordinates_3, lacing=Longest)
byCoordinates_4 = Point.ByCoordinates(x=number, y=number_3, z=number, lacing=Longest)
byStartPointEndPoint_3 = Line.ByStartPointEndPoint(startPoint=byCoordinates_3, endPoint=byCoordinates_4, lacing=Longest)
byStartPointEndPoint_4 = Line.ByStartPointEndPoint(startPoint=byCoordinates_4, endPoint=byCoordinates, lacing=Longest)
create_list = List.Create(byStartPointEndPoint, byStartPointEndPoint_2, byStartPointEndPoint_3, byStartPointEndPoint_4)
byJoinedCurves = PolyCurve.ByJoinedCurves(create_list, lacing=Longest)
number_4 = DoubleInput(200)
byCoordinates_5 = Point.ByCoordinates(x=number, y=number, z=number_4, lacing=Longest)
byCoordinates_6 = Point.ByCoordinates(x=number_3, y=number, z=number_4, lacing=Longest)
byStartPointEndPoint_5 = Line.ByStartPointEndPoint(startPoint=byCoordinates_5, endPoint=byCoordinates_6, lacing=Longest)
byCoordinates_7 = Point.ByCoordinates(x=number_3, y=number_3, z=number_4, lacing=Longest)
byStartPointEndPoint_6 = Line.ByStartPointEndPoint(startPoint=byCoordinates_6, endPoint=byCoordinates_7, lacing=Longest)
byCoordinates_8 = Point.ByCoordinates(x=number, y=number_3, z=number_4, lacing=Longest)
byStartPointEndPoint_7 = Line.ByStartPointEndPoint(startPoint=byCoordinates_7, endPoint=byCoordinates_8, lacing=Longest)
byStartPointEndPoint_8 = Line.ByStartPointEndPoint(startPoint=byCoordinates_8, endPoint=byCoordinates_5, lacing=Longest)
create_list_2 = List.Create(byStartPointEndPoint_5, byStartPointEndPoint_6, byStartPointEndPoint_7, byStartPointEndPoint_8)
byJoinedCurves_2 = PolyCurve.ByJoinedCurves(create_list_2, lacing=Longest)
create_list_3 = List.Create(byJoinedCurves, byJoinedCurves_2)
byLoft = Solid.ByLoft(create_list_3, lacing=Longest)
