# Dynamo graph BoxByCenterAndDimensions.dyn (Dynamo 1.0.1.1821)

code_block = CodeBlock { Point.ByCoordinates(0,0,0); }
number_slider = DoubleSlider(11.80510137, range=0..100 step 0.1)
byLengths = Cuboid.ByLengths(origin=code_block, width=number_slider, length=number_slider, lacing=Longest)
