# Dynamo graph BoxByTwoCorners.dyn (Dynamo 0.8.1.1441)

number = DoubleInput(2)
number_2 = DoubleInput(-1)
mul = number * number_2  # lacing=Longest
byCoordinates = Point.ByCoordinates(x=mul, y=mul, z=mul, lacing=Longest)
byCoordinates_2 = Point.ByCoordinates(x=number, y=number, z=number, lacing=Longest)
byCorners = Cuboid.ByCorners(lowPoint=byCoordinates, highPoint=byCoordinates_2, lacing=Longest)
