# Dynamo graph RevolveSolid.dyn (Dynamo 0.8.1.1441)

identity = CoordinateSystem.Identity(lacing=Longest)
identity_2 = CoordinateSystem.Identity()
byCoordinates = Point.ByCoordinates(lacing=Longest)
number = DoubleInput(1)
number_2 = DoubleInput(0)
byCoordinates_2 = Point.ByCoordinates(x=number, y=number_2, z=number_2, lacing=Longest)
asVector = Point.AsVector(byCoordinates_2)
PI = Math.PI()
number_3 = DoubleInput(2)
div = PI / number_3  # lacing=Longest
radiansToDegrees = Math.RadiansToDegrees(div)
rotate = CoordinateSystem.Rotate(coordinateSystem=identity_2, origin=byCoordinates, axis=asVector, degrees=radiansToDegrees, lacing=Longest)
watch = Watch()
number_4 = DoubleInput(50)
byCoordinates_3 = Point.ByCoordinates(x=number_4, y=number_2, z=number_4, lacing=Longest)
ZAxis = Vector.ZAxis()
byOriginNormal = Plane.ByOriginNormal(origin=byCoordinates_3, normal=ZAxis)
number_5 = DoubleInput(20)
number_6 = DoubleInput(25)
radiansToDegrees_2 = Math.RadiansToDegrees(number_2)
number_7 = DoubleInput(1.57)
sub = number_7 - number_2
radiansToDegrees_3 = Math.RadiansToDegrees(sub)
byPlaneRadiiStartAngleSweepAngle = EllipseArc.ByPlaneRadiiStartAngleSweepAngle(byOriginNormal, number_5, number_6, radiansToDegrees_2, radiansToDegrees_3, lacing=Longest)
identity_3 = CoordinateSystem.Identity()
transform = Geometry.Transform(byPlaneRadiiStartAngleSweepAngle, identity_3, lacing=Longest)
number_8 = DoubleInput(2)
offset = Curve.Offset(curve=transform, distance=number_8, lacing=Longest)
byCoordinates_4 = Point.ByCoordinates(x=number_2, y=number, z=number_2, lacing=Longest)
asVector_2 = Point.AsVector(byCoordinates_4)
byThickeningCurve = PolyCurve.ByThickeningCurve(curve=offset, thickness=number_8, nor=asVector_2, lacing=Longest)
byRevolve = Solid.ByRevolve(byThickeningCurve, byCoordinates_4, asVector_2, PI, number_2)
