# Dynamo graph SolidBySkeleton.dyn (Dynamo 0.8.1.1441)

number = DoubleInput(50)
number_2 = DoubleInput(0)
byCoordinates = Point.ByCoordinates(x=number, y=number_2, z=number_2, lacing=Longest)
byCoordinates_2 = Point.ByCoordinates(x=number, y=number, z=number_2, lacing=Longest)
byStartPointEndPoint = Line.ByStartPointEndPoint(startPoint=byCoordinates, endPoint=byCoordinates_2, lacing=Longest)
byCoordinates_3 = Point.ByCoordinates(x=number_2, y=number, z=number_2, lacing=Longest)
byStartPointEndPoint_2 = Line.ByStartPointEndPoint(startPoint=byCoordinates_2, endPoint=byCoordinates_3, lacing=Longest)
number_3 = DoubleInput(100)
byCoordinates_4 = Point.ByCoordinates(x=number_3, y=number_3, z=number_2, lacing=Longest)
byStartPointEndPoint_3 = Line.ByStartPointEndPoint(startPoint=byCoordinates_3, endPoint=byCoordinates_4, lacing=Longest)
byStartPointEndPoint_4 = Line.ByStartPointEndPoint(startPoint=byCoordinates_4, endPoint=byCoordinates, lacing=Longest)
create_list = List.Create(byStartPointEndPoint, byStartPointEndPoint_2, byStartPointEndPoint_3, byStartPointEndPoint_4)
byJoinedCurves = PolyCurve.ByJoinedCurves(create_list, lacing=Longest)
number_4 = DoubleInput(75)
byCoordinates_5 = Point.ByCoordinates(x=number_4, y=number_4, z=number_3, lacing=Longest)
byStartPointEndPoint_5 = Line.ByStartPointEndPoint(startPoint=byCoordinates, endPoint=byCoordinates_5, lacing=Longest)
byStartPointEndPoint_6 = Line.ByStartPointEndPoint(startPoint=byCoordinates_2, endPoint=byCoordinates_5, lacing=Longest)
create_list_2 = List.Create(byStartPointEndPoint, byStartPointEndPoint_5, byStartPointEndPoint_6)
byJoinedCurves_2 = PolyCurve.ByJoinedCurves(create_list_2, lacing=Longest)
byStartPointEndPoint_7 = Line.ByStartPointEndPoint(startPoint=byCoordinates_3, endPoint=byCoordinates_5, lacing=Longest)
create_list_3 = List.Create(byStartPointEndPoint_2, byStartPointEndPoint_6, byStartPointEndPoint_7)
byJoinedCurves_3 = PolyCurve.ByJoinedCurves(create_list_3, lacing=Longest)
byStartPointEndPoint_8 = Line.ByStartPointEndPoint(startPoint=byCoordinates_4, endPoint=byCoordinates_5, lacing=Longest)
create_list_4 = List.Create(byStartPointEndPoint_3, byStartPointEndPoint_7, byStartPointEndPoint_8)
byJoinedCurves_4 = PolyCurve.ByJoinedCurves(create_list_4, lacing=Longest)
create_list_5 = List.Create(byStartPointEndPoint_4, byStartPointEndPoint_5, byStartPointEndPoint_8)
byJoinedCurves_5 = PolyCurve.ByJoinedCurves(create_list_5, lacing=Longest)
create_list_6 = List.Create(byJoinedCurves, byJoinedCurves_2, byJoinedCurves_3, byJoinedCurves_4, byJoinedCurves_5)
