# Dynamo graph SweptBlend.dyn (Dynamo 0.8.1.1441)

identity = CoordinateSystem.Identity(lacing=Longest)
number = DoubleInput(10)
number_2 = DoubleInput(20)
byWidthHeight = Rectangle.ByWidthHeight(identity, number, number_2, lacing=Longest)
identity_2 = CoordinateSystem.Identity()
number_3 = DoubleInput(0)
byCoordinates = Point.ByCoordinates(x=number, y=number_3, z=number_2, lacing=Longest)
number_4 = DoubleInput(0.4)
scale = Geometry.Scale(geometry=byCoordinates, amount=number_4, lacing=Longest)
asVector = Point.AsVector(scale)
translate = CoordinateSystem.Translate(identity_2, asVector, lacing=Longest)
number_5 = DoubleInput(15)
byWidthHeight_2 = Rectangle.ByWidthHeight(translate, number, number_5, lacing=Longest)
identity_3 = CoordinateSystem.Identity()
asVector_2 = Point.AsVector(byCoordinates)
translate_2 = CoordinateSystem.Translate(identity_3, asVector_2, lacing=Longest)
byWidthHeight_3 = Rectangle.ByWidthHeight(translate_2, number_2, number, lacing=Longest)
create_list = List.Create(byWidthHeight, byWidthHeight_2, byWidthHeight_3)
byCoordinates_2 = Point.ByCoordinates(x=number, y=number_3, z=number_3, lacing=Longest)
byStartPointEndPoint = Line.ByStartPointEndPoint(startPoint=byCoordinates_2, endPoint=byCoordinates, lacing=Longest)
bySweep = Solid.BySweep(create_list, byStartPointEndPoint, lacing=Longest)
watch = Watch(bySweep)
