# Dynamo graph CanCreateSpaceFromLevelLocationNameNumber.dyn (Dynamo 2.6.0.7237)

levels = Levels("Level 0")
code_block = CodeBlock { Point.ByCoordinates(-5266.333, -2266.975, 0.000); }
code_block_2 = CodeBlock { "TestSpace"; "99"; }
byLevelLocation = Space.ByLevelLocation(level=levels, location=code_block, name=code_block_2.out0, number=code_block_2.out1)
id = Element.Id(element=byLevelLocation)
type = Object.Type(obj=byLevelLocation)
