# Dynamo graph CanGetSpaceLocation.dyn (Dynamo 2.6.0.7237)

select_model_element = DSModelElementSelection()  # 1 picked in the model
location = Space.Location(space=select_model_element)
X = Point.X(point=location)
Y = Point.Y(point=location)
Z = Point.Z(point=location)
