# Dynamo graph CanSetSpaceName.dyn (Dynamo 2.6.0.7237)

select_model_element = DSModelElementSelection()  # 1 picked in the model
code_block = CodeBlock { "newSpaceName"; }
setName = Space.SetName(space=select_model_element, value=code_block)
name = Space.Name(space=setName)
