# Dynamo graph CanSetSpaceNumber.dyn (Dynamo 2.6.0.7237)

select_model_element = DSModelElementSelection()  # 1 picked in the model
code_block = CodeBlock { "99"; }
setNumber = Space.SetNumber(space=select_model_element, value=code_block)
number = Space.Number(space=setNumber)
