# Dynamo graph Column.dyn (Dynamo 0.8.1.1151)

code_block = CodeBlock { Autodesk.Point.ByCoordinates(0,0,0); Autodesk.Point.ByCoordinates(0,0,20); 20; 10; }
byCenterPointRadius = Circle.ByCenterPointRadius(centerPoint=code_block.out0, radius=code_block.out2)
integer_slider = IntegerSlider(10, range=0..100 step 1)
code_block_2 = CodeBlock(count=integer_slider) { 0..0.9..#count; }
pointAtParameter = Curve.PointAtParameter(curve=byCenterPointRadius, param=code_block_2)
byCenterPointRadius_2 = Circle.ByCenterPointRadius(centerPoint=code_block.out1, radius=code_block.out3)
pointAtParameter_2 = Curve.PointAtParameter(curve=byCenterPointRadius_2, param=code_block_2)
byStartPointEndPoint = Line.ByStartPointEndPoint(startPoint=pointAtParameter, endPoint=pointAtParameter_2)
levels = Levels("Level 2")
structural_column_types = StructuralColumnTypes("30\"")
columnByCurve = StructuralFraming.ColumnByCurve(byStartPointEndPoint, levels, structural_column_types)
