# Dynamo graph SubelementTest.dyn (Dynamo 3.1.0.4724)

pick_model_elements = DSModelElementMultipleSelection()  # 1 picked in the model
subelements = Element.Subelements(element=pick_model_elements)
element = Subelement.Element(subelement=subelements)
category = Subelement.Category(subelement=subelements)
getAllParameters = Subelement.GetAllParameters(subelement=subelements)
getParameterValue = Subelement.GetParameterValue(subelement=subelements, paramId=getAllParameters)
code_block = CodeBlock { -1153128; }
getParameterValue_2 = Subelement.GetParameterValue(subelement=subelements, paramId=code_block)
code_block_2 = CodeBlock { 1; }
setIntegerParameterValue = Subelement.SetIntegerParameterValue(subelement=subelements, paramId=code_block, value=code_block_2)
code_block_3 = CodeBlock { -1114124; }
code_block_4 = CodeBlock { 2; }
setDoubleParameterValue = Subelement.SetDoubleParameterValue(subelement=subelements, paramId=code_block_3, value=code_block_4)
