# Dynamo graph SunSettings.dyn (Dynamo 0.7.2.38068)

origin = Point.Origin()
current = SunSettings()  # "SunSettings.Current"
sunDirection = SunSettings.SunDirection(current)
code_block = CodeBlock { 100; }
byStartPointDirectionLength = Line.ByStartPointDirectionLength(origin, sunDirection, code_block)
byCurve = ModelCurve.ByCurve(byStartPointDirectionLength)
azimuth = SunSettings.Azimuth(current)
watch = Watch([azimuth, azimuth])
altitude = SunSettings.Altitude(current)
watch_2 = Watch([altitude, altitude])
startDateTime = SunSettings.StartDateTime()
endDateTime = SunSettings.EndDateTime()
