# Dynamo graph CanGetSetConditionAndLocationOfLeaderEnd.dyn (Dynamo 2.8.0.2195)

views = Views("Level 1")
select_model_element = DSModelElementSelection()  # 1 picked in the model
boolean = BoolSelector(true)
code_block = CodeBlock { "Middle"; "Center"; }
code_block_2 = CodeBlock { 10; }
byCoordinates = Vector.ByCoordinates(x=code_block_2, y=code_block_2)
byElement = Tag.ByElement(view=views, element=select_model_element, horizontal=boolean, addLeader=boolean, horizontalAlignment=code_block.out0, verticalAlignment=code_block.out1, offset=byCoordinates)
leaderend_condition = LeaderEndCondition("Free")
setLeaderEndCondition = Tag.SetLeaderEndCondition(tag=byElement, leaderEndCondition=leaderend_condition)
getLeaderEndCondition = Tag.GetLeaderEndCondition(tag=setLeaderEndCondition)
leaderEnd = Tag.LeaderEnd(tag=setLeaderEndCondition)
code_block_3 = CodeBlock { 2; }
byCoordinates_2 = Vector.ByCoordinates(y=code_block_3)
add = Point.Add(point=leaderEnd, vectorToAdd=byCoordinates_2)
setLeaderEnd = Tag.SetLeaderEnd(tag=setLeaderEndCondition, location=add)
leaderEnd_2 = Tag.LeaderEnd(tag=setLeaderEnd)
