# Dynamo graph CanGetSetHeadPositionLeaderElbow.dyn (Dynamo 2.8.0.2195)

views = Views("Level 1")
select_model_element = DSModelElementSelection()  # 1 picked in the model
boolean = BoolSelector(true)
code_block = CodeBlock { "Middle"; "Center"; }
code_block_2 = CodeBlock { 10; }
byCoordinates = Vector.ByCoordinates(x=code_block_2, y=code_block_2)
byElement = Tag.ByElement(view=views, element=select_model_element, horizontal=boolean, addLeader=boolean, horizontalAlignment=code_block.out0, verticalAlignment=code_block.out1, offset=byCoordinates)
headLocation = Tag.HeadLocation(tag=byElement)
code_block_3 = CodeBlock { 5; }
byCoordinates_2 = Vector.ByCoordinates(y=code_block_3)
add = Point.Add(point=headLocation, vectorToAdd=byCoordinates_2)
setHeadLocation = Tag.SetHeadLocation(tag=byElement, location=add)
headLocation_2 = Tag.HeadLocation(tag=setHeadLocation)
setLeaderElbow = Tag.SetLeaderElbow(tag=setHeadLocation, location=headLocation)
leaderElbow = Tag.LeaderElbow(tag=setLeaderElbow)
