# Dynamo graph UVRandom.dyn (Dynamo 0.8.1.1441)

number = DoubleInput(0)
byCoordinates = UV.ByCoordinates(number, number, lacing=Longest)
number_2 = DoubleInput(1)
byCoordinates_2 = UV.ByCoordinates(number_2, number_2, lacing=Longest)
uv_domain = CodeBlock(min=byCoordinates, max=byCoordinates_2) { {{min.U,min.V},{max.U,max.V}}; }
number_3 = DoubleInput(5)
random_uv = CodeBlock(dom=uv_domain, ucount=number_3, vcount=number_3)
# ---------- random_uv.designscript (6 lines) ----------
dom[0][0]+Math.RandomList
(ucount*vcount)
*(dom[1][0]-dom[0][0]);
dom[0][1]+Math.RandomList
(ucount*vcount)
*(dom[1][1]-dom[0][1]);
# ----------------------------------------
byCoordinates_3 = UV.ByCoordinates(random_uv.out0, random_uv.out1, lacing=Longest)
