# Dynamo graph CanGetSetCategoryOverridesAndHidden.dyn (Dynamo 2.6.1.9130)

views = Views("{3D}")
categories = Categories("OST_Walls")
code_block = CodeBlock { 100; }
detail_level = DetailLevel("Fine")
byProperties = Revit.Filter.OverrideGraphicSettings.ByProperties(transparency=code_block, detailLevel=detail_level)
boolean = BoolSelector(true)
setCategoryOverrides = View.SetCategoryOverrides(view=views, category=categories, overrides=byProperties, hide=boolean)
getCategoryOverrides = View.GetCategoryOverrides(view=setCategoryOverrides, category=categories)
isCategoryHidden = View.IsCategoryHidden(view=setCategoryOverrides, category=categories)
