# Dynamo graph CanGetSetDiscipline.dyn (Dynamo 2.8.0.2195)

views = Views("{3D}")
view_disciplines = ViewDisciplines("Structural")
setDiscipline = View.SetDiscipline(view=views, discipline=view_disciplines)
discipline = View.Discipline(view=setDiscipline)
