# Dynamo graph CanGetSetDisplayStyle.dyn (Dynamo 2.8.0.2195)

views = Views("{3D}")
view_displaystyles = ViewDisplayStyles("Shading")
setDisplayStyle = View.SetDisplayStyle(view=views, displayStyle=view_displaystyles)
displaystyle = View.Displaystyle(view=setDisplayStyle)
