# Dynamo graph CanGetSetPartsVisibility.dyn (Dynamo 2.8.0.2195)

views = Views("{3D}")
view_partsvisibilitys = ViewPartsVisibilitys("ShowPartsAndOriginal")
setPartsVisibility = View.SetPartsVisibility(view=views, partsVisibility=view_partsvisibilitys)
partsvisibility = View.Partsvisibility(view=setPartsVisibility)
