# Dynamo graph CanGetSetSketchPlane.dyn (Dynamo 2.6.1.9130)

views = Views("{3D}")
XY = Plane.XY()
code_block = CodeBlock { 2; }
offset = Plane.Offset(plane=XY, dist=code_block)
byPlane = SketchPlane.ByPlane(plane=offset)
setSketchPlane = View.SetSketchPlane(view=views, sketchPlane=byPlane)
sketchPlane = View.SketchPlane(view=setSketchPlane)
