# Dynamo graph CanGetView3dSpaceProperties.dyn (Dynamo 2.6.1.9130)

views = Views("{3D}")
origin = View.Origin(view=views)
outline = View.Outline(view=views)
rightDirection = View.RightDirection(view=views)
scale = View.Scale(view=views)
viewDirection = View.ViewDirection(view=views)
