# Dynamo graph CropBoxofView.dyn (Dynamo 2.6.1.9130)

views = Views("Level 1")
boundingBox = Element.BoundingBox(element=views)
setCropBox = View.SetCropBox(view=views, boundingBox=boundingBox)
cropBox = View.CropBox(view=setCropBox)
boolean = BoolSelector(true)
setCropBoxActive = View.SetCropBoxActive(view=views, IsActive=boolean)
cropBoxActive = View.CropBoxActive(view=setCropBoxActive)
setCropBoxVisible = View.SetCropBoxVisible(view=views, IsVisible=boolean)
cropBoxVisible = View.CropBoxVisible(view=setCropBoxVisible)
