# Dynamo graph DuplicateView.dyn (Dynamo 2.8.0.2195)

views = Views("East")
view_duplicate_options = ViewDuplicateOptions("WithDetailing")
string = StringInput("Test")
duplicateView = View.DuplicateView(view=views, viewDuplicateOption=view_duplicate_options, prefix=string)
