# Dynamo graph HideCategoryTemporary.dyn (Dynamo 2.6.1.9130)

views = Views("{3D}")
categories = Categories("OST_Walls")
hideCategoriesTemporary = View.HideCategoriesTemporary(view=views, categories=categories)
isCategoryHidden = View.IsCategoryHidden(view=hideCategoriesTemporary, category=categories)
