# Dynamo graph HideElementTemporary.dyn (Dynamo 2.6.1.9130)

select_model_element = DSModelElementSelection()  # 1 picked in the model
views = Views("{3D}")
hideElementsTemporary = View.HideElementsTemporary(view=views, elements=select_model_element)
isHiddeninView = Element.IsHiddeninView(element=select_model_element, view=hideElementsTemporary)
