# Dynamo graph IsolateCategoriesTemporary.dyn (Dynamo 2.6.1.9130)

views = Views("{3D}")
categories = Categories("OST_Walls")
categories_2 = Categories("OST_Columns")
list_create = List.Create(item0=categories, item1=categories_2)
isolateCategoriesTemporary = View.IsolateCategoriesTemporary(view=views, categories=list_create)
