# Dynamo graph IsolateElementsTemporary.dyn (Dynamo 2.6.1.9130)

views = Views("{3D}")
select_model_elements = DSModelElementsSelection()  # 2 picked in the model
isolateElementsTemporary = View.IsolateElementsTemporary(view=views, elements=select_model_elements)
