# Dynamo graph OverrideElementColorInView.dyn (Dynamo 0.8.1.1441)

family_types = FamilyTypes("AC_panel:AC_panel")
all_elements_of_family_type = ElementsOfFamilyType(family_types)
number = DoubleInput(255)
count = List.Count(all_elements_of_family_type)
number_2 = DoubleInput(1..length, count, lacing=Longest)
number_3 = DoubleInput(1..length, count, lacing=Longest)
formula = Formula("(a/b)*c", a=number_3, b=count, c=number, lacing=Longest)
formula_2 = Formula("(a/b)*c", a=number_2, b=count, c=number, lacing=Longest)
byARGB = Color.ByARGB(a=number, r=number_2, g=formula, b=formula_2, lacing=Longest)
overrideColorInView = Element.OverrideColorInView(element=all_elements_of_family_type, color=byARGB, lacing=Longest)
