# Dynamo graph testViewScheduleFilters.dyn (Dynamo 1.2.1.3083)

categories = Categories("Walls")
code_block = CodeBlock { "Wall Schedule"; }
schedule_type = ScheduleTypes("RegularSchedule")
createSchedule = ScheduleView.CreateSchedule(category=categories, name=code_block, scheduleType=schedule_type)
schedulableFields = ScheduleView.SchedulableFields(createSchedule)
code_block_2 = CodeBlock(IN=schedulableFields) { mark = IN[33]; width = IN[41]; family = IN[2]; count = IN[0]; {family, mark, width, count}; }
addFields = ScheduleView.AddFields(scheduleView=createSchedule, fields=code_block_2.out4)
fields = ScheduleView.Fields(addFields)
code_block_3 = CodeBlock(IN=fields) { IN[2]; }
schedule_filter_type = ScheduleFilterType("GreaterThanOrEqual")
code_block_4 = CodeBlock { 10; }
convert_between_units = DynamoConvert(code_block_4, conversionMetric=Length, conversionFrom=Inches, conversionTo=Feet)
byFieldTypeAndValue = Revit.Schedules.ScheduleFilter.ByFieldTypeAndValue(field=code_block_3, filterType=schedule_filter_type, value=convert_between_units)
schedule_filter_type_2 = ScheduleFilterType("LessThanOrEqual")
code_block_5 = CodeBlock { 15; }
convert_between_units_2 = DynamoConvert(code_block_5, conversionMetric=Length, conversionFrom=Inches, conversionTo=Feet)
byFieldTypeAndValue_2 = Revit.Schedules.ScheduleFilter.ByFieldTypeAndValue(field=code_block_3, filterType=schedule_filter_type_2, value=convert_between_units_2)
create = List.Create(byFieldTypeAndValue, byFieldTypeAndValue_2)
addFilters = ScheduleView.AddFilters(scheduleView=addFields, scheduleFilters=create)
scheduleFilters = ScheduleView.ScheduleFilters(addFilters)
