# Dynamo graph CanGetSetViewportBoxCenter.dyn (Dynamo 2.6.1.8772)

select_model_element = DSModelElementSelection()  # 1 picked in the model
code_block = CodeBlock { 250; 500; }
byCoordinates = Point.ByCoordinates(x=code_block.out0, y=code_block.out1)
setBoxCenter = Viewport.SetBoxCenter(viewport=select_model_element, point=byCoordinates)
boxCenter = Viewport.BoxCenter(viewport=setBoxCenter)
