# Dynamo graph CanGetSetViewportLabelLineLength.dyn (Dynamo 2.10.1.3976)

select_model_element = DSModelElementSelection()  # 1 picked in the model
number = DoubleInput(1)
setLabelLineLength = Viewport.SetLabelLineLength(viewport=select_model_element, length=number)
labelLineLength = Viewport.LabelLineLength(viewport=setLabelLineLength)
