# Dynamo graph CanGetSetViewportLabelOffset.dyn (Dynamo 2.10.1.3976)

select_model_element = DSModelElementSelection()  # 1 picked in the model
code_block = CodeBlock { x=23; y=-10; }
byCoordinates = Point.ByCoordinates(x=code_block.x, y=code_block.y)
setLabelOffset = Viewport.SetLabelOffset(viewport=select_model_element, point=byCoordinates)
labelOffset = Viewport.LabelOffset(viewport=setLabelOffset)
