# Dynamo graph CanGetViewportProperties.dyn (Dynamo 2.6.1.8772)

select_model_element = DSModelElementSelection()  # 1 picked in the model
boxCenter = Viewport.BoxCenter(viewport=select_model_element)
boxOutline = Viewport.BoxOutline(viewport=select_model_element)
labelOutline = Viewport.LabelOutline(viewport=select_model_element)
sheet = Viewport.Sheet(viewport=select_model_element)
view = Viewport.View(viewport=select_model_element)
