# Dynamo graph CanResetLocationWhenCreate.dyn (Dynamo 2.6.1.8772)

sheets = Sheets("Unnamed")
views = Views("Level 0")
integer_slider = IntegerSlider(0, range=0..100 step 1)
byCoordinates = Point.ByCoordinates(x=integer_slider, y=integer_slider)
bySheetViewLocation = Viewport.BySheetViewLocation(sheet=sheets, view=views, location=byCoordinates)
name = Element.Name(element=bySheetViewLocation)
