# Dynamo graph canGetWallTypeProperties.dyn (Dynamo 2.6.0.7237)

select_model_element = DSModelElementSelection()  # 1 picked in the model
elementType = Element.ElementType(element=select_model_element)
kind = WallType.Kind(wallType=elementType)
width = WallType.Width(wallType=elementType)
function = WallType.Function(wallType=elementType)
name = WallType.Name(wallType=elementType)
