# Dynamo graph CanGetFailingElementsFromWarning.dyn (Dynamo 2.6.0.7237)

current = Document.Current()
getWarnings = Warning.GetWarnings(document=current)
getFailingElements = Warning.GetFailingElements(warning=getWarnings)
id = Element.Id(element=getFailingElements)
firstItem = List.FirstItem(list=id)
