# Dynamo graph CanGetWarningDescription.dyn (Dynamo 2.6.0.7237)

current = Document.Current()
getWarnings = Warning.GetWarnings(document=current)
description = Warning.Description(warning=getWarnings)
uniqueItems = List.UniqueItems(list=description)
