# Dynamo graph Panels_Nodes.dyn (Dynamo 0.8.1.1193)

code_block = CodeBlock { 15; 3; }
byCoordinates = Point.ByCoordinates(x=code_block.out0, y=code_block.out1)
origin = Point.Origin()
code_block_2 = CodeBlock { -8; -7; }
byCoordinates_2 = Point.ByCoordinates(x=code_block_2.out0, y=code_block_2.out1)
create = List.Create(byCoordinates, origin, byCoordinates_2)
byPoints = NurbsCurve.ByPoints(create)
code_block_3 = CodeBlock { 15; -1; 15; }
byCoordinates_3 = Point.ByCoordinates(x=code_block_3.out0, y=code_block_3.out1, z=code_block_3.out2)
code_block_4 = CodeBlock { 2; 3; 15; }
byCoordinates_4 = Point.ByCoordinates(x=code_block_4.out0, y=code_block_4.out1, z=code_block_4.out2)
code_block_5 = CodeBlock { -10; -7; 15; }
byCoordinates_5 = Point.ByCoordinates(x=code_block_5.out0, y=code_block_5.out1, z=code_block_5.out2)
create_2 = List.Create(byCoordinates_3, byCoordinates_4, byCoordinates_5)
byPoints_2 = NurbsCurve.ByPoints(create_2)
create_3 = List.Create(byPoints, byPoints_2)
byLoft = Surface.ByLoft(create_3)
integer_slider = IntegerSlider(25, range=0..40 step 1)
integer_slider_2 = IntegerSlider(20, range=0..40 step 1)
uv_quads_on_surface = Custom[UV Quads on Surface](surface=byLoft, u=integer_slider, v=integer_slider_2)  # Create groups of 4 points from a grid on a surface
family_types = FamilyTypes("quad:quad")
byPoints_3 = AdaptiveComponent.ByPoints(uv_quads_on_surface, family_types)
file_path = Filename("C:\Users\t_yanz\Documents\GitHub\DynamoRevit\test\System\Workflow\CodeBlocksReference\dynamoPanels.PNG")
fromPath = FileObject(file_path)  # "File.FromPath"
readFromFile = Image.ReadFromFile(fromPath)
code_block_6 = CodeBlock { 1; }
sub = integer_slider - code_block_6
sub_2 = integer_slider_2 - code_block_6
pixels = Image.Pixels(image=readFromFile, xSamples=sub, ySamples=sub_2)
code_block_7 = CodeBlock { 1; }
flatten = List.Flatten(list=pixels, amt=code_block_7)
overrideColorInView = Element.OverrideColorInView(element=byPoints_3, color=flatten)
