# Dynamo graph Panels2.dyn (Dynamo 0.8.1.1310)

code_block = CodeBlock { 15; 3; }
byCoordinates = Point.ByCoordinates(x=code_block.out0, y=code_block.out1)
origin = Point.Origin()
code_block_2 = CodeBlock { -8; -7; }
byCoordinates_2 = Point.ByCoordinates(x=code_block_2.out0, y=code_block_2.out1)
create = List.Create(byCoordinates, origin, byCoordinates_2)
byPoints = NurbsCurve.ByPoints(create)
code_block_3 = CodeBlock { 15; -1; 15; }
byCoordinates_3 = Point.ByCoordinates(x=code_block_3.out0, y=code_block_3.out1, z=code_block_3.out2)
code_block_4 = CodeBlock { 2; 3; 15; }
byCoordinates_4 = Point.ByCoordinates(x=code_block_4.out0, y=code_block_4.out1, z=code_block_4.out2)
code_block_5 = CodeBlock { -10; -7; 15; }
byCoordinates_5 = Point.ByCoordinates(x=code_block_5.out0, y=code_block_5.out1, z=code_block_5.out2)
create_2 = List.Create(byCoordinates_3, byCoordinates_4, byCoordinates_5)
byPoints_2 = NurbsCurve.ByPoints(create_2)
create_3 = List.Create(byPoints, byPoints_2)
byLoft = Surface.ByLoft(create_3)
integer_slider = IntegerSlider(25, range=0..40 step 1)
integer_slider_2 = IntegerSlider(20, range=0..40 step 1)
lunchbox_quad_grid_by_face = Custom[LunchBox Quad Grid by Face](Surface=byLoft, U=integer_slider, V=integer_slider_2)  # Create a quadrangular XYZ grid on a face. The face surface must have an untrimmed UV parameter space.
# note: This is to correct the funny structure of the list that comes out of the Lunchbox node.
firstItem = List.FirstItem(lunchbox_quad_grid_by_face.Panel_Pts)
family_types = FamilyTypes("quad:quad")
byPoints_3 = AdaptiveComponent.ByPoints(firstItem, family_types)
file_path = Filename("C:\Users\t_yanz\Documents\GitHub\DynamoRevit\test\System\Workflow\Definitions\black-and-white-photography1.jpg")
# note: Use these two nodes together to (1) set up a file watcher and (2) read the image.
fromPath = FileObject(file_path)  # "File.FromPath"
readFromFile = Image.ReadFromFile(fromPath)
pixels = Image.Pixels(image=readFromFile, xSamples=integer_slider, ySamples=integer_slider_2)
# note: Transpose the color list to match
# the order in which the panels were
# specified by the Lunchbox node.
transpose = List.Transpose(pixels)
reverse = List.Reverse()
# note: Reverse the columns of colors
# to match the Lunchbox node
# sampling order.
map = List.Map(list=transpose, f_x=reverse)
# note: Flatten the list to match
# the structure of the
# Lunchbox node.
flatten = Flatten(map)
overrideColorInView = Element.OverrideColorInView(element=byPoints_3, color=flatten)
