# Dynamo graph 01 Truss.dyn (Dynamo 0.8.1.1163)

# note: Exit dynamo nd reopen the file height of the node increase

integer_slider = IntegerSlider(11, range=0..100 step 1)
code_block = CodeBlock(x=integer_slider) { 0..#x..4; }
number = DoubleInput(0)
number_2 = DoubleInput(5)
byCoordinates = Point.ByCoordinates(x=code_block, y=number, z=number_2, lacing=Longest)
byBestFitThroughPoints = Line.ByBestFitThroughPoints(byCoordinates)
byCoordinates_2 = Point.ByCoordinates(x=code_block, y=number, z=number, lacing=Longest)
byBestFitThroughPoints_2 = Line.ByBestFitThroughPoints(byCoordinates_2)
byStartPointEndPoint = Line.ByStartPointEndPoint(startPoint=byCoordinates, endPoint=byCoordinates_2, lacing=Longest)
number_3 = DoubleInput(2)
number_4 = DoubleInput(1)
dropEveryNthItem = List.DropEveryNthItem(list=byCoordinates, n=number_3, offset=number_4)
number_5 = DoubleInput(2)
dropEveryNthItem_2 = List.DropEveryNthItem(list=byCoordinates_2, n=number_5, offset=number)
byStartPointEndPoint_2 = Line.ByStartPointEndPoint(startPoint=dropEveryNthItem, endPoint=dropEveryNthItem_2)
restOfItems = List.RestOfItems(dropEveryNthItem_2)
byStartPointEndPoint_3 = Line.ByStartPointEndPoint(startPoint=dropEveryNthItem, endPoint=restOfItems, lacing=Longest)
create_list = List.Create(byBestFitThroughPoints, byBestFitThroughPoints_2, byStartPointEndPoint, byStartPointEndPoint_2, byStartPointEndPoint_3)
flatten = Flatten(create_list)
byCurve = ModelCurve.ByCurve(flatten)
watch_3d = Watch3D(create_list)
levels = Levels("Level 1")
structural_framing_types = StructuralFramingTypes("W12X26")
beamByCurve = StructuralFraming.BeamByCurve(flatten, levels, structural_framing_types)
braceByCurve = StructuralFraming.BraceByCurve()
