# Dynamo graph 06 Read from CSV.dyn (Dynamo 0.7.4.3225)

# note: Browse to the file "eCAADe.csv"
file_path = Filename("C:\DynamoExamples\20140901 Colin's Workshop Files\01 Dynamo Basics\ecaade.csv")
importFromCSV = ImportFromCSV(file_path)
code_block = CodeBlock(ls=importFromCSV) { ls[0]; ls[1]; ls[2]; }
byCoordinates = Point.ByCoordinates(code_block.out0, code_block.out1, code_block.out2)
byPoints = NurbsCurve.ByPoints(byCoordinates)
