# Dynamo graph 01_StructuralFraming.dyn (Dynamo 0.8.1.1193)

# note: Select curve from Revit
# note: Run this graph the .RVT file in the Samples folder.
select_model_element = DSModelElementSelection()  # 1 picked in the model
curve = CurveElement.Curve(select_model_element)
integer_slider = IntegerSlider(9, range=2..10 step 1)
code_block = CodeBlock(x=integer_slider) { 0..1..#x; }
pointAtParameter = Curve.PointAtParameter(curve=curve, param=code_block, lacing=CrossProduct)
select_model_element_2 = DSModelElementSelection()  # 1 picked in the model
curve_2 = CurveElement.Curve(select_model_element_2)
pointAtParameter_2 = Curve.PointAtParameter(curve=curve_2, param=code_block)
byStartPointEndPoint = Line.ByStartPointEndPoint(startPoint=pointAtParameter, endPoint=pointAtParameter_2)
levels = Levels("Level 1")
structural_framing_types = StructuralFramingTypes("12 x 24")
braceByCurve = StructuralFraming.BraceByCurve(byStartPointEndPoint, levels, structural_framing_types)
