# Dynamo graph 02_Adaptive Component Placement 1.dyn (Dynamo 0.8.1.1193)

# note: Select curve from Revit
# note: Run this graph the .RVT file in the Samples folder.
select_model_element = DSModelElementSelection()  # 1 picked in the model
select_model_element_2 = DSModelElementSelection()  # 1 picked in the model
select_model_element_3 = DSModelElementSelection()  # 1 picked in the model
create_list = List.Create(select_model_element, select_model_element_2, select_model_element_3)
curve = CurveElement.Curve(create_list)
integer_slider = IntegerSlider(9, range=2..10 step 1)
code_block = CodeBlock(x=integer_slider) { 0..1..#x; }
pointAtParameter = Curve.PointAtParameter(curve=curve, param=code_block, lacing=CrossProduct)
transpose = Transpose(pointAtParameter)
family_types = FamilyTypes("3PointAC_SquareTruss:3PointAC_SquareTruss")
byPoints = AdaptiveComponent.ByPoints(transpose, family_types)
