# Dynamo graph 05_PlaceFamiliesByLevel_Set Parameters.dyn (Dynamo 0.8.1.1191)

family_types = FamilyTypes("Photovoltaic-Panel-SolarWorld-SunModule-(235-240):SunModule SW 245 Silver Mono - 10 Deg. Angle")
code_block = CodeBlock { -30; 30; 10; }
number_range = NumberRange(code_block.out0, code_block.out1, code_block.out2, lacing=Longest)
code_block_2 = CodeBlock { -30..-50..#3; }
byCoordinates = Point.ByCoordinates(x=number_range, y=code_block_2, lacing=CrossProduct)
flatten = Flatten(byCoordinates)
levels = Levels("Level 1 Living Rm.")
byPointAndLevel = FamilyInstance.ByPointAndLevel(family_types, flatten, levels)
string = StringInput("Mark")
number = DoubleInput(1)
count = Count(byPointAndLevel)
number_sequence = NumberSeq(number, count, number, lacing=Longest)
string_from_object = FromObject(number_sequence)
setParameterByName = Element.SetParameterByName(element=byPointAndLevel, parameterName=string, value=string_from_object)
