# Dynamo graph 05 Curvy surface structure From Revit.dyn (Dynamo 0.8.1.1323)

ZAxis = Vector.ZAxis()
code_block = CodeBlock()
# ---------- code_block.designscript (4 lines) ----------
p = Point.ByCoordinates(01,1,2);
p2 = Point.ByCoordinates(12,5,3);
p3 = Point.ByCoordinates(13,1,24);
p4 = Point.ByCoordinates(121,52,33);
# ----------------------------------------
byStartPointEndPoint = Line.ByStartPointEndPoint(startPoint=code_block.p, endPoint=code_block.p2)
byStartPointEndPoint_2 = Line.ByStartPointEndPoint(startPoint=code_block.p3, endPoint=code_block.p4)
create = List.Create(byStartPointEndPoint, byStartPointEndPoint_2)
byRuledLoft = Surface.ByRuledLoft(create)
code_block_2 = CodeBlock { 2; }
byIsoCurveOnSurface = Curve.ByIsoCurveOnSurface(baseSurface=byRuledLoft, parameter=code_block_2)
levels = Levels("Level 1")
structural_framing_types = StructuralFramingTypes("W12X26")
# note: Each truss as its own list item
beamByCurve = StructuralFraming.BeamByCurve(byIsoCurveOnSurface, levels, structural_framing_types)
number_of_trusses = IntegerSlider(4, range=0..20 step 1)
code_block_3 = CodeBlock(num=number_of_trusses) { 0; 0..1..#num; }
byIsoCurveOnSurface_2 = Curve.ByIsoCurveOnSurface(baseSurface=byRuledLoft, parameter=code_block_3.out1)
number_of_cells = IntegerSlider(6, range=0..20 step 1)
code_block_4 = CodeBlock(cells=number_of_cells) { 0; 0..1..#(cells+1); }
pointAtParameter = Curve.PointAtParameter(curve=byIsoCurveOnSurface_2, param=code_block_4.out1, lacing=CrossProduct)
byPoints = PolyCurve.ByPoints(points=pointAtParameter)
curves = PolyCurve.Curves(byPoints)
tangentAtParameter = Curve.TangentAtParameter(byIsoCurveOnSurface_2, code_block_4.out1, lacing=CrossProduct)
YAxis = Vector.YAxis()
cross = Vector.Cross(vector=tangentAtParameter, cross=YAxis)
height_of_trusses = DoubleSlider(5, range=0..15 step 0.01)
code_block_5 = CodeBlock(height=height_of_trusses) { -height; }
scale = Vector.Scale(vector=cross, scale_factor=code_block_5)
add = Point.Add(point=pointAtParameter, vectorToAdd=scale)
byStartPointEndPoint_3 = Line.ByStartPointEndPoint(startPoint=pointAtParameter, endPoint=add)
byPoints_2 = PolyCurve.ByPoints(points=add)
curves_2 = PolyCurve.Curves(byPoints_2)
code_block_6 = CodeBlock { 0; }
shiftIndices = List.ShiftIndices(amount=code_block_6)
map = List.Map(list=add, f_x=shiftIndices)
restOfItems = List.RestOfItems()
map_2 = List.Map(list=map, f_x=restOfItems)
byStartPointEndPoint_4 = Line.ByStartPointEndPoint(startPoint=pointAtParameter, endPoint=map_2)
create_2 = List.Create(curves, byStartPointEndPoint_3, curves_2, byStartPointEndPoint_4)
flatten = Flatten(create_2)
transpose = List.Transpose(create_2)
flatten_2 = Flatten()
map_3 = List.Map(list=transpose, f_x=flatten_2)
