# Dynamo graph 06 Curvy surface structure.dyn (Dynamo 0.8.1.1310)

amplitude = DoubleSlider(6.12, range=0..10 step 0.01)
code_block = CodeBlock(amplitude=amplitude)
# ---------- code_block.designscript (14 lines) ----------
// Make a surface
min = -20;
max = 20;

x = min..max..#9;
z1 = amplitude * Math.Sin((360/(max-min))*(x+min));
z2 = amplitude * Math.Sin((360/(max-min))*(x));

pts1 = Point.ByCoordinates(x,min,z1);
pts2 = Point.ByCoordinates(x,(min + (max-min)/2),z2);
pts3 = Point.ByCoordinates(x,max,z1);

crvs = NurbsCurve.ByPoints({pts1,pts2,pts3});
Surface.ByLoft(crvs);
# ----------------------------------------
number_of_trusses = IntegerSlider(4, range=0..20 step 1)
code_block_2 = CodeBlock(num=number_of_trusses) { 0; 0..1..#num; }
byIsoCurveOnSurface = Curve.ByIsoCurveOnSurface(baseSurface=code_block.out9, direction=code_block_2.out0, parameter=code_block_2.out1)
number_of_cells = IntegerSlider(6, range=0..20 step 1)
code_block_3 = CodeBlock(cells=number_of_cells) { 0; 0..1..#(cells+1); }
pointAtParameter = Curve.PointAtParameter(curve=byIsoCurveOnSurface, param=code_block_3.out1, lacing=CrossProduct)
byPoints = PolyCurve.ByPoints(points=pointAtParameter)
curves = PolyCurve.Curves(byPoints)
tangentAtParameter = Curve.TangentAtParameter(byIsoCurveOnSurface, code_block_3.out1, lacing=CrossProduct)
YAxis = Vector.YAxis()
cross = Vector.Cross(vector=tangentAtParameter, cross=YAxis)
height_of_trusses = DoubleSlider(5, range=0..15 step 0.01)
code_block_4 = CodeBlock(height=height_of_trusses) { -height; }
scale = Vector.Scale(vector=cross, scale_factor=code_block_4)
add = Point.Add(point=pointAtParameter, vectorToAdd=scale)
byStartPointEndPoint = Line.ByStartPointEndPoint(startPoint=pointAtParameter, endPoint=add)
byPoints_2 = PolyCurve.ByPoints(points=add)
curves_2 = PolyCurve.Curves(byPoints_2)
code_block_5 = CodeBlock { 0; }
shiftIndices = List.ShiftIndices(amount=code_block_5)
map = List.Map(list=add, f_x=shiftIndices)
restOfItems = List.RestOfItems()
map_2 = List.Map(list=map, f_x=restOfItems)
byStartPointEndPoint_2 = Line.ByStartPointEndPoint(startPoint=pointAtParameter, endPoint=map_2)
create = List.Create(curves, byStartPointEndPoint, curves_2, byStartPointEndPoint_2)
transpose = List.Transpose(create)
flatten = Flatten()
# note: Each truss as its own list item
map_3 = List.Map(list=transpose, f_x=flatten)
flatten_2 = Flatten(create)
levels = Levels("Level 1")
structural_framing_types = StructuralFramingTypes("W12X26")
beamByCurve = StructuralFraming.BeamByCurve(flatten_2, levels, structural_framing_types)
