# Dynamo graph PanelWall.dyn (Dynamo 0.8.1.1310)

number_slider = DoubleSlider(0, range=0..100 step 0.1)
code_block = CodeBlock { 10; }
byCoordinates = Point.ByCoordinates(x=number_slider, y=code_block)
code_block_2 = CodeBlock()
# ---------- code_block_2.designscript (14 lines) ----------
// Bottom curve
pts = {Point.ByCoordinates(0,0,0),
Point.ByCoordinates(7,2,0),
Point.ByCoordinates(20,-2,0)};

bottom = NurbsCurve.ByPoints(pts);

// Top curve
top = Line.ByStartPointEndPoint(
Point.ByCoordinates(0,0,12),
Point.ByCoordinates(20,0,12));

// Surface
Surface.ByLoft({bottom,top});
# ----------------------------------------
code_block_3 = CodeBlock { 10; 6; }
lunchbox_quad_grid_by_face = Custom[LunchBox Quad Grid by Face](Surface=code_block_2.out3, U=code_block_3.out0, V=code_block_3.out1)  # Create a quadrangular XYZ grid on a face. The face surface must have an untrimmed UV parameter space.
firstItem = List.FirstItem(lunchbox_quad_grid_by_face.Panel_Pts)
family_types = FamilyTypes("coloredGlassPanel:glue glass")
byPoints = AdaptiveComponent.ByPoints(firstItem, family_types)
code_block_4 = CodeBlock { "Radius"; }
file_path = Filename("C:\Users\t_yanz\Documents\GitHub\DynamoRevit\test\System\Workflow\PerforatedScreenByImage\gradient.jpg")
fromPath = FileObject(file_path)  # "File.FromPath"
readFromFile = Image.ReadFromFile(fromPath)
pixels = Image.Pixels(image=readFromFile, xSamples=code_block_3.out1, ySamples=code_block_3.out0)
brightness = Color.Brightness(pixels)
flatten = Flatten(brightness)
code_block_5 = CodeBlock { 0.1; 0.9; }
remapRange = Math.RemapRange(numbers=flatten, newMin=code_block_5.out0, newMax=code_block_5.out1)
setParameterByName = Element.SetParameterByName(element=byPoints, parameterName=code_block_4, value=remapRange)
