# Dynamo graph Perforations by image.dyn (Dynamo 0.8.1.1310)

number_slider = DoubleSlider(0, range=0..100 step 0.1)
code_block = CodeBlock { 10; }
byCoordinates = Point.ByCoordinates(x=number_slider, y=code_block)
code_block_2 = CodeBlock()
# ---------- code_block_2.designscript (5 lines) ----------
def SeriesAtHalfCells(num)
{
halfInc = (1/(2*(num+1)));
return = halfInc..(1-halfInc)..#num;
};
# ----------------------------------------
code_block_3 = CodeBlock()
# ---------- code_block_3.designscript (14 lines) ----------
// Bottom curve
pts = {Point.ByCoordinates(0,0,0),
Point.ByCoordinates(7,2,0),
Point.ByCoordinates(20,-2,0)};

bottom = NurbsCurve.ByPoints(pts);

// Top curve
top = Line.ByStartPointEndPoint(
Point.ByCoordinates(0,0,12),
Point.ByCoordinates(20,0,12));

// Surface
Surface.ByLoft({bottom,top});
# ----------------------------------------
integer_slider = IntegerSlider(20, range=1..40 step 1)
integer_slider_2 = IntegerSlider(10, range=1..40 step 1)
code_block_4 = CodeBlock(numX=integer_slider, numY=integer_slider_2) { SeriesAtHalfCells(numX); SeriesAtHalfCells(numY); }
pointAtParameter = Surface.PointAtParameter(surface=code_block_3.out3, u=code_block_4.out0, v=code_block_4.out1, lacing=CrossProduct)
normalAtParameter = Surface.NormalAtParameter(surface=code_block_3.out3, u=code_block_4.out0, v=code_block_4.out1, lacing=CrossProduct)
tangentAtUParameter = Surface.TangentAtUParameter(code_block_3.out3, code_block_4.out0, code_block_4.out1, lacing=CrossProduct)
byOriginNormalXAxis = Plane.ByOriginNormalXAxis(origin=pointAtParameter, normal=normalAtParameter, xAxis=tangentAtUParameter)
file_path = Filename("C:\Users\t_yanz\Documents\GitHub\DynamoRevit\test\System\Workflow\PerforatedScreenByImage\gradient.jpg")
fromPath = FileObject(file_path)  # "File.FromPath"
readFromFile = Image.ReadFromFile(fromPath)
pixels = Image.Pixels(image=readFromFile, xSamples=integer_slider, ySamples=integer_slider_2)
brightness = Color.Brightness(pixels)
reverse = List.Reverse(brightness)
transpose = List.Transpose(reverse)
code_block_5 = CodeBlock { 0.1; 0.5; }
remapRange = Math.RemapRange(numbers=transpose, newMin=code_block_5.out0, newMax=code_block_5.out1)
byPlaneRadius = Circle.ByPlaneRadius(plane=byOriginNormalXAxis, radius=remapRange)
translate = Geometry.Translate(geometry=byPlaneRadius, direction=normalAtParameter)
reverse_2 = Vector.Reverse(normalAtParameter)
code_block_6 = CodeBlock { 2; }
scale = Vector.Scale(vector=reverse_2, scale_factor=code_block_6)
extrudeAsSolid = Curve.ExtrudeAsSolid(curve=translate, direction=scale)
flatten = Flatten(extrudeAsSolid)
byUnion = Solid.ByUnion(flatten)
subtractFrom = Surface.SubtractFrom(surface=code_block_3.out3, trimmingEntity=byUnion)
byGeometries = ImportInstance.ByGeometries(subtractFrom)
