# Dynamo graph Revit API via Python.dyn (Dynamo 2.6.1.8727)

select_model_elements = DSModelElementsSelection()  # 2 picked in the model
include_openings = BoolSelector(true)
include_shadows = BoolSelector(true)
include_embedded_walls = BoolSelector(true)
include_shared_embedded_inserts = BoolSelector(true)
# note: Get Inserts
python_script = Python(IN[0]=select_model_elements, IN[1]=include_openings, IN[2]=include_shadows, IN[3]=include_embedded_walls, IN[4]=include_shared_embedded_inserts)  # CPython3
# ---------- python_script.python (23 lines) ----------
import clr

clr.AddReference('RevitAPI')
from Autodesk.Revit.DB import *

clr.AddReference("RevitServices")
import RevitServices
from RevitServices.Persistence import DocumentManager

doc = DocumentManager.Instance.CurrentDBDocument
items = UnwrapElement(IN[0])
incopenings = IN[1]
incshadows = IN[2]
incwalls = IN[3]
incshared = IN[4]
elementlist = list()

for item in items:
	itemlist = list()
	for insert in item.FindInserts(incopenings,incshadows,incwalls,incshared):
		itemlist.append(doc.GetElement(insert))
	elementlist.append(itemlist)
OUT = elementlist
# ----------------------------------------
watch = Watch(python_script)
select_model_elements_2 = DSModelElementsSelection()  # 2 picked in the model
# note: Get Host
python_script_2 = Python(IN[0]=select_model_elements_2)  # CPython3
# ---------- python_script_2.python (12 lines) ----------
import clr
clr.AddReference('RevitAPI')
from Autodesk.Revit.DB import *

faminsts = UnwrapElement(IN[0])
elementlist = list()
for item in faminsts:
	try:
		elementlist.append(item.Host)
	except:
		elementlist.append(list())
OUT = elementlist
# ----------------------------------------
watch_2 = Watch(python_script_2)
firstItem = List.FirstItem(list=select_model_elements)
python_script_3 = Python(IN[0]=firstItem)  # CPython3
# ---------- python_script_3.python (24 lines) ----------
import clr

item1=dir(IN[0])
item2=dir(UnwrapElement(IN[0]))

str1 = "AreJoined,BoundingBox,ByCurveAndHeight,ByCurveAndLevels,ByFace,Curves,Delete,Dispose,ElementCurveReferences,ElementFaceReferences,ElementType,Equals,Faces,Geometry,GetCategory,GetChildElements,GetHashCode,GetHostedElements,GetIntersectingElementsOfCategory,GetJoinedElements,GetLocation,GetMaterials,GetParameterValueByName,GetParentElement,GetType,Id,InternalElement,InternalElementId,InternalUniqueId,IsAlive,IsFrozen,IsPinned,JoinGeometry,MemberwiseClone,MoveByVector,Name,OverrideColorInView,OverrideInView,Parameters,ReferenceEquals,SafeInit,SetGeometryJoinOrder,SetLocation,SetParameterByName,SetPinnedStatus,Solids,Tessellate,ToString,UniqueId,UnjoinAllGeometry,UnjoinGeometry,__class__,__delattr__,__doc__,__enter__,__eq__,__exit__,__format__,__getattribute__,__hash__,__init__,__ne__,__new__,__reduce__,__reduce_ex__,__repr__,__setattr__,__sizeof__,__str__,__subclasshook__"
str2 = "ArePhasesModifiable,AssemblyInstanceId,BoundingBox,CanBeHidden,CanBeLocked,CanDeleteSubelement,CanHaveAnalyticalModel,CanHaveTypeAssigned,Category,ChangeTypeId,Create,CreatedPhaseId,CrossSection,CurtainGrid,DeleteEntity,DeleteSubelement,DeleteSubelements,DemolishedPhaseId,DesignOption,Dispose,Document,Equals,FindInserts,Flip,Flipped,Geometry,GetAnalyticalModel,GetAnalyticalModelId,GetChangeTypeAny,GetChangeTypeElementAddition,GetChangeTypeElementDeletion,GetChangeTypeGeometry,GetChangeTypeParameter,GetDependentElements,GetEntity,GetEntitySchemaGuids,GetExternalFileReference,GetExternalResourceReference,GetExternalResourceReferences,GetGeneratingElementIds,GetGeometryObjectFromReference,GetHashCode,GetMaterialArea,GetMaterialIds,GetMaterialVolume,GetMonitoredLinkElementIds,GetMonitoredLocalElementIds,GetOrderedParameters,GetParameterFormatOptions,GetParameters,GetPhaseStatus,GetStackedWallMemberIds,GetSubelements,GetType,GetTypeId,GetValidTypes,GroupId,HasPhases,Id,IsCreatedPhaseOrderValid,IsDemolishedPhaseOrderValid,IsExternalFileReference,IsHidden,IsMonitoringLinkElement,IsMonitoringLocalElement,IsPhaseCreatedValid,IsPhaseDemolishedValid,IsStackedWall,IsStackedWallMember,IsTransient,IsValidObject,IsValidType,IsWallCrossSectionValid,LevelId,Location,LookupParameter,MemberwiseClone,Name,Orientation,OwnerViewId,Parameter,Parameters,ParametersMap,Pinned,ReferenceEquals,RefersToExternalResourceReference,RefersToExternalResourceReferences,ReleaseUnmanagedResources,SetEntity,StackedWallOwnerId,StructuralUsage,ToString,UniqueId,VersionGuid,ViewSpecific,WallType,Width,WorksetId,__class__,__delattr__,__doc__,__enter__,__exit__,__format__,__getattribute__,__hash__,__init__,__new__,__reduce__,__reduce_ex__,__repr__,__setattr__,__sizeof__,__str__,__subclasshook__,getBoundingBox,setElementType"

list1 = str1.Split(",")
list2 = str2.Split(",")

isContained = True

for str in list1:
	if str not in item1:
		isContained = False
		break
if isContained:
	for str in list2:
		if str not in item2:
			isContained = False
			break

OUT = isContained
# ----------------------------------------
watch_3 = Watch(python_script_3)
