# Dynamo graph 03 Ellipse Tower v3.dyn (Dynamo 0.8.1.1193)

number_slider = DoubleSlider(50, range=0..100 step 0.1)
code_block = CodeBlock(height=number_slider) { Point.ByCoordinates(0,0,{0,30,height}); {10,8,12}; {20,12,17}; }
byOriginRadii = Ellipse.ByOriginRadii(code_block.out0, code_block.out1, code_block.out2)
byLoft = Surface.ByLoft(byOriginRadii)
code_block_2 = CodeBlock { 0; }
code_block_3 = CodeBlock()
# ---------- code_block_3.designscript (2 lines) ----------
// first floor height
8;
# ----------------------------------------
code_block_4 = CodeBlock(secondFloor=code_block_3, height=number_slider) { secondFloor..height..3.5; }
# note: Floor elevations
addItemToFront = List.AddItemToFront(item=code_block_2, list=code_block_4)
byCoordinates = Point.ByCoordinates(z=addItemToFront)
ZAxis = Vector.ZAxis()
byOriginNormal = Plane.ByOriginNormal(origin=byCoordinates, normal=ZAxis)
intersect = Geometry.Intersect(geometry=byLoft, other=byOriginNormal)
# note: Ellipses
flatten = Flatten(intersect)
code_block_5 = CodeBlock { 0..1..#40; }
pointAtParameter = Curve.PointAtParameter(curve=flatten, param=code_block_5, lacing=CrossProduct)
# note: Approximate curve by many-sided polygons
byPoints = PolyCurve.ByPoints(points=pointAtParameter)
floor_types = FloorTypes("LW Concrete on Metal Deck")
code_block_6 = CodeBlock { "G"; }
# note: Make levels
count = List.Count(addItemToFront)
code_block_7 = CodeBlock(numFloors=count) { 2..numFloors; }
string_from_object = FromObject(code_block_7)
addItemToFront_2 = List.AddItemToFront(item=code_block_6, list=string_from_object)
code_block_8 = CodeBlock { "Lvl "; }
concat = String.Concat(code_block_8)
map = List.Map(list=addItemToFront_2, f_x=concat)
byElevationAndName = Level.ByElevationAndName(addItemToFront, map)
byOutlineTypeAndLevel = Floor.ByOutlineTypeAndLevel(outline=byPoints, floorType=floor_types, level=byElevationAndName)
code_block_9 = CodeBlock { 10; 15; }
# note: Place panels in Revit
uv_quads_on_surface = Custom[UV Quads on Surface](surface=byLoft, u=code_block_9.out0, v=code_block_9.out1)  # Create groups of 4 points from a grid on a surface
family_types = FamilyTypes("deflectionPanel:deflectionPanel")
byPoints_2 = AdaptiveComponent.ByPoints(uv_quads_on_surface, family_types)
# note: Navigate to "rainbow colors" in the samples folder
file_path = Filename("C:\Users\t_yanz\Documents\GitHub\DynamoRevit\test\System\Workflow\RevitProject\rainbowColors.jpg")
fromPath = FileObject(file_path)  # "File.FromPath"
readFromFile = Image.ReadFromFile(fromPath)
pixels = Image.Pixels(image=readFromFile, xSamples=code_block_9.out0, ySamples=code_block_9.out1)
chop = List.Chop(pixels, code_block_9.out0)
transpose = List.Transpose(chop)
flatten_2 = Flatten(transpose)
overrideColorInView = Element.OverrideColorInView(element=byPoints_2, color=flatten_2)
fromPath_2 = FileObject(file_path)  # "File.FromPath"
readFromFile_2 = Image.ReadFromFile(fromPath_2)
pixels_2 = Image.Pixels(image=readFromFile_2, xSamples=code_block_9.out1, ySamples=code_block_9.out0)
chop_2 = List.Chop(pixels_2, code_block_9.out0)
transpose_2 = List.Transpose(chop_2)
flatten_3 = Flatten(transpose_2)
