# Dynamo graph Vignette-02-Adaptive-Families-Mult.dyn (Dynamo 0.8.0.950)

# note: Origin Plane
# note: Note: Notice in the bottom left of the interface, the "Manual" option is checked.  Since we are generating Revit elements, the solver will be slow with each run.  Now that we're in 'Manual' mode, remember to hit the 'Run' button to see an update.
XY = Plane.XY()
# note: Width
code_block = CodeBlock { 100; }
# note: Length
code_block_2 = CodeBlock { 200; }
# note: Create Ground Rectangle
byWidthHeight = Rectangle.ByWidthHeight(XY, code_block, code_block_2)
# note: Extract points from rectangle.
points = Polygon.Points(byWidthHeight)
# note: Height
code_block_3 = CodeBlock { 80; }
# note: Offset Plane for Roof Level
offset = Plane.Offset(XY, code_block_3)
# note: Create Roof Rectangle
byWidthHeight_2 = Rectangle.ByWidthHeight(offset, code_block, code_block_2)
points_2 = Polygon.Points(byWidthHeight_2)
# note: Merge lists and flatten, in order with Adaptive Component setup.
create = List.Create(points, points_2)
flatten = Flatten(create)
# note: # of modules (X)
integer_slider = IntegerSlider(3, range=1..3 step 1)
# note: Shorthand for creating series [0,1,2...]
code_block_4 = CodeBlock(x=integer_slider) { 0..(x-1)..1; }
# note: Multiply width by series from code block.
mul = code_block * code_block_4
# note: # of modules (Y)
integer_slider_2 = IntegerSlider(3, range=1..3 step 1)
code_block_5 = CodeBlock(x=integer_slider_2) { 0..(x-1)..1; }
# note: Multiply length by series from code block.
mul_2 = code_block_2 * code_block_5
# note: Copy Geometry according to grid parameters.
translate = Geometry.Translate(geometry=flatten, xTranslation=mul, yTranslation=mul_2, lacing=CrossProduct)
flatten_2 = Flatten()
# note: List operations to make data structure aligned with adaptive points.  Each list in the structure has 8 points, representing one adaptive component.
map = List.Map(list=translate, f_x=flatten_2)
transpose = List.Transpose(map)
# note: Select Family Type to create adaptive component.
family_types = FamilyTypes("BLDG-COMPONENT-STRUCTURE-FULLYADAPTIVE:BLDG-COMPONENT-STRUCTURE-FULLYADAPTIVE")
# note: Create Adaptive component from points.
byPoints = AdaptiveComponent.ByPoints(transpose, family_types)
