# Dynamo graph Vignette-02-Adaptive-Family.dyn (Dynamo 0.8.0.950)

# note: Origin Plane
# note: Note: Notice in the bottom left of the interface, the "Manual" option is checked.  Since we are generating Revit elements, the solver will be slow with each run.  Now that we're in 'Manual' mode, remember to hit the 'Run' button to see an update.
XY = Plane.XY()
# note: Width
code_block = CodeBlock { 100; }
# note: Length
code_block_2 = CodeBlock { 200; }
# note: Create Ground Rectangle
byWidthHeight = Rectangle.ByWidthHeight(XY, code_block, code_block_2)
# note: Extract points from rectangle.
points = Polygon.Points(byWidthHeight)
# note: Height
code_block_3 = CodeBlock { 80; }
# note: Offset Plane for Roof Level
offset = Plane.Offset(XY, code_block_3)
# note: Create Roof Rectangle
byWidthHeight_2 = Rectangle.ByWidthHeight(offset, code_block, code_block_2)
points_2 = Polygon.Points(byWidthHeight_2)
# note: Merge lists and flatten, in order with Adaptive Component setup.
create = List.Create(points, points_2)
flatten = Flatten(create)
# note: Select Family Type to create adaptive component.
family_types = FamilyTypes("BLDG-COMPONENT-STRUCTURE-FULLYADAPTIVE:BLDG-COMPONENT-STRUCTURE-FULLYADAPTIVE")
# note: Create Adaptive component from points.
byPoints = AdaptiveComponent.ByPoints(flatten, family_types)
