# Dynamo graph Vignette-04-Attractors.dyn (Dynamo 0.8.2.2010)

# note: Select Family Type: ROOF-PANEL-4PT
family_types = FamilyTypes("ROOF-PANEL-4PT:ROOF-PANEL-4PT")
# note: Select all elements of specified type
all_elements_of_family_type = ElementsOfFamilyType(family_types)
watch = Watch(all_elements_of_family_type)
code_block = CodeBlock { "Aperture Ratio"; }
# note: Retrieve adaptive points of adaptive components
locations = AdaptiveComponent.Locations(all_elements_of_family_type)
code_block_2 = CodeBlock { 0; }
getItemAtIndex = List.GetItemAtIndex(index=code_block_2)
# note: Get the first adaptive point of each adaptive component.
map = List.Map(list=locations, f_x=getItemAtIndex)
# note: Get the last adaptive component point to use as an attractor.
lastItem = List.LastItem(map)
# note: Compare distance of the last adaptive point with all of the others
distanceTo = Geometry.DistanceTo(geometry=map, other=lastItem)
code_block_3 = CodeBlock { 0.15; 0.45; }
# note: Remap distances to a suitable aperture range for ETFE
remapRange = Math.RemapRange(numbers=distanceTo, newMin=code_block_3.out0, newMax=code_block_3.out1)
# note: Set Aperture Ratio Parameter.  The element input port should connect to the output port of "All Element of Family Type"
setParameterByName = Element.SetParameterByName(element=all_elements_of_family_type, parameterName=code_block, value=remapRange)
