# Dynamo graph Vignette-04-Deviation.dyn (Dynamo 0.8.2.2010)

# note: Choose family type to select.
family_types = FamilyTypes("ETFE-PILLOW-SIMPLE:ETFE-PILLOW-SIMPLE")
# note: Select all elements of that family type
all_elements_of_family_type = ElementsOfFamilyType(family_types)
code_block = CodeBlock { 255; 0; }
byARGB = Color.ByARGB(r=code_block.out1, g=code_block.out0, b=code_block.out0)
# note: Define two colors for color range.
code_block_2 = CodeBlock { 255; 0; }
byARGB_2 = Color.ByARGB(r=code_block_2.out0, g=code_block_2.out1, b=code_block_2.out1)
create = List.Create(byARGB, byARGB_2)
# note: Convert to Dynamo Geometry.
faces = Element.Faces(all_elements_of_family_type)
perimeterCurves = Surface.PerimeterCurves(faces)
# note: Extract adaptive points from nested adaptive component.
startPoint = Curve.StartPoint(perimeterCurves)
byPoints = Polygon.ByPoints(startPoint)
# note: After converting to polygon, evaluate for planar deviation.
planeDeviation = Polygon.PlaneDeviation(byPoints)
flatten = Flatten(planeDeviation)
code_block_3 = CodeBlock { 0; 1; }
# note: Use code block to define write to file inputs.
# note: Remap to color range domain of 0-1.
remapRange = Math.RemapRange(numbers=flatten, newMin=code_block_3.out0, newMax=code_block_3.out1)
# note: Translate number values into colors along gradient.
color_range = ColorRange(create, remapRange, remapRange)
# note: Override colors in 3D view based on analysis.
overrideColorInView = Element.OverrideColorInView(element=all_elements_of_family_type, color=color_range)
# note: Be sure this filePath is updated for your local path before connecting to Excel.WriteToFile.
file_path = Filename("C:\Users\Erick\Google Drive\EDUCATION\DYNAMO STUDIO RESELLER DEMO\ASSETS\Vignettes\04\Datasets\PanelAnalysis.xlsx")
code_block_4 = CodeBlock(y=flatten) { "Deviation"; 2; 0; y; }
writeToFile = Excel.WriteToFile(sheetName=code_block_4.out0, startRow=code_block_4.out1, startCol=code_block_4.out2, data=code_block_4.y)
