# Dynamo graph Vignette-04-Solar.dyn (Dynamo 0.8.2.2010)

# note: Choose family type to select.
family_types = FamilyTypes("ETFE-PILLOW-SIMPLE:ETFE-PILLOW-SIMPLE")
# note: Select all elements of that family type
all_elements_of_family_type = ElementsOfFamilyType(family_types)
# note: Convert to Dynamo Geometry.
# note: Deviation values
faces = Element.Faces(all_elements_of_family_type)
perimeterCurves = Surface.PerimeterCurves(faces)
# note: Extract adaptive points from nested adaptive component.
startPoint = Curve.StartPoint(perimeterCurves)
byPoints = Polygon.ByPoints(startPoint)
# note: After converting to polygon, evaluate for planar deviation.
planeDeviation = Polygon.PlaneDeviation(byPoints)
# note: Define two colors for color range.
code_block = CodeBlock { 255; 0; }
byARGB = Color.ByARGB(r=code_block.out0, g=code_block.out1, b=code_block.out1)
code_block_2 = CodeBlock { {0,1}; }
# note: Translate number values into colors along gradient.
color_range = ColorRange(byARGB, code_block_2, code_block_2)
# note: Override colors in 3D view based on analysis.
overrideColorInView = Element.OverrideColorInView(element=all_elements_of_family_type, color=color_range)
# note: Solar values
faces_2 = Element.Faces(all_elements_of_family_type)
perimeterCurves_2 = Surface.PerimeterCurves(faces_2)
startPoint_2 = Curve.StartPoint(perimeterCurves_2)
# note: Find perpendicular vector to roof panels.
byBestFitThroughPoints = Plane.ByBestFitThroughPoints(startPoint_2)
# note: Compare how parallel two vectors are. This is what we use to test solar orientation.
normal = Plane.Normal(byBestFitThroughPoints)
current = SunSettings()  # "SunSettings.Current"
sunDirection = SunSettings.SunDirection(current)
dot = Vector.Dot(normal, sunDirection)
# note: Take absolute value in case planes are pointing in the other direction.
abs = Math.Abs(dot)
flatten = Flatten(abs)
code_block_3 = CodeBlock { 0; 1; }
# note: Use code block to define write to file inputs.
# note: Remap to color range domain of 0-1.
remapRange = Math.RemapRange(numbers=flatten, newMin=code_block_3.out0, newMax=code_block_3.out1)
code_block_4 = CodeBlock { 255; 0; }
byARGB_2 = Color.ByARGB(r=code_block_4.out1, g=code_block_4.out0, b=code_block_4.out0)
# note: Be sure this filePath is updated for your local path before connecting to Excel.WriteToFile.
file_path = Filename("C:\Users\Erick\Google Drive\EDUCATION\DYNAMO STUDIO RESELLER DEMO\ASSETS\Vignettes\04\Datasets\PanelAnalysis.xlsx")
code_block_5 = CodeBlock(y=flatten) { "Solar Orientation"; 2; 0; y; }
writeToFile = Excel.WriteToFile(sheetName=code_block_5.out0, startRow=code_block_5.out1, startCol=code_block_5.out2, data=code_block_5.y)
