# Dynamo graph WorkFlow_test01.dyn (Dynamo 0.8.1.1191)

code_block = CodeBlock { 1; }
byCoordinates = Point.ByCoordinates(x=code_block)
code_block_2 = CodeBlock { 10; }
byCoordinates_2 = Point.ByCoordinates(x=code_block_2)
byStartPointEndPoint = Line.ByStartPointEndPoint(startPoint=byCoordinates, endPoint=byCoordinates_2)
code_block_3 = CodeBlock { 1..10..3; }
byElevation = Level.ByElevation(code_block_3)
wall_types = WallTypes("Curtain Wall 1")
byCurveAndHeight = Wall.ByCurveAndHeight(curve=byStartPointEndPoint, height=code_block_3, level=byElevation, wallType=wall_types)
