# Dynamo graph XYZByPolar.dyn (Dynamo 0.8.1.1441)

identity = CoordinateSystem.Identity()
piTimes2 = Math.PiTimes2()
number = DoubleInput(0..PI..0.1, piTimes2, lacing=Longest)
radiansToDegrees = Math.RadiansToDegrees(number)
number_2 = DoubleInput(10)
number_3 = DoubleInput(2)
byCylindricalCoordinates = Point.ByCylindricalCoordinates(identity, radiansToDegrees, number_2, number_3, lacing=Longest)
