# Dynamo graph XYZBySphericalCoordinates.dyn (Dynamo 0.8.1.1441)

identity = CoordinateSystem.Identity()
PI = Math.PI()
number = DoubleInput(0..PI..0.1, PI, lacing=Longest)
radiansToDegrees = Math.RadiansToDegrees(number)
piTimes2 = Math.PiTimes2()
number_slider = DoubleSlider(0.2258992806, range=0..6.28 step 0.1)
number_2 = DoubleInput(0..PI..x, piTimes2, number_slider, lacing=Longest)
radiansToDegrees_2 = Math.RadiansToDegrees(number_2)
number_3 = DoubleInput(2)
bySphericalCoordinates = Point.BySphericalCoordinates(identity, radiansToDegrees, radiansToDegrees_2, number_3, lacing=CrossProduct)
watch_3d = Watch3D(bySphericalCoordinates)
