# Dynamo graph XYZToPolarCoordinates.dyn (Dynamo 0.8.1.1441)

identity = CoordinateSystem.Identity()
number = DoubleInput(1.2)
radiansToDegrees = Math.RadiansToDegrees(number)
number_2 = DoubleInput(3)
number_3 = DoubleInput(2)
byCylindricalCoordinates = Point.ByCylindricalCoordinates(identity, radiansToDegrees, number_2, number_3, lacing=Longest)
xyz_to_polar_coordinates = CodeBlock(p=byCylindricalCoordinates)
# ---------- xyz_to_polar_coordinates.designscript (4 lines) ----------
radius = Math.Sqrt(p.X*p.X + p.Y*p.Y);
rotation = Math.DegreesToRadians
(Math.Atan(p.Y/p.X));
offset = p.Z;
# ----------------------------------------
