# Dynamo graph XYZToSphericalCoordinates.dyn (Dynamo 0.8.1.1441)

identity = CoordinateSystem.Identity()
identity_2 = CoordinateSystem.Identity()
number = DoubleInput(1)
radiansToDegrees = Math.RadiansToDegrees(number)
number_2 = DoubleInput(1.2)
radiansToDegrees_2 = Math.RadiansToDegrees(number_2)
number_3 = DoubleInput(2)
bySphericalCoordinates = Point.BySphericalCoordinates(identity_2, radiansToDegrees, radiansToDegrees_2, number_3, lacing=Longest)
xyz_to_spherical_coordinates = CodeBlock(p=bySphericalCoordinates)
# ---------- xyz_to_spherical_coordinates.designscript (6 lines) ----------
radius = Math.Sqrt(p.X*p.X + p.Y*p.Y + p.Z*p.Z);
xyrotation = (p.X == 0 && p.Y == 0) ? 0 : (p.X == 0) ?
((p.Y > 0) ? Math.PI/2 : Math.PI*3/2)
: Math.DegreesToRadians(Math.Atan(p.Y/p.X));
zrotation = (p.X == 0 && p.Y == 0) ? ((p.Z > 0) ? 0 : Math.PI) :
Math.DegreesToRadians(Math.Acos(p.Z / radius));
# ----------------------------------------
radiansToDegrees_3 = Math.RadiansToDegrees(xyz_to_spherical_coordinates.zrotation)
radiansToDegrees_4 = Math.RadiansToDegrees(xyz_to_spherical_coordinates.xyrotation)
bySphericalCoordinates_2 = Point.BySphericalCoordinates(identity, radiansToDegrees_3, radiansToDegrees_4, xyz_to_spherical_coordinates.radius, lacing=Longest)
